# Grasshopper definition ParametricRoom-RC-V1.gh (Grasshopper 1.0.7)
# plug-ins: ShapeDiverForGrasshopper, PW_AI

mbox = MeshBox(
    Base={Plane=PlaneXY(100000000, 100000000, 100000000), X=Domain(-2, 2), Y=Domain(-0.5, 0.5), Z=Domain(0, 0.25)},
    XCount=1,
    YCount=1,
    ZCount=1)
footprint = Curve(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)
int_walls = Curve(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)
wwr_1 = BooleanToggle(True)
sddp = ShapeDiverDocumentPayload({AbsoluteTolerance=0, AngleTolerance=0, DistanceDisplayPrecision=0, GltfVersion="Gltf2", InputGroups="{}", OutputGroups="{}", RelativeTolerance=0, UnitSystem=0, VersionCreated="1.13.1.0", VersionSaved="1.13.1.0"})
wwr_2 = BooleanToggle(True)
wwr_3 = BooleanToggle(True)
wwr_4 = BooleanToggle(True)
wwr = Slider(0.5, range=0..1)
vertical_fin_onoff = BooleanToggle(True)
vertical_fin_count = Slider(2, range=1..10)
vertical_fin_depth = Slider(0.5, range=0..5)
horizontal_fin_onoff = BooleanToggle(True)
horizontal_fin_count = Slider(2, range=1..10)
horizontal_fin_depth = Slider(1.3, range=0..5)
terrain = Slider(0, range=0..2)
heat_capacity = Slider(0, range=0..2)
heat_source = Slider(0, range=0..2)
hot_water_source = Slider(0, range=0..2)
building_height = Slider(3.5, range=0..10)
building_type = Slider(0, range=0..6)
ceiling_reflectance = Slider(0.7, range=0..1)
floor_reflectance = Slider(0.2, range=0..1)
wall_reflectance = Slider(0.4, range=0..1)
glazing_reflectance = Slider(0.3, range=0..1)
wall_r_value = Slider(20, range=0..100)
roof_r_value = Slider(20, range=0..100)
window_u_value = Slider(20, range=0..100)
window_shgc = Slider(20, range=0..100)
sensor_grid_size = Slider(2, range=0..2)
weather_file = Text("C:\Users\Asus\Desktop\EPW\CAN_BC_Vancouver.Harbour.CS.712010_TMYx.2004-2018\CAN_BC_Vancouver.Harbour.CS.712010_TMYx.2004-2018.epw")

# ---- group: UnitConvertor to Meters
c_script = CSharpScript()  # -> out, A
# ---------- c_script: C# ----------
    Rhino.RhinoDoc.ActiveDoc.AdjustModelUnitSystem(UnitSystem.Meters, false);
# ---------- end c_script ----------

# ----
int_walls_2 = GetGeometry(int_walls, AtLeast=1, AtMost=1, DeleteInput=False, Filter=1074004029, TreeAccess=False)
context = GetGeometry(mbox, AtLeast=1, AtMost=1, DeleteInput=False, Filter=1074004029, TreeAccess=False)
selected_walls = GetBoolean([wwr_1, wwr_2, wwr_3, wwr_4], AtLeast=1, AtMost=1, FalseValue="False", TreeAccess=False, TrueValue="True")
wwr_5 = GetNumber(wwr, AtLeast=1, AtMost=1, Maximum=1.797693135e+308, Minimum=-1.797693135e+308, TreeAccess=False)
vertical_fin_onoff_2 = GetBoolean(vertical_fin_onoff, AtLeast=1, AtMost=1, FalseValue="False", TreeAccess=False, TrueValue="True")
vertical_fin_count_2 = GetInteger(vertical_fin_count, AtLeast=1, AtMost=1, Maximum=2147483647, Minimum=-2147483648, TreeAccess=False)
vertical_fin_depth_2 = GetNumber(vertical_fin_depth, AtLeast=1, AtMost=1, Maximum=1.797693135e+308, Minimum=-1.797693135e+308, TreeAccess=False)
horizontal_fin_onoff_2 = GetBoolean(horizontal_fin_onoff, AtLeast=1, AtMost=1, FalseValue="False", TreeAccess=False, TrueValue="True")
horizontal_fin_count_2 = GetInteger(horizontal_fin_count, AtLeast=1, AtMost=1, Maximum=2147483647, Minimum=-2147483648, TreeAccess=False)
horizontal_fin_depth_2 = GetNumber(horizontal_fin_depth, AtLeast=1, AtMost=1, Maximum=1.797693135e+308, Minimum=-1.797693135e+308, TreeAccess=False)
terrain_2 = GetInteger(terrain, AtLeast=1, AtMost=1, Maximum=2147483647, Minimum=-2147483648, TreeAccess=False)
heat_capacity_2 = GetInteger(heat_capacity, AtLeast=1, AtMost=1, Maximum=2147483647, Minimum=-2147483648, TreeAccess=False)
heat_source_2 = GetInteger(heat_source, AtLeast=1, AtMost=1, Maximum=2147483647, Minimum=-2147483648, TreeAccess=False)
hot_water_source_2 = GetNumber(hot_water_source, AtLeast=1, AtMost=1, Maximum=1.797693135e+308, Minimum=-1.797693135e+308, TreeAccess=False)
building_height_2 = GetNumber(building_height, AtLeast=1, AtMost=1, Maximum=1.797693135e+308, Minimum=-1.797693135e+308, TreeAccess=False)
building_type_2 = GetInteger(building_type, AtLeast=1, AtMost=1, Maximum=2147483647, Minimum=-2147483648, TreeAccess=False)
ceiling_reflectance_2 = GetNumber(ceiling_reflectance, AtLeast=1, AtMost=1, Maximum=1.797693135e+308, Minimum=-1.797693135e+308, TreeAccess=False)
floor_reflectance_2 = GetNumber(floor_reflectance, AtLeast=1, AtMost=1, Maximum=1.797693135e+308, Minimum=-1.797693135e+308, TreeAccess=False)
wall_reflectance_2 = GetNumber(wall_reflectance, AtLeast=1, AtMost=1, Maximum=1.797693135e+308, Minimum=-1.797693135e+308, TreeAccess=False)
glazing_reflectance_2 = GetNumber(glazing_reflectance, AtLeast=1, AtMost=1, Maximum=1.797693135e+308, Minimum=-1.797693135e+308, TreeAccess=False)
wall_r_value_2 = GetNumber(wall_r_value, AtLeast=1, AtMost=1, Maximum=1.797693135e+308, Minimum=-1.797693135e+308, TreeAccess=False)
roof_r_value_2 = GetNumber(roof_r_value, AtLeast=1, AtMost=1, Maximum=1.797693135e+308, Minimum=-1.797693135e+308, TreeAccess=False)
window_u_value_2 = GetNumber(window_u_value, AtLeast=1, AtMost=1, Maximum=1.797693135e+308, Minimum=-1.797693135e+308, TreeAccess=False)
window_shgc_2 = GetNumber(window_shgc, AtLeast=1, AtMost=1, Maximum=1.797693135e+308, Minimum=-1.797693135e+308, TreeAccess=False)
footprint_2 = GetGeometry(footprint, AtLeast=1, AtMost=1, DeleteInput=False, Filter=1074004029, TreeAccess=False)
sensor_grid_size_2 = GetNumber(sensor_grid_size, AtLeast=1, AtMost=1, Maximum=1.797693135e+308, Minimum=-1.797693135e+308, TreeAccess=False)
weather_file_2 = GetFilePath(weather_file, AtLeast=1, AtMost=1, TreeAccess=False)
num = Number([0.6096, 1.2192, 1.8288])
floor_type = Slider(0, range=0..6)
item = ListItem(List=num, Index=sensor_grid_size_2, Wrap=True)
c_script_2 = CSharpScript(
    footprint=footprint_2,
    interiorWalls=int_walls_2,
    selectedWalls=selected_walls,
    WWR=wwr_5,
    verticalFnOnOff=vertical_fin_onoff_2,
    verticalFnCnt=vertical_fin_count_2,
    verticalFnDp=vertical_fin_depth_2,
    horizontalFnOnOff=horizontal_fin_onoff_2,
    horizontalFnCnt=horizontal_fin_count_2,
    horizontalFnDp=horizontal_fin_depth_2,
    terrain=terrain_2,
    heatCapacity=heat_capacity_2,
    heatingSource=heat_source_2,
    hotWaterSource=hot_water_source_2,
    height=building_height_2,
    floorProgram=building_type_2,
    floorType=floor_type,
    ceilingReflectance=ceiling_reflectance_2,
    floorReflectance=floor_reflectance_2,
    wallReflectance=wall_reflectance_2,
    glazingReflectance=glazing_reflectance_2,
    wallRValue=wall_r_value_2,
    roofRValue=roof_r_value_2,
    groundRValue=Slider(20, range=0..100),
    winUValue=window_u_value_2,
    winSHGC=window_shgc_2)  # -> out, ZoneOutline, SurfaceFloor, MeshFloor, MeshCeiling, MeshExteriorWalls, MeshVerticalFins, MeshHorizontalFins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; inputs footprint: Curve, interiorWalls: list of Curve, selectedWalls: list of Boolean, WWR: Double, verticalFnOnOff: Double, verticalFnCnt: Int32, verticalFnDp: Double, horizontalFnOnOff: Double, horizontalFnCnt: Int32, horizontalFnDp: Double, terrain: String, heatCapacity: String, heatingSource: String, hotWaterSource: String, height: Double, floorProgram: Double, floorType: Double, ceilingReflectance: Double, floorReflectance: Double, wallReflectance: Double, glazingReflectance: Double, wallRValue: Double, roofRValue: Double, groundRValue: Double, winUValue: Double, winSHGC: Double
# ---------- c_script_2: C# ----------
    if(footprint == null || !footprint.IsClosed )return;


    ///////////////////////Generating data

    if(wallcount != selectedWalls.Count ){
      allData.Clear();
      allCurves.Clear();

      for(int i = 0 ;i < selectedWalls.Count ;i++){

        allData.Add("0", new GH_Path(2));
        allData.Add("0", new GH_Path(3));
        allData.Add("0", new GH_Path(4));
        allData.Add("0", new GH_Path(5));
        allData.Add("0", new GH_Path(6));
        allData.Add("0", new GH_Path(7));
        allData.Add("0", new GH_Path(8));
        if(i == 0){
          allCurves.Add(footprint, new GH_Path(0));
          allCurves.AddRange(interiorWalls, new GH_Path(1));

          allData.Add(terrain.ToString(), new GH_Path(9));
          allData.Add(heatCapacity.ToString(), new GH_Path(10));
          allData.Add(heatingSource.ToString(), new GH_Path(11));
          allData.Add(hotWaterSource.ToString(), new GH_Path(12));

          allData.Add(height.ToString(), new GH_Path(13));
          allData.Add(floorProgram.ToString(), new GH_Path(14));
          allData.Add(floorType.ToString(), new GH_Path(15));
          allData.Add(ceilingReflectance.ToString(), new GH_Path(16));
          allData.Add(floorReflectance.ToString(), new GH_Path(17));
          allData.Add(wallReflectance.ToString(), new GH_Path(18));
          allData.Add(glazingReflectance.ToString(), new GH_Path(19));
          allData.Add(wallRValue.ToString(), new GH_Path(20));
          allData.Add(roofRValue.ToString(), new GH_Path(21));
          allData.Add(winUValue.ToString(), new GH_Path(22));
          allData.Add(winSHGC.ToString(), new GH_Path(23));
        }
      }
    }


    wallcount = selectedWalls.Count;



    for(int i = 0 ;i < selectedWalls.Count ;i++){

      allCurves[new GH_Path(0), 0] = footprint;

      allCurves.RemovePath(new GH_Path(1));
      allCurves.AddRange(interiorWalls, new GH_Path(1));

      if(selectedWalls[i]){
        allData[new GH_Path(2), i] = WWR.ToString();
        allData[new GH_Path(3), i] = verticalFnOnOff.ToString();
        allData[new GH_Path(4), i] = verticalFnCnt.ToString();
        allData[new GH_Path(5), i] = verticalFnDp.ToString();
        allData[new GH_Path(6), i] = horizontalFnOnOff.ToString();
        allData[new GH_Path(7), i] = horizontalFnCnt.ToString();
        allData[new GH_Path(8), i] = horizontalFnDp.ToString();
      }

      allData[new GH_Path(9), 0] = terrain.ToString();
      allData[new GH_Path(10), 0] = heatCapacity.ToString();
      allData[new GH_Path(11), 0] = heatingSource.ToString();
      allData[new GH_Path(12), 0] = hotWaterSource.ToString();

      allData[new GH_Path(13), 0] = height.ToString();
      allData[new GH_Path(14), 0] = floorProgram.ToString();
      allData[new GH_Path(15), 0] = floorType.ToString();
      allData[new GH_Path(16), 0] = ceilingReflectance.ToString();
      allData[new GH_Path(17), 0] = floorReflectance.ToString();
      allData[new GH_Path(18), 0] = wallReflectance.ToString();
      allData[new GH_Path(19), 0] = glazingReflectance.ToString();
      allData[new GH_Path(20), 0] = wallRValue.ToString();
      allData[new GH_Path(21), 0] = roofRValue.ToString();
      allData[new GH_Path(22), 0] = winUValue.ToString();
      allData[new GH_Path(23), 0] = winSHGC.ToString();
    }



    /////////////////////Generating Frames and fins

    List<Curve> AllClosedCurves = new List<Curve> ();
    AllClosedCurves.Add(allCurves[new GH_Path(0), 0]);
    foreach(Curve c in interiorWalls){
      if(c.IsClosed){
        List<Point3d> cornerPoints = new List<Point3d> ();
        cornerPoints.AddRange(c.ToNurbsCurve().GrevillePoints());
        foreach(Point3d pt in cornerPoints){
          if(footprint.Contains(pt, Plane.WorldXY, 0.01) == Rhino.Geometry.PointContainment.Inside){
            AllClosedCurves.Add(c);
          }
        }
      }
    }

    Brep FloorBrep = Brep.CreatePlanarBreps(AllClosedCurves, 0.01)[0].DuplicateBrep();
    Mesh floorM = Mesh.CreateFromBrep(FloorBrep, MeshingParameters.FastRenderMesh)[0];
    Mesh ceilingM = floorM.DuplicateMesh();
    ceilingM.Translate(Vector3d.ZAxis * Convert.ToDouble(allData[new GH_Path(13), 0]));
    MeshFloor = floorM;
    MeshCeiling = ceilingM;
    SurfaceFloor = FloorBrep;

    //////Ceiling and Floor geometry without holes
    Brep solidFloorBrep = Brep.CreatePlanarBreps(allCurves[new GH_Path(0), 0], 0.01)[0].DuplicateBrep();
    Mesh solidFloorM = Mesh.CreateFromBrep(solidFloorBrep, MeshingParameters.FastRenderMesh)[0];
    Mesh solidCeilingM = solidFloorM.DuplicateMesh();
    solidCeilingM.Translate(Vector3d.ZAxis * Convert.ToDouble(allData[new GH_Path(13), 0]));
    SolidMeshFloor = solidFloorM;
    SolidMeshCeiling = solidCeilingM;




    List<Mesh> porousWalls = new List<Mesh>();Mesh solidWalls = new Mesh();
    List<double> wwrForEachWall = new List<double>();

    Mesh AllFrames = new Mesh();Mesh AllVrtFins = new Mesh();Mesh AllHrzFins = new Mesh();
    Mesh mesh = new Mesh();Mesh VrtFins = new Mesh(); Mesh HrzFins = new Mesh();
    List<double> verticalSpacingNumbers = new List<double>();
    List<double> horizontalSpacingNumbers = new List<double>();
    List<double> verticalFinsDepth = new List<double>();List<double> horizontalFinsDepth = new List<double>();
    List<Mesh> allWindows = new List<Mesh>();
    double verticalSpacing = 0;double horizontalSpacing = 0; Vector3d normalVector = new Vector3d();
    List<Curve> allSegments1 = new List<Curve> ();
    allSegments1.AddRange(allCurves[new GH_Path(0), 0].DuplicateSegments());
    List<Curve> allSegments2 = new List<Curve> ();
    double minLng = 3;
    TWWR = 0;


    if(allSegments1.Count != selectedWalls.Count)return; /////Checkkkk


    A = FloorBrep;
    

    for(int i = 0 ;i < allSegments1.Count ;i++){
      TWWR += Convert.ToDouble(allData[new GH_Path(2), i]) / allSegments1.Count * 1.0;
      Curve cr = allSegments1[i];
      cr.Domain = new Interval(0, 1);

      /////////////////////////////////Generating objects for energy performance
      if(Convert.ToDouble(allData[new GH_Path(2), i]) > 0){
        porousWalls.Add(GenerateInteriorWalls(FloorBrep, cr, Convert.ToDouble(allData[new GH_Path(13), 0])));
        wwrForEachWall.Add(Convert.ToDouble(allData[new GH_Path(2), i]));
      }
      else
        solidWalls.Append(GenerateInteriorWalls(FloorBrep, cr, Convert.ToDouble(allData[new GH_Path(13), 0])));
      ///////////////////////
      
      

      double crvLength = cr.PointAtStart.DistanceTo(cr.PointAtEnd);
      int crvDivision = (int) Math.Ceiling(crvLength / minLng);
      Mesh win = new Mesh();
      if(crvDivision == 1){
        GenerateFrame(FloorBrep, cr, Convert.ToDouble(allData[new GH_Path(2), i]), Convert.ToDouble(allData[new GH_Path(13), 0]), Convert.ToInt32(allData[new GH_Path(3), i]), Convert.ToInt32(allData[new GH_Path(4), i]),
          Convert.ToDouble(allData[new GH_Path(5), i]), Convert.ToInt32(allData[new GH_Path(6), i]), Convert.ToInt32(allData[new GH_Path(7), i]), Convert.ToDouble(allData[new GH_Path(8), i]), out mesh, 
          out VrtFins, out  HrzFins, out verticalSpacing, out horizontalSpacing, out normalVector, out win);
        AllFrames.Append(mesh);
        AllVrtFins.Append(VrtFins);
        AllHrzFins.Append(HrzFins);
        if(Convert.ToDouble(allData[new GH_Path(2), i]) > 0){
          verticalSpacingNumbers.Add(verticalSpacing);
          horizontalSpacingNumbers.Add(horizontalSpacing);
          allWindows.Add(win);

          if(Convert.ToInt32(allData[new GH_Path(3), i]) == 0)
            verticalFinsDepth.Add(0);
          else
            verticalFinsDepth.Add(Convert.ToDouble(allData[new GH_Path(5), i]));

          if(Convert.ToInt32(allData[new GH_Path(6), i]) == 0)
            horizontalFinsDepth.Add(0);
          else
            horizontalFinsDepth.Add(Convert.ToDouble(allData[new GH_Path(8), i]));
        }
      }
      else{
        List<double> tParameters = new List<double> ();
        List<Curve> splittedCurves = new List<Curve> ();
        for(int j = 0 ;j < crvDivision ;j++)
          tParameters.Add(j * (1.0 / crvDivision * 1.0));
        splittedCurves.AddRange(cr.Split(tParameters));
        for(int k = 0 ;k < splittedCurves.Count ;k++){
          GenerateFrame(FloorBrep, splittedCurves[k], Convert.ToDouble(allData[new GH_Path(2), i]), Convert.ToDouble(allData[new GH_Path(13), 0]), Convert.ToInt32(allData[new GH_Path(3), i]), Convert.ToInt32(allData[new GH_Path(4), i]),
            Convert.ToDouble(allData[new GH_Path(5), i]), Convert.ToInt32(allData[new GH_Path(6), i]), Convert.ToInt32(allData[new GH_Path(7), i]), Convert.ToDouble(allData[new GH_Path(8), i]), out mesh, out VrtFins, out  HrzFins, out verticalSpacing, out horizontalSpacing, out normalVector, out win);
          AllFrames.Append(mesh);
          AllVrtFins.Append(VrtFins);
          AllHrzFins.Append(HrzFins);
          if(Convert.ToDouble(allData[new GH_Path(2), i]) > 0){
            verticalSpacingNumbers.Add(verticalSpacing);
            horizontalSpacingNumbers.Add(horizontalSpacing);
            allWindows.Add(win);
            if(Convert.ToDouble(allData[new GH_Path(3), i]) == 0)
              verticalFinsDepth.Add(0);
            else
              verticalFinsDepth.Add(Convert.ToDouble(allData[new GH_Path(5), i]));
            if(Convert.ToDouble(allData[new GH_Path(6), i]) == 0)
              horizontalFinsDepth.Add(0);
            else
              horizontalFinsDepth.Add(Convert.ToDouble(allData[new GH_Path(8), i]));
          }
        }
      }

    }

    ///////////////////////Generating Interior Walls
    Mesh interiorWallMesh = new Mesh();

    if(interiorWalls.Count > 0){

      foreach(Curve crv in interiorWalls){
        List<Curve> allSegments = new List<Curve> ();
        allSegments.AddRange(crv.DuplicateSegments());

        for(int i = 0 ;i < allSegments.Count ;i++){
          Curve cr = allSegments[i];
          interiorWallMesh.Append(GenerateInteriorWalls(FloorBrep, cr, Convert.ToDouble(allData[new GH_Path(13), 0])));
        }
      }
    }


    MeshExteriorWalls = AllFrames;
    if(AllVrtFins.Vertices.Count > 0)
      MeshVerticalFins = AllVrtFins;
    if(AllHrzFins.Vertices.Count > 0)
      MeshHorizontalFins = AllHrzFins;
    MeshInteriorWalls = interiorWallMesh;;
    VerticalFinsSpacing = verticalSpacingNumbers;
    HorizontalFinsSpacing = horizontalSpacingNumbers;
    AlternativeData1 = allData;
    AlternativeData2 = allCurves;
    MeshWindows = allWindows;
    TotalWWR = RoundNumber(TWWR, 0.01);
    VerticalFinsDepth = verticalFinsDepth;
    HorizontalFinsDepth = horizontalFinsDepth;
    PorousWalls = porousWalls;
    WwrForEachWall = wwrForEachWall;
    SolidWalls = solidWalls;
    ZoneOutline = allSegments1;
# ---------- c_script_2: C# additional code ----------
  double TWWR = 0;
  int wallcount = 0;
  DataTree<string> allData = new DataTree<string>();
  DataTree<Curve> allCurves = new DataTree<Curve>();

  List<double> VrtFinDep = new List<double>();
  List<int> VrtFinCnt = new List<int>();

  List<double> HrzFinDep = new List<double>();
  List<int> HrzFinCnt = new List<int>();


  public void GenerateFrame (Brep floor, Curve crv, double WWR, double height, int verticalFnOnOff, int verticalFnCnt, double verticalFnDp, int horizontalFnOnOff, int horizontalFnCnt,
    double horizontalFnDp, out Mesh Frame, out Mesh VrtFins, out Mesh HrzFins, out double verticalSpacing, out double horizontalSpacing, out Vector3d normalVector,
  out Mesh window){


    ///////////////////////////////Generating frame Mesh
    Frame = new Mesh();
    Curve crv1 = crv.DuplicateCurve();
    Curve crv2 = crv.DuplicateCurve();
    crv1.Domain = new Interval(0, 1);
    Point3d midPt = crv1.PointAt(0.5) + new Vector3d(0, 0, height / 2);
    var tr1 = Rhino.Geometry.Transform.Scale(midPt, Math.Sqrt(WWR));
    crv2.Transform(tr1);
    Point3d p1 = crv1.PointAtStart; Point3d p2 = crv1.PointAtEnd;
    Point3d p4 = crv2.PointAtStart; Point3d p3 = crv2.PointAtEnd;
    Frame.Vertices.Add(p1);
    Frame.Vertices.Add(p2);
    Frame.Vertices.Add(p3);
    Frame.Vertices.Add(p4);


    var tr2 = Rhino.Geometry.Transform.Translation(new Vector3d(0, 0, height));
    Curve crvTop = crv.DuplicateCurve();
    crvTop.Transform(tr2);
    Curve crv3 = crvTop.DuplicateCurve();
    Curve crv4 = crvTop.DuplicateCurve();
    crv1.Domain = new Interval(0, 1);
    midPt = crv1.PointAt(0.5) + new Vector3d(0, 0, height / 2);
    crv4.Transform(tr1);
    Point3d p5 = crv3.PointAtStart; Point3d p6 = crv3.PointAtEnd;
    Point3d p8 = crv4.PointAtStart; Point3d p7 = crv4.PointAtEnd;
    Frame.Vertices.Add(p5);
    Frame.Vertices.Add(p6);
    Frame.Vertices.Add(p7);
    Frame.Vertices.Add(p8);

    if(WWR > 0.01){
      Frame.Faces.AddFace(new MeshFace(0, 1, 2, 3));
      Frame.Faces.AddFace(new MeshFace(4, 5, 6, 7));
      Frame.Faces.AddFace(new MeshFace(1, 5, 6, 2));
      Frame.Faces.AddFace(new MeshFace(4, 0, 3, 7));
      Frame.UnifyNormals();
    }
    else
      Frame.Faces.AddFace(new MeshFace(0, 1, 5, 4));

    Frame = repairMesh(Frame);

    ////////////////////////////////Normal Vector
    Vector3d vr1 = p2 - p1;
    vr1.Unitize();
    vr1.Rotate(0.5 * Math.PI, Vector3d.ZAxis);
    Vector3d vr2 = -1 * vr1;
    Point3d[] testPs = new Point3d[2] {(p1 + p2) / 2 + (0.1 * vr1),(p1 + p2) / 2 + (0.1 * vr2)};
    Vector3d[] testVs = new Vector3d[2] {vr1,vr2};
    double[] testDs = new double[2] {testPs[0].DistanceTo(floor.ClosestPoint(testPs[0])),testPs[1].DistanceTo(floor.ClosestPoint(testPs[1]))};
    Array.Sort(testDs, testVs);

    normalVector = testVs[1];

    /////////////////////////////Defining objects
    window = new Mesh();
    verticalSpacing = 0;
    VrtFins = new Mesh();
    horizontalSpacing = 0;
    HrzFins = new Mesh();
    //////////////////////////////Generating windows
    if(WWR > 0){
      window.Vertices.Add(p3);
      window.Vertices.Add(p4);
      window.Vertices.Add(p8);
      window.Vertices.Add(p7);
      window.Faces.AddFace(new MeshFace(0, 1, 2, 3));

      /////////////////////////verticalSpacing

      if(verticalFnCnt < 2)
        verticalSpacing = p3.DistanceTo(p4);
      else
        verticalSpacing = p3.DistanceTo(p4) / verticalFnCnt * 1.0;

      if(verticalFnOnOff == 1){
        ///////////////////////VerticalFinMesh
        verticalFnCnt--;
        for(int i = 0 ;i <= verticalFnCnt ;i++){
          double step = 1.0 / verticalFnCnt * 1.0;
          Point3d topPt = (p3 * (i * step)) + (p4 * (1 - (i * step)));
          Point3d bottomPt = (p7 * (i * step)) + (p8 * (1 - (i * step)));
          VrtFins.Vertices.Add(topPt);
          VrtFins.Vertices.Add(bottomPt);
          VrtFins.Vertices.Add(topPt + testVs[1] * verticalFnDp);
          VrtFins.Vertices.Add(bottomPt + testVs[1] * verticalFnDp);
          VrtFins.Faces.AddFace((4 * i) + 0, (4 * i) + 1, (4 * i) + 3, (4 * i) + 2);
        }
        VrtFins = repairMesh(VrtFins);
      }

      ////////////////////////horizontalSpacing
      if(horizontalFnCnt < 2)
        horizontalSpacing = p3.DistanceTo(p7);
      else
        horizontalSpacing = p3.DistanceTo(p7) / horizontalFnCnt * 1.0;

      if(horizontalFnOnOff == 1){
        ////////////////////////////////horizontalFinMesh
        for(int i = 0 ;i < horizontalFnCnt ;i++){
          double step = 1.0 / horizontalFnCnt * 1.0;
          Point3d leftPt = (p3 * (i * step)) + (p7 * (1 - (i * step)));
          Point3d rightPt = (p4 * (i * step)) + (p8 * (1 - (i * step)));
          HrzFins.Vertices.Add(leftPt);
          HrzFins.Vertices.Add(rightPt);
          HrzFins.Vertices.Add(leftPt + testVs[1] * horizontalFnDp);
          HrzFins.Vertices.Add(rightPt + testVs[1] * horizontalFnDp);
          HrzFins.Faces.AddFace((4 * i) + 0, (4 * i) + 1, (4 * i) + 3, (4 * i) + 2);
        }
        HrzFins = repairMesh(HrzFins);
      }
    }

  }

  public Mesh repairMesh(Mesh invalidMesh){
    invalidMesh.Vertices.CombineIdentical(true, true);
    invalidMesh.Faces.CullDegenerateFaces();
    invalidMesh.UnifyNormals();
    invalidMesh.RebuildNormals();
    invalidMesh.Compact();
    return invalidMesh;
  }


  public Mesh GenerateInteriorWalls (Brep floor, Curve crv, double height){

    Mesh InetriorWall = new Mesh();
    Point3d midPt = (crv.PointAtStart + crv.PointAtEnd) * 0.5;
    double testDs = midPt.DistanceTo(floor.ClosestPoint(midPt));
    if(testDs < 1){

      Point3d p1 = crv.PointAtStart; Point3d p2 = crv.PointAtEnd;
      Point3d p3 = crv.PointAtStart + Vector3d.ZAxis * height; Point3d p4 = crv.PointAtEnd + Vector3d.ZAxis * height;
      InetriorWall.Vertices.Add(p1);
      InetriorWall.Vertices.Add(p2);
      InetriorWall.Vertices.Add(p4);
      InetriorWall.Vertices.Add(p3);
      InetriorWall.Faces.AddFace(new MeshFace(0, 1, 2, 3));

      InetriorWall = repairMesh(InetriorWall);
      return InetriorWall;
    }
    else{
      return null;
    }
  }

  public double RoundNumber (double Number, double Scope){
    double Divide = Number / Scope;
    double wholeDiv = Math.Round(Divide);
    return Scope * wholeDiv;
  }
# ---------- end c_script_2 ----------
relay = Relay([c_script_2.AlternativeData2, c_script_2.AlternativeData1])
mjoin = MeshJoin(Meshes=[c_script_2.MeshExteriorWalls, c_script_2.MeshInteriorWalls])
data = Data(relay)
cluster = Cluster_5(G=c_script_2.SurfaceFloor)

# ---- group: Daylight
mesh = Mesh(graft(c_script_2.MeshWindows))
branch = TreeBranch(Tree=data, Path="{19}", MaintainPaths=True)
branch_2 = TreeBranch(Tree=data, Path="{16}", MaintainPaths=True)
branch_3 = TreeBranch(Tree=data, Path="{17}", MaintainPaths=True)
updatesensorgrid = Text(item)
branch_4 = TreeBranch(Tree=data, Path="{18}", MaintainPaths=True)
transparent_object = ConstructTransparentDaylightObjectPWAIV0400(
    GlazingGeometry=mesh,
    TransparencyValue=branch,
    ShadingDepth=simplify(graft(c_script_2.HorizontalFinsDepth)),
    ShadingSpacing=simplify(graft(c_script_2.HorizontalFinsSpacing)),
    ShadingType="horizontal",
    GenerateShadingGeometries=True)  # -> GlazingDaylighObject, ShadingDeviceGeometry
transparent_object_2 = ConstructTransparentDaylightObjectPWAIV0400(
    GlazingGeometry=simplify(mesh),
    TransparencyValue=branch,
    ShadingDepth=simplify(graft(c_script_2.VerticalFinsDepth)),
    ShadingSpacing=simplify(graft(c_script_2.VerticalFinsSpacing)),
    ShadingType="vertical",
    GenerateShadingGeometries=True)  # -> GlazingDaylighObject, ShadingDeviceGeometry
opaque_object = ConstructOpaqueDaylightObjectPWAIV0400(BuildingGeometry=c_script_2.MeshFloor, ReflectanceValue=branch_3)
opaque_object_2 = ConstructOpaqueDaylightObjectPWAIV0400(BuildingGeometry=c_script_2.MeshCeiling, ReflectanceValue=branch_2)
opaque_object_3 = ConstructOpaqueDaylightObjectPWAIV0400(BuildingGeometry=mjoin, ReflectanceValue=branch_4)
opaque_object_4 = ConstructOpaqueDaylightObjectPWAIV0400(BuildingGeometry=context, ReflectanceValue=Slider(0.5, range=0..1))  # -> flatten(OpaqueDaylightObject)
analysis_grid = ConstructAnalysisGridPWAIV0420(FloorPlane=c_script_2.SurfaceFloor, GridSpacing=updatesensorgrid)
dl_obj = DaylightObjectPWAIV0400(flatten([opaque_object_2, opaque_object, opaque_object_3, transparent_object_2.GlazingDaylighObject, transparent_object.GlazingDaylighObject]))
toggle = BooleanToggle(True)
toggle_2 = BooleanToggle(True)
predict_daylight = PredictDaylightMetricsFromGeometryMaterialsAndWeatherDataPWAIV0500(
    AnalysisGrid=analysis_grid,
    BuildingDaylightObjects=dl_obj,
    SurroundingDaylightObjects=opaque_object_4,
    GroundElevation=cluster,
    PathOfEpwFile=weather_file_2,
    ComputeSolution=Toggle(False),
    PredictDA=toggle,
    PredictSE=toggle_2,
    PredictMI=toggle,
    PredictUDI=toggle_2,
    NumberOfThreads=-1)  # -> PredictedDaylightAutonomy_sensor_array, PredictedSunlightExposure_sensor_array, PredictedMeanIlluminance_sensor_array, PredictedUsefulDaylightIlluminanceFailing_sensor_array, PredictedUsefulDaylightIlluminanceSupplementary_sensor_array, PredictedUsefulDaylightIlluminanceAcceptable_sensor_array, PredictedUsefulDaylightIlluminanceExcessive_sensor_array

# ----
demesh = DeconstructMesh(Mesh=analysis_grid)  # -> Vertices, Faces, Colours, Normals
conmesh = ConstructMesh(Vertices=demesh.Vertices, Faces=demesh.Faces)
data_2 = Data(conmesh)
demesh_2 = DeconstructMesh(Mesh=data_2)  # -> Vertices, Faces, Colours, Normals
larger = LargerThan(FirstNumber=predict_daylight.PredictedSunlightExposure_sensor_array, SecondNumber=250)  # -> LargerThan, OrEqualTo
larger_2 = LargerThan(FirstNumber=predict_daylight.PredictedDaylightAutonomy_sensor_array, SecondNumber=0.5)  # -> LargerThan, OrEqualTo
int = Integer(larger_2.LargerThan)
int_2 = Integer(larger.LargerThan)
gradient = Gradient(
    LowerLimit=0,
    UpperLimit=1,
    Parameter=int_2,
    stops=[0: RGB(138, 138, 138), 0: RGB(186, 186, 186), 0: RGB(221, 232, 170), 0: RGB(173, 173, 173), 1: RGB(255, 208, 18)])
gradient_2 = Gradient(
    LowerLimit=0,
    UpperLimit=1,
    Parameter=int,
    stops=[0: RGB(181, 181, 181), 0: RGB(186, 186, 186), 0: RGB(221, 232, 170), 0: RGB(173, 173, 173), 1: RGB(200, 250, 147)])
gradient_3 = Gradient(
    LowerLimit=Slider(3000, range=0..10000),
    UpperLimit=Slider(50, range=0..100),
    Parameter=predict_daylight.PredictedMeanIlluminance_sensor_array,
    stops=[0: RGB(234, 38, 0), 0.25: RGB(234, 126, 0), 0.5: RGB(254, 244, 84), 0.75: RGB(173, 203, 249), 1: RGB(75, 107, 169)])
data_3 = Data(data_2)
c_script_3 = CSharpScript(
    srf=c_script_2.SurfaceFloor,
    sensor=demesh_2.Vertices,
    spacing=updatesensorgrid,
    f=predict_daylight.PredictedUsefulDaylightIlluminanceFailing_sensor_array,
    s=predict_daylight.PredictedUsefulDaylightIlluminanceSupplementary_sensor_array,
    a=predict_daylight.PredictedUsefulDaylightIlluminanceAcceptable_sensor_array,
    e=predict_daylight.PredictedUsefulDaylightIlluminanceExcessive_sensor_array,
    colors=[ColourSwatch(SwatchColor=RGB(65, 128, 176)), ColourSwatch(SwatchColor=RGB(117, 186, 163)), ColourSwatch(SwatchColor=RGB(180, 224, 119)), ColourSwatch(SwatchColor=RGB(255, 176, 255))])  # -> out, A; inputs srf: Surface, sensor: Point3d, spacing: Double, f: Double, s: Double, a: Double, e: Double, colors: list of Color
# ---------- c_script_3: C# ----------
    Curve crVt = srf.IsoCurve(0, 0);
    Vector3d v1 = crVt.PointAtEnd - crVt.PointAtStart;
    v1.Unitize();
    Vector3d v2 = v1;
    v2.Rotate(-0.5 * Math.PI, Vector3d.ZAxis);



    Mesh Tmesh = new Mesh();

    double totalVal = f + s + a + e;
    f = f / totalVal * spacing;
    s = s / totalVal * spacing;
    a = a / totalVal * spacing;
    e = e / totalVal * spacing;


    Mesh fMesh = new Mesh();
    Point3d p0 = sensor + (v1 * (0.5 * f)) + (v2 * (0.5 * f));
    Point3d p1 = sensor - (v1 * (0.5 * f)) + (v2 * (0.5 * f));
    Point3d p2 = sensor - (v1 * (0.5 * f)) - (v2 * (0.5 * f));
    Point3d p3 = sensor + (v1 * (0.5 * f)) - (v2 * (0.5 * f));
    fMesh.Vertices.Add(p0);
    fMesh.Vertices.Add(p1);
    fMesh.Vertices.Add(p2);
    fMesh.Vertices.Add(p3);
    fMesh.Faces.AddFace(0, 1, 2, 3);
    fMesh.VertexColors.CreateMonotoneMesh(colors[0]);
    fMesh = repairMesh(fMesh);



    Mesh sMesh = new Mesh();
    Point3d p4 = sensor + (v1 * (0.5 * (f + s))) + (v2 * (0.5 * (f + s)));
    Point3d p5 = sensor - (v1 * (0.5 * (f + s))) + (v2 * (0.5 * (f + s)));
    Point3d p6 = sensor - (v1 * (0.5 * (f + s))) - (v2 * (0.5 * (f + s)));
    Point3d p7 = sensor + (v1 * (0.5 * (f + s))) - (v2 * (0.5 * (f + s)));
    sMesh.Vertices.Add(p0);
    sMesh.Vertices.Add(p1);
    sMesh.Vertices.Add(p2);
    sMesh.Vertices.Add(p3);
    sMesh.Vertices.Add(p4);
    sMesh.Vertices.Add(p5);
    sMesh.Vertices.Add(p6);
    sMesh.Vertices.Add(p7);
    sMesh.Faces.AddFace(0, 4, 5, 1);
    sMesh.Faces.AddFace(1, 5, 6, 2);
    sMesh.Faces.AddFace(2, 6, 7, 3);
    sMesh.Faces.AddFace(0, 3, 7, 4);
    sMesh.VertexColors.CreateMonotoneMesh(colors[1]);
    sMesh = repairMesh(sMesh);


    Mesh aMesh = new Mesh();
    Point3d p8 = sensor + (v1 * ( 0.5 * (f + s + a))) + (v2 * (0.5 * (f + s + a)));
    Point3d p9 = sensor - (v1 * (0.5 * (f + s + a))) + (v2 * (0.5 * (f + s + a)));
    Point3d p10 = sensor - (v1 * (0.5 * (f + s + a))) - (v2 * (0.5 * (f + s + a)));
    Point3d p11 = sensor + (v1 * (0.5 * (f + s + a))) - (v2 * (0.5 * (f + s + a)));
    aMesh.Vertices.Add(p4);
    aMesh.Vertices.Add(p5);
    aMesh.Vertices.Add(p6);
    aMesh.Vertices.Add(p7);
    aMesh.Vertices.Add(p8);
    aMesh.Vertices.Add(p9);
    aMesh.Vertices.Add(p10);
    aMesh.Vertices.Add(p11);
    aMesh.Faces.AddFace(0, 4, 5, 1);
    aMesh.Faces.AddFace(1, 5, 6, 2);
    aMesh.Faces.AddFace(2, 6, 7, 3);
    aMesh.Faces.AddFace(0, 3, 7, 4);
    aMesh.VertexColors.CreateMonotoneMesh(colors[2]);
    aMesh = repairMesh(aMesh);


    Mesh eMesh = new Mesh();
    Point3d p12 = sensor + (v1 * (0.5 * (f + s + a + e))) + (v2 * (0.5 * (f + s + a + e)));
    Point3d p13 = sensor - (v1 * (0.5 * (f + s + a + e))) + (v2 * (0.5 * (f + s + a + e)));
    Point3d p14 = sensor - (v1 * (0.5 * (f + s + a + e))) - (v2 * (0.5 * (f + s + a + e)));
    Point3d p15 = sensor + (v1 * (0.5 * (f + s + a + e))) - (v2 * (0.5 * (f + s + a + e)));
    eMesh.Vertices.Add(p8);
    eMesh.Vertices.Add(p9);
    eMesh.Vertices.Add(p10);
    eMesh.Vertices.Add(p11);
    eMesh.Vertices.Add(p12);
    eMesh.Vertices.Add(p13);
    eMesh.Vertices.Add(p14);
    eMesh.Vertices.Add(p15);
    eMesh.Faces.AddFace(0, 4, 5, 1);
    eMesh.Faces.AddFace(1, 5, 6, 2);
    eMesh.Faces.AddFace(2, 6, 7, 3);
    eMesh.Faces.AddFace(0, 3, 7, 4);
    eMesh.VertexColors.CreateMonotoneMesh(colors[3]);
    eMesh = repairMesh(eMesh);


    Tmesh.Append(fMesh);
    Tmesh.Append(sMesh);
    Tmesh.Append(aMesh);
    Tmesh.Append(eMesh);

    A = Tmesh;
# ---------- c_script_3: C# additional code ----------
  public Mesh repairMesh(Mesh invalidMesh){
    invalidMesh.Vertices.CombineIdentical(true, true);
    invalidMesh.Faces.CullDegenerateFaces();
    invalidMesh.UnifyNormals();
    invalidMesh.RebuildNormals();
    invalidMesh.Compact();
    return invalidMesh;
  }
# ---------- end c_script_3 ----------
avr = Average(Input=int_2)  # -> flatten(ArithmeticMean)
mcol = MeshColours(Mesh=data_3, Colours=gradient)
avr_2 = Average(Input=int)  # -> flatten(ArithmeticMean)
mcol_2 = MeshColours(Mesh=data_3, Colours=gradient_3)
mcol_3 = MeshColours(Mesh=data_3, Colours=gradient_2)
ase = Panel(avr)
sda = Panel(avr_2)
mesh_2 = Mesh(mcol)
mesh_3 = Mesh(mcol_2)
mesh_4 = Mesh(mcol_3)
int_3 = Integer(Slider(1, range=0..4))
cluster_2 = Cluster(
    relay_2=predict_daylight.PredictedDaylightAutonomy_sensor_array,
    relay=predict_daylight.PredictedSunlightExposure_sensor_array,
    I=predict_daylight.PredictedUsefulDaylightIlluminanceAcceptable_sensor_array,
    I_2=predict_daylight.PredictedMeanIlluminance_sensor_array)
c_script_4 = CSharpScript(Number=c_script_2.TotalWWR, Scope=0.001)  # -> out, A; inputs Number: Double, Scope: Double
# ---------- c_script_4: C# ----------
    double x = Number;
    double y = Scope;
    double Divide = x / y;
    double wholeDiv = Math.Round(Divide);
    A = "Total WWR:"+Convert.ToString((Scope * wholeDiv) * 100) + " %";
# ---------- end c_script_4 ----------
filter = StreamFilter(Gate=int_3, Stream0=mesh_4, Stream1=mesh_2, Stream2=c_script_3.A, Stream3=mesh_3)

# ---- group: RH_OUT:daylight_mesh
daylight_mesh = Mesh(filter)

# ---- group: RH_OUT:wall_mesh
mesh_5 = Mesh(c_script_2.MeshExteriorWalls)

# ---- group: RH_OUT:windows_mesh
mesh_6 = Mesh(c_script_2.MeshWindows)

# ---- group: RH_OUT:VerticalFins_mesh
mesh_7 = Mesh(c_script_2.MeshVerticalFins)

# ---- group: RH_OUT:HorizontalFins_mesh
mesh_8 = Mesh(c_script_2.MeshHorizontalFins)

# ---- group: RH_OUT:daylight_results
txt = Text(cluster_2)

# ---- group: RH_OUT:totalWWR
txt_2 = Text(c_script_4.A)

# ---- group: Energy
txt_3 = Text(Tree({0}: ["0.051129|6.888896|7.965286|8.340905"], {1}: ["15.6_15.6_24_24|15.6_15.6_24_24|15.6_15.6_24_24|15.6_15.6_24_24|17.8_17.8_24_24|20_20_24_24|21_21_24_24|21_21_24_24|21_21_24_24|21_21_24_24|21_21_24_24|21_21_24_24|21_21_24_24|21_21_24_24|21_21_24_24|21_21_24_24|21_21_24_24|21_15.6_24_24|21_15.6_24_24|21_15.6_24_24|21_15.6_24_24|21_15.6_24_24|15.6_15.6_24_24|15.6_15.6_24_24"], {2}: ["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"]))
txt_4 = Text(Tree({0}: ["0.051129|9.364593|7.965286|1.291949"], {1}: ["15.6_15.6_26.7_26.7|15.6_15.6_26.7_26.7|15.6_15.6_26.7_26.7|15.6_15.6_26.7_26.7|15.6_15.6_26.7_26.7|17.8_17.8_25.6_25.7|20_20_25_25|21_21_24_24|21_21_24_24|21_21_24_24|21_21_24_24|21_21_24_24|21_21_24_24|21_21_24_24|21_21_24_24|21_21_24_24|21_21_24_24|21_15.6_24_26.7|21_15.6_24_26.7|21_15.6_24_26.7|21_15.6_24_26.7|21_15.6_24_26.7|15.6_15.6_26.7_26.7|15.6_15.6_26.7_26.7"], {2}: ["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"]))
txt_5 = Text(Tree({0}: ["0.051129|9.364593|7.965286|0.022217"], {1}: ["15.56_15.56_29.44_29.44|15.56_15.56_29.44_29.44|15.56_15.56_29.44_29.44|15.56_15.56_29.44_29.44|15.56_15.56_29.44_29.44|15.56_15.56_29.44_29.44|21.11_15.56_23.89_29.44|21.11_15.56_23.89_29.44|21.11_15.56_23.89_29.44|21.11_15.56_23.89_29.44|21.11_15.56_23.89_29.44|21.11_15.56_23.89_29.44|21.11_15.56_23.89_29.44|21.11_15.56_23.89_29.44|21.11_15.56_23.89_29.44|21.11_15.56_23.89_29.44|21.11_15.56_23.89_29.44|21.11_15.56_23.89_29.44|21.11_15.56_29.44_29.44|15.56_15.56_29.44_29.44|15.56_15.56_29.44_29.44|15.56_15.56_29.44_29.44|15.56_15.56_29.44_29.44|15.56_15.56_29.44_29.44"], {2}: ["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"]))
txt_6 = Text(Tree({0}: ["0.028309|6.669994|6.45834|0.149258"], {1}: ["21.7_21.7_24.4_24.4|21.7_21.7_24.4_24.4|21.7_21.7_24.4_24.4|21.7_21.7_24.4_24.4|21.7_21.7_24.4_24.4|21.7_21.7_24.4_24.4|21.7_21.7_24.4_24.4|21.7_21.7_24.4_24.4|21.7_21.7_24.4_24.4|21.7_21.7_24.4_24.4|21.7_21.7_24.4_24.4|21.7_21.7_24.4_24.4|21.7_21.7_24.4_24.4|21.7_21.7_24.4_24.4|21.7_21.7_24.4_24.4|21.7_21.7_24.4_24.4|21.7_21.7_24.4_24.4|21.7_21.7_24.4_24.4|21.7_21.7_24.4_24.4|21.7_21.7_24.4_24.4|21.7_21.7_24.4_24.4|21.7_21.7_24.4_24.4|21.7_21.7_24.4_24.4|21.7_21.7_24.4_24.4"], {2}: ["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"]))
txt_7 = Text(Tree({0}: ["0.376737|9.999663|7.642369|0.94112"], {1}: ["15.6_15.6_24_24|15.6_15.6_24_24|15.6_15.6_24_24|15.6_15.6_24_24|15.6_15.6_24_24|15.6_15.6_24_24|15.6_15.6_24_24|15.6_15.6_24_24|15.6_15.6_24_24|15.6_15.6_24_24|15.6_15.6_24_24|15.6_15.6_24_24|15.6_15.6_24_24|15.6_15.6_24_24|15.6_15.6_24_24|15.6_15.6_24_24|15.6_15.6_24_24|15.6_15.6_24_24|15.6_15.6_24_24|15.6_15.6_24_24|15.6_15.6_24_24|15.6_15.6_24_24|15.6_15.6_24_24|15.6_15.6_24_24"], {2}: ["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"]))
txt_8 = Text(Tree({0}: ["0.038427|6.748965|4.413199|0.121267"], {1}: ["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"], {2}: ["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"]))
txt_9 = Text(Tree({0}: ["0.028309|6.669994|6.45834|0.149258"], {1}: ["21.7_21.7_24.4_24.4|21.7_21.7_24.4_24.4|21.7_21.7_24.4_24.4|21.7_21.7_24.4_24.4|21.7_21.7_24.4_24.4|21.7_21.7_24.4_24.4|21.7_21.7_24.4_24.4|21.7_21.7_24.4_24.4|21.7_21.7_24.4_24.4|21.7_21.7_24.4_24.4|21.7_21.7_24.4_24.4|21.7_21.7_24.4_24.4|21.7_21.7_24.4_24.4|21.7_21.7_24.4_24.4|21.7_21.7_24.4_24.4|21.7_21.7_24.4_24.4|21.7_21.7_24.4_24.4|21.7_21.7_24.4_24.4|21.7_21.7_24.4_24.4|21.7_21.7_24.4_24.4|21.7_21.7_24.4_24.4|21.7_21.7_24.4_24.4|21.7_21.7_24.4_24.4|21.7_21.7_24.4_24.4"], {2}: ["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"]))
txt_10 = Text(Tree({0}: ["0.269098|14.999495|7.642369|1.12574"], {1}: ["15.6_15.6_26.7_26.7|15.6_15.6_26.7_26.7|15.6_15.6_26.7_26.7|15.6_15.6_26.7_26.7|15.6_15.6_26.7_26.7|15.6_15.6_26.7_26.7|21_15.6_24_26.7|21_15.6_24_26.7|21_15.6_24_26.7|21_15.6_24_26.7|21_15.6_24_26.7|21_15.6_24_26.7|21_15.6_24_26.7|21_15.6_24_26.7|21_15.6_24_26.7|21_15.6_24_26.7|21_15.6_24_26.7|21_15.6_24_26.7|21_15.6_24_26.7|21_15.6_24_26.7|21_15.6_24_26.7|15.6_15.6_26.7_26.7|15.6_15.6_26.7_26.7|15.6_15.6_26.7_26.7"], {2}: ["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"]))
txt_11 = Text(Tree({0}: ["0.045962|11.84029|4.413199|0.257708"], {1}: ["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"], {2}: ["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"]))
entwine = Entwine(
    Branch00=txt_3,
    Branch01=txt_4,
    Branch02=txt_5,
    Branch03=txt_6,
    Branch04=txt_9,
    Branch05=txt_10,
    Branch06=txt_7,
    Branch07=txt_11,
    Branch08=txt_8,
    FlattenInputs=True)  # -> simplify(Result)
c_script_5 = CSharpScript(
    path=weather_file_2,
    Reference=["C:\Users\Asus\AppData\Roaming\Grasshopper\Libraries\MITACS folder\daylight\CsvHelper.dll", "C:\Users\Asus\AppData\Roaming\Grasshopper\Libraries\MITACS folder\daylight\EPWReader.dll"])  # -> out, Location, WeatherDataValues; inputs path: String
# ---------- c_script_5: C# usings ----------
using EPWReader;
using CsvHelper;
# ---------- c_script_5: C# ----------
    EPWeatherData epw = new EPWeatherData(path);
    List<string> locationData = new List<string>();
    locationData.Add(epw.Location.Country.ToString());
    locationData.Add(epw.Location.State.ToString());
    locationData.Add(epw.Location.City.ToString());
    locationData.Add(epw.Location.Longitude.ToString() + "," + epw.Location.Latitude.ToString());
    locationData.Add("Time Zone Offset= " + epw.Location.TimeZoneOffset.ToString());
    locationData.Add("Elevation= " + epw.Location.Elevation.ToString());


    Location = locationData;


    Dictionary<string, List<double>> keyValuePairs = epw.GetHourlyDataFields(new List<string>
      {"DryBulbTemperature",
        "GlobalHorizontalRadiation",
        "DirectNormalRadiation",
        "DiffuseHorizontalRadiation",
        "WindSpeed",
        "RelativeHumidity",
        "AtmoshpericStationPressure",
        "DewPointTemperature",
        "OpaqueSkyCover",
        });
    DataTree<double> weatherDataValues = new DataTree<double> ();
    weatherDataValues.AddRange(keyValuePairs["DryBulbTemperature"], new GH_Path(0));
    weatherDataValues.AddRange(keyValuePairs["GlobalHorizontalRadiation"], new GH_Path(1));
    weatherDataValues.AddRange(keyValuePairs["DirectNormalRadiation"], new GH_Path(2));
    weatherDataValues.AddRange(keyValuePairs["DiffuseHorizontalRadiation"], new GH_Path(3));
    weatherDataValues.AddRange(keyValuePairs["WindSpeed"], new GH_Path(4));
    weatherDataValues.AddRange(keyValuePairs["RelativeHumidity"], new GH_Path(5));
    weatherDataValues.AddRange(keyValuePairs["AtmoshpericStationPressure"], new GH_Path(6));
    weatherDataValues.AddRange(keyValuePairs["DewPointTemperature"], new GH_Path(7));
    weatherDataValues.AddRange(keyValuePairs["OpaqueSkyCover"], new GH_Path(8));


    WeatherDataValues = weatherDataValues;
# ---------- end c_script_5 ----------
c_script_6 = CSharpScript(x=weather_file_2)  # -> out, ClimateType; inputs x: String
# ---------- c_script_6: C# usings ----------
using System.IO;
using System.Text.RegularExpressions;
# ---------- c_script_6: C# ----------
///*
    string statPath = x.EndsWith(".epw", StringComparison.OrdinalIgnoreCase) ? x.Replace(".epw", ".stat") : x;
    string text = File.ReadAllText(statPath);
    string pattern = @"- Climate Zone ""([A-Za-z0-9]+)""";
    Match match = Regex.Match(text, pattern);
    string climateType = match.Value;
    ClimateType = climateType.Split('"')[1];
# ---------- end c_script_6 ----------
cluster_3 = Cluster_3(y=c_script_2.ZoneOutline, relay=data)  # -> A, wall_2, win_2
branch_5 = TreeBranch(Tree=data, Path="{14}", MaintainPaths=True)
panel = Panel("""{20}
{21}
{22}
{23}""")
branch_6 = TreeBranch(Tree=data, Path=panel, MaintainPaths=True)
branch_7 = TreeBranch(Tree=entwine, Path=branch_5, MaintainPaths=True)
item_2 = ListItem(List=c_script_5.Location, Index=3, Wrap=True)  # -> Item, Item1
bang = ExplodeTree(Data=branch_6)  # -> Branch0, Branch1, Branch2, Branch3
cluster_4 = Cluster_4(G=c_script_2.SurfaceFloor, T=data)  # -> R, B, A
item_3 = ListItem(List=branch_7, Index=0, Wrap=True)  # -> Item, Item1, Item2
split = TextSplit(Text=item_2.Item, Separators=",")
split_2 = TextSplit(Text=item_2.Item1, Separators="=")
split_3 = TextSplit(Text=item_3.Item, Separators="|")
panel_2 = Panel("""S
SE
E
NE
N
NW
W
SW
Roof(Hor)""")
item_4 = ListItem(List=reverse(split_2), Index=0, Wrap=True)
item_5 = ListItem(List=split, Index=0, Wrap=True)  # -> Item, Item1
one_over_x = OneOverX(Value=bang.Branch0)
one_over_x_2 = OneOverX(Value=bang.Branch1)
num_2 = Number(bang.Branch2)
num_3 = Number(bang.Branch3)
item_6 = ListItem(List=split_3, Index=0, Wrap=True)  # -> Item, Item1, Item2, Item3
num_4 = Number(item_4)
txt_12 = Text(flatten(cluster_3.wall_2))
txt_13 = Text(flatten(cluster_3.win_2))
c_script_7 = CSharpScript(SHGC=num_3, U=num_2)  # -> out, A; inputs SHGC: Double, U: Double
# ---------- c_script_7: C# ----------
    if(U>4.5 && SHGC <0.7206)
      A = 0.939998 * Math.Pow(SHGC, 2) + 0.20332 * SHGC;
    if(U > 4.5 && SHGC >= 0.7206)
      A = 1.30415*SHGC  - 0.30515;
    if(U < 3.4 && SHGC <= 0.15)
      A = 0.41040 * SHGC;
    if(U < 3.4 && SHGC > 0.15)
      A = 0.085775 * Math.Pow(SHGC, 2)+ 0.963954 *SHGC -0.084958;
# ---------- end c_script_7 ----------
merge = Merge(Data1=flatten(item_5.Item1), Data2=flatten(item_5.Item), Data3=flatten(num_4), Data4=flatten(c_script_6.ClimateType))
branch_8 = TreeBranch(Tree=data, Path="{9}", MaintainPaths=True)
one_over_x_3 = OneOverX(Value=item_6.Item)
branch_9 = TreeBranch(Tree=data, Path="{11}", MaintainPaths=True)
branch_10 = TreeBranch(Tree=data, Path="{10}", MaintainPaths=True)
branch_11 = TreeBranch(Tree=data, Path="{12}", MaintainPaths=True)
division = Division(A=Slider(1, range=0..1), B=item_6.Item)
merge_2 = Merge(Data1=flatten(txt_12), Data2=flatten(cluster_4.A))
dup = DuplicateData(Data=0, Number=9, Order=True)  # -> simplify(Data)
merge_3 = Merge(Data1=flatten(txt_13), Data2=flatten(0))
c_script_8 = CSharpScript(x=branch_5, y="8.3")  # -> out, A; inputs x: list of Double, y: Double
# ---------- c_script_8: C# ----------
    if(x.Count > 0 )
      A = y;
    else
      A =x;
# ---------- end c_script_8 ----------
c_script_9 = CSharpScript(x=branch_5, y="88")  # -> out, A; inputs x: list of Double, y: Double; same code as c_script_8
item_7 = ListItem(
    List=["Very Light: 80,000 * Af", "Light : 110,000 * Af", "Medium: 165,000 * Af", "Heavy: 260,000 * Af", "Very heavy: 370,000 * Af"],
    Index=branch_10,
    Wrap=True)
panel_3 = Panel(merge)
item_8 = ListItem(List=["Electricity", "Natural Gas", "Fuel"], Index=branch_11, Wrap=True)
item_9 = ListItem(List=["Electricity", "Natural Gas", "Fuel"], Index=branch_9, Wrap=True)
item_10 = ListItem(List=["Open terrain", "Country", "Urban / City"], Index=branch_8, Wrap=True)
merge_4 = Merge(Data1=flatten(one_over_x), Data2=flatten(0.85), Data3=flatten(0.85), Data4=flatten(0))
merge_5 = Merge(Data1=flatten(one_over_x_2), Data2=flatten(0.85), Data3=flatten(0.85), Data4=flatten(0))
merge_6 = Merge(Data1=flatten(num_2), Data2=flatten(0), Data3=flatten(0.85), Data4=flatten(c_script_7.A))
entwine_2 = Entwine(Branch00=merge_2, Branch01=dup, Branch02=merge_3, FlattenInputs=True)  # -> simplify(Result)
entwine_3 = Entwine(Branch00=merge_5, Branch01=[0, 0, 0, 0], Branch02=merge_4, Branch03=[0, 0, 0, 0], Branch04=merge_6, FlattenInputs=True)  # -> simplify(Result)
txt_14 = Text(item_8)
txt_15 = Text(item_9)
txt_16 = Text(item_10)
txt_17 = Text(cluster_4.B)
txt_18 = Text(item_7)
txt_19 = Text(cluster_4.R)
panel_4 = Panel("""-90
60
1
1367
0.14""")
flip = FlipMatrix(Data=c_script_5.WeatherDataValues)
flip_2 = FlipMatrix(Data=entwine_2)
split_4 = TextSplit(Text=item_3.Item1, Separators="|")
merge_7 = Merge(Data1=txt_15, Data2=txt_14)  # -> flatten(Result)
merge_8 = Merge(
    Data1=flatten(txt_16),
    Data2=flatten(txt_19),
    Data3=flatten(txt_17),
    Data4=flatten(""),
    Data5=flatten(""),
    Data6=flatten(txt_18))
join = TextJoin(Text=flip, Join="_")  # -> flatten(Result)
join_2 = TextJoin(Text=entwine_3, Join="_")  # -> flatten(Result)
join_3 = TextJoin(Text=flip_2, Join="_")  # -> flatten(Result)
split_5 = TextSplit(Text=split_4, Separators="_")
join_4 = TextJoin(Text=merge, Join="|")  # -> flatten(Result)
join_5 = TextJoin(Text=merge_8, Join="|")  # -> flatten(Result)
join_6 = TextJoin(Text=merge_7, Join="|")  # -> flatten(Result)
join_7 = TextJoin(Text=join_2, Join="|")  # -> flatten(Result)
join_8 = TextJoin(Text=join_3, Join="|")  # -> flatten(Result)
join_9 = TextJoin(Text=join, Join="|")  # -> flatten(Result)
join_10 = TextJoin(Text=panel_4, Join="|")  # -> flatten(Result)
flip_3 = FlipMatrix(Data=split_5)
merge_9 = Merge(Data1=flatten(join_4), Data2=flatten(join_10), Data3=flatten(join_9))
panel_5 = Panel("""EPW_Data
INPUT""")
panel_6 = Panel("""17_3|20_3
25_3|29_3
10_7|8769_15""")
panel_7 = Panel("""13_3|18_3
73_3|74_3
10_7|16_7
20_7|43_10
20_13|43_18
50_7|58_9
64_7|68_11""")
c_script_10 = CSharpScript(x="\MITACS folder\EPC_v_M2.0_EPW Convertor_v1.4.xlsx")  # -> A
# ---------- c_script_10: C# ----------
    A = Grasshopper.Folders.DefaultAssemblyFolder+x;
# ---------- end c_script_10 ----------
entwine_4 = Entwine(Branch0X=panel_6, Branch1X=panel_7, FlattenInputs=False)  # -> simplify(Result)

c_script_11 = CSharpScript(x=item_6.Item3, y="0.735")  # -> out, A; inputs x: list of Double, y: Double
# ---------- c_script_11: C# ----------
    if(x.Count > 0 )
      A = x[0] * y;
    else
      A = x;
# ---------- end c_script_11 ----------

merge_10 = Merge(
    Data1=flatten(cluster_4.A),
    Data2=flatten(one_over_x_3),
    Data3=flatten(c_script_9.A),
    Data4=flatten(item_6.Item1),
    Data5=flatten(item_6.Item2),
    Data6=flatten(c_script_8.A),
    Data7=flatten(c_script_11.A))
join_11 = TextJoin(Text=merge_10, Join="|")  # -> flatten(Result)
merge_11 = Merge(
    Data1=flatten(join_5),
    Data2=flatten(join_6),
    Data3=flatten(join_11),
    Data4=flatten(item_3.Item1),
    Data5=flatten(item_3.Item2),
    Data6=flatten(join_8),
    Data7=flatten(join_7))
entwine_5 = Entwine(Branch0X=merge_9, Branch1X=merge_11, FlattenInputs=False)  # -> simplify(Result)
c_script_12 = CSharpScript(
    Action=Toggle(True),
    check=branch_9,
    filePath=c_script_10,
    sheetNameToWrite=panel_5,
    startEndcellsToWrite=entwine_4,
    valuesToWrite=entwine_5,
    sheetNameToRead="RESULT",
    row_clnToRead="13_3|25_4",
    closeApp=Toggle(False),
    Reference="C:\Users\Asus\AppData\Roaming\Grasshopper\Libraries\MITACS folder\Microsoft.Office.Interop.Excel.dll")  # -> out, CellValueStringlist, WorkBook, ExcelApp; inputs Action: Boolean, check: String, filePath: String, sheetNameToWrite: list, startEndcellsToWrite: tree of String, valuesToWrite: tree of String, row_clnToRead: list of String, closeApp: Boolean
# ---------- c_script_12: C# usings ----------
using Excel = Microsoft.Office.Interop.Excel;
using System.Runtime.InteropServices;
# ---------- c_script_12: C# ----------
    if(!Action || string.IsNullOrEmpty(check) )
      return;

    InitializeExcel(filePath);


    

    // write data to Excel sheets
    for (int i = 0; i < sheetNameToWrite.Count; i++)
    {
      Excel.Worksheet worksheetToWrite = (Excel.Worksheet) workbook.Sheets[sheetNameToWrite[i]];
      for (int j = 0; j < startEndcellsToWrite.Branch(i).Count; j++)
      {
        ///To check if the values has changed or is not empty
        if(string.IsNullOrEmpty(valuesToWrite[new GH_Path(i), j]) || currentValues[i][j] == valuesToWrite[new GH_Path(i), j])
          continue;
        else
        {
          currentValues[i][j] = valuesToWrite[new GH_Path(i), j];

          string[] startEndAdrs = startEndcellsToWrite.Branch(i)[j].Split('|');
          string[] startCellIndices = startEndAdrs[0].Split('_');
          string[] endCellIndices = startEndAdrs[1].Split('_');
          int startRow = int.Parse(startCellIndices[0]);
          int startCol = int.Parse(startCellIndices[1]);
          int endRow = int.Parse(endCellIndices[0]);
          int endCol = int.Parse(endCellIndices[1]);

          string[] valueListForEachRow = valuesToWrite.Branch(i)[j].Split('|');
          object[,] cellValues = new object[valueListForEachRow.Length, valueListForEachRow[0].Split('_').Length];
          for (int m = 0; m < valueListForEachRow.Length; m++)
          {
            string[] singleValuesOfEachRow = valueListForEachRow[m].Split('_');
            for (int n = 0; n < singleValuesOfEachRow.Length; n++)
            {
              cellValues[m, n] = singleValuesOfEachRow[n];
            }
          }
          Excel.Range startRange = (Excel.Range) worksheetToWrite.Cells[startRow, startCol];
          Excel.Range endRange = (Excel.Range) worksheetToWrite.Cells[endRow, endCol];
          Excel.Range writeRange = (Excel.Range) worksheetToWrite.Range[startRange, endRange];
          writeRange.Value = cellValues;
          writeRange.NumberFormat = "General";

        }


      }
    }
    //workbook.Save();

    // read data from Excel sheets
    Excel.Worksheet worksheetToRead = (Excel.Worksheet) workbook.Sheets[sheetNameToRead];
    DataTree<string> readValues = new DataTree<string>();

    for (int i = 0; i < row_clnToRead.Count; i++)
    {
      string[] startEndAdrs = row_clnToRead[i].Split('|');
      string[] startCellIndices = startEndAdrs[0].Split('_');
      string[] endCellIndices = startEndAdrs[1].Split('_');
      int startRow = int.Parse(startCellIndices[0]);
      int startCol = int.Parse(startCellIndices[1]);
      int endRow = int.Parse(endCellIndices[0]);
      int endCol = int.Parse(endCellIndices[1]);

      Excel.Range startRange = (Excel.Range) worksheetToRead.Cells[startRow, startCol];
      Excel.Range endRange = (Excel.Range) worksheetToRead.Cells[endRow, endCol];
      Excel.Range readRange = (Excel.Range) worksheetToRead.Range[startRange, endRange];
      object[,] values = (object[,]) readRange.Value2;

      for (int m = 1; m <= values.GetLength(0); m++)
      {
        string readValueRow = "";
        for (int n = 1; n <= values.GetLength(1); n++)
        {
          if (values[m, n] != null && n == 1)
            readValueRow += values[m, n].ToString();
          else if (values[m, n] != null && n != 1)
            readValueRow += "_" + values[m, n].ToString();
          else
            readValueRow += "_ _";
        }
        readValues.Add(readValueRow, new GH_Path(i));
      }
    }
    CellValueStringlist = readValues;

    WorkBook = workbook;
    ExcelApp = excelApp;

    if(closeApp)
      CloseExcel();
# ---------- c_script_12: C# additional code ----------
  string[][] currentValues = { new string[3] { "","","" }, new string[7]{"","","","","","",""} };


  private Excel.Application excelApp = null;
  private Excel.Workbook workbook = null;


  private void InitializeExcel(string filePath)
  {
    if (excelApp == null)
    {
      excelApp = new Excel.Application
        {
          Visible = false,
          ScreenUpdating = false,
          DisplayAlerts = false,
          EnableEvents = false,
          };
    }
    if (workbook == null)
    {
      workbook = excelApp.Workbooks.Open(
        filePath,
        ReadOnly: false,
      Editable: true,
      Notify: false,
      CorruptLoad: Excel.XlCorruptLoad.xlNormalLoad,
      IgnoreReadOnlyRecommended: true,
      AddToMru: false,
      Local: false
      );
    }
  }


  public void CloseExcel()
  {
    if (workbook != null)
    {
      workbook.Close(false);
      Marshal.ReleaseComObject(workbook);
      workbook = null;
    }
    if (excelApp != null)
    {
      excelApp.Quit();
      Marshal.ReleaseComObject(excelApp);
      excelApp = null;
    }
  }
# ---------- end c_script_12 ----------
c_script_13 = CSharpScript(
    closeApp=Toggle(False),
    workbook=c_script_12.WorkBook,
    excelapp=c_script_12.ExcelApp,
    Reference="C:\Users\Asus\AppData\Roaming\Grasshopper\Libraries\MITACS folder\Microsoft.Office.Interop.Excel.dll")  # -> out; inputs closeApp: Boolean
# ---------- c_script_13: C# ----------
    if(closeApp)
      CloseExcel((Excel.Workbook) workbook, (Excel.Application) excelapp);
# ---------- c_script_13: C# additional code ----------
  //private Excel.Application excelApp = null;
  //private Excel.Workbook workbook = null;



  public void CloseExcel(Excel.Workbook workbook, Excel.Application excelApp)
  {
    if (workbook != null)
    {
      workbook.Save();
      workbook.Close(false);
      Marshal.ReleaseComObject(workbook);
      workbook = null;


    }
    if (excelApp != null)
    {
      excelApp.Quit();
      Marshal.ReleaseComObject(excelApp);
      excelApp = null;
    }
  }
# ---------- end c_script_13 ----------
split_6 = TextSplit(Text=c_script_12.CellValueStringlist, Separators="_")
c_script_14 = CSharpScript(x=split_6)  # -> out, A; inputs x: String
# ---------- c_script_14: C# ----------
      A = Math.Round(double.Parse(x), 2);
# ---------- end c_script_14 ----------

# ----
cluster_5 = Cluster_2(D=c_script_14.A)

# ---- group: RH_OUT:energy_results
txt_20 = Text(cluster_5)

# ==== cluster Cluster
se_threshold = Slider(250, range=0..1000)
relay = ClusterInput()
relay_2 = ClusterInput()
c_script = CSharpScript(x=relay, y=se_threshold)  # -> out, A; inputs x: Double, y: Double
# ---------- c_script: C# ----------
    if(x>=y)
      A = 1;
    else
      A = 0;
# ---------- end c_script ----------
larger = LargerThan(FirstNumber=relay_2, SecondNumber=0.5)  # -> LargerThan, OrEqualTo
larger_2 = LargerThan(FirstNumber=c_script.A, SecondNumber=0)  # -> LargerThan, OrEqualTo
int = Integer(larger.LargerThan)
cull = CullPattern(List=c_script.A, CullPattern=larger_2.LargerThan)
lng = ListLength(List=cull)
lng_2 = ListLength(List=c_script.A)
I = ClusterInput()
I_2 = ClusterInput()
avr = Average(Input=int)
division = Division(A=lng, B=lng_2)
avr_2 = Average(Input=I)
S = Scope(1)
avr_3 = Average(Input=I_2)
multiplication = Multiplication(A=division, B=100)
multiplication_2 = Multiplication(A=avr, B=100)
multiplication_3 = Multiplication(A=avr_2, B=100)
c_script_2 = CSharpScript(Number=avr_3, Scope=S)  # -> out, A; inputs Number: Double, Scope: Double
# ---------- c_script_2: C# usings ----------
using System.IO;
using System.Linq;
using System.Data;
using System.Drawing;
using System.Reflection;
using System.Windows.Forms;
using System.Xml;
using System.Xml.Linq;
using System.Runtime.InteropServices;

using Rhino.DocObjects;
using Rhino.Collections;
using GH_IO;
using GH_IO.Serialization;
# ---------- c_script_2: C# ----------
    double x = Number;
    double y = Scope;
    double Divide = x / y;
    double wholeDiv = Math.Round(Divide);
    A = Scope * wholeDiv;
# ---------- end c_script_2 ----------
c_script_3 = CSharpScript(Number=multiplication_2, Scope=S)  # -> out, A; inputs Number: Double, Scope: Double; same code as c_script_2
c_script_4 = CSharpScript(Number=multiplication, Scope=S)  # -> out, A; inputs Number: Double, Scope: Double; same code as c_script_2
null = NullItem(Item=avr_3)  # -> NullFlags, InvalidFlags, Description
c_script_5 = CSharpScript(Number=multiplication_3, Scope=S)  # -> out, A; inputs Number: Double, Scope: Double; same code as c_script_2
null_2 = NullItem(Item=avr_2)  # -> NullFlags, InvalidFlags, Description
null_3 = NullItem(Item=division)  # -> NullFlags, InvalidFlags, Description
null_4 = NullItem(Item=avr)  # -> NullFlags, InvalidFlags, Description
filter = StreamFilter(Gate=null.NullFlags, Stream0=c_script_2.A, Stream1="0")
filter_2 = StreamFilter(Gate=null_3.NullFlags, Stream0=c_script_4.A, Stream1="0")
filter_3 = StreamFilter(Gate=null_4.NullFlags, Stream0=c_script_3.A, Stream1="0")
filter_4 = StreamFilter(Gate=null_2.NullFlags, Stream0=c_script_5.A, Stream1="0")
merge = Merge(Data1=flatten(filter_3), Data2=flatten(filter_2), Data3=flatten(filter_4), Data4=flatten(filter))
c_script_6 = CSharpScript(x=merge, y=["0", "0", "0", "0"])  # -> out, A; inputs x: Double, y: Double
# ---------- c_script_6: C# ----------
    if(x == null){
      A = y;}
    else
      A = x;
# ---------- end c_script_6 ----------
format = Format(Format="{0}: {1} {2}", Culture=127, Data0=["sDA", "ASE", "UDIa", "MI"], Data1=c_script_6.A, Data2=["%", "%", "%", "lux"])
T = ClusterOutput(format)

# ==== cluster Cluster_2
D = ClusterInput()
flip = FlipMatrix(Data=D)
cull_i = CullIndex(List=flip, Indices=12, Wrap=True)
item = ListItem(List=flip, Index=12, Wrap=True)  # -> flatten(Item)
ma = MassAddition(Input=cull_i)  # -> flatten(Result), PartialResults
ma_2 = MassAddition(Input=item)  # -> Result, PartialResults
c_script = CSharpScript(Number=ma.Result, Scope=0.1)  # -> out, A; inputs Number: Double, Scope: Double; same code as c_script_2
c_script_2 = CSharpScript(Number=ma_2.Result, Scope=0.01)  # -> out, A; inputs Number: Double, Scope: Double; same code as c_script_2
format = Format(Format="{0} : {1} kwh", Culture=127, Data0=["Heating", "Cooling"], Data1=c_script.A)
format_2 = Format(Format="Energy Need : {0}", Culture=127, Data0=c_script_2.A)
merge = Merge(Data1=flatten(format_2), Data2=flatten(format))
R = ClusterOutput(merge)

# ==== cluster Cluster_3
y = ClusterInput()
relay = ClusterInput()
c_script = CSharpScript(x=relay, y=y)  # -> out, A; inputs x: tree, y: list
# ---------- c_script: C# ----------
    if(x.DataCount > 0)
      A = y;
    else
      A = z;
# ---------- end c_script ----------
crv = Curve(c_script.A)
branch = TreeBranch(Tree=simplify(relay), Path="{13}", MaintainPaths=True)
Z = UnitZ(Factor=1)
len = Length(Curve=crv)
vrot = Rotate(Vector=graft(crv), Axis=Z, Angle=[1.570796327, -1.570796327])
curvepoint = PointOnCurve(crv, parameter=0.5)
join = JoinCurves(Curves=crv, Preserve=False)

# ---- group: Wall Areas
multiplication = Multiplication(A=len, B=branch)

# ----
addition = Addition(A=graft(curvepoint), B=vrot)
boundary = BoundarySurfaces(Edges=join)
pull = PullPoint(Point=addition, Geometry=boundary, ClosestOnly=True)  # -> ClosestPoint, Distance
sort = SortList(Keys=pull.Distance, ValuesA=vrot)  # -> Keys, ValuesA
item = ListItem(List=reverse(sort.ValuesA), Index=0, Wrap=True)
Y = UnitY(Factor=-1)
pl = ConstructPlane(Origin=Point(0, 0, 0), XAxis=Vector(-1, 0, 0), YAxis=Vector(0, 1, 0))
angle = Angle(VectorA=item, VectorB=Y, Plane=pl)  # -> Angle, Reflex
pi = Pi(Factor=1)
B = B(8)
division = Division(A=pi, B=B)
series = Series(Start=0, Step=division, Count=expr("(x*2)+1", B))
branch_2 = TreeBranch(Tree=relay, Path="{2}", MaintainPaths=True)
consec = ConsecutiveDomains(Numbers=series, Additive=False)
shift = ShiftList(List=consec, Shift=-1, Wrap=True)
multiplication_2 = Multiplication(A=multiplication, B=branch_2)
fdom = FindDomain(Domains=shift, Number=flatten(angle.Angle), Strict=False)  # -> Index, Neighbour
panel = Panel("""S
SE
E
NE
N
NW
W
SW""")
division_2 = Division(A=fdom.Index, B=2)
round = Round(Number=division_2)  # -> Nearest, Floor, Ceiling
c_script_2 = CSharpScript(x=round.Floor, z=multiplication, u=multiplication_2, y=panel)  # -> out, Wall, Win; inputs x: list of Int32, z: list of Double, u: list of Double, y: list of String
# ---------- c_script_2: C# ----------
    if(x.Count != z.Count)return;
    List<string> strList1 = new List <string>();
    List<string> strList2 = new List <string>();

    for(int i = 0 ;i < y.Count;i++){
      double win = 0;
      double wall = 0;
      for(int j = 0 ;j < x.Count;j++){
        if(x[j] == i){
          wall += z[j];
          win += u[j];
        }
      }
      double n1;
      double n2;
      if(wall != 0){
        n1 = Math.Round(wall, 2);
      }
      else{
        n1 = 0;
      }
      if(win != 0){
        n2 = Math.Round(win, 2);
      }
      else{
        n2 = 0;
      }
      strList1.Add(y[i] + "=" + n1.ToString());
      strList2.Add(y[i] + "=" + n2.ToString());
    }
    Wall = strList1;
    Win = strList2;
# ---------- end c_script_2 ----------
c_script_3 = CSharpScript(x=round.Floor, z=branch_2, y=panel)  # -> out, A, B; inputs x: list of Int32, z: list of Double, y: list of String
# ---------- c_script_3: C# ----------
    if(x.Count != z.Count)return;
    List<string> strList = new List <string>();
    for(int i = 0 ;i < y.Count;i++){
      int n = 0;
      double wwr = 0;
      for(int j = 0 ;j < x.Count;j++){
        if(x[j] == i){
          n++;
          wwr += z[j];
        }
      }
      double n1;
      if(wwr != 0){
        n1 = Math.Round(wwr / n, 2);
      }
      else{
        n1 = 0;
      }
      strList.Add(y[i] + "=" + n1.ToString());
    }
    A = strList;
# ---------- end c_script_3 ----------

# ---- group: WWR
A = ClusterOutput()  # disabled

# ----
split = TextSplit(Text=c_script_2.Win, Separators="=")  # -> simplify(Result)
split_2 = TextSplit(Text=c_script_2.Wall, Separators="=")  # -> simplify(Result)
item_2 = ListItem(List=reverse(split_2), Index=0, Wrap=True)
item_3 = ListItem(List=reverse(split), Index=0, Wrap=True)
wall = Text(item_2)
win = Text(item_3)
wall_2 = ClusterOutput(wall)
win_2 = ClusterOutput(win)
panel_2 = Panel(item_3)

# ==== cluster Cluster_4
G = ClusterInput()
T = ClusterInput()
area = Area(Geometry=G)  # -> Area, Centroid
branch = TreeBranch(Tree=simplify(T), Path="{13}", MaintainPaths=True)
multiplication = Multiplication(A=area.Area, B=branch)
R = ClusterOutput(multiplication)
A = ClusterOutput(area.Area)
B = ClusterOutput(branch)

# ==== cluster Cluster_5
G = ClusterInput()
area = Area(Geometry=G)  # -> Area, Centroid
xy = XYPlane(Origin=area.Centroid)
planesrf = PlaneSurface(Plane=xy, XSize=Domain(-500, 500), YSize=Domain(-500, 500))
mplane = MeshPlane(Boundary=planesrf, WidthCount=10, HeightCount=10)  # -> Mesh, Area
demesh = DeconstructMesh(Mesh=mplane.Mesh)  # -> Vertices, Faces, Colours, Normals
item = ListItem(List=demesh.Vertices, Index=0, Wrap=True)
pdecon = Deconstruct(Point=item)  # -> XComponent, YComponent, ZComponent
Z = ClusterOutput(pdecon.ZComponent)
