# Grasshopper definition ParametricRoom-RC-V2.gh (Grasshopper 1.0.7)
# plug-ins: ShapeDiverForGrasshopper, PW_AI, MetaHopper, Weaverbird

footprint = Curve(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)
zone = GetGeometry(footprint, AtLeast=1, AtMost=1, DeleteInput=False, Filter=1074004029, TreeAccess=False)
panel = Panel("C:\Users\abuzr\Documents\Projects\Mitacs2023\Unicorn\bin\Debug\net48\CAN_BC_Vancouver.Harbour.CS.712010_TMYx.2004-2018.epw")
weather_file = Text("C:\Users\Asus\Desktop\EPW\CAN_BC_Vancouver.Harbour.CS.712010_TMYx.2004-2018\CAN_BC_Vancouver.Harbour.CS.712010_TMYx.2004-2018.epw")
mbox = MeshBox(
    Base={Plane=PlaneXY(100000000, 100000000, 100000000), X=Domain(-2, 2), Y=Domain(-0.5, 0.5), Z=Domain(0, 0.25)},
    XCount=1,
    YCount=1,
    ZCount=1)
number_of_floors = Slider(20, range=0..100)
explode = Explode(Curve=zone, Recursive=True)  # -> Segments, Vertices
list_length = ListLength(List=explode.Segments)
panel_2 = Panel("""0.65
0.65
0.65
0.65""")
sddp = ShapeDiverDocumentPayload({AbsoluteTolerance=0, AngleTolerance=0, DistanceDisplayPrecision=0, GltfVersion="Gltf2", GrasshopperVersion="1.0.0007", InputGroups="{}", OutputGroups="{}", RelativeTolerance=0, RhinoVersion="7.37.24107.15001", UnitSystem=0, VersionCreated="1.13.1.0", VersionSaved="1.15.0.0"})
terrain = Slider(0, range=0..2)
heat_capacity = Slider(0, range=0..2)
heat_source = Slider(0, range=0..2)
hot_water_source = Slider(0, range=0..2)
building_height = Slider(3.2, range=0..10)
building_type = Slider(0, range=0..6)
ceiling_reflectance = Slider(0.7, range=0..1)
floor_reflectance = Slider(0.2, range=0..1)
wall_reflectance = Slider(0.4, range=0..1)
glazing_reflectance = Slider(0.3, range=0..1)
wall_r_value = Slider(30, range=0..100)
roof_r_value = Slider(20, range=0..100)
sensor_grid_size = Slider(2, range=0..2)
weather_file_2 = Text(panel)

# ---- group: UnitConvertor to Meters
c_script = CSharpScript()  # -> out, A
# ---------- c_script: C# ----------
   // Rhino.RhinoDoc.ActiveDoc.AdjustModelUnitSystem(UnitSystem.Meters, false);
# ---------- end c_script ----------

# ----
panel_3 = Panel("""0
0
0
0""")

# ---- group: num walls
num_walls = Number(list_length)

# ----
duplicate_data = DuplicateData(Data="0.65", Number=num_walls, Order=True)
duplicate_data_2 = DuplicateData(Data="0.0", Number=num_walls, Order=True)
path = FilePath("C:\Users\Asus\Desktop\EPW\CAN_BC_Vancouver.Harbour.CS.712010_TMYx.2004-2018\CAN_BC_Vancouver.Harbour.CS.712010_TMYx.2004-2018.epw")
duplicate_data_3 = DuplicateData(Data="0.0", Number=num_walls, Order=True)
panel_5 = Panel("""0.5
0.00
0.00
0.00""")
horizontalshadings_multiplier = GetNumber(duplicate_data_2, AtLeast=1, AtMost=1, Maximum=1.797693135e+308, Minimum=-1.797693135e+308, TreeAccess=False)
verticalshadings_multiplier = GetNumber(duplicate_data_2, AtLeast=1, AtMost=1, Maximum=1.797693135e+308, Minimum=-1.797693135e+308, TreeAccess=False)
win_u_val = GetNumber(Slider(2.2, range=0..10), AtLeast=1, AtMost=1, Maximum=1.797693135e+308, Minimum=-1.797693135e+308, TreeAccess=False)
win_shgc = GetNumber(Slider(0.3, range=0..1), AtLeast=1, AtMost=1, Maximum=1.797693135e+308, Minimum=-1.797693135e+308, TreeAccess=False)
interior_walls = GetGeometry(AtLeast=1, AtMost=1, DeleteInput=False, Filter=1074004029, TreeAccess=False)
hot_water_source_2 = GetInteger(hot_water_source, AtLeast=1, AtMost=1, Maximum=2147483647, Minimum=-2147483648, TreeAccess=False)
context = GetGeometry(mbox, AtLeast=1, AtMost=1, DeleteInput=False, Filter=1074004029, TreeAccess=False)
terrain_2 = GetInteger(terrain, AtLeast=1, AtMost=1, Maximum=2147483647, Minimum=-2147483648, TreeAccess=False)
heat_capacity_2 = GetInteger(heat_capacity, AtLeast=1, AtMost=1, Maximum=2147483647, Minimum=-2147483648, TreeAccess=False)
heat_source_2 = GetInteger(heat_source, AtLeast=1, AtMost=1, Maximum=2147483647, Minimum=-2147483648, TreeAccess=False)
building_type_2 = GetInteger(building_type, AtLeast=1, AtMost=1, Maximum=2147483647, Minimum=-2147483648, TreeAccess=False)
ceiling_reflectance_2 = GetNumber(ceiling_reflectance, AtLeast=1, AtMost=1, Maximum=1.797693135e+308, Minimum=-1.797693135e+308, TreeAccess=False)
floor_reflectance_2 = GetNumber(floor_reflectance, AtLeast=1, AtMost=1, Maximum=1.797693135e+308, Minimum=-1.797693135e+308, TreeAccess=False)
wall_reflectance_2 = GetNumber(wall_reflectance, AtLeast=1, AtMost=1, Maximum=1.797693135e+308, Minimum=-1.797693135e+308, TreeAccess=False)
glazing_transparency = GetNumber(glazing_reflectance, AtLeast=1, AtMost=1, Maximum=1.797693135e+308, Minimum=-1.797693135e+308, TreeAccess=False)
wall_r_val = GetNumber(wall_r_value, AtLeast=1, AtMost=1, Maximum=1.797693135e+308, Minimum=-1.797693135e+308, TreeAccess=False)
# ground r value set to defaul 0.2
roof_r_val = GetNumber(roof_r_value, AtLeast=1, AtMost=1, Maximum=1.797693135e+308, Minimum=-1.797693135e+308, TreeAccess=False)
floor_to_floor = GetNumber(building_height, AtLeast=1, AtMost=1, Maximum=1.797693135e+308, Minimum=-1.797693135e+308, TreeAccess=False)
horizontalshadings_depth = GetNumber(duplicate_data, AtLeast=1, AtMost=1, Maximum=1.797693135e+308, Minimum=-1.797693135e+308, TreeAccess=False)
number_of_floors_2 = GetInteger(number_of_floors, AtLeast=1, AtMost=1, Maximum=2147483647, Minimum=-2147483648, TreeAccess=False)
verticalshadings_depth = GetNumber(duplicate_data, AtLeast=1, AtMost=1, Maximum=1.797693135e+308, Minimum=-1.797693135e+308, TreeAccess=False)
c_script_2 = CSharpScript(x=duplicate_data_3)  # -> out, A; inputs x: list of Double
# ---------- c_script_2: C# ----------
    if(x != null && x.Count > 0)
    {
      x[0] = 0.5;
    }
    A = x;
# ---------- end c_script_2 ----------
grid_size = GetNumber(sensor_grid_size, AtLeast=1, AtMost=1, Maximum=1.797693135e+308, Minimum=-1.797693135e+308, TreeAccess=False)
weather_file_3 = GetFilePath(weather_file_2, AtLeast=1, AtMost=1, TreeAccess=False)
wwr_per_wall = GetNumber(c_script_2.A, AtLeast=1, AtMost=1, Maximum=1.797693135e+308, Minimum=-1.797693135e+308, TreeAccess=False)
num = Number([0.6096, 1.2192, 1.8288])
floor_type = Slider(0, range=0..6)
item = ListItem(List=num, Index=grid_size, Wrap=True)
cluster = Cluster_6(crv=explode.Segments)
c_script_3 = CSharpScript(
    footprint=zone,
    interiorWalls=interior_walls,
    WWRPerWall=wwr_per_wall,
    verticalFnCnts=verticalshadings_multiplier,
    verticalFnDps=verticalshadings_depth,
    horizontalFnCnts=horizontalshadings_multiplier,
    horizontalFnDps=horizontalshadings_depth,
    terrain=terrain_2,
    heatCapacity=heat_capacity_2,
    heatingSource=heat_source_2,
    hotWaterSource=hot_water_source_2,
    height=floor_to_floor,
    floorProgram=building_type_2,
    floorType=floor_type,
    ceilingReflectance=ceiling_reflectance_2,
    floorReflectance=floor_reflectance_2,
    wallReflectance=wall_reflectance_2,
    glazingReflectance=glazing_transparency,
    wallRValue=wall_r_val,
    roofRValue=roof_r_val,
    groundRValue=Slider(20, range=0..100),
    winUValue=win_u_val,
    winSHGC=win_shgc)  # -> out, ZoneOutline, SurfaceFloor, MeshFloor, MeshCeiling, MeshExteriorWalls, BrepExteriorWalls, MeshExteriorWallsSplit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; inputs footprint: Curve, interiorWalls: list of Curve, WWRPerWall: list of Double, verticalFnCnts: list of Int32, verticalFnDps: list of Double, horizontalFnCnts: list of Int32, horizontalFnDps: list of Double, terrain: String, heatCapacity: String, heatingSource: String, hotWaterSource: String, height: Double, floorProgram: Double, floorType: Double, ceilingReflectance: Double, floorReflectance: Double, wallReflectance: Double, glazingReflectance: Double, wallRValue: Double, roofRValue: Double, groundRValue: Double, winUValue: Double, winSHGC: Double
# ---------- c_script_3: C# usings ----------
using System.Linq;
# ---------- c_script_3: C# ----------
    bool verticalFnOnOff = verticalFnCnts.Any(n => n != 0);
    bool horizontalFnOnOff = horizontalFnCnts.Any(n => n != 0);

    if(footprint == null || !footprint.IsClosed )return;


    ///////////////////////Generating data

    //if(wallcount != WWRPerWall.Count )
    {
      allData.Clear();
      allCurves.Clear();

      for(int i = 0 ;i < WWRPerWall.Count ;i++){

        allData.Add("0", new GH_Path(2));
        allData.Add("0", new GH_Path(3));
        allData.Add("0", new GH_Path(4));
        allData.Add("0", new GH_Path(5));
        allData.Add("0", new GH_Path(6));
        allData.Add("0", new GH_Path(7));
        allData.Add("0", new GH_Path(8));
        if(i == 0){
          allCurves.Add(footprint, new GH_Path(0));
          allCurves.AddRange(interiorWalls, new GH_Path(1));

          allData.Add(terrain.ToString(), new GH_Path(9));
          allData.Add(heatCapacity.ToString(), new GH_Path(10));
          allData.Add(heatingSource.ToString(), new GH_Path(11));
          allData.Add(hotWaterSource.ToString(), new GH_Path(12));

          allData.Add(height.ToString(), new GH_Path(13));
          allData.Add(floorProgram.ToString(), new GH_Path(14));
          allData.Add(floorType.ToString(), new GH_Path(15));
          allData.Add(ceilingReflectance.ToString(), new GH_Path(16));
          allData.Add(floorReflectance.ToString(), new GH_Path(17));
          allData.Add(wallReflectance.ToString(), new GH_Path(18));
          allData.Add(glazingReflectance.ToString(), new GH_Path(19));
          allData.Add(wallRValue.ToString(), new GH_Path(20));
          allData.Add(roofRValue.ToString(), new GH_Path(21));
          allData.Add(winUValue.ToString(), new GH_Path(22));
          allData.Add(winSHGC.ToString(), new GH_Path(23));
        }
      }
    }


    wallcount = WWRPerWall.Count;
    debug1 = allCurves;


    for(int i = 0 ;i < WWRPerWall.Count ;i++){

      allCurves[new GH_Path(0), 0] = footprint;

      allCurves.RemovePath(new GH_Path(1));
      allCurves.AddRange(interiorWalls, new GH_Path(1));
      debug2 = allCurves;
      if(WWRPerWall[i] > 0){
        allData[new GH_Path(2), i] = WWRPerWall[i].ToString();
        allData[new GH_Path(3), i] = verticalFnOnOff.ToString();
        allData[new GH_Path(4), i] = verticalFnCnts[i].ToString();
        allData[new GH_Path(5), i] = verticalFnDps[i].ToString();
        allData[new GH_Path(6), i] = horizontalFnOnOff.ToString();
        allData[new GH_Path(7), i] = horizontalFnCnts[i].ToString();
        allData[new GH_Path(8), i] = horizontalFnDps[i].ToString();
      }

      allData[new GH_Path(9), 0] = terrain.ToString();
      allData[new GH_Path(10), 0] = heatCapacity.ToString();
      allData[new GH_Path(11), 0] = heatingSource.ToString();
      allData[new GH_Path(12), 0] = hotWaterSource.ToString();

      allData[new GH_Path(13), 0] = height.ToString();
      allData[new GH_Path(14), 0] = floorProgram.ToString();
      allData[new GH_Path(15), 0] = floorType.ToString();
      allData[new GH_Path(16), 0] = ceilingReflectance.ToString();
      allData[new GH_Path(17), 0] = floorReflectance.ToString();
      allData[new GH_Path(18), 0] = wallReflectance.ToString();
      allData[new GH_Path(19), 0] = glazingReflectance.ToString();
      allData[new GH_Path(20), 0] = wallRValue.ToString();
      allData[new GH_Path(21), 0] = roofRValue.ToString();
      allData[new GH_Path(22), 0] = winUValue.ToString();
      allData[new GH_Path(23), 0] = winSHGC.ToString();
    }



    /////////////////////Generating Frames and fins

    List<Curve> AllClosedCurves = new List<Curve> ();
    AllClosedCurves.Add(allCurves[new GH_Path(0), 0]);
    foreach(Curve c in interiorWalls){
      if(c.IsClosed){
        List<Point3d> cornerPoints = new List<Point3d> ();
        cornerPoints.AddRange(c.ToNurbsCurve().GrevillePoints());
        foreach(Point3d pt in cornerPoints){
          if(footprint.Contains(pt, Plane.WorldXY, 0.01) == Rhino.Geometry.PointContainment.Inside){
            AllClosedCurves.Add(c);
          }
        }
      }
    }

    Brep FloorBrep = Brep.CreatePlanarBreps(AllClosedCurves, 0.01)[0].DuplicateBrep();
    Mesh floorM = Mesh.CreateFromBrep(FloorBrep, MeshingParameters.FastRenderMesh)[0];
    Mesh ceilingM = floorM.DuplicateMesh();
    ceilingM.Translate(Vector3d.ZAxis * Convert.ToDouble(allData[new GH_Path(13), 0]));
    MeshFloor = floorM;
    MeshCeiling = ceilingM;
    SurfaceFloor = FloorBrep;

    //////Ceiling and Floor geometry without holes
    Brep solidFloorBrep = Brep.CreatePlanarBreps(allCurves[new GH_Path(0), 0], 0.01)[0].DuplicateBrep();
    Mesh solidFloorM = Mesh.CreateFromBrep(solidFloorBrep, MeshingParameters.FastRenderMesh)[0];
    Mesh solidCeilingM = solidFloorM.DuplicateMesh();
    solidCeilingM.Translate(Vector3d.ZAxis * Convert.ToDouble(allData[new GH_Path(13), 0]));
    SolidMeshFloor = solidFloorM;
    SolidMeshCeiling = solidCeilingM;




    List<Mesh> porousWalls = new List<Mesh>();Mesh solidWalls = new Mesh(); List<Brep> solidWallsBrep = new List<Brep>();
    List<Brep> porousWallsBrep = new List<Brep>();

    List<double> wwrForEachWall = new List<double>();

    Mesh AllFrames = new Mesh();Mesh AllVrtFins = new Mesh();Mesh AllHrzFins = new Mesh();
    List<Brep> AllFramesBrep = new List<Brep>();DataTree<Brep> AllVrtFinsBrep = new DataTree<Brep>();DataTree<Brep> AllHrzFinsBrep = new DataTree<Brep>();
    List<Mesh> AllWalls = new List<Mesh>();
    List<Brep> AllWallsBrep = new List<Brep>();

    Mesh mesh = new Mesh();Mesh VrtFins = new Mesh(); Mesh HrzFins = new Mesh();
    Brep brepFrame = new Brep();Brep BrepVrtFins = new Brep(); Brep BrepHrzFins = new Brep();
    List<double> verticalSpacingNumbers = new List<double>();
    List<double> horizontalSpacingNumbers = new List<double>();
    List<double> verticalFinsDepth = new List<double>();List<double> horizontalFinsDepth = new List<double>();
    List<Mesh> allWindows = new List<Mesh>();
    double verticalSpacing = 0;double horizontalSpacing = 0; Vector3d normalVector = new Vector3d();
    List<Curve> allSegments1 = new List<Curve> ();
    allSegments1.AddRange(allCurves[new GH_Path(0), 0].DuplicateSegments());
    List<Curve> allSegments2 = new List<Curve> ();
    double minLng = 3;
    TWWR = 0;


    if(allSegments1.Count != WWRPerWall.Count)return; /////Checkkkk


    A = FloorBrep;


    for(int i = 0 ;i < allSegments1.Count ;i++){
      TWWR += Convert.ToDouble(allData[new GH_Path(2), i]) / allSegments1.Count * 1.0;
      Curve cr = allSegments1[i];
      cr.Domain = new Interval(0, 1);

      /////////////////////////////////Generating objects for energy performance
      if(Convert.ToDouble(allData[new GH_Path(2), i]) > 0){
        Mesh w = new Mesh();
        Brep b = new Brep();
        GenerateInteriorWalls(FloorBrep, cr, Convert.ToDouble(allData[new GH_Path(13), 0]), out w, out b);
        porousWalls.Add(w); porousWallsBrep.Add(b);
        wwrForEachWall.Add(Convert.ToDouble(allData[new GH_Path(2), i]));
        AllWalls.Add(w);
        AllWallsBrep.Add(b);
      }
      else
      {
        Mesh w = new Mesh();Brep b = new Brep();
        GenerateInteriorWalls(FloorBrep, cr, Convert.ToDouble(allData[new GH_Path(13), 0]), out w, out b);
        solidWalls.Append(w);
        solidWallsBrep.Add(b);
        AllWalls.Add(w);
        AllWallsBrep.Add(b);
      }
      ///////////////////////



      double crvLength = cr.PointAtStart.DistanceTo(cr.PointAtEnd);
      int crvDivision = (int) Math.Ceiling(crvLength / minLng);
      Mesh win = new Mesh();

      if(crvDivision == 1){
        GenerateFrame(FloorBrep, cr, Convert.ToDouble(allData[new GH_Path(2), i]), Convert.ToDouble(allData[new GH_Path(13), 0]), verticalFnOnOff, Convert.ToInt32(allData[new GH_Path(4), i]),
          Convert.ToDouble(allData[new GH_Path(5), i]), horizontalFnOnOff, Convert.ToInt32(allData[new GH_Path(7), i]), Convert.ToDouble(allData[new GH_Path(8), i]), out mesh,
          out VrtFins, out  HrzFins, out verticalSpacing, out horizontalSpacing, out normalVector, out win, out brepFrame, out BrepVrtFins, out  BrepHrzFins);


        if(mesh.IsValid)
          AllFrames.Append(mesh);
        string t;
        if(brepFrame.IsValidGeometry(out t))
          AllFramesBrep.Add(brepFrame);

        if(VrtFins.IsValid)
          AllVrtFins.Append(VrtFins);
        if(VrtFins.IsValid)
          AllVrtFinsBrep.Add(BrepVrtFins, new GH_Path(i));

        if(HrzFins.IsValid)
          AllHrzFins.Append(HrzFins);
        if(HrzFins.IsValid)
          AllHrzFinsBrep.Add(BrepHrzFins, new GH_Path(i));

        if(Convert.ToDouble(allData[new GH_Path(2), i]) > 0){
          verticalSpacingNumbers.Add(verticalSpacing);
          horizontalSpacingNumbers.Add(horizontalSpacing);
          allWindows.Add(win);

          if(verticalFnOnOff == false)
            verticalFinsDepth.Add(0);
          else
            verticalFinsDepth.Add(Convert.ToDouble(allData[new GH_Path(5), i]));

          if(horizontalFnOnOff == false)
            horizontalFinsDepth.Add(0);
          else
            horizontalFinsDepth.Add(Convert.ToDouble(allData[new GH_Path(8), i]));
        }
      }
      else{
        List<double> tParameters = new List<double> ();
        List<Curve> splittedCurves = new List<Curve> ();
        for(int j = 0 ;j < crvDivision ;j++)
          tParameters.Add(j * (1.0 / crvDivision * 1.0));
        splittedCurves.AddRange(cr.Split(tParameters));

        List<Brep> BrepWallSegments = new List<Brep>();
        List<Brep> BrepVerticalFinsSegments = new List<Brep>();
        List<Brep> BrepHorzintalFinsSegments = new List<Brep>();

        for(int k = 0 ;k < splittedCurves.Count ;k++){


          GenerateFrame(FloorBrep, splittedCurves[k], Convert.ToDouble(allData[new GH_Path(2), i]), Convert.ToDouble(allData[new GH_Path(13), 0]), verticalFnOnOff, Convert.ToInt32(allData[new GH_Path(4), i]),
            Convert.ToDouble(allData[new GH_Path(5), i]), horizontalFnOnOff, Convert.ToInt32(allData[new GH_Path(7), i]), Convert.ToDouble(allData[new GH_Path(8), i]), out mesh, out VrtFins, out  HrzFins, out verticalSpacing, out horizontalSpacing, out normalVector
            , out win, out brepFrame, out BrepVrtFins, out  BrepHrzFins);

          string t;
          if(mesh.IsValidWithLog(out t))
            AllFrames.Append(mesh);
          if(brepFrame.IsValidGeometry(out t))
            BrepWallSegments.Add(brepFrame);

          if(VrtFins.IsValidWithLog(out t))
            AllVrtFins.Append(VrtFins);
          if(BrepVrtFins.IsValidGeometry(out t))
            BrepVerticalFinsSegments.Add(BrepVrtFins);

          if(HrzFins.IsValidWithLog(out t))
            AllHrzFins.Append(HrzFins);
          if(BrepHrzFins.IsValidGeometry(out t))
            BrepHorzintalFinsSegments.Add(BrepHrzFins);

          if(Convert.ToDouble(allData[new GH_Path(2), i]) > 0){
            verticalSpacingNumbers.Add(verticalSpacing);
            horizontalSpacingNumbers.Add(horizontalSpacing);
            allWindows.Add(win);
            if(verticalFnOnOff == false)
              verticalFinsDepth.Add(0);
            else
              verticalFinsDepth.Add(Convert.ToDouble(allData[new GH_Path(5), i]));
            if(horizontalFnOnOff == false)
              horizontalFinsDepth.Add(0);
            else
              horizontalFinsDepth.Add(Convert.ToDouble(allData[new GH_Path(8), i]));
          }
        }
        AllFramesBrep.AddRange(Brep.JoinBreps(BrepWallSegments, 0.01));
        AllVrtFinsBrep.AddRange(Brep.JoinBreps(BrepVerticalFinsSegments, 0.01), new GH_Path(i));
        AllHrzFinsBrep.AddRange(Brep.JoinBreps(BrepHorzintalFinsSegments, 0.01), new GH_Path(i));





      }

    }

    ///////////////////////Generating Interior Walls
    Mesh interiorWallMesh = new Mesh();
    List<Brep> interiorWallBrep = new List<Brep>();


    if(interiorWalls.Count > 0){

      foreach(Curve crv in interiorWalls){
        List<Curve> allSegments = new List<Curve> ();
        allSegments.AddRange(crv.DuplicateSegments());

        for(int i = 0 ;i < allSegments.Count ;i++){
          Curve cr = allSegments[i];
          Mesh m = new Mesh();Brep b = new Brep();
          GenerateInteriorWalls(FloorBrep, cr, Convert.ToDouble(allData[new GH_Path(13), 0]), out m, out b);
          interiorWallMesh.Append(m);
          interiorWallBrep.Add(b);
        }
      }
    }


    MeshExteriorWalls = AllFrames;
    BrepExteriorWalls = AllFramesBrep;
    MeshExteriorWallsSplit = AllWalls;
    if(AllVrtFins.Vertices.Count > 0){
      MeshVerticalFins = AllVrtFins;
      BrepVerticalFins = AllVrtFinsBrep;
    }
    if(AllHrzFins.Vertices.Count > 0){
      MeshHorizontalFins = AllHrzFins;
      BrepHorizontalFins = AllHrzFinsBrep;
    }
    MeshInteriorWalls = interiorWallMesh;;
    BrepInteriorWalls = interiorWallBrep;;
    VerticalFinsSpacing = verticalSpacingNumbers;
    HorizontalFinsSpacing = horizontalSpacingNumbers;
    AlternativeData1 = allData;
    AlternativeData2 = allCurves;
    MeshWindows = allWindows;
    TotalWWR = RoundNumber(TWWR, 0.01);
    VerticalFinsDepth = verticalFinsDepth;
    HorizontalFinsDepth = horizontalFinsDepth;
    PorousWalls = porousWalls;
    WwrForEachWall = wwrForEachWall;
    SolidWalls = solidWalls;
    ZoneOutline = allSegments1;
# ---------- c_script_3: C# additional code ----------
  double TWWR = 0;
  int wallcount = 0;
  DataTree<string> allData = new DataTree<string>();
  DataTree<Curve> allCurves = new DataTree<Curve>();

  List<double> VrtFinDep = new List<double>();
  List<int> VrtFinCnt = new List<int>();

  List<double> HrzFinDep = new List<double>();
  List<int> HrzFinCnt = new List<int>();


  public void GenerateFrame (Brep floor, Curve crv, double WWR, double height, bool verticalFnOnOff, int verticalFnCnt, double verticalFnDp, bool horizontalFnOnOff, int horizontalFnCnt,
    double horizontalFnDp, out Mesh Frame, out Mesh VrtFins, out Mesh HrzFins, out double verticalSpacing, out double horizontalSpacing, out Vector3d normalVector,
  out Mesh window, out Brep BrepFrame, out Brep BrepVrtFins, out Brep BrepHrzFins){


    ///////////////////////////////Generating frame Mesh
    Frame = new Mesh();
    BrepFrame = new Brep();
    Curve crv1 = crv.DuplicateCurve();
    Curve crv2 = crv.DuplicateCurve();
    crv1.Domain = new Interval(0, 1);
    Point3d midPt = crv1.PointAt(0.5) + new Vector3d(0, 0, height / 2);
    var tr1 = Rhino.Geometry.Transform.Scale(midPt, Math.Sqrt(WWR));
    crv2.Transform(tr1);
    Point3d p1 = crv1.PointAtStart; Point3d p2 = crv1.PointAtEnd;
    Point3d p4 = crv2.PointAtStart; Point3d p3 = crv2.PointAtEnd;
    Frame.Vertices.Add(p1);
    Frame.Vertices.Add(p2);
    Frame.Vertices.Add(p3);
    Frame.Vertices.Add(p4);


    var tr2 = Rhino.Geometry.Transform.Translation(new Vector3d(0, 0, height));
    Curve crvTop = crv.DuplicateCurve();
    crvTop.Transform(tr2);
    Curve crv3 = crvTop.DuplicateCurve();
    Curve crv4 = crvTop.DuplicateCurve();
    crv1.Domain = new Interval(0, 1);
    midPt = crv1.PointAt(0.5) + new Vector3d(0, 0, height / 2);
    crv4.Transform(tr1);
    Point3d p5 = crv3.PointAtStart; Point3d p6 = crv3.PointAtEnd;
    Point3d p8 = crv4.PointAtStart; Point3d p7 = crv4.PointAtEnd;
    Frame.Vertices.Add(p5);
    Frame.Vertices.Add(p6);
    Frame.Vertices.Add(p7);
    Frame.Vertices.Add(p8);

    if(WWR > 0.01){
      Frame.Faces.AddFace(new MeshFace(0, 1, 2, 3));
      Frame.Faces.AddFace(new MeshFace(4, 5, 6, 7));
      Frame.Faces.AddFace(new MeshFace(1, 5, 6, 2));
      Frame.Faces.AddFace(new MeshFace(4, 0, 3, 7));
      Frame.UnifyNormals();
    }
    else
      Frame.Faces.AddFace(new MeshFace(0, 1, 5, 4));

    Frame = repairMesh(Frame);
    BrepFrame = Brep.CreateFromMesh(Frame, true);

    ////////////////////////////////Normal Vector
    Vector3d vr1 = p2 - p1;
    vr1.Unitize();
    vr1.Rotate(0.5 * Math.PI, Vector3d.ZAxis);
    Vector3d vr2 = -1 * vr1;
    Point3d[] testPs = new Point3d[2] {(p1 + p2) / 2 + (0.1 * vr1),(p1 + p2) / 2 + (0.1 * vr2)};
    Vector3d[] testVs = new Vector3d[2] {vr1,vr2};
    double[] testDs = new double[2] {testPs[0].DistanceTo(floor.ClosestPoint(testPs[0])),testPs[1].DistanceTo(floor.ClosestPoint(testPs[1]))};
    Array.Sort(testDs, testVs);

    normalVector = testVs[1];

    /////////////////////////////Defining objects
    window = new Mesh();
    verticalSpacing = 0;
    VrtFins = new Mesh();
    BrepVrtFins = new Brep();
    horizontalSpacing = 0;
    HrzFins = new Mesh();
    BrepHrzFins = new Brep();
    //////////////////////////////Generating windows
    if(WWR > 0){
      window.Vertices.Add(p3);
      window.Vertices.Add(p4);
      window.Vertices.Add(p8);
      window.Vertices.Add(p7);
      window.Faces.AddFace(new MeshFace(0, 1, 2, 3));

      /////////////////////////verticalSpacing

      if(verticalFnCnt < 2)
        verticalSpacing = p3.DistanceTo(p4);
      else
        verticalSpacing = p3.DistanceTo(p4) / verticalFnCnt * 1.0;

      if(verticalFnOnOff){
        ///////////////////////VerticalFinMesh
        verticalFnCnt--;
        for(int i = 0;i <= verticalFnCnt ;i++){
          double step = 1.0 / verticalFnCnt * 1.0;
          Point3d topPt = (p3 * (i * step)) + (p4 * (1 - (i * step)));
          Point3d bottomPt = (p7 * (i * step)) + (p8 * (1 - (i * step)));
          VrtFins.Vertices.Add(topPt);
          VrtFins.Vertices.Add(bottomPt);
          VrtFins.Vertices.Add(topPt + testVs[1] * verticalFnDp);
          VrtFins.Vertices.Add(bottomPt + testVs[1] * verticalFnDp);
          VrtFins.Faces.AddFace((4 * i) + 0, (4 * i) + 1, (4 * i) + 3, (4 * i) + 2);
        }
        if(VrtFins.IsValid)
          VrtFins = repairMesh(VrtFins);
        if(VrtFins.IsValid)
          BrepVrtFins = Brep.CreateFromMesh(VrtFins, true);
      }

      ////////////////////////horizontalSpacing
      if(horizontalFnCnt < 2)
        horizontalSpacing = p3.DistanceTo(p7);
      else
        horizontalSpacing = p3.DistanceTo(p7) / horizontalFnCnt * 1.0;

      if(horizontalFnOnOff){
        ////////////////////////////////horizontalFinMesh
        for(int i = 0;i < horizontalFnCnt ;i++){
          double step = 1.0 / horizontalFnCnt * 1.0;
          Point3d leftPt = (p3 * (i * step)) + (p7 * (1 - (i * step)));
          Point3d rightPt = (p4 * (i * step)) + (p8 * (1 - (i * step)));
          HrzFins.Vertices.Add(leftPt);
          HrzFins.Vertices.Add(rightPt);
          HrzFins.Vertices.Add(leftPt + testVs[1] * horizontalFnDp);
          HrzFins.Vertices.Add(rightPt + testVs[1] * horizontalFnDp);
          HrzFins.Faces.AddFace((4 * i) + 0, (4 * i) + 1, (4 * i) + 3, (4 * i) + 2);
        }
        if(HrzFins.IsValid)
          HrzFins = repairMesh(HrzFins);
        if(HrzFins.IsValid)
          BrepHrzFins = Brep.CreateFromMesh(HrzFins, true);

      }
    }

  }

  public Mesh repairMesh(Mesh invalidMesh){
    invalidMesh.Vertices.CombineIdentical(true, true);
    invalidMesh.Faces.CullDegenerateFaces();
    invalidMesh.UnifyNormals();
    invalidMesh.RebuildNormals();
    invalidMesh.Compact();
    return invalidMesh;
  }


  public void GenerateInteriorWalls (Brep floor, Curve crv, double height, out Mesh intWallMesh, out Brep intWallBrep){

    Mesh InetriorWall = new Mesh();
    Point3d midPt = (crv.PointAtStart + crv.PointAtEnd) * 0.5;
    double testDs = midPt.DistanceTo(floor.ClosestPoint(midPt));
    if(testDs < 1){

      Point3d p1 = crv.PointAtStart; Point3d p2 = crv.PointAtEnd;
      Point3d p3 = crv.PointAtStart + Vector3d.ZAxis * height; Point3d p4 = crv.PointAtEnd + Vector3d.ZAxis * height;
      InetriorWall.Vertices.Add(p1);
      InetriorWall.Vertices.Add(p2);
      InetriorWall.Vertices.Add(p4);
      InetriorWall.Vertices.Add(p3);
      InetriorWall.Faces.AddFace(new MeshFace(0, 1, 2, 3));

      InetriorWall = repairMesh(InetriorWall);
      intWallMesh = InetriorWall;
      intWallBrep = Brep.CreateFromMesh(InetriorWall, true);
    }
    else{
      intWallMesh = null;
      intWallBrep = null;
    }
  }

  public double RoundNumber (double Number, double Scope){
    double Divide = Number / Scope;
    double wholeDiv = Math.Round(Divide);
    return Scope * wholeDiv;
  }






  /// <summary>
  /// This method will be called once every solution, before any calls to RunScript.
  /// </summary>
  public override void BeforeRunScript()
  { }
  /// <summary>
  /// This method will be called once every solution, after any calls to RunScript.
  /// </summary>
  public override void AfterRunScript()
  { }


  //Return a BoundingBox that contains all the geometry you are about to draw.
  public override BoundingBox ClippingBox
  {
    get
    {
      return BoundingBox.Empty;
    }
  }

  //Draw all meshes in this method.
  public override void DrawViewportMeshes(IGH_PreviewArgs args)
  {
  }

  //Draw all wires and points in this method.
  public override void DrawViewportWires(IGH_PreviewArgs args)
  {
  }
# ---------- end c_script_3 ----------

# ---- group: RH_OUT:wall_facing_directions
integer = Integer(cluster)

# ----
relay = Relay([c_script_3.AlternativeData2, c_script_3.AlternativeData1])
mjoin = MeshJoin(Meshes=[c_script_3.MeshExteriorWalls, c_script_3.MeshInteriorWalls])

enable_energy = BooleanToggle(True)
enable_daylight = BooleanToggle(True)
enable_daylight_2 = GetBoolean(enable_daylight, AtLeast=1, AtMost=1, FalseValue="False", TreeAccess=False, TrueValue="True")
enable_energy_2 = GetBoolean(enable_energy, AtLeast=1, AtMost=1, FalseValue="False", TreeAccess=False, TrueValue="True")
onoff = EnableDisableObject(Enabled=enable_daylight_2)
onoff_2 = EnableDisableObject(Enabled=enable_energy_2)

mesh = Mesh(c_script_3.MeshInteriorWalls)
data = Data(relay)

brep = Brep(c_script_3.BrepVerticalFins)
brep_2 = Brep(c_script_3.BrepHorizontalFins)
clean = CleanTree(RemoveNulls=True, RemoveInvalid=True, RemoveEmpty=False, Tree=brep)
srf = Surface(c_script_3.BrepInteriorWalls)
brep_3 = Brep(c_script_3.BrepExteriorWalls)
clean_2 = CleanTree(RemoveNulls=True, RemoveInvalid=True, RemoveEmpty=False, Tree=brep_2)

# ---- group: Energy / 30-4-2024
txt = Text(Tree({0}: ["0.045962|11.84029|4.413199|0.257708"], {1}: ["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"], {2}: ["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"]))
txt_2 = Text(Tree({0}: ["0.051129|6.888896|7.965286|8.340905"], {1}: ["15.6_15.6_24_24|15.6_15.6_24_24|15.6_15.6_24_24|15.6_15.6_24_24|17.8_17.8_24_24|20_20_24_24|21_21_24_24|21_21_24_24|21_21_24_24|21_21_24_24|21_21_24_24|21_21_24_24|21_21_24_24|21_21_24_24|21_21_24_24|21_21_24_24|21_21_24_24|21_15.6_24_24|21_15.6_24_24|21_15.6_24_24|21_15.6_24_24|21_15.6_24_24|15.6_15.6_24_24|15.6_15.6_24_24"], {2}: ["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"]))
txt_3 = Text(Tree({0}: ["0.051129|9.364593|7.965286|1.291949"], {1}: ["15.6_15.6_26.7_26.7|15.6_15.6_26.7_26.7|15.6_15.6_26.7_26.7|15.6_15.6_26.7_26.7|15.6_15.6_26.7_26.7|17.8_17.8_25.6_25.7|20_20_25_25|21_21_24_24|21_21_24_24|21_21_24_24|21_21_24_24|21_21_24_24|21_21_24_24|21_21_24_24|21_21_24_24|21_21_24_24|21_21_24_24|21_15.6_24_26.7|21_15.6_24_26.7|21_15.6_24_26.7|21_15.6_24_26.7|21_15.6_24_26.7|15.6_15.6_26.7_26.7|15.6_15.6_26.7_26.7"], {2}: ["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"]))
txt_4 = Text(Tree({0}: ["0.051129|9.364593|7.965286|0.022217"], {1}: ["15.56_15.56_29.44_29.44|15.56_15.56_29.44_29.44|15.56_15.56_29.44_29.44|15.56_15.56_29.44_29.44|15.56_15.56_29.44_29.44|15.56_15.56_29.44_29.44|21.11_21.11_23.89_23.89|21.11_21.11_23.89_23.89|21.11_21.11_23.89_23.89|21.11_21.11_23.89_23.89|21.11_21.11_23.89_23.89|21.11_21.11_23.89_23.89|21.11_21.11_23.89_23.89|21.11_21.11_23.89_23.89|21.11_21.11_23.89_23.89|21.11_21.11_23.89_23.89|21.11_21.11_23.89_23.89|21.11_21.11_23.89_23.89|21.11_21.11_29.44_29.44|15.56_15.56_29.44_29.44|15.56_15.56_29.44_29.44|15.56_15.56_29.44_29.44|15.56_15.56_29.44_29.44|15.56_15.56_29.44_29.44"], {2}: ["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"]))
txt_5 = Text(Tree({0}: ["0.028309|6.669994|6.45834|0.149258"], {1}: ["21.7_21.7_24.4_24.4|21.7_21.7_24.4_24.4|21.7_21.7_24.4_24.4|21.7_21.7_24.4_24.4|21.7_21.7_24.4_24.4|21.7_21.7_24.4_24.4|21.7_21.7_24.4_24.4|21.7_21.7_24.4_24.4|21.7_21.7_24.4_24.4|21.7_21.7_24.4_24.4|21.7_21.7_24.4_24.4|21.7_21.7_24.4_24.4|21.7_21.7_24.4_24.4|21.7_21.7_24.4_24.4|21.7_21.7_24.4_24.4|21.7_21.7_24.4_24.4|21.7_21.7_24.4_24.4|21.7_21.7_24.4_24.4|21.7_21.7_24.4_24.4|21.7_21.7_24.4_24.4|21.7_21.7_24.4_24.4|21.7_21.7_24.4_24.4|21.7_21.7_24.4_24.4|21.7_21.7_24.4_24.4"], {2}: ["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"]))
txt_6 = Text(Tree({0}: ["0.376737|9.999663|7.642369|0.94112"], {1}: ["15.6_15.6_24_24|15.6_15.6_24_24|15.6_15.6_24_24|15.6_15.6_24_24|15.6_15.6_24_24|15.6_15.6_24_24|17.8_17.8_24_24|20_20_24_24|21_21_24_24|21_21_24_24|21_21_24_24|21_21_24_24|21_21_24_24|21_21_24_24|21_21_24_24|21_21_24_24|21_21_24_24|21_21_24_24|21_21_24_24|21_21_24_24|21_21_24_24|15.6_15.6_24_24|15.6_15.6_24_24|15.6_15.6_24_24"], {2}: ["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"]))
txt_7 = Text(Tree({0}: ["0.038427|6.748965|4.413199|0.121267"], {1}: ["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"], {2}: ["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"]))
txt_8 = Text(Tree({0}: ["0.028309|6.669994|6.45834|0.149258"], {1}: ["21.7_21.7_24.4_24.4|21.7_21.7_24.4_24.4|21.7_21.7_24.4_24.4|21.7_21.7_24.4_24.4|21.7_21.7_24.4_24.4|21.7_21.7_24.4_24.4|21.7_21.7_24.4_24.4|21.7_21.7_24.4_24.4|21.7_21.7_24.4_24.4|21.7_21.7_24.4_24.4|21.7_21.7_24.4_24.4|21.7_21.7_24.4_24.4|21.7_21.7_24.4_24.4|21.7_21.7_24.4_24.4|21.7_21.7_24.4_24.4|21.7_21.7_24.4_24.4|21.7_21.7_24.4_24.4|21.7_21.7_24.4_24.4|21.7_21.7_24.4_24.4|21.7_21.7_24.4_24.4|21.7_21.7_24.4_24.4|21.7_21.7_24.4_24.4|21.7_21.7_24.4_24.4|21.7_21.7_24.4_24.4"], {2}: ["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"]))
txt_9 = Text(Tree({0}: ["0.269098|14.999495|7.642369|1.12574"], {1}: ["15.6_15.6_26.7_26.7|15.6_15.6_26.7_26.7|15.6_15.6_26.7_26.7|15.6_15.6_26.7_26.7|15.6_15.6_26.7_26.7|15.6_15.6_26.7_26.7|21_21_24_24|21_21_24_24|21_21_24_24|21_21_24_24|21_21_24_24|21_21_24_24|21_21_24_24|21_21_24_24|21_21_24_24|21_21_24_24|21_21_24_24|21_21_24_24|21_21_24_24|21_21_24_24|21_21_24_24|15.6_15.6_26.7_26.7|15.6_15.6_26.7_26.7|15.6_15.6_26.7_26.7"], {2}: ["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"]))
entwine = Entwine(
    Branch00=txt_2,
    Branch01=txt_3,
    Branch02=txt_4,
    Branch03=txt_5,
    Branch04=txt_8,
    Branch05=txt_9,
    Branch06=txt_6,
    Branch07=txt,
    Branch08=txt_7,
    FlattenInputs=True)  # -> simplify(Result)

# ---- group: Energy / Volume
cluster_2 = Cluster_5(A=number_of_floors_2, T=data)  # -> R_2, R_3, R

# ----
cluster_3 = Cluster_3(G=c_script_3.SurfaceFloor)

# ---- group: Daylight
mesh_2 = Mesh(graft(c_script_3.MeshWindows))
branch = TreeBranch(Tree=data, Path="{19}", MaintainPaths=True)
branch_2 = TreeBranch(Tree=data, Path="{16}", MaintainPaths=True)
branch_3 = TreeBranch(Tree=data, Path="{17}", MaintainPaths=True)
updatesensorgrid = Text(item)
branch_4 = TreeBranch(Tree=data, Path="{18}", MaintainPaths=True)
transparent_object = ConstructTransparentDaylightObjectPWAIV0400(
    GlazingGeometry=mesh_2,
    TransparencyValue=branch,
    ShadingDepth=simplify(graft(c_script_3.HorizontalFinsDepth)),
    ShadingSpacing=simplify(graft(c_script_3.HorizontalFinsSpacing)),
    ShadingType="horizontal",
    GenerateShadingGeometries=True)  # -> GlazingDaylighObject, ShadingDeviceGeometry
transparent_object_2 = ConstructTransparentDaylightObjectPWAIV0400(
    GlazingGeometry=simplify(mesh_2),
    TransparencyValue=branch,
    ShadingDepth=simplify(graft(c_script_3.VerticalFinsDepth)),
    ShadingSpacing=simplify(graft(c_script_3.VerticalFinsSpacing)),
    ShadingType="vertical",
    GenerateShadingGeometries=True)  # -> GlazingDaylighObject, ShadingDeviceGeometry
opaque_object = ConstructOpaqueDaylightObjectPWAIV0400(BuildingGeometry=c_script_3.MeshFloor, ReflectanceValue=branch_3)
analysis_grid = ConstructAnalysisGridPWAIV0502(FloorPlane=c_script_3.SurfaceFloor, GridSpacing=updatesensorgrid)
opaque_object_2 = ConstructOpaqueDaylightObjectPWAIV0400(BuildingGeometry=c_script_3.MeshCeiling, ReflectanceValue=branch_2)
opaque_object_3 = ConstructOpaqueDaylightObjectPWAIV0400(BuildingGeometry=mjoin, ReflectanceValue=branch_4)
opaque_object_4 = ConstructOpaqueDaylightObjectPWAIV0400(BuildingGeometry=context, ReflectanceValue=Slider(0.5, range=0..1))  # -> flatten(OpaqueDaylightObject)
dl_obj = DaylightObjectPWAIV0400(flatten([opaque_object_2, opaque_object, opaque_object_3, transparent_object_2.GlazingDaylighObject, transparent_object.GlazingDaylighObject]))
toggle = BooleanToggle(True)
toggle_2 = BooleanToggle(True)
toggle_3 = BooleanToggle(True)
predict_daylight = PredictDaylightMetricsFromGeometryMaterialsAndWeatherDataPWAIV0500(
    AnalysisGrid=analysis_grid,
    BuildingDaylightObjects=dl_obj,
    SurroundingDaylightObjects=opaque_object_4,
    GroundElevation=cluster_3,
    PathOfEpwFile=weather_file_3,
    ComputeSolution=enable_daylight_2,
    PredictDA=toggle_2,
    PredictSE=toggle_3,
    PredictMI=toggle_2,
    PredictUDI=toggle_3,
    NumberOfThreads=-1)  # -> PredictedDaylightAutonomy_sensor_array, PredictedSunlightExposure_sensor_array, PredictedMeanIlluminance_sensor_array, PredictedUsefulDaylightIlluminanceFailing_sensor_array, PredictedUsefulDaylightIlluminanceSupplementary_sensor_array, PredictedUsefulDaylightIlluminanceAcceptable_sensor_array, PredictedUsefulDaylightIlluminanceExcessive_sensor_array

# ----
cluster_4 = Cluster(
    relay_2=predict_daylight.PredictedDaylightAutonomy_sensor_array,
    relay=predict_daylight.PredictedSunlightExposure_sensor_array,
    I=predict_daylight.PredictedUsefulDaylightIlluminanceAcceptable_sensor_array,
    I_2=predict_daylight.PredictedMeanIlluminance_sensor_array)  # -> T, A
demesh = DeconstructMesh(Mesh=analysis_grid)  # -> Vertices, Faces, Colours, Normals
conmesh = ConstructMesh(Vertices=demesh.Vertices, Faces=demesh.Faces)
data_2 = Data(conmesh)
demesh_2 = DeconstructMesh(Mesh=data_2)  # -> Vertices, Faces, Colours, Normals
larger = LargerThan(FirstNumber=predict_daylight.PredictedSunlightExposure_sensor_array, SecondNumber=250)  # -> LargerThan, OrEqualTo
larger_2 = LargerThan(FirstNumber=predict_daylight.PredictedDaylightAutonomy_sensor_array, SecondNumber=0.5)  # -> LargerThan, OrEqualTo
int = Integer(larger_2.LargerThan)
int_2 = Integer(larger.LargerThan)
gradient = Gradient(
    LowerLimit=0,
    UpperLimit=1,
    Parameter=int_2,
    stops=[0: RGB(138, 138, 138), 0: RGB(186, 186, 186), 0: RGB(221, 232, 170), 0: RGB(173, 173, 173), 1: RGB(255, 208, 18)])
gradient_2 = Gradient(
    LowerLimit=0,
    UpperLimit=1,
    Parameter=int,
    stops=[0: RGB(181, 181, 181), 0: RGB(186, 186, 186), 0: RGB(221, 232, 170), 0: RGB(173, 173, 173), 1: RGB(200, 250, 147)])
gradient_3 = Gradient(
    LowerLimit=Slider(3000, range=0..10000),
    UpperLimit=Slider(50, range=0..100),
    Parameter=predict_daylight.PredictedMeanIlluminance_sensor_array,
    stops=[0: RGB(234, 38, 0), 0.25: RGB(234, 126, 0), 0.5: RGB(254, 244, 84), 0.75: RGB(173, 203, 249), 1: RGB(75, 107, 169)])

# ---- group: A place holder mesh for when a daylighting mesh is not present
mesh_3 = Mesh(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)

# ----
data_3 = Data(data_2)
txt_10 = Text([ColourSwatch(SwatchColor=RGB(65, 128, 176)), ColourSwatch(SwatchColor=RGB(117, 186, 163)), ColourSwatch(SwatchColor=RGB(180, 224, 119)), ColourSwatch(SwatchColor=RGB(255, 176, 255))])
c_script_4 = CSharpScript(
    srf=c_script_3.SurfaceFloor,
    sensor=demesh_2.Vertices,
    spacing=updatesensorgrid,
    f=predict_daylight.PredictedUsefulDaylightIlluminanceFailing_sensor_array,
    s=predict_daylight.PredictedUsefulDaylightIlluminanceSupplementary_sensor_array,
    a=predict_daylight.PredictedUsefulDaylightIlluminanceAcceptable_sensor_array,
    e=predict_daylight.PredictedUsefulDaylightIlluminanceExcessive_sensor_array,
    colors=txt_10)  # -> out, A, flatten(B), C; inputs srf: Surface, sensor: Point3d, spacing: Double, f: Double, s: Double, a: Double, e: Double, colors: list of Color
# ---------- c_script_4: C# usings ----------
using Rhino.Geometry.Collections;
# ---------- c_script_4: C# ----------
    Curve crVt = srf.IsoCurve(0, 0);
    Vector3d v1 = crVt.PointAtEnd - crVt.PointAtStart;
    v1.Unitize();
    Vector3d v2 = v1;
    v2.Rotate(-0.5 * Math.PI, Vector3d.ZAxis);



    Mesh Tmesh = new Mesh();

    double totalVal = f + s + a + e;
    f = f / totalVal * spacing;
    s = s / totalVal * spacing;
    a = a / totalVal * spacing;
    e = e / totalVal * spacing;


    Mesh fMesh = new Mesh();
    Point3d p0 = sensor + (v1 * (0.5 * f)) + (v2 * (0.5 * f));
    Point3d p1 = sensor - (v1 * (0.5 * f)) + (v2 * (0.5 * f));
    Point3d p2 = sensor - (v1 * (0.5 * f)) - (v2 * (0.5 * f));
    Point3d p3 = sensor + (v1 * (0.5 * f)) - (v2 * (0.5 * f));
    fMesh.Vertices.Add(p0);
    fMesh.Vertices.Add(p1);
    fMesh.Vertices.Add(p2);
    fMesh.Vertices.Add(p3);
    fMesh.Faces.AddFace(0, 1, 2, 3);
    fMesh.VertexColors.CreateMonotoneMesh(colors[0]);
    fMesh = repairMesh(fMesh);



    Mesh sMesh = new Mesh();
    Point3d p4 = sensor + (v1 * (0.5 * (f + s))) + (v2 * (0.5 * (f + s)));
    Point3d p5 = sensor - (v1 * (0.5 * (f + s))) + (v2 * (0.5 * (f + s)));
    Point3d p6 = sensor - (v1 * (0.5 * (f + s))) - (v2 * (0.5 * (f + s)));
    Point3d p7 = sensor + (v1 * (0.5 * (f + s))) - (v2 * (0.5 * (f + s)));
    sMesh.Vertices.Add(p0);
    sMesh.Vertices.Add(p1);
    sMesh.Vertices.Add(p2);
    sMesh.Vertices.Add(p3);
    sMesh.Vertices.Add(p4);
    sMesh.Vertices.Add(p5);
    sMesh.Vertices.Add(p6);
    sMesh.Vertices.Add(p7);
    sMesh.Faces.AddFace(0, 4, 5, 1);
    sMesh.Faces.AddFace(1, 5, 6, 2);
    sMesh.Faces.AddFace(2, 6, 7, 3);
    sMesh.Faces.AddFace(0, 3, 7, 4);
    sMesh.VertexColors.CreateMonotoneMesh(colors[1]);
    sMesh = repairMesh(sMesh);


    Mesh aMesh = new Mesh();
    Point3d p8 = sensor + (v1 * ( 0.5 * (f + s + a))) + (v2 * (0.5 * (f + s + a)));
    Point3d p9 = sensor - (v1 * (0.5 * (f + s + a))) + (v2 * (0.5 * (f + s + a)));
    Point3d p10 = sensor - (v1 * (0.5 * (f + s + a))) - (v2 * (0.5 * (f + s + a)));
    Point3d p11 = sensor + (v1 * (0.5 * (f + s + a))) - (v2 * (0.5 * (f + s + a)));
    aMesh.Vertices.Add(p4);
    aMesh.Vertices.Add(p5);
    aMesh.Vertices.Add(p6);
    aMesh.Vertices.Add(p7);
    aMesh.Vertices.Add(p8);
    aMesh.Vertices.Add(p9);
    aMesh.Vertices.Add(p10);
    aMesh.Vertices.Add(p11);
    aMesh.Faces.AddFace(0, 4, 5, 1);
    aMesh.Faces.AddFace(1, 5, 6, 2);
    aMesh.Faces.AddFace(2, 6, 7, 3);
    aMesh.Faces.AddFace(0, 3, 7, 4);
    aMesh.VertexColors.CreateMonotoneMesh(colors[2]);
    aMesh = repairMesh(aMesh);


    Mesh eMesh = new Mesh();
    Point3d p12 = sensor + (v1 * (0.5 * (f + s + a + e))) + (v2 * (0.5 * (f + s + a + e)));
    Point3d p13 = sensor - (v1 * (0.5 * (f + s + a + e))) + (v2 * (0.5 * (f + s + a + e)));
    Point3d p14 = sensor - (v1 * (0.5 * (f + s + a + e))) - (v2 * (0.5 * (f + s + a + e)));
    Point3d p15 = sensor + (v1 * (0.5 * (f + s + a + e))) - (v2 * (0.5 * (f + s + a + e)));
    eMesh.Vertices.Add(p8);
    eMesh.Vertices.Add(p9);
    eMesh.Vertices.Add(p10);
    eMesh.Vertices.Add(p11);
    eMesh.Vertices.Add(p12);
    eMesh.Vertices.Add(p13);
    eMesh.Vertices.Add(p14);
    eMesh.Vertices.Add(p15);
    eMesh.Faces.AddFace(0, 4, 5, 1);
    eMesh.Faces.AddFace(1, 5, 6, 2);
    eMesh.Faces.AddFace(2, 6, 7, 3);
    eMesh.Faces.AddFace(0, 3, 7, 4);
    eMesh.VertexColors.CreateMonotoneMesh(colors[3]);
    eMesh = repairMesh(eMesh);


    Tmesh.Append(fMesh);
    Tmesh.Append(sMesh);
    Tmesh.Append(aMesh);
    Tmesh.Append(eMesh);
    Tmesh = repairMesh(Tmesh);


    var lst = new List<System.Drawing.Color>();


    var meshColors = new MeshVertexColorList[]{fMesh.VertexColors, sMesh.VertexColors, aMesh.VertexColors, eMesh.VertexColors};

    for(var m = 0; m < meshColors.Length; m++)
    {
      for(var i = 0; i < meshColors[m].Count;i++)
      {
        lst.Add(meshColors[m][i]);
      }
    }



    var allVertexColors = new List<MeshVertexColorList>();


    allVertexColors.Add(fMesh.VertexColors);
    allVertexColors.Add(sMesh.VertexColors);
    allVertexColors.Add(aMesh.VertexColors);
    allVertexColors.Add(eMesh.VertexColors);



    A = Tmesh;
    B = lst;
    C = allVertexColors;
# ---------- c_script_4: C# additional code ----------
  public Mesh repairMesh(Mesh invalidMesh){
    invalidMesh.Vertices.CombineIdentical(true, true);
    invalidMesh.Faces.CullDegenerateFaces();
    invalidMesh.UnifyNormals();
    invalidMesh.RebuildNormals();
    invalidMesh.Compact();
    return invalidMesh;
  }
# ---------- end c_script_4 ----------
c_script_5 = CSharpScript(mesh=mesh_3)  # -> verticesColors; inputs mesh: Mesh
# ---------- c_script_5: C# ----------
    mesh.VertexColors.CreateMonotoneMesh(System.Drawing.Color.White);

    verticesColors = mesh.VertexColors;
# ---------- end c_script_5 ----------
avr = Average(Input=int_2)  # -> flatten(ArithmeticMean)
mcol = MeshColours(Mesh=data_3, Colours=gradient)
avr_2 = Average(Input=int)  # -> flatten(ArithmeticMean)
mcol_2 = MeshColours(Mesh=data_3, Colours=gradient_2)
unit_z = UnitZ(Factor=10)
mcol_3 = MeshColours(Mesh=data_3, Colours=gradient_3)
ase = Panel(avr)
wbjoin = WeaverbirdsJoinMeshesAndWeld(Mesh=c_script_4.A, Weld=False)
sda = Panel(avr_2)
c_script_6 = CSharpScript(Number=c_script_3.TotalWWR, Scope=0.001)  # -> out, A; inputs Number: Double, Scope: Double
# ---------- c_script_6: C# ----------
    double x = Number;
    double y = Scope;
    double Divide = x / y;
    double wholeDiv = Math.Round(Divide);
    A = "Total WWR:"+Convert.ToString((Scope * wholeDiv) * 100) + " %";
# ---------- end c_script_6 ----------
col = Colour(c_script_5)
c_script_7 = CSharpScript(mesh=wbjoin)  # -> verticesColors; inputs mesh: Mesh
# ---------- c_script_7: C# ----------
    verticesColors = mesh.VertexColors;
# ---------- end c_script_7 ----------
mesh_4 = Mesh(mcol_3)
mesh_5 = Mesh(mcol)
mesh_6 = Mesh(mcol_2)
col_2 = Colour(c_script_5)
c_script_8 = CSharpScript(x=gradient_3, y=col)  # -> out, A
# ---------- c_script_8: C# ----------
    if(x != null)
    {
      A = x;
    }
    else
    {
      A = y;
    }
# ---------- end c_script_8 ----------
int_3 = Integer(Slider(0, range=0..4))
c_script_9 = CSharpScript(x=gradient_2, y=col_2)  # -> out, A
# ---------- c_script_9: C# ----------
    if(x != null)
    {
      A = x;
    }
    else 
    {
      A = y;
    }
# ---------- end c_script_9 ----------
c_script_10 = CSharpScript(x=c_script_7, y=c_script_4.B)  # -> out, A
# ---------- c_script_10: C# ----------
    if(x == null)
    {
      A = y;
    }
    else 
    {
      A = x;
    }
# ---------- end c_script_10 ----------
merge = Merge(Data1=flatten(mesh_6), Data2=flatten(mesh_5), Data3=flatten(wbjoin), Data4=flatten(mesh_4))
entwine_2 = Entwine(Branch00=c_script_9.A, Branch01=gradient, Branch02=c_script_10.A, Branch03=c_script_8.A, FlattenInputs=True)  # -> simplify(Result)
list_item = ListItem(List=merge, Index=int_3, Wrap=True)

# ---- group: RH_OUT:windows_mesh
mesh_7 = Mesh(c_script_3.MeshWindows)

# ----
nullrep = ReplaceNulls(Items=merge, Replacements=mesh_3)  # -> Items, Count

# ---- group: RH_OUT:totalWWR
num_2 = Number(c_script_3.TotalWWR)

# ---- group: RH_OUT:wall_mesh
mesh_8 = Mesh(c_script_3.MeshExteriorWalls)

# ---- group: RH_OUT:VerticalFins_mesh
mesh_9 = Mesh(c_script_3.MeshVerticalFins)

# ---- group: RH_OUT:HorizontalFins_mesh
mesh_10 = Mesh(c_script_3.MeshHorizontalFins)

# ---- group: RH_OUT:walls_mesh
mesh_11 = Mesh(c_script_3.MeshExteriorWallsSplit)

# ---- group: RH_OUT:daylight_results
txt_11 = Text(cluster_4.T)

# ---- group: RH_OUT:DA_all_metrics
num_3 = Number(cluster_4.A)

# ---- group: RH_OUT:all_daylight_colors
all_daylight_colors = Text(entwine_2)

# ---- group: RH_OUT:daylight_meshes
daylight_mesh = Mesh(nullrep.Items)

# ----
mjoin_2 = MeshJoin(Meshes=[mesh_9, mesh_10])
face_boundaries = FaceBoundaries(Mesh=mesh_7)

# ---- group: RH_OUT:daylight_mesh
daylight_mesh_2 = Mesh(list_item)

# ---- group: RH_OUT:walls_brep
geo = Geometry(brep_3)

# ----
panel_7 = Panel(""""sDA"
"ASE"
"UDIa"
"MI"
""")

# ---- group: RH_OUT:shading_mesh
mesh_12 = Mesh(mjoin_2)

# ----
rh_out_interior_walls_mesh = Mesh(mesh)

# ---- group: RH_OUT:energy_results
txt_12 = Text()

# ----
boundary_surfaces = BoundarySurfaces(Edges=face_boundaries)  # -> flatten(Surfaces)
brep_join = BrepJoin(Breps=boundary_surfaces)  # -> Breps, Closed
brep_4 = Brep(brep_join.Breps)

# ---- group: RH_OUT:windows_brep
geo_2 = Geometry(brep_4)

# ---- group: Energy
cluster_5 = Cluster_4(relay=number_of_floors_2, relay_2=data)  # -> A, wall_2, win_2
branch_5 = TreeBranch(Tree=data, Path="{14}", MaintainPaths=True)
txt_13 = Text(["LargeOffice", "MediumOffice", "SmallOffice", "MidriseApartment", "HighriseApartment", "PrimarySchool", "SecondarySchool", "SmallHotel", "LargeHotel"])
panel_8 = Panel("""{20}
{21}
{22}
{23}""")
V = FilePath(weather_file_3)
branch_6 = TreeBranch(Tree=data, Path=panel_8, MaintainPaths=True)
branch_7 = TreeBranch(Tree=entwine, Path=branch_5, MaintainPaths=True)
c_script_11 = CSharpScript(
    path=V,
    Reference=["C:\USERS\ABUZR\APPDATA\ROAMING\GRASSHOPPER\LIBRARIES\MITACS FOLDER\daylight\CsvHelper.dll", "C:\USERS\ABUZR\APPDATA\ROAMING\GRASSHOPPER\LIBRARIES\MITACS FOLDER\daylight\EPWReader.dll"])  # -> out, Location, WeatherDataValues; inputs path: String
# ---------- c_script_11: C# usings ----------
using EPWReader;
using CsvHelper;
# ---------- c_script_11: C# ----------
    EPWeatherData epw = new EPWeatherData(path);
    List<string> locationData = new List<string>();
    locationData.Add(epw.Location.Country.ToString());
    locationData.Add(epw.Location.State.ToString());
    locationData.Add(epw.Location.City.ToString());
    locationData.Add(epw.Location.Longitude.ToString() + "," + epw.Location.Latitude.ToString());
    locationData.Add("Time Zone Offset= " + epw.Location.TimeZoneOffset.ToString());
    locationData.Add("Elevation= " + epw.Location.Elevation.ToString());


    Location = locationData;


    Dictionary<string, List<double>> keyValuePairs = epw.GetHourlyDataFields(new List<string>
      {"DryBulbTemperature",
        "GlobalHorizontalRadiation",
        "DirectNormalRadiation",
        "DiffuseHorizontalRadiation",
        "WindSpeed",
        "RelativeHumidity",
        "AtmoshpericStationPressure",
        "DewPointTemperature",
        "OpaqueSkyCover",
        });
    DataTree<double> weatherDataValues = new DataTree<double> ();
    weatherDataValues.AddRange(keyValuePairs["DryBulbTemperature"], new GH_Path(0));
    weatherDataValues.AddRange(keyValuePairs["GlobalHorizontalRadiation"], new GH_Path(1));
    weatherDataValues.AddRange(keyValuePairs["DirectNormalRadiation"], new GH_Path(2));
    weatherDataValues.AddRange(keyValuePairs["DiffuseHorizontalRadiation"], new GH_Path(3));
    weatherDataValues.AddRange(keyValuePairs["WindSpeed"], new GH_Path(4));
    weatherDataValues.AddRange(keyValuePairs["RelativeHumidity"], new GH_Path(5));
    weatherDataValues.AddRange(keyValuePairs["AtmoshpericStationPressure"], new GH_Path(6));
    weatherDataValues.AddRange(keyValuePairs["DewPointTemperature"], new GH_Path(7));
    weatherDataValues.AddRange(keyValuePairs["OpaqueSkyCover"], new GH_Path(8));


    WeatherDataValues = weatherDataValues;
# ---------- end c_script_11 ----------
c_script_12 = CSharpScript(x=V)  # -> out, ClimateType; inputs x: String
# ---------- c_script_12: C# usings ----------
using System.IO;
using System.Text.RegularExpressions;
# ---------- c_script_12: C# ----------
///*
    string statPath = x.EndsWith(".epw", StringComparison.OrdinalIgnoreCase) ? x.Replace(".epw", ".stat") : x;
    string text = File.ReadAllText(statPath);
    string pattern = @"- Climate Zone ""([A-Za-z0-9]+)""";
    Match match = Regex.Match(text, pattern);
    string climateType = match.Value;
    ClimateType = climateType.Split('"')[1];
# ---------- end c_script_12 ----------
bang = ExplodeTree(Data=branch_6)  # -> Branch0, Branch1, Branch2, Branch3
item_2 = ListItem(List=branch_7, Index=0, Wrap=True)  # -> Item, Item1, Item2
split = TextSplit(Text=item_2.Item, Separators="|")
item_3 = ListItem(List=c_script_11.Location, Index=3, Wrap=True)  # -> Item, Item1
item_4 = ListItem(List=split, Index=0, Wrap=True)  # -> Item, Item1, Item2, Item3
multiplication = Multiplication(A=bang.Branch1, B="0.176228083653")
multiplication_2 = Multiplication(A=bang.Branch0, B="0.176228083653")
split_2 = TextSplit(Text=item_3.Item, Separators=",")
split_3 = TextSplit(Text=item_3.Item1, Separators="=")
one_over_x = OneOverX(Value=item_4.Item)
branch_8 = TreeBranch(Tree=data, Path="{11}", MaintainPaths=True)
branch_9 = TreeBranch(Tree=data, Path="{9}", MaintainPaths=True)
branch_10 = TreeBranch(Tree=data, Path="{10}", MaintainPaths=True)
branch_11 = TreeBranch(Tree=data, Path="{12}", MaintainPaths=True)
item_5 = ListItem(List=reverse(split_3), Index=0, Wrap=True)
item_6 = ListItem(List=split_2, Index=0, Wrap=True)  # -> Item, Item1
c_script_13 = CSharpScript(x=branch_5, y="8.3")  # -> out, A; inputs x: list of Double, y: Double
# ---------- c_script_13: C# ----------
    if(x.Count > 0 )
      A = y;
    else
      A =x;
# ---------- end c_script_13 ----------
c_script_14 = CSharpScript(x=branch_5, y="88")  # -> out, A; inputs x: list of Double, y: Double; same code as c_script_13
item_7 = ListItem(
    List=["Very Light: 80,000 * Af", "Light : 110,000 * Af", "Medium: 165,000 * Af", "Heavy: 260,000 * Af", "Very heavy: 370,000 * Af"],
    Index=branch_10,
    Wrap=True)
item_8 = ListItem(List=["Electricity", "Natural Gas", "Fuel"], Index=branch_11, Wrap=True)
item_9 = ListItem(List=["Electricity", "Natural Gas", "Fuel"], Index=branch_8, Wrap=True)
item_10 = ListItem(List=["Open terrain", "Country", "Urban / City"], Index=branch_9, Wrap=True)
num_4 = Number(item_5)
flip = FlipMatrix(Data=c_script_11.WeatherDataValues)
merge_2 = Merge(Data1=flatten(item_6.Item1), Data2=flatten(item_6.Item), Data3=flatten(num_4), Data4=flatten(c_script_12.ClimateType))
join = TextJoin(Text=flip, Join="_")  # -> flatten(Result)
panel_9 = Panel(merge_2)
join_2 = TextJoin(Text=join, Join="|")  # -> flatten(Result)
join_3 = TextJoin(Text=merge_2, Join="|")  # -> flatten(Result)
merge_3 = Merge(Data1=flatten(join_3), Data2=flatten(join_2))
panel_10 = Panel("""EPW_Data
INPUT""")
panel_11 = Panel("""17_3|20_3
10_7|8769_15""")
panel_12 = Panel("""13_3|18_3
73_3|74_3
10_7|16_7
20_7|43_10
20_13|43_18
50_7|58_9
64_7|68_11""")
entwine_3 = Entwine(Branch0X=panel_11, Branch1X=panel_12, FlattenInputs=False)  # -> simplify(Result)
toggle_4 = BooleanToggle(False)
c_script_15 = CSharpScript(x="MITACS folder\EPC_v_M2.0_EPW Convertor_v1.4.xlsx")  # -> A
# ---------- c_script_15: C# ----------
    A = Grasshopper.Folders.DefaultAssemblyFolder+x;
# ---------- end c_script_15 ----------

# ---- group: Energy / Envelope
panel_13 = Panel("""S
SE
E
NE
N
NW
W
SW
Roof(Hor)""")
txt_14 = Text(flatten(cluster_5.wall_2))
txt_15 = Text(flatten(cluster_5.win_2))
merge_4 = Merge(Data1=flatten(txt_14), Data2=flatten(cluster_2.R))
dup = DuplicateData(Data=0, Number=9, Order=True)  # -> simplify(Data)
merge_5 = Merge(Data1=flatten(txt_15), Data2=flatten(0))
entwine_4 = Entwine(Branch00=merge_4, Branch01=dup, Branch02=merge_5, FlattenInputs=True)  # -> simplify(Result)
flip_2 = FlipMatrix(Data=entwine_4)
join_4 = TextJoin(Text=flip_2, Join="_")  # -> flatten(Result)
join_5 = TextJoin(Text=join_4, Join="|")  # -> flatten(Result)

# ---- group: Energy / Win SHGC
num_5 = Number(bang.Branch3)

# ----
item_11 = ListItem(List=c_script_11.Location, Index=2, Wrap=True)  # -> Item, Item1

# ---- group: Energy / Windows U value
num_6 = Number(bang.Branch2)

# ---- group: Energy
c_script_16 = CSharpScript(x=item_4.Item3, y="0.735")  # -> out, A; inputs x: list of Double, y: Double
# ---------- c_script_16: C# ----------
    if(x.Count > 0 )
      A = x[0] * y;
    else
      A = x;
# ---------- end c_script_16 ----------

# ---- group: Energy / Roof U value
one_over_x_2 = OneOverX(Value=multiplication)

# ---- group: Energy / Wall U value
one_over_x_3 = OneOverX(Value=multiplication_2)

# ---- group: RH_OUT:weather_location
text = Text(item_11.Item)

# ---- group: Energy / Energy Sources
txt_16 = Text(item_9)
txt_17 = Text(item_8)
merge_6 = Merge(Data1=txt_16, Data2=txt_17)  # -> flatten(Result)
join_6 = TextJoin(Text=merge_6, Join="|")  # -> flatten(Result)

# ---- group: Energy / Building General
txt_18 = Text(cluster_2.R_3)
txt_19 = Text(item_10)
txt_20 = Text(cluster_2.R_2)
txt_21 = Text(item_7)
merge_7 = Merge(
    Data1=flatten(txt_19),
    Data2=flatten(txt_20),
    Data3=flatten(txt_18),
    Data4=flatten(""),
    Data5=flatten(""),
    Data6=flatten(txt_21))
join_7 = TextJoin(Text=merge_7, Join="|")  # -> flatten(Result)

# ---- group: Energy / Zone
merge_8 = Merge(
    Data1=flatten(cluster_2.R),
    Data2=flatten(one_over_x),
    Data3=flatten(c_script_14.A),
    Data4=flatten(item_4.Item1),
    Data5=flatten(item_4.Item2),
    Data6=flatten(c_script_13.A),
    Data7=flatten(c_script_16.A))
join_8 = TextJoin(Text=merge_8, Join="|")  # -> flatten(Result)

# ---- group: Energy (continued)
c_script_17 = CSharpScript(SHGC=num_5, U=num_6)  # -> out, A; inputs SHGC: Double, U: Double
# ---------- c_script_17: C# ----------
    if(U>4.5 && SHGC <0.7206)
      A = 0.939998 * Math.Pow(SHGC, 2) + 0.20332 * SHGC;
    if(U > 4.5 && SHGC >= 0.7206)
      A = 1.30415*SHGC  - 0.30515;
    if(U < 3.4 && SHGC <= 0.15)
      A = 0.41040 * SHGC;
    if(U < 3.4 && SHGC > 0.15)
      A = 0.085775 * Math.Pow(SHGC, 2)+ 0.963954 *SHGC -0.084958;
# ---------- end c_script_17 ----------
merge_9 = Merge(Data1=flatten(one_over_x_3), Data2=flatten(0.85), Data3=flatten(0.85), Data4=flatten(0))
merge_10 = Merge(Data1=flatten(one_over_x_2), Data2=flatten(0.85), Data3=flatten(0.85), Data4=flatten(0))
merge_11 = Merge(Data1=flatten(num_6), Data2=flatten(0), Data3=flatten(0.85), Data4=flatten(c_script_17.A))
entwine_5 = Entwine(Branch00=merge_10, Branch01=[0, 0, 0, 0], Branch02=merge_9, Branch03=[0, 0, 0, 0], Branch04=merge_11, FlattenInputs=True)  # -> simplify(Result)
join_9 = TextJoin(Text=entwine_5, Join="_")  # -> flatten(Result)
join_10 = TextJoin(Text=join_9, Join="|")  # -> flatten(Result)
merge_12 = Merge(
    Data1=flatten(join_7),
    Data2=flatten(join_6),
    Data3=flatten(join_8),
    Data4=flatten(item_2.Item1),
    Data5=flatten(item_2.Item2),
    Data6=flatten(join_5),
    Data7=flatten(join_10))
entwine_6 = Entwine(Branch0X=merge_3, Branch1X=merge_12, FlattenInputs=False)  # -> simplify(Result)
c_script_18 = CSharpScript(
    Action=enable_energy_2,
    check=branch_8,
    filePath=c_script_15,
    sheetNameToWrite=panel_10,
    startEndcellsToWrite=entwine_3,
    valuesToWrite=entwine_6,
    sheetNameToRead="RESULT",
    row_clnToRead="13_3|25_4",
    closeApp=Toggle(False),
    Reference="C:\Users\abuzr\AppData\Roaming\Grasshopper\Libraries\MITACS folder\Microsoft.Office.Interop.Excel.dll")  # -> out, CellValueStringlist, WorkBook, ExcelApp; inputs Action: Boolean, check: String, filePath: String, sheetNameToWrite: list, startEndcellsToWrite: tree of String, valuesToWrite: tree of String, row_clnToRead: list of String, closeApp: Boolean
# ---------- c_script_18: C# usings ----------
using Excel = Microsoft.Office.Interop.Excel;
using System.Runtime.InteropServices;
# ---------- c_script_18: C# ----------
    if(!Action || string.IsNullOrEmpty(check) )
      return;

    InitializeExcel(filePath);




    // write data to Excel sheets
    for (int i = 0; i < sheetNameToWrite.Count; i++)
    {
      Excel.Worksheet worksheetToWrite = (Excel.Worksheet) workbook.Sheets[sheetNameToWrite[i]];
      for (int j = 0; j < startEndcellsToWrite.Branch(i).Count; j++)
      {
        ///To check if the values has changed or is not empty
        if(string.IsNullOrEmpty(valuesToWrite[new GH_Path(i), j]) || currentValues[i][j] == valuesToWrite[new GH_Path(i), j])
          continue;
        else
        {
          currentValues[i][j] = valuesToWrite[new GH_Path(i), j];

          string[] startEndAdrs = startEndcellsToWrite.Branch(i)[j].Split('|');
          string[] startCellIndices = startEndAdrs[0].Split('_');
          string[] endCellIndices = startEndAdrs[1].Split('_');
          int startRow = int.Parse(startCellIndices[0]);
          int startCol = int.Parse(startCellIndices[1]);
          int endRow = int.Parse(endCellIndices[0]);
          int endCol = int.Parse(endCellIndices[1]);

          string[] valueListForEachRow = valuesToWrite.Branch(i)[j].Split('|');
          object[,] cellValues = new object[valueListForEachRow.Length, valueListForEachRow[0].Split('_').Length];
          for (int m = 0; m < valueListForEachRow.Length; m++)
          {
            string[] singleValuesOfEachRow = valueListForEachRow[m].Split('_');
            for (int n = 0; n < singleValuesOfEachRow.Length; n++)
            {
              cellValues[m, n] = singleValuesOfEachRow[n];
            }
          }
          Excel.Range startRange = (Excel.Range) worksheetToWrite.Cells[startRow, startCol];
          Excel.Range endRange = (Excel.Range) worksheetToWrite.Cells[endRow, endCol];
          Excel.Range writeRange = (Excel.Range) worksheetToWrite.Range[startRange, endRange];
          writeRange.Value = cellValues;
          writeRange.NumberFormat = "General";

        }


      }
    }
    //workbook.Save();

    // read data from Excel sheets
    Excel.Worksheet worksheetToRead = (Excel.Worksheet) workbook.Sheets[sheetNameToRead];
    DataTree<string> readValues = new DataTree<string>();

    for (int i = 0; i < row_clnToRead.Count; i++)
    {
      string[] startEndAdrs = row_clnToRead[i].Split('|');
      string[] startCellIndices = startEndAdrs[0].Split('_');
      string[] endCellIndices = startEndAdrs[1].Split('_');
      int startRow = int.Parse(startCellIndices[0]);
      int startCol = int.Parse(startCellIndices[1]);
      int endRow = int.Parse(endCellIndices[0]);
      int endCol = int.Parse(endCellIndices[1]);

      Excel.Range startRange = (Excel.Range) worksheetToRead.Cells[startRow, startCol];
      Excel.Range endRange = (Excel.Range) worksheetToRead.Cells[endRow, endCol];
      Excel.Range readRange = (Excel.Range) worksheetToRead.Range[startRange, endRange];
      object[,] values = (object[,]) readRange.Value2;

      for (int m = 1; m <= values.GetLength(0); m++)
      {
        string readValueRow = "";
        for (int n = 1; n <= values.GetLength(1); n++)
        {
          if (values[m, n] != null && n == 1)
            readValueRow += values[m, n].ToString();
          else if (values[m, n] != null && n != 1)
            readValueRow += "_" + values[m, n].ToString();
          else
            readValueRow += "_ _";
        }
        readValues.Add(readValueRow, new GH_Path(i));
      }
    }
    CellValueStringlist = readValues;

    WorkBook = workbook;
    ExcelApp = excelApp;

    if(closeApp)
      CloseExcel();
# ---------- c_script_18: C# additional code ----------
  string[][] currentValues = { new string[3] { "","","" }, new string[7]{"","","","","","",""} };


  private Excel.Application excelApp = null;
  private Excel.Workbook workbook = null;


  private void InitializeExcel(string filePath)
  {
    if (excelApp == null)
    {

      try
      {
        excelApp = (Excel.Application) Marshal.GetActiveObject("Excel.Application");
      }
      catch (COMException ex)
      {
        excelApp = new Excel.Application
          {
            Visible = false,
            ScreenUpdating = false,
            DisplayAlerts = false,
            EnableEvents = false,
            };
      }
    }
    if (workbook == null)
    {

      foreach (Excel.Workbook xlWorkbook in excelApp.Workbooks)
      {
        if (xlWorkbook.FullName == filePath)
        {
          workbook = xlWorkbook;
        }
      }
      if(workbook == null)
      {
        workbook = excelApp.Workbooks.Open(filePath, ReadOnly: false, Editable: true, Notify: false, CorruptLoad: Excel.XlCorruptLoad.xlNormalLoad, IgnoreReadOnlyRecommended: true, AddToMru: false, Local: false);
      }
    }
  }


  public void CloseExcel()
  {
    if (workbook != null)
    {
      workbook.Close(false);
      Marshal.ReleaseComObject(workbook);
      workbook = null;
    }
    if (excelApp != null)
    {
      excelApp.Quit();
      Marshal.ReleaseComObject(excelApp);
      excelApp = null;
    }
  }
# ---------- end c_script_18 ----------
c_script_19 = CSharpScript(
    closeApp=Button(),
    workbook=c_script_18.WorkBook,
    excelapp=c_script_18.ExcelApp,
    Reference="C:\USERS\ABUZR\APPDATA\ROAMING\GRASSHOPPER\LIBRARIES\MITACS FOLDER\Microsoft.Office.Interop.Excel.dll")  # -> out; inputs closeApp: Boolean
# ---------- c_script_19: C# ----------
    if(closeApp)
      CloseExcel((Excel.Workbook) workbook, (Excel.Application) excelapp);
# ---------- c_script_19: C# additional code ----------
  //private Excel.Application excelApp = null;
  //private Excel.Workbook workbook = null;



  public void CloseExcel(Excel.Workbook workbook, Excel.Application excelApp)
  {
    if (workbook != null)
    {
      workbook.Save();
      workbook.Close(false);
      Marshal.ReleaseComObject(workbook);
      workbook = null;


    }
    if (excelApp != null)
    {
      excelApp.Quit();
      Marshal.ReleaseComObject(excelApp);
      excelApp = null;
    }
  }
# ---------- end c_script_19 ----------
split_4 = TextSplit(Text=c_script_18.CellValueStringlist, Separators="_")
c_script_20 = CSharpScript(x=split_4)  # -> out, A; inputs x: String
# ---------- c_script_20: C# ----------
    if(x != null)
    {
          A = Math.Round(double.Parse(x), 2);
    }
    else 
    {
      A = x;
    }
# ---------- end c_script_20 ----------

# ----
cluster_6 = Cluster_2(D=c_script_20.A)  # -> heating_and_cooling_need, heating_need, cooling_need, monthly_loads

# ----
# temporarily adding 0's for the equipment and lighting till we decide about them
panel_14 = Panel("2")
panel_15 = Panel("""0
0""")
python = GhPythonScript(tree=simplify(c_script_20.A), target=12)  # -> out, a; inputs tree: tree
# ---------- python: Python ----------
__author__ = "abuzr"
__version__ = "2024.05.02"

import rhinoscriptsyntax as rs

# delete the target branch
for i in range(0,tree.BranchCount):
    if i==target: tree.RemovePath(i)

    
a = tree
# ---------- end python ----------
ins = InsertItems(List=python.a, Item=panel_15, Indices=panel_14, Wrap=True)
merge_13 = Merge(Data1=cluster_6.heating_need, Data2=cluster_6.cooling_need, Data3="0", Data4="0")

# ---- group: RH_OUT:energy_loads_metric
num_7 = Number(merge_13)

# ---- group: RH_OUT:energy_total_loads_metrics_tree
number = Number(simplify(ins))

# ---- group: RH_OUT:Heating_Need
number_2 = Number(simplify(cluster_6.heating_need))

# ---- group: RH_OUT:Cooling_Need
number_3 = Number(simplify(cluster_6.heating_need))

# ---- group: RH_OUT:Heating&Cooling_Need
num_8 = Number(cluster_6.heating_and_cooling_need)

# ==== cluster Cluster
se_threshold = Slider(250, range=0..1000)
relay = ClusterInput()
relay_2 = ClusterInput()
c_script = CSharpScript(x=relay, y=se_threshold)  # -> out, A; inputs x: Double, y: Double
# ---------- c_script: C# ----------
    if(x>=y)
      A = 1;
    else
      A = 0;
# ---------- end c_script ----------
larger = LargerThan(FirstNumber=relay_2, SecondNumber=0.5)  # -> LargerThan, OrEqualTo
larger_2 = LargerThan(FirstNumber=c_script.A, SecondNumber=0)  # -> LargerThan, OrEqualTo
int = Integer(larger.LargerThan)
cull = CullPattern(List=c_script.A, CullPattern=larger_2.LargerThan)
lng = ListLength(List=cull)
lng_2 = ListLength(List=c_script.A)
I = ClusterInput()
I_2 = ClusterInput()
avr = Average(Input=int)
division = Division(A=lng, B=lng_2)
avr_2 = Average(Input=I)
S = Scope(1)
avr_3 = Average(Input=I_2)
multiplication = Multiplication(A=division, B=100)
multiplication_2 = Multiplication(A=avr, B=100)
multiplication_3 = Multiplication(A=avr_2, B=100)
c_script_2 = CSharpScript(Number=avr_3, Scope=S)  # -> out, A; inputs Number: Double, Scope: Double
# ---------- c_script_2: C# usings ----------
using System.IO;
using System.Linq;
using System.Data;
using System.Drawing;
using System.Reflection;
using System.Windows.Forms;
using System.Xml;
using System.Xml.Linq;
using System.Runtime.InteropServices;

using Rhino.DocObjects;
using Rhino.Collections;
using GH_IO;
using GH_IO.Serialization;
# ---------- c_script_2: C# ----------
    double x = Number;
    double y = Scope;
    double Divide = x / y;
    double wholeDiv = Math.Round(Divide);
    A = Scope * wholeDiv;
# ---------- end c_script_2 ----------
c_script_3 = CSharpScript(Number=multiplication_2, Scope=S)  # -> out, A; inputs Number: Double, Scope: Double; same code as c_script_2
c_script_4 = CSharpScript(Number=multiplication, Scope=S)  # -> out, A; inputs Number: Double, Scope: Double; same code as c_script_2
null = NullItem(Item=avr_3)  # -> NullFlags, InvalidFlags, Description
c_script_5 = CSharpScript(Number=multiplication_3, Scope=S)  # -> out, A; inputs Number: Double, Scope: Double; same code as c_script_2
null_2 = NullItem(Item=avr_2)  # -> NullFlags, InvalidFlags, Description
null_3 = NullItem(Item=division)  # -> NullFlags, InvalidFlags, Description
null_4 = NullItem(Item=avr)  # -> NullFlags, InvalidFlags, Description
filter = StreamFilter(Gate=null.NullFlags, Stream0=c_script_2.A, Stream1="0")
filter_2 = StreamFilter(Gate=null_3.NullFlags, Stream0=c_script_4.A, Stream1="0")
filter_3 = StreamFilter(Gate=null_4.NullFlags, Stream0=c_script_3.A, Stream1="0")
filter_4 = StreamFilter(Gate=null_2.NullFlags, Stream0=c_script_5.A, Stream1="0")
merge = Merge(Data1=flatten(filter_3), Data2=flatten(filter_2), Data3=flatten(filter_4), Data4=flatten(filter))
c_script_6 = CSharpScript(x=merge, y=["0", "0", "0", "0"])  # -> out, A; inputs x: Double, y: Double
# ---------- c_script_6: C# ----------
    if(x == null){
      A = y;}
    else
      A = x;
# ---------- end c_script_6 ----------
format = Format(Format="{0}: {1} {2}", Culture=127, Data0=["sDA", "ASE", "UDIa", "MI"], Data1=c_script_6.A, Data2=["%", "%", "%", "lux"])
A = ClusterOutput(c_script_6.A)
T = ClusterOutput(format)

# ==== cluster Cluster_2
D = ClusterInput()
flip = FlipMatrix(Data=D)
cull_i = CullIndex(List=flip, Indices=12, Wrap=True)
item = ListItem(List=flip, Index=12, Wrap=True)  # -> flatten(Item)
ma = MassAddition(Input=cull_i)  # -> flatten(Result), PartialResults
ma_2 = MassAddition(Input=item)  # -> Result, PartialResults
c_script = CSharpScript(Number=ma.Result, Scope=0.1)  # -> out, A; inputs Number: Double, Scope: Double; same code as c_script_2
c_script_2 = CSharpScript(Number=ma_2.Result, Scope=0.01)  # -> out, A; inputs Number: Double, Scope: Double; same code as c_script_2
format = Format(Format="Energy Need : {0}", Culture=127, Data0=c_script_2.A)
format_2 = Format(Format="{0} : {1} kwh", Culture=127, Data0=["Heating", "Cooling"], Data1=c_script.A)
monthly_loads = ClusterOutput(cull_i)
item_2 = ListItem(List=c_script.A, Index=0, Wrap=True)  # -> Item, Item1
heating_and_cooling_need = ClusterOutput(c_script_2.A)
cooling_need = ClusterOutput(item_2.Item1)
heating_need = ClusterOutput(item_2.Item)

# ==== cluster Cluster_3
G = ClusterInput()
area = Area(Geometry=G)  # -> Area, Centroid
xy = XYPlane(Origin=area.Centroid)
planesrf = PlaneSurface(Plane=xy, XSize=Domain(-500, 500), YSize=Domain(-500, 500))
mplane = MeshPlane(Boundary=planesrf, WidthCount=10, HeightCount=10)  # -> Mesh, Area
demesh = DeconstructMesh(Mesh=mplane.Mesh)  # -> Vertices, Faces, Colours, Normals
item = ListItem(List=demesh.Vertices, Index=0, Wrap=True)
pdecon = Deconstruct(Point=item)  # -> XComponent, YComponent, ZComponent
Z = ClusterOutput(pdecon.ZComponent)

# ==== cluster Cluster_4
relay = ClusterInput()
y = ClusterInput()
relay_2 = ClusterInput()
c_script = CSharpScript(x=relay_2, y=y)  # -> out, A; inputs x: tree, y: list
# ---------- c_script: C# ----------
    if(x.DataCount > 0)
      A = y;
    else
      A = z;
# ---------- end c_script ----------
crv = Curve(c_script.A)
branch = TreeBranch(Tree=simplify(relay_2), Path="{13}", MaintainPaths=True)
Z = UnitZ(Factor=1)
len = Length(Curve=crv)
vrot = Rotate(Vector=graft(crv), Axis=Z, Angle=[1.570796327, -1.570796327])
curvepoint = PointOnCurve(crv, parameter=0.5)
join = JoinCurves(Curves=crv, Preserve=False)

# ---- group: Wall Areas
multiplication = Multiplication(A=len, B=branch)

# ----
addition = Addition(A=graft(curvepoint), B=vrot)
boundary = BoundarySurfaces(Edges=join)
pull = PullPoint(Point=addition, Geometry=boundary, ClosestOnly=True)  # -> ClosestPoint, Distance
sort = SortList(Keys=pull.Distance, ValuesA=vrot)  # -> Keys, ValuesA
item = ListItem(List=reverse(sort.ValuesA), Index=0, Wrap=True)
Y = UnitY(Factor=-1)
pl = ConstructPlane(Origin=Point(0, 0, 0), XAxis=Vector(-1, 0, 0), YAxis=Vector(0, 1, 0))
angle = Angle(VectorA=item, VectorB=Y, Plane=pl)  # -> Angle, Reflex
pi = Pi(Factor=1)
B = B(8)
division = Division(A=pi, B=B)
series = Series(Start=0, Step=division, Count=expr("(x*2)+1", B))
branch_2 = TreeBranch(Tree=relay_2, Path="{2}", MaintainPaths=True)
consec = ConsecutiveDomains(Numbers=series, Additive=False)
shift = ShiftList(List=consec, Shift=-1, Wrap=True)
multiplication_2 = Multiplication(A=multiplication, B=branch_2, C=relay)
multiplication_3 = Multiplication(A=multiplication, B=relay)
fdom = FindDomain(Domains=shift, Number=flatten(angle.Angle), Strict=False)  # -> Index, Neighbour
division_2 = Division(A=fdom.Index, B=2)
round = Round(Number=division_2)  # -> Nearest, Floor, Ceiling
panel = Panel("""S
SE
E
NE
N
NW
W
SW""")
c_script_2 = CSharpScript(x=round.Floor, z=multiplication_3, u=multiplication_2, y=panel)  # -> out, Wall, Win; inputs x: list of Int32, z: list of Double, u: list of Double, y: list of String
# ---------- c_script_2: C# ----------
    if(x.Count != z.Count)return;
    List<string> strList1 = new List <string>();
    List<string> strList2 = new List <string>();

    for(int i = 0 ;i < y.Count;i++){
      double win = 0;
      double wall = 0;
      for(int j = 0 ;j < x.Count;j++){
        if(x[j] == i){
          wall += z[j];
          win += u[j];
        }
      }
      double n1;
      double n2;
      if(wall != 0){
        n1 = Math.Round(wall, 2);
      }
      else{
        n1 = 0;
      }
      if(win != 0){
        n2 = Math.Round(win, 2);
      }
      else{
        n2 = 0;
      }
      strList1.Add(y[i] + "=" + n1.ToString());
      strList2.Add(y[i] + "=" + n2.ToString());
    }
    Wall = strList1;
    Win = strList2;
# ---------- end c_script_2 ----------
c_script_3 = CSharpScript(x=round.Floor, z=branch_2, y=panel)  # -> out, A, B; inputs x: list of Int32, z: list of Double, y: list of String
# ---------- c_script_3: C# ----------
    if(x.Count != z.Count)return;
    List<string> strList = new List <string>();
    for(int i = 0 ;i < y.Count;i++){
      int n = 0;
      double wwr = 0;
      for(int j = 0 ;j < x.Count;j++){
        if(x[j] == i){
          n++;
          wwr += z[j];
        }
      }
      double n1;
      if(wwr != 0){
        n1 = Math.Round(wwr / n, 2);
      }
      else{
        n1 = 0;
      }
      strList.Add(y[i] + "=" + n1.ToString());
    }
    A = strList;
# ---------- end c_script_3 ----------

# ---- group: WWR
A = ClusterOutput()  # disabled

# ----
split = TextSplit(Text=c_script_2.Win, Separators="=")  # -> simplify(Result)
split_2 = TextSplit(Text=c_script_2.Wall, Separators="=")  # -> simplify(Result)
item_2 = ListItem(List=reverse(split_2), Index=0, Wrap=True)
item_3 = ListItem(List=reverse(split), Index=0, Wrap=True)
wall = Text(item_2)
win = Text(item_3)
wall_2 = ClusterOutput(wall)
win_2 = ClusterOutput(win)
panel_2 = Panel(item_3)

# ==== cluster Cluster_5
A = ClusterInput()
G = ClusterInput()
T = ClusterInput()
area = Area(Geometry=G)  # -> Area, Centroid
branch = TreeBranch(Tree=simplify(T), Path="{13}", MaintainPaths=True)
multiplication = Multiplication(A=A, B=area.Area, C=branch)
multiplication_2 = Multiplication(A=branch, B=A)
multiplication_3 = Multiplication(A=area.Area, B=A)
R = ClusterOutput(multiplication_3)
R_2 = ClusterOutput(multiplication)
R_3 = ClusterOutput(multiplication_2)

# ==== cluster Cluster_6
crv = ClusterInput()
crv_2 = Curve(crv)
end = EndPoints(Curve=crv_2)  # -> Start, End
ln = Line(StartPoint=end.Start, EndPoint=end.End)
Z = UnitZ(Factor=1)
amp = Amplitude(Vector=ln, Amplitude=1)
vrot = Rotate(Vector=graft(amp), Axis=Z, Angle=[1.570796327, -1.570796327])
curvepoint = PointOnCurve(crv_2, parameter=0.5)
join = JoinCurves(Curves=crv_2, Preserve=False)
boundary = BoundarySurfaces(Edges=join)
addition = Addition(A=graft(curvepoint), B=vrot)
pi = Pi(Factor=1)
_4 = B(4)
division = Division(A=pi, B=_4)
pull = PullPoint(Point=addition, Geometry=boundary, ClosestOnly=True)  # -> ClosestPoint, Distance
series = Series(Start=0, Step=division, Count=expr("(x*2)+1", _4))
sort = SortList(Keys=pull.Distance, ValuesA=vrot)  # -> Keys, ValuesA
item = ListItem(List=reverse(sort.ValuesA), Index=0, Wrap=True)
consec = ConsecutiveDomains(Numbers=series, Additive=False)
shift = ShiftList(List=consec, Shift=-1, Wrap=True)
Y = UnitY(Factor=-1)
pl = ConstructPlane(Origin=Point(0, 0, 0), XAxis=Vector(-1, 0, 0), YAxis=Vector(0, 1, 0))
angle = Angle(VectorA=item, VectorB=Y, Plane=pl)  # -> Angle, Reflex
fdom = FindDomain(Domains=shift, Number=flatten(angle.Angle), Strict=False)  # -> Index, Neighbour
# This numbers show which line belong to which direction
division_2 = Division(A=fdom.Index, B=2)
round = Round(Number=division_2)  # -> Nearest, Floor, Ceiling
F = ClusterOutput(round.Floor)
