# Grasshopper definition ParametricRoom_Latest.gh (Grasshopper 1.0.7)
# plug-ins: PW_AI, MetaHopper

# We cannot have vetical and horizontal shadings on a window at the same time.
# Instead, we can have either multiple horizontal Shadings + Overhang or vertical shadings + overhang or without overhang
image = ImageSampler(Filter="Colour", Interpolate=False, Umax=1, Umin=0, Vmax=1, Vmin=0, Wrap=1)

footprint = Curve(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)
zone = GetGeometry(footprint, AtLeast=1, AtMost=1, DeleteInput=False, Filter=1074004029, TreeAccess=False)
explode = Explode(Curve=zone, Recursive=True)  # -> Segments, Vertices
list_length = ListLength(List=explode.Segments)

panel = Panel("""1
1
1
1
1
1
1
1
1
1
1
1
1
1
1
1
1
1
1
1""")
panel_2 = Panel("DPredict/CAN_BC_Vancouver.Harbour.CS.712010_TMYx.2004-2018.epw")

# ----
# footprint-offset
footprint_offset = GetNumber(Slider(0, range=0..100), AtLeast=0, AtMost=1, Maximum=1.797693135e+308, Minimum=-1.797693135e+308, TreeAccess=False)

panel_3 = Panel("""0.65
0
0
0""")
c_script = CSharpScript(x=panel_2)  # -> A
# ---------- c_script: C# ----------
    A = Grasshopper.Folders.DefaultAssemblyFolder+x;
# ---------- end c_script ----------
panel_4 = Panel("""1
0
1
0""")
get_local_path = CSharpScript(file=panel_2)  # -> out, A; inputs file: String; disabled
# ---------- get_local_path: C# usings ----------
using System.IO;
# ---------- get_local_path: C# ----------
    var ghFilePath = GrasshopperDocument.FilePath;
    var ghFolderPath = ghFilePath.Substring(0, ghFilePath.LastIndexOf("\\"));
    A = Path.Combine(ghFolderPath, file);
# ---------- end get_local_path ----------
weather_file = Text("C:\Users\Asus\Desktop\EPW\CAN_BC_Vancouver.Harbour.CS.712010_TMYx.2004-2018\CAN_BC_Vancouver.Harbour.CS.712010_TMYx.2004-2018.epw")
path = FilePath("D:\SFU\MITACS\D-Predict-Versions\DPredict-11.7.24\DPredict\EPW\Atlanta\USA_GA_Atlanta-Hartsfield-Jackson.Intl.AP.722190_TMY3.epw")

# ---- group: num walls
num_walls = Number(list_length)

# ----
duplicate_data = DuplicateData(Data="0.65", Number=num_walls, Order=True)
duplicate_data_2 = DuplicateData(Data="1", Number=num_walls, Order=True)
curve = Curve(explode.Segments)
duplicate_data_3 = DuplicateData(Data="0", Number=num_walls, Order=True)
number_of_floors = Slider(20, range=0..100)
weather_file_2 = Text(c_script)
duplicate_data_4 = DuplicateData(Data="0", Number=num_walls, Order=True)
c_script_2 = CSharpScript(x=duplicate_data_4)  # -> out, A; inputs x: list of Double
# ---------- c_script_2: C# ----------
    if(x != null && x.Count > 0)
    {
      x[0] = 0.5;
    }
    A = x;
# ---------- end c_script_2 ----------
terrain = Slider(0, range=0..2)
heat_source = Slider(0, range=0..2)
hot_water_source = Slider(0, range=0..2)
heat_capacity = Slider(0, range=0..2)
building_height = Slider(3.2, range=0..10)
building_type = Slider(0, range=0..6)
ceiling_reflectance = Slider(0.7, range=0..1)
floor_reflectance = Slider(0.2, range=0..1)
wall_reflectance = Slider(0.4, range=0..1)
glazing_reflectance = Slider(0.3, range=0..1)
wall_r_value = Slider(30, range=0..100)
roof_r_value = Slider(20, range=0..100)
sensor_grid_size = Slider(2, range=0..2)
cluster = Cluster_7(crv=curve)
horizontalfnonoff = GetNumber(duplicate_data_3, AtLeast=1, AtMost=1, Maximum=1.797693135e+308, Minimum=-1.797693135e+308, TreeAccess=False)
verticalfnonoff = GetNumber(duplicate_data_3, AtLeast=1, AtMost=1, Maximum=1.797693135e+308, Minimum=-1.797693135e+308, TreeAccess=False)
overhangsonoff = GetNumber(duplicate_data_3, AtLeast=1, AtMost=1, Maximum=1.797693135e+308, Minimum=-1.797693135e+308, TreeAccess=False)
path_2 = FilePath("C:\Users\Asus\Desktop\EPW\CAN_BC_Vancouver.Harbour.CS.712010_TMYx.2004-2018\CAN_BC_Vancouver.Harbour.CS.712010_TMYx.2004-2018.epw")
c_script_3 = CSharpScript(x=duplicate_data_4)  # -> out, A; inputs x: list of Double; same code as c_script_2
horizontalshadings_multiplier = GetNumber(duplicate_data_3, AtLeast=1, AtMost=1, Maximum=1.797693135e+308, Minimum=-1.797693135e+308, TreeAccess=False)
horizontalshadings_depth = GetNumber(duplicate_data, AtLeast=1, AtMost=1, Maximum=1.797693135e+308, Minimum=-1.797693135e+308, TreeAccess=False)
overhangs_depth = GetNumber(duplicate_data, AtLeast=1, AtMost=1, Maximum=1.797693135e+308, Minimum=-1.797693135e+308, TreeAccess=False)
verticalshadings_depth = GetNumber(duplicate_data, AtLeast=1, AtMost=1, Maximum=1.797693135e+308, Minimum=-1.797693135e+308, TreeAccess=False)
overhangs_offset = GetNumber(duplicate_data_3, AtLeast=1, AtMost=1, Maximum=1.797693135e+308, Minimum=-1.797693135e+308, TreeAccess=False)
verticalshadings_multiplier = GetNumber(duplicate_data_3, AtLeast=1, AtMost=1, Maximum=1.797693135e+308, Minimum=-1.797693135e+308, TreeAccess=False)

# ---- group: RH_OUT:wall_facing_directions
# We need to remove this because users should change the rhino unit
integer = Integer(cluster)

# ----
mbox = MeshBox(
    Base={Plane=PlaneXY(100000000, 100000000, 100000000), X=Domain(-2, 2), Y=Domain(-0.5, 0.5), Z=Domain(0, 0.25)},
    XCount=1,
    YCount=1,
    ZCount=1)
c_script_4 = CSharpScript()  # -> out, A
# ---------- c_script_4: C# ----------
    var testLine = new Line();
   

    A = testLine;
# ---------- end c_script_4 ----------
wwr_per_wall = GetNumber(duplicate_data, AtLeast=1, AtMost=1, Maximum=1.797693135e+308, Minimum=-1.797693135e+308, TreeAccess=False)
hot_water_source_2 = GetInteger(hot_water_source, AtLeast=1, AtMost=1, Maximum=2147483647, Minimum=-2147483648, TreeAccess=False)
terrain_2 = GetInteger(terrain, AtLeast=1, AtMost=1, Maximum=2147483647, Minimum=-2147483648, TreeAccess=False)
heat_capacity_2 = GetInteger(heat_capacity, AtLeast=1, AtMost=1, Maximum=2147483647, Minimum=-2147483648, TreeAccess=False)
heat_source_2 = GetInteger(heat_source, AtLeast=1, AtMost=1, Maximum=2147483647, Minimum=-2147483648, TreeAccess=False)
building_type_2 = GetInteger(building_type, AtLeast=1, AtMost=1, Maximum=2147483647, Minimum=-2147483648, TreeAccess=False)
floor_to_floor = GetNumber(building_height, AtLeast=1, AtMost=1, Maximum=1.797693135e+308, Minimum=-1.797693135e+308, TreeAccess=False)
win_u_val = GetNumber(Slider(2.2, range=0..10), AtLeast=1, AtMost=1, Maximum=1.797693135e+308, Minimum=-1.797693135e+308, TreeAccess=False)
win_shgc = GetNumber(Slider(0.5, range=0..1), AtLeast=1, AtMost=1, Maximum=1.797693135e+308, Minimum=-1.797693135e+308, TreeAccess=False)
epcspreadsheet = GetFilePath(AtLeast=1, AtMost=1, TreeAccess=False)
ceiling_reflectance_2 = GetNumber(ceiling_reflectance, AtLeast=1, AtMost=1, Maximum=1.797693135e+308, Minimum=-1.797693135e+308, TreeAccess=False)
floor_reflectance_2 = GetNumber(floor_reflectance, AtLeast=1, AtMost=1, Maximum=1.797693135e+308, Minimum=-1.797693135e+308, TreeAccess=False)
wall_reflectance_2 = GetNumber(wall_reflectance, AtLeast=1, AtMost=1, Maximum=1.797693135e+308, Minimum=-1.797693135e+308, TreeAccess=False)
glazing_transparency = GetNumber(glazing_reflectance, AtLeast=1, AtMost=1, Maximum=1.797693135e+308, Minimum=-1.797693135e+308, TreeAccess=False)
wall_r_val = GetNumber(wall_r_value, AtLeast=1, AtMost=1, Maximum=1.797693135e+308, Minimum=-1.797693135e+308, TreeAccess=False)
# ground r value set to defaul 0.2
roof_r_val = GetNumber(roof_r_value, AtLeast=1, AtMost=1, Maximum=1.797693135e+308, Minimum=-1.797693135e+308, TreeAccess=False)
number_of_floors_2 = GetInteger(number_of_floors, AtLeast=1, AtMost=1, Maximum=2147483647, Minimum=-2147483648, TreeAccess=False)
grid_size = GetNumber(sensor_grid_size, AtLeast=1, AtMost=1, Maximum=1.797693135e+308, Minimum=-1.797693135e+308, TreeAccess=False)
weather_file_3 = GetFilePath(weather_file_2, AtLeast=1, AtMost=1, TreeAccess=False)
context = GetGeometry(mbox, AtLeast=1, AtMost=1, DeleteInput=False, Filter=1074004029, TreeAccess=False)

# ---- group: UnitConvertor to Meters
c_script_5 = CSharpScript()  # -> out, A; disabled
# ---------- c_script_5: C# ----------
     Rhino.RhinoDoc.ActiveDoc.AdjustModelUnitSystem(UnitSystem.Meters, false);
# ---------- end c_script_5 ----------

# ----
interior_walls = GetGeometry(AtLeast=1, AtMost=1, DeleteInput=False, Filter=1074004029, TreeAccess=False)
floor_type = Slider(0, range=0..6)
num = Number([0.6096, 1.2192, 1.8288])
item = ListItem(List=num, Index=grid_size, Wrap=True)
c_script_6 = CSharpScript(
    footprint=zone,
    interiorWalls=interior_walls,
    WWRPerWall=wwr_per_wall,
    verticalFnOnOff=verticalfnonoff,
    verticalFnCnts=verticalshadings_multiplier,
    verticalFnDps=verticalshadings_depth,
    horizontalFnOnOff=horizontalfnonoff,
    horizontalFnCnts=horizontalshadings_multiplier,
    horizontalFnDps=horizontalshadings_depth,
    overhangOnOff=overhangsonoff,
    overhangOfst=overhangs_offset,
    overhangDp=overhangs_depth,
    floorCount=number_of_floors_2,
    terrain=terrain_2,
    heatCapacity=heat_capacity_2,
    heatingSource=heat_source_2,
    hotWaterSource=hot_water_source_2,
    height=floor_to_floor,
    floorProgram=building_type_2,
    floorType=floor_type,
    ceilingReflectance=ceiling_reflectance_2,
    floorReflectance=floor_reflectance_2,
    wallReflectance=wall_reflectance_2,
    glazingReflectance=glazing_transparency,
    wallRValue=wall_r_val,
    roofRValue=roof_r_val,
    groundRValue=Slider(20, range=0..100),
    winUValue=win_u_val,
    winSHGC=win_shgc)  # -> out, ZoneOutline, SurfaceFloor, MeshFloor, MeshCeiling, MeshExteriorWalls, BrepExteriorWalls, MeshExteriorWallsSplit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; inputs footprint: Curve, interiorWalls: list of Curve, WWRPerWall: list of Double, verticalFnOnOff: list of Int32, verticalFnCnts: list of Int32, verticalFnDps: list of Double, horizontalFnOnOff: list of Int32, horizontalFnCnts: list of Int32, horizontalFnDps: list of Double, overhangOnOff: list of Int32, overhangOfst: list of Double, overhangDp: list of Double, floorCount: Int32, terrain: Int32, heatCapacity: Int32, heatingSource: Int32, hotWaterSource: Int32, height: Double, floorProgram: Int32, floorType: Double, ceilingReflectance: Double, floorReflectance: Double, wallReflectance: Double, glazingReflectance: Double, wallRValue: Double, roofRValue: Double, groundRValue: Double, winUValue: Double, winSHGC: Double
# ---------- c_script_6: C# usings ----------
using System.Linq;

using System.IO;
# ---------- c_script_6: C# ----------
    bool verticalFnOnOffValue = verticalFnCnts.Any(n => n != 0);
    bool horizontalFnOnOffValue = horizontalFnCnts.Any(n => n != 0);
    bool overhangsOnOffValue = overhangDp.Any(n => n != 0);

    //verticalFnOnOff = Enumerable.Repeat(verticalFnOnOffValue ? 1 : 0, WWRPerWall.Count).ToList();
    //horizontalFnOnOff = Enumerable.Repeat(horizontalFnOnOffValue ? 1 : 0, WWRPerWall.Count).ToList();
    //overhangOnOff = Enumerable.Repeat(overhangsOnOffValue ? 1 : 0, WWRPerWall.Count).ToList();



    if(footprint == null || !footprint.IsClosed )return;


    ///////////////////////Generating data
    debug2 = WWRPerWall.Count;
    //if(wallcount != WWRPerWall.Count )
    {
      allData.Clear();
      allCurves.Clear();

      for(int i = 0 ;i < WWRPerWall.Count ;i++){

        allData.Add("0", new GH_Path(2));
        allData.Add("0", new GH_Path(3));
        allData.Add("0", new GH_Path(4));
        allData.Add("0", new GH_Path(5));
        allData.Add("0", new GH_Path(6));
        allData.Add("0", new GH_Path(7));
        allData.Add("0", new GH_Path(8));

        allData.Add("0", new GH_Path(25));
        allData.Add("0", new GH_Path(26));
        allData.Add("0", new GH_Path(27));
        if(i == 0){
          allCurves.Add(footprint, new GH_Path(0));
          allCurves.AddRange(interiorWalls, new GH_Path(1));

          allData.Add(terrain.ToString(), new GH_Path(9));
          allData.Add(heatCapacity.ToString(), new GH_Path(10));
          allData.Add(heatingSource.ToString(), new GH_Path(11));
          allData.Add(hotWaterSource.ToString(), new GH_Path(12));

          allData.Add(height.ToString(), new GH_Path(13));
          allData.Add(floorCount.ToString(), new GH_Path(14));
          allData.Add(floorProgram.ToString(), new GH_Path(15));
          allData.Add(floorType.ToString(), new GH_Path(16));
          allData.Add(ceilingReflectance.ToString(), new GH_Path(17));
          allData.Add(floorReflectance.ToString(), new GH_Path(18));
          allData.Add(wallReflectance.ToString(), new GH_Path(19));
          allData.Add(glazingReflectance.ToString(), new GH_Path(20));
          allData.Add(wallRValue.ToString(), new GH_Path(21));
          allData.Add(roofRValue.ToString(), new GH_Path(22));
          allData.Add(winUValue.ToString(), new GH_Path(23));
          allData.Add(winSHGC.ToString(), new GH_Path(24));
        }
      }
    }


    wallcount = WWRPerWall.Count;



    for(int i = 0 ;i < WWRPerWall.Count ;i++){

      allCurves[new GH_Path(0), 0] = footprint;

      allCurves.RemovePath(new GH_Path(1));
      allCurves.AddRange(interiorWalls, new GH_Path(1));

      if(WWRPerWall[i] > 0){
        allData[new GH_Path(2), i] = WWRPerWall[i].ToString();
        allData[new GH_Path(3), i] = verticalFnOnOff[i].ToString();
        allData[new GH_Path(4), i] = verticalFnCnts[i].ToString();
        allData[new GH_Path(5), i] = verticalFnDps[i].ToString();
        allData[new GH_Path(6), i] = horizontalFnOnOff[i].ToString();
        allData[new GH_Path(7), i] = horizontalFnCnts[i].ToString();
        allData[new GH_Path(8), i] = horizontalFnDps[i].ToString();

        allData[new GH_Path(25), i] = overhangOnOff[i].ToString();
        allData[new GH_Path(26), i] = overhangOfst[i].ToString();
        allData[new GH_Path(27), i] = overhangDp[i].ToString();
      }

      allData[new GH_Path(9), 0] = terrain.ToString();
      allData[new GH_Path(10), 0] = heatCapacity.ToString();
      allData[new GH_Path(11), 0] = heatingSource.ToString();
      allData[new GH_Path(12), 0] = hotWaterSource.ToString();

      allData[new GH_Path(13), 0] = height.ToString();
      allData[new GH_Path(14), 0] = floorCount.ToString();
      allData[new GH_Path(15), 0] = floorProgram.ToString();
      allData[new GH_Path(16), 0] = floorType.ToString();
      allData[new GH_Path(17), 0] = ceilingReflectance.ToString();
      allData[new GH_Path(18), 0] = floorReflectance.ToString();
      allData[new GH_Path(19), 0] = wallReflectance.ToString();
      allData[new GH_Path(20), 0] = glazingReflectance.ToString();
      allData[new GH_Path(21), 0] = wallRValue.ToString();
      allData[new GH_Path(22), 0] = roofRValue.ToString();
      allData[new GH_Path(23), 0] = winUValue.ToString();
      allData[new GH_Path(24), 0] = winSHGC.ToString();
      debug1 = i;
    }
    debug3 = allData[new GH_Path(5), 1];

    /////////////////////Generating Frames and fins

    List<Curve> AllClosedCurves = new List<Curve> ();
    AllClosedCurves.Add(allCurves[new GH_Path(0), 0]);
    foreach(Curve c in interiorWalls){
      if(c.IsClosed){
        List<Point3d> cornerPoints = new List<Point3d> ();
        cornerPoints.AddRange(c.ToNurbsCurve().GrevillePoints());
        foreach(Point3d pt in cornerPoints){    // NOTE: this is adding curves even if only one point is inside the footprint. it is also adding n curves = n cornerPoints which is bad
          if(footprint.Contains(pt, Plane.WorldXY, 0.01) == Rhino.Geometry.PointContainment.Inside){
            AllClosedCurves.Add(c);
          }
        }
      }
    }

    Brep FloorBrep = Brep.CreatePlanarBreps(AllClosedCurves, 0.01)[0].DuplicateBrep();
    Mesh floorM = Mesh.CreateFromBrep(FloorBrep, MeshingParameters.FastRenderMesh)[0];
    Mesh ceilingM = floorM.DuplicateMesh();


    ceilingM.Translate(Vector3d.ZAxis * Convert.ToDouble(allData[new GH_Path(13), 0]));
    MeshFloor = floorM;
    MeshCeiling = ceilingM;
    SurfaceFloor = FloorBrep;

    //////Ceiling and Floor geometry without holes
    Brep solidFloorBrep = Brep.CreatePlanarBreps(allCurves[new GH_Path(0), 0], 0.01)[0].DuplicateBrep();
    Mesh solidFloorM = Mesh.CreateFromBrep(solidFloorBrep, MeshingParameters.FastRenderMesh)[0];
    Mesh solidCeilingM = solidFloorM.DuplicateMesh();


    solidCeilingM.Translate(Vector3d.ZAxis * Convert.ToDouble(allData[new GH_Path(13), 0]));
    SolidMeshFloor = solidFloorM;
    SolidMeshCeiling = solidCeilingM;





    DataTree<Mesh> porousWalls = new DataTree<Mesh>();
    DataTree<Mesh> solidWalls = new DataTree<Mesh>();
    List<Brep> solidWallsBrep = new List<Brep>();
    List<Brep> porousWallsBrep = new List<Brep>();

    DataTree<double> wwrForEachWall = new DataTree<double>();

    DataTree<Mesh> AllFrames = new DataTree<Mesh>();
    DataTree<Mesh> AllVrtFins = new DataTree<Mesh>();
    DataTree<Mesh> AllHrzFins = new DataTree<Mesh>();
    DataTree<Mesh> AllOverhangs = new DataTree<Mesh>();
    List<Brep> AllFramesBrep = new List<Brep>();
    DataTree<Brep> AllVrtFinsBrep = new DataTree<Brep>();
    DataTree<Brep> AllHrzFinsBrep = new DataTree<Brep>();
    List<Mesh> AllWalls = new List<Mesh>();
    List<Brep> AllWallsBrep = new List<Brep>();

    Mesh mesh = new Mesh();Mesh VrtFins = new Mesh(); Mesh HrzFins = new Mesh();
    Brep brepFrame = new Brep();Brep BrepVrtFins = new Brep(); Brep BrepHrzFins = new Brep();
    DataTree<double> verticalSpacingNumbers = new DataTree<double>();
    DataTree<double> horizontalSpacingNumbers = new DataTree<double>();
    DataTree<double> verticalFinsDepth = new DataTree<double>();
    DataTree<double> horizontalFinsDepth = new DataTree<double>();
    DataTree<Mesh> allWindows = new DataTree<Mesh>();
    double verticalSpacing = 0;double horizontalSpacing = 0; Vector3d normalVector = new Vector3d();
    List<Curve> allSegments1 = new List<Curve> ();
    allSegments1.AddRange(allCurves[new GH_Path(0), 0].DuplicateSegments());

    List<Curve> allSegments2 = new List<Curve> ();
    double minLng = 3;
    TWWR = 0;

    if(allSegments1.Count != WWRPerWall.Count)return; /////Checkkkk



    DataTree<double> lgVrtHrzSpacingDepth = new DataTree<double>();

    A = FloorBrep;


    for(int i = 0 ;i < allSegments1.Count ;i++){
      TWWR += Convert.ToDouble(allData[new GH_Path(2), i]) / allSegments1.Count * 1.0;
      Curve cr = allSegments1[i];
      cr.Domain = new Interval(0, 1);

      /////////////////////////////////Generating objects for energy performance
      if(Convert.ToDouble(allData[new GH_Path(2), i]) > 0){
        Mesh w = new Mesh();
        Brep b = new Brep();
        GenerateInteriorWalls(FloorBrep, cr, Convert.ToDouble(allData[new GH_Path(13), 0]), out w, out b);
        porousWalls.Add(w, new GH_Path(i)); porousWallsBrep.Add(b);
        wwrForEachWall.Add(Convert.ToDouble(allData[new GH_Path(2), i]), new GH_Path(i));
        AllWalls.Add(w);
        AllWallsBrep.Add(b);
      }
      else
      {
        Mesh w = new Mesh();Brep b = new Brep();
        GenerateInteriorWalls(FloorBrep, cr, Convert.ToDouble(allData[new GH_Path(13), 0]), out w, out b);
        solidWalls.Add(w, new GH_Path(i));
        solidWallsBrep.Add(b);
        AllWalls.Add(w);
        AllWallsBrep.Add(b);
      }
      ///////////////////////



      double crvLength = cr.PointAtStart.DistanceTo(cr.PointAtEnd);
      lgVrtHrzSpacingDepth.Add(crvLength, new GH_Path(i));//

      int crvDivision = (int) Math.Ceiling(crvLength / minLng);
      Mesh win = new Mesh();
      Mesh overhng = new Mesh();

      if(crvDivision == 1){
        GenerateFrame(FloorBrep, cr, Convert.ToDouble(allData[new GH_Path(2), i]), Convert.ToDouble(allData[new GH_Path(13), 0]), Convert.ToInt32(allData[new GH_Path(3), i]), Convert.ToInt32(allData[new GH_Path(4), i]),
          Convert.ToDouble(allData[new GH_Path(5), i]), Convert.ToInt32(allData[new GH_Path(6), i]), Convert.ToInt32(allData[new GH_Path(7), i]), Convert.ToDouble(allData[new GH_Path(8), i]),
          Convert.ToInt32(allData[new GH_Path(25), i]), Convert.ToDouble(allData[new GH_Path(26), i]), Convert.ToDouble(allData[new GH_Path(27), i]),
          out mesh, out VrtFins, out  HrzFins, out verticalSpacing, out horizontalSpacing, out normalVector, out win, out overhng, out brepFrame, out BrepVrtFins, out  BrepHrzFins);


        if(mesh.IsValid)
          AllFrames.Add(mesh, new GH_Path(i));
        string t;
        if(brepFrame.IsValidGeometry(out t))
          AllFramesBrep.Add(brepFrame);

        if(VrtFins.IsValid)
          AllVrtFins.Add(VrtFins, new GH_Path(i));
        if(VrtFins.IsValid)
          AllVrtFinsBrep.Add(BrepVrtFins, new GH_Path(i));

        if(HrzFins.IsValid)
          AllHrzFins.Add(HrzFins, new GH_Path(i));
        if(HrzFins.IsValid)
          AllHrzFinsBrep.Add(BrepHrzFins, new GH_Path(i));

        AllOverhangs.Add(overhng, new GH_Path(i));

        if(Convert.ToDouble(allData[new GH_Path(2), i]) > 0){
          verticalSpacingNumbers.Add(verticalSpacing, new GH_Path(i));
          horizontalSpacingNumbers.Add(horizontalSpacing, new GH_Path(i));
          allWindows.Add(win, new GH_Path(i));

          lgVrtHrzSpacingDepth.Add(verticalSpacing, new GH_Path(i));//
          lgVrtHrzSpacingDepth.Add(horizontalSpacing, new GH_Path(i));//

          if(Convert.ToInt32(allData[new GH_Path(3), i]) == 0){
            verticalFinsDepth.Add(0, new GH_Path(i));
            lgVrtHrzSpacingDepth.Add(0, new GH_Path(i));//
          }
          else{
            verticalFinsDepth.Add(Convert.ToDouble(allData[new GH_Path(5), i]), new GH_Path(i));
            lgVrtHrzSpacingDepth.Add(Convert.ToDouble(allData[new GH_Path(5), i]), new GH_Path(i));//
          }

          if(Convert.ToInt32(allData[new GH_Path(6), i]) == 0){
            horizontalFinsDepth.Add(0, new GH_Path(i));
            lgVrtHrzSpacingDepth.Add(0, new GH_Path(i));//
          }
          else{
            horizontalFinsDepth.Add(Convert.ToDouble(allData[new GH_Path(8), i]), new GH_Path(i));
            lgVrtHrzSpacingDepth.Add(Convert.ToDouble(allData[new GH_Path(8), i]), new GH_Path(i));//
          }
        }
      }
      else{
        List<double> tParameters = new List<double> ();
        List<Curve> splittedCurves = new List<Curve> ();
        for(int j = 0 ;j < crvDivision ;j++)
          tParameters.Add(j * (1.0 / crvDivision * 1.0));
        splittedCurves.AddRange(cr.Split(tParameters));

        List<Brep> BrepWallSegments = new List<Brep>();
        List<Brep> BrepVerticalFinsSegments = new List<Brep>();
        List<Brep> BrepHorzintalFinsSegments = new List<Brep>();

        for(int k = 0 ;k < splittedCurves.Count ;k++){


          GenerateFrame(FloorBrep, splittedCurves[k], Convert.ToDouble(allData[new GH_Path(2), i]), Convert.ToDouble(allData[new GH_Path(13), 0]), Convert.ToInt32(allData[new GH_Path(3), i]), Convert.ToInt32(allData[new GH_Path(4), i]),
            Convert.ToDouble(allData[new GH_Path(5), i]), Convert.ToInt32(allData[new GH_Path(6), i]), Convert.ToInt32(allData[new GH_Path(7), i]), Convert.ToDouble(allData[new GH_Path(8), i]),
            Convert.ToInt32(allData[new GH_Path(25), i]), Convert.ToDouble(allData[new GH_Path(26), i]), Convert.ToDouble(allData[new GH_Path(27), i]),
            out mesh, out VrtFins, out  HrzFins, out verticalSpacing, out horizontalSpacing, out normalVector
            , out win, out overhng, out brepFrame, out BrepVrtFins, out  BrepHrzFins);

          string t;
          if(mesh.IsValidWithLog(out t))
            AllFrames.Add(mesh, new GH_Path(i));
          if(brepFrame.IsValidGeometry(out t))
            BrepWallSegments.Add(brepFrame);

          if(VrtFins.IsValidWithLog(out t))
            AllVrtFins.Add(VrtFins, new GH_Path(i));
          if(BrepVrtFins.IsValidGeometry(out t))
            BrepVerticalFinsSegments.Add(BrepVrtFins);

          if(HrzFins.IsValidWithLog(out t))
            AllHrzFins.Add(HrzFins, new GH_Path(i));
          if(BrepHrzFins.IsValidGeometry(out t))
            BrepHorzintalFinsSegments.Add(BrepHrzFins);

          AllOverhangs.Add(overhng, new GH_Path(i));

          if(Convert.ToDouble(allData[new GH_Path(2), i]) > 0){
            verticalSpacingNumbers.Add(verticalSpacing, new GH_Path(i));
            horizontalSpacingNumbers.Add(horizontalSpacing, new GH_Path(i));



            if(k == 0){
              lgVrtHrzSpacingDepth.Add(verticalSpacing, new GH_Path(i));//
              lgVrtHrzSpacingDepth.Add(horizontalSpacing, new GH_Path(i));//
            }


            allWindows.Add(win, new GH_Path(i));
            if(Convert.ToInt32(allData[new GH_Path(3), i]) == 0){
              verticalFinsDepth.Add(0, new GH_Path(i));
              if(k == 0){
                lgVrtHrzSpacingDepth.Add(0, new GH_Path(i));//
              }
            }
            else{
              verticalFinsDepth.Add(Convert.ToDouble(allData[new GH_Path(5), i]), new GH_Path(i));
              if(k == 0){
                lgVrtHrzSpacingDepth.Add(Convert.ToDouble(allData[new GH_Path(5), i]), new GH_Path(i));//
              }
            }
            if(Convert.ToInt32(allData[new GH_Path(6), i]) == 0){
              horizontalFinsDepth.Add(0, new GH_Path(i));
              if(k == 0){
                lgVrtHrzSpacingDepth.Add(0, new GH_Path(i));//
              }
            }
            else{
              horizontalFinsDepth.Add(Convert.ToDouble(allData[new GH_Path(8), i]), new GH_Path(i));
              if(k == 0){
                lgVrtHrzSpacingDepth.Add(Convert.ToDouble(allData[new GH_Path(8), i]), new GH_Path(i));//
              }
            }
          }
        }
        AllFramesBrep.AddRange(Brep.JoinBreps(BrepWallSegments, 0.01));
        AllVrtFinsBrep.AddRange(Brep.JoinBreps(BrepVerticalFinsSegments, 0.01), new GH_Path(i));
        AllHrzFinsBrep.AddRange(Brep.JoinBreps(BrepHorzintalFinsSegments, 0.01), new GH_Path(i));





      }

    }

    CurveLngVerticalHorizontalSpacingDepth = lgVrtHrzSpacingDepth;

    ///////////////////////Generating Interior Walls
    Mesh interiorWallMesh = new Mesh();
    List<Brep> interiorWallBrep = new List<Brep>();


    if(interiorWalls.Count > 0){

      foreach(Curve crv in interiorWalls){
        List<Curve> allSegments = new List<Curve> ();
        allSegments.AddRange(crv.DuplicateSegments());

        for(int i = 0 ;i < allSegments.Count ;i++){
          Curve cr = allSegments[i];
          Mesh m = new Mesh();Brep b = new Brep();
          GenerateInteriorWalls(FloorBrep, cr, Convert.ToDouble(allData[new GH_Path(13), 0]), out m, out b);
          interiorWallMesh.Append(m);
          interiorWallBrep.Add(b);
        }
      }
    }


    DataTree<Mesh> JoinedAllFrames = new DataTree<Mesh>();
    for (int i = 0; i < AllFrames.BranchCount; i++){
      var joinedMesh = new Mesh();
      AllFrames.Branch(i).ForEach(m => joinedMesh.Append(m));
      JoinedAllFrames.Add(joinedMesh, AllFrames.Path(i));
    }

    DataTree<Mesh> JoinedAllVrtFins = new DataTree<Mesh>();
    for (int i = 0; i < AllVrtFins.BranchCount; i++){
      var joinedMesh = new Mesh();
      AllVrtFins.Branch(i).ForEach(m => joinedMesh.Append(m));
      JoinedAllVrtFins.Add(joinedMesh, AllVrtFins.Path(i));
    }

    DataTree<Mesh> JoinedAllHrzFins = new DataTree<Mesh>();
    for (int i = 0; i < AllHrzFins.BranchCount; i++){
      var joinedMesh = new Mesh();
      AllHrzFins.Branch(i).ForEach(m => joinedMesh.Append(m));
      JoinedAllHrzFins.Add(joinedMesh, AllHrzFins.Path(i));
    }

    DataTree<Mesh> JoinedAllOverhangs = new DataTree<Mesh>();
    for (int i = 0; i < AllOverhangs.BranchCount; i++){
      var joinedMesh = new Mesh();
      AllOverhangs.Branch(i).ForEach(m => joinedMesh.Append(m));
      JoinedAllOverhangs.Add(joinedMesh, AllOverhangs.Path(i));
    }


    MeshExteriorWalls = JoinedAllFrames;
    BrepExteriorWalls = AllFramesBrep;
    MeshExteriorWallsSplit = AllWalls;
    MeshVerticalFins = JoinedAllVrtFins;
    BrepVerticalFins = AllVrtFinsBrep;


    MeshHorizontalFins = JoinedAllHrzFins;
    BrepHorizontalFins = AllHrzFinsBrep;

    MeshInteriorWalls = repairMesh(interiorWallMesh);
    BrepInteriorWalls = interiorWallBrep;;
    VerticalFinsSpacing = verticalSpacingNumbers;
    HorizontalFinsSpacing = horizontalSpacingNumbers;
    AlternativeData1 = allData;
    AlternativeData2 = allCurves;
    MeshWindows = allWindows;
    TotalWWR = RoundNumber(TWWR, 0.01);
    VerticalFinsDepth = verticalFinsDepth;
    HorizontalFinsDepth = horizontalFinsDepth;
    PorousWalls = porousWalls;
    WwrForEachWall = wwrForEachWall;
    SolidWalls = solidWalls;
    ZoneOutline = allSegments1;


    Overhangs = JoinedAllOverhangs;
# ---------- c_script_6: C# additional code ----------
  double TWWR = 0;
  int wallcount = 0;
  DataTree<string> allData = new DataTree<string>();
  DataTree<Curve> allCurves = new DataTree<Curve>();

  List<double> VrtFinDep = new List<double>();
  List<int> VrtFinCnt = new List<int>();

  List<double> HrzFinDep = new List<double>();
  List<int> HrzFinCnt = new List<int>();


  public void GenerateFrame (Brep floor, Curve crv, double WWR, double height, int verticalFnOnOff, int verticalFnCnt, double verticalFnDp, int horizontalFnOnOff, int horizontalFnCnt,
    double horizontalFnDp, int overhangOnOff, double overhangOfst, double overhangDp, out Mesh Frame, out Mesh VrtFins, out Mesh HrzFins, out double verticalSpacing, out double horizontalSpacing, out Vector3d normalVector,
  out Mesh window, out Mesh OverhangMesh, out Brep BrepFrame, out Brep BrepVrtFins, out Brep BrepHrzFins){


    ///////////////////////////////Generating frame Mesh
    Frame = new Mesh();
    BrepFrame = new Brep();
    Curve crv1 = crv.DuplicateCurve();
    Curve crv2 = crv.DuplicateCurve();
    crv1.Domain = new Interval(0, 1);
    Point3d midPt = crv1.PointAt(0.5) + new Vector3d(0, 0, height / 2);
    var tr1 = Rhino.Geometry.Transform.Scale(midPt, Math.Sqrt(WWR));
    crv2.Transform(tr1);
    Point3d p1 = crv1.PointAtStart; Point3d p2 = crv1.PointAtEnd;
    Point3d p4 = crv2.PointAtStart; Point3d p3 = crv2.PointAtEnd;
    Frame.Vertices.Add(p1);
    Frame.Vertices.Add(p2);
    Frame.Vertices.Add(p3);
    Frame.Vertices.Add(p4);


    var tr2 = Rhino.Geometry.Transform.Translation(new Vector3d(0, 0, height));
    Curve crvTop = crv.DuplicateCurve();
    crvTop.Transform(tr2);
    Curve crv3 = crvTop.DuplicateCurve();
    Curve crv4 = crvTop.DuplicateCurve();
    crv1.Domain = new Interval(0, 1);
    midPt = crv1.PointAt(0.5) + new Vector3d(0, 0, height / 2);
    crv4.Transform(tr1);
    Point3d p5 = crv3.PointAtStart; Point3d p6 = crv3.PointAtEnd;
    Point3d p8 = crv4.PointAtStart; Point3d p7 = crv4.PointAtEnd;
    Frame.Vertices.Add(p5);
    Frame.Vertices.Add(p6);
    Frame.Vertices.Add(p7);
    Frame.Vertices.Add(p8);

    if(WWR > 0.01){
      Frame.Faces.AddFace(new MeshFace(0, 1, 2, 3));
      Frame.Faces.AddFace(new MeshFace(4, 5, 6, 7));
      Frame.Faces.AddFace(new MeshFace(1, 5, 6, 2));
      Frame.Faces.AddFace(new MeshFace(4, 0, 3, 7));
      Frame.UnifyNormals();
    }
    else
      Frame.Faces.AddFace(new MeshFace(0, 1, 5, 4));

    Frame = repairMesh(Frame);
    BrepFrame = Brep.CreateFromMesh(Frame, true);

    ////////////////////////////////Normal Vector
    Vector3d vr1 = p2 - p1;
    vr1.Unitize();
    vr1.Rotate(0.5 * Math.PI, Vector3d.ZAxis);
    Vector3d vr2 = -1 * vr1;
    Point3d[] testPs = new Point3d[2] {(p1 + p2) / 2 + (0.1 * vr1),(p1 + p2) / 2 + (0.1 * vr2)};
    Vector3d[] testVs = new Vector3d[2] {vr1,vr2};
    double[] testDs = new double[2] {testPs[0].DistanceTo(floor.ClosestPoint(testPs[0])),testPs[1].DistanceTo(floor.ClosestPoint(testPs[1]))};
    Array.Sort(testDs, testVs);

    normalVector = testVs[1];


    /////////////////////////////Defining objects
    window = new Mesh();
    verticalSpacing = 0;
    VrtFins = new Mesh();
    BrepVrtFins = new Brep();
    horizontalSpacing = 0;
    HrzFins = new Mesh();
    BrepHrzFins = new Brep();
    OverhangMesh = new Mesh();

    //////////////////////////////Overhang
    if(overhangOnOff != 0){
      crv1.Domain = new Interval(0, 1);
      Point3d[] overhangPt = new Point3d[2]{ crv1.PointAt(0.1) , crv1.PointAt(0.9)};
      Vector3d vtt1 = crv1.TangentAtStart;
      vtt1.Rotate(0.5 * Math.PI, Vector3d.ZAxis);

      Vector3d vtt2 = crv1.TangentAtEnd;
      vtt2.Rotate(0.5 * Math.PI, Vector3d.ZAxis);

      Point3d[] overhangPtStart = new Point3d[2]{ overhangPt[0] + 0.1 * vtt1, overhangPt[0] - 0.1 * vtt1};
      Point3d[] overhangPtEnd = new Point3d[2]{ overhangPt[1] + 0.1 * vtt2, overhangPt[1] - 0.1 * vtt2};
      Vector3d[] overhangVtStart = new Vector3d[2]{ vtt1, -1 * vtt1};
      Vector3d[] overhangVtEnd = new Vector3d[2]{ vtt2, -1 * vtt2};

      double[] overhangDisStart = new double[2]{overhangPtStart[0].DistanceTo(floor.ClosestPoint(overhangPtStart[0])),overhangPtStart[1].DistanceTo(floor.ClosestPoint(overhangPtStart[1]))};
      double[] overhangDisEnd = new double[2]{overhangPtEnd[0].DistanceTo(floor.ClosestPoint(overhangPtEnd[0])),overhangPtEnd[1].DistanceTo(floor.ClosestPoint(overhangPtEnd[1]))};
      Array.Sort(overhangDisStart, overhangVtStart);
      Array.Sort(overhangDisEnd, overhangVtEnd);

      OverhangMesh.Vertices.Add(crvTop.PointAtStart);
      OverhangMesh.Vertices.Add(crvTop.PointAtEnd);
      OverhangMesh.Vertices.Add(crvTop.PointAtEnd + (overhangDp * overhangVtEnd[1]));
      OverhangMesh.Vertices.Add(crvTop.PointAtStart + (overhangDp * overhangVtStart[1]));

      OverhangMesh.Faces.AddFace(new MeshFace(0, 1, 2, 3));
      OverhangMesh.Translate(Vector3d.ZAxis * overhangOfst * -1);
      OverhangMesh = repairMesh(OverhangMesh);
    }


    //////////////////////////////Generating windows
    if(WWR > 0){
      window.Vertices.Add(p3);
      window.Vertices.Add(p4);
      window.Vertices.Add(p8);
      window.Vertices.Add(p7);
      window.Faces.AddFace(new MeshFace(0, 1, 2, 3));

      /////////////////////////verticalSpacing
      verticalFnCnt--;
      if(verticalFnCnt < 2)
        verticalSpacing = p3.DistanceTo(p4);
      else
        verticalSpacing = p3.DistanceTo(p4) / verticalFnCnt * 1.0;

      if(verticalFnOnOff == 1){
        ///////////////////////VerticalFinMesh

        for(int i = 0;i <= verticalFnCnt ;i++){
          double step = 1.0 / verticalFnCnt * 1.0;
          Point3d topPt = (p3 * (i * step)) + (p4 * (1 - (i * step)));
          Point3d bottomPt = (p7 * (i * step)) + (p8 * (1 - (i * step)));
          VrtFins.Vertices.Add(topPt);
          VrtFins.Vertices.Add(bottomPt);
          VrtFins.Vertices.Add(topPt + testVs[1] * verticalFnDp);
          VrtFins.Vertices.Add(bottomPt + testVs[1] * verticalFnDp);
          VrtFins.Faces.AddFace((4 * i) + 0, (4 * i) + 1, (4 * i) + 3, (4 * i) + 2);
        }
        if(VrtFins.IsValid)
          VrtFins = repairMesh(VrtFins);
        if(VrtFins.IsValid)
          BrepVrtFins = Brep.CreateFromMesh(VrtFins, true);
      }

      ////////////////////////horizontalSpacing
      horizontalFnCnt--;
      if(horizontalFnCnt < 2)
        horizontalSpacing = p3.DistanceTo(p7);
      else
        horizontalSpacing = p3.DistanceTo(p7) / horizontalFnCnt * 1.0;

      if(horizontalFnOnOff == 1){
        ////////////////////////////////horizontalFinMesh

        for(int i = 0;i <= horizontalFnCnt ;i++){
          double step = 1.0 / horizontalFnCnt * 1.0;
          Point3d leftPt = (p3 * (i * step)) + (p7 * (1 - (i * step)));
          Point3d rightPt = (p4 * (i * step)) + (p8 * (1 - (i * step)));
          HrzFins.Vertices.Add(leftPt);
          HrzFins.Vertices.Add(rightPt);
          HrzFins.Vertices.Add(leftPt + testVs[1] * horizontalFnDp);
          HrzFins.Vertices.Add(rightPt + testVs[1] * horizontalFnDp);
          HrzFins.Faces.AddFace((4 * i) + 0, (4 * i) + 1, (4 * i) + 3, (4 * i) + 2);
        }
        if(HrzFins.IsValid)
          HrzFins = repairMesh(HrzFins);
        if(HrzFins.IsValid)
          BrepHrzFins = Brep.CreateFromMesh(HrzFins, true);

      }
    }

  }

  public Mesh repairMesh(Mesh invalidMesh){
    invalidMesh.Vertices.CombineIdentical(true, true);
    invalidMesh.Faces.CullDegenerateFaces();
    invalidMesh.UnifyNormals();
    invalidMesh.RebuildNormals();
    invalidMesh.Compact();
    return invalidMesh;
  }


  public void GenerateInteriorWalls (Brep floor, Curve crv, double height, out Mesh intWallMesh, out Brep intWallBrep){

    intWallBrep = Extrusion.Create(crv, height, false).ToBrep();
    Mesh[] wMesh = Mesh.CreateFromBrep(intWallBrep, MeshingParameters.Default);
    intWallMesh = new Mesh();
    foreach (Mesh m in wMesh) {
      intWallMesh.Append(m);
    }
    /*
    Mesh InetriorWall = new Mesh();
    Point3d midPt = (crv.PointAtStart + crv.PointAtEnd) * 0.5;
    double testDs = midPt.DistanceTo(floor.ClosestPoint(midPt));  // NOTE: why do we need the check???
    if(testDs < 1){

      Point3d p1 = crv.PointAtStart; Point3d p2 = crv.PointAtEnd;
      Point3d p3 = crv.PointAtStart + Vector3d.ZAxis * height; Point3d p4 = crv.PointAtEnd + Vector3d.ZAxis * height;
      InetriorWall.Vertices.Add(p1);
      InetriorWall.Vertices.Add(p2);
      InetriorWall.Vertices.Add(p4);
      InetriorWall.Vertices.Add(p3);
      InetriorWall.Faces.AddFace(new MeshFace(0, 1, 2, 3));

      InetriorWall = repairMesh(InetriorWall);
      intWallMesh = InetriorWall;
      intWallBrep = Brep.CreateFromMesh(InetriorWall, true);
    }
    else{
      intWallMesh = null;
      intWallBrep = null;
    }
 */
  }

  public double RoundNumber (double Number, double Scope){
    double Divide = Number / Scope;
    double wholeDiv = Math.Round(Divide);
    return Scope * wholeDiv;
  }






  /// <summary>
  /// This method will be called once every solution, before any calls to RunScript.
  /// </summary>
  public override void BeforeRunScript()
  { }
  /// <summary>
  /// This method will be called once every solution, after any calls to RunScript.
  /// </summary>
  public override void AfterRunScript()
  { }


  //Return a BoundingBox that contains all the geometry you are about to draw.
  public override BoundingBox ClippingBox
  {
    get
    {
      return BoundingBox.Empty;
    }
  }

  //Draw all meshes in this method.
  public override void DrawViewportMeshes(IGH_PreviewArgs args)
  {
  }

  //Draw all wires and points in this method.
  public override void DrawViewportWires(IGH_PreviewArgs args)
  {
  }
# ---------- end c_script_6 ----------
panel_6 = Panel("""{9}
{10}
{11}
{12}
{13}
{14}
{15}
{16}
{17}
{18}
{19}
{20}
{21}
{22}""")
data = Data(c_script_6.SurfaceFloor)
mesh = Mesh(c_script_6.MeshInteriorWalls)
relay = Relay([c_script_6.AlternativeData2, c_script_6.AlternativeData1])

enable_energy = BooleanToggle(True)
enable_daylight = BooleanToggle(True)
enable_daylight_2 = GetBoolean(enable_daylight, AtLeast=1, AtMost=1, FalseValue="False", TreeAccess=False, TrueValue="True")
enable_energy_2 = GetBoolean(enable_energy, AtLeast=1, AtMost=1, FalseValue="False", TreeAccess=False, TrueValue="True")
onoff = EnableDisableObject(Enabled=enable_daylight_2)
onoff_2 = EnableDisableObject(Enabled=enable_energy_2)

mjoin = MeshJoin(Meshes=[c_script_6.MeshExteriorWalls, c_script_6.MeshInteriorWalls])
branch = TreeBranch(Tree=relay, Path=panel_6, MaintainPaths=True)

srf = Surface(c_script_6.BrepInteriorWalls)
brep = Brep(c_script_6.BrepVerticalFins)
brep_2 = Brep(c_script_6.BrepHorizontalFins)
clean = CleanTree(RemoveNulls=True, RemoveInvalid=True, RemoveEmpty=False, Tree=brep)
brep_3 = Brep(c_script_6.BrepExteriorWalls)
clean_2 = CleanTree(RemoveNulls=True, RemoveInvalid=True, RemoveEmpty=False, Tree=brep_2)

c_script_7 = CSharpScript(x=relay)  # -> out, A; disabled
# ---------- c_script_7: C# ----------
    A = Convert.ToDouble(x);
# ---------- end c_script_7 ----------
c_script_8 = CSharpScript(x=branch)  # -> out, A
# ---------- c_script_8: C# ----------
    A = x.GetType();
# ---------- end c_script_8 ----------
data_2 = Data(relay)
text = Text(data_2)
panel_7 = Panel(c_script_7.A)
panel_8 = Panel(c_script_8.A)
dup = DuplicateData(Number="8", Order=True)
panel_9 = Panel("""3
6""")
branch_2 = TreeBranch(Tree=data_2, Path=panel_9, MaintainPaths=True)  # -> simplify(Branch)
branch_3 = TreeBranch(Tree=data_2, Path="{20}", MaintainPaths=True)
updatesensorgrid = Text(item)
cluster_2 = Cluster(G=c_script_6.SurfaceFloor)
branch_4 = TreeBranch(Tree=data_2, Path="{16}", MaintainPaths=True)
merge = Merge(Data1=flatten(dup), Data2=flatten(""))
dup_2 = DuplicateData(Number=9, Order=True)  # -> simplify(Data)
number_slider = Slider(0.5, range=0..1)
bang = ExplodeTree(Data=branch_2)  # -> Branch0, Branch1
branch_5 = TreeBranch(Tree=data_2, Path="{17}", MaintainPaths=True)
branch_6 = TreeBranch(Tree=data_2, Path="{18}", MaintainPaths=True)
num_2 = Number(branch_3)
c_script_9 = CSharpScript(x=bang.Branch0, y=bang.Branch1)  # -> out, simplify(graft(A)); inputs x: Int32, y: Int32
# ---------- c_script_9: C# ----------
    if(x==1)
      A = 0;
    else if (y==1)
      A = 1;
    else
      A = 2;
# ---------- end c_script_9 ----------
mesh_2 = Mesh(context)
mesh_3 = Mesh(c_script_6.Overhangs)
opaque_object = ConstructOpaqueDaylightObjectPWAIV0400(BuildingGeometry=c_script_6.MeshFloor, ReflectanceValue=branch_5)
analysis_grid = ConstructAnalysisGridPWAIV0502(FloorPlane=c_script_6.SurfaceFloor, GridSpacing=updatesensorgrid)
opaque_object_2 = ConstructOpaqueDaylightObjectPWAIV0400(BuildingGeometry=c_script_6.MeshCeiling, ReflectanceValue=branch_4)
opaque_object_3 = ConstructOpaqueDaylightObjectPWAIV0400(BuildingGeometry=mjoin, ReflectanceValue=branch_6)
tstat = TreeStatistics(Tree=c_script_6.MeshWindows)  # -> Paths, Length, Count
branch_7 = TreeBranch(Tree=simplify(c_script_9.A), Path=simplify(tstat.Paths), MaintainPaths=True)
opaque_object_4 = ConstructOpaqueDaylightObjectPWAIV0400(BuildingGeometry=flatten(mesh_2), ReflectanceValue=number_slider)  # -> flatten(OpaqueDaylightObject)

# ---- group: Overhang
opaque_object_5 = ConstructOpaqueDaylightObjectPWAIV0400(BuildingGeometry=flatten(mesh_3), ReflectanceValue=number_slider)  # -> flatten(OpaqueDaylightObject)

# ----
lng = ListLength(List=c_script_6.HorizontalFinsDepth)  # -> expr("x/x", Length)
dup_3 = DuplicateData(Data="vertical", Number=lng, Order=True)
dup_4 = DuplicateData(Data="horizontal", Number=lng, Order=True)
multiplication = Multiplication(A=c_script_6.VerticalFinsDepth, B=0)
c_script_10 = CSharpScript(
    key=simplify(branch_7),
    firstData=simplify(c_script_6.VerticalFinsSpacing),
    secondData=simplify(c_script_6.HorizontalFinsSpacing))  # -> out, A; inputs key: tree of Int32, firstData: tree, secondData: tree
# ---------- c_script_10: C# ----------
    DataTree<object> results = new DataTree<object>();
    for(int i = 0 ; i < key.Branches.Count ;i++){
      if(key.Branches[i][0] == 0)
        results.AddRange(firstData.Branches[i], new GH_Path(i));
      else if(key.Branches[i][0] == 1)
        results.AddRange(secondData.Branches[i], new GH_Path(i));
      else
        results.AddRange(secondData.Branches[i], new GH_Path(i));
    }
    A = results;
# ---------- end c_script_10 ----------
c_script_11 = CSharpScript(
    key=simplify(branch_7),
    firstData=simplify(c_script_6.VerticalFinsDepth),
    secondData=simplify(c_script_6.HorizontalFinsDepth),
    thirdData=simplify(multiplication))  # -> out, A; inputs key: tree of Int32, firstData: tree, secondData: tree, thirdData: tree
# ---------- c_script_11: C# ----------
    DataTree<object> results = new DataTree<object>();
    for(int i = 0 ; i < key.Branches.Count ;i++){
      if(key.Branches[i][0] == 0)
        results.AddRange(firstData.Branches[i], new GH_Path(i));
      else if(key.Branches[i][0] == 1)
        results.AddRange(secondData.Branches[i], new GH_Path(i));
      else
        results.AddRange(thirdData.Branches[i], new GH_Path(i));
    }
    A = results;
# ---------- end c_script_11 ----------
c_script_12 = CSharpScript(key=simplify(branch_7), firstData=simplify(dup_3), secondData=simplify(dup_4))  # -> out, A; inputs key: tree of Int32, firstData: tree, secondData: tree; same code as c_script_10
panel_10 = Panel(c_script_10.A)
transparent_object = ConstructTransparentDaylightObjectPWAIV0400(
    GlazingGeometry=c_script_6.MeshWindows,
    TransparencyValue=num_2,
    ShadingDepth=simplify(c_script_11.A),
    ShadingSpacing=simplify(c_script_10.A),
    ShadingType=simplify(c_script_12.A),
    GenerateShadingGeometries=True)  # -> GlazingDaylighObject, ShadingDeviceGeometry
dl_obj = DaylightObjectPWAIV0400(flatten([opaque_object_2, opaque_object, opaque_object_3, transparent_object.GlazingDaylighObject]))
dl_obj_2 = DaylightObjectPWAIV0562(flatten([opaque_object_4, opaque_object_5]))

subtraction = Subtraction(A=cluster_2, B="0.1")

toggle = BooleanToggle(True)
toggle_2 = BooleanToggle(True)
predict_daylight_ogl = PredictDaylightMetricsFromGeometryMaterialsAndWeatherDataUsingOpenGLPWAIV0600(
    AnalysisGrid=analysis_grid,
    BuildingDaylightObjects=dl_obj,
    SurroundingDaylightObjects=dl_obj_2,
    GroundElevation=subtraction,
    NorthOffset=0,
    PathOfEpwFile=weather_file_3,
    ComputeSolution=enable_daylight_2,
    PredictDA=toggle_2,
    PredictSE=toggle_2,
    PredictMI=toggle_2,
    PredictUDI=toggle_2)  # -> PredictedDaylightAutonomy_sensor_array, PredictedSunlightExposure_sensor_array, PredictedMeanIlluminance_sensor_array, PredictedUsefulDaylightIlluminanceFailing_sensor_array, PredictedUsefulDaylightIlluminanceSupplementary_sensor_array, PredictedUsefulDaylightIlluminanceAcceptable_sensor_array, PredictedUsefulDaylightIlluminanceExcessive_sensor_array
panel_11 = Panel("""20_7|43_10
20_13|43_18""")
panel_12 = Panel("""13_3|18_3
73_3|74_3
10_7|16_7
50_7|58_12
64_7|68_11""")
panel_13 = Panel("""13_3|18_3
73_3|74_3
10_7|16_7
50_7|58_11
64_7|68_11""")
entwine = Entwine(Branch0X=panel_11, Branch1X=panel_12, Branch2X=panel_13, FlattenInputs=False)  # -> simplify(Result)
panel_14 = Panel("""INPUT
INPUT
INPUT""")
run_energy = Boolean(enable_energy_2)
gradient = Gradient(
    LowerLimit=Slider(3000, range=0..10000),
    UpperLimit=Slider(50, range=0..100),
    Parameter=predict_daylight_ogl.PredictedMeanIlluminance_sensor_array,
    stops=[0: RGB(234, 38, 0), 0.25: RGB(234, 126, 0), 0.5: RGB(254, 244, 84), 0.75: RGB(173, 203, 249), 1: RGB(75, 107, 169)])
average = Average(Input=predict_daylight_ogl.PredictedMeanIlluminance_sensor_array)
visualize_udi = VisualizeUsefulDaylightIlluminance(
    AnalysisGrid=analysis_grid,
    UDIFailing=predict_daylight_ogl.PredictedUsefulDaylightIlluminanceFailing_sensor_array,
    UDISupplemental=predict_daylight_ogl.PredictedUsefulDaylightIlluminanceSupplementary_sensor_array,
    UDIAcceptable=predict_daylight_ogl.PredictedUsefulDaylightIlluminanceAcceptable_sensor_array,
    UDIExcessive=predict_daylight_ogl.PredictedUsefulDaylightIlluminanceExcessive_sensor_array)  # -> VisualizationMesh, AverageUDIAcceptable
visualize_da = VisualizeDaylightAutonomy(AnalysisGrid=analysis_grid, DaylightAutonomy=predict_daylight_ogl.PredictedDaylightAutonomy_sensor_array)  # -> VisualizationMesh, SpatialDaylightAutonomy

# ---- group: A place holder mesh for when a daylighting mesh is not present
mesh_4 = Mesh(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)

# ----
visualize_se = VisualizeSunlightExposure(AnalysisGrid=analysis_grid, SunlightExposure=predict_daylight_ogl.PredictedSunlightExposure_sensor_array)  # -> VisualizationMesh, AnnualSunlightExposure
mult_100 = CSharpScript(x=visualize_se.AnnualSunlightExposure)  # -> out, A; inputs x: Double
# ---------- mult_100: C# ----------
    A = Math.Round(x * 100);
# ---------- end mult_100 ----------
mult_100_2 = CSharpScript(x=visualize_da.SpatialDaylightAutonomy)  # -> out, A; inputs x: Double; same code as mult_100
mult_100_3 = CSharpScript(x=visualize_udi.AverageUDIAcceptable)  # -> out, A; inputs x: Double; same code as mult_100
round = CSharpScript(x=average)  # -> out, A; inputs x: Double
# ---------- round: C# ----------
    A = Math.Round(x);
# ---------- end round ----------
c_script_13 = CSharpScript(mesh=visualize_da.VisualizationMesh)  # -> verticesColors; inputs mesh: Mesh
# ---------- c_script_13: C# ----------
    verticesColors = mesh.VertexColors;
# ---------- end c_script_13 ----------
c_script_14 = CSharpScript(mesh=mesh_4)  # -> verticesColors; inputs mesh: Mesh
# ---------- c_script_14: C# ----------
    mesh.VertexColors.CreateMonotoneMesh(System.Drawing.Color.White);

    verticesColors = mesh.VertexColors;
# ---------- end c_script_14 ----------
c_script_15 = CSharpScript(mesh=visualize_udi.VisualizationMesh)  # -> verticesColors; inputs mesh: Mesh; same code as c_script_13
c_script_16 = CSharpScript(mesh=visualize_se.VisualizationMesh)  # -> verticesColors; inputs mesh: Mesh; same code as c_script_13
mcol = MeshColours(Mesh=analysis_grid, Colours=gradient)
entwine_2 = Entwine(Branch00=mult_100_2.A, Branch01=mult_100.A, Branch02=mult_100_3.A, Branch03=round.A, FlattenInputs=True)  # -> flatten(Result)
c_script_17 = CSharpScript(Number=c_script_6.TotalWWR, Scope=0.001)  # -> out, A; inputs Number: Double, Scope: Double; disabled
# ---------- c_script_17: C# ----------
    double x = Number;
    double y = Scope;
    double Divide = x / y;
    double wholeDiv = Math.Round(Divide);
    A = "Total WWR:"+Convert.ToString((Scope * wholeDiv) * 100) + " %";
# ---------- end c_script_17 ----------
cluster_3 = Cluster_6(
    relay_2=predict_daylight_ogl.PredictedDaylightAutonomy_sensor_array,
    relay=predict_daylight_ogl.PredictedSunlightExposure_sensor_array,
    I=predict_daylight_ogl.PredictedUsefulDaylightIlluminanceAcceptable_sensor_array,
    I_2=predict_daylight_ogl.PredictedMeanIlluminance_sensor_array)  # -> T, A
c_script_18 = CSharpScript(x=c_script_13, y=c_script_14)  # -> out, A
# ---------- c_script_18: C# ----------
    if(x != null)
    {
      A = x;
    }
    else 
    {
      A = y;
    }
# ---------- end c_script_18 ----------
c_script_19 = CSharpScript(x=c_script_16, y=c_script_14)  # -> out, A; same code as c_script_18
c_script_20 = CSharpScript(x=c_script_15, y=c_script_14)  # -> out, A; same code as c_script_18
c_script_21 = CSharpScript(x=gradient, y=c_script_14)  # -> out, A
# ---------- c_script_21: C# ----------
    if(x != null)
    {
      A = x;
    }
    else
    {
      A = y;
    }
# ---------- end c_script_21 ----------
merge_2 = Merge(
    Data1=flatten(visualize_da.VisualizationMesh),
    Data2=flatten(visualize_se.VisualizationMesh),
    Data3=flatten(visualize_udi.VisualizationMesh),
    Data4=flatten(mcol))
entwine_3 = Entwine(Branch00=c_script_18.A, Branch01=c_script_19.A, Branch02=c_script_20.A, Branch03=c_script_21.A, FlattenInputs=True)  # -> simplify(Result)
nullrep = ReplaceNulls(Items=merge_2, Replacements=mesh_4)  # -> Items, Count

# ---- group: RH_OUT:DA_all_metrics
num_3 = Number(entwine_2)

# ---- group: RH_OUT:all_daylight_colors
all_daylight_colors = Text(entwine_3)

# ---- group: RH_OUT:daylight_meshes
daylight_mesh = Mesh(nullrep.Items)

# ---- group: RH_OUT:windows_mesh
mesh_5 = Mesh(c_script_6.MeshWindows)

# ---- group: RH_OUT:totalWWR
num_4 = Number(c_script_6.TotalWWR)

# ---- group: RH_OUT:wall_mesh
mesh_6 = Mesh(c_script_6.MeshExteriorWalls)

# ---- group: RH_OUT:walls_mesh
mesh_7 = Mesh(c_script_6.MeshExteriorWallsSplit)

# ---- group: RH_OUT:interior_walls
geometry = Geometry(c_script_6.BrepInteriorWalls)

# ---- group: RH_OUT:walls_brep
geo = Geometry(brep_3)

# ---- group: RH_OUT:daylight_results
txt = Text(cluster_3.T)

# ----
panel_15 = Panel(num_3)
face_boundaries = FaceBoundaries(Mesh=mesh_5)
clean_tree = CleanTree(RemoveNulls=True, RemoveInvalid=True, RemoveEmpty=False, Tree=mesh_3)

# ---- group: RH_OUT:VerticalFins_mesh
mesh_8 = Mesh(c_script_6.MeshVerticalFins)

# ---- group: RH_OUT:energy_results
txt_2 = Text()

# ---- group: RH_OUT:HorizontalFins_mesh
mesh_9 = Mesh(c_script_6.MeshHorizontalFins)

# ----
panel_16 = Panel(""""sDA"
"ASE"
"UDIa"
"MI"
""")
mjoin_2 = MeshJoin(Meshes=[mesh_8, mesh_9])
boundary_surfaces = BoundarySurfaces(Edges=face_boundaries)  # -> flatten(Surfaces)

# ---- group: RH_OUT:shading_mesh
mesh_10 = Mesh(mjoin_2)

# ----
brep_join = BrepJoin(Breps=boundary_surfaces)  # -> Breps, Closed

# ---- group: RH_OUT:Overhangs_mesh
mesh_11 = Mesh(clean_tree)

# ----
brep_4 = Brep(brep_join.Breps)

# ---- group: RH_OUT:windows_brep
geo_2 = Geometry(brep_4)

# ----
brep_5 = Brep(zone)
curve_2 = Curve(c_script_6.ZoneOutline)
text_2 = Text(weather_file_3)
branch_8 = TreeBranch(Tree=text, Path="{15}", MaintainPaths=True)
V = FilePath(text_2)
branch_9 = TreeBranch(Tree=text, Path="{10}", MaintainPaths=True)
branch_10 = TreeBranch(Tree=text, Path="{11}", MaintainPaths=True)
branch_11 = TreeBranch(Tree=text, Path="{12}", MaintainPaths=True)
branch_12 = TreeBranch(Tree=text, Path="{9}", MaintainPaths=True)

cluster_4 = Cluster_10(relay=brep_5)  # -> srf_2, R_2, R

data_3 = Data(c_script_6.MeshWindows)
crv = Curve(curve_2)
mesh_12 = Mesh(context)
srf_2 = Surface(c_script_6.SurfaceFloor)
txt_3 = Text(data_2)
num_5 = Number(footprint_offset)
cluster_5 = Cluster_9(crv=crv, mesh=mesh_12, relay=srf_2, relay_2=data_3, relay_3=txt_3, B=num_5)  # -> horizonangles, R

number = Number(branch_8)
mesh_13 = Mesh(cluster_5.R)
number_2 = Number(branch_9)
number_3 = Number(branch_10)
number_4 = Number(branch_12)
number_5 = Number(branch_11)
merge_3 = Merge(Data1=flatten(dup), Data2=flatten(cluster_4.R_2))
merge_4 = Merge(Data1=cluster_4.R, Data2=cluster_4.R_2)
ma = MassAddition(Input=merge_4)  # -> Result, PartialResults
division = Division(A=merge_4, B=ma.Result)
num_6 = Number(division)
item_2 = ListItem(List=num_6, Index=0, Wrap=True)  # -> Item, Item1

text_3 = Text(c_script_6.CurveLngVerticalHorizontalSpacingDepth)
panel_17 = Panel(text_3)
branch_13 = TreeBranch(Tree=text, Path="{14}", MaintainPaths=True)
branch_14 = TreeBranch(Tree=simplify(text), Path="{13}", MaintainPaths=True)
branch_15 = TreeBranch(Tree=simplify(text), Path="{2}", MaintainPaths=True)
txt_4 = Text(["LargeOffice", "MediumOffice", "SmallOffice", "MidriseApartment", "HighriseApartment", "PrimarySchool", "SecondarySchool", "SmallHotel", "LargeHotel"])
cluster_6 = Cluster_4(crv=curve_2, data=text_3)  # -> alpha, beta
horizontal = Panel(cluster_6.alpha)
horizon_angle = Panel(cluster_5.horizonangles)
txt_5 = Text(Tree({0}: ["0.051129|6.888896|7.965286|8.340905", "15.6_15.6_24_24|15.6_15.6_24_24|15.6_15.6_24_24|15.6_15.6_24_24|17.8_16.7_24_24|20_17.8_24_24|21_18.3_24_24|21_18.3_24_24|21_18.3_24_24|21_18.3_24_24|21_18.3_24_24|21_18.3_24_24|21_18.3_24_24|21_18.3_24_24|21_18.3_24_24|21_18.3_24_24|21_18.3_24_24|21_15.6_24_24|21_15.6_24_24|21_15.6_24_24|21_15.6_24_24|21_15.6_24_24|15.6_15.6_24_24|15.6_15.6_24_24", "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"], {1}: ["0.051129|9.364593|7.965286|1.291949", "15.6_15.6_24_24|15.6_15.6_24_24|15.6_15.6_24_24|15.6_15.6_24_24|15.6_15.6_24_24|21_18.3_24_24|21_18.3_24_24|21_18.3_24_24|21_18.3_24_24|21_18.3_24_24|21_18.3_24_24|21_18.3_24_24|21_18.3_24_24|21_18.3_24_24|21_18.3_24_24|21_18.3_24_24|21_18.3_24_24|21_15.6_24_24|21_15.6_24_24|21_15.6_24_24|21_15.6_24_24|21_15.6_24_24|15.6_15.6_24_24|15.6_15.6_24_24", "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"], {2}: ["0.051129|9.364593|7.965286|0.022217", "15.56_15.56_23.89_23.89|15.56_15.56_23.89_23.89|15.56_15.56_23.89_23.89|15.56_15.56_23.89_23.89|15.56_15.56_23.89_23.89|15.56_15.56_23.89_23.89|21.11_15.56_23.89_23.89|21.11_15.56_23.89_23.89|21.11_15.56_23.89_23.89|21.11_15.56_23.89_23.89|21.11_15.56_23.89_23.89|21.11_15.56_23.89_23.89|21.11_15.56_23.89_23.89|21.11_15.56_23.89_23.89|21.11_15.56_23.89_23.89|21.11_15.56_23.89_23.89|21.11_15.56_23.89_23.89|21.11_15.56_23.89_23.89|21.11_15.56_23.89_23.89|15.56_15.56_23.89_23.89|15.56_15.56_23.89_23.89|15.56_15.56_23.89_23.89|15.56_15.56_23.89_23.89|15.56_15.56_23.89_23.89", "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"], {3}: ["0.028309|6.669994|6.45834|0.149258", "21.1_21.1_24_24|21.1_21.1_24_24|21.1_21.1_24_24|21.1_21.1_24_24|21.1_21.1_24_24|21.1_21.1_24_24|21.1_21.1_24_24|21.1_21.1_24_24|21.1_21.1_24_24|21.1_21.1_24_24|21.1_21.1_24_24|21.1_21.1_24_24|21.1_21.1_24_24|21.1_21.1_24_24|21.1_21.1_24_24|21.1_21.1_24_24|21.1_21.1_24_24|21.1_21.1_24_24|21.1_21.1_24_24|21.1_21.1_24_24|21.1_21.1_24_24|21.1_21.1_24_24|21.1_21.1_24_24|21.1_21.1_24_24", "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"], {4}: ["0.028309|6.669994|6.45834|0.149258", "21.7_21.7_24.4_24.4|21.7_21.7_24.4_24.4|21.7_21.7_24.4_24.4|21.7_21.7_24.4_24.4|21.7_21.7_24.4_24.4|21.7_21.7_24.4_24.4|21.7_21.7_24.4_24.4|21.7_21.7_24.4_24.4|21.7_21.7_24.4_24.4|21.7_21.7_24.4_24.4|21.7_21.7_24.4_24.4|21.7_21.7_24.4_24.4|21.7_21.7_24.4_24.4|21.7_21.7_24.4_24.4|21.7_21.7_24.4_24.4|21.7_21.7_24.4_24.4|21.7_21.7_24.4_24.4|21.7_21.7_24.4_24.4|21.7_21.7_24.4_24.4|21.7_21.7_24.4_24.4|21.7_21.7_24.4_24.4|21.7_21.7_24.4_24.4|21.7_21.7_24.4_24.4|21.7_21.7_24.4_24.4", "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"], {5}: ["0.269098|14.999495|7.642369|1.12574", "15.6_15.6_24_24|15.6_15.6_24_24|15.6_15.6_24_24|15.6_15.6_24_24|15.6_15.6_24_24|15.6_15.6_24_24|21_15.6_24_24|21_15.6_24_24|21_15.6_24_24|21_15.6_24_24|21_15.6_24_24|21_15.6_24_24|21_15.6_24_24|21_15.6_24_24|21_15.6_24_24|21_15.6_24_24|21_15.6_24_24|21_15.6_24_24|21_15.6_24_24|21_15.6_24_24|21_15.6_24_24|15.6_15.6_24_24|15.6_15.6_24_24|15.6_15.6_24_24", "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"], {6}: ["0.376737|9.999663|7.642369|0.94112", "15.6_15.6_24_24|15.6_15.6_24_24|15.6_15.6_24_24|15.6_15.6_24_24|15.6_15.6_24_24|15.6_15.6_24_24|17.8_15.6_24_24|20_15.6_24_24|21_15.6_24_24|21_15.6_24_24|21_15.6_24_24|21_15.6_24_24|21_15.6_24_24|21_15.6_24_24|21_15.6_24_24|21_15.6_24_24|21_15.6_24_24|21_15.6_24_24|21_15.6_24_24|21_15.6_24_24|21_15.6_24_24|15.6_15.6_24_24|15.6_15.6_24_24|15.6_15.6_24_24", "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"], {7}: ["0.045962|11.84029|4.413199|0.257708", "21.11_21.11_21.11_21.11|21.11_21.11_21.11_21.11|21.11_21.11_21.11_21.11|21.11_21.11_21.11_21.11|21.11_21.11_21.11_21.11|21.11_21.11_21.11_21.11|21.11_21.11_21.11_21.11|21.11_21.11_21.11_21.11|21.11_21.11_21.11_21.11|21.11_21.11_21.11_21.11|21.11_21.11_21.11_21.11|21.11_21.11_21.11_21.11|21.11_21.11_21.11_21.11|21.11_21.11_21.11_21.11|21.11_21.11_21.11_21.11|21.11_21.11_21.11_21.11|21.11_21.11_21.11_21.11|21.11_21.11_21.11_21.11|21.111_21.11_21.111_21.11|21.111_21.11_21.111_21.11|21.111_21.11_21.111_21.11|21.111_21.11_21.111_21.11|21.111_21.11_21.111_21.11|21.111_21.11_21.111_21.11", "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"], {8}: ["0.038427|6.748965|4.413199|0.121267", "21.11_21.11_21.11_21.11|21.11_21.11_21.11_21.11|21.11_21.11_21.11_21.11|21.11_21.11_21.11_21.11|21.11_21.11_21.11_21.11|21.11_21.11_21.11_21.11|21.11_21.11_21.11_21.11|21.11_21.11_21.11_21.11|21.11_21.11_21.11_21.11|21.11_21.11_21.11_21.11|21.11_21.11_21.11_21.11|21.11_21.11_21.11_21.11|21.11_21.11_21.11_21.11|21.11_21.11_21.11_21.11|21.11_21.11_21.11_21.11|21.11_21.11_21.11_21.11|21.11_21.11_21.11_21.11|21.11_21.11_21.11_21.11|21.11_21.11_21.11_21.11|21.11_21.11_21.11_21.11|21.11_21.11_21.11_21.11|21.11_21.11_21.11_21.11|21.11_21.11_21.11_21.11|21.11_21.11_21.11_21.11", "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"], {9}: ["0.05382|43.0556|14.315987|0.028594", "22.22_22.22_22.22_22.22|22.22_22.22_22.22_22.22|22.22_22.22_22.22_22.22|22.22_22.22_22.22_22.22|22.22_22.22_22.22_22.22|22.22_22.22_22.22_22.22|22.22_22.22_22.22_22.22|22.22_22.22_22.22_22.22|22.22_22.22_22.22_22.22|22.22_22.22_22.22_22.22|22.22_22.22_22.22_22.22|22.22_22.22_22.22_22.22|22.22_22.22_22.22_22.22|22.22_22.22_22.22_22.22|22.22_22.22_22.22_22.22|22.22_22.22_22.22_22.22|22.22_22.22_22.22_22.22|22.22_22.22_22.22_22.22|22.22_22.22_22.22_22.22|22.22_22.22_22.22_22.22|22.22_22.22_22.22_22.22|22.22_22.22_22.22_22.22|22.22_22.22_22.22_22.22|22.22_22.22_22.22_22.22", "0.05_0.05_0.2_0.2_0.2_0.1|0.05_0.05_0.2_0.2_0.2_0.1|0.05_0.05_0.2_0.2_0.2_0.1|0.05_0.05_0.2_0.2_0.2_0.1|0.05_0.05_0.2_0.2_0.2_0.1|0.05_0.05_0.2_0.3_0.3_0.1|0.1_0.1_0.3_0.3_0.5_0.1|0.2_0.1_0.4_0.4_0.9_0.4|0.9_0.3_0.5_0.4_0.9_0.4|0.9_0.3_0.5_0.4_0.9_0.4|0.45_0.3_0.5_0.4_0.9_0.4|0.45_0.3_0.4_0.3_0.8_0.2|0.9_0.1_0.5_0.3_0.9_0.2|0.9_0.1_0.5_0.3_0.9_0.2|0.9_0.1_0.5_0.3_0.9_0.2|0.9_0.1_0.5_0.3_0.9_0.2|0.9_0.1_0.4_0.2_0.9_0.1|0.3_0.05_0.3_0.2_0.5_0.1|0.1_0.05_0.3_0.2_0.5_0.1|0.1_0.05_0.2_0.2_0.3_0.1|0.1_0.05_0.2_0.2_0.3_0.1|0.05_0.05_0.2_0.2_0.2_0.1|0.05_0.05_0.2_0.2_0.2_0.1|0.05_0.05_0.2_0.2_0.2_0.1"]))
branch_16 = TreeBranch(Tree=txt_5, Path=number, MaintainPaths=True)
vertical = Panel(cluster_6.beta)
item_3 = ListItem(List=branch_16, Index=0, Wrap=True)  # -> Item, Item1, Item2
panel_18 = Panel("""{21}
{22}
{23}
{24}""")
branch_17 = TreeBranch(Tree=text, Path=panel_18, MaintainPaths=True)
split = TextSplit(Text=item_3.Item, Separators="|")
panel_19 = Panel("""S
SE
E
NE
N
NW
W
SW
Roof(Hor)""")
item_4 = ListItem(List=split, Index=0, Wrap=True)  # -> Item, Item1, Item2, Item3
one_over_x = OneOverX(Value=item_4.Item)
merge_5 = Merge(Data1=flatten(cluster_5.horizonangles), Data2=flatten(""))
merge_6 = Merge(Data1=flatten(cluster_6.alpha), Data2=flatten(""))
merge_7 = Merge(Data1=flatten(cluster_6.beta), Data2=flatten(""))
dup_5 = DuplicateData(Number=9, Order=True)  # -> simplify(Data)
c_script_22 = CSharpScript(x=item_4.Item3, y="0.735")  # -> out, A; inputs x: list of Double, y: Double
# ---------- c_script_22: C# ----------
    if(x.Count > 0 )
      A = x[0] * y;
    else
      A = x;
# ---------- end c_script_22 ----------
dup_6 = DuplicateData(Number="4", Order=True)

number_6 = Number(branch_13)
number_7 = Number(branch_14)

num_7 = Number(cluster_4.R)
multiplication_2 = Multiplication(A=num_7, B=number_6)
multiplication_3 = Multiplication(A=number_6, B=number_7)
multiplication_4 = Multiplication(A=num_7, B=number_6, C=number_7)
c_script_23 = CSharpScript(x=number, y="120")  # -> out, A; inputs x: list of Double, y: Double
# ---------- c_script_23: C# ----------
    if(x.Count > 0 )
      A = y;
    else
      A =x;
# ---------- end c_script_23 ----------
item_5 = ListItem(
    List=["Very Light: 80,000 * Af", "Light : 110,000 * Af", "Medium: 165,000 * Af", "Heavy: 260,000 * Af", "Very heavy: 370,000 * Af"],
    Index=number_2,
    Wrap=True)
c_script_24 = CSharpScript(x=number, y="8.02")  # -> out, A; inputs x: list of Double, y: Double; same code as c_script_23
item_6 = ListItem(List=["Electricity", "Natural Gas", "Fuel"], Index=number_3, Wrap=True)
item_7 = ListItem(List=["Electricity", "Natural Gas", "Fuel"], Index=number_5, Wrap=True)
item_8 = ListItem(List=["Open terrain", "Country", "Urban / City"], Index=number_4, Wrap=True)
txt_6 = Text(item_6)
txt_7 = Text(item_7)
txt_8 = Text(multiplication_3)
txt_9 = Text(item_5)
txt_10 = Text(multiplication_4)
txt_11 = Text(item_8)
merge_8 = Merge(
    Data1=flatten(multiplication_2),
    Data2=flatten(one_over_x),
    Data3=flatten(c_script_23.A),
    Data4=flatten(item_4.Item1),
    Data5=flatten(item_4.Item2),
    Data6=flatten(c_script_24.A),
    Data7=flatten(c_script_22.A))
merge_9 = Merge(Data1=txt_6, Data2=txt_7)  # -> flatten(Result)
merge_10 = Merge(
    Data1=flatten(txt_11),
    Data2=flatten(txt_10),
    Data3=flatten(txt_8),
    Data4=flatten(""),
    Data5=flatten(""),
    Data6=flatten(txt_9))
join = TextJoin(Text=merge_10, Join="|")  # -> flatten(Result)
join_2 = TextJoin(Text=merge_9, Join="|")  # -> flatten(Result)
join_3 = TextJoin(Text=merge_8, Join="|")  # -> flatten(Result)

number_8 = Number(branch_15)
number_9 = Number(branch_17)

cluster_7 = Cluster_2(C=number_6, crv=curve_2, B=number_7, relay=number_8)  # -> wall_2, win_2
panel_20 = Panel(cluster_7.wall_2)
panel_21 = Panel(cluster_7.win_2)
bang_2 = ExplodeTree(Data=number_9)  # -> Branch0, Branch1, Branch2, Branch3
txt_12 = Text(flatten(cluster_7.win_2))
txt_13 = Text(flatten(cluster_7.wall_2))
num_8 = Number(bang_2.Branch3)
num_9 = Number(bang_2.Branch2)
multiplication_5 = Multiplication(A=bang_2.Branch1, B="0.176228083653")
multiplication_6 = Multiplication(A=bang_2.Branch0, B="0.176228083653")
merge_11 = Merge(Data1=flatten(txt_12), Data2=flatten(""))
merge_12 = Merge(Data1=flatten(txt_13), Data2=flatten(num_7))
c_script_25 = CSharpScript(SHGC=num_8, U=num_9)  # -> out, A; inputs SHGC: Double, U: Double
# ---------- c_script_25: C# ----------
    if(U>4.5 && SHGC <0.7206)
      A = 0.939998 * Math.Pow(SHGC, 2) + 0.20332 * SHGC;
    if(U > 4.5 && SHGC >= 0.7206)
      A = 1.30415*SHGC  - 0.30515;
    if(U < 3.4 && SHGC <= 0.15)
      A = 0.41040 * SHGC;
    if(U < 3.4 && SHGC > 0.15)
      A = 0.085775 * Math.Pow(SHGC, 2)+ 0.963954 *SHGC -0.084958;
# ---------- end c_script_25 ----------
one_over_x_2 = OneOverX(Value=multiplication_5)
one_over_x_3 = OneOverX(Value=multiplication_6)
merge_13 = Merge(Data1=flatten(one_over_x_3), Data2=flatten(0.85), Data3=flatten(0.85), Data4=flatten(" "))
merge_14 = Merge(Data1=flatten(num_9), Data2=flatten(" "), Data3=flatten(0.85), Data4=flatten(c_script_25.A))
merge_15 = Merge(Data1=flatten(one_over_x_2), Data2=flatten(0.85), Data3=flatten(0.85), Data4=flatten(" "))
entwine_4 = Entwine(
    Branch00=merge_12,
    Branch01=dup_5,
    Branch02=merge_11,
    Branch03=merge_6,
    Branch04=merge_7,
    Branch05=merge_5,
    FlattenInputs=True)  # -> simplify(Result)
entwine_5 = Entwine(Branch00=merge_15, Branch01=dup_6, Branch02=merge_13, Branch03=dup_6, Branch04=merge_14, FlattenInputs=True)  # -> simplify(Result)
flip = FlipMatrix(Data=entwine_4)
join_4 = TextJoin(Text=entwine_5, Join="_")  # -> flatten(Result)
join_5 = TextJoin(Text=flip, Join="_")  # -> flatten(Result)
join_6 = TextJoin(Text=join_4, Join="|")  # -> flatten(Result)
join_7 = TextJoin(Text=join_5, Join="|")  # -> flatten(Result)

multiplication_7 = Multiplication(A=cluster_4.R_2, B=number_6, C=number_7)
multiplication_8 = Multiplication(A=number_6, B=number_7)
multiplication_9 = Multiplication(A=cluster_4.R_2, B=number_6)
merge_16 = Merge(Data1=flatten(cluster_6.alpha), Data2=flatten(""))
merge_17 = Merge(Data1=flatten(cluster_6.beta), Data2=flatten(""))
entwine_6 = Entwine(Branch00=merge_3, Branch01=dup_2, Branch02=merge, Branch03=merge_16, Branch04=merge_17, FlattenInputs=True)  # -> simplify(Result)
flip_2 = FlipMatrix(Data=entwine_6)
merge_18 = Merge(
    Data1=flatten(multiplication_9),
    Data2=flatten(one_over_x),
    Data3=flatten(c_script_23.A),
    Data4=flatten(item_4.Item1),
    Data5=flatten(item_4.Item2),
    Data6=flatten(c_script_24.A),
    Data7=flatten(c_script_22.A))
merge_19 = Merge(
    Data1=flatten(txt_11),
    Data2=flatten(multiplication_7),
    Data3=flatten(multiplication_8),
    Data4=flatten(""),
    Data5=flatten(""),
    Data6=flatten(txt_9))
join_8 = TextJoin(Text=flip_2, Join="_")  # -> flatten(Result)
join_9 = TextJoin(Text=merge_19, Join="|")  # -> flatten(Result)
join_10 = TextJoin(Text=merge_18, Join="|")  # -> flatten(Result)
join_11 = TextJoin(Text=join_8, Join="|")  # -> flatten(Result)
merge_20 = Merge(Data1=flatten(item_3.Item1), Data2=flatten(item_3.Item2))
merge_21 = Merge(Data1=flatten(join), Data2=flatten(join_2), Data3=flatten(join_3), Data4=flatten(join_7), Data5=flatten(join_6))
merge_22 = Merge(Data1=flatten(join_9), Data2=flatten(join_2), Data3=flatten(join_10), Data4=flatten(join_11), Data5=flatten(join_6))
entwine_7 = Entwine(Branch00=merge_20, Branch01=merge_21, Branch02=merge_22, FlattenInputs=True)  # -> simplify(Result)
epc_connector = EPCConnectorMinus(
    RunComponent=run_energy,
    PathOfEpwFile=V,
    SheetNameToWrite=panel_14,
    StartEndCellsToWrite=entwine,
    ValuesToWrite=entwine_7,
    SheetNameToRead="RESULT",
    RowClnToRead="13_3|25_4",
    PathOfEpcExcelFileFile=epcspreadsheet)  # -> CellValueStringList, WorkingExcelFilePath, Location
panel_22 = Panel(epc_connector.WorkingExcelFilePath)
flip_3 = FlipMatrix(Data=epc_connector.CellValueStringList)

# ---- group: RH_OUT:weather_location
text_4 = Text(epc_connector.Location)

# ----
item_9 = ListItem(List=flip_3, Index=0, Wrap=True)  # -> flatten(Item), flatten(Item1)
split_2 = TextSplit(Text=item_9.Item1, Separators="_")  # -> simplify(Result)
split_3 = TextSplit(Text=item_9.Item, Separators="_")  # -> simplify(Result)
c_script_26 = CSharpScript(x=split_3)  # -> out, A; inputs x: String
# ---------- c_script_26: C# ----------
    double px;
    if (Double.TryParse(x, out px))
      A = Math.Round(px, 2);
    else
      A = 0;
# ---------- end c_script_26 ----------
c_script_27 = CSharpScript(x=split_2)  # -> out, A; inputs x: String; same code as c_script_26
multiplication_10 = Multiplication(A=c_script_26.A, B=item_2.Item)  # -> simplify(Result)
multiplication_11 = Multiplication(A=c_script_27.A, B=item_2.Item1)  # -> simplify(Result)
addition = Addition(A=multiplication_10, B=multiplication_11)
number_10 = Number(addition)
cluster_8 = Cluster_5(D=number_10)  # -> heating_and_cooling_need, heating_need, cooling_need, monthly_loads

# ----
# temporarily adding 0's for the equipment and lighting till we decide about them
panel_23 = Panel("2")
panel_24 = Panel("""0
0""")
python = GhPythonScript(tree=simplify(number_10), target=12)  # -> out, a; inputs tree: tree
# ---------- python: Python ----------
__author__ = "abuzr"
__version__ = "2024.05.02"

import rhinoscriptsyntax as rs

# delete the target branch
for i in range(0,tree.BranchCount):
    if i==target: tree.RemovePath(i)

    
a = tree
# ---------- end python ----------
ins = InsertItems(List=python.a, Item=panel_24, Indices=panel_23, Wrap=True)
merge_23 = Merge(Data1=cluster_8.heating_need, Data2=cluster_8.cooling_need, Data3="0", Data4="0")

flip_4 = FlipMatrix(Data=addition)

# ---- group: RH_OUT:energy_loads_metric
num_10 = Number(merge_23)

# ---- group: RH_OUT:energy_total_loads_metrics_tree
number_11 = Number(simplify(ins))

# ---- group: RH_OUT:Heating_Need
number_12 = Number(simplify(cluster_8.heating_need))

# ---- group: RH_OUT:Cooling_Need
number_13 = Number(simplify(cluster_8.heating_need))

# ---- group: RH_OUT:Heating&Cooling_Need
num_11 = Number(cluster_8.heating_and_cooling_need)

# ----
item_10 = ListItem(List=flip_4, Index="12", Wrap=True)  # -> flatten(Item)
cull_i = CullIndex(List=flip_4, Indices="12", Wrap=True)  # -> simplify(List)
c_script_28 = CSharpScript(x=cull_i)  # -> out, A; inputs x: String; same code as c_script_26
c_script_29 = CSharpScript(x=item_10)  # -> out, A; inputs x: String; same code as c_script_26

# ==== cluster Cluster
G = ClusterInput()
area = Area(Geometry=G)  # -> Area, Centroid
xy = XYPlane(Origin=area.Centroid)
planesrf = PlaneSurface(Plane=xy, XSize=Domain(-500, 500), YSize=Domain(-500, 500))
mplane = MeshPlane(Boundary=planesrf, WidthCount=10, HeightCount=10)  # -> Mesh, Area
demesh = DeconstructMesh(Mesh=mplane.Mesh)  # -> Vertices, Faces, Colours, Normals
item = ListItem(List=demesh.Vertices, Index=0, Wrap=True)
pdecon = Deconstruct(Point=item)  # -> XComponent, YComponent, ZComponent
Z = ClusterOutput(pdecon.ZComponent)

# ==== cluster Cluster_2
C = ClusterInput()
crv = ClusterInput()
B = ClusterInput()
relay = ClusterInput()
crv_2 = Curve(crv)
end = EndPoints(Curve=crv_2)  # -> Start, End
ln = Line(StartPoint=end.Start, EndPoint=end.End)
Z = UnitZ(Factor=1)
len = Length(Curve=crv_2)
amp = Amplitude(Vector=ln, Amplitude=1)
vrot = Rotate(Vector=graft(amp), Axis=Z, Angle=[1.570796327, -1.570796327])
curvepoint = PointOnCurve(crv_2, parameter=0.5)
join = JoinCurves(Curves=crv_2, Preserve=False)

# ---- group: Wall Areas
multiplication = Multiplication(A=len, B=B)

# ----
boundary = BoundarySurfaces(Edges=join)
addition = Addition(A=graft(curvepoint), B=vrot)
pull = PullPoint(Point=addition, Geometry=boundary, ClosestOnly=True)  # -> ClosestPoint, Distance
sort = SortList(Keys=pull.Distance, ValuesA=vrot)  # -> Keys, ValuesA
item = ListItem(List=reverse(sort.ValuesA), Index=0, Wrap=True)
Y = UnitY(Factor=-1)
pl = ConstructPlane(Origin=Point(0, 0, 0), XAxis=Vector(-1, 0, 0), YAxis=Vector(0, 1, 0))
angle = Angle(VectorA=item, VectorB=Y, Plane=pl)  # -> Angle, Reflex
pi = Pi(Factor=1)
B_2 = B(8)
division = Division(A=pi, B=B_2)
series = Series(Start=0, Step=division, Count=expr("(x*2)+1", B_2))
multiplication_2 = Multiplication(A=multiplication, B=C)
consec = ConsecutiveDomains(Numbers=series, Additive=False)
shift = ShiftList(List=consec, Shift=-1, Wrap=True)
multiplication_3 = Multiplication(A=multiplication_2, B=relay)
crv_3 = Curve(crv_2)
fdom = FindDomain(Domains=shift, Number=flatten(angle.Angle), Strict=False)  # -> Index, Neighbour
c_script = CSharpScript(x=multiplication_3, y=multiplication_3)  # -> out, A; inputs x: Double
# ---------- c_script: C# ----------
    if(x < 0)
      A = "";
    else
      A = y;
# ---------- end c_script ----------
subtraction = Subtraction(A=multiplication_2, B=multiplication_3)
division_2 = Division(A=fdom.Index, B=2)
c_script_2 = CSharpScript(x=multiplication_3, y=subtraction)  # -> out, A; inputs x: Double; same code as c_script
round = Round(Number=division_2)  # -> Nearest, Floor, Ceiling
panel = Panel("""S
SE
E
NE
N
NW
W
SW""")
panel_2 = Panel(subtraction)
num = Number(c_script.A)
num_2 = Number(c_script_2.A)
c_script_3 = CSharpScript(x=round.Floor, z=num_2, u=num, y=panel)  # -> out, Wall, Win; inputs x: list of Int32, z: list of Double, u: list of Double, y: list of String
# ---------- c_script_3: C# ----------
    if(x.Count != z.Count)return;
    List<string> strList1 = new List <string>();
    List<string> strList2 = new List <string>();

    for(int i = 0 ;i < y.Count;i++){
      double win = 0;
      double wall = 0;
      for(int j = 0 ;j < x.Count;j++){
        if(x[j] == i){
          if(u[j] >= 0){
            wall += z[j];
            win += u[j];
          }
        }
      }
      double n1;
      double n2;
      if(wall != 0){
        n1 = Math.Round(wall, 2);
      }
      else{
        n1 = 0;
      }
      if(win != 0){
        n2 = Math.Round(win, 2);
      }
      else{
        n2 = 0;
      }
      if(n1!=0)
        strList1.Add(n1.ToString());
      else
        strList1.Add("");

      if(n2 != 0)
        strList2.Add(n2.ToString());
      else
        strList2.Add("");

    }
    Wall = strList1;
    Win = strList2;
# ---------- end c_script_3 ----------
panel_3 = Panel(num_2)
win = Text(simplify(graft(c_script_3.Win)))
wall = Text(simplify(graft(c_script_3.Wall)))
panel_4 = Panel(num)
c_script_4 = CSharpScript(x=multiplication_3)  # -> out, A; inputs x: Double
# ---------- c_script_4: C# ----------
if(x<0)
      A = "";
    else
      A = x;
# ---------- end c_script_4 ----------
panel_5 = Panel(c_script_4.A)
wall_2 = ClusterOutput(wall)
win_2 = ClusterOutput(win)
panel_6 = Panel(wall)

# ==== cluster Cluster_4
data = ClusterInput()
panel = Panel("""CurveLng
VerticalSpacing
HorizontalSpacing
VerticalDepth
HorizontalDepth""")
data_2 = Data(data)
crv = ClusterInput()
item = ListItem(List=data_2, Index=0, Wrap=False)  # -> flatten(Item), flatten(Item1), flatten(Item2), flatten(Item3), flatten(Item4)
crv_2 = Curve(crv)
end = EndPoints(Curve=crv_2)  # -> Start, End
division = Division(A=item.Item1, B=2)  # -> flatten(Result)
division_2 = Division(A=item.Item2, B=2)  # -> flatten(Result)
ln = Line(StartPoint=end.Start, EndPoint=end.End)
Z = UnitZ(Factor=1)
division_3 = Division(A=item.Item3, B=division)
amp = Amplitude(Vector=ln, Amplitude=1)
division_4 = Division(A=item.Item4, B=division_2)
vrot = Rotate(Vector=graft(amp), Axis=Z, Angle=[1.570796327, -1.570796327])
curvepoint = PointOnCurve(crv_2, parameter=0.5)
join = JoinCurves(Curves=crv_2, Preserve=False)
atan = ArcTangent(Value=division_3)
atan_2 = ArcTangent(Value=division_4)
deg = Degrees(Radians=atan_2)
deg_2 = Degrees(Radians=atan)
boundary = BoundarySurfaces(Edges=join)
addition = Addition(A=graft(curvepoint), B=vrot)
pull = PullPoint(Point=addition, Geometry=boundary, ClosestOnly=True)  # -> ClosestPoint, Distance
sort = SortList(Keys=pull.Distance, ValuesA=vrot)  # -> Keys, ValuesA
panel_2 = Panel(deg_2)
pi = Pi(Factor=1)
B = B(8)
item_2 = ListItem(List=reverse(sort.ValuesA), Index=0, Wrap=True)
division_5 = Division(A=pi, B=B)
series = Series(Start=0, Step=division_5, Count=expr("(x*2)+1", B))
Y = UnitY(Factor=-1)
pl = ConstructPlane(Origin=Point(0, 0, 0), XAxis=Vector(-1, 0, 0), YAxis=Vector(0, 1, 0))
panel_5 = Panel(deg)
consec = ConsecutiveDomains(Numbers=series, Additive=False)
angle = Angle(VectorA=item_2, VectorB=Y, Plane=pl)  # -> Angle, Reflex
shift = ShiftList(List=consec, Shift=-1, Wrap=True)
fdom = FindDomain(Domains=shift, Number=flatten(angle.Angle), Strict=False)  # -> Index, Neighbour
division_6 = Division(A=fdom.Index, B=2)
round = Round(Number=division_6)  # -> Nearest, Floor, Ceiling
panel_7 = Panel(item.Item)
panel_9 = Panel(round.Floor)
panel_11 = Panel("""S
SE
E
NE
N
NW
W
SW""")
c_script = CSharpScript(x=round.Floor, z=deg, u=deg_2, v=item.Item, y=panel_11)  # -> out, A, alpha, beta, debug1, debug2; inputs x: list of Int32, z: list of Double, u: list of Double, v: list of Double, y: list of String
# ---------- c_script: C# ----------
    if(x.Count != z.Count)return;
    List<double> strList1 = new List <double>();
    List<double> strList2 = new List <double>();
    List<double> strList3 = new List <double>();

    for(int i = 0 ;i < y.Count;i++){
      double Alpha = 0;
      double Beta = 0;
      double SideLengthA = 0;
      double SideLengthB = 0;
      bool skipDir = true;
      for(int j = 0 ;j < x.Count;j++){
        if(x[j] == i){
          skipDir = false;
          if(z[j] > 0){
            Alpha += z[j] * v[j];
            SideLengthA += v[j];
          }

          if(u[j] > 0){
            Beta += u[j] * v[j];
            SideLengthB += v[j];

          }
        }

      }

      if(skipDir) continue;





      double a = (Alpha * 1.0 / SideLengthA * 1.0);
      double b = (Beta * 1.0 / SideLengthB * 1.0);

      debug1 = a;
      debug2 = b;


      if(!Double.IsNaN(a))
        strList1.Add(a);
      else
        strList1.Add(-1);
      if(!Double.IsNaN(b))
        strList2.Add(b);
      else
        strList2.Add(-1);


    }
    alpha = strList1;
    beta = strList2;
# ---------- end c_script ----------
cluster = Cluster_3(relay_2=c_script.alpha)
cluster_2 = Cluster_3(relay=c_script.beta)
panel_12 = Panel(c_script.alpha)
beta = ClusterOutput(cluster_2)
alpha = ClusterOutput(cluster)
panel_13 = Panel(cluster_2)

# ==== cluster Cluster_5
D = ClusterInput()
flip = FlipMatrix(Data=D)
cull_i = CullIndex(List=flip, Indices=12, Wrap=True)
item = ListItem(List=flip, Index=12, Wrap=True)  # -> flatten(Item)
ma = MassAddition(Input=cull_i)  # -> flatten(Result), PartialResults
ma_2 = MassAddition(Input=item)  # -> Result, PartialResults
c_script = CSharpScript(Number=ma.Result, Scope=0.1)  # -> out, A; inputs Number: Double, Scope: Double
# ---------- c_script: C# usings ----------
using System.IO;
using System.Linq;
using System.Data;
using System.Drawing;
using System.Reflection;
using System.Windows.Forms;
using System.Xml;
using System.Xml.Linq;
using System.Runtime.InteropServices;

using Rhino.DocObjects;
using Rhino.Collections;
using GH_IO;
using GH_IO.Serialization;
# ---------- c_script: C# ----------
    double x = Number;
    double y = Scope;
    double Divide = x / y;
    double wholeDiv = Math.Round(Divide);
    A = Scope * wholeDiv;
# ---------- end c_script ----------
c_script_2 = CSharpScript(Number=ma_2.Result, Scope=0.01)  # -> out, A; inputs Number: Double, Scope: Double; same code as c_script
format = Format(Format="Energy Need : {0}", Culture=127, Data0=c_script_2.A)
format_2 = Format(Format="{0} : {1} kwh", Culture=127, Data0=["Heating", "Cooling"], Data1=c_script.A)
monthly_loads = ClusterOutput(cull_i)
item_2 = ListItem(List=c_script.A, Index=0, Wrap=True)  # -> Item, Item1
heating_and_cooling_need = ClusterOutput(c_script_2.A)
cooling_need = ClusterOutput(item_2.Item1)
heating_need = ClusterOutput(item_2.Item)

# ==== cluster Cluster_6
se_threshold = Slider(0.5, range=0..1000)
relay = ClusterInput()
relay_2 = ClusterInput()
c_script = CSharpScript(x=relay, y=se_threshold)  # -> out, A; inputs x: Double, y: Double
# ---------- c_script: C# ----------
    if(x>=y)
      A = 1;
    else
      A = 0;
# ---------- end c_script ----------
larger = LargerThan(FirstNumber=relay_2, SecondNumber=0.5)  # -> LargerThan, OrEqualTo
larger_2 = LargerThan(FirstNumber=c_script.A, SecondNumber=0)  # -> LargerThan, OrEqualTo
int = Integer(larger.LargerThan)
cull = CullPattern(List=c_script.A, CullPattern=larger_2.LargerThan)
lng = ListLength(List=cull)
lng_2 = ListLength(List=c_script.A)
I = ClusterInput()
I_2 = ClusterInput()
avr = Average(Input=int)
division = Division(A=lng, B=lng_2)
avr_2 = Average(Input=I)
S = Scope(1)
avr_3 = Average(Input=I_2)
multiplication = Multiplication(A=division, B=100)
multiplication_2 = Multiplication(A=avr, B=100)
multiplication_3 = Multiplication(A=avr_2, B=100)
c_script_2 = CSharpScript(Number=avr_3, Scope=S)  # -> out, A; inputs Number: Double, Scope: Double; same code as c_script
c_script_3 = CSharpScript(Number=multiplication_2, Scope=S)  # -> out, A; inputs Number: Double, Scope: Double; same code as c_script
c_script_4 = CSharpScript(Number=multiplication, Scope=S)  # -> out, A; inputs Number: Double, Scope: Double; same code as c_script
null = NullItem(Item=avr_3)  # -> NullFlags, InvalidFlags, Description
c_script_5 = CSharpScript(Number=multiplication_3, Scope=S)  # -> out, A; inputs Number: Double, Scope: Double; same code as c_script
null_2 = NullItem(Item=avr_2)  # -> NullFlags, InvalidFlags, Description
null_3 = NullItem(Item=division)  # -> NullFlags, InvalidFlags, Description
null_4 = NullItem(Item=avr)  # -> NullFlags, InvalidFlags, Description
filter = StreamFilter(Gate=null.NullFlags, Stream0=c_script_2.A, Stream1="0")
filter_2 = StreamFilter(Gate=null_3.NullFlags, Stream0=c_script_4.A, Stream1="0")
filter_3 = StreamFilter(Gate=null_4.NullFlags, Stream0=c_script_3.A, Stream1="0")
filter_4 = StreamFilter(Gate=null_2.NullFlags, Stream0=c_script_5.A, Stream1="0")
merge = Merge(Data1=flatten(filter_3), Data2=flatten(filter_2), Data3=flatten(filter_4), Data4=flatten(filter))
c_script_6 = CSharpScript(x=merge, y=["0", "0", "0", "0"])  # -> out, A; inputs x: Double, y: Double
# ---------- c_script_6: C# ----------
    if(x == null){
      A = y;}
    else
      A = x;
# ---------- end c_script_6 ----------
format = Format(Format="{0}: {1} {2}", Culture=127, Data0=["sDA", "ASE", "UDIa", "MI"], Data1=c_script_6.A, Data2=["%", "%", "%", "lux"])
A = ClusterOutput(c_script_6.A)
T = ClusterOutput(format)

# ==== cluster Cluster_7
crv = ClusterInput()
crv_2 = Curve(crv)
end = EndPoints(Curve=crv_2)  # -> Start, End
ln = Line(StartPoint=end.Start, EndPoint=end.End)
Z = UnitZ(Factor=1)
amp = Amplitude(Vector=ln, Amplitude=1)
vrot = Rotate(Vector=graft(amp), Axis=Z, Angle=[1.570796327, -1.570796327])
curvepoint = PointOnCurve(crv_2, parameter=0.5)
join = JoinCurves(Curves=crv_2, Preserve=False)
boundary = BoundarySurfaces(Edges=join)
addition = Addition(A=graft(curvepoint), B=vrot)
pi = Pi(Factor=1)
_4 = B(4)
division = Division(A=pi, B=_4)
pull = PullPoint(Point=addition, Geometry=boundary, ClosestOnly=True)  # -> ClosestPoint, Distance
series = Series(Start=0, Step=division, Count=expr("(x*2)+1", _4))
sort = SortList(Keys=pull.Distance, ValuesA=vrot)  # -> Keys, ValuesA
item = ListItem(List=reverse(sort.ValuesA), Index=0, Wrap=True)
consec = ConsecutiveDomains(Numbers=series, Additive=False)
shift = ShiftList(List=consec, Shift=-1, Wrap=True)
Y = UnitY(Factor=-1)
pl = ConstructPlane(Origin=Point(0, 0, 0), XAxis=Vector(-1, 0, 0), YAxis=Vector(0, 1, 0))
angle = Angle(VectorA=item, VectorB=Y, Plane=pl)  # -> Angle, Reflex
fdom = FindDomain(Domains=shift, Number=flatten(angle.Angle), Strict=False)  # -> Index, Neighbour
# This numbers show which line belong to which direction
division_2 = Division(A=fdom.Index, B=2)
round = Round(Number=division_2)  # -> Nearest, Floor, Ceiling
F = ClusterOutput(round.Floor)

# ==== cluster Cluster_9
mesh = ClusterInput()
relay = ClusterInput()
relay_2 = ClusterInput()
relay_3 = ClusterInput()
B = ClusterInput()
mesh_2 = Mesh(mesh)
number_of_levels = Slider(3, range=0..10)
disjoint = DisjointMesh(Mesh=mesh_2)
branch = TreeBranch(Tree=relay_3, Path=["{13}", "{14}"], MaintainPaths=True)
bang = ExplodeTree(Data=branch)  # -> Branch0, Branch1
facen = FaceNormals(Mesh=relay_2)  # -> flatten(Centers), Normals
avr = Average(Input=facen.Centers)
div = DivideDomain(Domain=Domain(0, 1), Count=number_of_levels)
dedomain = DeconstructDomain(Domain=div)  # -> simplify(graft(Start)), simplify(graft(End))
pdecon = Deconstruct(Point=avr)  # -> XComponent, YComponent, ZComponent
division = Division(A=bang.Branch0, B=2)
subtraction = Subtraction(A=pdecon.ZComponent, B=division)
avr_2 = Average(Input=[dedomain.Start, dedomain.End])  # -> flatten(ArithmeticMean)
subtraction_2 = Subtraction(A=subtraction, B=B)
multiplication = Multiplication(A=bang.Branch0, B=bang.Branch1)
pt = ConstructPoint(XCoordinate=pdecon.XComponent, YCoordinate=pdecon.YComponent, ZCoordinate=subtraction_2)
panel = Panel(avr_2)
facen_2 = FaceNormals(Mesh=relay_2)  # -> Centers, Normals
multiplication_2 = Multiplication(A=multiplication, B=panel)
merge = Merge(Data1=flatten(multiplication_2), Data2=flatten(pdecon.ZComponent))
volume = Volume(Geometry=disjoint)  # -> Volume, Centroid
neg = Negative(Value=facen_2.Normals)
xy = XYPlane(Origin=volume.Centroid)
range = Range(Domain=Domain(0, 3.141592654), Steps=Slider(20, range=0..100))
merge_2 = Merge(Data1=neg, Data2=facen_2.Normals)
rotate = Rotate(Geometry=graft(xy), Angle=range, Plane=graft(volume.Centroid))  # -> Geometry, Transform
bbox = BoundingBox(Content=graft(disjoint), Plane=rotate.Geometry)  # -> Box, Box_2
multiplication_3 = Multiplication(A=merge_2, B=0.05)
number_slider = Slider(7, range=1..31)
tstat = TreeStatistics(Tree=simplify(bbox.Box))  # -> Paths, Length, Count
addition = Addition(A=facen_2.Centers, B=multiplication_3)
item = ListItem(List=tstat.Paths, Index=0, Wrap=True)
division_2 = Division(A=multiplication, B=2)
pi = Pi(Factor=Slider(0.25, range=0..1))
pdecon_2 = Deconstruct(Point=facen_2.Centers)  # -> XComponent, YComponent, ZComponent
dpath = DeconstructPath(Branch=item)
pull = PullPoint(Point=addition, Geometry=relay, ClosestOnly=True)  # -> ClosestPoint, Distance
neg_2 = Negative(Value=pi)
addition_2 = Addition(A=subtraction_2, B=merge)
lng = ListLength(List=dpath)
dom = ConstructDomain(DomainStart=neg_2, DomainEnd=pi)
sort = SortList(Keys=pull.Distance, ValuesA=multiplication_3)  # -> Keys, reverse(ValuesA)
pshift = ShiftPaths(Data=simplify(bbox.Box), Offset=-1)
larger = LargerThan(FirstNumber=lng, SecondNumber=1)  # -> LargerThan, OrEqualTo
range_2 = Range(Domain=dom, Steps=expr("x-1", number_slider))
pt_2 = ConstructPoint(XCoordinate=pdecon_2.XComponent, YCoordinate=pdecon_2.YComponent, ZCoordinate=addition_2)
item_2 = ListItem(List=sort.ValuesA, Index=0, Wrap=True)
lng_2 = ListLength(List=merge)
filter = StreamFilter(Gate=larger.LargerThan, Stream0=flatten(bbox.Box), Stream1=pshift)
Z = UnitZ(Factor=1)
dup = DuplicateData(Data=item_2, Number=lng_2, Order=True)  # -> simplify(graft(Data))
project = Project(Geometry=relay, Plane=pt)  # -> Geometry, Transform
volume_2 = Volume(Geometry=filter)  # -> Volume, Centroid
sort_2 = SortList(Keys=volume_2.Volume, ValuesA=filter)  # -> Keys, ValuesA
addition_3 = Addition(A=pt_2, B=item_2)
vrot = Rotate(Vector=dup, Axis=Z, Angle=range_2)
item_3 = ListItem(List=sort_2.ValuesA, Index=0, Wrap=True)  # -> flatten(Item)
Z_2 = UnitZ(Factor=multiplication)
line = LineSDL(Start=graft(addition_3), Direction=vrot, Length=100)
crv = ClusterInput()
extr = Extrude(Base=project.Geometry, Direction=Z_2)
end = EndPoints(Curve=line)  # -> graft(Start), End
bcx = BrepCurve(Brep=extr, Curve=graft(line))  # -> Curves, simplify(Points)
bcx_2 = BrepCurve(Brep=flatten(item_3), Curve=graft(line))  # -> Curves, Points
dist = Distance(PointA=end.Start, PointB=bcx.Points)
pull_2 = PullPoint(Point=bcx_2.Points, Geometry=flatten(addition_3), ClosestOnly=True)  # -> ClosestPoint, Distance
sort_3 = SortList(Keys=dist, ValuesA=bcx.Points)  # -> Keys, ValuesA
dup_2 = DuplicateData(Data=graft(pt_2), Number=simplify(flatten(number_slider)), Order=True)  # -> simplify(graft(Data))
crv_2 = Curve(crv)
item_4 = ListItem(List=sort_3.ValuesA, Index=0, Wrap=True)
sort_4 = SortList(Keys=pull_2.Distance, ValuesA=bcx_2.Points)  # -> Keys, ValuesA
end_2 = EndPoints(Curve=crv_2)  # -> Start, End
item_5 = ListItem(List=sort_4.ValuesA, Index=0, Wrap=False)
tstat_2 = TreeStatistics(Tree=simplify(sort_4.ValuesA))  # -> Paths, Length, Count
dist_2 = Distance(PointA=dup_2, PointB=item_4)
ln = Line(StartPoint=end_2.Start, EndPoint=end_2.End)
item_6 = ListItem(List=tstat_2.Paths, Index=0, Wrap=True)
clean = CleanTree(RemoveNulls=True, RemoveInvalid=True, RemoveEmpty=False, Tree=item_5)
panel_2 = Panel(item_4)
c_script = CSharpScript(x=bang.Branch0, y=bang.Branch1, u=dist_2)  # -> out, A; inputs x: Double, y: Double, u: String
# ---------- c_script: C# ----------
    if(!String.IsNullOrEmpty(u))
      A = ((x * y) / 2) / Convert.ToDouble(u);
    else
     A = null;
# ---------- end c_script ----------
dpath_2 = DeconstructPath(Branch=item_6)
lng_3 = ListLength(List=dpath_2)
lng_4 = ListLength(List=clean)
atan = ArcTangent(Value=c_script.A)
larger_2 = LargerThan(FirstNumber=lng_3, SecondNumber=1)  # -> LargerThan, OrEqualTo
lng_5 = ListLength(List=item_3)
pshift_2 = ShiftPaths(Data=lng_4, Offset=-1)
filter_2 = StreamFilter(Gate=larger_2.LargerThan, Stream0=lng_4, Stream1=pshift_2)
series = Series(Start=0, Step=1, Count=lng_5)
cull = CullPattern(List=flatten(series), CullPattern=filter_2)
Z_3 = UnitZ(Factor=1)
amp = Amplitude(Vector=ln, Amplitude=1)
replace = ReplaceItems(List=item_2, Item=addition_2, Indices=0, Wrap=False)  # -> simplify(graft(List))
item_7 = ListItem(List=cull, Index=0, Wrap=True)
vrot_2 = Rotate(Vector=graft(amp), Axis=Z_3, Angle=[1.570796327, -1.570796327])
curvepoint = PointOnCurve(crv_2, parameter=0.5)
join = JoinCurves(Curves=crv_2, Preserve=False)
item_8 = ListItem(List=item_3, Index=item_7, Wrap=True)
pt_3 = Point(addition_3)
debrep = DeconstructBrep(Brep=item_8)  # -> Faces, Edges, Vertices
dup_3 = DuplicateData(Data=replace, Number=number_slider, Order=True)  # -> simplify(graft(Data))
pshift_3 = ShiftPaths(Data=clean, Offset=-1)
dup_4 = DuplicateData(Data=graft(pt_3), Number=number_slider, Order=True)  # -> simplify(graft(Data))
pdecon_3 = Deconstruct(Point=debrep.Vertices)  # -> XComponent, YComponent, ZComponent
panel_3 = Panel(replace)
sort_5 = SortList(Keys=pdecon_3.ZComponent, ValuesA=debrep.Vertices)  # -> reverse(Keys), reverse(ValuesA)
boundary = BoundarySurfaces(Edges=join)
item_9 = ListItem(List=sort_5.Keys, Index=0, Wrap=True)  # -> simplify(Item)
addition_4 = Addition(A=graft(curvepoint), B=vrot_2)
dist_3 = Distance(PointA=dup_4, PointB=pshift_3)
c_script_2 = CSharpScript(x=item_9, y=dup_3)  # -> out, A; inputs x: String, y: String
# ---------- c_script_2: C# ----------
    if(String.IsNullOrEmpty(x))
      A = null;
    else
      A = Convert.ToDouble( x) - Convert.ToDouble(y);
# ---------- end c_script_2 ----------
pull_3 = PullPoint(Point=addition_4, Geometry=boundary, ClosestOnly=True)  # -> ClosestPoint, Distance
sort_6 = SortList(Keys=pull_3.Distance, ValuesA=vrot_2)  # -> Keys, ValuesA
pi_2 = Pi(Factor=1)
B_2 = B(8)
division_3 = Division(A=c_script_2.A, B=dist_3)
item_10 = ListItem(List=reverse(sort_6.ValuesA), Index=0, Wrap=True)
division_4 = Division(A=pi_2, B=B_2)
panel_4 = Panel(atan)
series_2 = Series(Start=0, Step=division_4, Count=expr("(x*2)+1", B_2))
Y = UnitY(Factor=-1)
pl = ConstructPlane(Origin=Point(0, 0, 0), XAxis=Vector(-1, 0, 0), YAxis=Vector(0, 1, 0))
panel_5 = Panel(division_3)
consec = ConsecutiveDomains(Numbers=series_2, Additive=False)
angle = Angle(VectorA=item_10, VectorB=Y, Plane=pl)  # -> Angle, Reflex
num = Number(simplify(graft(atan)))
ln_2 = Line(StartPoint=dup_4, EndPoint=pshift_3)
null = NullItem(Item=atan)  # -> simplify(graft(NullFlags)), InvalidFlags, Description
ln_3 = Line(StartPoint=dup_4, EndPoint=item_4)
atan_2 = ArcTangent(Value=division_3)  # -> simplify(Result)
shift = ShiftList(List=consec, Shift=-1, Wrap=True)
fdom = FindDomain(Domains=shift, Number=flatten(angle.Angle), Strict=False)  # -> Index, Neighbour
cull_2 = CullPattern(List=ln_3, CullPattern=invert(null.NullFlags))  # -> simplify(List)
cull_3 = CullPattern(List=num, CullPattern=invert(null.NullFlags))  # -> simplify(List)
cull_4 = CullPattern(List=ln_2, CullPattern=null.NullFlags)  # -> simplify(List)
cull_5 = CullPattern(List=atan_2, CullPattern=null.NullFlags)  # -> simplify(List)
division_5 = Division(A=fdom.Index, B=2)
merge_3 = Merge(Data1=cull_3, Data2=cull_5)
round = Round(Number=division_5)  # -> Nearest, Floor, Ceiling
panel_6 = Panel(atan_2)
pshift_4 = ShiftPaths(Data=merge_3, Offset=-1)
ma = MassAddition(Input=pshift_4)  # -> Result, PartialResults
crv_3 = Curve([cull_4, cull_2])
division_6 = Division(A=ma.Result, B=number_slider)
pshift_5 = ShiftPaths(Data=division_6, Offset=-1)
cull_i = CullIndex(List=pshift_5, Indices=expr("x-1", lng_2), Wrap=True)  # -> simplify(List)
item_11 = ListItem(List=pshift_5, Index=expr("x-1", lng_2), Wrap=True)
rad = Radians(Degrees=Slider(70, range=0..200))
subtraction_3 = Subtraction(A=lng_2, B=1)
B_3 = DomainEnd(rad)
A = DomainStart(Slider(0, range=0..1))
ma_2 = MassAddition(Input=cull_i)  # -> Result, PartialResults
dom_2 = ConstructDomain(DomainStart=B_3, DomainEnd=A)
panel_7 = Panel(ma_2.Result)
division_7 = Division(A=ma_2.Result, B=subtraction_3)
remap = RemapNumbers(Value=item_11, Source=dom_2, Target=Domain(0, 1))  # -> Mapped, Clipped
pshift_6 = ShiftPaths(Data=division_7, Offset=-1)
# High Exposure / Low Exposure
gradient = Gradient(
    LowerLimit=B_3,
    UpperLimit=A,
    Parameter=remap.Mapped,
    stops=[0: RGB(255, 255, 0), 0.471: RGB(255, 255, 0), 1: RGB(65, 105, 225)])
clean_2 = CleanTree(RemoveNulls=True, RemoveInvalid=True, RemoveEmpty=False, Tree=pshift_6)
lng_6 = ListLength(List=relay_2)
ma_3 = MassAddition(Input=clean_2)  # -> Result, PartialResults
division_8 = Division(A=ma_3.Result, B=lng_6)  # -> flatten(Result)
number_slider_2 = Slider(0.95, range=0..1)
ahsl = SplitAHSL(Colour=gradient)  # -> Alpha, Hue, Saturation, Luminance
col = Colour(simplify(graft(gradient)))
mesh_3 = Mesh(graft(relay_2))
len = Length(Curve=crv_2)
hsl = ColourHSL(Alpha=number_slider_2, Hue=ahsl.Hue, Saturation=ahsl.Saturation, Luminance=ahsl.Luminance)
panel_8 = Panel(division_8)
demesh = DeconstructMesh(Mesh=mesh_3)  # -> Vertices, Faces, Colours, Normals
demesh_2 = DeconstructMesh(Mesh=mesh_3)  # -> Vertices, Faces, Colours, Normals
hsl_2 = ColourHSL(Alpha=number_slider_2, Hue=Slider(0, range=0..1), Saturation=Slider(1, range=0..1), Luminance=Slider(0.38, range=0..1))
deg = Degrees(Radians=division_8)  # -> flatten(Degrees)
panel_9 = Panel(hsl)
null_2 = NullItem(Item=col)  # -> simplify(graft(NullFlags)), InvalidFlags, Description
conmesh = ConstructMesh(Vertices=demesh.Vertices, Faces=demesh.Faces, Colours=hsl)  # -> simplify(Mesh)
conmesh_2 = ConstructMesh(Vertices=demesh_2.Vertices, Faces=demesh_2.Faces, Colours=hsl_2)  # -> simplify(Mesh)
cull_6 = CullPattern(List=conmesh, CullPattern=invert(null_2.NullFlags))
panel_10 = Panel(deg)
c_script_3 = CSharpScript(x=round.Floor, z=deg, v=len)  # -> out, HorizonAngles, A; inputs x: list of Int32, z: list of Double, v: list of Double
# ---------- c_script_3: C# ----------
    if(x.Count != z.Count)return;
    List<string> strList1 = new List <string>();


    for(int i = 0 ;i < 8;i++){
      double Hrzn = 0;
      double SideLength = 0;
      for(int j = 0 ;j < x.Count;j++){
        if(x[j] == i){
          if(z[j] > 0){
            Hrzn += z[j] * v[j];
            SideLength += v[j];
          }
        }
      }


      double a = (Hrzn * 1.0 / SideLength * 1.0);

      if(a.ToString()!="NaN")
        strList1.Add(a.ToString());
      else
        strList1.Add("");


    }
    HorizonAngles = strList1;
# ---------- end c_script_3 ----------
cull_7 = CullPattern(List=conmesh_2, CullPattern=null_2.NullFlags)
crv_4 = Curve(crv_3)
merge_4 = Merge(Data1=simplify(cull_6), Data2=simplify(cull_7))
cluster = Cluster_8(relay=c_script_3.HorizonAngles)
panel_11 = Panel("""S
SE
E
NE
N
NW
W
SW""")
R = ClusterOutput(merge_4)
panel_12 = Panel(cluster)
panel_13 = Panel(null_2.NullFlags)
horizonangles = ClusterOutput(cluster)

# ==== cluster Cluster_10
relay = ClusterInput()
edges = BrepEdges(Brep=relay)  # -> Naked, Interior, NonManifold
join = JoinCurves(Curves=edges.Naked, Preserve=False)
number_slider = Slider(20, range=0..100)
ext = ExtendCurve(Curve=edges.Naked, Type=0, Start=number_slider, End=number_slider)
pipe = Pipe(Curve=ext, Radius="5", Caps=0)  # -> flatten(Pipe)
splitmul = SplitBrepMultiple(Brep=relay, Cutters=pipe)
c_script = CSharpScript(x=splitmul)  # -> out, A; inputs x: list of Brep; disabled
# ---------- c_script: C# ----------
    List<Brep> selected = new List<Brep>();
    for (int i = 0; i < x.Count; ++i) {
      if (x[i].IsValid) {
        selected.Add(x[i]); 
      }
      A = selected;
    }
# ---------- end c_script ----------
popgeo = PopulateGeometry(Geometry=splitmul, Count=1, Seed=1)  # -> flatten(Population)
pull = PullPoint(Point=popgeo, Geometry=join, ClosestOnly=True)  # -> ClosestPoint, Distance
larger = LargerThan(FirstNumber=pull.Distance, SecondNumber=5)  # -> LargerThan, OrEqualTo
cull = CullPattern(List=splitmul, CullPattern=invert(larger.LargerThan))
area = Area(Geometry=relay)  # -> Area, Centroid
area_2 = Area(Geometry=cull)  # -> Area, Centroid
ma = MassAddition(Input=area_2.Area)  # -> Result, PartialResults
srf = Surface(cull)
subtraction = Subtraction(A=area.Area, B=ma.Result)
R = ClusterOutput(ma.Result)
R_2 = ClusterOutput(subtraction)
srf_2 = ClusterOutput(srf)

# ==== cluster Cluster_3
relay = ClusterInput()
relay_2 = ClusterInput()
panel = Panel("""0
30
45
60""")
c_script = CSharpScript(x=simplify(graft(relay)), y=simplify(panel))  # -> out, A; inputs x: Double
# ---------- c_script: C# ----------
    if(x == -1)
      A = null;
    else
      A = Math.Abs(Convert.ToDouble(x) - Convert.ToDouble(y));
# ---------- end c_script ----------
sort = SortList(Keys=c_script.A, ValuesA=panel)  # -> Keys, ValuesA
item = ListItem(List=sort.ValuesA, Index=0, Wrap=True)  # -> flatten(Item)
c_script_2 = CSharpScript(x=relay, y=item)  # -> out, A; inputs x: String
# ---------- c_script_2: C# ----------
    if(String.IsNullOrEmpty(x))
      A = String.Empty;
    else
      A = y;
# ---------- end c_script_2 ----------
A = ClusterOutput(c_script_2.A)

# ==== cluster Cluster_8
relay = ClusterInput()
series = Series(Start=0, Step=10, Count=9)
c_script = CSharpScript(x=simplify(graft(relay)), y=simplify(series))  # -> out, A
# ---------- c_script: C# ----------
    if(x == null)
      A = null;
    else
      A = Math.Abs(Convert.ToDouble(x) - Convert.ToDouble(y));
# ---------- end c_script ----------
sort = SortList(Keys=c_script.A, ValuesA=series)  # -> Keys, ValuesA
item = ListItem(List=sort.ValuesA, Index=0, Wrap=True)  # -> flatten(Item)
c_script_2 = CSharpScript(x=relay, y=item)  # -> out, A; inputs x: String; same code as c_script_2
A = ClusterOutput(c_script_2.A)
