# Grasshopper definition daylight_sample_2.gh (Grasshopper 1.0.7)
# plug-ins: PW_AI, ShapeDiverForGrasshopper, Pufferfish, Heteroptera

center = Point(Point(3.511033938, 1.371262087, 0))
point2 = Point(Point(0.4274476005, -1.396124976, 0))
point1 = Point(Point(0.9706611853, -2.021825226, 0))
point2_2 = GetPoint(point2, AtLeast=0, AtMost=2147483647, Realtime=True, TreeAccess=False)
center_2 = GetPoint(center, AtLeast=0, AtMost=2147483647, Realtime=True, TreeAccess=False)
point1_2 = GetPoint(point1, AtLeast=0, AtMost=2147483647, Realtime=True, TreeAccess=False)
vec2pt = Vector2Pt(PointA=point2_2, PointB=center_2, Unitize=False)  # -> Vector, Length
Z = UnitZ(Factor=1)
dist = Distance(PointA=point1_2, PointB=center_2)
move = Move(Geometry=center_2, Motion=vec2pt.Vector)  # -> Geometry, Transform
length = Number(vec2pt.Length)
rotate = Rotate(Geometry=vec2pt.Vector, Angle=1.570796327, Plane=Z)  # -> Geometry, Transform
multiplication = Multiplication(A=dist, B=2)
unit = UnitVector(Vector=rotate.Geometry)
multiplication_2 = Multiplication(A=multiplication, B=unit)
move_2 = Move(Geometry=point1_2, Motion=multiplication_2)  # -> Geometry, Transform

# ---- group: Parameter
rotation = Slider(0, range=0..360)
depth = Slider(12, range=3..20)
width = Slider(12, range=3..20)

# ----
pt = Point(point2_2)
pt_2 = Point(move_2.Geometry)
pt_3 = Point(point1_2)
pt_4 = Point(move.Geometry)

# ---- group: Inputs
depth_2 = GetNumber(depth, AtLeast=1, AtMost=1, Maximum=1.797693135e+308, Minimum=-1.797693135e+308, TreeAccess=False)
width_2 = GetNumber(width, AtLeast=1, AtMost=1, Maximum=1.797693135e+308, Minimum=-1.797693135e+308, TreeAccess=False)
rotation_2 = GetNumber(rotation, AtLeast=1, AtMost=1, Maximum=1.797693135e+308, Minimum=-1.797693135e+308, TreeAccess=False)

# ----
rad = Radians(Degrees=rotation_2)
planesrf = PlaneSurface(Plane=PlaneXY(0, 0, 0), XSize=Domain(-10, 10), YSize=Domain(-10, 10))
xy = XYPlane(Origin=Point(0, 0, 0))
pt_5 = Point(pt_4)
angle = Data(rad)
width_3 = Data(width_2)
depth_3 = Data(depth_2)
pt_6 = Point(pt_2)
rotate_2 = Rotate(Geometry=planesrf, Angle=angle, Plane=xy)  # -> Geometry, Transform
dist_2 = Distance(PointA=pt_3, PointB=pt_6)
vec2pt_2 = Vector2Pt(PointA=pt_3, PointB=pt_6, Unitize=False)  # -> Vector, Length
pln = Plane(rotate_2.Geometry)
width_4 = Number(dist_2)
division = Division(A=vec2pt_2.Vector, B="2")
rev = Reverse(Vector=division)
rev_2 = Reverse(Vector=division)
move_3 = Move(Geometry=pt_5, Motion=rev)  # -> Geometry, Transform
move_4 = Move(Geometry=pt_5, Motion=division)  # -> Geometry, Transform
move_5 = Move(Geometry=point2_2, Motion=division)  # -> Geometry, Transform
move_6 = Move(Geometry=point2_2, Motion=rev_2)  # -> Geometry, Transform
pt_7 = Point(move_5.Geometry)
pt_8 = Point(move_3.Geometry)
pt_9 = Point(move_4.Geometry)
fin_depth_side_1 = Slider(1, range=0..1)
height = Slider(4, range=2.4..5)
window_u_side_1 = Slider(0, range=-1..1)
window_v_side_1 = Slider(0, range=-1..1)
window_height_norm_side_1 = Slider(0.99, range=0.01..0.99)
window_width_norm_side_1 = Slider(0.99, range=0.01..0.99)
n_fins_multiplier_side_1 = Slider(0.3, range=0..1)
window_u_side_2 = Slider(0, range=-1..1)
window_v_side_2 = Slider(0, range=-1..1)
window_height_norm_side_2 = Slider(0.99, range=0.01..0.99)
window_width_norm_side_2 = Slider(0.99, range=0.01..0.99)
fin_depth_side_2 = Slider(0, range=0..1)
n_fins_multiplier_side_2 = Slider(0.21, range=0..1)
window_u_side_3 = Slider(0, range=-1..1)
window_v_side_3 = Slider(0, range=-1..1)
window_height_norm_side_3 = Slider(0.99, range=0.01..0.99)
window_width_norm_side_3 = Slider(0.99, range=0.01..0.99)
fin_depth_side_3 = Slider(0, range=0..1)
n_fins_multiplier_side_3 = Slider(0.21, range=0..1)
window_u_side_4 = Slider(0, range=-1..1)
window_v_side_4 = Slider(0, range=-1..1)
window_height_norm_side_4 = Slider(0.99, range=0.01..0.99)
window_width_norm_side_4 = Slider(0.99, range=0.01..0.99)
fin_depth_side_4 = Slider(1, range=0..1)
n_fins_multiplier_side_4 = Slider(0.21, range=0..1)
wall_type = Slider(2, range=0..9)
floor_type = Slider(2, range=0..9)
ceiling_type = Slider(2, range=0..9)
glazing_type = Slider(2, range=0..9)
pt_10 = Point(move_6.Geometry)
rec_3pt = Rectangle3Pt(PointA=pt_8, PointB=pt_9, PointC=pt_7)  # -> Rectangle, Length
panel = Panel("3")
vec2pt_3 = Vector2Pt(Unitize=False)  # -> Vector, Length
window_height_norm = Data(window_height_norm_side_3)
window_height_norm_2 = Data(window_height_norm_side_4)
window_height_norm_3 = Data(window_height_norm_side_1)
window_height_norm_4 = Data(window_height_norm_side_2)
n_fins_multiplier = Data(n_fins_multiplier_side_2)
n_fins_multiplier_2 = Data(n_fins_multiplier_side_3)
window_width_norm = Data(window_width_norm_side_1)
n_fins_multiplier_3 = Data(n_fins_multiplier_side_1)
window_width_norm_2 = Data(window_width_norm_side_2)
window_width_norm_3 = Data(window_width_norm_side_3)
window_width_norm_4 = Data(window_width_norm_side_4)
n_fins_multiplier_4 = Data(n_fins_multiplier_side_4)
glazing_type_2 = Data(glazing_type)
ceiling_type_2 = Data(ceiling_type)
window_u = Data(window_u_side_1)
window_u_2 = Data(window_u_side_2)
window_u_3 = Data(window_u_side_3)
window_v = Data(window_v_side_3)
window_u_4 = Data(window_u_side_4)
window_v_2 = Data(window_v_side_4)
floor_type_2 = Data(floor_type)
window_v_3 = Data(window_v_side_1)
window_v_4 = Data(window_v_side_2)
fin_depth = Data(fin_depth_side_1)
fin_depth_2 = Data(fin_depth_side_2)
fin_depth_3 = Data(fin_depth_side_4)
fin_depth_4 = Data(fin_depth_side_3)
wall_type_2 = Data(wall_type)
height_2 = Data(height)
boxrec = BoxRectangle(Rectangle=rec_3pt.Rectangle, Height=height_2)

minimum_fin_spacing = Slider(0.3, range=0..1)
minimum_fin_spacing_2 = Data(minimum_fin_spacing)

# ---- group: room box
xy_2 = XYPlane(Origin=Point(0, 0, 0))
rotate_3 = Rotate(Geometry=xy_2, Angle=angle, Plane=PlaneXY(0, 0, 0))  # -> Geometry, Transform
box = CenterBox(Base=rotate_3.Geometry, X=expr("0.5*x", width_3), Y=expr("0.5*x", depth_3), Z=expr("0.5*x", height_2))
debrep = DeconstructBrep(Brep=boxrec)  # -> Faces, Edges, Vertices

# ----
ln = Line()
brep = Brep(rotate_2.Geometry)

number_slider = Slider(1, range=0..1)  # disabled
item = ListItem(List=debrep.Faces, Index="1", Wrap=True)
cluster = Cluster(srf=item, u=window_u_2, v=window_v_4, height_norm=window_height_norm_4, width_norm=window_width_norm_2)  # -> wall, window, plane, win_wid_vec, window_width, window_height
cluster_2 = Cluster_2(
    window_plane=cluster.plane,
    fin_depth=fin_depth_2,
    window_vector=cluster.win_wid_vec,
    window_height=cluster.window_height,
    window_width=cluster.window_width,
    fin_multiplier=n_fins_multiplier,
    min_fin_spacing=minimum_fin_spacing_2)  # -> louvers, louver_depth, louver_spacing, fins, fin_depth_2, fin_spacing

number_slider_2 = Slider(2, range=0..10)  # disabled
item_2 = ListItem(List=debrep.Faces, Index="2", Wrap=True)
cluster_3 = Cluster(srf=item_2, u=window_u_3, v=window_v, height_norm=window_height_norm, width_norm=window_width_norm_3)  # -> wall, window, plane, win_wid_vec, window_width, window_height
cluster_4 = Cluster_2(
    window_plane=cluster_3.plane,
    fin_depth=fin_depth_4,
    window_vector=cluster_3.win_wid_vec,
    window_height=cluster_3.window_height,
    window_width=cluster_3.window_width,
    fin_multiplier=n_fins_multiplier_2,
    min_fin_spacing=minimum_fin_spacing_2)  # -> louvers, louver_depth, louver_spacing, fins, fin_depth_2, fin_spacing

number_slider_3 = Slider(3, range=0..10)  # disabled
item_3 = ListItem(List=debrep.Faces, Index="3", Wrap=True)
cluster_5 = Cluster(srf=item_3, u=window_u_4, v=window_v_2, height_norm=window_height_norm_2, width_norm=window_width_norm_4)  # -> wall, window, plane, win_wid_vec, window_width, window_height
cluster_6 = Cluster_2(
    window_plane=cluster_5.plane,
    fin_depth=fin_depth_3,
    window_vector=cluster_5.win_wid_vec,
    window_height=cluster_5.window_height,
    window_width=cluster_5.window_width,
    fin_multiplier=n_fins_multiplier_4,
    min_fin_spacing=minimum_fin_spacing_2)  # -> louvers, louver_depth, louver_spacing, fins, fin_depth_2, fin_spacing

item_4 = ListItem(List=debrep.Faces, Index=0, Wrap=True)
cluster_7 = Cluster(srf=item_4, u=window_u, v=window_v_3, height_norm=window_height_norm_3, width_norm=window_width_norm)  # -> wall, window, plane, win_wid_vec, window_width, window_height
cluster_8 = Cluster_2(
    window_plane=cluster_7.plane,
    fin_depth=fin_depth,
    window_vector=cluster_7.win_wid_vec,
    window_height=cluster_7.window_height,
    window_width=cluster_7.window_width,
    fin_multiplier=n_fins_multiplier_3,
    min_fin_spacing=minimum_fin_spacing_2)  # -> louvers, louver_depth, louver_spacing, fins, fin_depth_2, fin_spacing

item_5 = ListItem(List=debrep.Faces, Index=Slider(4, range=0..10), Wrap=True)
item_6 = ListItem(List=debrep.Faces, Index=Slider(5, range=0..10), Wrap=True)
floor = Data(item_5)
ceiling = Data(item_6)
fin_spacing = Panel(cluster_8.fin_spacing)
windows = Merge(Data1=cluster_7.window, Data2=cluster.window, Data3=cluster_3.window, Data4=cluster_5.window)
louvers = Data([cluster_8.louvers, cluster_2.louvers, cluster_4.louvers, cluster_6.louvers])  # disabled
lng = ListLength(List=cluster_8.fins)
repeat = RepeatData(Data=cluster_8.fin_depth_2, Length=lng)
louver_spacing = Merge(
    Data1=cluster_8.louver_spacing,
    Data2=cluster_2.louver_spacing,
    Data3=cluster_4.louver_spacing,
    Data4=cluster_6.louver_spacing)
louver_depth = Merge(Data1=cluster_8.louver_depth, Data2=cluster_2.louver_depth, Data3=cluster_4.louver_depth, Data4=cluster_6.louver_depth)
fin_depths = Merge(Data1=cluster_8.fin_depth_2, Data2=cluster_2.fin_depth_2, Data3=cluster_4.fin_depth_2, Data4=cluster_6.fin_depth_2)
fin_spacings = Merge(Data1=cluster_8.fin_spacing, Data2=cluster_2.fin_spacing, Data3=cluster_4.fin_spacing, Data4=cluster_6.fin_spacing)
brep_2 = Brep(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)
brep_3 = Brep(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)
context = GetGeometry(AtLeast=1, AtMost=1, DeleteInput=False, Filter=1074004029, TreeAccess=False)
geo = Geometry([brep_2, brep_3, context])
ceilingtype = Slider(4, range=0..9)
glazingtype = Slider(4, range=0..9)
walltype = Slider(4, range=0..9)
floortype = Slider(4, range=0..9)
objdet = ObjectDetails(Object=geo)  # -> Referenced, Available, Name, Layer, Colour, Guid
panel_2 = Panel("ground")
null = NullItem(Item=brep_3)  # -> NullFlags, InvalidFlags, Description
c_script = CSharpScript(objsLayers=objdet.Layer, objs=geo)  # -> out, groundObjs, contextObjs; inputs objsLayers: list of String, objs: list of GeometryBase; disabled
# ---------- c_script: C# ----------
    List<GeometryBase> context = new List<GeometryBase>();
    List<GeometryBase> ground = new List<GeometryBase>();

    for(int i = 0 ; i < objs.Count; i++)
    {
      if(objsLayers[i].Equals("ground"))
      {
        ground.Add(objs[i]);
      }
      else {
        context.Add(objs[i]);
      }
    }
    contextObjs = context;
    groundObjs = ground;
# ---------- end c_script ----------
# Geometries
not = GateNot(A=null.NullFlags)
filter = StreamFilter(Gate=not, Stream0=context, Stream1=brep_3)

# ---- group: geometry inputs
srf = Surface(brep_2)
brep_4 = Brep(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)
brep_5 = Brep(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)
brep_6 = Brep(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)
brep_7 = Brep(brep_3)
brep_8 = Brep(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)

# ----
# Materials
panel_3 = Panel("0.0425")
panel_4 = Panel(walltype)
panel_5 = Panel(floortype)
panel_6 = Panel(ceilingtype)
panel_7 = Panel("Solarban 72 (2) on Starphire - Solarban 72 (4) on Starphire - Starphire")
panel_8 = Panel(glazingtype)
mesh = MeshBrep(
    Brep=brep_7,
    Settings={GridMaxCount=0, GridMinCount=16, JaggedSeams=False, MaxEdgeLength=0, MinEdgeLength=0.0001, MinTolerance=0, Refine=True, RefineAngle=0, RelativeTolerance=0.65, SimplePlanes=True, Tolerance=0})

# ---- group: RH_OUT:ground
ground = Mesh(srf)

# ---- group: RH_OUT:context
context_2 = Mesh(mesh)

# ----
num = Number(panel_3)
num_2 = Number("0.0975")
num_3 = Number("0.2174")
num_4 = Number("0.2984")
num_5 = Number("0.4191")
num_6 = Number("0.5065")
num_7 = Number("0.6214")
num_8 = Number("0.7052")
num_9 = Number("0.9253")
num_10 = Number("0.8069")
num_11 = Number("0.0507")
num_12 = Number("0.5720")
num_13 = Number("0.7000")
num_14 = Number("0.7233")
num_15 = Number("0.7803")
num_16 = Number("0.8060")
num_17 = Number("0.8220")
num_18 = Number("0.8490")
num_19 = Number("0.8718")
num_20 = Number("0.894")
num_21 = Number("0.7773")
num_22 = Number("0.0475")
num_23 = Number("0.1294")
num_24 = Number("0.2000")
num_25 = Number("0.2885")
num_26 = Number("0.3708")
num_27 = Number("0.4179")
num_28 = Number("0.5204")
num_29 = Number("0.6039")
num_30 = Number("0.7032")
num_31 = Number("0.9110")
num_32 = Number("0.214")
num_33 = Number("0.278")
num_34 = Number("0.359")
num_35 = Number("0.437")
num_36 = Number("0.512")
num_37 = Number("0.595")
num_38 = Number("0.678")
num_39 = Number("0.7540")
num_40 = Number("0.835")
filter_2 = StreamFilter(
    Gate=panel_6,
    Stream0="Black Ceiling",
    Stream1="Metal Reflector On Ceiling",
    Stream2="Ceiling LM83",
    Stream3="Plastic Ceiling Vent E14 526",
    Stream4="Specular Reflective Ceiling Panels",
    Stream5="Plastic Ceiling Vent E14 548",
    Stream6="White Painted Room Ceiling",
    Stream7="Dropped Ceiling Panel",
    Stream8="White Painted Corridor Ceiling",
    Stream9="White painted ceiling")
filter_3 = StreamFilter(
    Gate=ceilingtype,
    Stream0=num_11,
    Stream1=num_12,
    Stream2=num_13,
    Stream3=num_14,
    Stream4=num_15,
    Stream5=num_16,
    Stream6=num_17,
    Stream7=num_18,
    Stream8=num_19,
    Stream9=num_20)
filter_4 = StreamFilter(
    Gate=walltype,
    Stream0=num,
    Stream1=num_2,
    Stream2=num_3,
    Stream3=num_4,
    Stream4=num_5,
    Stream5=num_6,
    Stream6=num_7,
    Stream7=num_8,
    Stream8=num_10,
    Stream9=num_9)
filter_5 = StreamFilter(
    Gate=panel_4,
    Stream0="Black Ceramic wall Tile",
    Stream1="Darkgreen Ceramic Tile wall",
    Stream2="Grey Plaster wall",
    Stream3="Rough Concrete Wall",
    Stream4="Violet Painted Interior Walls",
    Stream5="Green Painted Wall",
    Stream6="Brown Ceramic Tile wall",
    Stream7="Pink Painted wall",
    Stream8="Matte White wall",
    Stream9="Whiteboard wall")
filter_6 = StreamFilter(
    Gate=floortype,
    Stream0=num_22,
    Stream1=num_23,
    Stream2=num_24,
    Stream3=num_25,
    Stream4=num_26,
    Stream5=num_27,
    Stream6=num_28,
    Stream7=num_29,
    Stream8=num_30,
    Stream9=num_21)
filter_7 = StreamFilter(
    Gate=panel_5,
    Stream0="Black Wooden Stage Floor",
    Stream1="Dark Grey Painted Floor",
    Stream2="Floor LM83",
    Stream3="Concrete Floor",
    Stream4="Light Grey Painted Floor",
    Stream5="Light Grey Floor Tiles Nonslip",
    Stream6="Light Wood Floor",
    Stream7="Light Grey Ceramic Tile floor",
    Stream8="Ceramic tile floor",
    Stream9="Light Blue Ceramic Tile floor")
filter_8 = StreamFilter(
    Gate=glazingtype,
    Stream0=num_32,
    Stream1=num_33,
    Stream2=num_34,
    Stream3=num_35,
    Stream4=num_36,
    Stream5=num_37,
    Stream6=num_38,
    Stream7=num_39,
    Stream8=num_40,
    Stream9=num_31)
filter_9 = StreamFilter(
    Gate=panel_8,
    Stream0="Pacifica - Solarban 90 (3)",
    Stream1="Vistacool on Pacifica - Sungate 400 (3)",
    Stream2="Pacifica - Sungate 400 (3)",
    Stream3="Solarban 90 (2) on Solexia - Clear",
    Stream4=panel_7,
    Stream5="Azuria - Clear",
    Stream6="Solexia - Clear (Argon)",
    Stream7="Clear - Sungate 400 (3) (Argon)",
    Stream8="Starphire - Starphire (Argon)",
    Stream9="Starphire")
sddisplay = LegacyDisplay(Geometry=[context_2, srf], ShapeDiverMaterial=ColourSwatch(SwatchColor=RGB(199, 199, 199)))
range = Range(Domain=Domain(0, 1), Steps=10)
sddp = ShapeDiverDocumentPayload({AbsoluteTolerance=0, AngleTolerance=0, DistanceDisplayPrecision=0, GltfVersion="Gltf2", GrasshopperVersion="1.0.0007", InputGroups="{}", OutputGroups="{}", RelativeTolerance=0, RhinoVersion="7.33.23248.13001", UnitSystem=0, VersionCreated="1.15.0.0", VersionSaved="1.15.0.0"})
finspacing = Number(fin_spacings)
findepth = Number(fin_depths)
panel_9 = Panel("C:\Users\abuzr\AppData\Roaming\Grasshopper\Libraries\net48\trained_model_v6-atlanta-fins-da-super.onnx")
Z_2 = UnitZ(Factor="0.762")
Z_3 = UnitZ(Factor=Slider(0.8, range=0..10))

# ---- group: visualize
walls = Data([cluster_7.wall, cluster.wall, cluster_5.wall, cluster_3.wall])
fins = Data([cluster_8.fins, cluster_2.fins, cluster_6.fins, cluster_4.fins])

# ----
wires = BrepWireframe(Brep=[louvers, fins, walls], Density=-1)

# ---- group: visualize (continued)
preview = CustomPreview(Geometry=[louvers, wires], Material=ColourSwatch(SwatchColor=RGB(0, 0, 0)))

# ----
walls_2 = Geometry(walls)
ceiling_2 = Geometry(ceiling)
floor_2 = Geometry(floor)
window = Geometry(windows)
shading = Data(fins)

null_2 = NullItem(Item=shading)  # -> NullFlags, InvalidFlags, Description
not_2 = GateNot(A=null_2.NullFlags)
cull = CullPattern(List=shading, CullPattern=not_2)
sddisplay_2 = LegacyDisplay(Geometry=[walls_2, floor_2, window, cull], ShapeDiverMaterial=ColourSwatch(SwatchColor=RGBA(112, 0, 0, 162)))
brep_9 = Brep([walls_2, floor_2, window, cull])
mesh_2 = MeshBrep(
    Brep=brep_9,
    Settings={GridMaxCount=0, GridMinCount=16, JaggedSeams=False, MaxEdgeLength=0, MinEdgeLength=0.0001, MinTolerance=0, Refine=True, RefineAngle=0, RelativeTolerance=0.65, SimplePlanes=True, Tolerance=0})

# ---- group: RH_OUT:brep
brep_10 = Brep(flatten(brep_9))

# ----
mjoin = MeshJoin(Meshes=flatten(mesh_2))

# ---- group: RH_OUT:mesh
mesh_3 = Mesh(mjoin)

# ---- group: analysis grid
Z_4 = UnitZ(Factor="0.762")
move_7 = Move(Geometry=floor_2, Motion=Z_4)  # -> Geometry, Transform
c__0_003 = CSharpScript(gridSurface=move_7.Geometry, spacing=0.6096, offset="0.0254 * 18", complex=Toggle(False))  # -> out, A, B, nU, nV, E; inputs gridSurface: Brep, spacing: Double, offset: Double, complex: Boolean
# ---------- c__0_003: C# ----------
    Surface srf = gridSurface.Faces[0];

    double width = 0.0;
    double depth = 0.0;
    srf.GetSurfaceSize(out width, out depth);

    srf.SetDomain(0, new Interval(0, width));
    srf.SetDomain(1, new Interval(0, depth));

    int n_usteps = (int) (0.999999999 + (width - 2.0 * offset) / spacing);
    int n_vsteps = (int) (0.999999999 + (depth - 2.0 * offset) / spacing);
    double u_spacing = (width - 2.0 * offset) / n_usteps;
    double v_spacing = (depth - 2.0 * offset) / n_vsteps;

    Mesh m = new Mesh();

    for (int i = 0; i < n_usteps + 1; ++i) {
      for (int j = 0; j < n_vsteps + 1; ++j) {
        Point3d pt;
        Vector3d[] vv;
        srf.Evaluate(offset + i * u_spacing, offset + j * v_spacing, 0, out pt, out vv);
        m.Vertices.Add(pt.X, pt.Y, pt.Z);
      }
    }

    for (int j = 0; j < n_usteps ; ++j) {
      for (int i = 0; i < n_vsteps ; ++i) {
        m.Faces.AddFace(new MeshFace(i + j * (n_vsteps + 1), i + (j + 1) * (n_vsteps + 1), i + (j + 1) * (n_vsteps + 1) + 1, i + j * (n_vsteps + 1) + 1));
      }
    }


    // filter vertices outside of the trimmed surface
    if (complex) {
      bool[] validVertices = new bool[m.Vertices.Count];
      for (int i = 0; i < validVertices.Length; ++i) {
        validVertices[i] = false;
      }

      for (int i = 0; i < m.Vertices.Count; ++i) {
        foreach (BrepFace face in  gridSurface.Faces) {
          if (!face.IsValid) continue;

          double u, v;
          face.ClosestPoint(m.Vertices[i], out u, out v);
          PointFaceRelation pfr = face.IsPointOnFace(u, v);
          if (pfr == PointFaceRelation.Interior) {
            validVertices[i] = true;
            break;
          }
        }
      }

      List<int> cullVertices = new List<int>();
      for (int i = 0; i < validVertices.Length; ++i) {
        if (!validVertices[i]) {
          cullVertices.Add(i);
        }
      }

      m.Vertices.Remove(cullVertices, true);
    }

    m.RebuildNormals();


    A = m;
    B = m.Vertices;
    nU = n_usteps;
    nV = n_vsteps;
    E = srf;
# ---------- end c__0_003 ----------

# ----
paramsubdivsrf = ParameterSubdivideSurface(Surface=move_7.Geometry, ParametersU=range, ParametersV=range)
pt_11 = Point(c__0_003.B)

# ---- group: RH_OUT:sensors
# sensor views (ray casting)
sensors = Point(c__0_003.B)

# ----
bang = ExplodeTree(Data=graft(window))  # -> Branch0, Branch1, Branch2, Branch3
fins_2 = Geometry(cull)
geo_2 = Geometry(flatten([bang.Branch1, bang.Branch2]))
geo_3 = Geometry(flatten([bang.Branch0, bang.Branch3]))
python = GhPythonScript(x=fins_2)  # -> out, a, b; inputs x: list
# ---------- python: Python ----------
__author__ = "AmpanavosS"
__version__ = "2023.05.04"

import rhinoscriptsyntax as rs

a = [0] * len(x)
b = [1] * len(x)
# ---------- end python ----------
center_3 = Center(Geometry=geo_3)  # -> Center, Dimension
sensor_views = CreateSensorViews(
    SensorsPositions=c__0_003.B,
    CeilingGeometries=ceiling_2,
    FloorGeometries=floor_2,
    WallsGeometries=geo_2,
    GlazingGeometries=geo_3,
    ShadingGeometries=fins_2,
    SurroundingGeometries=brep_7,
    GroundSurface=srf,
    CeilingReflectance=filter_3,
    FloorReflectance=filter_6,
    WallsReflectance=filter_4,
    GlazingTransparency=filter_8,
    FinDepth=python.a,
    FinSpacing=python.b,
    UpdatedRays=False,
    NumberOfPasses=1,
    ComputeSolution=Toggle(True),
    NumberOfThreads=-1)  # -> SensorViewsDataTree, SensorViewsMdArray
predictda = PredictDAFromGeometryAndMaterialInputs(
    SensorsPositions=c__0_003.B,
    CeilingGeometries=ceiling_2,
    FloorGeometries=floor_2,
    WallsGeometries=walls_2,
    GlazingGeometries=window,
    ShadingGeometries=window,
    SurroundingGeometries=brep_7,
    GroundSurface=srf,
    CeilingReflectance=filter_3,
    FloorReflectance=filter_6,
    WallsReflectance=filter_4,
    GlazingTransparency=filter_8,
    FinDepth=python.a,
    FinSpacing=python.b,
    ComputeSolution=Toggle(False),
    NumberOfThreads=-1,
    ProduceAdditionalDataForDebugging=False,
    IndexOfSensorToDebug=0)  # disabled

# ---- group: RH_OUT:centers
centers = Point(center_3.Center)

# ----
predictor = DaylightPredictor(SensorView=sensor_views.SensorViewsDataTree, ModelPath=panel_9)

# ---- group: RH_OUT:predictions
predictions = Number(predictor)

# ----
move_8 = Move(Geometry=floor_2, Motion=Z_2)  # -> Geometry, Transform
c__0_003_2 = CSharpScript(gridSurface=move_8.Geometry, spacing=0.6096, offset="0.0254 * 10", complex=Toggle(False))  # -> out, A, B, nU, nV, E; inputs gridSurface: Brep, spacing: Double, offset: Double, complex: Boolean; same code as c__0_003
gradient = Gradient(
    LowerLimit=1,
    UpperLimit=0,
    Parameter=predictions,
    stops=[0: RGB(234, 38, 0), 0.25: RGB(234, 126, 0), 0.5: RGB(254, 244, 84), 0.75: RGB(173, 203, 249), 1: RGB(75, 107, 169)])
mcol = MeshColours(Mesh=c__0_003_2.A, Colours=gradient)
move_9 = Move(Geometry=mcol, Motion=Z_3)  # -> Geometry, Transform

# ==== cluster Cluster
srf = ClusterInput()
u = ClusterInput()
v = ClusterInput()
height_norm = ClusterInput()
width_norm = ClusterInput()
pt = ConstructPoint(XCoordinate=expr("x+0.5", u), YCoordinate=expr("x+0.5", v), ZCoordinate=0)
srf_2 = Surface(reparameterize(srf))
dim = Dimensions(Surface=srf)  # -> UDimension, VDimension
multiplication = Multiplication(A=dim.VDimension, B=height_norm)
multiplication_2 = Multiplication(A=dim.UDimension, B=width_norm)
dom = ConstructDomain(DomainStart=expr("-0.5*x", multiplication), DomainEnd=expr("0.5*x", multiplication))
dom_2 = ConstructDomain(DomainStart=expr("-0.5*x", multiplication_2), DomainEnd=expr("0.5*x", multiplication_2))
evalsrf = EvaluateSurface(Surface=srf_2, Point=pt)  # -> Point, Normal, UDirection, VDirection, Frame
pl = ConstructPlane(Origin=evalsrf.Point, XAxis=evalsrf.UDirection, YAxis=evalsrf.VDirection)
rectangle = Rectangle(Plane=pl, XSize=dom_2, YSize=dom, Radius=0)  # -> Rectangle, Length
boundary = BoundarySurfaces(Edges=[srf_2, rectangle.Rectangle])
boundary_2 = BoundarySurfaces(Edges=rectangle.Rectangle)
srfpt = SurfacePoints(Surface=boundary_2)  # -> Points, Weights, Greville, UCount, VCount
item = ListItem(List=srfpt.Points, Index=Slider(0, range=0..10), Wrap=True)
item_2 = ListItem(List=srfpt.Points, Index=Slider(2, range=0..10), Wrap=True)
vec2pt = Vector2Pt(PointA=item, PointB=item_2, Unitize=False)  # -> Vector, Length
pl_origin = PlaneOrigin(Base=pl, Origin=item)
wall = ClusterOutput(boundary)
window = ClusterOutput(boundary_2)
plane = ClusterOutput(pl_origin)
win_wid_vec = ClusterOutput(vec2pt.Vector)
window_width = ClusterOutput(multiplication_2)
window_height = ClusterOutput(multiplication)

# ==== cluster Cluster_2
window_plane = ClusterInput()
fin_depth = ClusterInput()
window_vector = ClusterInput()
window_height = ClusterInput()
window_width = ClusterInput()
fin_multiplier = ClusterInput()
min_fin_spacing = ClusterInput()
data = Data(window_plane)
deplane = DeconstructPlane(Plane=window_plane)  # -> Origin, XAxis, YAxis, ZAxis
xy = XYPlane(Origin=window_plane)
c__louvers = CSharpScript(window_height=window_height, fin_multiplier=fin_multiplier, min_fin_spacing=min_fin_spacing, fin_depth=fin_depth)  # -> out, N_Fins, Spacing, Depth; inputs window_height: Double, fin_multiplier: Double, min_fin_spacing: Double, fin_depth: Double
# ---------- c__louvers: C# ----------
    int max_n_fins = (int) (window_height / min_fin_spacing);
    int n_fins = (int) (fin_multiplier * max_n_fins);
    double spacing;
    double depth;

    if (n_fins <= 1) {
      spacing = window_height;
      depth = 0;
    }
    else {
      spacing = window_height / (n_fins - 1);
      depth = fin_depth;
    }

    N_Fins = n_fins;
    Spacing = spacing;
    Depth = depth;
# ---------- end c__louvers ----------
c_script = CSharpScript(window_width=window_width, fin_multiplier=fin_multiplier, min_fin_spacing=min_fin_spacing, fin_depth=fin_depth)  # -> out, N_Fins, Spacing, Depth; inputs window_width: Double, fin_multiplier: Double, min_fin_spacing: Double, fin_depth: Double
# ---------- c_script: C# ----------
    int max_n_fins = (int) (window_width / min_fin_spacing);
    int n_fins = (int) (fin_multiplier * max_n_fins);
    double spacing;
    double depth;

    if (n_fins <= 1) {
      spacing = window_width;
      depth = 0;
    }
    else {
      spacing = window_width / (n_fins-1);
      depth = fin_depth;
    }

    N_Fins = n_fins;
    Spacing = spacing;
    Depth = depth;
# ---------- end c_script ----------
rotate = Rotate(Geometry=window_plane, Angle=-1.570796327, Plane=xy)  # -> Geometry, Transform
pl = ConstructPlane(Origin=deplane.Origin, XAxis=window_vector, YAxis=deplane.ZAxis)
panel = Panel(c_script.N_Fins)
rectangle = Rectangle(Plane=pl, XSize=window_width, YSize=c__louvers.Depth, Radius=0)  # -> Rectangle, Length
rectangle_2 = Rectangle(Plane=rotate.Geometry, XSize=c_script.Depth, YSize=window_height, Radius=0)  # -> Rectangle, Length
series = Series(Start=0, Step=c__louvers.Spacing, Count=c__louvers.N_Fins)
boundary = BoundarySurfaces(Edges=rectangle.Rectangle)
boundary_2 = BoundarySurfaces(Edges=rectangle_2.Rectangle)
series_2 = Series(Start=0, Step=c_script.Spacing, Count=c_script.N_Fins)
Z = UnitZ(Factor=series)
amp = Amplitude(Vector=window_vector, Amplitude=series_2)
move = Move(Geometry=boundary, Motion=Z)  # -> Geometry, Transform
move_2 = Move(Geometry=boundary_2, Motion=amp)  # -> Geometry, Transform
louvers = ClusterOutput(move.Geometry)
louver_depth = ClusterOutput(c__louvers.Depth)
louver_spacing = ClusterOutput(c__louvers.Spacing)
fins = ClusterOutput(move_2.Geometry)
fin_depth_2 = ClusterOutput(c_script.Depth)
fin_spacing = ClusterOutput(c_script.Spacing)
