# Grasshopper definition nonparametric.gh (Grasshopper 1.0.7)
# plug-ins: NGon, Parakeet, PW_AI, Human, eleFront

panel = Panel("\"{\\\"71a6daf7-953e-480a-99d8-ee2278d09a13\\\":{\\\"W Height\\\":0.5,\\\"W Length\\\":1.0}, \\\"61577a59-8976-4ac7-ac6b-5d3f35b7c5ba\\\":{\\\"W Height\\\":0.5,\\\"W Length\\\":1.0}}\"")
panel_2 = Panel("{\"71a6daf7-953e-480a-99d8-ee2278d09a13\":{\"W Height\":0.5,\"W Length\":1.0}, \"71fe5632-3d1d-4f95-bdc9-b06dcc632997\":{\"W Height\":0.5,\"W Length\":1.0},\"61577a59-8976-4ac7-ac6b-5d3f35b7c5ba\":{\"W Height\":0.5,\"W Length\":1.0}}")
panel_3 = Panel("{\"9d35a015-c3d4-4c56-a2d4-2f701ed46ed7\":{\"W Height\":0.25,\"W Length\":1.0}}")
panel_4 = Panel("\"\\\"{\\\\\\\"61577a59-8976-4ac7-ac6b-5d3f35b7c5ba\\\\\\\":{\\\\\\\"W Height\\\\\\\":\\\\\\\"0.5\\\\\\\",\\\\\\\"W Length\\\\\\\":\\\\\\\"1\\\\\\\"}}\\\"\"")
panel_5 = Panel("""9d35a015-c3d4-4c56-a2d4-2f701ed46ed7
909e96a6-d7b2-4e8d-b5a9-2ab78da1fde9
7e13be06-ca32-4ffd-a38b-cbdafcc1fb1c
6e2c9cbc-3bf6-4a66-a3e7-536e64e4f2ce""")
parametrized_walls_data = GetString(panel_2, AtLeast=0, AtMost=1, TreeAccess=False)  # disabled
clean = GhPythonScript(x=parametrized_walls_data)  # -> out, a; disabled
# ---------- clean: Python ----------
__author__ = "abuzr"
__version__ = "2023.11.07"

import rhinoscriptsyntax as rs


# JSON string with extra quotations
if(x and x[0] == '\"'):
    a = x.replace("\\", "")[1:-1]
else:
    a = x
# ---------- end clean ----------
panel_6 = Panel(parametrized_walls_data)
c_script = CSharpScript(x=clean.a, y="{\"\":{}}")  # -> out, A; disabled
# ---------- c_script: C# ----------
    if(x == null){
      A = y;
    }
    else {
      A = x;
    }
# ---------- end c_script ----------
parsing = GhPythonScript(x=c_script.A)  # -> out, a, keys, values, tree, path; disabled
# ---------- parsing: Python ----------
__author__ = "abuzr"
__version__ = "2023.11.07"

import rhinoscriptsyntax as rs
import json
import ghpythonlib.treehelpers as th

# Parse the JSON string to a JSON object
json_obj = json.loads(x)

all = []
pklist = []
keys = json_obj.keys()
i = 0
path = []
for k in json_obj:
    item =  json_obj[k]
    vals = []
    for x in range(0, 4):
        path.append("{"+str(i)+"}")
    i += 1       
    for pk in item:
        pv =  item[pk]
        pklist.append(pk)
        vals.append(pv)
    all.append(vals)

# values = json_obj.items()

tree = th.list_to_tree(all, source=[0,0])
# ---------- end parsing ----------
panel_7 = Panel(parsing.keys)

xz = XZPlane(Origin=Point(0, 0, 0))  # disabled
panel_8 = Panel("4")  # disabled
panel_9 = Panel("4")  # disabled
rectangle = Rectangle(Plane=xz, XSize=panel_8, YSize=panel_9, Radius=0)  # -> Rectangle, Length; disabled
srf = Surface(rectangle.Rectangle)  # disabled
walls = Geometry([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])
floor = Geometry(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)
ceiling = Geometry(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)
surrounding = Brep(<brep referenced from the Rhino model>)
item = ListItem(List=walls, Index=1, Wrap=True)
item_2 = ListItem(List=walls, Index=0, Wrap=True)
floor_2 = GetGeometry(floor, AtLeast=1, AtMost=1, DeleteInput=False, Filter=1074004029, TreeAccess=False)
walls_2 = GetGeometry(walls, AtLeast=1, AtMost=2147483647, DeleteInput=False, Filter=1074004029, TreeAccess=False)
ceiling_2 = GetGeometry(ceiling, AtLeast=1, AtMost=1, DeleteInput=False, Filter=1074004029, TreeAccess=False)

# ----
# 4. OKB, Wide, heigh of Window
number_slider = Slider(1, range=0..10)  # disabled
number_slider_2 = Slider(0, range=0..1)  # disabled
okb_window = Slider(1.6, range=0.3..1.6)  # disabled
heigh_window = Slider(3.3, range=0.1..3.3)  # disabled
wide_window = Slider(1.7, range=0.1..1.7)  # disabled
sdivide = DivideSurface(Surface=srf, UCount=number_slider, VCount=number_slider)  # -> Points, Normals, Parameters; disabled
item_3 = ListItem(List=sdivide.Points, Index=number_slider_2, Wrap=True)  # disabled
Z = UnitZ(Factor=okb_window)  # disabled
move = Move(Geometry=item_3, Motion=Z)  # -> flatten(Geometry), Transform; disabled
multiplication = Multiplication(A=wide_window, B=-1)  # disabled
item_4 = ListItem(List=move.Geometry, Index=1, Wrap=True)  # disabled
item_5 = ListItem(List=move.Geometry, Index=0, Wrap=True)  # disabled
dom = ConstructDomain(DomainStart=multiplication, DomainEnd=wide_window)  # disabled
dom_2 = ConstructDomain(DomainStart=0, DomainEnd=heigh_window)  # disabled
ln = Line(StartPoint=item_5, EndPoint=item_4)  # disabled
curvepoint = PointOnCurve(ln, parameter=0.501)  # disabled
xz_2 = XZPlane(Origin=curvepoint)  # disabled
rectangle_2 = Rectangle(Plane=xz_2, XSize=dom, YSize=dom_2, Radius=0)  # -> Rectangle, Length; disabled
s_hand_window = Surface(rectangle_2.Rectangle)  # disabled

parametrized_walls = GetGeometry(item_2, AtLeast=0, AtMost=2147483647, DeleteInput=False, Filter=1074004029, TreeAccess=False)
c_script_2 = CSharpScript(x=walls_2, y=parametrized_walls, z=walls_2)  # -> out, indices, values; inputs x: list of GeometryBase, y: list of GeometryBase, z: list of GeometryBase
# ---------- c_script_2: C# ----------
    List<int> indicesArr = new List<int>();
    List<GeometryBase> valuesArr = new List<GeometryBase>();
    if(y != null && x != null && z != null && y.Count > 0)
    {
      foreach(var i in y)
      {
        int iter = 0;
        foreach(var j in x)
        {
          
          if(Rhino.Geometry.GeometryBase.GeometryEquals(i, j)) // i.Equals(j)
          {
            indicesArr.Add(iter);
            valuesArr.Add(z[iter]);
          }
          iter += 1;
        }
      }
    }
    indices = indicesArr;
    values = valuesArr;
    /*
    values = []
    a = type(y[0])
    if y != None:
    for i in y:
      iter = 0
    for j in x:
      if i == j:
    indices.append(iter)
    values.append(z[iter])
    iter += 1
 */
# ---------- end c_script_2 ----------
ws_height = GetNumber("1.0", AtLeast=0, AtMost=2147483647, Maximum=1.797693135e+308, Minimum=-1.797693135e+308, TreeAccess=False)
ws_length = GetNumber("1", AtLeast=0, AtMost=2147483647, Maximum=1.797693135e+308, Minimum=-1.797693135e+308, TreeAccess=False)
parametrized_walls_2 = Geometry(c_script_2.values)
weave = Weave(Pattern=[0, 1], Stream0=graft(ws_height), Stream1=graft(ws_length), NullGaps=False)
panel_10 = Panel("""{0}
{0}
{0}
{0}
{1}
{1}
{1}
{1}""")
panel_11 = Panel(weave)
path_generator = GhPythonScript(vals=ws_length)  # -> out, path; inputs vals: list
# ---------- path_generator: Python ----------
__author__ = "abuzr"
__version__ = "2023.11.13"

import rhinoscriptsyntax as rs
path = []
i = 0
for k in vals:
    for x in range(0, 4):
        path.append("{"+str(i)+"}")
    i = i + 1
# ---------- end path_generator ----------
dim = Dimensions(Surface=parametrized_walls_2)  # -> UDimension, VDimension
dom_3 = ConstructDomain(DomainStart=0, DomainEnd=dim.UDimension)
dup = DuplicateData(Data=panel_11, Number=2, Order=True)  # -> simplify(Data)
planesrf = PlaneSurface(Plane=parametrized_walls_2, XSize=dom_3, YSize=dom_3)
explode = Explode(Curve=parametrized_walls_2, Recursive=True)  # -> Segments, Vertices
neg = Negative(Value=dup)
offset = OffsetCurve(Curve=explode.Segments, Distance=neg, Plane=graft(planesrf), Corners=1)  # -> simplify(Curve)

glazing_t = Slider(0.3, range=0..1)
ceiling_r = Slider(0.5, range=0..1)
floor_r = Slider(0.2, range=0..1)
wall_r = Slider(0.5, range=0..1)

tree = CreateTree(Data=flatten(offset), Path=path_generator.path)
mcx = MultipleCurves(Curves=tree)  # -> Points, IndexA, IndexB, ParamA, ParamB
ceiling_r_2 = GetNumber(ceiling_r, AtLeast=1, AtMost=1, Maximum=1.797693135e+308, Minimum=-1.797693135e+308, TreeAccess=False)
floor_r_2 = GetNumber(floor_r, AtLeast=1, AtMost=1, Maximum=1.797693135e+308, Minimum=-1.797693135e+308, TreeAccess=False)
wall_r_2 = GetNumber(wall_r, AtLeast=1, AtMost=1, Maximum=1.797693135e+308, Minimum=-1.797693135e+308, TreeAccess=False)
glazing_t_2 = GetNumber(glazing_t, AtLeast=1, AtMost=1, Maximum=1.797693135e+308, Minimum=-1.797693135e+308, TreeAccess=False)
alongcrv = SortAlongCurve(Points=mcx.Points, Curve=graft(parametrized_walls_2))  # -> Points, Indices
pline = PolyLine(Vertices=alongcrv.Points, Closed=invert(False))
X = UnitX(Factor=1)
facen = FaceNormals(Mesh=parametrized_walls_2)  # -> Centers, Normals
boundary = BoundarySurfaces(Edges=flatten([parametrized_walls_2, pline]))
c_script_3 = CSharpScript(x=facen.Normals, y=X)  # -> out, A; same code as c_script
window = Geometry(pline)
boundary_2 = BoundarySurfaces(Edges=flatten(window))
multiplication_2 = Multiplication(A=flatten(c_script_3.A), B="0.25")
move_2 = Move(Geometry=boundary_2, Motion=multiplication_2)  # -> Geometry, Transform
mesh = Mesh(move_2.Geometry)
glazing = Mesh(flatten(boundary_2))
floor_3 = Brep(floor_2)
colormesh = ColorMesh(Mesh=mesh, Color=RGB(30, 153, 235))
area = Area(Geometry=floor_3)  # -> Area, Centroid

# ---- group: RH_OUT:windows
mesh_2 = Mesh(colormesh)

# ----
xy = XYPlane(Origin=area.Centroid)
area_2 = Area(Geometry=floor_3)  # -> Area, Centroid
dom_4 = ConstructDomain(DomainStart=Slider(0.5, range=0..1), DomainEnd=Slider(1, range=0..4))
planesrf_2 = PlaneSurface(Plane=xy, XSize="-500 To 500", YSize="-500 To 500")
remap = RemapNumbers(Value=area_2.Area, Source=Domain(13.37305172, 408.2402504), Target=dom_4)  # -> Mapped, Clipped
Z_2 = UnitZ(Factor="0.762")
ground = Brep(planesrf_2)
rectangle_3 = Rectangle(Plane=PlaneXY(0, 0, 0), XSize=Domain(0, 0.1), YSize=Domain(0, 0.1), Radius=0)  # -> Rectangle, Length
move_3 = Move(Geometry=floor_3, Motion=Z_2)  # -> Geometry, Transform
c_script_4 = CSharpScript(x=glazing, y=rectangle_3.Rectangle)  # -> out, A
# ---------- c_script_4: C# ----------
    if(x == null)
    {
      A = y;
    }
    else {
      A = x;
    }
# ---------- end c_script_4 ----------
c__0_003 = CSharpScript(gridSurface=move_3.Geometry, spacing=remap.Mapped, offset="0.0254 * 10", complex=Toggle(True))  # -> out, A, B, nU, nV, E; inputs gridSurface: Brep, spacing: Double, offset: Double, complex: Boolean
# ---------- c__0_003: C# ----------
    Surface srf = gridSurface.Faces[0];

    double width = 0.0;
    double depth = 0.0;
    srf.GetSurfaceSize(out width, out depth);

    srf.SetDomain(0, new Interval(0, width));
    srf.SetDomain(1, new Interval(0, depth));

    int n_usteps = (int) (0.999999999 + (width - 2.0 * offset) / spacing);
    int n_vsteps = (int) (0.999999999 + (depth - 2.0 * offset) / spacing);
    double u_spacing = (width - 2.0 * offset) / n_usteps;
    double v_spacing = (depth - 2.0 * offset) / n_vsteps;

    Mesh m = new Mesh();

    for (int i = 0; i < n_usteps + 1; ++i) {
      for (int j = 0; j < n_vsteps + 1; ++j) {
        Point3d pt;
        Vector3d[] vv;
        srf.Evaluate(offset + i * u_spacing, offset + j * v_spacing, 0, out pt, out vv);
        m.Vertices.Add(pt.X, pt.Y, pt.Z);
      }
    }

    for (int j = 0; j < n_usteps ; ++j) {
      for (int i = 0; i < n_vsteps ; ++i) {
        m.Faces.AddFace(new MeshFace(i + j * (n_vsteps + 1), i + (j + 1) * (n_vsteps + 1), i + (j + 1) * (n_vsteps + 1) + 1, i + j * (n_vsteps + 1) + 1));
      }
    }


    // filter vertices outside of the trimmed surface
    if (complex) {
      bool[] validVertices = new bool[m.Vertices.Count];
      for (int i = 0; i < validVertices.Length; ++i) {
        validVertices[i] = false;
      }

      for (int i = 0; i < m.Vertices.Count; ++i) {
        foreach (BrepFace face in  gridSurface.Faces) {
          if (!face.IsValid) continue;

          double u, v;
          face.ClosestPoint(m.Vertices[i], out u, out v);
          PointFaceRelation pfr = face.IsPointOnFace(u, v);
          if (pfr == PointFaceRelation.Interior) {
            validVertices[i] = true;
            break;
          }
        }
      }

      List<int> cullVertices = new List<int>();
      for (int i = 0; i < validVertices.Length; ++i) {
        if (!validVertices[i]) {
          cullVertices.Add(i);
        }
      }

      m.Vertices.Remove(cullVertices, true);
    }

    m.RebuildNormals();


    A = m;
    B = m.Vertices;
    nU = n_usteps;
    nV = n_vsteps;
    E = srf;
# ---------- end c__0_003 ----------
walls_3 = Mesh(walls_2)
fins = GhPythonScript(x=c_script_4.A)  # -> out, a, b; inputs x: list
# ---------- fins: Python ----------
__author__ = "AmpanavosS"
__version__ = "2023.05.04"

import rhinoscriptsyntax as rs

a = [0] * len(x)
b = [1] * len(x)
# ---------- end fins ----------

# ---- group: Surrogate Model
predict_daylight = PredictDaylightMetricsFromGeometryAndMaterialInputsPWAIV01(
    SensorsPositions=c__0_003.B,
    CeilingGeometries=ceiling_2,
    FloorGeometries=floor_3,
    WallsGeometries=walls_3,
    GlazingGeometries=c_script_4.A,
    SurroundingGeometries=surrounding,
    GroundSurface=ground,
    CeilingReflectance=ceiling_r_2,
    FloorReflectance=floor_r_2,
    WallsReflectance=wall_r_2,
    GlazingTransparency=glazing_t_2,
    FinDepth=fins.a,
    FinSpacing=fins.b,
    ComputeSolution=Toggle(True),
    PredictDA=True,
    PredictSE=False,
    PredictMI=False,
    PredictUDI=False,
    NumberOfThreads=-1,
    ProduceAdditionalDataForDebugging=False,
    IndexOfSensorToDebug=0,
    City="Boston")  # -> PredictedDaylightAutonomy_sensor_array, PredictedSunlightExposure_sensor_array, PredictedMeanIlluminance_sensor_array, PredictedUsefulDaylightIlluminanceFailing_sensor_array, PredictedUsefulDaylightIlluminanceSupplementary_sensor_array, PredictedUsefulDaylightIlluminanceAcceptable_sensor_array, PredictedUsefulDaylightIlluminanceExcessive_sensor_array

# ---- group: RH_OUT:DA_metric
da_metric = Number(predict_daylight.PredictedDaylightAutonomy_sensor_array)

# ---- group: DA indicator
avr = Average(Input=predict_daylight.PredictedDaylightAutonomy_sensor_array)
custom_round = CustomRound(Numbers=avr, Scope=Slider(0.01, range=0..1))
format = Format(Format="DA = {0}", Culture=127, Data0=custom_round)
pt = ConstructPoint(XCoordinate=Slider(32, range=0..100), YCoordinate=Slider(87, range=0..100), ZCoordinate=0)
texttoscreen = RenderTextToScreen(
    Text=format,
    Location=pt,
    Size=Slider(37.182, range=0..100),
    Color=ColourSwatch(SwatchColor=RGB(255, 250, 102)),
    m_scWithvp=False)

# ----
metric = Integer()
which_daylight_metric_0_4 = Panel("0")

# ---- group: Inputs
metric_2 = GetInteger(metric, AtLeast=1, AtMost=1, Maximum=2147483647, Minimum=-2147483648, TreeAccess=False)

# ----
c_script_5 = CSharpScript(x=metric_2, y=which_daylight_metric_0_4)  # -> out, A; same code as c_script

# ---- group: DA Visualization
lng = ListLength(List=predict_daylight.PredictedUsefulDaylightIlluminanceFailing_sensor_array)
merge = Merge(
    Data1=graft(predict_daylight.PredictedUsefulDaylightIlluminanceFailing_sensor_array),
    Data2=graft(predict_daylight.PredictedUsefulDaylightIlluminanceSupplementary_sensor_array),
    Data3=graft(predict_daylight.PredictedUsefulDaylightIlluminanceAcceptable_sensor_array),
    Data4=graft(predict_daylight.PredictedUsefulDaylightIlluminanceExcessive_sensor_array))  # -> simplify(Result)
dup_2 = DuplicateData(Data=0.0001, Number=lng, Order=True)
ma = MassAddition(Input=merge)  # -> Result, PartialResults
merge_2 = Merge(Data1=simplify(graft(dup_2)), Data2=simplify(ma.PartialResults))  # -> simplify(Result)
dual = Dual(Mesh=c__0_003.A, Type=0)
demesh = DeconstructMesh(Mesh=c__0_003.A)  # -> Vertices, Faces, Colours, Normals
se_threshold = Slider(1000, range=0..1000)
faceb = FaceBoundaries(Mesh=dual)
c_script_6 = CSharpScript(x=predict_daylight.PredictedSunlightExposure_sensor_array, y=se_threshold)  # -> out, A; inputs x: Double, y: Double
# ---------- c_script_6: C# ----------
    if(x>=y)
      A = 1;
    else
      A = 0;
# ---------- end c_script_6 ----------
scale = Scale(Geometry=graft(faceb), Center=graft(demesh.Vertices), Factor=merge_2)  # -> Geometry, Transform
gradient = Gradient(
    LowerLimit=1,
    UpperLimit=0,
    Parameter=predict_daylight.PredictedDaylightAutonomy_sensor_array,
    stops=[0: RGB(234, 38, 0), 0.25: RGB(234, 126, 0), 0.5: RGB(254, 244, 84), 0.75: RGB(173, 203, 249), 1: RGB(75, 107, 169)])
gradient_2 = Gradient(LowerLimit=0, UpperLimit=1, Parameter=c_script_6.A, stops=[0: RGB(171, 171, 171), 1: RGB(251, 255, 0)])
shift = ShiftList(List=scale.Geometry, Shift=1, Wrap=False)
shift_2 = ShiftList(List=scale.Geometry, Shift=-1, Wrap=False)
rulesrf = RuledSurface(CurveA=shift, CurveB=shift_2)
se_threshold_2 = Slider(300, range=0..1000)
panel_12 = Panel("""0 to 100
100 to 300
300 to 3000
3000 to 10000""")
mesh_3 = MeshBrep(
    Brep=rulesrf,
    Settings={GridMaxCount=0, GridMinCount=16, JaggedSeams=False, MaxEdgeLength=0, MinEdgeLength=0.0001, MinTolerance=0, Refine=True, RefineAngle=0, RelativeTolerance=0.65, SimplePlanes=True, Tolerance=0})
c_script_7 = CSharpScript(x=gradient, y=ColourSwatch(SwatchColor=RGB(70, 100, 166)))  # -> out, A; inputs x: tree of Color, y: Color
# ---------- c_script_7: C# ----------
    if(x.BranchCount>0){
      A = x;}
    else
      A = y;
    
    //A = x.BranchCount > 0;
# ---------- end c_script_7 ----------
c_script_8 = CSharpScript(x=gradient_2, y=ColourSwatch(SwatchColor=RGB(70, 100, 166)))  # -> out, A; inputs x: tree of Color, y: Color; same code as c_script_7
merge_3 = Merge(
    Data1=ColourSwatch(SwatchColor=RGB(65, 128, 176)),
    Data2=ColourSwatch(SwatchColor=RGB(117, 186, 163)),
    Data3=ColourSwatch(SwatchColor=RGB(180, 224, 119)),
    Data4=ColourSwatch(SwatchColor=RGB(255, 176, 255)))  # -> graft(Result)
flip = FlipMatrix(Data=mesh_3)
mcol = MeshColours(Mesh=c__0_003.A, Colours=c_script_7.A)
mcol_2 = MeshColours(Mesh=c__0_003.A, Colours=c_script_8.A)
fdom = FindDomain(Domains=panel_12, Number=predict_daylight.PredictedMeanIlluminance_sensor_array, Strict=False)  # -> Index, Neighbour
c_script_9 = CSharpScript(x=predict_daylight.PredictedSunlightExposure_sensor_array, y=se_threshold_2)  # -> out, A; inputs x: Double, y: Double; same code as c_script_6
mcol_3 = MeshColours(Mesh=flip, Colours=merge_3)
gradient_3 = Gradient(LowerLimit=0, UpperLimit=1, Parameter=c_script_9.A, stops=[0: RGB(171, 171, 171), 1: RGB(180, 224, 119)])
item_6 = ListItem(List=flatten(merge_3), Index=fdom.Index, Wrap=True)
mcol_4 = MeshColours(Mesh=c__0_003.A, Colours=item_6)
c_script_10 = CSharpScript(x=gradient_3, y=ColourSwatch(SwatchColor=RGB(70, 100, 166)))  # -> out, A; inputs x: tree of Color, y: Color; same code as c_script_7
mcol_5 = MeshColours(Mesh=c__0_003.A, Colours=c_script_10.A)
mesh_4 = Mesh(mcol_4)
mesh_5 = Mesh(mcol_5)
mesh_6 = Mesh(mcol_3)
mesh_7 = Mesh(mcol_2)
mesh_8 = Mesh(mcol)
int = Integer(c_script_5.A)
filter = StreamFilter(Gate=int, Stream0=mesh_8, Stream1=mesh_7, Stream2=mesh_6, Stream3=mesh_5, Stream4=mesh_4)
mesh_9 = Mesh(filter)
Z_3 = UnitZ(Factor=Slider(0.1, range=0..10))
move_4 = Move(Geometry=mesh_9, Motion=Z_3)  # -> Geometry, Transform

# ---- group: RH_OUT:daylight_colors2
daylight_colors2 = Text(c_script_7.A)

# ---- group: RH_OUT:daylight_colors
daylight_colors = Colour(c_script_7.A)

# ---- group: RH_OUT:daylight_mesh
daylight_mesh = Mesh(move_4.Geometry)
