# Grasshopper definition parametricRoom-V10b.gh (Grasshopper 1.0.7)
# plug-ins: Pufferfish, Heteroptera, NGon, Parakeet, Human, PW_AI

# ---- group: Interface
r_height = Slider(3.8, range=1..6)
w_length = Slider(1, range=0.5..4)
w_height = Slider(2.5, range=0..4)
l_movement = Slider(0, range=-2..2)
v_movement = Slider(0, range=-2..2)
add_remove_fins = BooleanToggle(True)
f_multiplier = Slider(0.2, range=0..0.8)
f_depth = Slider(0.65, range=0..1)

glazing_t = Slider(0.3, range=0..1)
ceiling_r = Slider(0.5, range=0..1)
floor_r = Slider(0.2, range=0..1)
wall_r = Slider(0.5, range=0..1)

# ----
geo = Geometry({Plane=PlaneXY(0, 0, 0), X=Domain(-1, 1), Y=Domain(-1, 1), Z=Domain(-1, 1)})

# ---- group: Interface / Inputs
wall3 = GetInteger(AtLeast=1, AtMost=1, Maximum=2147483647, Minimum=-2147483648, TreeAccess=False)
wall0 = GetInteger("1", AtLeast=1, AtMost=1, Maximum=2147483647, Minimum=-2147483648, TreeAccess=False)
wall2 = GetInteger(AtLeast=1, AtMost=1, Maximum=2147483647, Minimum=-2147483648, TreeAccess=False)
wall1 = GetInteger(AtLeast=1, AtMost=1, Maximum=2147483647, Minimum=-2147483648, TreeAccess=False)

# ---- group: Interface
c_script = CSharpScript(x=wall0, y="0")  # -> out, A
# ---------- c_script: C# ----------
    if(x == null){
      A = y;}
    else
      A = x;
# ---------- end c_script ----------
c_script_2 = CSharpScript(x=wall3, y="0")  # -> out, A; same code as c_script
c_script_3 = CSharpScript(x=wall1, y="0")  # -> out, A; same code as c_script
c_script_4 = CSharpScript(x=wall2, y="0")  # -> out, A; same code as c_script
int = Integer([c_script.A, c_script_3.A, c_script_4.A, c_script_2.A])

# ----
c_script_5 = CSharpScript()  # -> out, A; inputs x: list
# ---------- c_script_5: C# ----------
    if(x == null){
      A = y;
    }
    else {
      A = x;
    }
# ---------- end c_script_5 ----------
walls = Integer(int)
metric = Integer()
which_daylight_metric_0_4 = Panel("0")

# ---- group: Inputs
metric_2 = GetInteger(metric, AtLeast=1, AtMost=1, Maximum=2147483647, Minimum=-2147483648, TreeAccess=False)

# ----
c_script_6 = CSharpScript(x=metric_2, y=which_daylight_metric_0_4)  # -> out, A; same code as c_script_5

# ---- group: Interface
cp = Slider(1.5, range=0..10)
zone = Curve(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)
c_script_7 = CSharpScript()  # -> out, A; inputs x: Curve, y: Curve; same code as c_script
c_script_8 = CSharpScript()  # -> out, A, B; inputs x: list of Brep, y: Brep
# ---------- c_script_8: C# ----------
    if(x.Count>0)
      A = x;
    else 
      A = y;
# ---------- end c_script_8 ----------

# ---- group: Inputs
add_remove_fins_2 = GetBoolean(add_remove_fins, AtLeast=1, AtMost=1, FalseValue="False", TreeAccess=False, TrueValue="True")
v_movement_2 = GetNumber(v_movement, AtLeast=1, AtMost=1, Maximum=1.797693135e+308, Minimum=-1.797693135e+308, TreeAccess=False)
context = GetGeometry(geo, AtLeast=1, AtMost=1, DeleteInput=False, Filter=1074004029, TreeAccess=False)
cp_2 = GetNumber(cp, AtLeast=1, AtMost=1, Maximum=1.797693135e+308, Minimum=-1.797693135e+308, TreeAccess=False)
r_height_2 = GetNumber(r_height, AtLeast=1, AtMost=1, Maximum=1.797693135e+308, Minimum=-1.797693135e+308, TreeAccess=False)
w_length_2 = GetNumber(w_length, AtLeast=1, AtMost=1, Maximum=1.797693135e+308, Minimum=-1.797693135e+308, TreeAccess=False)
w_height_2 = GetNumber(w_height, AtLeast=1, AtMost=1, Maximum=1.797693135e+308, Minimum=-1.797693135e+308, TreeAccess=False)
l_movement_2 = GetNumber(l_movement, AtLeast=1, AtMost=1, Maximum=1.797693135e+308, Minimum=-1.797693135e+308, TreeAccess=False)
f_multiplier_2 = GetNumber(f_multiplier, AtLeast=1, AtMost=1, Maximum=1.797693135e+308, Minimum=-1.797693135e+308, TreeAccess=False)
f_depth_2 = GetNumber(f_depth, AtLeast=1, AtMost=1, Maximum=1.797693135e+308, Minimum=-1.797693135e+308, TreeAccess=False)
ceiling_r_2 = GetNumber(ceiling_r, AtLeast=1, AtMost=1, Maximum=1.797693135e+308, Minimum=-1.797693135e+308, TreeAccess=False)
floor_r_2 = GetNumber(floor_r, AtLeast=1, AtMost=1, Maximum=1.797693135e+308, Minimum=-1.797693135e+308, TreeAccess=False)
wall_r_2 = GetNumber(wall_r, AtLeast=1, AtMost=1, Maximum=1.797693135e+308, Minimum=-1.797693135e+308, TreeAccess=False)
glazing_t_2 = GetNumber(glazing_t, AtLeast=1, AtMost=1, Maximum=1.797693135e+308, Minimum=-1.797693135e+308, TreeAccess=False)
zone_2 = GetGeometry(zone, AtLeast=1, AtMost=1, DeleteInput=False, Filter=1074004029, TreeAccess=False)

# ---- group: Interface (continued)
simplify = SimplifyCurve(Curve=zone_2, Tolerance=1)  # -> Curve, Simplified

# ----
merge = Merge(
    Data1=r_height_2,
    Data2=w_length_2,
    Data3=w_height_2,
    Data4=l_movement_2,
    Data5=v_movement_2,
    Data6=add_remove_fins_2,
    Data7=f_multiplier_2,
    Data8=f_depth_2,
    Data9=ceiling_r_2,
    Data10=floor_r_2,
    Data11=wall_r_2,
    Data12=glazing_t_2)

# ---- group: Interface / Clipping Plane
center = Center(Geometric=simplify.Curve)  # -> Center, Dimension
O = Origin(center.Center)
Z = UnitZ(Factor=cp_2)
move = Move(Geometry=O, Motion=Z)  # -> Geometry, Transform
xy = XYPlane(Origin=move.Geometry)
c_script_9 = CSharpScript(ClippingPlane=xy, flip=Toggle(True))  # -> out, A; inputs ClippingPlane: Plane, flip: Boolean
# ---------- c_script_9: C# ----------
    foreach(var obj in RhinoDocument.Objects){
      if(obj is Rhino.DocObjects.ClippingPlaneObject){
        doc.Objects.Delete(obj.Id, true);
      }
    }
    if(flip)
      ClippingPlane.Flip();
    id = RhinoDocument.Objects.AddClippingPlane(ClippingPlane, 0.5, 0.5, RhinoDocument.Views.ActiveView.ActiveViewportID);
    A = id;
# ---------- c_script_9: C# additional code ----------
  Guid id;
# ---------- end c_script_9 ----------

# ---- group: Geometry
lng = ListLength(List=walls)
button = Button()
c_script_10 = CSharpScript(Reset=button, SelectedSubWinWalls=walls, wallCount=lng)  # -> out, A; inputs Reset: Boolean, SelectedSubWinWalls: list of Int32, wallCount: Int32
# ---------- c_script_10: C# ----------
    if(Reset ){
      wallSubWinsList.Clear();
      for(int i = 0;i < wallCount ;i++)
        wallSubWinsList.Add(1);
    }


    wallSubWinsList = SelectedSubWinWalls;

    List<string> opts1 = new List<string> ();
    for(int i = 0 ;i < wallCount ;i++){

      if(wallSubWinsList.Count == wallCount){
        for(int j = 0 ;j < wallSubWinsList[i] ;j++){
          opts1.Add(i.ToString() + "-" + j.ToString());
        }
      }
    }
    A = opts1;
# ---------- c_script_10: C# additional code ----------
  int WallCount = 4;
  int WindowCount ;
  List<int> wallSubWinsList = new List<int> ();
# ---------- end c_script_10 ----------
cull_i = CullIndex(List=merge, Indices=0, Wrap=True)
explode = Explode(Curve=simplify.Curve, Recursive=True)  # -> Segments, Vertices
ceiling_thickness = Panel("0.1")
wall_thickness = Panel("0.1")
min_fin_spacing = Slider(0.1, range=0..1)
c_script_11 = CSharpScript(x=walls)  # -> out, A; inputs x: Int32
# ---------- c_script_11: C# ----------
    if(x ==0)
      x = 1;
    
    A = x;
# ---------- end c_script_11 ----------
crv = Curve(simplify(graft(explode.Segments)))
div = DivideDomain(Domain=Domain(0, 1), Count=walls)
div_2 = DivideDomain(Domain=Domain(0, 1), Count=c_script_11.A)
subcrv = SubCurve(BaseCurve=reparameterize(simplify(crv)), Domain=simplify(div_2))  # -> simplify(graft(Curve))
subcrv_2 = SubCurve(BaseCurve=reparameterize(simplify(crv)), Domain=simplify(div))  # -> graft(Curve)
clean = CleanTree(RemoveNulls=True, RemoveInvalid=True, RemoveEmpty=True, Tree=subcrv_2)
lng_2 = ListLength(List=subcrv_2)
equals = Equality(FirstNumber=lng_2, SecondNumber=0)  # -> Equality, Inequality
cull = CullPattern(List=subcrv, CullPattern=equals.Equality)
item = ListItem(List=merge, Index=0, Wrap=True)
boundary = BoundarySurfaces(Edges=simplify.Curve)
Z_2 = UnitZ(Factor=item)
move_2 = Move(Geometry=boundary, Motion=Z_2)  # -> Geometry, Transform
crv_2 = Curve(clean)
len = Length(Curve=crv_2)
multiplication = Multiplication(A=wall_thickness, B=2)
subtraction = Subtraction(A=len, B=multiplication)
offset_l = OffsetCurveLoose(Curve=simplify.Curve, Distance=[1, -1])
multiplication_2 = Multiplication(A=ceiling_thickness, B=2)
len_2 = Length(Curve=offset_l)
subtraction_2 = Subtraction(A=item, B=multiplication_2)
sort = SortList(Keys=len_2, ValuesA=offset_l)  # -> Keys, ValuesA
len_3 = Length(Curve=crv_2)
division = Division(A=item, B=2)
item_2 = ListItem(List=sort.ValuesA, Index=0, Wrap=True)
Z_3 = UnitZ(Factor=1)
crv_3 = Curve(clean)
extr = Extrude(Base=crv_3, Direction=Z_2)
clean_2 = CleanTree(RemoveNulls=True, RemoveInvalid=True, RemoveEmpty=True, Tree=cull)
join = JoinCurves(Curves=extr, Preserve=False)  # -> simplify(Curves)
extr_2 = Extrude(Base=clean_2, Direction=Z_2)
number_slider = Slider(0.014, range=0..0.02)
number_slider_2 = Slider(0.02, range=0..0.1)
neg = Negative(Value=number_slider)
neg_2 = Negative(Value=number_slider_2)
relay = Relay([number_slider, neg])
relay_2 = Relay([number_slider_2, neg_2])
dom = ConstructDomain(DomainStart=Slider(0.5, range=0..1), DomainEnd=Slider(1, range=0..4))
brep = Brep(context)
toggle = BooleanToggle(True)

# ----
lng_3 = ListLength(List=c_script_10.A)
series = Series(Start=0, Step=1, Count=lng_3)

# ---- group: Geometry / Floor
roof = Geometry(boundary)

# ---- group: Geometry / Ceiling
geo_2 = Geometry(move_2.Geometry)

# ---- group: Geometry
area = Area(Geometry=roof)  # -> Area, Centroid
xy_2 = XYPlane(Origin=area.Centroid)
planesrf = PlaneSurface(Plane=xy_2, XSize="-500 To 500", YSize="-500 To 500")

c_script_12 = CSharpScript(Reset=button, opts1=c_script_10.A, branches=series, newNumbers=cull_i)  # -> out, A; inputs Reset: Boolean, opts1: list of String, branches: list of Int32, newNumbers: list of Double
# ---------- c_script_12: C# ----------
    if(opts1.Count == 0) return;
///*
    bool Check = false;/////////////////////////
    if (opts1.Count != opts2.Count )
    {
      Check = true;////////////////////////////
      opts2.Clear();
      opts2.AddRange(opts1);
    }
    else{
      for(int i = 0; i < opts1.Count;i++){ //////////
        if( opts1[i] != opts2[i]){////////
          Check = true;////////////////////////////
          opts2.Clear();
          opts2.AddRange(opts1);
        }
      }
    }


    if(Reset || Check){
      AllInitialNumbers.ClearData();
      for(int i = 0 ;i < opts1.Count;i++){
        var brancheNames = opts1[i].Split('-');
        AllInitialNumbers.AddRange(Numbers, new GH_Path(new int[2]{Int32.Parse(brancheNames[0]),Int32.Parse(brancheNames[1])}));
      }
    }

    ///Regenerating input Values based on new numbers
    for(int j = 0 ;j < branches.Count;j++){
      var brancheNames = opts1[branches[j]].Split('-');
      var path = new GH_Path(new int[2]{Int32.Parse(brancheNames[0]),Int32.Parse(brancheNames[1])});
      if(AllInitialNumbers.PathExists(path)){
        AllInitialNumbers.Branch(path).Clear();
        AllInitialNumbers.AddRange(newNumbers, new GH_Path(path));
      }
    }

    ///Removing empty branches
    List<GH_Path> allBranchePathes = new List<GH_Path>();
    for(int i = 0 ;i < AllInitialNumbers.BranchCount ;i++){
      allBranchePathes.Add(AllInitialNumbers.Path(i));
    }
    for(int i = 0 ;i < allBranchePathes.Count ;i++){
      if(AllInitialNumbers.Branch(allBranchePathes[i]) != null){
        bool flag = AllInitialNumbers.Branch(allBranchePathes[i]).Count == 0;
        if(flag)
          AllInitialNumbers.RemovePath(allBranchePathes[i]);
      }
    }

    A = AllInitialNumbers;

//*/
# ---------- c_script_12: C# additional code ----------
  double[] Numbers = new double[11]{1.5,1.5,0,0,1,0.5,0.4,0.5,0.2,0.5,0.3};

  List<string> opts2 = new List<string>(){"0-0","1-0","2-0","3-0"};
  DataTree<double> AllInitialNumbers = new DataTree<double>();
# ---------- end c_script_12 ----------
item_3 = ListItem(List=c_script_12.A, Index=0, Wrap=True)  # -> Item, Item1, Item2, Item3, Item4, Item5, Item6
num = Number(item_3.Item)
num_2 = Number(item_3.Item1)
c_script_13 = CSharpScript(x=num, y=subtraction)  # -> out, A; inputs x: Double
# ---------- c_script_13: C# ----------
    double Number = 0;
    if(x >= y.Max)
      Number = y.Max;
    else if(x<= y.Min)
      Number = y.Min;
    else
      Number = x;
    
    A = Number;
# ---------- end c_script_13 ----------
c_script_14 = CSharpScript(x=num_2, y=subtraction_2)  # -> out, A; inputs x: Double; same code as c_script_13
subtraction_3 = Subtraction(A=subtraction, B=c_script_13.A)
subtraction_4 = Subtraction(A=item, B=c_script_14.A)
num_3 = Number(item_3.Item3)
c_script_15 = CSharpScript(x=subtraction_3)  # -> out, A; inputs x: Double
# ---------- c_script_15: C# ----------
    x = x / 2;
    Interval Intrvl = new Interval(-x, x);
    A = Intrvl;
# ---------- end c_script_15 ----------
num_4 = Number(item_3.Item2)
subtraction_5 = Subtraction(A=subtraction_4, B=multiplication_2)
c_script_16 = CSharpScript(x=num_4, y=c_script_15.A)  # -> out, A; inputs x: Double; same code as c_script_13
c_script_17 = CSharpScript(x=subtraction_5)  # -> out, A; inputs x: Double; same code as c_script_15
division_2 = Division(A=c_script_16.A, B=len_3)
c_script_18 = CSharpScript(x=num_3, y=c_script_17.A)  # -> out, A; inputs x: Double; same code as c_script_13
addition = Addition(A=division, B=c_script_18.A)
addition_2 = Addition(A=division_2, B="0.5")
eval = EvaluateCurve(Curve=reparameterize(crv_2), Parameter=addition_2)  # -> Point, Tangent, Angle
pull = PullPoint(Point=eval.Point, Geometry=item_2, ClosestOnly=True)  # -> ClosestPoint, Distance
vrot = Rotate(Vector=eval.Tangent, Axis=Z_3, Angle=[-1.570796327, 1.570796327])
subtraction_6 = Subtraction(A=pull.ClosestPoint, B=eval.Point)
angle = Angle(VectorA=subtraction_6, VectorB=vrot)  # -> Angle, Reflex
sort_2 = SortList(Keys=angle.Angle, ValuesA=vrot)  # -> Keys, reverse(ValuesA)
item_4 = ListItem(List=sort_2.ValuesA, Index=0, Wrap=True)
multiplication_3 = Multiplication(A=Z_3, B=addition)
move_3 = Move(Geometry=eval.Point, Motion=multiplication_3)  # -> Geometry, Transform
vrot_2 = Rotate(Vector=Z_3, Axis=item_4, Angle=-1.570796327)
c_script_19 = CSharpScript(x=c_script_13.A)  # -> out, A; inputs x: Double; same code as c_script_15
pl = ConstructPlane(Origin=move_3.Geometry, XAxis=vrot_2, YAxis=Z_3)
match = MatchTree(Tree=pl, Guide=c_script_19.A)
c_script_20 = CSharpScript(x=c_script_14.A)  # -> out, A; inputs x: Double; same code as c_script_15
rectangle = Rectangle(Plane=match, XSize=c_script_19.A, YSize=c_script_20.A, Radius=0)  # -> Rectangle, Length
area_2 = Area(Geometry=rectangle.Rectangle)  # -> Area, Centroid
amp = Amplitude(Vector=item_4, Amplitude=Slider(0.04, range=0..1))
amp_2 = Amplitude(Vector=item_4, Amplitude=Slider(0.02, range=0..1))
larger = LargerThan(FirstNumber=area_2.Area, SecondNumber=0.1)  # -> LargerThan, OrEqualTo
cull_2 = CullPattern(List=rectangle.Rectangle, CullPattern=larger.LargerThan)
neg_3 = Negative(Value=amp)
match_2 = MatchTree(Tree=join, Guide=cull_2)
match_3 = MatchTree(Tree=join, Guide=cull_2)
move_4 = Move(Geometry=cull_2, Motion=neg_3)  # -> Geometry, Transform
move_5 = Move(Geometry=cull_2, Motion=amp_2)  # -> Geometry, Transform
merge_2 = Merge(Data1=cull_2, Data2=match_3, Data3=extr_2)
merge_3 = Merge(Data1=cull_2, Data2=match_2)
merge_4 = Merge(Data1=move_4.Geometry, Data2=move_5.Geometry)  # -> simplify(Result)
explode_2 = Explode(Curve=move_5.Geometry, Recursive=True)  # -> Segments, Vertices
explode_3 = Explode(Curve=cull_2, Recursive=True)  # -> Segments, Vertices
boundary_2 = BoundarySurfaces(Edges=merge_3)
boundary_3 = BoundarySurfaces(Edges=cull_2)
curvepoint = PointOnCurve(explode_2.Segments, parameter=0.5)
mesh = MeshBrep(
    Brep=boundary_3,
    Settings={GridMaxCount=0, GridMinCount=16, JaggedSeams=False, MaxEdgeLength=0, MinEdgeLength=0.0001, MinTolerance=0, Refine=True, RefineAngle=0, RelativeTolerance=0.65, SimplePlanes=True, Tolerance=0})
pdecon = Deconstruct(Point=curvepoint)  # -> XComponent, YComponent, ZComponent
join_2 = BrepJoin(Breps=flatten(boundary_2))  # -> Breps, Closed
boundary_4 = BoundarySurfaces(Edges=merge_2)
sort_3 = SortList(Keys=pdecon.ZComponent, ValuesC=explode_3.Segments, ValuesA=explode_2.Segments)  # -> Keys, ValuesC, ValuesA
mesh_2 = MeshBrep(
    Brep=boundary_4,
    Settings={GridMaxCount=0, GridMinCount=16, JaggedSeams=False, MaxEdgeLength=0, MinEdgeLength=0.0001, MinTolerance=0, Refine=True, RefineAngle=0, RelativeTolerance=0.65, SimplePlanes=True, Tolerance=0})
offmsh = OffsetMesh(Mesh=join_2.Breps, Distance=0.01, BothSides=False, CreateSolid=True)
item_5 = ListItem(List=sort_3.ValuesC, Index=0, Wrap=True)
relay_3 = Relay([offmsh, mesh_2])
offset = OffsetCurve(Curve=graft(merge_4), Distance=flatten(relay), Corners=1)
len_4 = Length(Curve=item_5)
offset_2 = OffsetCurve(Curve=graft(merge_4), Distance=flatten(relay_2), Corners=1)
bool = Boolean(item_3.Item4)
pshift = ShiftPaths(Data=offset, Offset=-1)
pshift_2 = ShiftPaths(Data=offset_2, Offset=-1)
c_script_21 = CSharpScript(window_width=len_4, minFinSpacing=min_fin_spacing, finMultiplier=item_3.Item5, finDepth=item_3.Item6, AddRemoveFins=bool)  # -> out, N_Fins, Spacing, Depth; inputs window_width: Double, minFinSpacing: Double, finMultiplier: Double, finDepth: Double, AddRemoveFins: Boolean
# ---------- c_script_21: C# ----------
    int max_n_fins = (int) (window_width / minFinSpacing);
    int n_fins = (int) (finMultiplier * max_n_fins);
    double spacing;
    double depth;
    
    if(AddRemoveFins){

      if (n_fins <= 0.1) {
        spacing = window_width;
        depth = 0;
      }
      else {
        spacing = window_width / (n_fins - 1);
        depth = finDepth;
      }
    }
    else{
      spacing = window_width;
      depth = 0;     
      }

    N_Fins = n_fins;
    Spacing = spacing;
    Depth = depth;
# ---------- end c_script_21 ----------
len_5 = Length(Curve=pshift_2)
len_6 = Length(Curve=pshift)
sort_4 = SortList(Keys=len_5, ValuesA=pshift_2)  # -> Keys, reverse(ValuesA)
sort_5 = SortList(Keys=len_6, ValuesA=pshift)  # -> Keys, ValuesA
item_6 = ListItem(List=sort_5.ValuesA, Index=0, Wrap=True)
item_7 = ListItem(List=sort_4.ValuesA, Index=0, Wrap=True)
item_8 = ListItem(List=reverse(sort_3.ValuesC), Index=0, Wrap=True)
divide = DivideCurve(Curve=item_5, Count=c_script_21.N_Fins, Kinks=False)  # -> Points, Tangents, Parameters
pshift_3 = ShiftPaths(Data=item_7, Offset=-1)
pshift_4 = ShiftPaths(Data=item_6, Offset=-1)
pull_2 = PullPoint(Point=divide.Points, Geometry=item_8, ClosestOnly=True)  # -> ClosestPoint, Distance
ln = Line(StartPoint=divide.Points, EndPoint=pull_2.ClosestPoint)
amp_3 = Amplitude(Vector=item_4, Amplitude=c_script_21.Depth)
merge_5 = Merge(Data1=pshift_4, Data2=reverse(pshift_3))  # -> simplify(Result)
extr_3 = Extrude(Base=ln, Direction=amp_3)
loft = Loft(Curves=merge_5, Options={Adjust=False, Closed=True, LoftEnds=0, LoftSimp=0, LoftType=3, Rebuild=10, Refit=0.01})
mesh_3 = MeshBrep(
    Brep=extr_3,
    Settings={GridMaxCount=0, GridMinCount=16, JaggedSeams=False, MaxEdgeLength=0, MinEdgeLength=0.0001, MinTolerance=0, Refine=True, RefineAngle=0, RelativeTolerance=0.65, SimplePlanes=True, Tolerance=0})
offmsh_2 = OffsetMesh(Mesh=mesh_3, Distance=0.01, BothSides=False, CreateSolid=True)
preview = CustomPreview(Geometry=loft, Material=ColourSwatch(SwatchColor=RGB(84, 84, 84)))
preview_2 = CustomPreview(Geometry=relay_3, Material=ColourSwatch(SwatchColor=RGB(191, 191, 191)))
preview_3 = CustomPreview(Geometry=offmsh_2, Material=ColourSwatch(SwatchColor=RGB(110, 93, 24)))
item_9 = ListItem(List=c_script_12.A, Index=6, Wrap=True)
area_3 = Area(Geometry=roof)  # -> Area, Centroid
remap = RemapNumbers(Value=area_3.Area, Source=Domain(13.37305172, 408.2402504), Target=dom)  # -> Mapped, Clipped
flatten = FlattenTree(Tree=c_script_21.Spacing, Path="{0}")
flatten_2 = FlattenTree(Tree=item_9, Path="{0}")
brep_2 = Brep(geo_2)
brep_3 = Brep(roof)
mesh_4 = Mesh(flatten(mesh))
brep_4 = Brep(planesrf)

# ---- group: Dimensions
number_slider_3 = Slider(0.67, range=0..10)
crv_4 = Curve(simplify.Curve)
offset_3 = OffsetCurve(Curve=crv_4, Distance=[0.1, -0.1], Corners=1)  # -> flatten(Curve)
sort_6 = SortList(Keys=offset_3, ValuesA=offset_3)  # -> Keys, reverse(ValuesA)
explode_4 = Explode(Curve=crv_4, Recursive=True)  # -> Segments, Vertices
neg_4 = Negative(Value=number_slider_3)
merge_6 = Merge(Data1=neg_4, Data2=number_slider_3)
item_10 = ListItem(List=sort_6.ValuesA, Index=0, Wrap=True)
explode_5 = Explode(Curve=simplify.Curve, Recursive=True)  # -> Segments, Vertices
curvepoint_2 = PointOnCurve(explode_4.Segments, parameter=0.5)
Z_4 = UnitZ(Factor=1)
disc = Discontinuity(Curve=item_10, Level=1)  # -> Points, Parameters
disc_2 = Discontinuity(Curve=crv_4, Level=1)  # -> Points, Parameters
pull_3 = PullPoint(Point=curvepoint_2, Geometry=item_10, ClosestOnly=True)  # -> ClosestPoint, Distance
vrot_3 = Rotate(Vector=graft(explode_5.Segments), Axis=Z_4, Angle=[1.570796327, -1.570796327])
curvepoint_3 = PointOnCurve(explode_5.Segments, parameter=0.5)
offset_l_2 = OffsetCurveLoose(Curve=graft(explode_5.Segments), Distance=merge_6)
Z_5 = UnitZ(Factor=1)
subtraction_7 = Subtraction(A=pull_3.ClosestPoint, B=curvepoint_2)
pull_4 = PullPoint(Point=disc_2.Points, Geometry=disc.Points, ClosestOnly=True)  # -> ClosestPoint, Distance
line = LineSDL(Start=disc_2.Points, Direction=Z_5, Length=item)
addition_3 = Addition(A=graft(curvepoint_3), B=vrot_3)
boundary_5 = BoundarySurfaces(Edges=simplify.Curve)
curvepoint_4 = PointOnCurve(offset_l_2, parameter=0.5)
vrot_4 = Rotate(Vector=subtraction_7, Axis=Z_5, Angle=-1.570796327)
curvepoint_5 = PointOnCurve(line, parameter=0.5)
subtraction_8 = Subtraction(A=disc_2.Points, B=pull_4.ClosestPoint)
pull_5 = PullPoint(Point=addition_3, Geometry=boundary_5, ClosestOnly=True)  # -> ClosestPoint, Distance
end = EndPoints(Curve=line)  # -> Start, End
line_2 = LineSDL(Start=curvepoint_2, Direction=vrot_4, Length=1)
pl_2 = ConstructPlane(Origin=curvepoint_5, XAxis=subtraction_8, YAxis=Z_5)
pull_6 = PullPoint(Point=curvepoint_4, Geometry=boundary_5, ClosestOnly=True)  # -> ClosestPoint, Distance
curvepoint_6 = PointOnCurve(crv_3, parameter=0.5)
multiplication_4 = Multiplication(A=Z_2, B=1.2)
sort_7 = SortList(Keys=pull_5.Distance, ValuesA=vrot_3)  # -> Keys, ValuesA
sort_8 = SortList(Keys=pull_6.Distance, ValuesA=offset_l_2)  # -> Keys, ValuesA
move_6 = Move(Geometry=curvepoint_6, Motion=multiplication_4)  # -> Geometry, Transform
flip = FlipCurve(Curve=graft(explode_4.Segments), Guide=graft(line_2))  # -> flatten(Curve), Flag
item_11 = ListItem(List=reverse(sort_7.ValuesA), Index=0, Wrap=True)
pl_3 = ConstructPlane(Origin=curvepoint_2, XAxis=vrot_4, YAxis=subtraction_7)
center_2 = Center(Geometric=simplify.Curve)  # -> Center, Dimension
item_12 = ListItem(List=reverse(sort_8.ValuesA), Index=0, Wrap=True)  # -> simplify(Item)
tstat = TreeStatistics(Tree=move_6.Geometry)  # -> Paths, Length, Count
item_13 = ListItem(List=reverse(sort_3.ValuesA), Index=[0, 1], Wrap=True)
end_2 = EndPoints(Curve=flip.Curve)  # -> Start, End
vrot_5 = Rotate(Vector=item_11, Axis=Vector(0, 0, 1), Angle=-1.570796327)
Z_6 = UnitZ(Factor=1)
dpath = DeconstructPath(Branch=tstat.Paths)  # -> simplify(Indices)
curvepoint_7 = PointOnCurve(item_12, parameter=0.5)
merge_7 = Merge(Data1=pl_3, Data2=pl_2)
tstat_2 = TreeStatistics(Tree=item_12)  # -> graft(Paths), Length, Count
item_14 = ListItem(List=sort_3.ValuesA, Index=0, Wrap=True)
vrot_6 = Rotate(Vector=Z_6, Axis=amp_3, Angle=-1.570796327)
merge_8 = Merge(Data1=flatten(end_2.Start), Data2=flatten(end.Start))
curvepoint_8 = PointOnCurve(item_13, parameter=0.451)
merge_9 = Merge(Data1=flatten(end_2.End), Data2=flatten(end.End))
item_15 = ListItem(List=dpath, Index=0, Wrap=True)  # -> Item, Item1
project = Project(Geometry=item_14, Plane=center_2.Center)  # -> Geometry, Transform
vrot_7 = Rotate(Vector=item_13, Axis=amp_3, Angle=-1.570796327)
dpath_2 = DeconstructPath(Branch=tstat_2.Paths)
Z_7 = UnitZ(Factor=1)
panel = Panel("""[
]""")
format = Format(Format="w{1}", Culture=127, Data0=item_15.Item, Data1=item_15.Item1)
curvepoint_9 = PointOnCurve(project.Geometry, parameter=0.5)
weave = Weave(Pattern=[1, 0, 1], Stream0=dpath_2, Stream1=panel, NullGaps=False)
end_3 = EndPoints(Curve=item_13)  # -> Start, End
pl_4 = ConstructPlane(Origin=curvepoint_8, XAxis=item_13, YAxis=vrot_7)
pl_5 = ConstructPlane(Origin=curvepoint_7, XAxis=expr("-X", vrot_5), YAxis=Z_7)
match_4 = MatchTree(Tree=simplify(format), Guide=simplify(move_6.Geometry))
join_3 = TextJoin(Text=weave)
pl_6 = ConstructPlane(Origin=curvepoint_9, XAxis=vrot_6, YAxis=Z_6)
aligndim = AlignedDimension(
    Plane=pl_4,
    PointA=end_3.Start,
    PointB=end_3.End,
    Offset=Slider(0.16, range=0..1),
    Text="{0:0.00}",
    Size=Slider(0.12, range=0..1))
tag = TextTag3D(
    Location=pl_6,
    Text=match_4,
    Size=Slider(0.34, range=0..10),
    Colour=ColourSwatch(SwatchColor=RGB(69, 0, 0)),
    Justification=8)
aligndim_2 = AlignedDimension(
    Plane=merge_7,
    PointA=merge_8,
    PointB=merge_9,
    Offset=Slider(0.35, range=0..1),
    Text="{0:0.00}",
    Size=Slider(0.17, range=0..1))
tag_2 = TextTag3D(
    Location=pl_5,
    Text=join_3,
    Size=Slider(0.52, range=0..10),
    Colour=ColourSwatch(SwatchColor=RGB(191, 0, 0)),
    Justification=9)

# ---- group: Geometry / Walls
geo_3 = Geometry(flatten(mesh_2))

# ---- group: Geometry / analysis grid
Z_8 = UnitZ(Factor="0.762")
move_7 = Move(Geometry=roof, Motion=Z_8)  # -> Geometry, Transform
c__0_003 = CSharpScript(gridSurface=move_7.Geometry, spacing=remap.Mapped, offset="0.0254 * 10", complex=Toggle(True))  # -> out, A, B, nU, nV, E; inputs gridSurface: Brep, spacing: Double, offset: Double, complex: Boolean
# ---------- c__0_003: C# ----------
    Surface srf = gridSurface.Faces[0];

    double width = 0.0;
    double depth = 0.0;
    srf.GetSurfaceSize(out width, out depth);

    srf.SetDomain(0, new Interval(0, width));
    srf.SetDomain(1, new Interval(0, depth));

    int n_usteps = (int) (0.999999999 + (width - 2.0 * offset) / spacing);
    int n_vsteps = (int) (0.999999999 + (depth - 2.0 * offset) / spacing);
    double u_spacing = (width - 2.0 * offset) / n_usteps;
    double v_spacing = (depth - 2.0 * offset) / n_vsteps;

    Mesh m = new Mesh();

    for (int i = 0; i < n_usteps + 1; ++i) {
      for (int j = 0; j < n_vsteps + 1; ++j) {
        Point3d pt;
        Vector3d[] vv;
        srf.Evaluate(offset + i * u_spacing, offset + j * v_spacing, 0, out pt, out vv);
        m.Vertices.Add(pt.X, pt.Y, pt.Z);
      }
    }

    for (int j = 0; j < n_usteps ; ++j) {
      for (int i = 0; i < n_vsteps ; ++i) {
        m.Faces.AddFace(new MeshFace(i + j * (n_vsteps + 1), i + (j + 1) * (n_vsteps + 1), i + (j + 1) * (n_vsteps + 1) + 1, i + j * (n_vsteps + 1) + 1));
      }
    }


    // filter vertices outside of the trimmed surface
    if (complex) {
      bool[] validVertices = new bool[m.Vertices.Count];
      for (int i = 0; i < validVertices.Length; ++i) {
        validVertices[i] = false;
      }

      for (int i = 0; i < m.Vertices.Count; ++i) {
        foreach (BrepFace face in  gridSurface.Faces) {
          if (!face.IsValid) continue;

          double u, v;
          face.ClosestPoint(m.Vertices[i], out u, out v);
          PointFaceRelation pfr = face.IsPointOnFace(u, v);
          if (pfr == PointFaceRelation.Interior) {
            validVertices[i] = true;
            break;
          }
        }
      }

      List<int> cullVertices = new List<int>();
      for (int i = 0; i < validVertices.Length; ++i) {
        if (!validVertices[i]) {
          cullVertices.Add(i);
        }
      }

      m.Vertices.Remove(cullVertices, true);
    }

    m.RebuildNormals();


    A = m;
    B = m.Vertices;
    nU = n_usteps;
    nV = n_vsteps;
    E = srf;
# ---------- end c__0_003 ----------

# ---- group: Geometry (continued)
mesh_5 = Mesh(geo_3)

# ---- group: Surrogate Model
predict_daylight = PredictDaylightMetricsFromGeometryAndMaterialInputsPWAIV01(
    SensorsPositions=c__0_003.B,
    CeilingGeometries=brep_2,
    FloorGeometries=brep_3,
    WallsGeometries=mesh_5,
    GlazingGeometries=mesh_4,
    SurroundingGeometries=brep,
    GroundSurface=brep_4,
    CeilingReflectance=ceiling_r_2,
    FloorReflectance=floor_r_2,
    WallsReflectance=wall_r_2,
    GlazingTransparency=glazing_t_2,
    FinDepth=flatten_2,
    FinSpacing=flatten,
    ComputeSolution=toggle,
    PredictDA=True,
    PredictSE=False,
    PredictMI=False,
    PredictUDI=False,
    NumberOfThreads=-1,
    ProduceAdditionalDataForDebugging=False,
    IndexOfSensorToDebug=0,
    City="Boston")  # -> PredictedDaylightAutonomy_sensor_array, PredictedSunlightExposure_sensor_array, PredictedMeanIlluminance_sensor_array, PredictedUsefulDaylightIlluminanceFailing_sensor_array, PredictedUsefulDaylightIlluminanceSupplementary_sensor_array, PredictedUsefulDaylightIlluminanceAcceptable_sensor_array, PredictedUsefulDaylightIlluminanceExcessive_sensor_array

# ---- group: DA Visualization
lng_4 = ListLength()
merge_10 = Merge()  # -> simplify(Result)
dup = DuplicateData(Data=0.0001, Number=lng_4, Order=True)
ma = MassAddition(Input=merge_10)  # -> Result, PartialResults
merge_11 = Merge(Data1=simplify(graft(dup)), Data2=simplify(ma.PartialResults))  # -> simplify(Result)
dual = Dual(Mesh=c__0_003.A, Type=0)
demesh = DeconstructMesh(Mesh=c__0_003.A)  # -> Vertices, Faces, Colours, Normals
se_threshold = Slider(1000, range=0..1000)
faceb = FaceBoundaries(Mesh=dual)
relay_4 = Relay()
c_script_22 = CSharpScript(x=relay_4, y=se_threshold)  # -> out, A; inputs x: Double, y: Double
# ---------- c_script_22: C# ----------
    if(x>=y)
      A = 1;
    else
      A = 0;
# ---------- end c_script_22 ----------
scale = Scale(Geometry=graft(faceb), Center=graft(demesh.Vertices), Factor=merge_11)  # -> Geometry, Transform
gradient = Gradient(
    LowerLimit=1,
    UpperLimit=0,
    Parameter=predict_daylight.PredictedDaylightAutonomy_sensor_array,
    stops=[0: RGB(234, 38, 0), 0.25: RGB(234, 126, 0), 0.5: RGB(254, 244, 84), 0.75: RGB(173, 203, 249), 1: RGB(75, 107, 169)])
gradient_2 = Gradient(LowerLimit=0, UpperLimit=1, Parameter=c_script_22.A, stops=[0: RGB(171, 171, 171), 1: RGB(251, 255, 0)])
shift = ShiftList(List=scale.Geometry, Shift=1, Wrap=False)
shift_2 = ShiftList(List=scale.Geometry, Shift=-1, Wrap=False)
rulesrf = RuledSurface(CurveA=shift, CurveB=shift_2)
se_threshold_2 = Slider(300, range=0..1000)
panel_2 = Panel("""0 to 100
100 to 300
300 to 3000
3000 to 10000""")
mesh_6 = MeshBrep(
    Brep=rulesrf,
    Settings={GridMaxCount=0, GridMinCount=16, JaggedSeams=False, MaxEdgeLength=0, MinEdgeLength=0.0001, MinTolerance=0, Refine=True, RefineAngle=0, RelativeTolerance=0.65, SimplePlanes=True, Tolerance=0})
c_script_23 = CSharpScript(x=gradient, y=ColourSwatch(SwatchColor=RGB(70, 100, 166)))  # -> out, A; inputs x: tree of Color, y: Color
# ---------- c_script_23: C# ----------
    if(x.BranchCount>0){
      A = x;}
    else
      A = y;
    
    //A = x.BranchCount > 0;
# ---------- end c_script_23 ----------
c_script_24 = CSharpScript(x=gradient_2, y=ColourSwatch(SwatchColor=RGB(70, 100, 166)))  # -> out, A; inputs x: tree of Color, y: Color; same code as c_script_23
merge_12 = Merge(
    Data1=ColourSwatch(SwatchColor=RGB(65, 128, 176)),
    Data2=ColourSwatch(SwatchColor=RGB(117, 186, 163)),
    Data3=ColourSwatch(SwatchColor=RGB(180, 224, 119)),
    Data4=ColourSwatch(SwatchColor=RGB(255, 176, 255)))  # -> graft(Result)
flip_2 = FlipMatrix(Data=mesh_6)
mcol = MeshColours(Mesh=c__0_003.A, Colours=c_script_23.A)
mcol_2 = MeshColours(Mesh=c__0_003.A, Colours=c_script_24.A)
fdom = FindDomain(Domains=panel_2, Strict=False)  # -> Index, Neighbour
c_script_25 = CSharpScript(x=relay_4, y=se_threshold_2)  # -> out, A; inputs x: Double, y: Double; same code as c_script_22
mcol_3 = MeshColours(Mesh=flip_2, Colours=merge_12)
gradient_3 = Gradient(LowerLimit=0, UpperLimit=1, Parameter=c_script_25.A, stops=[0: RGB(171, 171, 171), 1: RGB(180, 224, 119)])
item_16 = ListItem(List=flatten(merge_12), Index=fdom.Index, Wrap=True)
mcol_4 = MeshColours(Mesh=c__0_003.A, Colours=item_16)
c_script_26 = CSharpScript(x=gradient_3, y=ColourSwatch(SwatchColor=RGB(70, 100, 166)))  # -> out, A; inputs x: tree of Color, y: Color; same code as c_script_23
mcol_5 = MeshColours(Mesh=c__0_003.A, Colours=c_script_26.A)
mesh_7 = Mesh(mcol_4)
mesh_8 = Mesh(mcol_5)
mesh_9 = Mesh(mcol_3)
mesh_10 = Mesh(mcol_2)
mesh_11 = Mesh(mcol)
int_2 = Integer(c_script_6.A)
filter = StreamFilter(Gate=int_2, Stream0=mesh_11, Stream1=mesh_10, Stream2=mesh_9, Stream3=mesh_8, Stream4=mesh_7)
mesh_12 = Mesh(filter)
Z_9 = UnitZ(Factor=Slider(0.1, range=0..10))
move_8 = Move(Geometry=mesh_12, Motion=Z_9)  # -> Geometry, Transform

# ---- group: DA indicator
avr = Average(Input=predict_daylight.PredictedDaylightAutonomy_sensor_array)
custom_round = CustomRound(Numbers=avr, Scope=Slider(0.01, range=0..1))
format_2 = Format(Format="DA = {0}", Culture=127, Data0=custom_round)
pt = ConstructPoint(XCoordinate=Slider(32, range=0..100), YCoordinate=Slider(87, range=0..100), ZCoordinate=0)
texttoscreen = RenderTextToScreen(
    Text=format_2,
    Location=pt,
    Size=Slider(37.182, range=0..100),
    Color=ColourSwatch(SwatchColor=RGB(255, 250, 102)),
    m_scWithvp=False)

# ---- group: RH_OUT:daylight_mesh
daylight_mesh = Mesh(move_8.Geometry)
