# Grasshopper definition parametricRoom-V22-sense.gh (Grasshopper 1.0.7)
# plug-ins: Pufferfish, Heteroptera, Human UI, Weaverbird, NGon, PW_AI, MetaHopper, CORE.Grasshopper.Colibri

panel = Panel("""Single floor
Ground floor
middle floor
Top floor""")
panel_2 = Panel("Program")
data = Data(["2019::Hospital::Basement", "2019::Hospital::Corridor", "2019::Hospital::Dining", "2019::Hospital::ER_Exam", "2019::Hospital::ER_NurseStn", "2019::Hospital::ER_Trauma", "2019::Hospital::ER_Triage", "2019::Hospital::HospitalOffice", "2019::Hospital::ICU_NurseStn", "2019::Hospital::ICU_Open", "2019::Hospital::ICU_PatRm", "2019::Hospital::Kitchen", "2019::Hospital::Lab", "2019::Hospital::Lobby", "2019::Hospital::NurseStn", "2019::Hospital::OR", "2019::Hospital::Office", "2019::Hospital::PatCorridor", "2019::Hospital::PatRoom", "2019::Hospital::PhysTherapy", "2019::Hospital::Radiology"])
data_2 = Data(["LargeOffice", "MediumOffice", "SmallOffice", "MidriseApartment", "HighriseApartment", "Retail", "StripMall", "PrimarySchool", "SecondarySchool", "SmallHotel", "LargeHotel", "Hospital", "Outpatient", "Laboratory", "Warehouse", "SuperMarket", "FullServiceRestaurant", "QuickServiceRestaurant", "Courthouse", "LargeDataCenterHighITE", "LargeDataCenterLowITE", "SmallDataCenterHighITE", "SmallDataCenterLowITE"])
floor_num = Slider(0, range=0..4)
panel_3 = Panel(data)
panel_4 = Panel(data_2)
program = GetString(AtLeast=1, AtMost=1, TreeAccess=False)
floor_num_2 = GetNumber(floor_num, AtLeast=1, AtMost=1, Maximum=1.797693135e+308, Minimum=-1.797693135e+308, TreeAccess=False)
bool = Boolean(Tree({0;0}: [True, True], {0;1}: [True, False], {0;2}: [False, False], {0;3}: [False, True]))
c_script = CSharpScript(x=floor_num_2, y="0")  # -> out, A; inputs y: Int32
# ---------- c_script: C# ----------
    if(x == null){
      A = y;}
    else
      A = x;
# ---------- end c_script ----------

ceiling_refl = Slider(0.5, range=0..1)
glazing_trans = Slider(0.3, range=0..1)
floor_refl = Slider(0.2, range=0..1)
wall_refl = Slider(0.5, range=0..1)

c_script_2 = CSharpScript(x=program, y="2019::Hospital::Basement")  # -> out, A; inputs x: String, y: String; same code as c_script
index = ItemIndex(List=panel, Item=c_script.A)
add_remove_fins = BooleanToggle(False)
count = Slider(2, range=2..5)
depth = Slider(0.7, range=0..1)
add_remove_overhangs = BooleanToggle(True)
count_2 = Slider(1, range=1..5)
depth_2 = Slider(0.7, range=0..1)
wall_r_val = Slider(20, range=10..30)
roof_r_val = Slider(30, range=20..40)
ground_r_val = Slider(10, range=5..30)
win_u_val = Slider(0.3, range=0.2..0.4)
win_shgc = Slider(0.3, range=0.2..0.4)
branch = TreeBranch(Tree=simplify(bool), Path=c_script.A, MaintainPaths=True)
height = Slider(4, range=1..6)
floor_reflectance = GetNumber(floor_refl, AtLeast=1, AtMost=1, Maximum=1.797693135e+308, Minimum=-1.797693135e+308, TreeAccess=False)
wall_reflectance = GetNumber(wall_refl, AtLeast=1, AtMost=1, Maximum=1.797693135e+308, Minimum=-1.797693135e+308, TreeAccess=False)
glazing_transparency = GetNumber(glazing_trans, AtLeast=1, AtMost=1, Maximum=1.797693135e+308, Minimum=-1.797693135e+308, TreeAccess=False)
ceiling_reflectance = GetNumber(ceiling_refl, AtLeast=1, AtMost=1, Maximum=1.797693135e+308, Minimum=-1.797693135e+308, TreeAccess=False)
enable_fins = GetBoolean(add_remove_fins, AtLeast=1, AtMost=1, FalseValue="False", TreeAccess=False, TrueValue="True")
win_shgc_2 = GetNumber(win_shgc, AtLeast=1, AtMost=1, Maximum=1.797693135e+308, Minimum=-1.797693135e+308, TreeAccess=False)
ground_r_val_2 = GetNumber(ground_r_val, AtLeast=1, AtMost=1, Maximum=1.797693135e+308, Minimum=-1.797693135e+308, TreeAccess=False)
overhangs_multiplier = GetNumber(count_2, AtLeast=1, AtMost=1, Maximum=1.797693135e+308, Minimum=-1.797693135e+308, TreeAccess=False)
wall_r_val_2 = GetNumber(wall_r_val, AtLeast=1, AtMost=1, Maximum=1.797693135e+308, Minimum=-1.797693135e+308, TreeAccess=False)
roof_r_val_2 = GetNumber(roof_r_val, AtLeast=1, AtMost=1, Maximum=1.797693135e+308, Minimum=-1.797693135e+308, TreeAccess=False)
enable_overhangs = GetBoolean(add_remove_overhangs, AtLeast=1, AtMost=1, FalseValue="False", TreeAccess=False, TrueValue="True")
win_u_val_2 = GetNumber(win_u_val, AtLeast=1, AtMost=1, Maximum=1.797693135e+308, Minimum=-1.797693135e+308, TreeAccess=False)
windows_3 = Slider(2, range=0..2)
windows_1 = Slider(2, range=0..2)
overhangs_depth = GetNumber(depth_2, AtLeast=1, AtMost=1, Maximum=1.797693135e+308, Minimum=-1.797693135e+308, TreeAccess=False)
windows_2 = Slider(2, range=0..2)
windows_4 = Slider(2, range=0..2)
fins_multiplier = GetNumber(count, AtLeast=1, AtMost=1, Maximum=1.797693135e+308, Minimum=-1.797693135e+308, TreeAccess=False)
fins_depth = GetNumber(depth, AtLeast=1, AtMost=1, Maximum=1.797693135e+308, Minimum=-1.797693135e+308, TreeAccess=False)
height_2 = GetNumber(height, AtLeast=1, AtMost=1, Maximum=1.797693135e+308, Minimum=-1.797693135e+308, TreeAccess=False)
length = Slider(4, range=1..4)
merge = Merge(Data1=windows_1, Data2=windows_2, Data3=windows_3, Data4=windows_4)
length_2 = Slider(4, range=0.5..4)
height_3 = Slider(2, range=0..4)
h_movement = Slider(0, range=-2..2)
v_movement = Slider(0, range=-2..2)
zone = Curve(<curve referenced from the Rhino model>)
winperwall = Panel("""1
2
0
0
0
0""")
merge_2 = Merge(
    Data1=ceiling_reflectance,
    Data2=floor_reflectance,
    Data3=wall_reflectance,
    Data4=glazing_transparency,
    Data6=wall_r_val_2,
    Data7=roof_r_val_2,
    Data8=ground_r_val_2,
    Data9=win_u_val_2,
    Data10=win_shgc_2)
colibri_in = ColibriInputsIterator(
    R=Toggle(True),
    windows_1=windows_1,
    windows_2=windows_2,
    windows_3=windows_3,
    windows_4=windows_4,
    Length=length,
    ignoreAllWarningMsg=True)  # -> U, IP, windows_1, windows_2, windows_3, windows_4, Length, V_N
vertical_movement = GetNumber(v_movement, AtLeast=1, AtMost=1, Maximum=1.797693135e+308, Minimum=-1.797693135e+308, TreeAccess=False)
lateral_movement = GetNumber(h_movement, AtLeast=1, AtMost=1, Maximum=1.797693135e+308, Minimum=-1.797693135e+308, TreeAccess=False)
windows_length = GetNumber(length, AtLeast=1, AtMost=1, Maximum=1.797693135e+308, Minimum=-1.797693135e+308, TreeAccess=False)
windows_height = GetNumber(height_3, AtLeast=1, AtMost=1, Maximum=1.797693135e+308, Minimum=-1.797693135e+308, TreeAccess=False)
item = ListItem(List=merge_2, Index=0, Wrap=True)  # -> Item, Item1, Item2, Item3, Item4, Item5, Item6, Item7, Item8, Item9
interior_walls = Geometry(<curve referenced from the Rhino model>)  # disabled
context = Geometry(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)
zone_2 = Curve(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)
zone_3 = GetGeometry(zone, AtLeast=1, AtMost=1, DeleteInput=False, Filter=1074004029, TreeAccess=False)
context_2 = GetGeometry(context, AtLeast=1, AtMost=1, DeleteInput=False, Filter=1074004029, TreeAccess=False)
interior_walls_2 = GetGeometry(interior_walls, AtLeast=1, AtMost=1, DeleteInput=False, Filter=1074004029, TreeAccess=False)  # disabled
merge_3 = Merge(
    Data1=windows_length,
    Data2=windows_height,
    Data3=lateral_movement,
    Data4=vertical_movement,
    Data5=enable_fins,
    Data6=fins_multiplier,
    Data7=fins_depth,
    Data8=enable_overhangs,
    Data9=overhangs_multiplier,
    Data10=overhangs_depth)
box = CenterBox(Base=PlaneXY(0, 0, 0), X=1, Y=1, Z=1)
panel_5 = Panel("""W Length
W Height
H Movement
V Movement
Add/Remove Fins
F Multiplier
F Depth
 Add Overhangs
O Multiplier
O Depth""")
simplify = SimplifyCurve(Curve=zone_3)  # -> Curve, Simplified
c_script_3 = CSharpScript(x=context_2, y=box)  # -> out, A, B; inputs x: list of GeometryBase, y: Brep
# ---------- c_script_3: C# ----------
    if(x != null && x.Count > 0)
      A = x;
    else
      A = y;
# ---------- end c_script_3 ----------
button = Button()
explode = Explode(Curve=simplify.Curve, Recursive=True)  # -> Segments, Vertices
ceiling_thickness = Panel("0.1")
wall_thickness = Panel("0.1")
min_fin_spacing = Slider(0.1, range=0..1)
crv = Curve(simplify(graft(explode.Segments)))

# ---- group: Wall construction making / where you can adjust insulation value
number_slider = Slider(1, range=1..100)

# ----
boundary = BoundarySurfaces(Edges=simplify.Curve)
Z = UnitZ(Factor=height_2)
move = Move(Geometry=boundary, Motion=Z)  # -> Geometry, Transform
multiplication = Multiplication(A=wall_thickness, B=2)

# ---- group: Window construction making / Where you can adjust U & SHGC
number_slider_2 = Slider(0.05, range=0.05..0.95)
number_slider_3 = Slider(0.95, range=0.05..0.95)

# ---- group: Roof construction making / where you can adjust insulation value
number_slider_4 = Slider(1, range=1..100)

# ---- group: Slab construction making / where you can adjust insulation value
number_slider_5 = Slider(1, range=1..100)

# ----
offset_l = OffsetCurveLoose(Curve=simplify.Curve, Distance=[1, -1])
multiplication_2 = Multiplication(A=ceiling_thickness, B=2)
len = Length(Curve=offset_l)
subtraction = Subtraction(A=height_2, B=multiplication_2)
sort = SortList(Keys=len, ValuesA=offset_l)  # -> Keys, ValuesA
expression = Expression(x=item.Item6, Expression="max(x - 0.337473, 1)")
expression_2 = Expression(x=item.Item7, Expression="max(x-0.604099-1, 1)")
expression_3 = Expression(x=expression_2, Expression="Format(\"insulation-R{0}\", x)")
expression_4 = Expression(x=expression, Expression="Format(\"insulation-R{0}\", x)")

# ---- group: Window construction making / You might give a new name
give_a_name_to_the_window = Panel("NewWindow")

# ---- group: Window construction making
uip2usi = Ladybug_uIP2uSI(U_IP=item.Item8)  # -> U_SI; plug-in component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
windowmat = HBWindowMaterial(name=give_a_name_to_the_window, u_factor=uip2usi, shgc=item.Item9)  # -> mat; plug-in component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
windowconstr = HBWindowConstruction(name=give_a_name_to_the_window, materials=windowmat)  # -> constr; plug-in component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
decnstrconstr = HBDeconstructConstruction(constr=windowconstr)  # -> materials, layers, r_val_si, r_val_ip, u_fac_si, u_fac_ip, shgc, t_sol, t_vis; plug-in component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

# ----
division = Division(A=height_2, B=2)
item_2 = ListItem(List=sort.ValuesA, Index=0, Wrap=True)

# ---- group: Wall construction making / You might give a new name
give_a_name_to_the_new_wall = Panel("NewConstruction")

# ---- group: Slab construction making / You might give a new name
give_a_name_to_the_new_slab = Panel("NewSlab")

# ---- group: Slab construction making
searchconstrs = HBSearchConstructions(keywords="typical insulated 6in R5")  # -> opaque_constrs, window_constrs, shade_constrs; plug-in component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
i_am_using_this_typical_assembly_as_the = Panel(searchconstrs.opaque_constrs)  # "I am using this typical assembly as the starting point"
decnstrconstr_2 = HBDeconstructConstruction(constr=searchconstrs.opaque_constrs)  # -> materials, layers, r_val_si, r_val_ip, u_fac_si, u_fac_ip, shgc, t_sol, t_vis; plug-in component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
example_slab_r_value = Panel(decnstrconstr_2.r_val_ip)
panel_6 = Panel(decnstrconstr_2.layers)
bang = ExplodeTree(Data=graft(decnstrconstr_2.layers))  # -> _0000, _0001, _0002
decnstrmat = HBDeconstructMaterial(mat=bang._0000)  # -> values, attr_names, r_val_si, r_val_ip; plug-in component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
panel_7 = Panel(decnstrmat.attr_names)
bang_2 = ExplodeTree(Data=graft(decnstrmat.values))  # -> _000000, _000001, _000002, _000003, _000004, _000005
rip2rsi = Ladybug_rIP2rSI(R_IP=expression_2)  # -> R_SI; plug-in component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
opaquematnomass = HBOpaqueMaterialNoMass(
    name=expression_3,
    r_value=rip2rsi,
    roughness=bang_2._000001,
    therm_absp=bang_2._000003,
    sol_absp=bang_2._000004,
    vis_absp=bang_2._000005)  # -> mat; plug-in component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
merge_4 = Merge(Data1=opaquematnomass, Data2=bang._0001, Data3=bang._0002)  # -> flatten(Result)
opaqueconstr = HBOpaqueConstruction(name=give_a_name_to_the_new_slab, materials=merge_4)  # -> constr; plug-in component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
decnstrconstr_3 = HBDeconstructConstruction(constr=opaqueconstr)  # -> materials, layers, r_val_si, r_val_ip, u_fac_si, u_fac_ip, shgc, t_sol, t_vis; plug-in component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

# ----
Z_2 = UnitZ(Factor=1)

# ---- group: Roof construction making / You might give a new name
give_a_name_to_the_new_roof = Panel("NewRoof")

# ---- group: Roof construction making
searchconstrs_2 = HBSearchConstructions(keywords="typical IEAD roof R10")  # -> opaque_constrs, window_constrs, shade_constrs; plug-in component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
i_am_using_this_typical_assembly_as_the_2 = Panel(searchconstrs_2.opaque_constrs)  # "I am using this typical assembly as the starting point"
decnstrconstr_4 = HBDeconstructConstruction(constr=searchconstrs_2.opaque_constrs)  # -> materials, layers, r_val_si, r_val_ip, u_fac_si, u_fac_ip, shgc, t_sol, t_vis; plug-in component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
example_roof_r_value = Panel(decnstrconstr_4.r_val_ip)
panel_8 = Panel(decnstrconstr_4.layers)
bang_3 = ExplodeTree(Data=graft(decnstrconstr_4.layers))  # -> _0000, _0001, _0002
decnstrmat_2 = HBDeconstructMaterial(mat=bang_3._0001)  # -> values, attr_names, r_val_si, r_val_ip; plug-in component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
panel_9 = Panel(decnstrmat_2.attr_names)
bang_4 = ExplodeTree(Data=graft(decnstrmat_2.values))  # -> _000100, _000101, _000102, _000103, _000104, _000105
rip2rsi_2 = Ladybug_rIP2rSI(R_IP=expression)  # -> R_SI; plug-in component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
opaquematnomass_2 = HBOpaqueMaterialNoMass(
    name=expression_4,
    r_value=rip2rsi_2,
    roughness=bang_4._000101,
    therm_absp=bang_4._000103,
    sol_absp=bang_4._000104,
    vis_absp=bang_4._000105)  # -> mat; plug-in component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
merge_5 = Merge(Data1=bang_3._0000, Data2=opaquematnomass_2, Data3=bang_3._0002)  # -> flatten(Result)
opaqueconstr_2 = HBOpaqueConstruction(name=give_a_name_to_the_new_roof, materials=merge_5)  # -> constr; plug-in component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
decnstrconstr_5 = HBDeconstructConstruction(constr=opaqueconstr_2)  # -> materials, layers, r_val_si, r_val_ip, u_fac_si, u_fac_ip, shgc, t_sol, t_vis; plug-in component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

# ---- group: Window construction making / the new window construction and its new U & SHGC value
new_win_u_value = Panel(decnstrconstr.u_fac_ip)
new_shgc_value = Panel(decnstrconstr.shgc)

# ---- group: Slab construction making / the new slab construction and its new R value
new_slab_r_value = Panel(decnstrconstr_3.r_val_ip)

# ---- group: Roof construction making / the newroof construction and its new R value
new_roof_r_value = Panel(decnstrconstr_5.r_val_ip)

# ----
geo = Geometry(interior_walls_2)  # disabled

extr = Extrude(Base=geo, Direction=Z)  # disabled
panel_10 = Panel("TODO: interior walls?")

groundsubset = HBGroundConstructionSubset(ground_floor=opaqueconstr)  # -> ground_set; plug-in component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
interiorsubset = HBInteriorConstructionSubset()  # -> interior_set; plug-in component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
subfacesubset = HBSubfaceSubset(window=windowconstr)  # -> subface_set; plug-in component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

# ---- group: Give a new ConstructionSet name
panel_11 = Panel("CustomSet")

# ----
number_slider_6 = Slider(2, range=0..10)
grid_size = Slider(0, range=0..3)
num = Number(0.6096)
division_2 = Division(A=num, B=2)
series = Series(Start=number_slider_6, Step=number_slider_6, Count=3)
grid_size_2 = GetNumber(grid_size, AtLeast=1, AtMost=1, Maximum=1.797693135e+308, Minimum=-1.797693135e+308, TreeAccess=False)
multiplication_3 = Multiplication(A=division_2, B=series)
panel_12 = Panel("""Sml   
Med   
Lrg   """)
item_3 = ListItem(List=multiplication_3, Index=grid_size_2, Wrap=True)

# ---- group: Floor
roof = Geometry(boundary)

# ---- group: Ceiling
geo_2 = Geometry(move.Geometry)

# ----
item_4 = ListItem(List=branch, Index=0, Wrap=True)  # -> Item, Item1
filter = StreamFilter(Gate=item_4.Item, Stream0="adiabatic", Stream1="outdoors")
filter_2 = StreamFilter(Gate=item_4.Item1, Stream0="adiabatic", Stream1="outdoors")
geo_3 = Geometry(move.Geometry)
geo_4 = Geometry(boundary)

# ---- group: analysis grid
Z_3 = UnitZ(Factor="0.762")
move_2 = Move(Geometry=roof, Motion=Z_3)  # -> Geometry, Transform
c__0_003 = CSharpScript(gridSurface=move_2.Geometry, spacing=item_3, offset="0.0254 * 10", complex=Toggle(True))  # -> out, A, B, nU, nV, E; inputs gridSurface: Brep, spacing: Double, offset: Double, complex: Boolean
# ---------- c__0_003: C# ----------
    Surface srf = gridSurface.Faces[0];

    double width = 0.0;
    double depth = 0.0;
    srf.GetSurfaceSize(out width, out depth);

    srf.SetDomain(0, new Interval(0, width));
    srf.SetDomain(1, new Interval(0, depth));

    int n_usteps = (int) (0.999999999 + (width - 2.0 * offset) / spacing);
    int n_vsteps = (int) (0.999999999 + (depth - 2.0 * offset) / spacing);
    double u_spacing = (width - 2.0 * offset) / n_usteps;
    double v_spacing = (depth - 2.0 * offset) / n_vsteps;

    Mesh m = new Mesh();

    for (int i = 0; i < n_usteps + 1; ++i) {
      for (int j = 0; j < n_vsteps + 1; ++j) {
        Point3d pt;
        Vector3d[] vv;
        srf.Evaluate(offset + i * u_spacing, offset + j * v_spacing, 0, out pt, out vv);
        m.Vertices.Add(pt.X, pt.Y, pt.Z);
      }
    }

    for (int j = 0; j < n_usteps ; ++j) {
      for (int i = 0; i < n_vsteps ; ++i) {
        m.Faces.AddFace(new MeshFace(i + j * (n_vsteps + 1), i + (j + 1) * (n_vsteps + 1), i + (j + 1) * (n_vsteps + 1) + 1, i + j * (n_vsteps + 1) + 1));
      }
    }


    // filter vertices outside of the trimmed surface
    if (complex) {
      bool[] validVertices = new bool[m.Vertices.Count];
      for (int i = 0; i < validVertices.Length; ++i) {
        validVertices[i] = false;
      }

      for (int i = 0; i < m.Vertices.Count; ++i) {
        foreach (BrepFace face in  gridSurface.Faces) {
          if (!face.IsValid) continue;

          double u, v;
          face.ClosestPoint(m.Vertices[i], out u, out v);
          PointFaceRelation pfr = face.IsPointOnFace(u, v);
          if (pfr == PointFaceRelation.Interior) {
            validVertices[i] = true;
            break;
          }
        }
      }

      List<int> cullVertices = new List<int>();
      for (int i = 0; i < validVertices.Length; ++i) {
        if (!validVertices[i]) {
          cullVertices.Add(i);
        }
      }

      m.Vertices.Remove(cullVertices, true);
    }

    m.RebuildNormals();


    A = m;
    B = m.Vertices;
    nU = n_usteps;
    nV = n_vsteps;
    E = srf;
# ---------- end c__0_003 ----------

# ----
area = Area(Geometry=roof)  # -> Area, Centroid
xy = XYPlane(Origin=area.Centroid)
planesrf = PlaneSurface(Plane=xy, XSize="-500 To 500", YSize="-500 To 500")

face = HBFace(geo=geo_4, type="Floor", bc=filter)  # -> report, faces; plug-in component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
face_2 = HBFace(geo=geo_3, type="RoofCeiling", bc=filter_2)  # -> report, faces; plug-in component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
brep = Brep(c_script_3.A)
toggle = BooleanToggle(True)
brep_2 = Brep(geo_2)
brep_3 = Brep(roof)
brep_4 = Brep(planesrf)
enable_energy = BooleanToggle(False)
enable_daylight = BooleanToggle(True)
enable_daylight_2 = GetBoolean(enable_daylight, AtLeast=1, AtMost=1, FalseValue="False", TreeAccess=False, TrueValue="True")
enable_energy_2 = GetBoolean(enable_energy, AtLeast=1, AtMost=1, FalseValue="False", TreeAccess=False, TrueValue="True")
bool_2 = Boolean(enable_energy_2)
filter_3 = StreamFilter(Gate=bool_2, Stream1=c_script_2.A)  # disabled
toggle_2 = BooleanToggle(True)
onoff = EnableDisableObject(
    Enabled=enable_daylight_2,
    AllObjects_Object=[mcol_3, gradient_4, swatch_7, c_script_26, c_script_23, demesh, dual, faceb, dup, scale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])
onoff_2 = EnableDisableObject(
    Enabled=enable_energy_2,
    AllObjects_Object=[annualloads, room, panel_24, panel_23, panel_25, downloadepw, toggle_4, data_4, ma_5, total_load_intensity_kwh_m2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])
se_threshold = Slider(250, range=0..1000)
number_slider_7 = Slider(1, range=0..10)
panel_13 = Panel("""sDA
ASE
UDI
UDIa
MI""")
toggle_3 = BooleanToggle(True)  # disabled
item_5 = ListItem(Index=0, Wrap=True)  # disabled
c_script_4 = CSharpScript(run=toggle_3, y=item_5)  # -> out, A, B; inputs run: Boolean; disabled
# ---------- c_script_4: C# usings ----------
using System.Drawing;
# ---------- c_script_4: C# ----------
    if(run)
    {
      var view = doc.Views.Find("Perspective", false);
      //var vp = view.ActiveViewport;
      Rhino.Display.DisplayModeDescription displayMode = Rhino.Display.DisplayModeDescription.FindByName("Shaded");

      Bitmap bitmap = view.CaptureToBitmap(new Size(256, 256), displayMode);
      A = bitmap;
      B = ImageToBase64String(bitmap);
    }
# ---------- c_script_4: C# additional code ----------
  private string ImageToBase64String(Bitmap bitmap)
  {

    System.IO.MemoryStream ms = new System.IO.MemoryStream();

    bitmap.Save(ms, System.Drawing.Imaging.ImageFormat.Jpeg);

    byte[] arr = new byte[ms.Length];

    ms.Position = 0;
    ms.Read(arr, 0, (int) ms.Length);
    ms.Close();

    string strBase64 = Convert.ToBase64String(arr);

    return strBase64;
  }
# ---------- end c_script_4 ----------
rh_out_perspective_view = Text(c_script_4.B)  # disabled
set_img = ColibriImageSetting(ImageSaveAsName="defaultName", RhinoViewNames="Perspective", Width=600, Height=600)

winperwall_2 = Panel(merge)
windows_per_wall = GetInteger(AtLeast=1, AtMost=2147483647, Maximum=2147483647, Minimum=-2147483648, TreeAccess=False)

c_script_5 = CSharpScript(x=windows_per_wall, y=winperwall_2)  # -> out, A
# ---------- c_script_5: C# ----------
    if(x == null)
    {
      A = y;}
    else
    {
      A = x;
    }
# ---------- end c_script_5 ----------

int = Integer(c_script_5.A)

walls = Integer(int)
lng = ListLength(List=walls)
c_script_6 = CSharpScript(Reset=button, SelectedSubWinWalls=walls, wallCount=lng)  # -> out, A; inputs Reset: Boolean, SelectedSubWinWalls: list of Int32, wallCount: Int32
# ---------- c_script_6: C# ----------
    if(Reset ){
      wallSubWinsList.Clear();
      for(int i = 0;i < wallCount ;i++)
        wallSubWinsList.Add(1);
    }


    wallSubWinsList = SelectedSubWinWalls;

    List<string> opts1 = new List<string> ();
    for(int i = 0 ;i < wallCount ;i++){
      if(wallSubWinsList.Count == wallCount){
        for(int j = 0 ;j < wallSubWinsList[i] ;j++){
          opts1.Add(i.ToString() + "-" + j.ToString());
        }
      }
    }

    A = opts1;
# ---------- c_script_6: C# additional code ----------
  int WallCount = 4;
  int WindowCount ;
  List<int> wallSubWinsList = new List<int> ();
# ---------- end c_script_6 ----------
lng_2 = ListLength(List=c_script_6.A)
series_2 = Series(Start=0, Step=1, Count=lng_2)
c_script_7 = CSharpScript(Reset=button, opts1=c_script_6.A, branches=series_2, newNumbers=merge_3)  # -> out, A; inputs Reset: Boolean, opts1: list of String, branches: list of Int32, newNumbers: list of Double
# ---------- c_script_7: C# ----------
    if(opts1.Count == 0) return;
    ///*
    bool Check = false;/////////////////////////
    if (opts1.Count != opts2.Count )
    {
      Check = true;////////////////////////////
      opts2.Clear();
      opts2.AddRange(opts1);
    }
    else{
      for(int i = 0; i < opts1.Count;i++){ //////////
        if( opts1[i] != opts2[i]){////////
          Check = true;////////////////////////////
          opts2.Clear();
          opts2.AddRange(opts1);
        }
      }
    }


    if(Reset || Check){
      AllInitialNumbers.ClearData();
      for(int i = 0 ;i < opts1.Count;i++){
        var brancheNames = opts1[i].Split('-');
        AllInitialNumbers.AddRange(Numbers, new GH_Path(new int[2]{Int32.Parse(brancheNames[0]),Int32.Parse(brancheNames[1])}));
      }
    }

    ///Regenerating input Values based on new numbers
    for(int j = 0 ;j < branches.Count;j++){
      var brancheNames = opts1[branches[j]].Split('-');
      var path = new GH_Path(new int[2]{Int32.Parse(brancheNames[0]),Int32.Parse(brancheNames[1])});
      if(AllInitialNumbers.PathExists(path)){
        AllInitialNumbers.Branch(path).Clear();
        AllInitialNumbers.AddRange(newNumbers, new GH_Path(path));
      }
    }

    ///Removing empty branches
    List<GH_Path> allBranchePathes = new List<GH_Path>();
    for(int i = 0 ;i < AllInitialNumbers.BranchCount ;i++){
      allBranchePathes.Add(AllInitialNumbers.Path(i));
    }
    for(int i = 0 ;i < allBranchePathes.Count ;i++){
      if(AllInitialNumbers.Branch(allBranchePathes[i]) != null){
        bool flag = AllInitialNumbers.Branch(allBranchePathes[i]).Count == 0;
        if(flag)
          AllInitialNumbers.RemovePath(allBranchePathes[i]);
      }
    }

    A = AllInitialNumbers;

    //*/
# ---------- c_script_7: C# additional code ----------
  double[] Numbers = new double[10]{1.5,1.5,0,0,0,1,0.4,0,1,0.4};

  List<string> opts2 = new List<string>(){"0-0","1-0","2-0","3-0"};
  DataTree<double> AllInitialNumbers = new DataTree<double>();
# ---------- end c_script_7 ----------
c_script_8 = CSharpScript(x=walls)  # -> out, A; inputs x: Int32
# ---------- c_script_8: C# ----------
    if(x ==0)
      x = 1;
    
    A = x;
# ---------- end c_script_8 ----------
div = DivideDomain(Domain=Domain(0, 1), Count=walls)
div_2 = DivideDomain(Domain=Domain(0, 1), Count=c_script_8.A)
subcrv = SubCurve(BaseCurve=reparameterize(simplify(crv)), Domain=simplify(div_2))  # -> simplify(graft(Curve))
subcrv_2 = SubCurve(BaseCurve=reparameterize(simplify(crv)), Domain=simplify(div))  # -> graft(Curve)
lng_3 = ListLength(List=subcrv_2)
clean = CleanTree(RemoveNulls=True, RemoveInvalid=True, RemoveEmpty=True, Tree=subcrv_2)
equals = Equality(FirstNumber=lng_3, SecondNumber=0)  # -> Equality, Inequality
cull = CullPattern(List=subcrv, CullPattern=equals.Equality)
item_6 = ListItem(List=c_script_7.A, Index=0, Wrap=True)  # -> Item, Item1, Item2, Item3, Item4, Item5, Item6, Item7, Item8, Item9
crv_2 = Curve(clean)
len_2 = Length(Curve=crv_2)
num_2 = Number(item_6.Item)
subtraction_2 = Subtraction(A=len_2, B=multiplication)
num_3 = Number(item_6.Item1)
c_script_9 = CSharpScript(x=num_2, y=subtraction_2)  # -> out, A; inputs x: Double
# ---------- c_script_9: C# ----------
    double Number = 0;
    if(x >= y.Max)
      Number = y.Max;
    else if(x<= y.Min)
      Number = y.Min;
    else
      Number = x;
    
    A = Number;
# ---------- end c_script_9 ----------
c_script_10 = CSharpScript(x=num_3, y=subtraction)  # -> out, A; inputs x: Double; same code as c_script_9
subtraction_3 = Subtraction(A=subtraction_2, B=c_script_9.A)
subtraction_4 = Subtraction(A=height_2, B=c_script_10.A)
num_4 = Number(item_6.Item3)
c_script_11 = CSharpScript(x=subtraction_3)  # -> out, A; inputs x: Double
# ---------- c_script_11: C# ----------
    x = x / 2;
    Interval Intrvl = new Interval(-x, x);
    A = Intrvl;
# ---------- end c_script_11 ----------
num_5 = Number(item_6.Item2)
bool_3 = Boolean(item_6.Item7)
subtraction_5 = Subtraction(A=subtraction_4, B=multiplication_2)
c_script_12 = CSharpScript(x=num_5, y=c_script_11.A)  # -> out, A; inputs x: Double; same code as c_script_9
len_3 = Length(Curve=crv_2)
c_script_13 = CSharpScript(x=subtraction_5)  # -> out, A; inputs x: Double; same code as c_script_11
division_3 = Division(A=c_script_12.A, B=len_3)
c_script_14 = CSharpScript(x=num_4, y=c_script_13.A)  # -> out, A; inputs x: Double; same code as c_script_9
addition = Addition(A=division, B=c_script_14.A)
addition_2 = Addition(A=division_3, B="0.5")
eval = EvaluateCurve(Curve=reparameterize(crv_2), Parameter=addition_2)  # -> Point, Tangent, Angle
pull = PullPoint(Point=eval.Point, Geometry=item_2, ClosestOnly=True)  # -> ClosestPoint, Distance
vrot = Rotate(Vector=eval.Tangent, Axis=Z_2, Angle=[-1.570796327, 1.570796327])
subtraction_6 = Subtraction(A=pull.ClosestPoint, B=eval.Point)
angle = Angle(VectorA=subtraction_6, VectorB=vrot)  # -> Angle, Reflex
sort_2 = SortList(Keys=angle.Angle, ValuesA=vrot)  # -> Keys, reverse(ValuesA)
item_7 = ListItem(List=sort_2.ValuesA, Index=0, Wrap=True)
multiplication_4 = Multiplication(A=Z_2, B=addition)
move_3 = Move(Geometry=eval.Point, Motion=multiplication_4)  # -> Geometry, Transform
vrot_2 = Rotate(Vector=Z_2, Axis=item_7, Angle=-1.570796327)
c_script_15 = CSharpScript(x=c_script_9.A)  # -> out, A; inputs x: Double; same code as c_script_11
pl = ConstructPlane(Origin=move_3.Geometry, XAxis=vrot_2, YAxis=Z_2)
crv_3 = Curve(clean)
match = MatchTree(Tree=pl, Guide=c_script_15.A)
c_script_16 = CSharpScript(x=c_script_10.A)  # -> out, A; inputs x: Double; same code as c_script_11
extr_2 = Extrude(Base=crv_3, Direction=Z)
rectangle = Rectangle(Plane=match, XSize=c_script_15.A, YSize=c_script_16.A, Radius=0)  # -> Rectangle, Length
area_2 = Area(Geometry=rectangle.Rectangle)  # -> Area, Centroid
join = JoinCurves(Curves=extr_2, Preserve=False)  # -> simplify(Curves)
clean_2 = CleanTree(RemoveNulls=True, RemoveInvalid=True, RemoveEmpty=True, Tree=cull)
amp = Amplitude(Vector=item_7, Amplitude=Slider(0.02, range=0..1))
larger = LargerThan(FirstNumber=area_2.Area, SecondNumber=0.1)  # -> LargerThan, OrEqualTo
cull_2 = CullPattern(List=rectangle.Rectangle, CullPattern=larger.LargerThan)
extr_3 = Extrude(Base=clean_2, Direction=Z)
match_2 = MatchTree(Tree=join, Guide=cull_2)
move_4 = Move(Geometry=cull_2, Motion=amp)  # -> Geometry, Transform
merge_6 = Merge(Data1=cull_2, Data2=match_2, Data3=extr_3)
clean_3 = CleanTree(RemoveNulls=True, RemoveInvalid=True, RemoveEmpty=True, Tree=merge_6)
explode_2 = Explode(Curve=move_4.Geometry, Recursive=True)  # -> Segments, Vertices
explode_3 = Explode(Curve=cull_2, Recursive=True)  # -> Segments, Vertices
boundary_2 = BoundarySurfaces(Edges=cull_2)
boundary_3 = BoundarySurfaces(Edges=clean_3)
curvepoint = PointOnCurve(explode_2.Segments, parameter=0.5)
item_8 = ListItem(List=flatten(boundary_3), Index=Slider(4, range=0..10), Wrap=True)

# ---- group: RH_OUT:windows_brep
windows_brep = Geometry(boundary_2)

# ----
mesh = MeshBrep(
    Brep=boundary_2,
    Settings={GridMaxCount=0, GridMinCount=16, JaggedSeams=False, MaxEdgeLength=0, MinEdgeLength=0.0001, MinTolerance=0, Refine=True, RefineAngle=0, RelativeTolerance=0.65, SimplePlanes=True, Tolerance=0})
pdecon = Deconstruct(Point=curvepoint)  # -> XComponent, YComponent, ZComponent

# ---- group: RH_OUT:walls_brep
walls_brep = Geometry(boundary_3)

# ----
sort_3 = SortList(Keys=pdecon.ZComponent, ValuesC=explode_3.Segments, ValuesA=explode_2.Segments)  # -> Keys, ValuesC, ValuesA
item_9 = ListItem(List=sort_3.ValuesC, Index=0, Wrap=True)  # -> Item, Item1, Item2
subtraction_7 = Subtraction(A=item_6.Item5, B=1)
len_4 = Length(Curve=item_9.Item)
c_script_17 = CSharpScript(x=item_6.Item8)  # -> out, A, B; inputs x: Int32
# ---------- c_script_17: C# ----------
    if(x == 1)
    {
      A = 1;
      B = true;
    }
    else{
      A = x - 1;
      B = false;
    }
# ---------- end c_script_17 ----------
bool_4 = Boolean(item_6.Item4)
len_5 = Length(Curve=item_9.Item1)

# ---- group: Fins
c_script_18 = CSharpScript(window_width=len_4, minFinSpacing=min_fin_spacing, finNum=subtraction_7, finDepth=item_6.Item6, AddRemoveFins=bool_4)  # -> out, N_Fins, Spacing, Depth; inputs window_width: Double, minFinSpacing: Double, finNum: Int32, finDepth: Double, AddRemoveFins: Boolean
# ---------- c_script_18: C# ----------
    double spacing;
    double depth;

    double spacing1 = window_width / finNum;
    if(AddRemoveFins){


      if (finNum < 1) {
        spacing = window_width;
        depth = 0;
      }
      else {
        if (spacing1 >= minFinSpacing) {
          spacing = spacing1;
          depth = finDepth;
        }
        else{
          spacing = minFinSpacing;
          depth = finDepth;
        }
      }
    }
    else{
      spacing = window_width;
      depth = 0;
    }

    N_Fins = finNum;
    Spacing = spacing;
    Depth = depth;
# ---------- end c_script_18 ----------

# ---- group: Overhangs
c_script_19 = CSharpScript(window_width=len_5, minFinSpacing=min_fin_spacing, finNum=c_script_17.A, finDepth=item_6.Item9, AddRemoveFins=bool_3)  # -> out, N_Fins, Spacing, Depth; inputs window_width: Double, minFinSpacing: Double, finNum: Int32, finDepth: Double, AddRemoveFins: Boolean; same code as c_script_18

# ----
item_10 = ListItem(List=reverse(sort_3.ValuesC), Index=0, Wrap=True)
divide = DivideCurve(Curve=item_9.Item, Count=c_script_18.N_Fins, Kinks=False)  # -> Points, Tangents, Parameters
divide_2 = DivideCurve(Curve=item_9.Item1, Count=c_script_19.N_Fins, Kinks=False)  # -> Points, Tangents, Parameters
pull_2 = PullPoint(Point=divide.Points, Geometry=item_10, ClosestOnly=True)  # -> ClosestPoint, Distance
pull_3 = PullPoint(Point=divide_2.Points, Geometry=item_9.Item2, ClosestOnly=True)  # -> ClosestPoint, Distance
ln = Line(StartPoint=pull_3.ClosestPoint, EndPoint=divide_2.Points)
amp_2 = Amplitude(Vector=item_7, Amplitude=c_script_19.Depth)
extr_4 = Extrude(Base=ln, Direction=amp_2)
center2 = Center(Geometric=extr_4)  # -> Center, Dimension
area_3 = Area(Geometry=extr_2)  # -> Area, Centroid
area_4 = Area(Geometry=cull_2)  # -> Area, Centroid
mesh_2 = MeshBrep(
    Brep=boundary_3,
    Settings={GridMaxCount=0, GridMinCount=16, JaggedSeams=False, MaxEdgeLength=0, MinEdgeLength=0.0001, MinTolerance=0, Refine=True, RefineAngle=0, RelativeTolerance=0.65, SimplePlanes=True, Tolerance=0})
pdecon_2 = Deconstruct(Point=center2.Center)  # -> XComponent, YComponent, ZComponent
ln_2 = Line(StartPoint=divide.Points, EndPoint=pull_2.ClosestPoint)
amp_3 = Amplitude(Vector=item_7, Amplitude=c_script_18.Depth)
pshift = ShiftPaths(Data=area_3.Area, Offset=-1)
pshift_2 = ShiftPaths(Data=area_4.Area, Offset=-1)
sort_4 = SortList(Keys=pdecon_2.ZComponent, ValuesA=extr_4)  # -> Keys, ValuesA
extr_5 = Extrude(Base=ln_2, Direction=amp_3)
ma = MassAddition(Input=pshift)  # -> Result, PartialResults
ma_2 = MassAddition(Input=pshift_2)  # -> Result, PartialResults
cull_i = CullIndex(List=sort_4.ValuesA, Indices=0, Wrap=True)
geo_5 = Geometry(extr_4)
c_script_20 = CSharpScript(x=simplify(graft(walls)))  # -> out, A; inputs x: tree of Int32
# ---------- c_script_20: C# ----------
    DataTree<int> y = new DataTree<int> ();
    for(int i = 0 ;i < x.BranchCount ;i++)
    {
      if(x.Branch(i)[0] == 0)
        y.Add(0, new GH_Path(i));
    }
    A = y;
# ---------- end c_script_20 ----------
mesh_3 = MeshBrep(
    Brep=extr_5,
    Settings={GridMaxCount=0, GridMinCount=16, JaggedSeams=False, MaxEdgeLength=0, MinEdgeLength=0.0001, MinTolerance=0, Refine=True, RefineAngle=0, RelativeTolerance=0.65, SimplePlanes=True, Tolerance=0})

# ---- group: Dimensions
number_slider_8 = Slider(0.67, range=0..10)
crv_4 = Curve(simplify.Curve)
offset = OffsetCurve(Curve=crv_4, Distance=[0.1, -0.1], Corners=1)  # -> flatten(Curve)
sort_5 = SortList(Keys=offset, ValuesA=offset)  # -> Keys, reverse(ValuesA)
explode_4 = Explode(Curve=crv_4, Recursive=True)  # -> Segments, Vertices
neg = Negative(Value=number_slider_8)
merge_7 = Merge(Data1=neg, Data2=number_slider_8)
item_11 = ListItem(List=sort_5.ValuesA, Index=0, Wrap=True)
explode_5 = Explode(Curve=simplify.Curve, Recursive=True)  # -> Segments, Vertices
curvepoint_2 = PointOnCurve(explode_4.Segments, parameter=0.5)
Z_4 = UnitZ(Factor=1)
disc = Discontinuity(Curve=item_11, Level=1)  # -> Points, Parameters
disc_2 = Discontinuity(Curve=crv_4, Level=1)  # -> Points, Parameters
pull_4 = PullPoint(Point=curvepoint_2, Geometry=item_11, ClosestOnly=True)  # -> ClosestPoint, Distance
vrot_3 = Rotate(Vector=graft(explode_5.Segments), Axis=Z_4, Angle=[1.570796327, -1.570796327])
curvepoint_3 = PointOnCurve(explode_5.Segments, parameter=0.5)
offset_l_2 = OffsetCurveLoose(Curve=graft(explode_5.Segments), Distance=merge_7)
Z_5 = UnitZ(Factor=1)
subtraction_8 = Subtraction(A=pull_4.ClosestPoint, B=curvepoint_2)
pull_5 = PullPoint(Point=disc_2.Points, Geometry=disc.Points, ClosestOnly=True)  # -> ClosestPoint, Distance
line = LineSDL(Start=disc_2.Points, Direction=Z_5, Length=height_2)
addition_3 = Addition(A=graft(curvepoint_3), B=vrot_3)
boundary_4 = BoundarySurfaces(Edges=simplify.Curve)
curvepoint_4 = PointOnCurve(offset_l_2, parameter=0.5)
vrot_4 = Rotate(Vector=subtraction_8, Axis=Z_5, Angle=-1.570796327)
curvepoint_5 = PointOnCurve(line, parameter=0.5)
subtraction_9 = Subtraction(A=disc_2.Points, B=pull_5.ClosestPoint)
pull_6 = PullPoint(Point=addition_3, Geometry=boundary_4, ClosestOnly=True)  # -> ClosestPoint, Distance
end = EndPoints(Curve=line)  # -> Start, End
line_2 = LineSDL(Start=curvepoint_2, Direction=vrot_4, Length=1)
pl_2 = ConstructPlane(Origin=curvepoint_5, XAxis=subtraction_9, YAxis=Z_5)
pull_7 = PullPoint(Point=curvepoint_4, Geometry=boundary_4, ClosestOnly=True)  # -> ClosestPoint, Distance
curvepoint_6 = PointOnCurve(crv_3, parameter=0.5)
multiplication_5 = Multiplication(A=Z, B=1.2)
sort_6 = SortList(Keys=pull_6.Distance, ValuesA=vrot_3)  # -> Keys, ValuesA
sort_7 = SortList(Keys=pull_7.Distance, ValuesA=offset_l_2)  # -> Keys, ValuesA
move_5 = Move(Geometry=curvepoint_6, Motion=multiplication_5)  # -> Geometry, Transform
flip = FlipCurve(Curve=graft(explode_4.Segments), Guide=graft(line_2))  # -> flatten(Curve), Flag
center3 = Center(Geometric=simplify.Curve)  # -> Center, Dimension
item_12 = ListItem(List=reverse(sort_6.ValuesA), Index=0, Wrap=True)
pl_3 = ConstructPlane(Origin=curvepoint_2, XAxis=vrot_4, YAxis=subtraction_8)
item_13 = ListItem(List=reverse(sort_7.ValuesA), Index=0, Wrap=True)  # -> simplify(Item)
tstat = TreeStatistics(Tree=move_5.Geometry)  # -> Paths, Length, Count
item_14 = ListItem(List=reverse(sort_3.ValuesA), Index=[0, 1], Wrap=True)
end_2 = EndPoints(Curve=flip.Curve)  # -> Start, End
vrot_5 = Rotate(Vector=item_12, Axis=Vector(0, 0, 1), Angle=-1.570796327)
Z_6 = UnitZ(Factor=1)
dpath = DeconstructPath(Branch=tstat.Paths)  # -> simplify(Indices)
curvepoint_7 = PointOnCurve(item_13, parameter=0.5)
merge_8 = Merge(Data1=pl_3, Data2=pl_2)
tstat_2 = TreeStatistics(Tree=item_13)  # -> graft(Paths), Length, Count
item_15 = ListItem(List=sort_3.ValuesA, Index=0, Wrap=True)
vrot_6 = Rotate(Vector=Z_6, Axis=amp_3, Angle=-1.570796327)
merge_9 = Merge(Data1=flatten(end_2.Start), Data2=flatten(end.Start))
curvepoint_8 = PointOnCurve(item_14, parameter=0.451)
merge_10 = Merge(Data1=flatten(end_2.End), Data2=flatten(end.End))
item_16 = ListItem(List=dpath, Index=0, Wrap=True)  # -> Item, Item1
project = Project(Geometry=item_15, Plane=center3.Center)  # -> Geometry, Transform
vrot_7 = Rotate(Vector=item_14, Axis=amp_3, Angle=-1.570796327)
dpath_2 = DeconstructPath(Branch=tstat_2.Paths)
Z_7 = UnitZ(Factor=1)
panel_14 = Panel("""[
]""")
format = Format(Format="win {1}", Culture=127, Data0=item_16.Item, Data1=item_16.Item1)
curvepoint_9 = PointOnCurve(project.Geometry, parameter=0.5)
weave = Weave(Pattern=[1, 0, 1], Stream0=dpath_2, Stream1=panel_14, NullGaps=False)
end_3 = EndPoints(Curve=item_14)  # -> Start, End
pl_4 = ConstructPlane(Origin=curvepoint_8, XAxis=item_14, YAxis=vrot_7)
pl_5 = ConstructPlane(Origin=curvepoint_7, XAxis=expr("-X", vrot_5), YAxis=Z_7)
match_3 = MatchTree(Tree=simplify(format), Guide=simplify(move_5.Geometry))
join_2 = TextJoin(Text=weave)
pl_6 = ConstructPlane(Origin=curvepoint_9, XAxis=vrot_6, YAxis=Z_6)
aligndim = AlignedDimension(
    Plane=pl_4,
    PointA=end_3.Start,
    PointB=end_3.End,
    Offset=Slider(0.16, range=0..1),
    Text="{0:0.00}",
    Size=Slider(0.12, range=0..1))
tag = TextTag3D(
    Location=pl_6,
    Text=match_3,
    Size=Slider(0.34, range=0..10),
    Colour=ColourSwatch(SwatchColor=RGB(69, 0, 0)),
    Justification=8)
aligndim_2 = AlignedDimension(
    Plane=merge_8,
    PointA=merge_9,
    PointB=merge_10,
    Offset=Slider(0.35, range=0..1),
    Text="{0:0.00}",
    Size=Slider(0.17, range=0..1))
tag_2 = TextTag3D(
    Location=pl_5,
    Text=join_2,
    Size=Slider(0.52, range=0..10),
    Colour=ColourSwatch(SwatchColor=RGB(130, 0, 0)),
    Justification=9)

# ----
division_4 = Division(A=ma_2.Result, B=ma.Result)
c_script_21 = CSharpScript(G=c_script_17.B, D0=geo_5, D1=cull_i)  # -> out, A; inputs G: Int32, D0: list of GeometryBase, D1: list of GeometryBase
# ---------- c_script_21: C# ----------
    if(G == 0)
      A = D0;
    
    else
      A = D1;
# ---------- end c_script_21 ----------
offmsh = OffsetMesh(Mesh=mesh_2, Distance=0.002, BothSides=False, CreateSolid=True)
offmsh_2 = OffsetMesh(Mesh=mesh_3, Distance=0.002, BothSides=False, CreateSolid=True)
mesh_4 = MeshBrep(
    Brep=c_script_21.A,
    Settings={GridMaxCount=0, GridMinCount=16, JaggedSeams=False, MaxEdgeLength=0, MinEdgeLength=0.0001, MinTolerance=0, Refine=True, RefineAngle=0, RelativeTolerance=0.65, SimplePlanes=True, Tolerance=0})
merge_11 = Merge(Data1=division_4, Data2=c_script_20.A)
offmsh_3 = OffsetMesh(Mesh=mesh_4, Distance=0.002, BothSides=False, CreateSolid=True)
round = Round(Number=merge_11)  # -> Nearest, Floor, Ceiling
preview = CustomPreview(Geometry=offmsh_3, Material=ColourSwatch(SwatchColor=RGB(94, 102, 95)))
preview_2 = CustomPreview(Geometry=offmsh_2, Material=ColourSwatch(SwatchColor=RGB(110, 93, 24)))
preview_3 = CustomPreview(Geometry=offmsh, Material=ColourSwatch(SwatchColor=RGB(227, 227, 227)))

# ---- group: RH_OUT:wwr_metric
wwr_metric = Number(flatten(round.Nearest))

# ---- group: Walls
geo_6 = Geometry(flatten(mesh_2))

# ----
item_17 = ListItem(List=c_script_7.A, Index=6, Wrap=True)
wbjoin = WeaverbirdsJoinMeshesAndWeld(Mesh=geo_6, Weld=False)
brep_5 = Brep(flatten(extr_3))
num_6 = Number(flatten(division_4))
pshift_3 = ShiftPaths(Data=extr_2, Offset=-1)
join_3 = BrepJoin(Breps=pshift_3)  # -> simplify(Breps), Closed
fmerge = MergeFaces(Brep=join_3.Breps)  # -> flatten(Breps), Before, After
flatten = FlattenTree(Tree=c_script_18.Spacing, Path="{0}")
flatten_2 = FlattenTree(Tree=c_script_18.Depth, Path="{0}")
geo_7 = Geometry(fmerge.Breps)
face_3 = HBFace(geo=brep_5, bc="outdoors")  # -> report, faces; plug-in component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
face_4 = HBFace(geo=geo_7, bc="outdoors")  # -> report, faces; plug-in component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
aperturesbyratio = HBAperturesByRatio(hb_objs=flatten(face_4.faces), ratio=num_6, subdivide=Toggle(True))  # -> report, hb_objs; plug-in component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
mesh_5 = Mesh(flatten(mesh))
mesh_6 = Mesh(wbjoin)
wbjoin_2 = WeaverbirdsJoinMeshesAndWeld(Mesh=mesh_5, Weld=False)
data_3 = Data([aperturesbyratio.hb_objs, face_3.faces, face.faces, face_2.faces])
clean_4 = CleanTree(RemoveNulls=True, RemoveInvalid=True, RemoveEmpty=False, Tree=data_3)
filter_4 = StreamFilter(Gate=bool_2, Stream1=clean_4)  # disabled
num_7 = Number(flatten(c_script_19.Depth))
num_8 = Number(flatten(c_script_19.Spacing))
predict_daylight = PredictDaylightMetricsFromGeometryAndMaterialInputsPWAIV0301(
    SensorsPositions=c__0_003.B,
    CeilingGeometries=brep_2,
    FloorGeometries=brep_3,
    WallsGeometries=mesh_6,
    GlazingGeometries=wbjoin_2,
    SurroundingGeometries=brep,
    GroundSurface=brep_4,
    CeilingReflectance=item.Item,
    FloorReflectance=item.Item1,
    WallsReflectance=item.Item2,
    GlazingTransparency=item.Item3,
    VerticalShadingDeviceDepth=flatten_2,
    VerticalShadingDeviceSpacing=flatten,
    HorizontalShadingDeviceDepth=num_7,
    HorizontalShadingDeviceSpacing=num_8,
    ComputeSolution=enable_daylight_2,
    PredictDA=toggle_2,
    PredictSE=toggle_2,
    PredictMI=toggle_2,
    PredictUDI=toggle_2,
    NumberOfThreads=-1,
    ProduceAdditionalDataForDebugging=False,
    IndexOfSensorToDebug=0,
    City="Boston")  # -> PredictedDaylightAutonomy_sensor_array, PredictedSunlightExposure_sensor_array, PredictedMeanIlluminance_sensor_array, PredictedUsefulDaylightIlluminanceFailing_sensor_array, PredictedUsefulDaylightIlluminanceSupplementary_sensor_array, PredictedUsefulDaylightIlluminanceAcceptable_sensor_array, PredictedUsefulDaylightIlluminanceExcessive_sensor_array, Rays

# ---- group: RH_OUT:DA_metric
da_metric = Number(predict_daylight.PredictedDaylightAutonomy_sensor_array)

# ----
merge_12 = Merge(
    Data1=graft(predict_daylight.PredictedUsefulDaylightIlluminanceFailing_sensor_array),
    Data2=graft(predict_daylight.PredictedUsefulDaylightIlluminanceSupplementary_sensor_array),
    Data3=graft(predict_daylight.PredictedUsefulDaylightIlluminanceAcceptable_sensor_array),
    Data4=graft(predict_daylight.PredictedUsefulDaylightIlluminanceExcessive_sensor_array))  # -> simplify(Result)

number_slider_9 = Slider(1, range=0..1)
lng_4 = ListLength(List=predict_daylight.PredictedUsefulDaylightIlluminanceFailing_sensor_array)
ma_3 = MassAddition(Input=merge_12)  # -> Result, PartialResults
dup = DuplicateData(Data=0.0001, Number=lng_4, Order=True)
subtraction_10 = Subtraction(A=number_slider_9, B=ma_3.Result)
addition_4 = Addition(A=number_slider_9, B=subtraction_10)
multiplication_6 = Multiplication(A=merge_12, B=addition_4)
ma_4 = MassAddition(Input=multiplication_6)  # -> Result, PartialResults
merge_13 = Merge(Data1=simplify(graft(dup)), Data2=simplify(ma_4.PartialResults))  # -> simplify(Result)
number_slider_10 = Slider(0.5, range=0..1)
dual = Dual(Mesh=c__0_003.A, Type=0)
demesh = DeconstructMesh(Mesh=c__0_003.A)  # -> Vertices, Faces, Colours, Normals
number_slider_11 = Slider(50, range=0..100)
number_slider_12 = Slider(3000, range=0..10000)
faceb = FaceBoundaries(Mesh=dual)
bnd = Bounds(Numbers=predict_daylight.PredictedMeanIlluminance_sensor_array)
c_script_22 = CSharpScript(x=predict_daylight.PredictedUsefulDaylightIlluminanceAcceptable_sensor_array, y=number_slider_10)  # -> out, A; inputs x: Double, y: Double
# ---------- c_script_22: C# ----------
    if(x>=y)
      A = 1;
    else
      A = 0;
# ---------- end c_script_22 ----------
scale = Scale(Geometry=graft(faceb), Center=graft(demesh.Vertices), Factor=merge_13)  # -> Geometry, Transform
remap = RemapNumbers(Value=predict_daylight.PredictedMeanIlluminance_sensor_array, Source=bnd, Target=Domain(0, 1))  # -> Mapped, Clipped
gradient = Gradient(
    LowerLimit=number_slider_12,
    UpperLimit=number_slider_11,
    Parameter=predict_daylight.PredictedMeanIlluminance_sensor_array,
    stops=[0: RGB(234, 38, 0), 0.25: RGB(234, 126, 0), 0.5: RGB(254, 244, 84), 0.75: RGB(173, 203, 249), 1: RGB(75, 107, 169)])
gradient_2 = Gradient(LowerLimit=0, UpperLimit=1, Parameter=c_script_22.A, stops=[0: RGB(171, 171, 171), 1: RGB(24, 121, 148)])
shift = ShiftList(List=scale.Geometry, Shift=-1, Wrap=False)
shift_2 = ShiftList(List=scale.Geometry, Shift=1, Wrap=False)
swatch = ColourSwatch(SwatchColor=RGB(65, 128, 176))
swatch_2 = ColourSwatch(SwatchColor=RGB(117, 186, 163))
swatch_3 = ColourSwatch(SwatchColor=RGB(180, 224, 119))
swatch_4 = ColourSwatch(SwatchColor=RGB(255, 176, 255))
explode_6 = Explode(Curve=shift, Recursive=True)  # -> graft(Segments), Vertices
explode_7 = Explode(Curve=shift_2, Recursive=True)  # -> graft(Segments), Vertices
swatch_5 = ColourSwatch(SwatchColor=RGB(194, 194, 194))
merge_14 = Merge(Data1=swatch, Data2=swatch_2, Data3=swatch_3, Data4=swatch_4)  # -> graft(Result)
end_4 = EndPoints(Curve=explode_7.Segments)  # -> Start, End
end_5 = EndPoints(Curve=explode_6.Segments)  # -> Start, End
panel_15 = Panel("""0 to 100
100 to 300
300 to 3000
3000 to 10000""")
c_script_23 = CSharpScript(x=predict_daylight.PredictedSunlightExposure_sensor_array, y=se_threshold)  # -> out, A; inputs x: Double, y: Double; same code as c_script_22
c_script_24 = CSharpScript(x=gradient_2, y=swatch_5)  # -> out, A; inputs x: tree of Color, y: Color
# ---------- c_script_24: C# ----------
    if(x.BranchCount>0){
      A = x;}
    else
      A = y;
    
    //A = x.BranchCount > 0;
# ---------- end c_script_24 ----------
c_script_25 = CSharpScript(x=predict_daylight.PredictedDaylightAutonomy_sensor_array, y=0.5)  # -> out, A; inputs x: Double, y: Double
# ---------- c_script_25: C# ----------
    if(x >= y)
      A = x;
    else
      A = 0;
# ---------- end c_script_25 ----------
merge_15 = Merge(Data1=end_4.Start, Data2=end_4.End, Data3=end_5.End, Data4=end_5.Start)
mcol = MeshColours(Mesh=c__0_003.A, Colours=c_script_24.A)
gradient_3 = Gradient(LowerLimit=0, UpperLimit=1, Parameter=c_script_25.A, stops=[0: RGB(171, 171, 171), 1: RGB(157, 224, 63)])
gradient_4 = Gradient(LowerLimit=0, UpperLimit=1, Parameter=c_script_23.A, stops=[0: RGB(171, 171, 171), 1: RGB(251, 255, 0)])
conmesh = ConstructMesh(Vertices=merge_15, Faces={A=0, B=1, C=2, D=3})  # -> simplify(Mesh)
fdom = FindDomain(Domains=panel_15, Number=predict_daylight.PredictedMeanIlluminance_sensor_array, Strict=False)  # -> Index, Neighbour
item_18 = ListItem(List=flatten(merge_14), Index=fdom.Index, Wrap=True)
pshift_4 = ShiftPaths(Data=conmesh, Offset=-1)
swatch_6 = ColourSwatch(SwatchColor=RGB(141, 219, 68))
swatch_7 = ColourSwatch(SwatchColor=RGB(70, 100, 166))
wbjoin_3 = WeaverbirdsJoinMeshesAndWeld(Mesh=pshift_4, Weld=False)
mcol_2 = MeshColours(Mesh=c__0_003.A, Colours=gradient)
pshift_5 = ShiftPaths(Data=wbjoin_3, Offset=-1)
c_script_26 = CSharpScript(x=gradient_4, y=swatch_7)  # -> out, A; inputs x: tree of Color, y: Color; same code as c_script_24
c_script_27 = CSharpScript(x=gradient_3, y=swatch_6)  # -> out, A; inputs x: tree of Color, y: Color; same code as c_script_24
flip_2 = FlipMatrix(Data=pshift_5)
mcol_3 = MeshColours(Mesh=c__0_003.A, Colours=c_script_26.A)
mcol_4 = MeshColours(Mesh=c__0_003.A, Colours=c_script_27.A)
mcol_5 = MeshColours(Mesh=flip_2, Colours=merge_14)
mesh_7 = Mesh(mcol_5)
mesh_8 = Mesh(mcol_2)
clean_5 = CleanTree(RemoveNulls=True, RemoveInvalid=True, RemoveEmpty=True, Tree=mesh_7)
mesh_9 = Mesh(mcol_3)
mesh_10 = Mesh(mcol_4)
mesh_11 = Mesh(mcol)
mjoin = MeshJoin(Meshes=flatten(clean_5))
c_script_28 = CSharpScript(mesh=mjoin)  # -> verticesColors; inputs mesh: Mesh
# ---------- c_script_28: C# ----------
      verticesColors = mesh.VertexColors;
# ---------- end c_script_28 ----------
number_slider_13 = Slider(0.2, range=0..10)
merge_16 = Merge(Data1=flatten(mesh_10), Data2=flatten(mesh_9), Data3=flatten(mjoin), Data4=flatten(mesh_11), Data5=flatten(mesh_8))  # -> flatten(Result)
entwine = Entwine(
    Branch00=gradient_3,
    Branch01=gradient_4,
    Branch02=c_script_28,
    Branch03=gradient_2,
    Branch04=gradient,
    FlattenInputs=True)  # -> simplify(Result)
Z_8 = UnitZ(Factor=number_slider_13)
move_6 = Move(Geometry=flatten(merge_16), Motion=Z_8)  # -> Geometry, Transform

item_19 = ListItem(List=move_6.Geometry, Index=number_slider_7, Wrap=True)

# ---- group: RH_OUT:all_daylight_colors
all_daylight_colors = Text(entwine)

# ---- group: RH_OUT:daylight_colors
daylight_colors = Text(gradient)

# ---- group: RH_OUT:daylight_meshes
daylight_mesh = Mesh(move_6.Geometry)

# ---- group: Wall construction making
searchconstrs_3 = HBSearchConstructions(keywords="typical insulated steel framed R5")  # -> opaque_constrs, window_constrs, shade_constrs; plug-in component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
i_am_using_this_typical_assembly_as_the_3 = Panel(searchconstrs_3.opaque_constrs)  # "I am using this typical assembly as the starting point"
expression_5 = Expression(x=item.Item5, Expression="max(x - 0.329761-1, 1)")
decnstrconstr_6 = HBDeconstructConstruction(constr=searchconstrs_3.opaque_constrs)  # -> materials, layers, r_val_si, r_val_ip, u_fac_si, u_fac_ip, shgc, t_sol, t_vis; plug-in component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
example_wall_r_value = Panel(decnstrconstr_6.r_val_ip)
rip2rsi_3 = Ladybug_rIP2rSI(R_IP=expression_5)  # -> R_SI; plug-in component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
panel_16 = Panel(decnstrconstr_6.layers)
bang_5 = ExplodeTree(Data=graft(decnstrconstr_6.layers))  # -> _0000, _0001, _0002, _0003
decnstrmat_3 = HBDeconstructMaterial(mat=bang_5._0002)  # -> values, attr_names, r_val_si, r_val_ip; plug-in component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
bang_6 = ExplodeTree(Data=graft(decnstrmat_3.values))  # -> _000200, _000201, _000202, _000203, _000204, _000205

# ----
expression_6 = Expression(x=expression_5, Expression="Format(\"insulation-R{0}\", x)")

# ---- group: Wall construction making (continued)
opaquematnomass_3 = HBOpaqueMaterialNoMass(
    name=expression_6,
    r_value=rip2rsi_3,
    roughness=bang_6._000201,
    therm_absp=bang_6._000203,
    sol_absp=bang_6._000204,
    vis_absp=bang_6._000205)  # -> mat; plug-in component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
merge_17 = Merge(Data1=bang_5._0000, Data2=bang_5._0001, Data3=opaquematnomass_3, Data4=bang_5._0003)  # -> flatten(Result)
opaqueconstr_3 = HBOpaqueConstruction(name=give_a_name_to_the_new_wall, materials=merge_17)  # -> constr; plug-in component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
decnstrconstr_7 = HBDeconstructConstruction(constr=opaqueconstr_3)  # -> materials, layers, r_val_si, r_val_ip, u_fac_si, u_fac_ip, shgc, t_sol, t_vis; plug-in component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

# ---- group: Wall construction making / the new wall construction and its new R value
new_wall_r_value = Panel(decnstrconstr_7.r_val_ip)

# ----
exteriorsubset = HBExteriorConstructionSubset(exterior_wall=opaqueconstr_3, exterior_roof=opaqueconstr_2, exposed_floor=opaqueconstr)  # -> exterior_set; plug-in component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
constructionset = HBConstructionSet(
    name=panel_11,
    exterior_subset=exteriorsubset,
    ground_subset=groundsubset,
    interior_subset=interiorsubset,
    subface_subset=subfacesubset)  # -> constr_set; plug-in component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
decnstrconstrset = HBDeconstructConstructionSet(constr_set=constructionset)  # -> exterior_wall, exterior_roof, exposed_floor, ground_wall, ground_roof, ground_floor, window, skylight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; plug-in component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
decnstrconstr_8 = HBDeconstructConstruction(constr=decnstrconstrset.exterior_wall)  # -> materials, layers, r_val_si, r_val_ip, u_fac_si, u_fac_ip, shgc, t_sol, t_vis; plug-in component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
decnstrconstr_9 = HBDeconstructConstruction(constr=decnstrconstrset.exterior_roof)  # -> materials, layers, r_val_si, r_val_ip, u_fac_si, u_fac_ip, shgc, t_sol, t_vis; plug-in component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
decnstrconstr_10 = HBDeconstructConstruction(constr=decnstrconstrset.ground_floor)  # -> materials, layers, r_val_si, r_val_ip, u_fac_si, u_fac_ip, shgc, t_sol, t_vis; plug-in component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
decnstrconstr_11 = HBDeconstructConstruction(constr=decnstrconstrset.exposed_floor)  # -> materials, layers, r_val_si, r_val_ip, u_fac_si, u_fac_ip, shgc, t_sol, t_vis; plug-in component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
decnstrconstr_12 = HBDeconstructConstruction(constr=decnstrconstrset.window)  # -> materials, layers, r_val_si, r_val_ip, u_fac_si, u_fac_ip, shgc, t_sol, t_vis; plug-in component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
panel_17 = Panel(decnstrconstr_9.r_val_ip)
panel_18 = Panel(decnstrconstr_8.r_val_ip)
panel_19 = Panel(decnstrconstr_11.r_val_ip)
panel_20 = Panel(decnstrconstr_10.r_val_ip)
panel_21 = Panel(decnstrconstr_12.u_fac_ip)
panel_22 = Panel(decnstrconstr_12.shgc)
filter_5 = StreamFilter(Gate=bool_2, Stream1=constructionset)  # disabled

panel_23 = Panel("2013::ClimateZone5::SteelFramed")  # disabled
panel_24 = Panel("Hospital Shoe Box")  # disabled
panel_25 = Panel("https://energyplus-weather.s3.amazonaws.com/north_and_central_america_wmo_region_4/USA/MA/USA_MA_Boston-Logan.Intl.AP.725090_TMY3/USA_MA_Boston-Logan.Intl.AP.725090_TMY3.zip")  # disabled
room = HBRoom(faces=flatten(filter_4), name=panel_24, constr_set=filter_5, program=filter_3, conditioned=True)  # -> report, room; disabled; plug-in component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
toggle_4 = BooleanToggle(True)  # disabled
downloadepw = LBDownloadWeather(weather_URL=panel_25)  # -> epw_file, stat_file, ddy_file; disabled; plug-in component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
annualloads = HBAnnualLoads(rooms=flatten(room.room), epw_file=downloadepw.epw_file, run_bal=toggle_4, run=bool_2)  # -> report, total_load, cooling, heating, lighting, equip, process, hot_water, balance; disabled; plug-in component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
item_20 = ListItem(List=annualloads.total_load, Index=[0, 1, 2, 3], Wrap=True)  # disabled
data_4 = Data(flatten([annualloads.cooling, annualloads.heating, annualloads.lighting, annualloads.equip, annualloads.hot_water]))  # disabled
xdata = LBDeconstructData(data=annualloads.balance)  # -> out, header, values; disabled; plug-in component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
txt = Text(simplify(["Mesh (V:44  F:11)", "", "Heating", "Solar", "Electric Equipment", "Lighting", "People", "Infiltration", "Mechanical Ventilation", "Opaque Conduction", "Window Conduction", "Cooling", "Storage"]))  # disabled
cull_i_2 = CullIndex(List=txt, Indices=[0, 1], Wrap=True)  # disabled
num_9 = Number(simplify(Tree({0;0}: [7.2265002e-06, 0, 0.1039358954, 0.2861826227, 0.9443003638, 2.748916509, 5.403891962, 4.634928965, 1.812474214, 0.2600811075, 0.003957734042, 2.370497837e-05], {0;1}: [2.608670595, 1.591759018, 0.8072011571, 0.07139265973, 0.01428444333, 0, 0, 0, 0, 0, 0.4241594778, 1.00916368], {0;2}: [1.813157427, 1.656090598, 1.875157491, 1.70500176, 1.875157491, 1.802135194, 1.778024058, 1.875157491, 1.767001824, 1.813157427, 1.802135194, 1.778024058], {0;3}: [3.227396731, 2.936581693, 3.288215763, 3.084670334, 3.288215763, 3.171004407, 3.201881691, 3.288215763, 3.145489367, 3.227396731, 3.171004407, 3.201881691])))  # disabled
split = TextSplit(Text=cull_i_2, Separators=" ")  # -> reverse(Result); disabled
c_script_29 = CSharpScript(x=bool_2, y=xdata.values)  # -> out, A; inputs y: tree of Double; disabled
# ---------- c_script_29: C# ----------
    A = y;
# ---------- end c_script_29 ----------
item_21 = ListItem(List=split, Index=0, Wrap=True)  # -> flatten(Item); disabled
split_2 = TextSplit(Text=xdata.header, Separators=" ")  # -> reverse(Result); disabled
num_10 = Number(Tree({0;0;0}: [2.608670595, 1.591759018, 0.8072011571, 0.07139265973, 0.01428444333, 0, 0, 0, 0, 0, 0.4241594778, 1.00916368], {0;0;1}: [0, 0, 0, 0, 0, 0, 0, 0, 0, 0, 0, 0], {0;0;2}: [3.227396731, 2.936581693, 3.288215763, 3.084670334, 3.288215763, 3.171004407, 3.201881691, 3.288215763, 3.145489367, 3.227396731, 3.171004407, 3.201881691], {0;0;3}: [1.813157427, 1.656090598, 1.875157491, 1.70500176, 1.875157491, 1.802135194, 1.778024058, 1.875157491, 1.767001824, 1.813157427, 1.802135194, 1.778024058], {0;0;4}: [0.659397436, 0.6032097995, 0.6855537496, 0.6167723324, 0.6855537496, 0.6581057662, 0.6442203158, 0.6855537496, 0.642928646, 0.659397436, 0.6581057662, 0.6442203158], {0;0;5}: [0, 0, 0, 0, 0, 0, 0, 0, 0, 0, 0, 0], {0;0;6}: [-8.275603782, -6.752980342, -6.48901464, -5.358800368, -4.7529242, -2.810738808, -0.100010157, -1.071623298, -3.706898604, -5.493480634, -6.141083554, -6.749904266], {0;0;7}: [0, 0, 0, 0, 0, 0, 0, 0, 0, 0, 0, 0], {0;0;8}: [0, 0, 0, 0, 0, 0, 0, 0, 0, 0, 0, 0], {0;0;9}: [-7.2265002e-06, 0, -0.1039358954, -0.2861826227, -0.9443003638, -2.748916509, -5.403891962, -4.634928965, -1.812474214, -0.2600811075, -0.003957734042, -2.370497837e-05], {0;0;10}: [-0.0330111803, -0.03466076799, -0.06317762588, 0.1671459042, -0.1659868838, -0.07159004895, -0.1202239447, -0.1423747418, -0.03604701861, 0.0536101473, 0.08963644422, 0.1166382267]))  # disabled
split_3 = SplitList(List=item_21, Index=5)  # -> ListA, ListB; disabled
txt_2 = Text(["Mesh (V:44  F:11)", "", "Heating", "Solar", "Electric Equipment", "Lighting", "People", "Infiltration", "Mechanical Ventilation", "Opaque Conduction", "Window Conduction", "Cooling", "Storage"])  # disabled
item_22 = ListItem(List=split_2, Index=0, Wrap=True)  # -> flatten(Item); disabled
cull_i_3 = CullIndex(List=txt_2, Indices=[0, 1], Wrap=True)  # disabled
c_script_30 = CSharpScript(x=item_22, y=split_3.ListA)  # -> out, A; inputs x: list of String, y: String; disabled
# ---------- c_script_30: C# ----------
    int a =0 ;
    for(int i = 0 ;i < x.Count ;i++)
    {
      if(x[i] == y)
        a = i;
    }
    A = a;
# ---------- end c_script_30 ----------
c_script_31 = CSharpScript(x=item_22, y=split_3.ListB)  # -> out, A; inputs x: list of String, y: String; disabled; same code as c_script_30
number_slider_14 = Slider(5, range=0..10)  # disabled
panel_26 = Panel("""Jan
Feb
Mar
Apr
May
Jun
Jul
Aug
Sep
Oct
Nov
Dec""")  # disabled
panel_27 = Panel("""cooling
heating
lighting
equipment""")  # disabled
panel_28 = Panel("ENERGY LOAD (kWh/m2)  &  LOAD BALANCE (kWh/m2)")  # disabled
split_4 = SplitList(List=cull_i_3, Index=number_slider_14)  # -> ListA, ListB; disabled
panel_29 = Panel("Load Balance (kWh/m2)")  # disabled
panel_30 = Panel("19")  # disabled
colrange = LBColorRange(index=panel_30)  # -> colors; disabled; plug-in component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
lng_5 = ListLength(List=c_script_30.A)  # disabled
lng_6 = ListLength(List=c_script_31.A)  # disabled
split_5 = SplitList(List=colrange, Index=number_slider_14)  # -> ListA, ListB; disabled
series_3 = Series(Start=0, Step=1, Count=lng_5)  # disabled
series_4 = Series(Start=0, Step=1, Count=lng_6)  # disabled

# ----
# Evaluate Total Load
ma_5 = MassAddition(Input=annualloads.total_load)  # -> Result, PartialResults; disabled
panel_31 = Panel(item_20)  # disabled
total_load_intensity_kwh_m2 = Panel(ma_5.Result)  # disabled
panel_32 = Panel("""cooling
heating
lighting
equipment""")  # disabled

# ---- group: RH_OUT:energy_loads_metric
energy_metric = Number(panel_31)  # disabled

# ----
roundd = RoundToDecimalPlace(NumberX=total_load_intensity_kwh_m2, DecimalPlace=1, RoundType=0)  # -> Rounded, Difference; disabled

# ----
# Visualize Monthly Load
monthly_loads = Data(data_4)  # disabled
swatch_8 = ColourSwatch(SwatchColor=RGB(255, 121, 0))  # disabled
swatch_9 = ColourSwatch(SwatchColor=RGB(255, 255, 0))  # disabled
swatch_10 = ColourSwatch(SwatchColor=RGB(4, 25, 145))  # disabled
swatch_11 = ColourSwatch(SwatchColor=RGB(153, 16, 0))  # disabled
panel_33 = Panel("30")  # disabled
panel_34 = Panel("0")  # disabled
panel_35 = Panel("2")  # disabled
legendpar = LBLegendParameters(max=panel_33, colors=[swatch_10, swatch_11, swatch_9, swatch_8], num_decimals=panel_34, text_height=panel_35)  # -> leg_par; disabled; plug-in component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
toggle_5 = BooleanToggle(True)  # disabled
panel_36 = Panel("40,0,0")  # disabled
monthlychart = LBMonthlyChart(data=monthly_loads, base_pt=panel_36, stack=toggle_5, legend_par=legendpar)  # -> report, data_mesh, data_lines, col_lines, legend, borders, labels, y_title, title, vis_set; disabled; plug-in component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

# ----
# Visualize Load Balance
monthly_loads_2 = Data(annualloads.balance)  # disabled
panel_37 = Panel("80")  # disabled
panel_38 = Panel("19")  # disabled
colrange_2 = LBColorRange(index=panel_38)  # -> colors; disabled; plug-in component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
panel_39 = Panel("2")  # disabled
neg_2 = Negative(Value=panel_33)  # disabled
panel_40 = Panel("0")  # disabled
legendpar_2 = LBLegendParameters(min=neg_2, max=panel_33, colors=colrange_2, num_decimals=panel_40, text_height=panel_39)  # -> leg_par; disabled; plug-in component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
toggle_6 = BooleanToggle(True)  # disabled
panel_41 = Panel("40,-90,0")  # disabled
monthlychart_2 = LBMonthlyChart(data=monthly_loads_2, base_pt=panel_41, y_dim=panel_37, stack=toggle_6, legend_par=legendpar_2)  # -> report, data_mesh, data_lines, col_lines, legend, borders, labels, y_title, title, vis_set; disabled; plug-in component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

roundd_2 = RoundToDecimalPlace(NumberX=c_script_29.A, DecimalPlace=1, RoundType=0)  # -> Rounded, Difference; disabled
roundd_3 = RoundToDecimalPlace(NumberX=num_10, DecimalPlace=1, RoundType=0)  # -> Rounded, Difference; disabled
roundd_4 = RoundToDecimalPlace(NumberX=num_9, DecimalPlace=1, RoundType=0)  # -> Rounded, Difference; disabled

c_script_32 = CSharpScript(x=predict_daylight.PredictedSunlightExposure_sensor_array, y=se_threshold)  # -> out, A; inputs x: Double, y: Double; same code as c_script_22
larger_2 = LargerThan(FirstNumber=c_script_32.A, SecondNumber=0)  # -> LargerThan, OrEqualTo
cull_3 = CullPattern(List=c_script_32.A, CullPattern=larger_2.LargerThan)
lng_7 = ListLength(List=cull_3)
lng_8 = ListLength(List=c_script_32.A)
avr = Average(Input=predict_daylight.PredictedUsefulDaylightIlluminanceSupplementary_sensor_array)
avr_2 = Average(Input=predict_daylight.PredictedDaylightAutonomy_sensor_array)
avr_3 = Average(Input=predict_daylight.PredictedUsefulDaylightIlluminanceAcceptable_sensor_array)
division_5 = Division(A=lng_7, B=lng_8)
multiplication_7 = Multiplication(A=avr, B=100)
multiplication_8 = Multiplication(A=avr_2, B=100)
multiplication_9 = Multiplication(A=division_5, B=100)
multiplication_10 = Multiplication(A=avr_3, B=100)
avr_4 = Average(Input=predict_daylight.PredictedMeanIlluminance_sensor_array)
null = NullItem(Item=avr_2)  # -> NullFlags, InvalidFlags, Description
null_2 = NullItem(Item=avr)  # -> NullFlags, InvalidFlags, Description
null_3 = NullItem(Item=division_5)  # -> NullFlags, InvalidFlags, Description
null_4 = NullItem(Item=avr_3)  # -> NullFlags, InvalidFlags, Description
null_5 = NullItem(Item=avr_4)  # -> NullFlags, InvalidFlags, Description

round_2 = Round(Number=multiplication_8)  # -> Nearest, Floor, Ceiling
round_3 = Round(Number=multiplication_9)  # -> Nearest, Floor, Ceiling
round_4 = Round(Number=multiplication_7)  # -> Nearest, Floor, Ceiling
round_5 = Round(Number=multiplication_10)  # -> Nearest, Floor, Ceiling
round_6 = Round(Number=[multiplication_7, avr_4])  # -> Nearest, Floor, Ceiling

filter_6 = StreamFilter(Gate=null_3.NullFlags, Stream0=round_3.Nearest, Stream1="0")
filter_7 = StreamFilter(Gate=null_2.NullFlags, Stream0=round_4.Nearest, Stream1="0")
filter_8 = StreamFilter(Gate=null.NullFlags, Stream0=round_2.Nearest, Stream1="0")
filter_9 = StreamFilter(Gate=null_4.NullFlags, Stream0=round_5.Nearest, Stream1="0")
filter_10 = StreamFilter(Gate=null_5.NullFlags, Stream0=round_6.Nearest, Stream1="0")
merge_18 = Merge(Data1=filter_8, Data2=filter_6, Data3=filter_7, Data4=filter_9, Data5=filter_10)

# ---- group: RH_OUT:DA_all_metrics
da_all_metrics = Number(merge_18)

# ----
item_23 = ListItem(List=da_all_metrics, Index=number_slider_7, Wrap=True)
panel_42 = Panel(item_23)
colibri_out = ColibriOutputs(glare=flatten(item_23))
ca = ColibriAggregator(
    Folder="C:\Users\abuzr\Documents\Projects\Mitacs2023\sensitivity\",
    Inputs=colibri_in.IP,
    Outputs=colibri_out,
    ImageSetting=set_img,
    Write=Toggle(False),
    recordingMode=0)

xdata_2 = LBDeconstructData(data=monthly_loads)  # -> out, header, values; disabled; plug-in component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
c_script_33 = CSharpScript(x=bool_2, y=xdata_2.values)  # -> out, A; inputs y: tree of Double; disabled; same code as c_script_29
flip_3 = FlipMatrix(Data=roundd_2.Rounded)  # -> simplify(Data); disabled
flip_4 = FlipMatrix(Data=roundd_3.Rounded)  # -> simplify(Data); disabled
split_6 = SplitList(List=flip_4, Index=number_slider_14)  # -> ListA, ListB; disabled
flip_5 = FlipMatrix(Data=roundd_4.Rounded)  # disabled
abs = Absolute(Value=split_6.ListB)  # disabled
item_24 = ListItem(List=flip_3, Index=c_script_31.A, Wrap=True)  # disabled
item_25 = ListItem(List=flip_3, Index=c_script_30.A, Wrap=True)  # disabled
lng_9 = ListLength(List=flip_5)  # disabled
num_11 = Number(item_25)  # disabled
series_5 = Series(Start=0, Step=1, Count=lng_9)  # -> simplify(Series); disabled
abs_2 = Absolute(Value=item_24)  # disabled
replace = ReplaceItems(List=split_6.ListA, Item=num_11, Indices=series_3, Wrap=False)  # disabled
replace_2 = ReplaceItems(List=split_6.ListB, Item=abs_2, Indices=series_4, Wrap=False)  # -> simplify(List); disabled
panel_43 = Panel(replace)  # disabled

roundd_5 = RoundToDecimalPlace(NumberX=c_script_33.A, DecimalPlace=1, RoundType=0)  # -> Rounded, Difference; disabled

flip_6 = FlipMatrix(Data=roundd_5.Rounded)  # disabled
replace_3 = ReplaceItems(List=flip_5, Item=flip_6, Indices=series_5, Wrap=False)  # -> simplify(List); disabled

multichart = CreateMultiChart(Data=simplify(abs), Names=split_4.ListB, SubTitle=panel_29, ClusterTitle=panel_26, ChartType=2)  # disabled
multichart_2 = CreateMultiChart(Data=simplify(split_6.ListA), Names=split_4.ListA, SubTitle=panel_29, ClusterTitle=panel_26, ChartType=2)  # disabled
multichart_3 = CreateMultiChart(Data=simplify(flip_5), Names=panel_27, SubTitle=panel_28, ClusterTitle=panel_26, ChartType=2)  # disabled
rh_out_energy_total_loads_metrics_tree = Number(flip_5)
