# Grasshopper definition parametricRoom-V22-ui.gh (Grasshopper 1.0.7)
# plug-ins: Human UI, Pufferfish, Heteroptera, Parakeet, Weaverbird, NGon, PW_AI

# ---- group: UnitConvertor to Meters
c_script = CSharpScript()  # -> out, A
# ---------- c_script: C# ----------
    Rhino.RhinoDoc.ActiveDoc.AdjustModelUnitSystem(UnitSystem.Meters, false);
# ---------- end c_script ----------

# ----
bool = Boolean(Tree({0;0}: [True, True], {0;1}: [True, False], {0;2}: [False, False], {0;3}: [False, True]))
panel = Panel("""Single floor
Ground floor
middle floor
Top floor""")
data = Data(["LargeOffice", "MediumOffice", "SmallOffice", "MidriseApartment", "HighriseApartment", "Retail", "StripMall", "PrimarySchool", "SecondarySchool", "SmallHotel", "LargeHotel", "Hospital", "Outpatient", "Laboratory", "Warehouse", "SuperMarket", "FullServiceRestaurant", "QuickServiceRestaurant", "Courthouse", "LargeDataCenterHighITE", "LargeDataCenterLowITE", "SmallDataCenterHighITE", "SmallDataCenterLowITE"])
pulldown = CreatePulldownMenu(ListItems=data, SelectedIndex=Slider(11, range=0..100), showLabel=True)
panel_2 = Panel("""Left
Right""")
panel_3 = Panel("""True
False""")
pulldown_2 = CreatePulldownMenu(ListItems=panel, SelectedIndex=Slider(0, range=0..4), showLabel=True)
values = ValueListener(Elements=pulldown, SomeProperty=True)  # -> Values, Indices

wall3 = GetInteger(AtLeast=1, AtMost=1, Maximum=2147483647, Minimum=-2147483648, TreeAccess=False)
wall0 = GetInteger(AtLeast=1, AtMost=1, Maximum=2147483647, Minimum=-2147483648, TreeAccess=False)
wall1 = GetInteger(AtLeast=1, AtMost=1, Maximum=2147483647, Minimum=-2147483648, TreeAccess=False)
wall2 = GetInteger(AtLeast=1, AtMost=1, Maximum=2147483647, Minimum=-2147483648, TreeAccess=False)
c_script_2 = CSharpScript(x=wall0)  # -> out, A
# ---------- c_script_2: C# ----------
    if(x == null){
      A = y;}
    else
      A = x;
# ---------- end c_script_2 ----------
c_script_3 = CSharpScript(x=wall3)  # -> out, A; same code as c_script_2
c_script_4 = CSharpScript(x=wall1)  # -> out, A; same code as c_script_2
c_script_5 = CSharpScript(x=wall2)  # -> out, A; same code as c_script_2
int = Integer([c_script_2.A, c_script_4.A, c_script_5.A, c_script_3.A])

data_2 = Data(simplify(Tree({0;0;0;0}: ["2019::LargeOffice::Attic", "2019::LargeOffice::BreakRoom", "2019::LargeOffice::Classroom", "2019::LargeOffice::ClosedOffice", "2019::LargeOffice::Conference", "2019::LargeOffice::Corridor", "2019::LargeOffice::Dining", "2019::LargeOffice::Elec/MechRoom", "2019::LargeOffice::Elevator Lobby", "2019::LargeOffice::Elevator Machine Room", "2019::LargeOffice::Elevator Shaft", "2019::LargeOffice::IT_Room", "2019::LargeOffice::Lobby", "2019::LargeOffice::Main Electrical", "2019::LargeOffice::Main Mechanical", "2019::LargeOffice::OfficeLarge Data Center", "2019::LargeOffice::OfficeLarge Main Data Center", "2019::LargeOffice::OpenOffice", "2019::LargeOffice::PrintRoom", "2019::LargeOffice::Restroom", "2019::LargeOffice::Stair", "2019::LargeOffice::Storage", "2019::LargeOffice::Vending"], {0;0;0;1}: ["2019::MediumOffice::Breakroom", "2019::MediumOffice::Classroom", "2019::MediumOffice::ClosedOffice", "2019::MediumOffice::Conference", "2019::MediumOffice::Corridor", "2019::MediumOffice::Dining", "2019::MediumOffice::Elec/MechRoom", "2019::MediumOffice::Lobby", "2019::MediumOffice::OpenOffice", "2019::MediumOffice::Restroom", "2019::MediumOffice::Stair", "2019::MediumOffice::Storage"], {0;0;0;2}: ["2019::SmallOffice::Breakroom", "2019::SmallOffice::Classroom", "2019::SmallOffice::ClosedOffice", "2019::SmallOffice::Conference", "2019::SmallOffice::Corridor", "2019::SmallOffice::Dining", "2019::SmallOffice::Elec/MechRoom", "2019::SmallOffice::Lobby", "2019::SmallOffice::OpenOffice", "2019::SmallOffice::Restroom", "2019::SmallOffice::Stair", "2019::SmallOffice::Storage"], {0;0;0;3}: ["2019::MidriseApartment::Apartment", "2019::MidriseApartment::Corridor", "2019::MidriseApartment::Office"], {0;0;0;4}: ["2019::HighriseApartment::Apartment", "2019::HighriseApartment::Corridor", "2019::HighriseApartment::Office"], {0;0;0;5}: ["2019::Retail::Back_Space", "2019::Retail::Core_Retail", "2019::Retail::Entry", "2019::Retail::Front_Retail", "2019::Retail::Point_of_Sale", "2019::Retail::Retail"]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)))
context = GetGeometry(AtLeast=1, AtMost=1, DeleteInput=False, Filter=1074004029, TreeAccess=False)
checkbox = CreateCheckbox(Label=panel_2, StartingValue=panel_3)
values_2 = ValueListener(Elements=pulldown_2, SomeProperty=True)  # -> Values, Indices
branch = TreeBranch(Tree=data_2, Path=values.Indices, MaintainPaths=True)
simplegrid = CreateSimpleGrid(UIElements=graft(checkbox), Width=graft(Slider(262, range=0..1000)), RowDefinitions="Auto", ColumnDefinitions="Auto")  # -> flatten(SimpleGrid)
branch_2 = TreeBranch(Tree=simplify(bool), Path=values_2.Indices, MaintainPaths=True)
join = TextJoin(Text=[Slider(0, range=0..100), Slider(0, range=0..100), Slider(10, range=0..100), Slider(0, range=0..100)], Join=",")

ceiling_refl = Slider(0.5, range=0..1)
glazing_trans = Slider(0.3, range=0..1)
floor_refl = Slider(0.2, range=0..1)
wall_refl = Slider(0.5, range=0..1)

length = Slider(1, range=0.5..4)
height = Slider(2, range=0..4)
h_movement = Slider(0, range=-2..2)
v_movement = Slider(0, range=-2..2)
add_remove_fins = BooleanToggle(False)
count = Slider(2, range=2..5)
depth = Slider(0.7, range=0..1)
add_remove_fins_2 = BooleanToggle(False)
count_2 = Slider(1, range=1..5)
depth_2 = Slider(0.7, range=0..1)
wall_r_val = Slider(20, range=10..30)
roof_r_val = Slider(30, range=20..40)
ground_r_val = Slider(10, range=5..30)
win_u_val = Slider(0.3, range=0.2..0.4)
win_shgc = Slider(0.3, range=0.2..0.4)
data_3 = Data(["2019::Hospital::Basement", "2019::Hospital::Corridor", "2019::Hospital::Dining", "2019::Hospital::ER_Exam", "2019::Hospital::ER_NurseStn", "2019::Hospital::ER_Trauma", "2019::Hospital::ER_Triage", "2019::Hospital::HospitalOffice", "2019::Hospital::ICU_NurseStn", "2019::Hospital::ICU_Open", "2019::Hospital::ICU_PatRm", "2019::Hospital::Kitchen", "2019::Hospital::Lab", "2019::Hospital::Lobby", "2019::Hospital::NurseStn", "2019::Hospital::OR", "2019::Hospital::Office", "2019::Hospital::PatCorridor", "2019::Hospital::PatRoom", "2019::Hospital::PhysTherapy", "2019::Hospital::Radiology"])
panel_4 = Panel("Program")
adjustpos = AdjustElementPositioning(ElementsToAdjust=pulldown_2, Margin=join, AbsolutePositioning=True, Width=Slider(189, range=0..300))
height_2 = Slider(4, range=1..6)
pulldown_3 = CreatePulldownMenu(ListItems=branch, SelectedIndex=Slider(0, range=0..100), showLabel=True)
section_h = Slider(3, range=0..10)
pickbtn = CreateRhinoPickButton(ButtonName="Walls", Prompt="Set interior walls", AllowMultiple=True, AllowNone=True, Type=2, ButtonStyle=0)
pickbtn_2 = CreateRhinoPickButton(ButtonName="Zone", Prompt="Set Outline", AllowMultiple=False, AllowNone=True, Type=2, ButtonStyle=0)
pickbtn_3 = CreateRhinoPickButton(ButtonName="Context", Prompt="Set Context", AllowMultiple=True, AllowNone=True, Type=1, ButtonStyle=0)
values_3 = ValueListener(Elements=pulldown_3, SomeProperty=True)  # -> Values, Indices
relay = Relay([pulldown, pulldown_3])
number_slider = Slider(0.1, range=0..0.1)
number_slider_2 = Slider(0.1, range=0..0.1)
tooltip = AttachTooltipToElement(ElementsToAttachTo=pickbtn_3, TooltipContent="Set Context", ShowDelay=500, Duration=2000)
tooltip_2 = AttachTooltipToElement(ElementsToAttachTo=pickbtn, TooltipContent="Set interior walls", ShowDelay=500, Duration=2000)
tooltip_3 = AttachTooltipToElement(ElementsToAttachTo=pickbtn_2, TooltipContent="Set Outline", ShowDelay=500, Duration=2000)
number_slider_3 = Slider(0.01, range=0..0.01)
number_slider_4 = Slider(1, range=0..1)
number_slider_5 = Slider(0.7, range=0..1)
number_slider_6 = Slider(0.1, range=0..0.1)
swatch = ColourSwatch(SwatchColor=RGB(5, 5, 5))
number_slider_7 = Slider(1, range=0..1)
number_slider_8 = Slider(0.1, range=0..0.1)
relay_2 = Relay([pickbtn_2, pickbtn, pickbtn_3])
slider = CreateSlider(
    Slider=section_h,
    SnapValue=number_slider,
    ShowBounds=False,
    ShowTicks=False,
    ShowTooltip=False,
    ShowValLabel=True,
    showLabel=True)
slider_2 = CreateSlider(
    Slider=height_2,
    SnapValue=number_slider,
    ShowBounds=False,
    ShowTicks=False,
    ShowTooltip=False,
    ShowValLabel=True,
    showLabel=True)
join_2 = TextJoin(Text=[Slider(0, range=0..100), Slider(4, range=0..100), Slider(0, range=0..100), Slider(0, range=0..100)], Join=",")
number_slider_9 = Slider(188, range=0..1000)
separator = CreateSeparator(Thickness=number_slider_5, Horizontal=True, Color=swatch)
slider_3 = CreateSlider(
    Slider=wall_r_val,
    SnapValue=number_slider_4,
    ShowBounds=False,
    ShowTicks=False,
    ShowTooltip=False,
    ShowValLabel=True,
    showLabel=True)
slider_4 = CreateSlider(
    Slider=roof_r_val,
    SnapValue=number_slider_4,
    ShowBounds=False,
    ShowTicks=False,
    ShowTooltip=False,
    ShowValLabel=True,
    showLabel=True)
slider_5 = CreateSlider(
    Slider=ground_r_val,
    SnapValue=number_slider_4,
    ShowBounds=False,
    ShowTicks=False,
    ShowTooltip=False,
    ShowValLabel=True,
    showLabel=True)
slider_6 = CreateSlider(
    Slider=win_u_val,
    SnapValue=number_slider_3,
    ShowBounds=False,
    ShowTicks=False,
    ShowTooltip=False,
    ShowValLabel=True,
    showLabel=True)
slider_7 = CreateSlider(
    Slider=win_shgc,
    SnapValue=number_slider_3,
    ShowBounds=False,
    ShowTicks=False,
    ShowTooltip=False,
    ShowValLabel=True,
    showLabel=True)
slider_8 = CreateSlider(
    Slider=wall_refl,
    SnapValue=number_slider_2,
    ShowBounds=False,
    ShowTicks=False,
    ShowTooltip=False,
    ShowValLabel=True,
    showLabel=True)
slider_9 = CreateSlider(
    Slider=glazing_trans,
    SnapValue=number_slider_2,
    ShowBounds=False,
    ShowTicks=False,
    ShowTooltip=False,
    ShowValLabel=True,
    showLabel=True)
slider_10 = CreateSlider(
    Slider=ceiling_refl,
    SnapValue=number_slider_2,
    ShowBounds=False,
    ShowTicks=False,
    ShowTooltip=False,
    ShowValLabel=True,
    showLabel=True)
slider_11 = CreateSlider(
    Slider=floor_refl,
    SnapValue=number_slider_2,
    ShowBounds=False,
    ShowTicks=False,
    ShowTooltip=False,
    ShowValLabel=True,
    showLabel=True)
separator_2 = CreateSeparator(Thickness=number_slider_5, Horizontal=True, Color=swatch)
simplegrid_2 = CreateSimpleGrid(UIElements=graft(relay), Width=number_slider_9, RowDefinitions="1*", ColumnDefinitions="1*")  # -> flatten(SimpleGrid)
adjustelem = AdjustElementAppearance(ElementsToAdjust=relay, FontSize=Slider(0, range=0..100))
separator_3 = CreateSeparator(Thickness=number_slider_5, Horizontal=True, Color=swatch)
slider_12 = CreateSlider(
    Slider=length,
    SnapValue=number_slider_6,
    ShowBounds=False,
    ShowTicks=False,
    ShowTooltip=False,
    ShowValLabel=True,
    showLabel=True)
slider_13 = CreateSlider(
    Slider=height,
    SnapValue=number_slider_6,
    ShowBounds=False,
    ShowTicks=False,
    ShowTooltip=False,
    ShowValLabel=True,
    showLabel=True)
slider_14 = CreateSlider(
    Slider=h_movement,
    SnapValue=number_slider_6,
    ShowBounds=False,
    ShowTicks=False,
    ShowTooltip=False,
    ShowValLabel=True,
    showLabel=True)
adjustpos_2 = AdjustElementPositioning(ElementsToAdjust=relay, Margin=join_2, AbsolutePositioning=True, Width=Slider(96, range=0..300))
slider_15 = CreateSlider(
    Slider=v_movement,
    SnapValue=number_slider_6,
    ShowBounds=False,
    ShowTicks=False,
    ShowTooltip=False,
    ShowValLabel=True,
    showLabel=True)
toggle = CreateToggle(Default=add_remove_fins, OnLabel=" Add Fins", OffLabel=" Add Fins")
slider_16 = CreateSlider(
    Slider=depth,
    SnapValue=number_slider_8,
    ShowBounds=False,
    ShowTicks=False,
    ShowTooltip=False,
    ShowValLabel=True,
    showLabel=True)
toggle_2 = CreateToggle(Default=add_remove_fins_2, OnLabel=" Add Overhangs", OffLabel=" Add Overhangs")
slider_17 = CreateSlider(
    Slider=count_2,
    SnapValue=number_slider_7,
    ShowBounds=False,
    ShowTicks=False,
    ShowTooltip=False,
    ShowValLabel=True,
    showLabel=True)
slider_18 = CreateSlider(
    Slider=depth_2,
    SnapValue=number_slider_8,
    ShowBounds=False,
    ShowTicks=False,
    ShowTooltip=False,
    ShowValLabel=True,
    showLabel=True)
slider_19 = CreateSlider(
    Slider=count,
    SnapValue=number_slider_7,
    ShowBounds=False,
    ShowTicks=False,
    ShowTooltip=False,
    ShowValLabel=True,
    showLabel=True)
simplegrid_3 = CreateSimpleGrid(UIElements=graft(relay_2), Width=number_slider_9, RowDefinitions="1*", ColumnDefinitions="1*")  # -> flatten(SimpleGrid)
adjustelem_2 = AdjustElementAppearance(
    ElementsToAdjust=relay_2,
    Foreground=ColourSwatch(SwatchColor=RGB(0, 0, 0)),
    Background=ColourSwatch(SwatchColor=RGB(255, 255, 255)),
    FontSize=Slider(11, range=0..100))
adjustpos_3 = AdjustElementPositioning(ElementsToAdjust=relay_2, Margin=Slider(0, range=0..100), AbsolutePositioning=True, Width=Slider(57, range=0..300))
relay_3 = Relay([slider_2, slider])
merge = Merge(
    Data1=flatten(slider_12),
    Data2=flatten(slider_13),
    Data3=flatten(slider_14),
    Data4=flatten(slider_15),
    Data5=flatten(separator_3),
    Data6=flatten(toggle),
    Data7=flatten(slider_19),
    Data8=flatten(slider_16),
    Data9=flatten(separator),
    Data10=flatten(toggle_2),
    Data11=flatten(slider_17),
    Data12=flatten(slider_18))
merge_2 = Merge(
    Data1=slider_10,
    Data2=slider_11,
    Data3=slider_8,
    Data4=slider_9,
    Data5=separator_2,
    Data6=slider_3,
    Data7=slider_4,
    Data8=slider_5,
    Data9=slider_6,
    Data10=slider_7)
join_3 = TextJoin(Text=[Slider(0, range=0..100), Slider(0, range=0..100), Slider(0, range=0..100), Slider(10, range=0..100)], Join=",")
relay_4 = Relay([slider_10, slider_11, slider_8, slider_9, slider_3, slider_4, slider_5, slider_6, slider_7])
relay_5 = Relay([slider_12, slider_13, slider_14, slider_15, slider_19, slider_16, slider_17, slider_18])
number_slider_10 = Slider(1, range=0..1)
adjustpos_4 = AdjustElementPositioning(ElementsToAdjust=flatten(separator_2), Margin=join_3, AbsolutePositioning=True, Width=Slider(238, range=0..300))
values_4 = ValueListener(Elements=pickbtn_3, SomeProperty=True)  # -> flatten(Values), Indices
values_5 = ValueListener(Elements=pickbtn_2, SomeProperty=True)  # -> flatten(Values), Indices
adjustpos_5 = AdjustElementPositioning(
    ElementsToAdjust=flatten([relay_5, relay_4]),
    Margin=Slider(0, range=0..100),
    AbsolutePositioning=True,
    Width=Slider(238, range=0..300))
values_6 = ValueListener(Elements=pickbtn, SomeProperty=True)  # -> flatten(Values), Indices
join_4 = TextJoin(Text=[Slider(0, range=0..100), Slider(6, range=0..100), Slider(0, range=0..100), Slider(0, range=0..100)], Join=",")
join_5 = TextJoin(Text=[Slider(0, range=0..100), Slider(0, range=0..100), Slider(0, range=0..100), Slider(0, range=0..100)], Join=",")
adjustpos_6 = AdjustElementPositioning(ElementsToAdjust=slider_2, Margin=join_4, AbsolutePositioning=True, Width=Slider(200, range=0..300))
swatch_2 = ColourSwatch(SwatchColor=RGB(181, 54, 54))
adjustpos_7 = AdjustElementPositioning(ElementsToAdjust=slider, Margin=join_5, AbsolutePositioning=True, Width=Slider(200, range=0..300))
geo = Geometry(<curve referenced from the Rhino model>)
item = ListItem(List=merge, Index=0, Wrap=False)  # -> Item, Item1, Item2, Item3, Item4, Item5, Item6, Item7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
adjustpos_8 = AdjustElementPositioning(
    ElementsToAdjust=[toggle, toggle_2],
    Margin=Slider(5, range=0..100),
    AbsolutePositioning=False,
    Width=Slider(218, range=0..400),
    Height=Slider(39, range=0..100),
    HorizontalAlignment=number_slider_10,
    VerticalAlignment=number_slider_10)
expander = CreateExpander(UIElements=merge_2, Header="Room Material | SI", Open=Toggle(True))
values_7 = ValueListener(Elements=relay_3, SomeProperty=True)  # -> flatten(Values), Indices
id = Guid(values_5.Values)
zone = GetGeometry(geo, AtLeast=1, AtMost=1, DeleteInput=False, Filter=1074004029, TreeAccess=False)
expander_2 = CreateExpander(UIElements=merge, Header="Room Propertices | SI", Open=True)
adjustelem_3 = AdjustElementAppearance(ElementsToAdjust=toggle, Foreground=swatch_2, Background=swatch_2, FontSize=Slider(53, range=0..100))
merge_3 = Merge(Data1=flatten(simplegrid_3), Data2=flatten(simplegrid_2), Data3=flatten(pulldown_2), Data4=flatten(relay_3))
item_2 = ListItem(List=reverse(values_7.Values), Index=0, Wrap=True)  # -> Item, Item1
rectangle = Rectangle(Plane=PlaneXY(0, 0, 0), XSize=Slider(4, range=0..10), YSize=Slider(6, range=0..10), Radius=0)  # -> Rectangle, Length
r_height = GetNumber(item_2.Item1, AtLeast=1, AtMost=1, Maximum=1.797693135e+308, Minimum=-1.797693135e+308, TreeAccess=False)
c_script_6 = CSharpScript(x=zone, y=rectangle.Rectangle)  # -> out, A; inputs x: GeometryBase, y: Curve; same code as c_script_2
merge_4 = Merge(
    Data1=item.Item,
    Data2=item.Item1,
    Data3=item.Item2,
    Data4=item.Item3,
    Data5=item.Item5,
    Data6=item.Item6,
    Data7=item.Item7,
    Data9=item.Item9,
    Data10=item.Item10,
    Data11=item.Item11)
c_script_7 = CSharpScript(x=id, y=c_script_6.A)  # -> out, A; inputs x: Guid, y: Curve
# ---------- c_script_7: C# ----------
    var obj = doc.Objects.Find(x);
    //B = obj;

    if(obj == null){
      A = y;}
    else
      A = x;
# ---------- end c_script_7 ----------
box = CenterBox(Base=PlaneXY(0, 0, 0), X=1, Y=1, Z=1)
id_2 = Guid(values_4.Values)
values_8 = ValueListener(Elements=merge_4, SomeProperty=True)  # -> flatten(Values), Indices
simplify = SimplifyCurve(Curve=c_script_7.A, Tolerance=1)  # -> Curve, Simplified
c_script_8 = CSharpScript(x=id_2, y=box)  # -> out, A, B; inputs x: list of Guid, y: Brep
# ---------- c_script_8: C# ----------
    if(x.Count>0)
      A = x;
    else 
      A = y;
# ---------- end c_script_8 ----------
item_3 = ListItem(List=values_8.Values, Index=0, Wrap=False)  # -> Item, Item1, Item2, Item3, Item4, Item5, Item6, Item7, Item8, Item9
explode = Explode(Curve=simplify.Curve, Recursive=True)  # -> Segments, Vertices
lng = ListLength(List=explode.Segments)
item_4 = ListItem(List=merge_2, Index=0, Wrap=True)  # -> Item, Item1, Item2, Item3, Item4, Item5, Item6, Item7, Item8, Item9
add_remove_fins_3 = GetBoolean(item_3.Item4, AtLeast=1, AtMost=1, FalseValue="False", TreeAccess=False, TrueValue="True")
f_multiplier = GetNumber(item_3.Item5, AtLeast=1, AtMost=1, Maximum=1.797693135e+308, Minimum=-1.797693135e+308, TreeAccess=False)
f_depth = GetNumber(item_3.Item6, AtLeast=1, AtMost=1, Maximum=1.797693135e+308, Minimum=-1.797693135e+308, TreeAccess=False)
v_movement_2 = GetNumber(item_3.Item3, AtLeast=1, AtMost=1, Maximum=1.797693135e+308, Minimum=-1.797693135e+308, TreeAccess=False)
l_movement = GetNumber(item_3.Item2, AtLeast=1, AtMost=1, Maximum=1.797693135e+308, Minimum=-1.797693135e+308, TreeAccess=False)
w_length = GetNumber(item_3.Item, AtLeast=1, AtMost=1, Maximum=1.797693135e+308, Minimum=-1.797693135e+308, TreeAccess=False)
w_height = GetNumber(item_3.Item1, AtLeast=1, AtMost=1, Maximum=1.797693135e+308, Minimum=-1.797693135e+308, TreeAccess=False)
add_overhangs = Boolean(item_3.Item7)
o_multiplier = Number(item_3.Item8)

# ---- group: Clipping Plane
center = Center(Geometric=simplify.Curve)  # -> Center, Dimension
O = Origin(center.Center)
Z = UnitZ(Factor=item_2.Item)
move = Move(Geometry=O, Motion=Z)  # -> Geometry, Transform
xy = XYPlane(Origin=move.Geometry)
c_script_9 = CSharpScript(ClippingPlane=xy, flip=Toggle(True))  # -> out, A; inputs ClippingPlane: Plane, flip: Boolean
# ---------- c_script_9: C# ----------
    foreach(var obj in RhinoDocument.Objects){
      if(obj is Rhino.DocObjects.ClippingPlaneObject){
        doc.Objects.Delete(obj.Id, true);
      }
    }
    if(flip)
      ClippingPlane.Flip();
    id = RhinoDocument.Objects.AddClippingPlane(ClippingPlane, 0.5, 0.5, RhinoDocument.Views.ActiveView.ActiveViewportID);
    A = id;
# ---------- c_script_9: C# additional code ----------
  Guid id;
# ---------- end c_script_9 ----------

# ----
o_depth = Number(item_3.Item9)

tooltip_4 = AttachTooltipToElement(ElementsToAttachTo=slider_3, TooltipContent="the R-Value of the exterior walls", ShowDelay=500, Duration=2000)
tooltip_5 = AttachTooltipToElement(ElementsToAttachTo=slider_4, TooltipContent="the R-Value of the Roof", ShowDelay=500, Duration=2000)
tooltip_6 = AttachTooltipToElement(ElementsToAttachTo=slider_5, TooltipContent="the R-Value of the Ground", ShowDelay=500, Duration=2000)
tooltip_7 = AttachTooltipToElement(ElementsToAttachTo=slider_6, TooltipContent="the U-Value of the glazing system", ShowDelay=500, Duration=2000)
tooltip_8 = AttachTooltipToElement(
    ElementsToAttachTo=slider_7,
    TooltipContent="the Solar Heat Gain Coefficient of the glazing system",
    ShowDelay=500,
    Duration=2000)

c_script_10 = CSharpScript(x=lng)  # -> out, A; inputs x: Int32
# ---------- c_script_10: C# ----------
    if(L != x)
    {
      L = x;
    }
    A = L;
# ---------- c_script_10: C# additional code ----------
  int L = 4;
# ---------- end c_script_10 ----------
values_9 = ValueListener(Elements=item_4.Item5, SomeProperty=True)  # -> flatten(Values), Indices
values_10 = ValueListener(Elements=item_4.Item6, SomeProperty=True)  # -> flatten(Values), Indices
values_11 = ValueListener(Elements=item_4.Item7, SomeProperty=True)  # -> flatten(Values), Indices
values_12 = ValueListener(Elements=item_4.Item8, SomeProperty=True)  # -> flatten(Values), Indices
values_13 = ValueListener(Elements=item_4.Item9, SomeProperty=True)  # -> flatten(Values), Indices
values_14 = ValueListener(Elements=item_4.Item, SomeProperty=True)  # -> flatten(Values), Indices
values_15 = ValueListener(Elements=item_4.Item1, SomeProperty=True)  # -> flatten(Values), Indices
values_16 = ValueListener(Elements=item_4.Item2, SomeProperty=True)  # -> flatten(Values), Indices
values_17 = ValueListener(Elements=item_4.Item3, SomeProperty=True)  # -> flatten(Values), Indices

tooltip_9 = AttachTooltipToElement(ElementsToAttachTo=slider_12, TooltipContent="Window Length", ShowDelay=500, Duration=2000)
tooltip_10 = AttachTooltipToElement(ElementsToAttachTo=slider_13, TooltipContent="Window Height", ShowDelay=500, Duration=2000)
tooltip_11 = AttachTooltipToElement(ElementsToAttachTo=slider_14, TooltipContent="Horizontal Movement", ShowDelay=500, Duration=2000)
tooltip_12 = AttachTooltipToElement(ElementsToAttachTo=slider_15, TooltipContent="Vertical Movement", ShowDelay=500, Duration=2000)

tooltip_13 = AttachTooltipToElement(ElementsToAttachTo=slider_10, TooltipContent="Ceiling Reflectance", ShowDelay=500, Duration=2000)
tooltip_14 = AttachTooltipToElement(ElementsToAttachTo=slider_11, TooltipContent="Floor Reflectance", ShowDelay=500, Duration=2000)
tooltip_15 = AttachTooltipToElement(ElementsToAttachTo=slider_8, TooltipContent="Wall Reflectance", ShowDelay=500, Duration=2000)
tooltip_16 = AttachTooltipToElement(ElementsToAttachTo=slider_9, TooltipContent="Glazing transparency", ShowDelay=500, Duration=2000)

merge_5 = Merge(
    Data1=w_length,
    Data2=w_height,
    Data3=l_movement,
    Data4=v_movement_2,
    Data5=add_remove_fins_3,
    Data6=f_multiplier,
    Data7=f_depth,
    Data8=add_overhangs,
    Data9=o_multiplier,
    Data10=o_depth)
panel_5 = Panel("""W Length
W Height
H Movement
V Movement
Add/Remove Fins
F Multiplier
F Depth
 Add Overhangs
O Multiplier
O Depth""")
series = Series(Start=0, Step=1, Count=c_script_10.A)
checklist = CreateChecklist(ChecklistItems=series, Selected=Toggle(False), Height=Slider(728, range=0..1000))
dup = DuplicateData(Data="0", Number=c_script_10.A, Order=True)
format = Format(Format="Wall {0}", Culture=127, Data0=series)
floor_r = GetNumber(AtLeast=1, AtMost=1, Maximum=1.797693135e+308, Minimum=-1.797693135e+308, TreeAccess=False)
ceiling_r = GetNumber(AtLeast=1, AtMost=1, Maximum=1.797693135e+308, Minimum=-1.797693135e+308, TreeAccess=False)
glazing_t = GetNumber(AtLeast=1, AtMost=1, Maximum=1.797693135e+308, Minimum=-1.797693135e+308, TreeAccess=False)
wall_r = GetNumber(AtLeast=1, AtMost=1, Maximum=1.797693135e+308, Minimum=-1.797693135e+308, TreeAccess=False)
textbox = CreateTextBox(Label=format, DefaultText=dup, UpdateButton=False, showLabel=True)
button = Button()
values_18 = ValueListener(Elements=textbox, SomeProperty=True)  # -> flatten(Values), Indices
lng_2 = ListLength(List=textbox)
c_script_11 = CSharpScript(Reset=button, SelectedSubWinWalls=values_18.Values, wallCount=lng_2)  # -> out, A; inputs Reset: Boolean, SelectedSubWinWalls: list of Int32, wallCount: Int32
# ---------- c_script_11: C# ----------
    if(Reset ){
      wallSubWinsList.Clear();
      for(int i = 0;i < wallCount ;i++)
        wallSubWinsList.Add(1);
    }


    wallSubWinsList = SelectedSubWinWalls;

    List<string> opts1 = new List<string> ();
    for(int i = 0 ;i < wallCount ;i++){
      if(wallSubWinsList.Count == wallCount){
        for(int j = 0 ;j < wallSubWinsList[i] ;j++){
          opts1.Add(i.ToString() + "-" + j.ToString());
        }
      }
    }

    A = opts1;
# ---------- c_script_11: C# additional code ----------
  int WallCount = 4;
  int WindowCount ;
  List<int> wallSubWinsList = new List<int> ();
# ---------- end c_script_11 ----------
split = TextSplit(Text=c_script_11.A, Separators="-")  # -> simplify(Result)
item_5 = ListItem(List=split, Index=0, Wrap=True)  # -> flatten(Item), flatten(Item1)
format_2 = Format(Format="Wall {0} __ Win {1}", Culture=127, Data0=item_5.Item, Data1=item_5.Item1)
checklist_2 = CreateChecklist(ChecklistItems=format_2, Selected=Toggle(True))
values_19 = ValueListener(Elements=checklist_2, SomeProperty=True)  # -> Values, Indices
explode_2 = Explode(Curve=simplify.Curve, Recursive=True)  # -> Segments, Vertices
c_script_12 = CSharpScript(Reset=button, opts1=c_script_11.A, branches=values_19.Indices, newNumbers=merge_5)  # -> out, A; inputs Reset: Boolean, opts1: list of String, branches: list of Int32, newNumbers: list of Double
# ---------- c_script_12: C# ----------
    if(opts1.Count == 0) return;
    ///*
    bool Check = false;/////////////////////////
    if (opts1.Count != opts2.Count )
    {
      Check = true;////////////////////////////
      opts2.Clear();
      opts2.AddRange(opts1);
    }
    else{
      for(int i = 0; i < opts1.Count;i++){ //////////
        if( opts1[i] != opts2[i]){////////
          Check = true;////////////////////////////
          opts2.Clear();
          opts2.AddRange(opts1);
        }
      }
    }


    if(Reset || Check){
      AllInitialNumbers.ClearData();
      for(int i = 0 ;i < opts1.Count;i++){
        var brancheNames = opts1[i].Split('-');
        AllInitialNumbers.AddRange(Numbers, new GH_Path(new int[2]{Int32.Parse(brancheNames[0]),Int32.Parse(brancheNames[1])}));
      }
    }

    ///Regenerating input Values based on new numbers
    for(int j = 0 ;j < branches.Count;j++){
      var brancheNames = opts1[branches[j]].Split('-');
      var path = new GH_Path(new int[2]{Int32.Parse(brancheNames[0]),Int32.Parse(brancheNames[1])});
      if(AllInitialNumbers.PathExists(path)){
        AllInitialNumbers.Branch(path).Clear();
        AllInitialNumbers.AddRange(newNumbers, new GH_Path(path));
      }
    }

    ///Removing empty branches
    List<GH_Path> allBranchePathes = new List<GH_Path>();
    for(int i = 0 ;i < AllInitialNumbers.BranchCount ;i++){
      allBranchePathes.Add(AllInitialNumbers.Path(i));
    }
    for(int i = 0 ;i < allBranchePathes.Count ;i++){
      if(AllInitialNumbers.Branch(allBranchePathes[i]) != null){
        bool flag = AllInitialNumbers.Branch(allBranchePathes[i]).Count == 0;
        if(flag)
          AllInitialNumbers.RemovePath(allBranchePathes[i]);
      }
    }

    A = AllInitialNumbers;

    //*/
# ---------- c_script_12: C# additional code ----------
  double[] Numbers = new double[10]{1.5,1.5,0,0,0,1,0.4,0,1,0.4};

  List<string> opts2 = new List<string>(){"0-0","1-0","2-0","3-0"};
  DataTree<double> AllInitialNumbers = new DataTree<double>();
# ---------- end c_script_12 ----------
ceiling_thickness = Panel("0.1")
wall_thickness = Panel("0.1")
min_fin_spacing = Slider(0.1, range=0..1)

# ---- group: Wall construction making / where you can adjust insulation value
number_slider_11 = Slider(1, range=1..100)

# ----
c_script_13 = CSharpScript(x=values_18.Values)  # -> out, A; inputs x: Int32
# ---------- c_script_13: C# ----------
    if(x ==0)
      x = 1;
    
    A = x;
# ---------- end c_script_13 ----------
crv = Curve(simplify(graft(explode_2.Segments)))
div = DivideDomain(Domain=Domain(0, 1), Count=values_18.Values)
div_2 = DivideDomain(Domain=Domain(0, 1), Count=c_script_13.A)
subcrv = SubCurve(BaseCurve=reparameterize(simplify(crv)), Domain=simplify(div_2))  # -> simplify(graft(Curve))
subcrv_2 = SubCurve(BaseCurve=reparameterize(simplify(crv)), Domain=simplify(div))  # -> graft(Curve)

# ---- group: Window construction making / Where you can adjust U & SHGC
number_slider_12 = Slider(0.05, range=0.05..0.95)
number_slider_13 = Slider(0.95, range=0.05..0.95)

# ---- group: Roof construction making / where you can adjust insulation value
number_slider_14 = Slider(1, range=1..100)

# ----
clean = CleanTree(RemoveNulls=True, RemoveInvalid=True, RemoveEmpty=True, Tree=subcrv_2)
lng_3 = ListLength(List=subcrv_2)

# ---- group: Slab construction making / where you can adjust insulation value
number_slider_15 = Slider(1, range=1..100)

# ----
equals = Equality(FirstNumber=lng_3, SecondNumber=0)  # -> Equality, Inequality
cull = CullPattern(List=subcrv, CullPattern=equals.Equality)
expression = Expression(x=values_10.Values, Expression="max(x - 0.337473, 1)")
expression_2 = Expression(x=values_11.Values, Expression="max(x-0.604099-1, 1)")
expression_3 = Expression(x=expression_2, Expression="Format(\"insulation-R{0}\", x)")
expression_4 = Expression(x=expression, Expression="Format(\"insulation-R{0}\", x)")

# ---- group: Window construction making / You might give a new name
give_a_name_to_the_window = Panel("NewWindow")

# ---- group: Window construction making
uip2usi = Ladybug_uIP2uSI(U_IP=values_12.Values)  # -> U_SI; plug-in component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
windowmat = HBWindowMaterial(name=give_a_name_to_the_window, u_factor=uip2usi, shgc=values_13.Values)  # -> mat; plug-in component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
windowconstr = HBWindowConstruction(name=give_a_name_to_the_window, materials=windowmat)  # -> constr; plug-in component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
decnstrconstr = HBDeconstructConstruction(constr=windowconstr)  # -> materials, layers, r_val_si, r_val_ip, u_fac_si, u_fac_ip, shgc, t_sol, t_vis; plug-in component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

# ---- group: Window construction making / Where you can adjust U & SHGC
number_slider_16 = Slider(0.05, range=0.05..0.95)  # disabled
number_slider_17 = Slider(0.05, range=0.05..0.95)  # disabled

# ----
item_6 = ListItem(List=c_script_12.A, Index=0, Wrap=True)  # -> Item, Item1, Item2, Item3, Item4, Item5, Item6, Item7, Item8, Item9
boundary = BoundarySurfaces(Edges=simplify.Curve)
Z_2 = UnitZ(Factor=r_height)
move_2 = Move(Geometry=boundary, Motion=Z_2)  # -> Geometry, Transform
crv_2 = Curve(clean)
multiplication = Multiplication(A=wall_thickness, B=2)

# ---- group: where you can adjust insulation value
number_slider_18 = Slider(1, range=1..100)  # disabled

# ---- group: Window construction making / You might give a new name
give_a_name_to_the_window_2 = Panel("New window")  # disabled

# ---- group: Window construction making
uip2usi_2 = Ladybug_uIP2uSI(U_IP=number_slider_16)  # -> U_SI; disabled; plug-in component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
windowmat_2 = HBWindowMaterial(name=give_a_name_to_the_window_2, u_factor=uip2usi_2, shgc=number_slider_17)  # -> mat; disabled; plug-in component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
windowconstr_2 = HBWindowConstruction(name=give_a_name_to_the_window_2, materials=windowmat_2)  # -> constr; disabled; plug-in component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
decnstrconstr_2 = HBDeconstructConstruction(constr=windowconstr_2)  # -> materials, layers, r_val_si, r_val_ip, u_fac_si, u_fac_ip, shgc, t_sol, t_vis; disabled; plug-in component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

# ----
len = Length(Curve=crv_2)

# ---- group: where you can adjust insulation value
number_slider_19 = Slider(1, range=1..100)  # disabled

number_slider_20 = Slider(1, range=1..100)  # disabled

# ----
num = Number(item_6.Item)
subtraction = Subtraction(A=len, B=multiplication)
offset_l = OffsetCurveLoose(Curve=simplify.Curve, Distance=[1, -1])
multiplication_2 = Multiplication(A=ceiling_thickness, B=2)

# ---- group: Wall construction making / You might give a new name
give_a_name_to_the_new_wall = Panel("NewConstruction")

# ---- group: Slab construction making / You might give a new name
give_a_name_to_the_new_slab = Panel("NewSlab")

# ---- group: Slab construction making
searchconstrs = HBSearchConstructions(keywords="typical insulated 6in R5")  # -> opaque_constrs, window_constrs, shade_constrs; plug-in component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
i_am_using_this_typical_assembly_as_the = Panel(searchconstrs.opaque_constrs)  # "I am using this typical assembly as the starting point"
decnstrconstr_3 = HBDeconstructConstruction(constr=searchconstrs.opaque_constrs)  # -> materials, layers, r_val_si, r_val_ip, u_fac_si, u_fac_ip, shgc, t_sol, t_vis; plug-in component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
example_slab_r_value = Panel(decnstrconstr_3.r_val_ip)
panel_6 = Panel(decnstrconstr_3.layers)
bang = ExplodeTree(Data=graft(decnstrconstr_3.layers))  # -> _0000, _0001, _0002
decnstrmat = HBDeconstructMaterial(mat=bang._0000)  # -> values, attr_names, r_val_si, r_val_ip; plug-in component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
panel_7 = Panel(decnstrmat.attr_names)
bang_2 = ExplodeTree(Data=graft(decnstrmat.values))  # -> _000000, _000001, _000002, _000003, _000004, _000005
rip2rsi = Ladybug_rIP2rSI(R_IP=expression_2)  # -> R_SI; plug-in component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
opaquematnomass = HBOpaqueMaterialNoMass(
    name=expression_3,
    r_value=rip2rsi,
    roughness=bang_2._000001,
    therm_absp=bang_2._000003,
    sol_absp=bang_2._000004,
    vis_absp=bang_2._000005)  # -> mat; plug-in component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
merge_6 = Merge(Data1=opaquematnomass, Data2=bang._0001, Data3=bang._0002)  # -> flatten(Result)
opaqueconstr = HBOpaqueConstruction(name=give_a_name_to_the_new_slab, materials=merge_6)  # -> constr; plug-in component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
decnstrconstr_4 = HBDeconstructConstruction(constr=opaqueconstr)  # -> materials, layers, r_val_si, r_val_ip, u_fac_si, u_fac_ip, shgc, t_sol, t_vis; plug-in component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

# ---- group: Roof construction making / You might give a new name
give_a_name_to_the_new_roof = Panel("NewRoof")

# ---- group: Roof construction making
searchconstrs_2 = HBSearchConstructions(keywords="typical IEAD roof R10")  # -> opaque_constrs, window_constrs, shade_constrs; plug-in component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
i_am_using_this_typical_assembly_as_the_2 = Panel(searchconstrs_2.opaque_constrs)  # "I am using this typical assembly as the starting point"
decnstrconstr_5 = HBDeconstructConstruction(constr=searchconstrs_2.opaque_constrs)  # -> materials, layers, r_val_si, r_val_ip, u_fac_si, u_fac_ip, shgc, t_sol, t_vis; plug-in component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
example_roof_r_value = Panel(decnstrconstr_5.r_val_ip)
panel_8 = Panel(decnstrconstr_5.layers)
bang_3 = ExplodeTree(Data=graft(decnstrconstr_5.layers))  # -> _0000, _0001, _0002
decnstrmat_2 = HBDeconstructMaterial(mat=bang_3._0001)  # -> values, attr_names, r_val_si, r_val_ip; plug-in component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
panel_9 = Panel(decnstrmat_2.attr_names)
bang_4 = ExplodeTree(Data=graft(decnstrmat_2.values))  # -> _000100, _000101, _000102, _000103, _000104, _000105
rip2rsi_2 = Ladybug_rIP2rSI(R_IP=expression)  # -> R_SI; plug-in component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
opaquematnomass_2 = HBOpaqueMaterialNoMass(
    name=expression_4,
    r_value=rip2rsi_2,
    roughness=bang_4._000101,
    therm_absp=bang_4._000103,
    sol_absp=bang_4._000104,
    vis_absp=bang_4._000105)  # -> mat; plug-in component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
merge_7 = Merge(Data1=bang_3._0000, Data2=opaquematnomass_2, Data3=bang_3._0002)  # -> flatten(Result)
opaqueconstr_2 = HBOpaqueConstruction(name=give_a_name_to_the_new_roof, materials=merge_7)  # -> constr; plug-in component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
decnstrconstr_6 = HBDeconstructConstruction(constr=opaqueconstr_2)  # -> materials, layers, r_val_si, r_val_ip, u_fac_si, u_fac_ip, shgc, t_sol, t_vis; plug-in component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

# ----
num_2 = Number(item_6.Item1)
len_2 = Length(Curve=offset_l)
subtraction_2 = Subtraction(A=r_height, B=multiplication_2)
c_script_14 = CSharpScript(x=num, y=subtraction)  # -> out, A; inputs x: Double
# ---------- c_script_14: C# ----------
    double Number = 0;
    if(x >= y.Max)
      Number = y.Max;
    else if(x<= y.Min)
      Number = y.Min;
    else
      Number = x;
    
    A = Number;
# ---------- end c_script_14 ----------
rip2rsi_3 = Ladybug_rIP2rSI(R_IP=number_slider_19)  # -> R_SI; disabled; plug-in component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
rip2rsi_4 = Ladybug_rIP2rSI(R_IP=number_slider_18)  # -> R_SI; disabled; plug-in component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
rip2rsi_5 = Ladybug_rIP2rSI(R_IP=number_slider_20)  # -> R_SI; disabled; plug-in component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

# ---- group: Window construction making / the new window construction and its new U & SHGC value
new_win_u_value = Panel(decnstrconstr.u_fac_ip)
new_shgc_value = Panel(decnstrconstr.shgc)

# ----
sort = SortList(Keys=len_2, ValuesA=offset_l)  # -> Keys, ValuesA
c_script_15 = CSharpScript(x=num_2, y=subtraction_2)  # -> out, A; inputs x: Double; same code as c_script_14
subtraction_3 = Subtraction(A=subtraction, B=c_script_14.A)
panel_10 = Panel("customized insulation material")  # disabled
panel_11 = Panel("customized insulation material")  # disabled
panel_12 = Panel("customized insulation material")  # disabled
subtraction_4 = Subtraction(A=r_height, B=c_script_15.A)
num_3 = Number(item_6.Item3)
c_script_16 = CSharpScript(x=subtraction_3)  # -> out, A; inputs x: Double
# ---------- c_script_16: C# ----------
    x = x / 2;
    Interval Intrvl = new Interval(-x, x);
    A = Intrvl;
# ---------- end c_script_16 ----------
opaquematnomass_3 = HBOpaqueMaterialNoMass(name=panel_10, r_value=rip2rsi_3)  # -> mat; disabled; plug-in component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
num_4 = Number(item_6.Item2)
opaquematnomass_4 = HBOpaqueMaterialNoMass(name=panel_11, r_value=rip2rsi_4)  # -> mat; disabled; plug-in component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
opaquematnomass_5 = HBOpaqueMaterialNoMass(name=panel_12, r_value=rip2rsi_5)  # -> mat; disabled; plug-in component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
bool_2 = Boolean(item_6.Item7)
subtraction_5 = Subtraction(A=subtraction_4, B=multiplication_2)

# ---- group: You might give a new name
give_a_name_to_the_new_wall_2 = Panel("New construction")  # disabled

give_a_name_to_the_new_wall_3 = Panel("New construction")  # disabled

give_a_name_to_the_new_wall_4 = Panel("New construction")  # disabled

# ----
c_script_17 = CSharpScript(x=num_4, y=c_script_16.A)  # -> out, A; inputs x: Double; same code as c_script_14
len_3 = Length(Curve=crv_2)
c_script_18 = CSharpScript(x=subtraction_5)  # -> out, A; inputs x: Double; same code as c_script_16

# ---- group: Window construction making / the new window construction and its new U & SHGC value
new_win_u_value_2 = Panel(decnstrconstr_2.u_fac_ip)  # disabled
new_shgc_value_2 = Panel(decnstrconstr_2.shgc)  # disabled

# ----
opaqueconstr_3 = HBOpaqueConstruction(name=give_a_name_to_the_new_wall_2, materials=opaquematnomass_3)  # -> constr; disabled; plug-in component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
opaqueconstr_4 = HBOpaqueConstruction(name=give_a_name_to_the_new_wall_3, materials=opaquematnomass_4)  # -> constr; disabled; plug-in component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
opaqueconstr_5 = HBOpaqueConstruction(name=give_a_name_to_the_new_wall_4, materials=opaquematnomass_5)  # -> constr; disabled; plug-in component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
division = Division(A=c_script_17.A, B=len_3)

# ---- group: Slab construction making / the new slab construction and its new R value
new_slab_r_value = Panel(decnstrconstr_4.r_val_ip)

# ---- group: Roof construction making / the newroof construction and its new R value
new_roof_r_value = Panel(decnstrconstr_6.r_val_ip)

# ----
division_2 = Division(A=r_height, B=2)
c_script_19 = CSharpScript(x=num_3, y=c_script_18.A)  # -> out, A; inputs x: Double; same code as c_script_14
item_7 = ListItem(List=sort.ValuesA, Index=0, Wrap=True)
addition = Addition(A=division_2, B=c_script_19.A)
addition_2 = Addition(A=division, B="0.5")
eval = EvaluateCurve(Curve=reparameterize(crv_2), Parameter=addition_2)  # -> Point, Tangent, Angle
Z_3 = UnitZ(Factor=1)
pull = PullPoint(Point=eval.Point, Geometry=item_7, ClosestOnly=True)  # -> ClosestPoint, Distance
vrot = Rotate(Vector=eval.Tangent, Axis=Z_3, Angle=[-1.570796327, 1.570796327])
subtraction_6 = Subtraction(A=pull.ClosestPoint, B=eval.Point)
angle = Angle(VectorA=subtraction_6, VectorB=vrot)  # -> Angle, Reflex
groundsubset = HBGroundConstructionSubset(ground_floor=opaqueconstr)  # -> ground_set; plug-in component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
interiorsubset = HBInteriorConstructionSubset()  # -> interior_set; plug-in component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
subfacesubset = HBSubfaceSubset(window=windowconstr)  # -> subface_set; plug-in component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
sort_2 = SortList(Keys=angle.Angle, ValuesA=vrot)  # -> Keys, reverse(ValuesA)
exteriorsubset = HBExteriorConstructionSubset(exterior_wall=opaqueconstr_4, exterior_roof=opaqueconstr_3, exposed_floor=opaqueconstr_5)  # -> exterior_set; disabled; plug-in component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
groundsubset_2 = HBGroundConstructionSubset(ground_floor=opaqueconstr_5)  # -> ground_set; disabled; plug-in component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
interiorsubset_2 = HBInteriorConstructionSubset()  # -> interior_set; disabled; plug-in component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
subfacesubset_2 = HBSubfaceSubset(window=windowconstr_2)  # -> subface_set; disabled; plug-in component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
item_8 = ListItem(List=sort_2.ValuesA, Index=0, Wrap=True)
multiplication_3 = Multiplication(A=Z_3, B=addition)
move_3 = Move(Geometry=eval.Point, Motion=multiplication_3)  # -> Geometry, Transform
vrot_2 = Rotate(Vector=Z_3, Axis=item_8, Angle=-1.570796327)

# ---- group: Give a new ConstructionSet name
panel_13 = Panel("CustomSet")

# ----
c_script_20 = CSharpScript(x=c_script_14.A)  # -> out, A; inputs x: Double; same code as c_script_16
pl = ConstructPlane(Origin=move_3.Geometry, XAxis=vrot_2, YAxis=Z_3)
crv_3 = Curve(clean)
toggle_3 = BooleanToggle(False)
match = MatchTree(Tree=pl, Guide=c_script_20.A)
c_script_21 = CSharpScript(x=c_script_15.A)  # -> out, A; inputs x: Double; same code as c_script_16

# ---- group: Give a new ConstructionSet name
panel_14 = Panel("CustomSet")  # disabled

# ----
geo_2 = Geometry(values_6.Values)
constructionset = HBConstructionSet(
    name=panel_14,
    exterior_subset=exteriorsubset,
    ground_subset=groundsubset_2,
    interior_subset=interiorsubset_2,
    subface_subset=subfacesubset_2)  # -> constr_set; disabled; plug-in component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
extr = Extrude(Base=crv_3, Direction=Z_2)
rectangle_2 = Rectangle(Plane=match, XSize=c_script_20.A, YSize=c_script_21.A, Radius=0)  # -> Rectangle, Length
area = Area(Geometry=rectangle_2.Rectangle)  # -> Area, Centroid
join_6 = JoinCurves(Curves=extr, Preserve=False)  # -> simplify(Curves)
clean_2 = CleanTree(RemoveNulls=True, RemoveInvalid=True, RemoveEmpty=True, Tree=cull)
extr_2 = Extrude(Base=geo_2, Direction=Z_2)
amp = Amplitude(Vector=item_8, Amplitude=Slider(0.02, range=0..1))
larger = LargerThan(FirstNumber=area.Area, SecondNumber=0.1)  # -> LargerThan, OrEqualTo
cull_2 = CullPattern(List=rectangle_2.Rectangle, CullPattern=larger.LargerThan)
extr_3 = Extrude(Base=clean_2, Direction=Z_2)
match_2 = MatchTree(Tree=join_6, Guide=cull_2)
move_4 = Move(Geometry=cull_2, Motion=amp)  # -> Geometry, Transform
merge_8 = Merge(Data1=cull_2, Data2=match_2, Data3=extr_3, Data4=extr_2)
explode_3 = Explode(Curve=move_4.Geometry, Recursive=True)  # -> Segments, Vertices
explode_4 = Explode(Curve=cull_2, Recursive=True)  # -> Segments, Vertices
boundary_2 = BoundarySurfaces(Edges=cull_2)
boundary_3 = BoundarySurfaces(Edges=merge_8)
curvepoint = PointOnCurve(explode_3.Segments, parameter=0.5)

# ---- group: RH_OUT:windows_brep
windows_brep = Geometry(boundary_2)

# ----
mesh = MeshBrep(
    Brep=boundary_2,
    Settings={GridMaxCount=0, GridMinCount=16, JaggedSeams=False, MaxEdgeLength=0, MinEdgeLength=0.0001, MinTolerance=0, Refine=True, RefineAngle=0, RelativeTolerance=0.65, SimplePlanes=True, Tolerance=0})
pdecon = Deconstruct(Point=curvepoint)  # -> XComponent, YComponent, ZComponent

# ---- group: RH_OUT:walls_brep
walls_brep = Geometry(boundary_3)

# ----
sort_3 = SortList(Keys=pdecon.ZComponent, ValuesC=explode_4.Segments, ValuesA=explode_3.Segments)  # -> Keys, ValuesC, ValuesA
item_9 = ListItem(List=sort_3.ValuesC, Index=0, Wrap=True)  # -> Item, Item1, Item2
subtraction_7 = Subtraction(A=item_6.Item5, B=1)
len_4 = Length(Curve=item_9.Item)
c_script_22 = CSharpScript(x=item_6.Item8)  # -> out, A, B; inputs x: Int32
# ---------- c_script_22: C# ----------
    if(x == 1)
    {
      A = 1;
      B = true;
    }
    else{
      A = x - 1;
      B = false;
    }
# ---------- end c_script_22 ----------
bool_3 = Boolean(item_6.Item4)
len_5 = Length(Curve=item_9.Item1)

# ---- group: Fins
c_script_23 = CSharpScript(window_width=len_4, minFinSpacing=min_fin_spacing, finNum=subtraction_7, finDepth=item_6.Item6, AddRemoveFins=bool_3)  # -> out, N_Fins, Spacing, Depth; inputs window_width: Double, minFinSpacing: Double, finNum: Int32, finDepth: Double, AddRemoveFins: Boolean
# ---------- c_script_23: C# ----------
    double spacing;
    double depth;

    double spacing1 = window_width / finNum;
    if(AddRemoveFins){


      if (finNum < 1) {
        spacing = window_width;
        depth = 0;
      }
      else {
        if (spacing1 >= minFinSpacing) {
          spacing = spacing1;
          depth = finDepth;
        }
        else{
          spacing = minFinSpacing;
          depth = finDepth;
        }
      }
    }
    else{
      spacing = window_width;
      depth = 0;
    }

    N_Fins = finNum;
    Spacing = spacing;
    Depth = depth;
# ---------- end c_script_23 ----------

# ---- group: Overhangs
c_script_24 = CSharpScript(window_width=len_5, minFinSpacing=min_fin_spacing, finNum=c_script_22.A, finDepth=item_6.Item9, AddRemoveFins=bool_2)  # -> out, N_Fins, Spacing, Depth; inputs window_width: Double, minFinSpacing: Double, finNum: Int32, finDepth: Double, AddRemoveFins: Boolean; same code as c_script_23

# ----
item_10 = ListItem(List=reverse(sort_3.ValuesC), Index=0, Wrap=True)
divide = DivideCurve(Curve=item_9.Item, Count=c_script_23.N_Fins, Kinks=False)  # -> Points, Tangents, Parameters
divide_2 = DivideCurve(Curve=item_9.Item1, Count=c_script_24.N_Fins, Kinks=False)  # -> Points, Tangents, Parameters
pull_2 = PullPoint(Point=divide.Points, Geometry=item_10, ClosestOnly=True)  # -> ClosestPoint, Distance
pull_3 = PullPoint(Point=divide_2.Points, Geometry=item_9.Item2, ClosestOnly=True)  # -> ClosestPoint, Distance
ln = Line(StartPoint=pull_3.ClosestPoint, EndPoint=divide_2.Points)
amp_2 = Amplitude(Vector=item_8, Amplitude=c_script_24.Depth)
extr_4 = Extrude(Base=ln, Direction=amp_2)
center_2 = Center(Geometric=extr_4)  # -> Center, Dimension
area_2 = Area(Geometry=extr)  # -> Area, Centroid
area_3 = Area(Geometry=cull_2)  # -> Area, Centroid
mesh_2 = MeshBrep(
    Brep=boundary_3,
    Settings={GridMaxCount=0, GridMinCount=16, JaggedSeams=False, MaxEdgeLength=0, MinEdgeLength=0.0001, MinTolerance=0, Refine=True, RefineAngle=0, RelativeTolerance=0.65, SimplePlanes=True, Tolerance=0})
pdecon_2 = Deconstruct(Point=center_2.Center)  # -> XComponent, YComponent, ZComponent
ln_2 = Line(StartPoint=divide.Points, EndPoint=pull_2.ClosestPoint)
amp_3 = Amplitude(Vector=item_8, Amplitude=c_script_23.Depth)
pshift = ShiftPaths(Data=area_2.Area, Offset=-1)
pshift_2 = ShiftPaths(Data=area_3.Area, Offset=-1)
sort_4 = SortList(Keys=pdecon_2.ZComponent, ValuesA=extr_4)  # -> Keys, ValuesA
extr_5 = Extrude(Base=ln_2, Direction=amp_3)
ma = MassAddition(Input=pshift)  # -> Result, PartialResults
ma_2 = MassAddition(Input=pshift_2)  # -> Result, PartialResults
cull_i = CullIndex(List=sort_4.ValuesA, Indices=0, Wrap=True)
geo_3 = Geometry(extr_4)
c_script_25 = CSharpScript(x=simplify(graft(values_18.Values)))  # -> out, A; inputs x: tree of Int32
# ---------- c_script_25: C# ----------
    DataTree<int> y = new DataTree<int> ();
    for(int i = 0 ;i < x.BranchCount ;i++)
    {
      if(x.Branch(i)[0] == 0)
        y.Add(0, new GH_Path(i));
    }
    A = y;
# ---------- end c_script_25 ----------
mesh_3 = MeshBrep(
    Brep=extr_5,
    Settings={GridMaxCount=0, GridMinCount=16, JaggedSeams=False, MaxEdgeLength=0, MinEdgeLength=0.0001, MinTolerance=0, Refine=True, RefineAngle=0, RelativeTolerance=0.65, SimplePlanes=True, Tolerance=0})

# ---- group: Dimensions
number_slider_21 = Slider(0.67, range=0..10)
crv_4 = Curve(simplify.Curve)
offset = OffsetCurve(Curve=crv_4, Distance=[0.1, -0.1], Corners=1)  # -> flatten(Curve)
sort_5 = SortList(Keys=offset, ValuesA=offset)  # -> Keys, reverse(ValuesA)
explode_5 = Explode(Curve=crv_4, Recursive=True)  # -> Segments, Vertices
neg = Negative(Value=number_slider_21)
merge_9 = Merge(Data1=neg, Data2=number_slider_21)
item_11 = ListItem(List=sort_5.ValuesA, Index=0, Wrap=True)
explode_6 = Explode(Curve=simplify.Curve, Recursive=True)  # -> Segments, Vertices
curvepoint_2 = PointOnCurve(explode_5.Segments, parameter=0.5)
Z_4 = UnitZ(Factor=1)
disc = Discontinuity(Curve=item_11, Level=1)  # -> Points, Parameters
disc_2 = Discontinuity(Curve=crv_4, Level=1)  # -> Points, Parameters
pull_4 = PullPoint(Point=curvepoint_2, Geometry=item_11, ClosestOnly=True)  # -> ClosestPoint, Distance
vrot_3 = Rotate(Vector=graft(explode_6.Segments), Axis=Z_4, Angle=[1.570796327, -1.570796327])
curvepoint_3 = PointOnCurve(explode_6.Segments, parameter=0.5)
offset_l_2 = OffsetCurveLoose(Curve=graft(explode_6.Segments), Distance=merge_9)
Z_5 = UnitZ(Factor=1)
subtraction_8 = Subtraction(A=pull_4.ClosestPoint, B=curvepoint_2)
pull_5 = PullPoint(Point=disc_2.Points, Geometry=disc.Points, ClosestOnly=True)  # -> ClosestPoint, Distance
line = LineSDL(Start=disc_2.Points, Direction=Z_5, Length=r_height)
addition_3 = Addition(A=graft(curvepoint_3), B=vrot_3)
boundary_4 = BoundarySurfaces(Edges=simplify.Curve)
curvepoint_4 = PointOnCurve(offset_l_2, parameter=0.5)
vrot_4 = Rotate(Vector=subtraction_8, Axis=Z_5, Angle=-1.570796327)
curvepoint_5 = PointOnCurve(line, parameter=0.5)
subtraction_9 = Subtraction(A=disc_2.Points, B=pull_5.ClosestPoint)
pull_6 = PullPoint(Point=addition_3, Geometry=boundary_4, ClosestOnly=True)  # -> ClosestPoint, Distance
end = EndPoints(Curve=line)  # -> Start, End
line_2 = LineSDL(Start=curvepoint_2, Direction=vrot_4, Length=1)
pl_2 = ConstructPlane(Origin=curvepoint_5, XAxis=subtraction_9, YAxis=Z_5)
pull_7 = PullPoint(Point=curvepoint_4, Geometry=boundary_4, ClosestOnly=True)  # -> ClosestPoint, Distance
curvepoint_6 = PointOnCurve(crv_3, parameter=0.5)
multiplication_4 = Multiplication(A=Z_2, B=1.2)
sort_6 = SortList(Keys=pull_6.Distance, ValuesA=vrot_3)  # -> Keys, ValuesA
sort_7 = SortList(Keys=pull_7.Distance, ValuesA=offset_l_2)  # -> Keys, ValuesA
move_5 = Move(Geometry=curvepoint_6, Motion=multiplication_4)  # -> Geometry, Transform
flip = FlipCurve(Curve=graft(explode_5.Segments), Guide=graft(line_2))  # -> flatten(Curve), Flag
item_12 = ListItem(List=reverse(sort_6.ValuesA), Index=0, Wrap=True)
pl_3 = ConstructPlane(Origin=curvepoint_2, XAxis=vrot_4, YAxis=subtraction_8)
center_3 = Center(Geometric=simplify.Curve)  # -> Center, Dimension
item_13 = ListItem(List=reverse(sort_7.ValuesA), Index=0, Wrap=True)  # -> simplify(Item)
tstat = TreeStatistics(Tree=move_5.Geometry)  # -> Paths, Length, Count
item_14 = ListItem(List=reverse(sort_3.ValuesA), Index=[0, 1], Wrap=True)
end_2 = EndPoints(Curve=flip.Curve)  # -> Start, End
vrot_5 = Rotate(Vector=item_12, Axis=Vector(0, 0, 1), Angle=-1.570796327)
Z_6 = UnitZ(Factor=1)
dpath = DeconstructPath(Branch=tstat.Paths)  # -> simplify(Indices)
curvepoint_7 = PointOnCurve(item_13, parameter=0.5)
merge_10 = Merge(Data1=pl_3, Data2=pl_2)
tstat_2 = TreeStatistics(Tree=item_13)  # -> graft(Paths), Length, Count
item_15 = ListItem(List=sort_3.ValuesA, Index=0, Wrap=True)
vrot_6 = Rotate(Vector=Z_6, Axis=amp_3, Angle=-1.570796327)
merge_11 = Merge(Data1=flatten(end_2.Start), Data2=flatten(end.Start))
curvepoint_8 = PointOnCurve(item_14, parameter=0.451)
merge_12 = Merge(Data1=flatten(end_2.End), Data2=flatten(end.End))
item_16 = ListItem(List=dpath, Index=0, Wrap=True)  # -> Item, Item1
project = Project(Geometry=item_15, Plane=center_3.Center)  # -> Geometry, Transform
vrot_7 = Rotate(Vector=item_14, Axis=amp_3, Angle=-1.570796327)
dpath_2 = DeconstructPath(Branch=tstat_2.Paths)
Z_7 = UnitZ(Factor=1)
panel_15 = Panel("""[
]""")
format_3 = Format(Format="win {1}", Culture=127, Data0=item_16.Item, Data1=item_16.Item1)
curvepoint_9 = PointOnCurve(project.Geometry, parameter=0.5)
weave = Weave(Pattern=[1, 0, 1], Stream0=dpath_2, Stream1=panel_15, NullGaps=False)
end_3 = EndPoints(Curve=item_14)  # -> Start, End
pl_4 = ConstructPlane(Origin=curvepoint_8, XAxis=item_14, YAxis=vrot_7)
pl_5 = ConstructPlane(Origin=curvepoint_7, XAxis=expr("-X", vrot_5), YAxis=Z_7)
match_3 = MatchTree(Tree=simplify(format_3), Guide=simplify(move_5.Geometry))
join_7 = TextJoin(Text=weave)
pl_6 = ConstructPlane(Origin=curvepoint_9, XAxis=vrot_6, YAxis=Z_6)
aligndim = AlignedDimension(
    Plane=pl_4,
    PointA=end_3.Start,
    PointB=end_3.End,
    Offset=Slider(0.16, range=0..1),
    Text="{0:0.00}",
    Size=Slider(0.12, range=0..1))
tag = TextTag3D(
    Location=pl_6,
    Text=match_3,
    Size=Slider(0.34, range=0..10),
    Colour=ColourSwatch(SwatchColor=RGB(69, 0, 0)),
    Justification=8)
aligndim_2 = AlignedDimension(
    Plane=merge_10,
    PointA=merge_11,
    PointB=merge_12,
    Offset=Slider(0.35, range=0..1),
    Text="{0:0.00}",
    Size=Slider(0.17, range=0..1))
tag_2 = TextTag3D(
    Location=pl_5,
    Text=join_7,
    Size=Slider(0.52, range=0..10),
    Colour=ColourSwatch(SwatchColor=RGB(130, 0, 0)),
    Justification=9)

# ----
division_3 = Division(A=ma_2.Result, B=ma.Result)
c_script_26 = CSharpScript(G=c_script_22.B, D0=geo_3, D1=cull_i)  # -> out, A; inputs G: Int32, D0: list of GeometryBase, D1: list of GeometryBase
# ---------- c_script_26: C# ----------
    if(G == 0)
      A = D0;
    
    else
      A = D1;
# ---------- end c_script_26 ----------
offmsh = OffsetMesh(Mesh=mesh_2, Distance=0.002, BothSides=False, CreateSolid=True)
offmsh_2 = OffsetMesh(Mesh=mesh_3, Distance=0.002, BothSides=False, CreateSolid=True)
mesh_4 = MeshBrep(
    Brep=c_script_26.A,
    Settings={GridMaxCount=0, GridMinCount=16, JaggedSeams=False, MaxEdgeLength=0, MinEdgeLength=0.0001, MinTolerance=0, Refine=True, RefineAngle=0, RelativeTolerance=0.65, SimplePlanes=True, Tolerance=0})
merge_13 = Merge(Data1=division_3, Data2=c_script_25.A)
offmsh_3 = OffsetMesh(Mesh=mesh_4, Distance=0.002, BothSides=False, CreateSolid=True)
item_17 = ListItem(List=branch_2, Index=0, Wrap=True)  # -> Item, Item1
preview = CustomPreview(Geometry=offmsh_3, Material=ColourSwatch(SwatchColor=RGB(94, 102, 95)))
preview_2 = CustomPreview(Geometry=offmsh_2, Material=ColourSwatch(SwatchColor=RGB(110, 93, 24)))
preview_3 = CustomPreview(Geometry=offmsh, Material=ColourSwatch(SwatchColor=RGB(227, 227, 227)))
hideshow = HideShowElement(ElementToHideShow=slider_4, Show=item_17.Item1, Collapse=True, Disable=False)
brep = Brep(flatten(extr_3))
num_5 = Number(flatten(division_3))
hideshow_2 = HideShowElement(ElementToHideShow=slider_5, Show=item_17.Item, Collapse=True, Disable=False)
pshift_3 = ShiftPaths(Data=extr, Offset=-1)
join_8 = BrepJoin(Breps=pshift_3)  # -> simplify(Breps), Closed
fmerge = MergeFaces(Brep=join_8.Breps)  # -> flatten(Breps), Before, After
filter = StreamFilter(Gate=item_17.Item, Stream0="adiabatic", Stream1="outdoors")
filter_2 = StreamFilter(Gate=item_17.Item1, Stream0="adiabatic", Stream1="outdoors")
geo_4 = Geometry(move_2.Geometry)
geo_5 = Geometry(boundary)
geo_6 = Geometry(fmerge.Breps)

# ---- group: Walls
geo_7 = Geometry(flatten(mesh_2))

# ----
item_18 = ListItem(List=c_script_12.A, Index=6, Wrap=True)
face = HBFace(geo=brep, bc="outdoors")  # -> report, faces; plug-in component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
face_2 = HBFace(geo=geo_5, type="Floor", bc=filter)  # -> report, faces; plug-in component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
face_3 = HBFace(geo=geo_6, bc="outdoors")  # -> report, faces; plug-in component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
face_4 = HBFace(geo=geo_4, type="RoofCeiling", bc=filter_2)  # -> report, faces; plug-in component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
wbjoin = WeaverbirdsJoinMeshesAndWeld(Mesh=geo_7, Weld=False)

# ---- group: Floor
roof = Geometry(boundary)

# ---- group: Ceiling
geo_8 = Geometry(move_2.Geometry)

# ----
aperturesbyratio = HBAperturesByRatio(hb_objs=flatten(face_3.faces), ratio=num_5, subdivide=Toggle(True))  # -> report, hb_objs; plug-in component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
data_4 = Data([aperturesbyratio.hb_objs, face.faces, face_2.faces, face_4.faces])
clean_3 = CleanTree(RemoveNulls=True, RemoveInvalid=True, RemoveEmpty=False, Tree=data_4)
flatten = FlattenTree(Tree=c_script_23.Spacing, Path="{0}")
flatten_2 = FlattenTree(Tree=c_script_23.Depth, Path="{0}")

area_4 = Area(Geometry=roof)  # -> Area, Centroid
xy_2 = XYPlane(Origin=area_4.Centroid)
planesrf = PlaneSurface(Plane=xy_2, XSize="-500 To 500", YSize="-500 To 500")

panel_16 = Panel("2013::ClimateZone5::SteelFramed")
brep_2 = Brep(c_script_8.A)
panel_17 = Panel("https://energyplus-weather.s3.amazonaws.com/north_and_central_america_wmo_region_4/USA/MA/USA_MA_Boston-Logan.Intl.AP.725090_TMY3/USA_MA_Boston-Logan.Intl.AP.725090_TMY3.zip")
toggle_4 = BooleanToggle(True)
tooltip_17 = AttachTooltipToElement(TooltipContent="Sensor per m2", ShowDelay=500, Duration=2000)
mesh_5 = Mesh(flatten(mesh))
brep_3 = Brep(geo_8)
brep_4 = Brep(roof)
mesh_6 = Mesh(wbjoin)
brep_5 = Brep(planesrf)
wbjoin_2 = WeaverbirdsJoinMeshesAndWeld(Mesh=mesh_5, Weld=False)
downloadepw = LBDownloadWeather(weather_URL=panel_17)  # -> epw_file, stat_file, ddy_file; plug-in component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
num_6 = Number(flatten(c_script_24.Depth))
num_7 = Number(flatten(c_script_24.Spacing))
toggle_5 = BooleanToggle(True)
panel_18 = Panel("80")  # disabled
se_threshold = Slider(250, range=0..1000)
button_2 = CreateButton(ButtonName="Save Alternative", ButtonStyle=0)
textbox_2 = CreateTextBox(Label="Name", DefaultText="image01", UpdateButton=True, showLabel=True)
values_20 = ValueListener(Elements=textbox_2, SomeProperty=True)  # -> flatten(Values), Indices
panel_19 = Panel("""0
0
0
0
0""")
filepicker = CreateFilePicker(ButtonLabelText="Select Folder", DialogType=2, MustExist=True, Filter="All Files|*.*")
txt = Text(simplify(["Mesh (V:44  F:11)", "", "Heating", "Solar", "Electric Equipment", "Lighting", "People", "Infiltration", "Mechanical Ventilation", "Opaque Conduction", "Window Conduction", "Cooling", "Storage"]))
txt_2 = Text()
txt_3 = Text(values_20.Values)
merge_14 = Merge(Data1=txt_3, Data2=txt_2)  # -> flatten(Result)
cull_i_2 = CullIndex(List=txt, Indices=[0, 1], Wrap=True)
number_slider_22 = Slider(2, range=0..10)
values_21 = ValueListener(Elements=button_2, SomeProperty=True)  # -> flatten(Values), Indices
panel_20 = Panel("""False
False
True""")
num_8 = Number(simplify(Tree({0;0}: [7.2265002e-06, 0, 0.1039358954, 0.2861826227, 0.9443003638, 2.748916509, 5.403891962, 4.634928965, 1.812474214, 0.2600811075, 0.003957734042, 2.370497837e-05], {0;1}: [2.608670595, 1.591759018, 0.8072011571, 0.07139265973, 0.01428444333, 0, 0, 0, 0, 0, 0.4241594778, 1.00916368], {0;2}: [1.813157427, 1.656090598, 1.875157491, 1.70500176, 1.875157491, 1.802135194, 1.778024058, 1.875157491, 1.767001824, 1.813157427, 1.802135194, 1.778024058], {0;3}: [3.227396731, 2.936581693, 3.288215763, 3.084670334, 3.288215763, 3.171004407, 3.201881691, 3.288215763, 3.145489367, 3.227396731, 3.171004407, 3.201881691])))
values_22 = ValueListener(Elements=filepicker, SomeProperty=True)  # -> flatten(Values), Indices
split_2 = TextSplit(Text=cull_i_2, Separators=" ")  # -> reverse(Result)
panel_21 = Panel("""Sml   
Med   
Lrg   """)
join_9 = TextJoin(Text=txt_3, Join="-")
grid = CreateGrid(
    UIElements=flatten([textbox_2, button_2, filepicker]),
    Width=Slider(450, range=0..5000),
    Height=Slider(60, range=0..100),
    ColumnDefinitions=flatten([Slider(158, range=150..400), Slider(171, range=0..1000), Slider(326, range=0..1000)]),
    ElementColumn=[Slider(1, range=0..3), Slider(2, range=0..3), Slider(0, range=0..3)],
    ElementRowSpan=2,
    ElementColumnSpan=1)
num_9 = Number(0.6096)
number_slider_23 = Slider(0.01, range=0..1)
item_19 = ListItem(List=split_2, Index=0, Wrap=True)  # -> flatten(Item)
c_script_27 = CSharpScript(takePic=values_21.Values, path=values_22.Values, fileName=join_9)  # -> out, A, B; inputs takePic: Boolean, path: String, fileName: String
# ---------- c_script_27: C# usings ----------
using System.Drawing;
using System.IO;
using System.Drawing.Imaging;
using System.Windows.Forms;
# ---------- c_script_27: C# ----------
    Bitmap screenshot = null;
    screenshot = CaptureScreen();

   if(takePic){
      string filePath = Path.Combine(path, fileName + ".jpg");
      screenshot.Save(filePath);
      B = filePath;
    }

    //A = screenshot;
# ---------- c_script_27: C# additional code ----------
  private Bitmap CaptureScreen()
  {
    Rectangle bounds = Screen.PrimaryScreen.Bounds;
    Bitmap screenshot = new Bitmap(bounds.Width, bounds.Height - 50, PixelFormat.Format32bppArgb);

    using (Graphics graphics = Graphics.FromImage(screenshot))
    {
      graphics.CopyFromScreen(bounds.X, bounds.Y, 0, 0, bounds.Size, CopyPixelOperation.SourceCopy);
    }

    return screenshot;
  }
  private Bitmap ResizeImage(Bitmap image, int width, int height)
  {
    Bitmap resizedImage = new Bitmap(width, height);
    using (Graphics graphics = Graphics.FromImage(resizedImage))
    {
      graphics.DrawImage(image, 0, 0, width, height);
    }
    return resizedImage;
  }
# ---------- end c_script_27 ----------
radiobtn = CreateRadioButton(RadioButtonName=panel_21, RadioButtonGroup="1", InitiallySelected=panel_20)
label = CreateLabel(LabelText=" Grid Size:  ", LabelSize=12, Justification=0)
division_4 = Division(A=num_9, B=2)
series_2 = Series(Start=number_slider_22, Step=number_slider_22, Count=3)
merge_15 = Merge(Data1="0", Data2="10", Data3="100")
merge_16 = Merge(Data1="0", Data2="40", Data3="55", Data4="75", Data5="100")
panel_22 = Panel("Capture Alternative                                                                                                             ")
num_10 = Number(Tree({0;0;0}: [2.608670595, 1.591759018, 0.8072011571, 0.07139265973, 0.01428444333, 0, 0, 0, 0, 0, 0.4241594778, 1.00916368], {0;0;1}: [0, 0, 0, 0, 0, 0, 0, 0, 0, 0, 0, 0], {0;0;2}: [3.227396731, 2.936581693, 3.288215763, 3.084670334, 3.288215763, 3.171004407, 3.201881691, 3.288215763, 3.145489367, 3.227396731, 3.171004407, 3.201881691], {0;0;3}: [1.813157427, 1.656090598, 1.875157491, 1.70500176, 1.875157491, 1.802135194, 1.778024058, 1.875157491, 1.767001824, 1.813157427, 1.802135194, 1.778024058], {0;0;4}: [0.659397436, 0.6032097995, 0.6855537496, 0.6167723324, 0.6855537496, 0.6581057662, 0.6442203158, 0.6855537496, 0.642928646, 0.659397436, 0.6581057662, 0.6442203158], {0;0;5}: [0, 0, 0, 0, 0, 0, 0, 0, 0, 0, 0, 0], {0;0;6}: [-8.275603782, -6.752980342, -6.48901464, -5.358800368, -4.7529242, -2.810738808, -0.100010157, -1.071623298, -3.706898604, -5.493480634, -6.141083554, -6.749904266], {0;0;7}: [0, 0, 0, 0, 0, 0, 0, 0, 0, 0, 0, 0], {0;0;8}: [0, 0, 0, 0, 0, 0, 0, 0, 0, 0, 0, 0], {0;0;9}: [-7.2265002e-06, 0, -0.1039358954, -0.2861826227, -0.9443003638, -2.748916509, -5.403891962, -4.634928965, -1.812474214, -0.2600811075, -0.003957734042, -2.370497837e-05], {0;0;10}: [-0.0330111803, -0.03466076799, -0.06317762588, 0.1671459042, -0.1659868838, -0.07159004895, -0.1202239447, -0.1423747418, -0.03604701861, 0.0536101473, 0.08963644422, 0.1166382267]))
split_3 = SplitList(List=item_19, Index=5)  # -> ListA, ListB
txt_4 = Text(["Mesh (V:44  F:11)", "", "Heating", "Solar", "Electric Equipment", "Lighting", "People", "Infiltration", "Mechanical Ventilation", "Opaque Conduction", "Window Conduction", "Cooling", "Storage"])
multiplication_5 = Multiplication(A=division_4, B=series_2)
consec = ConsecutiveDomains(Numbers=merge_15, Additive=False)
consec_2 = ConsecutiveDomains(Numbers=merge_16, Additive=False)
values_23 = ValueListener(Elements=radiobtn, SomeProperty=True)  # -> flatten(Values), Indices
cull_i_3 = CullIndex(List=txt_4, Indices=[0, 1], Wrap=True)
cull_3 = CullPattern(List=multiplication_5, CullPattern=values_23.Values)

# ---- group: analysis grid
Z_8 = UnitZ(Factor="0.762")
move_6 = Move(Geometry=roof, Motion=Z_8)  # -> Geometry, Transform
c__0_003 = CSharpScript(gridSurface=move_6.Geometry, spacing=cull_3, offset="0.0254 * 10", complex=Toggle(True))  # -> out, A, B, nU, nV, E; inputs gridSurface: Brep, spacing: Double, offset: Double, complex: Boolean
# ---------- c__0_003: C# ----------
    Surface srf = gridSurface.Faces[0];

    double width = 0.0;
    double depth = 0.0;
    srf.GetSurfaceSize(out width, out depth);

    srf.SetDomain(0, new Interval(0, width));
    srf.SetDomain(1, new Interval(0, depth));

    int n_usteps = (int) (0.999999999 + (width - 2.0 * offset) / spacing);
    int n_vsteps = (int) (0.999999999 + (depth - 2.0 * offset) / spacing);
    double u_spacing = (width - 2.0 * offset) / n_usteps;
    double v_spacing = (depth - 2.0 * offset) / n_vsteps;

    Mesh m = new Mesh();

    for (int i = 0; i < n_usteps + 1; ++i) {
      for (int j = 0; j < n_vsteps + 1; ++j) {
        Point3d pt;
        Vector3d[] vv;
        srf.Evaluate(offset + i * u_spacing, offset + j * v_spacing, 0, out pt, out vv);
        m.Vertices.Add(pt.X, pt.Y, pt.Z);
      }
    }

    for (int j = 0; j < n_usteps ; ++j) {
      for (int i = 0; i < n_vsteps ; ++i) {
        m.Faces.AddFace(new MeshFace(i + j * (n_vsteps + 1), i + (j + 1) * (n_vsteps + 1), i + (j + 1) * (n_vsteps + 1) + 1, i + j * (n_vsteps + 1) + 1));
      }
    }


    // filter vertices outside of the trimmed surface
    if (complex) {
      bool[] validVertices = new bool[m.Vertices.Count];
      for (int i = 0; i < validVertices.Length; ++i) {
        validVertices[i] = false;
      }

      for (int i = 0; i < m.Vertices.Count; ++i) {
        foreach (BrepFace face in  gridSurface.Faces) {
          if (!face.IsValid) continue;

          double u, v;
          face.ClosestPoint(m.Vertices[i], out u, out v);
          PointFaceRelation pfr = face.IsPointOnFace(u, v);
          if (pfr == PointFaceRelation.Interior) {
            validVertices[i] = true;
            break;
          }
        }
      }

      List<int> cullVertices = new List<int>();
      for (int i = 0; i < validVertices.Length; ++i) {
        if (!validVertices[i]) {
          cullVertices.Add(i);
        }
      }

      m.Vertices.Remove(cullVertices, true);
    }

    m.RebuildNormals();


    A = m;
    B = m.Vertices;
    nU = n_usteps;
    nV = n_vsteps;
    E = srf;
# ---------- end c__0_003 ----------

# ----
merge_17 = Merge(Data1=flatten(label), Data2=flatten(radiobtn))
label_2 = CreateLabel(LabelText=dup, LabelSize=Slider(12, range=0..20), Justification=1)
expander_3 = CreateExpander(UIElements=flatten(grid), Header=panel_22, Open=Toggle(True))
number_slider_24 = Slider(5, range=0..10)
entwine = Entwine(Branch00=textbox, Branch01=label_2, FlattenInputs=True)
panel_23 = Panel("""Jan
Feb
Mar
Apr
May
Jun
Jul
Aug
Sep
Oct
Nov
Dec""")
custom_round = CustomRound(Numbers=num_10, Scope=number_slider_23)
adjustelem_4 = AdjustElementAppearance(
    ElementsToAdjust=graft(expander_3),
    Foreground=ColourSwatch(SwatchColor=RGB(255, 255, 255)),
    Background=ColourSwatch(SwatchColor=RGB(0, 0, 0)),
    FontSize=Slider(13.6, range=0..20))
simplegrid_4 = CreateSimpleGrid(UIElements=graft(merge_17), Width=graft(Slider(294, range=0..1000)), RowDefinitions="Auto", ColumnDefinitions="Auto")  # -> flatten(SimpleGrid)
flip_2 = FlipMatrix(Data=custom_round)  # -> simplify(Data)
custom_round_2 = CustomRound(Numbers=merge_13, Scope=0.01)
split_4 = SplitList(List=cull_i_3, Index=number_slider_24)  # -> ListA, ListB
format_4 = Format(Format="{0}", Culture=127, Data0=custom_round_2)
split_5 = SplitList(List=flip_2, Index=number_slider_24)  # -> ListA, ListB
panel_24 = Panel("""cooling
heating
lighting
equipment""")
custom_round_3 = CustomRound(Numbers=num_8, Scope=Slider(0.1, range=0..1))
add_remove_fins_4 = BooleanToggle(False)
bang_5 = ExplodeTree(Data=entwine)  # -> Branch0, Branch1
txt_5 = Text(flatten(format_4))
flip_3 = FlipMatrix(Data=custom_round_3)
panel_25 = Panel("""sDA
ASE
UDI
UDIa
MI""")
adjustpos_9 = AdjustElementPositioning(
    ElementsToAdjust=expander_3,
    Margin="0,0,0,0",
    AbsolutePositioning=Toggle(True),
    Height=Slider(89, range=0..1000),
    HorizontalAlignment=Slider(0, range=0..10),
    VerticalAlignment=Slider(2, range=0..10))
panel_26 = Panel("""%
%
%
%
lux""")
abs = Absolute(Value=split_5.ListB)
setlabel = SetLabelContents(LabelToModify=bang_5.Branch1, NewLabelContents=txt_5)
multichart = CreateMultiChart(
    Data=simplify(flip_3),
    Names=panel_24,
    SubTitle="ENERGY LOAD (kWh/m2)  &  LOAD BALANCE (kWh/m2)",
    ClusterTitle=panel_23,
    ChartType=2)
toggle_6 = CreateToggle(Default=add_remove_fins_4, OnLabel="Update", OffLabel="Update")
multichart_2 = CreateMultiChart(Data=simplify(abs), Names=split_4.ListB, SubTitle="Load Balance (kWh/m2)", ClusterTitle=panel_23, ChartType=2)
colrange = LBColorRange(index="19")  # -> colors; plug-in component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
multichart_3 = CreateMultiChart(Data=simplify(split_5.ListA), Names=split_4.ListA, SubTitle="Load Balance (kWh/m2)", ClusterTitle=panel_23, ChartType=2)
true_button = CreateTrueOnlyButton(ButtonName=panel_25, ButtonStyle=0)
values_24 = ValueListener(Elements=toggle_6, SomeProperty=True)  # -> Values, Indices
lng_4 = ListLength(List=flip_3)
number_slider_25 = Slider(456, range=0..530)
bool_4 = Boolean(values_24.Values)
bool_5 = Boolean(bool_4)
predict_daylight = PredictDaylightMetricsFromGeometryAndMaterialInputsPWAIV0301(
    SensorsPositions=c__0_003.B,
    CeilingGeometries=brep_3,
    FloorGeometries=brep_4,
    WallsGeometries=mesh_6,
    GlazingGeometries=wbjoin_2,
    SurroundingGeometries=brep_2,
    GroundSurface=brep_5,
    CeilingReflectance=values_14.Values,
    FloorReflectance=values_15.Values,
    WallsReflectance=values_16.Values,
    GlazingTransparency=values_17.Values,
    VerticalShadingDeviceDepth=flatten_2,
    VerticalShadingDeviceSpacing=flatten,
    HorizontalShadingDeviceDepth=num_6,
    HorizontalShadingDeviceSpacing=num_7,
    ComputeSolution=bool_4,
    PredictDA=toggle_5,
    PredictSE=toggle_5,
    PredictMI=toggle_5,
    PredictUDI=toggle_5,
    NumberOfThreads=-1,
    ProduceAdditionalDataForDebugging=False,
    IndexOfSensorToDebug=0,
    City="Boston")  # -> PredictedDaylightAutonomy_sensor_array, PredictedSunlightExposure_sensor_array, PredictedMeanIlluminance_sensor_array, PredictedUsefulDaylightIlluminanceFailing_sensor_array, PredictedUsefulDaylightIlluminanceSupplementary_sensor_array, PredictedUsefulDaylightIlluminanceAcceptable_sensor_array, PredictedUsefulDaylightIlluminanceExcessive_sensor_array, Rays

# ---- group: RH_OUT:DA_metric
da_metric = Number(predict_daylight.PredictedDaylightAutonomy_sensor_array)

# ----
c_script_28 = CSharpScript(x=predict_daylight.PredictedSunlightExposure_sensor_array, y=se_threshold)  # -> out, A; inputs x: Double, y: Double
# ---------- c_script_28: C# ----------
    if(x>=y)
      A = 1;
    else
      A = 0;
# ---------- end c_script_28 ----------
larger_2 = LargerThan(FirstNumber=c_script_28.A, SecondNumber=0)  # -> LargerThan, OrEqualTo
cull_4 = CullPattern(List=c_script_28.A, CullPattern=larger_2.LargerThan)
lng_5 = ListLength(List=cull_4)
lng_6 = ListLength(List=c_script_28.A)
avr = Average(Input=predict_daylight.PredictedUsefulDaylightIlluminanceSupplementary_sensor_array)
avr_2 = Average(Input=predict_daylight.PredictedDaylightAutonomy_sensor_array)
avr_3 = Average(Input=predict_daylight.PredictedUsefulDaylightIlluminanceAcceptable_sensor_array)
division_5 = Division(A=lng_5, B=lng_6)
multiplication_6 = Multiplication(A=avr, B=100)
multiplication_7 = Multiplication(A=avr_2, B=100)
multiplication_8 = Multiplication(A=division_5, B=100)
multiplication_9 = Multiplication(A=avr_3, B=100)
avr_4 = Average(Input=predict_daylight.PredictedMeanIlluminance_sensor_array)
custom_round_4 = CustomRound(Numbers=multiplication_8, Scope=1)
null = NullItem(Item=avr)  # -> NullFlags, InvalidFlags, Description
null_2 = NullItem(Item=division_5)  # -> NullFlags, InvalidFlags, Description
custom_round_5 = CustomRound(Numbers=multiplication_6, Scope=1)
null_3 = NullItem(Item=avr_2)  # -> NullFlags, InvalidFlags, Description
custom_round_6 = CustomRound(Numbers=multiplication_7, Scope=1)
null_4 = NullItem(Item=avr_3)  # -> NullFlags, InvalidFlags, Description
custom_round_7 = CustomRound(Numbers=multiplication_9, Scope=1)
null_5 = NullItem(Item=avr_4)  # -> NullFlags, InvalidFlags, Description
custom_round_8 = CustomRound(Numbers=avr_4, Scope=1)
filter_3 = StreamFilter(Gate=null_2.NullFlags, Stream0=custom_round_4, Stream1="0")
filter_4 = StreamFilter(Gate=null.NullFlags, Stream0=custom_round_5, Stream1="0")
filter_5 = StreamFilter(Gate=null_3.NullFlags, Stream0=custom_round_6, Stream1="0")
filter_6 = StreamFilter(Gate=null_4.NullFlags, Stream0=custom_round_7, Stream1="0")
filter_7 = StreamFilter(Gate=null_5.NullFlags, Stream0=custom_round_8, Stream1="0")
merge_18 = Merge(
    Data1=flatten(filter_5),
    Data2=flatten(filter_3),
    Data3=flatten(filter_4),
    Data4=flatten(filter_6),
    Data5=flatten(filter_7))
c_script_29 = CSharpScript(x=merge_18, y=panel_19)  # -> out, A; inputs x: Double, y: Double; same code as c_script_2
item_20 = ListItem(List=c_script_29.A, Index=0, Wrap=True)  # -> Item, Item1
fdom = FindDomain(Domains=consec, Number=item_20.Item1, Strict=False)  # -> Index, Neighbour
fdom_2 = FindDomain(Domains=consec_2, Number=item_20.Item, Strict=False)  # -> Index, Neighbour
filter_8 = StreamFilter(Gate=fdom_2.Index, Stream0="LC:0", Stream1="LC:1", Stream2="LC:2", Stream3="LC:3")
filter_9 = StreamFilter(Gate=fdom.Index, Stream0="LC:1", Stream1="LC:0")
bnd = Bounds(Numbers=predict_daylight.PredictedMeanIlluminance_sensor_array)
merge_19 = Merge(Data1=filter_8, Data2=filter_9)
remap = RemapNumbers(Value=predict_daylight.PredictedMeanIlluminance_sensor_array, Source=bnd, Target=Domain(0, 1))  # -> Mapped, Clipped
gradient = Gradient(
    LowerLimit=Slider(3000, range=0..10000),
    UpperLimit=Slider(50, range=0..100),
    Parameter=predict_daylight.PredictedMeanIlluminance_sensor_array,
    stops=[0: RGB(234, 38, 0), 0.25: RGB(234, 126, 0), 0.5: RGB(254, 244, 84), 0.75: RGB(173, 203, 249), 1: RGB(75, 107, 169)])

# ---- group: RH_OUT:daylight_colors2
daylight_colors2 = Text(gradient)

# ---- group: RH_OUT:daylight_colors
daylight_colors = Colour(gradient)

# ----
format_5 = Format(Format="{0}: {1} {2}", Culture=127, Data0=panel_25, Data1=c_script_29.A, Data2=panel_26)
panel_27 = Panel("""20
20
20
20""")
split_6 = SplitList(List=colrange, Index=number_slider_24)  # -> ListA, ListB
series_3 = Series(Start=0, Step=1, Count=lng_4)  # -> simplify(Series)
replace = ReplaceItems(List=format_5, Item="       UDI        ", Indices=2, Wrap=False)
number_slider_26 = Slider(200, range=0..1000)
adjustelem_5 = AdjustElementAppearance(
    ElementsToAdjust=[multichart_3, multichart_2],
    Foreground=ColourSwatch(SwatchColor=RGB(10, 10, 10)),
    Background=ColourSwatch(SwatchColor=RGB(209, 209, 209)),
    FontSize=7)
swatch_3 = ColourSwatch(SwatchColor=RGB(181, 54, 54))
chartappearance = ChartAppearance(ChartToModify=multichart_3, Colors=split_6.ListA, Legend=True, Title=True)
chartappearance_2 = ChartAppearance(ChartToModify=multichart_2, Colors=split_6.ListB, Legend=True, Title=False)
setbtn = SetButton(ButtonToModify=true_button, ButtonName=replace)
adjustelem_6 = AdjustElementAppearance(ElementsToAdjust=toggle_6, Foreground=swatch_3, Background=swatch_3, FontSize=Slider(53, range=0..100))
panel_28 = Panel("""1*
2.5*""")
panel_29 = Panel("""2*
1*""")
avr_5 = Average(Input=predict_daylight.PredictedDaylightAutonomy_sensor_array)
number_slider_27 = Slider(265, range=100..600)
panel_30 = Panel("Total Load Intensity (kWh/m2)")
simplegrid_5 = CreateSimpleGrid(
    UIElements=graft([toggle_6, simplegrid_4]),
    Width=graft(Slider(572, range=0..1000)),
    RowDefinitions="Auto",
    ColumnDefinitions=panel_28)  # -> flatten(SimpleGrid)
simplegrid_6 = CreateSimpleGrid(UIElements=entwine, RowDefinitions="Auto", ColumnDefinitions=panel_29)
custom_round_9 = CustomRound(Numbers=avr_5, Scope=Slider(0.01, range=0..1))
relay_6 = Relay([ColourSwatch(SwatchColor=RGB(18, 53, 255)), ColourSwatch(SwatchColor=RGB(224, 22, 0)), ColourSwatch(SwatchColor=RGB(255, 255, 0)), ColourSwatch(SwatchColor=RGB(255, 149, 0))])
panel_31 = Panel("{0}                                                      {1}")
neg_2 = Negative(Value=Slider(0, range=0..100))
simplegrid_7 = CreateSimpleGrid(UIElements=graft(true_button), Width=number_slider_25, RowDefinitions="1*", ColumnDefinitions="1*")
values_25 = ValueListener(Elements=true_button, SomeProperty=True)  # -> flatten(Values), Indices
adjustelem_7 = AdjustElementAppearance(
    ElementsToAdjust=true_button,
    Foreground=ColourSwatch(SwatchColor=RGB(0, 0, 0)),
    Background=ColourSwatch(SwatchColor=RGB(227, 227, 227)),
    FontSize=10)
adjustpos_10 = AdjustElementPositioning(ElementsToAdjust=true_button, Margin=Slider(1, range=0..100), AbsolutePositioning=True, Width=Slider(82, range=0..300))
panel_32 = Panel(replace)
c_script_30 = CSharpScript(x=values_25.Values)  # -> out, A; inputs x: list of Boolean
# ---------- c_script_30: C# ----------
    
    for(int i = 0 ;i < x.Count ;i++){
      if(x[i])
        a = i;
    }
    A = a;
# ---------- c_script_30: C# additional code ----------
    int a = 0;
# ---------- end c_script_30 ----------

merge_20 = Merge(
    Data1=graft(predict_daylight.PredictedUsefulDaylightIlluminanceFailing_sensor_array),
    Data2=graft(predict_daylight.PredictedUsefulDaylightIlluminanceSupplementary_sensor_array),
    Data3=graft(predict_daylight.PredictedUsefulDaylightIlluminanceAcceptable_sensor_array),
    Data4=graft(predict_daylight.PredictedUsefulDaylightIlluminanceExcessive_sensor_array))  # -> simplify(Result)
number_slider_28 = Slider(1, range=0..1)
lng_7 = ListLength(List=predict_daylight.PredictedUsefulDaylightIlluminanceFailing_sensor_array)
ma_3 = MassAddition(Input=merge_20)  # -> Result, PartialResults
dup_2 = DuplicateData(Data=0.0001, Number=lng_7, Order=True)
subtraction_10 = Subtraction(A=number_slider_28, B=ma_3.Result)
addition_4 = Addition(A=number_slider_28, B=subtraction_10)
multiplication_10 = Multiplication(A=merge_20, B=addition_4)
ma_4 = MassAddition(Input=multiplication_10)  # -> Result, PartialResults
merge_21 = Merge(Data1=simplify(graft(dup_2)), Data2=simplify(ma_4.PartialResults))  # -> simplify(Result)
dual = Dual(Mesh=c__0_003.A, Type=0)
demesh = DeconstructMesh(Mesh=c__0_003.A)  # -> Vertices, Faces, Colours, Normals
faceb = FaceBoundaries(Mesh=dual)
c_script_31 = CSharpScript(x=predict_daylight.PredictedUsefulDaylightIlluminanceAcceptable_sensor_array, y=Slider(0.5, range=0..1))  # -> out, A; inputs x: Double, y: Double; same code as c_script_28
scale = Scale(Geometry=graft(faceb), Center=graft(demesh.Vertices), Factor=merge_21)  # -> Geometry, Transform
gradient_2 = Gradient(LowerLimit=0, UpperLimit=1, Parameter=c_script_31.A, stops=[0: RGB(171, 171, 171), 1: RGB(24, 121, 148)])
shift = ShiftList(List=scale.Geometry, Shift=-1, Wrap=False)
shift_2 = ShiftList(List=scale.Geometry, Shift=1, Wrap=False)
explode_7 = Explode(Curve=shift, Recursive=True)  # -> graft(Segments), Vertices
explode_8 = Explode(Curve=shift_2, Recursive=True)  # -> graft(Segments), Vertices
merge_22 = Merge(
    Data1=ColourSwatch(SwatchColor=RGB(65, 128, 176)),
    Data2=ColourSwatch(SwatchColor=RGB(117, 186, 163)),
    Data3=ColourSwatch(SwatchColor=RGB(180, 224, 119)),
    Data4=ColourSwatch(SwatchColor=RGB(255, 176, 255)))  # -> graft(Result)
end_4 = EndPoints(Curve=explode_8.Segments)  # -> Start, End
end_5 = EndPoints(Curve=explode_7.Segments)  # -> Start, End
panel_33 = Panel("""0 to 100
100 to 300
300 to 3000
3000 to 10000""")
c_script_32 = CSharpScript(x=gradient_2, y=ColourSwatch(SwatchColor=RGB(194, 194, 194)))  # -> out, A; inputs x: tree of Color, y: Color
# ---------- c_script_32: C# ----------
    if(x.BranchCount>0){
      A = x;}
    else
      A = y;
    
    //A = x.BranchCount > 0;
# ---------- end c_script_32 ----------
c_script_33 = CSharpScript(x=predict_daylight.PredictedDaylightAutonomy_sensor_array, y=0.5)  # -> out, A; inputs x: Double, y: Double
# ---------- c_script_33: C# ----------
    if(x >= y)
      A = x;
    else
      A = 0;
# ---------- end c_script_33 ----------
c_script_34 = CSharpScript(x=predict_daylight.PredictedSunlightExposure_sensor_array, y=se_threshold)  # -> out, A; inputs x: Double, y: Double; same code as c_script_28
merge_23 = Merge(Data1=end_4.Start, Data2=end_4.End, Data3=end_5.End, Data4=end_5.Start)
mcol = MeshColours(Mesh=c__0_003.A, Colours=c_script_32.A)
gradient_3 = Gradient(LowerLimit=0, UpperLimit=1, Parameter=c_script_33.A, stops=[0: RGB(171, 171, 171), 1: RGB(157, 224, 63)])
conmesh = ConstructMesh(Vertices=merge_23, Faces={A=0, B=1, C=2, D=3})  # -> simplify(Mesh)
gradient_4 = Gradient(LowerLimit=0, UpperLimit=1, Parameter=c_script_34.A, stops=[0: RGB(171, 171, 171), 1: RGB(251, 255, 0)])
fdom_3 = FindDomain(Domains=panel_33, Number=predict_daylight.PredictedMeanIlluminance_sensor_array, Strict=False)  # -> Index, Neighbour
pshift_4 = ShiftPaths(Data=conmesh, Offset=-1)
item_21 = ListItem(List=flatten(merge_22), Index=fdom_3.Index, Wrap=True)
wbjoin_3 = WeaverbirdsJoinMeshesAndWeld(Mesh=pshift_4, Weld=False)
mcol_2 = MeshColours(Mesh=c__0_003.A, Colours=gradient)
c_script_35 = CSharpScript(x=gradient_4, y=ColourSwatch(SwatchColor=RGB(70, 100, 166)))  # -> out, A; inputs x: tree of Color, y: Color; same code as c_script_32
pshift_5 = ShiftPaths(Data=wbjoin_3, Offset=-1)
c_script_36 = CSharpScript(x=gradient_3, y=ColourSwatch(SwatchColor=RGB(141, 219, 68)))  # -> out, A; inputs x: tree of Color, y: Color; same code as c_script_32
flip_4 = FlipMatrix(Data=pshift_5)
mcol_3 = MeshColours(Mesh=c__0_003.A, Colours=c_script_35.A)
mcol_4 = MeshColours(Mesh=c__0_003.A, Colours=c_script_36.A)
mcol_5 = MeshColours(Mesh=flip_4, Colours=merge_22)
mesh_7 = Mesh(mcol_5)
mesh_8 = Mesh(mcol_2)
mesh_9 = Mesh(mcol_3)
mesh_10 = Mesh(mcol_4)
mesh_11 = Mesh(mcol)
int_2 = Integer(c_script_30.A)
filter_10 = StreamFilter(Gate=int_2, Stream0=mesh_10, Stream1=mesh_9, Stream2=mesh_7, Stream3=mesh_11, Stream4=mesh_8)
mesh_12 = Mesh(filter_10)
filter_11 = StreamFilter(Gate=bool_4, Stream1=mesh_12)
Z_9 = UnitZ(Factor=Slider(0.1, range=0..10))
move_7 = Move(Geometry=filter_11, Motion=Z_9)  # -> Geometry, Transform

adjustpos_11 = AdjustElementPositioning(
    ElementsToAdjust=multichart,
    AbsolutePositioning=True,
    Width=Slider(470, range=200..500),
    Height=Slider(260, range=20..600),
    HorizontalAlignment=0,
    VerticalAlignment=0)
chartappearance_3 = ChartAppearance(ChartToModify=multichart, Colors=relay_6, Legend=True, Title=True)
adjustelem_8 = AdjustElementAppearance(
    ElementsToAdjust=multichart,
    Foreground=ColourSwatch(SwatchColor=RGB(0, 0, 0)),
    Background=ColourSwatch(SwatchColor=RGB(237, 237, 237)),
    FontSize=7)
adjustpos_12 = AdjustElementPositioning(
    ElementsToAdjust=multichart_3,
    AbsolutePositioning=True,
    Width=Slider(470, range=200..500),
    Height=number_slider_27,
    HorizontalAlignment=0,
    VerticalAlignment=0)
adjustpos_13 = AdjustElementPositioning(
    ElementsToAdjust=multichart_2,
    AbsolutePositioning=False,
    Width=Slider(470, range=200..500),
    Height=number_slider_27,
    HorizontalAlignment=0,
    VerticalAlignment=0)
number_slider_29 = Slider(13.4, range=0..20)
number_slider_30 = Slider(275, range=0..1000)
swatch_4 = ColourSwatch(SwatchColor=RGB(0, 0, 0))
swatch_5 = ColourSwatch(SwatchColor=RGB(255, 255, 255))
item_22 = ListItem(List=true_button, Index=0, Wrap=True)  # -> Item, Item1, Item2, Item3, Item4
panel_34 = Panel("""Spatial Daylight Autonomy in %
For LEED® projects, scoring varies by building type; higher scores equals more credits.
sDA300/50% (300 lux for 50% of annual hours)
40% = 1 credit
55% = 2 credits
75% = 3 credits""")
number_slider_31 = Slider(211, range=0..1000)
expander_4 = CreateExpander(UIElements=checklist_2, Header="Select Window/s", Open=Toggle(True))
number_slider_32 = Slider(13.6, range=0..20)
expander_5 = CreateExpander(UIElements=simplegrid_6, Header="Windows Count       WWR", Open=True)
panel_35 = Panel("""Aunual Sunlight Exposure in %
If ASE is > 10%, glare conditions must be addressed, or FAIL score for all LEED daylighting credits.
LEED Score (0-1)""")
panel_36 = Panel("""Useful Daylight Illuminance
Daylight illuminance levels <100 lux are generally insufficient for most tasks. 
100–300 lux is considered sufficient, but may require artificial lighting for some tasks. 
300–3000 lux is considered a desirable lighting level in most cases. 
Illuminance levels of >3000 lux are generally not usable, as this is likely to produce visual and thermal discomfort.""")
panel_37 = Panel("""Mean Illuminance in lux
The quantity of light emitted by a source that falls on a surface.
 Illuminance is measured in lux (lumens per m2)""")
scrollviewer = CreateScrollViewer(
    UIElements=expander,
    HorizontalScrollBarVisibility=2,
    VerticalScrollBarVisibility=1,
    Width=Slider(252, range=0..1000),
    Height=number_slider_30)
setexp = SetExpander()
expander_6 = CreateExpander(UIElements=flatten(merge_3), Header="Set Objects", Open=True)
adjustelem_9 = AdjustElementAppearance(ElementsToAdjust=graft(expander_2), Foreground=swatch_5, Background=swatch_4, FontSize=number_slider_29)
adjustelem_10 = AdjustElementAppearance(ElementsToAdjust=graft(expander), Foreground=swatch_5, Background=swatch_4, FontSize=number_slider_29)
expander_7 = CreateExpander(UIElements=simplegrid_7, Header="Daylight", Open=True)
sd = ShowDelay(500)
D = Duration(10000)
adjustelem_11 = AdjustElementAppearance(
    ElementsToAdjust=graft(expander_7),
    Foreground=ColourSwatch(SwatchColor=RGB(255, 255, 255)),
    Background=ColourSwatch(SwatchColor=RGB(0, 0, 0)),
    FontSize=number_slider_32)
tooltip_18 = AttachTooltipToElement(ElementsToAttachTo=item_22.Item, TooltipContent=panel_34, ShowDelay=sd, Duration=D)
tooltip_19 = AttachTooltipToElement(ElementsToAttachTo=item_22.Item1, TooltipContent=panel_35, ShowDelay=sd, Duration=D)
tooltip_20 = AttachTooltipToElement(ElementsToAttachTo=item_22.Item3, TooltipContent="Acceptable Useful Daylight Illuminance in %", ShowDelay=sd, Duration=D)
tooltip_21 = AttachTooltipToElement(ElementsToAttachTo=item_22.Item4, TooltipContent=panel_37, ShowDelay=sd, Duration=D)
tooltip_22 = AttachTooltipToElement(ElementsToAttachTo=item_22.Item2, TooltipContent=panel_36, ShowDelay=sd, Duration=D)
merge_24 = Merge(Data1=flatten(multichart), Data2=flatten(multichart_3), Data3=flatten(multichart_2))
number_slider_33 = Slider(276, range=0..1000)
number_slider_34 = Slider(209, range=0..1000)
number_slider_35 = Slider(180, range=0..300)
data_5 = Data(flatten(merge_24))
adjustpos_14 = AdjustElementPositioning(
    ElementsToAdjust=expander_2,
    AbsolutePositioning=False,
    Width=Slider(253, range=0..300),
    Height=Slider(389, range=0..500))
merge_25 = Merge(Data1=flatten(expander_2), Data2=flatten(scrollviewer))  # -> flatten(Result)
panel_38 = Panel("""1.2*
1.3*
1.3*""")
scrollviewer_2 = CreateScrollViewer(
    UIElements=expander_4,
    HorizontalScrollBarVisibility=2,
    VerticalScrollBarVisibility=0,
    Width=number_slider_31,
    Height=number_slider_33)
scrollviewer_3 = CreateScrollViewer(
    UIElements=expander_5,
    HorizontalScrollBarVisibility=2,
    VerticalScrollBarVisibility=0,
    Width=number_slider_31,
    Height=number_slider_34)
scrollviewer_4 = CreateScrollViewer(
    UIElements=expander_6,
    HorizontalScrollBarVisibility=2,
    VerticalScrollBarVisibility=0,
    Width=number_slider_31,
    Height=number_slider_35)
simplegrid_8 = CreateSimpleGrid(
    UIElements=simplify(data_5),
    Width=Slider(500, range=300..500),
    Height=Slider(540, range=0..1000),
    RowDefinitions=panel_38,
    ColumnDefinitions="Auto")  # -> flatten(SimpleGrid)
panel_39 = Panel("ENERGY LOAD (kWh/m2)  &  LOAD BALANCE (kWh/m2)                                             ")

# ---- group: RH_OUT:daylight_mesh
daylight_mesh = Mesh(move_7.Geometry)

# ----
expander_8 = CreateExpander(UIElements=simplegrid_8, Header=panel_39, Open=Toggle(False))
number_slider_36 = Slider(13.4, range=0..20)
adjustelem_12 = AdjustElementAppearance(
    ElementsToAdjust=graft(expander_8),
    Foreground=ColourSwatch(SwatchColor=RGB(255, 255, 255)),
    Background=ColourSwatch(SwatchColor=RGB(0, 0, 0)),
    FontSize=Slider(13.6, range=0..20))
swatch_6 = ColourSwatch(SwatchColor=RGB(0, 0, 0))
swatch_7 = ColourSwatch(SwatchColor=RGB(255, 255, 255))
number_slider_37 = Slider(249, range=0..300)
number_slider_38 = Slider(257, range=0..1000)
number_slider_39 = Slider(228, range=0..1000)
merge_26 = Merge(Data1=flatten(scrollviewer_4), Data2=flatten(scrollviewer_3), Data3=flatten(scrollviewer_2))  # -> flatten(Result)
adjustelem_13 = AdjustElementAppearance(ElementsToAdjust=graft(expander_6), Foreground=swatch_7, Background=swatch_6, FontSize=number_slider_36)
adjustelem_14 = AdjustElementAppearance(ElementsToAdjust=graft(expander_5), Foreground=swatch_7, Background=swatch_6, FontSize=number_slider_36)
adjustelem_15 = AdjustElementAppearance(ElementsToAdjust=graft(expander_4), Foreground=swatch_7, Background=swatch_6, FontSize=number_slider_36)
merge_27 = Merge(Data1=number_slider_37)
merge_28 = Merge(Data1=number_slider_35, Data2=number_slider_34, Data3=number_slider_33)
merge_29 = Merge(Data1=Slider(324, range=0..1000))
merge_30 = Merge(Data1=Slider(389, range=0..1000), Data2=number_slider_30)
relay_7 = Relay([Slider(0, range=0..2), Slider(1, range=0..2), Slider(2, range=0..2)])
relay_8 = Relay([Slider(0, range=0..2), Slider(0, range=0..2), Slider(0, range=0..2)])
relay_9 = Relay([Slider(0, range=0..2), Slider(1, range=0..2)])
relay_10 = Relay([Slider(0, range=0..2), Slider(0, range=0..2)])
grid_2 = CreateGrid(
    UIElements=merge_26,
    Width=number_slider_37,
    Height=Slider(1055, range=0..7000),
    RowDefinitions=flatten(merge_28),
    ColumnDefinitions=flatten(merge_27),
    ElementRow=relay_7,
    ElementColumn=relay_8,
    ElementRowSpan=2,
    ElementColumnSpan=1)
grid_3 = CreateGrid(
    UIElements=merge_25,
    Width=Slider(257, range=0..5000),
    Height=Slider(1232, range=0..7000),
    RowDefinitions=flatten(merge_30),
    ColumnDefinitions=flatten(merge_29),
    ElementRow=relay_9,
    ElementColumn=relay_10,
    ElementRowSpan=2,
    ElementColumnSpan=1)
merge_31 = Merge(Data1=grid_2, Data2=grid_3)
adjustelem_16 = AdjustElementAppearance(
    ElementsToAdjust=merge_31,
    Foreground=ColourSwatch(SwatchColor=RGB(0, 0, 0)),
    Background=ColourSwatch(SwatchColor=RGB(255, 255, 255)),
    FontSize=Slider(10, range=0..10))
merge_32 = Merge(Data1=Slider(663, range=0..1000))
merge_33 = Merge(Data1=Slider(215, range=0..1000), Data2=Slider(266, range=0..1000))
relay_11 = Relay([Slider(0, range=0..2), Slider(0, range=0..2), Slider(0, range=0..2)])
relay_12 = Relay([Slider(0, range=0..2), Slider(1, range=0..2), Slider(2, range=0..2)])
grid_4 = CreateGrid(
    UIElements=merge_31,
    Width=Slider(3508, range=0..5000),
    Height=Slider(740, range=0..7000),
    RowDefinitions=flatten(merge_32),
    ColumnDefinitions=flatten(merge_33),
    ElementRow=relay_11,
    ElementColumn=relay_12,
    ElementRowSpan=2,
    ElementColumnSpan=1)
merge_34 = Merge(
    Data1=Slider(40, range=0..1000),
    Data2=Slider(68, range=0..1000),
    Data3=Slider(90, range=0..1000),
    Data4=Slider(569, range=0..1000))
relay_13 = Relay([Slider(0, range=0..2), Slider(1, range=0..2), Slider(2, range=0..2), Slider(3, range=0..3)])
relay_14 = Relay([Slider(0, range=0..2), Slider(0, range=0..2), Slider(0, range=0..2), Slider(0, range=0..2)])
merge_35 = Merge(Data1=Slider(473, range=0..1000))
merge_36 = Merge(Data1=Slider(670, range=0..1000), Data2=Slider(106, range=0..1000))
relay_15 = Relay([Slider(0, range=0..2), Slider(1, range=0..2)])
relay_16 = Relay([Slider(0, range=0..2), Slider(0, range=0..2)])
merge_37 = Merge(Data1=grid_4, Data2=expander_3)  # -> flatten(Result)
grid_5 = CreateGrid(
    UIElements=merge_37,
    Width=Slider(472, range=0..5000),
    Height=Slider(1052, range=0..7000),
    RowDefinitions=flatten(merge_36),
    ColumnDefinitions=flatten(merge_35),
    ElementRow=relay_15,
    ElementColumn=relay_16,
    ElementRowSpan=2,
    ElementColumnSpan=1)
adjustelem_17 = AdjustElementAppearance(ElementsToAdjust=grid_5, Background=ColourSwatch(SwatchColor=RGB(255, 255, 255)))
panel_40 = Panel("\"Amber\", \"Blue\", \"Brown\", \"Cobalt\", \"Crimson\", \"Cyan\", \"Emerald\", \"Green\", \"Indigo\", \"Lime\", \"Magenta\", \"Mauve\", \"Olive\", \"Orange\", \"Pink\", \"Purple\", \"Red\", \"Sienna\", \"Steel\", \"Taupe\", \"Teal\", \"Violet\", \"Yellow\"")
split_7 = TextSplit(Text=panel_40, Separators=", ")
split_8 = TextSplit(Text=split_7, Separators="\"\"")
lng_8 = ListLength(List=split_8)
larger_3 = LargerThan(FirstNumber=lng_8, SecondNumber=2)  # -> LargerThan, OrEqualTo
cull_5 = CullPattern(List=split_8, CullPattern=larger_3.LargerThan)
launchwin = LaunchWindow(
    Show=Toggle(True),
    Name="Dashboard",
    Width=Slider(967, range=0..1000),
    Height=Slider(820, range=0..4000),
    FontFamily="Arial",
    ChildStatus=0,
    EnableHorizScroll=False)
clean_4 = CleanTree(RemoveNulls=True, RemoveInvalid=True, RemoveEmpty=True, Tree=cull_5)
merge_38 = Merge(Data1=Slider(768, range=0..1000))
merge_39 = Merge(Data1=Slider(476, range=0..1000), Data2=Slider(640, range=0..1000))
create_accent_list = ValueList({"One": 1, "Two": 2, "Three": 2² - 1, "Four": Sqrt(16)}, selected="Two")
relay_17 = Relay([Slider(0, range=0..2), Slider(0, range=0..2)])
relay_18 = Relay([Slider(0, range=0..2), Slider(1, range=0..2)])
item_23 = ListItem(List=clean_4, Index=1, Wrap=True)  # -> flatten(Item)
item_24 = ListItem(List=item_23, Index=Slider(11, range=0..23), Wrap=True)
winprops = SetWindowProperties(
    Window=launchwin,
    AccentColor=item_24,
    ShowTitleBar=True,
    BackgroundColor=ColourSwatch(SwatchColor=RGB(255, 255, 255)),
    ScaleFactor=1)

# ---- group: Wall construction making
searchconstrs_3 = HBSearchConstructions(keywords="typical insulated steel framed R5")  # -> opaque_constrs, window_constrs, shade_constrs; plug-in component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
i_am_using_this_typical_assembly_as_the_3 = Panel(searchconstrs_3.opaque_constrs)  # "I am using this typical assembly as the starting point"
expression_5 = Expression(x=values_9.Values, Expression="max(x - 0.329761-1, 1)")
decnstrconstr_7 = HBDeconstructConstruction(constr=searchconstrs_3.opaque_constrs)  # -> materials, layers, r_val_si, r_val_ip, u_fac_si, u_fac_ip, shgc, t_sol, t_vis; plug-in component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
example_wall_r_value = Panel(decnstrconstr_7.r_val_ip)
rip2rsi_6 = Ladybug_rIP2rSI(R_IP=expression_5)  # -> R_SI; plug-in component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
panel_41 = Panel(decnstrconstr_7.layers)
bang_6 = ExplodeTree(Data=graft(decnstrconstr_7.layers))  # -> _0000, _0001, _0002, _0003
decnstrmat_3 = HBDeconstructMaterial(mat=bang_6._0002)  # -> values, attr_names, r_val_si, r_val_ip; plug-in component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
bang_7 = ExplodeTree(Data=graft(decnstrmat_3.values))  # -> _000200, _000201, _000202, _000203, _000204, _000205

# ----
expression_6 = Expression(x=expression_5, Expression="Format(\"insulation-R{0}\", x)")

# ---- group: Wall construction making (continued)
opaquematnomass_6 = HBOpaqueMaterialNoMass(
    name=expression_6,
    r_value=rip2rsi_6,
    roughness=bang_7._000201,
    therm_absp=bang_7._000203,
    sol_absp=bang_7._000204,
    vis_absp=bang_7._000205)  # -> mat; plug-in component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
merge_40 = Merge(Data1=bang_6._0000, Data2=bang_6._0001, Data3=opaquematnomass_6, Data4=bang_6._0003)  # -> flatten(Result)
opaqueconstr_6 = HBOpaqueConstruction(name=give_a_name_to_the_new_wall, materials=merge_40)  # -> constr; plug-in component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
decnstrconstr_8 = HBDeconstructConstruction(constr=opaqueconstr_6)  # -> materials, layers, r_val_si, r_val_ip, u_fac_si, u_fac_ip, shgc, t_sol, t_vis; plug-in component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

# ---- group: Wall construction making / the new wall construction and its new R value
new_wall_r_value = Panel(decnstrconstr_8.r_val_ip)

# ----
exteriorsubset_2 = HBExteriorConstructionSubset(exterior_wall=opaqueconstr_6, exterior_roof=opaqueconstr_2, exposed_floor=opaqueconstr)  # -> exterior_set; plug-in component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
constructionset_2 = HBConstructionSet(
    name=panel_13,
    exterior_subset=exteriorsubset_2,
    ground_subset=groundsubset,
    interior_subset=interiorsubset,
    subface_subset=subfacesubset)  # -> constr_set; plug-in component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
decnstrconstrset = HBDeconstructConstructionSet(constr_set=constructionset_2)  # -> exterior_wall, exterior_roof, exposed_floor, ground_wall, ground_roof, ground_floor, window, skylight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; plug-in component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
decnstrconstr_9 = HBDeconstructConstruction(constr=decnstrconstrset.exterior_wall)  # -> materials, layers, r_val_si, r_val_ip, u_fac_si, u_fac_ip, shgc, t_sol, t_vis; plug-in component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
decnstrconstr_10 = HBDeconstructConstruction(constr=decnstrconstrset.exterior_roof)  # -> materials, layers, r_val_si, r_val_ip, u_fac_si, u_fac_ip, shgc, t_sol, t_vis; plug-in component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
decnstrconstr_11 = HBDeconstructConstruction(constr=decnstrconstrset.ground_floor)  # -> materials, layers, r_val_si, r_val_ip, u_fac_si, u_fac_ip, shgc, t_sol, t_vis; plug-in component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
decnstrconstr_12 = HBDeconstructConstruction(constr=decnstrconstrset.exposed_floor)  # -> materials, layers, r_val_si, r_val_ip, u_fac_si, u_fac_ip, shgc, t_sol, t_vis; plug-in component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
decnstrconstr_13 = HBDeconstructConstruction(constr=decnstrconstrset.window)  # -> materials, layers, r_val_si, r_val_ip, u_fac_si, u_fac_ip, shgc, t_sol, t_vis; plug-in component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
panel_42 = Panel(decnstrconstr_10.r_val_ip)
panel_43 = Panel(decnstrconstr_9.r_val_ip)
panel_44 = Panel(decnstrconstr_12.r_val_ip)
panel_45 = Panel(decnstrconstr_11.r_val_ip)
panel_46 = Panel(decnstrconstr_13.u_fac_ip)
panel_47 = Panel(decnstrconstr_13.shgc)
room = HBRoom(
    faces=flatten(clean_3),
    name="Hospital Shoe Box",
    constr_set=constructionset_2,
    program=values_3.Values,
    conditioned=True)  # -> report, room; plug-in component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
annualloads = HBAnnualLoads(rooms=flatten(room.room), epw_file=downloadepw.epw_file, run_bal=Toggle(True), run=bool_5)  # -> report, total_load, cooling, heating, lighting, equip, process, hot_water, balance; plug-in component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
item_25 = ListItem(List=annualloads.total_load, Index=[0, 1, 2, 3], Wrap=True)

# ----
# Evaluate Total Load
ma_5 = MassAddition(Input=annualloads.total_load)  # -> Result, PartialResults
panel_48 = Panel(item_25)
total_load_intensity_kwh_m2 = Panel(ma_5.Result)
panel_49 = Panel("""cooling
heating
lighting
equipment""")

data_6 = Data(flatten([annualloads.cooling, annualloads.heating, annualloads.lighting, annualloads.equip, annualloads.hot_water]))

# ----
# Visualize Monthly Load
monthly_loads = Data(data_6)
swatch_8 = ColourSwatch(SwatchColor=RGB(255, 121, 0))  # disabled
swatch_9 = ColourSwatch(SwatchColor=RGB(255, 255, 0))  # disabled
swatch_10 = ColourSwatch(SwatchColor=RGB(4, 25, 145))  # disabled
swatch_11 = ColourSwatch(SwatchColor=RGB(153, 16, 0))  # disabled
panel_50 = Panel("30")  # disabled
panel_51 = Panel("0")  # disabled
panel_52 = Panel("2")  # disabled
legendpar = LBLegendParameters(max=panel_50, colors=[swatch_10, swatch_11, swatch_9, swatch_8], num_decimals=panel_51, text_height=panel_52)  # -> leg_par; disabled; plug-in component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
toggle_7 = BooleanToggle(True)  # disabled
panel_53 = Panel("40,0,0")  # disabled
monthlychart = LBMonthlyChart(data=monthly_loads, base_pt=panel_53, stack=toggle_7, legend_par=legendpar)  # -> report, data_mesh, data_lines, col_lines, legend, borders, labels, y_title, title, vis_set; disabled; plug-in component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

# ----
# Visualize Load Balance
monthly_loads_2 = Data(annualloads.balance)
panel_54 = Panel("19")  # disabled
colrange_2 = LBColorRange(index=panel_54)  # -> colors; disabled; plug-in component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
panel_55 = Panel("2")  # disabled
neg_3 = Negative(Value=panel_50)  # disabled
panel_56 = Panel("0")  # disabled
legendpar_2 = LBLegendParameters(min=neg_3, max=panel_50, colors=colrange_2, num_decimals=panel_56, text_height=panel_55)  # -> leg_par; disabled; plug-in component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
toggle_8 = BooleanToggle(True)  # disabled
panel_57 = Panel("40,-90,0")  # disabled
monthlychart_2 = LBMonthlyChart(data=monthly_loads_2, base_pt=panel_57, y_dim=panel_18, stack=toggle_8, legend_par=legendpar_2)  # -> report, data_mesh, data_lines, col_lines, legend, borders, labels, y_title, title, vis_set; disabled; plug-in component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

custom_round_10 = CustomRound(Numbers=total_load_intensity_kwh_m2, Scope=Slider(0.1, range=0..1))
xdata = LBDeconstructData(data=monthly_loads_2)  # -> out, header, values; plug-in component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
xdata_2 = LBDeconstructData(data=monthly_loads)  # -> out, header, values; plug-in component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
c_script_37 = CSharpScript(x=bool_5, y=xdata.values)  # -> out, A; inputs y: tree of Double
# ---------- c_script_37: C# ----------
    A = y;
# ---------- end c_script_37 ----------
split_9 = TextSplit(Text=xdata.header, Separators=" ")  # -> reverse(Result)
c_script_38 = CSharpScript(x=bool_5, y=xdata_2.values)  # -> out, A; inputs y: tree of Double; same code as c_script_37
item_26 = ListItem(List=split_9, Index=0, Wrap=True)  # -> flatten(Item)
custom_round_11 = CustomRound(Numbers=c_script_37.A, Scope=number_slider_23)
flip_5 = FlipMatrix(Data=custom_round_11)  # -> simplify(Data)
custom_round_12 = CustomRound(Numbers=c_script_38.A, Scope=Slider(0.1, range=0..1))
c_script_39 = CSharpScript(x=item_26, y=split_3.ListA)  # -> out, A; inputs x: list of String, y: String
# ---------- c_script_39: C# ----------
    int a =0 ;
    for(int i = 0 ;i < x.Count ;i++)
    {
      if(x[i] == y)
        a = i;
    }
    A = a;
# ---------- end c_script_39 ----------
c_script_40 = CSharpScript(x=item_26, y=split_3.ListB)  # -> out, A; inputs x: list of String, y: String; same code as c_script_39
flip_6 = FlipMatrix(Data=custom_round_12)
item_27 = ListItem(List=flip_5, Index=c_script_40.A, Wrap=True)
item_28 = ListItem(List=flip_5, Index=c_script_39.A, Wrap=True)
lng_9 = ListLength(List=c_script_39.A)
num_11 = Number(item_28)
lng_10 = ListLength(List=c_script_40.A)
custom_round_13 = CustomRound(Numbers=item_25, Scope=Slider(0.1, range=0..1))
series_4 = Series(Start=0, Step=1, Count=lng_9)
abs_2 = Absolute(Value=item_27)
series_5 = Series(Start=0, Step=1, Count=lng_10)
replace_2 = ReplaceItems(List=flip_3, Item=flip_6, Indices=series_3, Wrap=False)  # -> simplify(List)
replace_3 = ReplaceItems(List=split_5.ListA, Item=num_11, Indices=series_4, Wrap=False)
replace_4 = ReplaceItems(List=split_5.ListB, Item=abs_2, Indices=series_5, Wrap=False)  # -> simplify(List)
datatable = CreateDataTable(Data=graft(panel_27), ColumnHeadings=panel_49, AllowSorting=False, ColumnSizingMode=Slider(114, range=100..130))
panel_58 = Panel(replace_3)
expander_9 = CreateExpander(UIElements=datatable, Header=panel_30, Open=True)
format_6 = Format(Format=panel_31, Culture=127, Data0=panel_30, Data1=custom_round_10)
adjustpos_15 = AdjustElementPositioning(
    ElementsToAdjust=datatable,
    Margin=neg_2,
    AbsolutePositioning=True,
    Width=number_slider_25,
    Height=Slider(47, range=0..1000))
setdatatable = SetDataTable(DataTableToSet=datatable, Data=graft(custom_round_13))
setmultichart = SetMultiChartContents(ChartToModify=multichart, NewChartValues=simplify(replace_2))
setmultichart_2 = SetMultiChartContents(ChartToModify=multichart_3, NewChartValues=simplify(replace_3))
setmultichart_3 = SetMultiChartContents(ChartToModify=multichart_2, NewChartValues=simplify(replace_4))
setexp_2 = SetExpander(Expander=expander_9, Name=format_6)
adjustelem_18 = AdjustElementAppearance(
    ElementsToAdjust=graft(expander_9),
    Foreground=ColourSwatch(SwatchColor=RGB(255, 255, 255)),
    Background=ColourSwatch(SwatchColor=RGB(0, 0, 0)),
    FontSize=number_slider_32)
merge_41 = Merge(Data1=flatten(simplegrid_5), Data2=flatten(expander_7), Data3=flatten(expander_9), Data4=flatten(expander_8))  # -> flatten(Result)
grid_6 = CreateGrid(
    UIElements=merge_41,
    Width=Slider(469, range=0..5000),
    Height=Slider(1128, range=0..7000),
    RowDefinitions=flatten(merge_34),
    ColumnDefinitions=flatten(Slider(600, range=0..1000)),
    ElementRow=relay_13,
    ElementColumn=relay_14,
    ElementRowSpan=2,
    ElementColumnSpan=1)
merge_42 = Merge(Data1=flatten(grid_5), Data2=flatten(grid_6))
grid_7 = CreateGrid(
    UIElements=merge_42,
    Width=Slider(964, range=0..5000),
    Height=Slider(760, range=600..800),
    RowDefinitions=flatten(merge_38),
    ColumnDefinitions=flatten(merge_39),
    ElementRow=relay_17,
    ElementColumn=relay_18,
    ElementRowSpan=2,
    ElementColumnSpan=1)
addelems = AddElements(Window=launchwin, Elements=flatten(grid_7), DoVLChecking=True)  # -> AddedElements, ElementNames
