# Grasshopper definition daylight_surrogate_eval-northClaytonCorner.gh (Grasshopper 1.0.7)
# plug-ins: ClimateStudioGH, PW_AI, ShapeDiverForGrasshopper

sddp = ShapeDiverDocumentPayload({AbsoluteTolerance=0, AngleTolerance=0, DistanceDisplayPrecision=0, GltfVersion="Gltf2", GrasshopperVersion="1.0.0007", InputGroups="{}", OutputGroups="{}", RelativeTolerance=0, RhinoVersion="7.29.23107.3001", UnitSystem=0, VersionCreated="1.15.0.0", VersionSaved="1.15.0.0"})

# ---- group: propeller
mullion_spacing = Panel("1.51")
mullion_depth = Panel("0.314")
analysis_plane_surface = Geometry(<brep referenced from the Rhino model>)
ceiling = Geometry([<mesh referenced from the Rhino model> x265])
mullions = Geometry([<mesh referenced from the Rhino model> x5000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])
floor = Geometry([<mesh referenced from the Rhino model> x147])
walls = Geometry([<mesh referenced from the Rhino model> x883])
glazing = Geometry([<mesh referenced from the Rhino model> x2512])
mjoin = MeshJoin(Meshes=mullions)

# ---- group: corner
analysis_plane_surface_2 = Geometry(<brep referenced from the Rhino model>)
fin_spacing = Panel("""1.812
22
22""")
fin_depth = Panel("""0.762
10
7""")
louver_spacing = Panel("""7
7
7""")
glazing_northwest = Geometry([<brep referenced from the Rhino model> x19])
louver_depth = Panel("""0
13
8""")
mullions_corner = Geometry([<brep referenced from the Rhino model> x175])
glazing_south = Geometry([<brep referenced from the Rhino model> x98])
ceiling_2 = Geometry(<brep referenced from the Rhino model>)
floor_2 = Geometry([<brep referenced from the Rhino model> x19])
walls_2 = Geometry([<brep referenced from the Rhino model> x66])
glazing_2 = Geometry([<brep referenced from the Rhino model> x619])

# ---- group: ground
area = Area(Geometry=analysis_plane_surface_2)  # -> Area, Centroid
Z = UnitZ(Factor="-5")
move = Move(Geometry=area.Centroid, Motion=Z)  # -> Geometry, Transform
xy = XYPlane(Origin=move.Geometry)
planesrf = PlaneSurface(Plane=xy, XSize="-1000 To 1000", YSize="-1000 To 1000")

# ----
mesh = Mesh(glazing_2)
mesh_2 = Mesh(glazing_south)
mesh_3 = Mesh(glazing_northwest)
mjoin_2 = MeshJoin(Meshes=mesh)
mjoin_3 = MeshJoin(Meshes=mesh_2)
mjoin_4 = MeshJoin(Meshes=mesh_3)
mjoin_5 = MeshJoin(Meshes=mullions_corner)
relay = Relay([walls_2, mjoin_5])
merge = Merge(Data1=mjoin_2, Data2=mjoin_3, Data3=mjoin_4)

# ---- group: analysis grid
Z_2 = UnitZ(Factor="0.762")
move_2 = Move(Geometry=analysis_plane_surface_2, Motion=Z_2)  # -> Geometry, Transform
c__0_003 = CSharpScript(gridSurface=move_2.Geometry, spacing=0.6096, offset="0.0254 * 18", complex=Toggle(True))  # -> out, A, B, nU, nV, E; inputs gridSurface: Brep, spacing: Double, offset: Double, complex: Boolean
# ---------- c__0_003: C# ----------
    Surface srf = gridSurface.Faces[0];

    double width = 0.0;
    double depth = 0.0;
    srf.GetSurfaceSize(out width, out depth);

    srf.SetDomain(0, new Interval(0, width));
    srf.SetDomain(1, new Interval(0, depth));

    int n_usteps = (int) (0.999999999 + (width - 2.0 * offset) / spacing);
    int n_vsteps = (int) (0.999999999 + (depth - 2.0 * offset) / spacing);
    double u_spacing = (width - 2.0 * offset) / n_usteps;
    double v_spacing = (depth - 2.0 * offset) / n_vsteps;

    Mesh m = new Mesh();

    for (int i = 0; i < n_usteps + 1; ++i) {
      for (int j = 0; j < n_vsteps + 1; ++j) {
        Point3d pt;
        Vector3d[] vv;
        srf.Evaluate(offset + i * u_spacing, offset + j * v_spacing, 0, out pt, out vv);
        m.Vertices.Add(pt.X, pt.Y, pt.Z);
      }
    }

    for (int j = 0; j < n_usteps ; ++j) {
      for (int i = 0; i < n_vsteps ; ++i) {
        m.Faces.AddFace(new MeshFace(i + j * (n_vsteps + 1), i + (j + 1) * (n_vsteps + 1), i + (j + 1) * (n_vsteps + 1) + 1, i + j * (n_vsteps + 1) + 1));
      }
    }


    // filter vertices outside of the trimmed surface
    if (complex) {
      bool[] validVertices = new bool[m.Vertices.Count];
      for (int i = 0; i < validVertices.Length; ++i) {
        validVertices[i] = false;
      }

      for (int i = 0; i < m.Vertices.Count; ++i) {
        foreach (BrepFace face in  gridSurface.Faces) {
          if (!face.IsValid) continue;

          double u, v;
          face.ClosestPoint(m.Vertices[i], out u, out v);
          PointFaceRelation pfr = face.IsPointOnFace(u, v);
          if (pfr == PointFaceRelation.Interior) {
            validVertices[i] = true;
            break;
          }
        }
      }

      List<int> cullVertices = new List<int>();
      for (int i = 0; i < validVertices.Length; ++i) {
        if (!validVertices[i]) {
          cullVertices.Add(i);
        }
      }

      m.Vertices.Remove(cullVertices, true);
    }

    m.RebuildNormals();


    A = m;
    B = m.Vertices;
    nU = n_usteps;
    nV = n_vsteps;
    E = srf;
# ---------- end c__0_003 ----------

# ----
number_slider = Slider(0.7, range=0..1)
number_slider_2 = Slider(0.2, range=0..1)
number_slider_3 = Slider(0.5, range=0..1)
number_slider_4 = Slider(0.6, range=0..1)
number_slider_5 = Slider(1, range=0..1)
box = CenterBox(Base=PlaneXY(0, 0, 0), X=1, Y=1, Z=1)
toggle = BooleanToggle(True)
toggle_2 = BooleanToggle(True)
predict_daylight = PredictDaylightMetricsFromGeometryAndMaterialInputsPWAIV02(
    SensorsPositions=c__0_003.B,
    CeilingGeometries=ceiling_2,
    FloorGeometries=floor_2,
    WallsGeometries=relay,
    GlazingGeometries=merge,
    GroundSurface=planesrf,
    CeilingReflectance=number_slider,
    FloorReflectance=number_slider_2,
    WallsReflectance=number_slider_3,
    GlazingTransparency=number_slider_4,
    ShadingDeviceDepth=fin_depth,
    ShadingDeviceSpacing=fin_spacing,
    ShadingDeviceType=Slider(0, range=0..1),
    ComputeSolution=Toggle(True),
    PredictDA=toggle,
    PredictSE=toggle,
    PredictMI=toggle,
    PredictUDI=toggle,
    NumberOfThreads=-1,
    ProduceAdditionalDataForDebugging=toggle_2,
    IndexOfSensorToDebug=0,
    City="Atlanta")  # -> PredictedDaylightAutonomy_sensor_array, PredictedSunlightExposure_sensor_array, PredictedMeanIlluminance_sensor_array, PredictedUsefulDaylightIlluminanceFailing_sensor_array, PredictedUsefulDaylightIlluminanceSupplementary_sensor_array, PredictedUsefulDaylightIlluminanceAcceptable_sensor_array, PredictedUsefulDaylightIlluminanceExcessive_sensor_array, Rays
number_slider_6 = Slider(0.6096, range=0..1)
item = ListItem(List=c__0_003.B, Index=Slider(0, range=0..21602), Wrap=True)
toggle_3 = BooleanToggle(True)
toggle_4 = BooleanToggle(True)
data = Data(c__0_003.B)

predict_daylight_2 = PredictDaylightMetricsFromGeometryAndMaterialInputsPWAIV02(
    SensorsPositions=c__0_003.B,
    CeilingGeometries=ceiling_2,
    FloorGeometries=floor_2,
    WallsGeometries=relay,
    GlazingGeometries=merge,
    SurroundingGeometries=box,
    GroundSurface=planesrf,
    CeilingReflectance=number_slider,
    FloorReflectance=number_slider_2,
    WallsReflectance=number_slider_3,
    GlazingTransparency=number_slider_4,
    ShadingDeviceDepth=louver_depth,
    ShadingDeviceSpacing=louver_spacing,
    ShadingDeviceType=Slider(1, range=0..1),
    ComputeSolution=Toggle(False),
    PredictDA=toggle,
    PredictSE=toggle,
    PredictMI=toggle,
    PredictUDI=toggle,
    NumberOfThreads=-1,
    ProduceAdditionalDataForDebugging=toggle_2,
    IndexOfSensorToDebug=0,
    City="Atlanta")  # -> PredictedDaylightAutonomy_sensor_array, PredictedSunlightExposure_sensor_array, PredictedMeanIlluminance_sensor_array, PredictedUsefulDaylightIlluminanceFailing_sensor_array, PredictedUsefulDaylightIlluminanceSupplementary_sensor_array, PredictedUsefulDaylightIlluminanceAcceptable_sensor_array, PredictedUsefulDaylightIlluminanceExcessive_sensor_array, Rays
c__min = CSharpScript(x=predict_daylight.PredictedDaylightAutonomy_sensor_array, y=predict_daylight_2.PredictedDaylightAutonomy_sensor_array)  # -> out, A; inputs x: list of Double, y: list of Double
# ---------- c__min: C# ----------
    
    if (x.Count == y.Count) {
      List<double> vv = new List<double> ();
    
      for (int i = 0; i < x.Count; ++i) {
        vv.Add(Math.Min(x[i], y[i]));
      }
      A = vv;
    }
# ---------- end c__min ----------
c__min_2 = CSharpScript(x=predict_daylight.PredictedSunlightExposure_sensor_array, y=predict_daylight_2.PredictedSunlightExposure_sensor_array)  # -> out, A; inputs x: list of Double, y: list of Double; same code as c__min
c__min_3 = CSharpScript(
    x=predict_daylight.PredictedUsefulDaylightIlluminanceExcessive_sensor_array,
    y=predict_daylight_2.PredictedUsefulDaylightIlluminanceExcessive_sensor_array)  # -> out, A; inputs x: list of Double, y: list of Double; same code as c__min
c__max = CSharpScript(
    x=predict_daylight.PredictedUsefulDaylightIlluminanceAcceptable_sensor_array,
    y=predict_daylight_2.PredictedUsefulDaylightIlluminanceAcceptable_sensor_array)  # -> out, A; inputs x: list of Double, y: list of Double
# ---------- c__max: C# ----------
    if (x.Count == y.Count) {
      List<double> vv = new List<double> ();

      for (int i = 0; i < x.Count; ++i) {
        vv.Add(Math.Max(x[i], y[i]));
      }
      A = vv;
    }
# ---------- end c__max ----------
c__max_2 = CSharpScript(
    x=predict_daylight.PredictedUsefulDaylightIlluminanceFailing_sensor_array,
    y=predict_daylight_2.PredictedUsefulDaylightIlluminanceFailing_sensor_array)  # -> out, A; inputs x: list of Double, y: list of Double; same code as c__max
c__min_4 = CSharpScript(
    x=predict_daylight.PredictedUsefulDaylightIlluminanceSupplementary_sensor_array,
    y=predict_daylight_2.PredictedUsefulDaylightIlluminanceSupplementary_sensor_array)  # -> out, A; inputs x: list of Double, y: list of Double; same code as c__min
c__mean = CSharpScript(
    x=predict_daylight.PredictedUsefulDaylightIlluminanceSupplementary_sensor_array,
    y=predict_daylight_2.PredictedUsefulDaylightIlluminanceSupplementary_sensor_array)  # -> out, A; inputs x: list of Double, y: list of Double
# ---------- c__mean: C# ----------
    if (x.Count == y.Count) {
      List<double> vv = new List<double> ();

      for (int i = 0; i < x.Count; ++i) {
        vv.Add(0.5 * (x[i] + y[i]));
      }
      A = vv;
    }
# ---------- end c__mean ----------
c__mean_2 = CSharpScript(
    x=predict_daylight.PredictedUsefulDaylightIlluminanceAcceptable_sensor_array,
    y=predict_daylight_2.PredictedUsefulDaylightIlluminanceAcceptable_sensor_array)  # -> out, A; inputs x: list of Double, y: list of Double; same code as c__mean
avr = Average(Input=c__mean_2.A)
c__udi_viz = CSharpScript(
    points=data,
    maxSide=number_slider_6,
    UDIf=c__max_2.A,
    UDIs=c__mean.A,
    UDIa=c__mean_2.A,
    UDIe=c__min_3.A,
    normalize=toggle_4,
    cumulative=toggle_3)  # -> out, M; inputs points: list of Point3d, maxSide: Double, UDIf: list of Double, UDIs: list of Double, UDIa: list of Double, UDIe: list of Double, normalize: Boolean, cumulative: Boolean
# ---------- c__udi_viz: C# usings ----------
using System.Drawing;
# ---------- c__udi_viz: C# ----------
    if (normalize) {
      for (int i = 0; i < UDIf.Count; ++i) {
        double sum = UDIf[i] + UDIs[i] + UDIa[i] + UDIe[i];
        double factor = 1 / sum;
        UDIf[i] *= factor;
        UDIs[i] *= factor;
        UDIa[i] *= factor;
        UDIe[i] *= factor;
      }
    }

    Color cf = Color.FromArgb(69, 130, 173);
    Color cs = Color.FromArgb(122, 194, 169);
    Color ca = Color.FromArgb(184, 234, 122);
    Color ce = Color.FromArgb(252, 163, 255);

    List<Mesh> mm = new List<Mesh> ();

    if (cumulative) {
      for (int i = 0; i < UDIf.Count; ++i) {
        UDIs[i] += UDIf[i];
        UDIa[i] += UDIs[i];
        UDIe[i] += UDIa[i];
      }
    }

    mm.Add(UDIMesh(points, UDIf, maxSide, 0.0, cf, 0.0));
    mm.Add(UDIMesh(points, UDIs, maxSide, -0.01, cs, 0.0));
    mm.Add(UDIMesh(points, UDIa, maxSide, -0.02, ca, 0.0));
    mm.Add(UDIMesh(points, UDIe, maxSide, -0.03, ce, 0.0));

    M = mm;
# ---------- c__udi_viz: C# additional code ----------
  public Mesh UDIMesh(List<Point3d> points, List<double> values, double maxSide, double offsetZ, Color color, double sideThreshold) {

    if (points.Count != values.Count) {
      return new Mesh();
    }

    Mesh mesh = new Mesh();

    for (int i = 0; i < points.Count; ++i) {
      double hs = 0.5 * maxSide * values[i];

      mesh.Vertices.Add(points[i].X - hs, points[i].Y + hs, points[i].Z + offsetZ);
      mesh.Vertices.Add(points[i].X - hs, points[i].Y - hs, points[i].Z + offsetZ);
      mesh.Vertices.Add(points[i].X + hs, points[i].Y - hs, points[i].Z + offsetZ);
      mesh.Vertices.Add(points[i].X + hs, points[i].Y + hs, points[i].Z + offsetZ);

      mesh.Faces.AddFace(new MeshFace(i * 4, i * 4 + 1, i * 4 + 2, i * 4 + 3));
    }


    Color[] cc = new Color[mesh.Vertices.Count];
    for (int i = 0; i < cc.Length; ++i) {
      cc[i] = color;
    }
    mesh.VertexColors.SetColors(cc);
    mesh.RebuildNormals();
    return mesh;

  }
# ---------- end c__udi_viz ----------
panel = Panel(avr)

larger = LargerThan(FirstNumber=predict_daylight.PredictedSunlightExposure_sensor_array, SecondNumber=250)  # -> LargerThan, OrEqualTo
larger_2 = LargerThan(FirstNumber=predict_daylight.PredictedDaylightAutonomy_sensor_array, SecondNumber=0.5)  # -> LargerThan, OrEqualTo
python = GhPythonScript(
    f=predict_daylight.PredictedUsefulDaylightIlluminanceFailing_sensor_array,
    s=predict_daylight.PredictedUsefulDaylightIlluminanceSupplementary_sensor_array,
    a=predict_daylight.PredictedUsefulDaylightIlluminanceAcceptable_sensor_array,
    e=predict_daylight.PredictedUsefulDaylightIlluminanceExcessive_sensor_array)  # -> out, v; inputs f: list, s: list, a: list, e: list
# ---------- python: Python ----------
__author__ = "AmpanavosS"
__version__ = "2023.11.02"

import rhinoscriptsyntax as rs

values = []

for i in range(len(f)):
    if f[i] > s[i] and f[i] > a[i] and f[i] > e[i]:
        values.append(0)
    elif s[i] > f[i] and s[i] > a[i] and s[i] > e[i]:
        values.append(0.25)
    elif a[i] > f[i] and a[i] > s[i] and a[i] > e[i]:
        values.append(0.5)
    elif e[i] > f[i] and e[i] > s[i] and e[i] > a[i]:
        values.append(0.5)
    else:
        print("error at index " + str(i))
        
v = values
# ---------- end python ----------
c__udi_viz_2 = CSharpScript(
    points=data,
    maxSide=number_slider_6,
    UDIf=predict_daylight.PredictedUsefulDaylightIlluminanceFailing_sensor_array,
    UDIs=predict_daylight.PredictedUsefulDaylightIlluminanceSupplementary_sensor_array,
    UDIa=predict_daylight.PredictedUsefulDaylightIlluminanceAcceptable_sensor_array,
    UDIe=predict_daylight.PredictedUsefulDaylightIlluminanceExcessive_sensor_array,
    normalize=toggle_4,
    cumulative=toggle_3)  # -> out, M; inputs points: list of Point3d, maxSide: Double, UDIf: list of Double, UDIs: list of Double, UDIa: list of Double, UDIe: list of Double, normalize: Boolean, cumulative: Boolean; same code as c__udi_viz
int = Integer(larger_2.LargerThan)
int_2 = Integer(larger.LargerThan)
gradient = Gradient(
    LowerLimit=0,
    UpperLimit=1,
    Parameter=int,
    stops=[0: RGB(181, 181, 181), 0: RGB(186, 186, 186), 0: RGB(221, 232, 170), 0: RGB(173, 173, 173), 1: RGB(200, 250, 147)])
gradient_2 = Gradient(
    LowerLimit=0,
    UpperLimit=1,
    Parameter=int_2,
    stops=[0: RGB(138, 138, 138), 0: RGB(186, 186, 186), 0: RGB(221, 232, 170), 0: RGB(173, 173, 173), 1: RGB(255, 208, 18)])

# ---- group: viz
gradient_3 = GetCSGradient(Steps=0, UnitSystem=4)
dom = ConstructDomain(DomainStart=0, DomainEnd=1)
falsecolor = ConstructCSFalsecolor(GradientS=gradient_3, DomainS=dom, UnitSystem=4)
samplefc = SampleCSFalsecolor(Falsecolor=falsecolor, Value=predict_daylight.PredictedDaylightAutonomy_sensor_array, UnitSystem=4)
c_script = CSharpScript(mesh=c__0_003.A, colors=gradient_2)  # -> out, Mesh; inputs mesh: Mesh, colors: list of Color
# ---------- c_script: C# ----------
    System.Drawing.Color[] cc = new System.Drawing.Color[colors.Count];
    for (int i = 0; i < colors.Count; ++i) {
      cc[i] = colors[i];
    }

    mesh.VertexColors.SetColors(cc);

    Mesh = mesh;
# ---------- end c_script ----------

# ----
gradient_4 = Gradient(
    LowerLimit=0,
    UpperLimit=1,
    Parameter=python.v,
    stops=[0: RGB(69, 130, 173), 0.25: RGB(122, 194, 169), 0.496: RGB(184, 234, 122), 0.755: RGB(252, 163, 255)])
avr_2 = Average(Input=predict_daylight.PredictedMeanIlluminance_sensor_array)
avr_3 = Average(Input=int_2)
avr_4 = Average(Input=c__mean_2.A)
avr_5 = Average(Input=int)
panel_2 = Panel(avr_2)
panel_3 = Panel(avr_5)
panel_4 = Panel(avr_3)
panel_5 = Panel(avr_4)
c__combine_fins_louvers = CSharpScript(
    fL=predict_daylight_2.PredictedUsefulDaylightIlluminanceFailing_sensor_array,
    sL=predict_daylight_2.PredictedUsefulDaylightIlluminanceSupplementary_sensor_array,
    aL=predict_daylight_2.PredictedUsefulDaylightIlluminanceAcceptable_sensor_array,
    eL=predict_daylight_2.PredictedUsefulDaylightIlluminanceExcessive_sensor_array,
    fF=predict_daylight.PredictedUsefulDaylightIlluminanceFailing_sensor_array,
    sF=predict_daylight.PredictedUsefulDaylightIlluminanceSupplementary_sensor_array,
    aF=predict_daylight.PredictedUsefulDaylightIlluminanceAcceptable_sensor_array,
    eF=predict_daylight.PredictedUsefulDaylightIlluminanceExcessive_sensor_array)  # -> out, UDIf, UDIs, UDIa, UDIe; inputs fL: list of Double, sL: list of Double, aL: list of Double, eL: list of Double, fF: list of Double, sF: list of Double, aF: list of Double, eF: list of Double
# ---------- c__combine_fins_louvers: C# ----------
    List<double> fC = new List<double>();
    List<double> sC = new List<double>();
    List<double> aC = new List<double>();
    List<double> eC = new List<double>();

    // first, normalize prediction values
    for (int i = 0; i < fL.Count; ++i) {
      double sum = fL[i] + sL[i] + aL[i] + eL[i];
      double factor = 1 / sum;
      fL[i] *= factor;
      sL[i] *= factor;
      aL[i] *= factor;
      eL[i] *= factor;

      sum = fF[i] + sF[i] + aF[i] + eF[i];
      factor = 1 / sum;
      fF[i] *= factor;
      sF[i] *= factor;
      aF[i] *= factor;
      eF[i] *= factor;
    }

    for (int i = 0; i < fL.Count; ++i) {
      double ec = Math.Min(eL[i], eF[i]);
      double aec = Math.Min(aL[i] + eL[i], aF[i] + eF[i]);
      double aesc = Math.Min(sL[i] + aL[i] + eL[i], sF[i] + aF[i] + eF[i]);

      double ac = aec - ec;
      double sc = aesc - aec;
      double fc = Math.Max(fL[i], fF[i]);
      //double fc = 1 - aesc;

      if (ec + ac + sc + fc - 1 > 1e-5) {
        Print("sum is not one at index");
        Print(i.ToString());
        Print((ec + ac + sc + fc).ToString());
        Print("louvers:");
        Print((eL[i] + sL[i] + aL[i] + fL[i]).ToString());
        Print("fins:");
        Print((eF[i] + sF[i] + aF[i] + fF[i]).ToString());
        break;
      }

      fC.Add(fc);
      sC.Add(sc);
      aC.Add(ac);
      eC.Add(ec);
    }

    UDIf = fC;
    UDIs = sC;
    UDIa = aC;
    UDIe = eC;
# ---------- end c__combine_fins_louvers ----------
panel_6 = Panel(c__combine_fins_louvers.out)
c__udi_viz_3 = CSharpScript(
    points=data,
    maxSide=number_slider_6,
    UDIf=c__combine_fins_louvers.UDIf,
    UDIs=c__combine_fins_louvers.UDIs,
    UDIa=c__combine_fins_louvers.UDIa,
    UDIe=c__combine_fins_louvers.UDIe,
    normalize=Toggle(True),
    cumulative=toggle_3)  # -> out, M; inputs points: list of Point3d, maxSide: Double, UDIf: list of Double, UDIs: list of Double, UDIa: list of Double, UDIe: list of Double, normalize: Boolean, cumulative: Boolean; same code as c__udi_viz
avr_6 = Average(Input=c__combine_fins_louvers.UDIa)
panel_7 = Panel(avr_6)
entwine = Entwine(
    Branch00=predict_daylight.PredictedDaylightAutonomy_sensor_array,
    Branch01=predict_daylight.PredictedSunlightExposure_sensor_array,
    Branch02=predict_daylight.PredictedMeanIlluminance_sensor_array,
    Branch03=predict_daylight.PredictedUsefulDaylightIlluminanceFailing_sensor_array,
    Branch04=predict_daylight.PredictedUsefulDaylightIlluminanceSupplementary_sensor_array,
    Branch05=predict_daylight.PredictedUsefulDaylightIlluminanceAcceptable_sensor_array,
    Branch06=predict_daylight.PredictedUsefulDaylightIlluminanceExcessive_sensor_array,
    FlattenInputs=True)

# ---- group: top floor
c__treebuffer = CSharpScript()  # -> out, A; inputs x: tree of Double, reset: Boolean
# ---------- c__treebuffer: C# ----------
    if (x.BranchCount > 0 || reset) {
      buffer = x;
    }

    A = buffer;
# ---------- c__treebuffer: C# additional code ----------
  DataTree<double> buffer = new DataTree<double>();
# ---------- end c__treebuffer ----------
bang = ExplodeTree(Data=c__treebuffer.A)  # -> Branch0, Branch1, Branch2, Branch3, Branch4, Branch5, Branch6

# ---- group: floor below
c__treebuffer_2 = CSharpScript()  # -> out, A; inputs x: tree of Double, reset: Boolean; same code as c__treebuffer
bang_2 = ExplodeTree(Data=c__treebuffer_2.A)  # -> Branch0, Branch1, Branch2, Branch3, Branch4, Branch5, Branch6

# ----
c__udi_viz_4 = CSharpScript(
    points=data,
    maxSide=number_slider_6,
    UDIf=bang.Branch3,
    UDIs=bang.Branch4,
    UDIa=bang.Branch5,
    UDIe=bang.Branch6,
    normalize=toggle_3)  # -> out, M; inputs points: list of Point3d, maxSide: Double, UDIf: list of Double, UDIs: list of Double, UDIa: list of Double, UDIe: list of Double, normalize: Boolean
# ---------- c__udi_viz_4: C# ----------
    if (normalize) {
      for (int i = 0; i < UDIf.Count; ++i) {
        double max = Math.Max(Math.Max(UDIf[i], UDIs[i]), Math.Max(UDIa[i], UDIe[i]));
        double factor = 1 / max;
        UDIf[i] *= factor;
        UDIs[i] *= factor;
        UDIa[i] *= factor;
        UDIe[i] *= factor;
      }
    }

    Color cf = Color.FromArgb(69, 130, 173);
    Color cs = Color.FromArgb(122, 194, 169);
    Color ca = Color.FromArgb(184, 234, 122);
    Color ce = Color.FromArgb(252, 163, 255);

    List<Mesh> mm = new List<Mesh> ();

    mm.Add(UDIMesh(points, UDIf, maxSide, 0.0, cf, 0.0));
    mm.Add(UDIMesh(points, UDIs, maxSide, -0.01, cs, 0.0));
    mm.Add(UDIMesh(points, UDIa, maxSide, -0.02, ca, 0.0));
    mm.Add(UDIMesh(points, UDIe, maxSide, -0.03, ce, 0.0));

    M = mm;
# ---------- c__udi_viz_4: C# additional code ----------
  public Mesh UDIMesh(List<Point3d> points, List<double> values, double maxSide, double offsetZ, Color color, double sideThreshold) {

    if (points.Count != values.Count) {
      return new Mesh();
    }

    Mesh mesh = new Mesh();

    for (int i = 0; i < points.Count; ++i) {
      double hs = 0.5 * maxSide * values[i];

      mesh.Vertices.Add(points[i].X - hs, points[i].Y + hs, points[i].Z + offsetZ);
      mesh.Vertices.Add(points[i].X - hs, points[i].Y - hs, points[i].Z + offsetZ);
      mesh.Vertices.Add(points[i].X + hs, points[i].Y - hs, points[i].Z + offsetZ);
      mesh.Vertices.Add(points[i].X + hs, points[i].Y + hs, points[i].Z + offsetZ);

      mesh.Faces.AddFace(new MeshFace(i * 4, i * 4 + 1, i * 4 + 2, i * 4 + 3));
    }


    Color[] cc = new Color[mesh.Vertices.Count];
    for (int i = 0; i < cc.Length; ++i) {
      cc[i] = color;
    }
    mesh.VertexColors.SetColors(cc);
    mesh.RebuildNormals();
    return mesh;

  }
# ---------- end c__udi_viz_4 ----------
larger_3 = LargerThan(FirstNumber=bang.Branch0, SecondNumber=0.5)  # -> LargerThan, OrEqualTo
larger_4 = LargerThan(FirstNumber=bang.Branch0, SecondNumber=0.5)  # -> LargerThan, OrEqualTo
larger_5 = LargerThan(FirstNumber=bang.Branch1, SecondNumber=250)  # -> LargerThan, OrEqualTo
int_3 = Integer(larger_3.LargerThan)
int_4 = Integer(larger_4.LargerThan)
int_5 = Integer(larger_5.LargerThan)
gradient_5 = Gradient(
    LowerLimit=0,
    UpperLimit=1,
    Parameter=int_3,
    stops=[0: RGB(181, 181, 181), 0: RGB(186, 186, 186), 0: RGB(221, 232, 170), 0: RGB(173, 173, 173), 1: RGB(200, 250, 147)])
avr_7 = Average(Input=int_4)
avr_8 = Average(Input=int_5)
avr_9 = Average(Input=bang.Branch5)
panel_8 = Panel(avr_9)
panel_9 = Panel(avr_7)
panel_10 = Panel(avr_8)
c_script_2 = CSharpScript(mesh=c__0_003.A, colors=gradient_5)  # -> out, Mesh; inputs mesh: Mesh, colors: list of Color; same code as c_script

item_2 = ListItem(List=predict_daylight.Rays, Index=Slider(989, range=0..10000), Wrap=True)
multiplication = Multiplication(A=item_2, B=Slider(187.8, range=0..230))
vdisex = VectorDisplayEx(Point=item, Vector=multiplication, Colour=RGB(0, 0, 0), Width=2)
