# Grasshopper definition daylight_surrogate_eval-northClaytonCorner_11092023.gh (Grasshopper 1.0.7)
# plug-ins: ClimateStudioGH, ShapeDiverForGrasshopper, PW_AI

sddp = ShapeDiverDocumentPayload({AbsoluteTolerance=0, AngleTolerance=0, DistanceDisplayPrecision=0, GltfVersion="Gltf2", GrasshopperVersion="1.0.0007", InputGroups="{}", OutputGroups="{}", RelativeTolerance=0, RhinoVersion="7.29.23107.3001", UnitSystem=0, VersionCreated="1.15.0.0", VersionSaved="1.15.0.0"})

# ---- group: propeller
mullion_spacing = Panel("1.51")
mullion_depth = Panel("0.314")
analysis_plane_surface = Geometry(<brep referenced from the Rhino model>)
ceiling = Geometry([<mesh referenced from the Rhino model> x265])
mullions = Geometry([<mesh referenced from the Rhino model> x5000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])
floor = Geometry([<mesh referenced from the Rhino model> x147])
walls = Geometry([<mesh referenced from the Rhino model> x883])
glazing = Geometry([<mesh referenced from the Rhino model> x2512])
mjoin = MeshJoin(Meshes=mullions)

# ---- group: corner
analysis_plane_surface_2 = Geometry(<brep referenced from the Rhino model>)
fin_spacing = Panel("""1.812
22
22""")
fin_depth = Panel("""0.762
10
7""")
louver_spacing = Panel("""7
7
7""")
glazing_northwest = Geometry([<brep referenced from the Rhino model> x19])
louver_depth = Panel("""0
13
8""")
mullions_corner = Geometry([<brep referenced from the Rhino model> x175])
glazing_south = Geometry([<brep referenced from the Rhino model> x98])
ceiling_2 = Geometry(<brep referenced from the Rhino model>)
floor_2 = Geometry([<brep referenced from the Rhino model> x2])
walls_2 = Geometry([<brep referenced from the Rhino model> x59])
glazing_2 = Geometry([<brep referenced from the Rhino model> x619])

# ---- group: analysis grid
panel = Panel("0.762")  # disabled
Z = UnitZ(Factor=panel)  # disabled
panel_2 = Panel("0.0254 * 18")  # disabled
toggle = BooleanToggle(True)  # disabled
move = Move(Geometry=analysis_plane_surface_2, Motion=Z)  # -> Geometry, Transform; disabled
c__0_003 = CSharpScript(gridSurface=move.Geometry, spacing=0.6096, offset=panel_2, complex=toggle)  # -> out, A, B, nU, nV, E; inputs gridSurface: Brep, spacing: Double, offset: Double, complex: Boolean; disabled
# ---------- c__0_003: C# ----------
    Surface srf = gridSurface.Faces[0];

    double width = 0.0;
    double depth = 0.0;
    srf.GetSurfaceSize(out width, out depth);

    srf.SetDomain(0, new Interval(0, width));
    srf.SetDomain(1, new Interval(0, depth));

    int n_usteps = (int) (0.999999999 + (width - 2.0 * offset) / spacing);
    int n_vsteps = (int) (0.999999999 + (depth - 2.0 * offset) / spacing);
    double u_spacing = (width - 2.0 * offset) / n_usteps;
    double v_spacing = (depth - 2.0 * offset) / n_vsteps;

    Mesh m = new Mesh();

    for (int i = 0; i < n_usteps + 1; ++i) {
      for (int j = 0; j < n_vsteps + 1; ++j) {
        Point3d pt;
        Vector3d[] vv;
        srf.Evaluate(offset + i * u_spacing, offset + j * v_spacing, 0, out pt, out vv);
        m.Vertices.Add(pt.X, pt.Y, pt.Z);
      }
    }

    for (int j = 0; j < n_usteps ; ++j) {
      for (int i = 0; i < n_vsteps ; ++i) {
        m.Faces.AddFace(new MeshFace(i + j * (n_vsteps + 1), i + (j + 1) * (n_vsteps + 1), i + (j + 1) * (n_vsteps + 1) + 1, i + j * (n_vsteps + 1) + 1));
      }
    }


    // filter vertices outside of the trimmed surface
    if (complex) {
      bool[] validVertices = new bool[m.Vertices.Count];
      for (int i = 0; i < validVertices.Length; ++i) {
        validVertices[i] = false;
      }

      for (int i = 0; i < m.Vertices.Count; ++i) {
        foreach (BrepFace face in  gridSurface.Faces) {
          if (!face.IsValid) continue;

          double u, v;
          face.ClosestPoint(m.Vertices[i], out u, out v);
          PointFaceRelation pfr = face.IsPointOnFace(u, v);
          if (pfr == PointFaceRelation.Interior) {
            validVertices[i] = true;
            break;
          }
        }
      }

      List<int> cullVertices = new List<int>();
      for (int i = 0; i < validVertices.Length; ++i) {
        if (!validVertices[i]) {
          cullVertices.Add(i);
        }
      }

      m.Vertices.Remove(cullVertices, true);
    }

    m.RebuildNormals();


    A = m;
    B = m.Vertices;
    nU = n_usteps;
    nV = n_vsteps;
    E = srf;
# ---------- end c__0_003 ----------

# ---- group: ground
area = Area(Geometry=analysis_plane_surface_2)  # -> Area, Centroid
Z_2 = UnitZ(Factor="-5")
move_2 = Move(Geometry=area.Centroid, Motion=Z_2)  # -> Geometry, Transform
xy = XYPlane(Origin=move_2.Geometry)
planesrf = PlaneSurface(Plane=xy, XSize="-1000 To 1000", YSize="-1000 To 1000")

# ----
mesh = Mesh(glazing_2)
mesh_2 = Mesh(glazing_south)
mesh_3 = Mesh(glazing_northwest)
mjoin_2 = MeshJoin(Meshes=mesh)
mjoin_3 = MeshJoin(Meshes=mesh_2)
mjoin_4 = MeshJoin(Meshes=mesh_3)
mjoin_5 = MeshJoin(Meshes=mullions_corner)
relay = Relay([walls_2, mjoin_5])
analysis_grid = ConstructAnalysisGridPWAIV0420(FloorPlane=analysis_plane_surface_2, GridSpacing=0.6096)
merge = Merge(Data1=mjoin_2, Data2=mjoin_3, Data3=mjoin_4)
demesh = DeconstructMesh(Mesh=analysis_grid)  # -> Vertices, Faces, Colours, Normals
number_slider = Slider(0.7, range=0..1)
number_slider_2 = Slider(0.5, range=0..1)
number_slider_3 = Slider(0.2, range=0..1)
number_slider_4 = Slider(0.6, range=0..1)

transparent_object = ConstructTransparentDaylightObjectPWAIV0421(
    GlazingGeometry=[glazing_south, glazing_northwest],
    TransparencyValue=number_slider_4,
    ShadingDepth=0,
    ShadingSpacing=1,
    ShadingType="vertical",
    GenerateShadingGeometries=False)  # -> GlazingDaylighObject, ShadingDeviceGeometry
transparent_object_2 = ConstructTransparentDaylightObjectPWAIV0421(
    GlazingGeometry=glazing_2,
    TransparencyValue=number_slider_4,
    ShadingDepth="0.762",
    ShadingSpacing="1.812",
    ShadingType="fins",
    GenerateShadingGeometries=False)  # -> GlazingDaylighObject, ShadingDeviceGeometry
opaque_object = ConstructOpaqueDaylightObjectPWAIV0421(BuildingGeometry=ceiling_2, ReflectanceValue=number_slider)
opaque_object_2 = ConstructOpaqueDaylightObjectPWAIV0421(BuildingGeometry=floor_2, ReflectanceValue=number_slider_3)
opaque_object_3 = ConstructOpaqueDaylightObjectPWAIV0421(BuildingGeometry=relay, ReflectanceValue=number_slider_2)

number_slider_5 = Slider(1, range=0..1)
dl_obj = DaylightObjectPWAIV0421([opaque_object_2, opaque_object_3, opaque_object, transparent_object_2.GlazingDaylighObject, transparent_object.GlazingDaylighObject])
toggle_2 = BooleanToggle(True)
toggle_3 = BooleanToggle(True)
item = ListItem(List=c__0_003.B, Index=Slider(0, range=0..21602), Wrap=True)
predict_daylight = PredictDaylightMetricsFromGeometryAndMaterialInputsPWAIV02(
    SensorsPositions=demesh.Vertices,
    CeilingGeometries=ceiling_2,
    FloorGeometries=floor_2,
    WallsGeometries=relay,
    GlazingGeometries=merge,
    GroundSurface=planesrf,
    CeilingReflectance=number_slider,
    FloorReflectance=number_slider_3,
    WallsReflectance=number_slider_2,
    GlazingTransparency=number_slider_4,
    VerticalShadingDeviceDepth=fin_depth,
    VerticalShadingDeviceSpacing=fin_spacing,
    HorizontalShadingDeviceDepth=louver_depth,
    HorizontalShadingDeviceSpacing=louver_spacing,
    ComputeSolution=Toggle(True),
    PredictDA=toggle_2,
    PredictSE=toggle_2,
    PredictMI=toggle_2,
    PredictUDI=toggle_2,
    NumberOfThreads=-1,
    ProduceAdditionalDataForDebugging=False,
    IndexOfSensorToDebug=0,
    City="Atlanta")  # -> PredictedDaylightAutonomy_sensor_array, PredictedSunlightExposure_sensor_array, PredictedMeanIlluminance_sensor_array, PredictedUsefulDaylightIlluminanceFailing_sensor_array, PredictedUsefulDaylightIlluminanceSupplementary_sensor_array, PredictedUsefulDaylightIlluminanceAcceptable_sensor_array, PredictedUsefulDaylightIlluminanceExcessive_sensor_array, Rays
number_slider_6 = Slider(3772, range=0..10000)
subset = SubList(List=demesh.Vertices, Domain="0 To 1000", Wrap=True)  # -> List, Index
sensor_views = CreateSensorViewsPWAIV0420(
    SensorsPositions=demesh.Vertices,
    BuildingDaylightObjects=dl_obj,
    GroundElevation=0,
    StochasticRays=Toggle(True),
    NumberOfPasses=1,
    ComputeSolution=Toggle(False),
    NumberOfThreads=-1,
    LimitOutput="md-Array")  # -> SensorViewsDataTree, SensorViewsMdArray
del = DelaunayMesh(Points=subset.List, Plane=PlaneXY(0, 0, 0))
item_2 = ListItem(List=demesh.Vertices, Index=number_slider_6, Wrap=True)
sv_as_bmp = RecordSensorViewsToBmpPWAIV0420(SensorViews=sensor_views.SensorViewsMdArray, IndexOfSensorView=number_slider_6, WriteToFile=Toggle(True))
larger = LargerThan(FirstNumber=predict_daylight.PredictedSunlightExposure_sensor_array, SecondNumber=250)  # -> LargerThan, OrEqualTo
visualize_udi = VisualizeUDI(
    AnalysisGrid=analysis_grid,
    UDIFailing=predict_daylight.PredictedUsefulDaylightIlluminanceFailing_sensor_array,
    UDISupplemental=predict_daylight.PredictedUsefulDaylightIlluminanceSupplementary_sensor_array,
    UDIAcceptable=predict_daylight.PredictedUsefulDaylightIlluminanceAcceptable_sensor_array,
    UDIExcessive=predict_daylight.PredictedUsefulDaylightIlluminanceExcessive_sensor_array)
python = GhPythonScript()  # -> out, v; inputs f: list, s: list, a: list, e: list
# ---------- python: Python ----------
__author__ = "AmpanavosS"
__version__ = "2023.11.02"

import rhinoscriptsyntax as rs

values = []

for i in range(len(f)):
    if f[i] > s[i] and f[i] > a[i] and f[i] > e[i]:
        values.append(0)
    elif s[i] > f[i] and s[i] > a[i] and s[i] > e[i]:
        values.append(0.25)
    elif a[i] > f[i] and a[i] > s[i] and a[i] > e[i]:
        values.append(0.5)
    elif e[i] > f[i] and e[i] > s[i] and e[i] > a[i]:
        values.append(0.5)
    else:
        print("error at index " + str(i))
        
v = values
# ---------- end python ----------
int = Integer(larger.LargerThan)
gradient = Gradient(
    LowerLimit=0,
    UpperLimit=1,
    Parameter=int,
    stops=[0: RGB(138, 138, 138), 0: RGB(186, 186, 186), 0: RGB(221, 232, 170), 0: RGB(173, 173, 173), 1: RGB(255, 208, 18)])

# ---- group: viz
gradient_2 = GetCSGradient(Steps=0, UnitSystem=4)
dom = ConstructDomain(DomainStart=0, DomainEnd=Slider(3000, range=0..10000))
falsecolor = ConstructCSFalsecolor(GradientS=gradient_2, DomainS=dom, UnitSystem=4)
samplefc = SampleCSFalsecolor(Falsecolor=falsecolor, Value=predict_daylight.PredictedMeanIlluminance_sensor_array, UnitSystem=4)
mcol = MeshColours(Mesh=analysis_grid, Colours=gradient)

# ----
gradient_3 = Gradient(
    LowerLimit=0,
    UpperLimit=1,
    Parameter=python.v,
    stops=[0: RGB(69, 130, 173), 0.25: RGB(122, 194, 169), 0.496: RGB(184, 234, 122), 0.755: RGB(252, 163, 255)])
panel_3 = Panel("\\wsl.localhost\Ubuntu-20.04\home\spyridon\code\ML-daylight\ML\logs\v7s-bos+sky\SEMI\lr2e-06_conv2d_f32-64-128_l256-128_s2_b128_e40\SEMI.onnx")
panel_4 = Panel("\\wsl.localhost\Ubuntu-20.04\home\spyridon\code\ML-daylight\ML\logs\v7s-boston\SEMI\lr5e-06_conv2d_f32-64-128_l256-128_s2_b128_e40\SEMI.onnx")
panel_5 = Panel("\\wsl.localhost\Ubuntu-20.04\home\spyridon\code\ML-daylight\ML\logs\v7s-boston\DA\lr5e-06_conv2d_f32-64-128_l128_s2_b128_e120\DA.onnx")
panel_6 = Panel("\\wsl.localhost\Ubuntu-20.04\home\spyridon\code\ML-daylight\ML\logs\v7s-bos+sky\DA\lr5e-06_conv2d_f32-64-128_l128_s2_b128_e60\DA.onnx")
panel_7 = Panel("\\wsl.localhost\Ubuntu-20.04\home\spyridon\code\ML-daylight\ML\logs\v7s-boston\UDI\lr3e-06_conv2d_f32-64-128_l256-128_s2_b128_e40\UDI.onnx")
panel_8 = Panel("\\wsl.localhost\Ubuntu-20.04\home\spyridon\code\ML-daylight\ML\logs\v7s-bos+sky\UDI\lr3e-06_conv2d_f32-64-128_l256-128_s2_b128_e40\UDI.onnx")
avr = Average()
avr_2 = Average(Input=int)
avr_3 = Average(Input=predict_daylight.PredictedUsefulDaylightIlluminanceAcceptable_sensor_array)
predictor = DaylightPredictor(SensorView=sensor_views.SensorViewsMdArray, ModelPath=panel_3)
predictor_2 = DaylightPredictor(SensorView=sensor_views.SensorViewsMdArray, ModelPath=panel_6)
larger_2 = LargerThan(FirstNumber=predictor_2, SecondNumber=0.5)  # -> LargerThan, OrEqualTo
int_2 = Integer(larger_2.LargerThan)
gradient_4 = Gradient(
    LowerLimit=0,
    UpperLimit=1,
    Parameter=int_2,
    stops=[0: RGB(181, 181, 181), 0: RGB(186, 186, 186), 0: RGB(221, 232, 170), 0: RGB(173, 173, 173), 1: RGB(200, 250, 147)])
avr_4 = Average(Input=int_2)
predictor_3 = DaylightPredictor(SensorView=sensor_views.SensorViewsMdArray, ModelPath=panel_7)
panel_9 = Panel(avr)
panel_10 = Panel(avr_4)
panel_11 = Panel(avr_2)
panel_12 = Panel(avr_3)
bang = ExplodeTree(Data=predictor_3)  # -> Branch0, Branch1, Branch2, Branch3
branch = TreeBranch(Tree=predictor, Path="{0}", MaintainPaths=True)
avr_5 = Average(Input=bang.Branch2)
visualize_udi_2 = VisualizeUDI(
    AnalysisGrid=analysis_grid,
    UDIFailing=bang.Branch0,
    UDISupplemental=bang.Branch1,
    UDIAcceptable=bang.Branch2,
    UDIExcessive=bang.Branch3)
panel_13 = Panel(avr_5)
number_slider_7 = Slider(0.6096, range=0..1)
c__udi_viz = CSharpScript(
    points=demesh.Vertices,
    maxSide=number_slider_7,
    UDIf=predict_daylight.PredictedUsefulDaylightIlluminanceFailing_sensor_array,
    UDIs=predict_daylight.PredictedUsefulDaylightIlluminanceSupplementary_sensor_array,
    UDIa=predict_daylight.PredictedUsefulDaylightIlluminanceAcceptable_sensor_array,
    UDIe=predict_daylight.PredictedUsefulDaylightIlluminanceExcessive_sensor_array,
    normalize=Toggle(False),
    cumulative=Toggle(True))  # -> out, M; inputs points: list of Point3d, maxSide: Double, UDIf: list of Double, UDIs: list of Double, UDIa: list of Double, UDIe: list of Double, normalize: Boolean, cumulative: Boolean
# ---------- c__udi_viz: C# usings ----------
using System.Drawing;
# ---------- c__udi_viz: C# ----------
    if (normalize) {
      for (int i = 0; i < UDIf.Count; ++i) {
        double sum = UDIf[i] + UDIs[i] + UDIa[i] + UDIe[i];
        double factor = 1 / sum;
        UDIf[i] *= factor;
        UDIs[i] *= factor;
        UDIa[i] *= factor;
        UDIe[i] *= factor;
      }
    }

    Color cf = Color.FromArgb(69, 130, 173);
    Color cs = Color.FromArgb(122, 194, 169);
    Color ca = Color.FromArgb(184, 234, 122);
    Color ce = Color.FromArgb(252, 163, 255);

    List<Mesh> mm = new List<Mesh> ();

    if (cumulative) {
      for (int i = 0; i < UDIf.Count; ++i) {
        UDIs[i] += UDIf[i];
        UDIa[i] += UDIs[i];
        UDIe[i] += UDIa[i];
      }
    }

    mm.Add(UDIMesh(points, UDIf, maxSide, 0.0, cf, 0.0));
    mm.Add(UDIMesh(points, UDIs, maxSide, -0.01, cs, 0.0));
    mm.Add(UDIMesh(points, UDIa, maxSide, -0.02, ca, 0.0));
    mm.Add(UDIMesh(points, UDIe, maxSide, -0.03, ce, 0.0));

    M = mm;
# ---------- c__udi_viz: C# additional code ----------
  public Mesh UDIMesh(List<Point3d> points, List<double> values, double maxSide, double offsetZ, Color color, double sideThreshold) {

    if (points.Count != values.Count) {
      return new Mesh();
    }

    Mesh mesh = new Mesh();

    for (int i = 0; i < points.Count; ++i) {
      double hs = 0.5 * maxSide * values[i];

      mesh.Vertices.Add(points[i].X - hs, points[i].Y + hs, points[i].Z + offsetZ);
      mesh.Vertices.Add(points[i].X - hs, points[i].Y - hs, points[i].Z + offsetZ);
      mesh.Vertices.Add(points[i].X + hs, points[i].Y - hs, points[i].Z + offsetZ);
      mesh.Vertices.Add(points[i].X + hs, points[i].Y + hs, points[i].Z + offsetZ);

      mesh.Faces.AddFace(new MeshFace(i * 4, i * 4 + 1, i * 4 + 2, i * 4 + 3));
    }


    Color[] cc = new Color[mesh.Vertices.Count];
    for (int i = 0; i < cc.Length; ++i) {
      cc[i] = color;
    }
    mesh.VertexColors.SetColors(cc);
    mesh.RebuildNormals();
    return mesh;

  }
# ---------- end c__udi_viz ----------
data = Data(c__0_003.B)  # disabled
entwine = Entwine(FlattenInputs=True)  # disabled

c__treebuffer = CSharpScript()  # -> out, A; inputs x: tree of Double, reset: Boolean; disabled
# ---------- c__treebuffer: C# ----------
    if (x.BranchCount > 0 || reset) {
      buffer = x;
    }

    A = buffer;
# ---------- c__treebuffer: C# additional code ----------
  DataTree<double> buffer = new DataTree<double>();
# ---------- end c__treebuffer ----------
bang_2 = ExplodeTree(Data=c__treebuffer.A)  # -> Branch0, Branch1, Branch2, Branch3, Branch4, Branch5, Branch6; disabled

c__treebuffer_2 = CSharpScript()  # -> out, A; inputs x: tree of Double, reset: Boolean; disabled; same code as c__treebuffer
bang_3 = ExplodeTree(Data=c__treebuffer_2.A)  # -> Branch0, Branch1, Branch2, Branch3, Branch4, Branch5, Branch6; disabled

c__udi_viz_2 = CSharpScript(points=data, maxSide=number_slider_7, UDIf=bang_2.Branch3, UDIs=bang_2.Branch4, UDIa=bang_2.Branch5, UDIe=bang_2.Branch6)  # -> out, M; inputs points: list of Point3d, maxSide: Double, UDIf: list of Double, UDIs: list of Double, UDIa: list of Double, UDIe: list of Double, normalize: Boolean; disabled
# ---------- c__udi_viz_2: C# ----------
    if (normalize) {
      for (int i = 0; i < UDIf.Count; ++i) {
        double max = Math.Max(Math.Max(UDIf[i], UDIs[i]), Math.Max(UDIa[i], UDIe[i]));
        double factor = 1 / max;
        UDIf[i] *= factor;
        UDIs[i] *= factor;
        UDIa[i] *= factor;
        UDIe[i] *= factor;
      }
    }

    Color cf = Color.FromArgb(69, 130, 173);
    Color cs = Color.FromArgb(122, 194, 169);
    Color ca = Color.FromArgb(184, 234, 122);
    Color ce = Color.FromArgb(252, 163, 255);

    List<Mesh> mm = new List<Mesh> ();

    mm.Add(UDIMesh(points, UDIf, maxSide, 0.0, cf, 0.0));
    mm.Add(UDIMesh(points, UDIs, maxSide, -0.01, cs, 0.0));
    mm.Add(UDIMesh(points, UDIa, maxSide, -0.02, ca, 0.0));
    mm.Add(UDIMesh(points, UDIe, maxSide, -0.03, ce, 0.0));

    M = mm;
# ---------- c__udi_viz_2: C# additional code ----------
  public Mesh UDIMesh(List<Point3d> points, List<double> values, double maxSide, double offsetZ, Color color, double sideThreshold) {

    if (points.Count != values.Count) {
      return new Mesh();
    }

    Mesh mesh = new Mesh();

    for (int i = 0; i < points.Count; ++i) {
      double hs = 0.5 * maxSide * values[i];

      mesh.Vertices.Add(points[i].X - hs, points[i].Y + hs, points[i].Z + offsetZ);
      mesh.Vertices.Add(points[i].X - hs, points[i].Y - hs, points[i].Z + offsetZ);
      mesh.Vertices.Add(points[i].X + hs, points[i].Y - hs, points[i].Z + offsetZ);
      mesh.Vertices.Add(points[i].X + hs, points[i].Y + hs, points[i].Z + offsetZ);

      mesh.Faces.AddFace(new MeshFace(i * 4, i * 4 + 1, i * 4 + 2, i * 4 + 3));
    }


    Color[] cc = new Color[mesh.Vertices.Count];
    for (int i = 0; i < cc.Length; ++i) {
      cc[i] = color;
    }
    mesh.VertexColors.SetColors(cc);
    mesh.RebuildNormals();
    return mesh;

  }
# ---------- end c__udi_viz_2 ----------
larger_3 = LargerThan(FirstNumber=bang_2.Branch0, SecondNumber=0.5)  # -> LargerThan, OrEqualTo; disabled
larger_4 = LargerThan(FirstNumber=bang_2.Branch0, SecondNumber=0.5)  # -> LargerThan, OrEqualTo; disabled
larger_5 = LargerThan(FirstNumber=bang_2.Branch1, SecondNumber=250)  # -> LargerThan, OrEqualTo; disabled
int_3 = Integer(larger_3.LargerThan)  # disabled
gradient_5 = Gradient(
    LowerLimit=0,
    UpperLimit=1,
    Parameter=int_3,
    stops=[0: RGB(181, 181, 181), 0: RGB(186, 186, 186), 0: RGB(221, 232, 170), 0: RGB(173, 173, 173), 1: RGB(200, 250, 147)])  # disabled
int_4 = Integer(larger_4.LargerThan)  # disabled
int_5 = Integer(larger_5.LargerThan)  # disabled
avr_6 = Average(Input=int_4)  # disabled
avr_7 = Average(Input=int_5)  # disabled
avr_8 = Average(Input=bang_2.Branch5)  # disabled
panel_14 = Panel(avr_6)  # disabled
panel_15 = Panel(avr_7)  # disabled
panel_16 = Panel(avr_8)  # disabled
c_script = CSharpScript(mesh=c__0_003.A, colors=gradient_5)  # -> out, Mesh; inputs mesh: Mesh, colors: list of Color; disabled
# ---------- c_script: C# ----------
    System.Drawing.Color[] cc = new System.Drawing.Color[colors.Count];
    for (int i = 0; i < colors.Count; ++i) {
      cc[i] = colors[i];
    }

    mesh.VertexColors.SetColors(cc);

    Mesh = mesh;
# ---------- end c_script ----------

number_slider_8 = Slider(989, range=0..10000)  # disabled
number_slider_9 = Slider(187.8, range=0..230)  # disabled
item_3 = ListItem(Index=number_slider_8, Wrap=True)  # disabled
multiplication = Multiplication(A=item_3, B=number_slider_9)  # disabled
vdisex = VectorDisplayEx(Point=item, Vector=multiplication, Colour=RGB(0, 0, 0), Width=2)  # disabled
