# Grasshopper definition DPredict-V135-29-10-24.gh (Grasshopper 1.0.7)
# plug-ins: Human UI, Human, PW_AI

alternativesdata = Text("")
series = Series(Start=0, Step=1, Count=29)
toggle = BooleanToggle(False)
panel = Panel("""False
False
True""")
panel_2 = Panel("""Sml   
Med   
Lrg   """)
add_remove_fins = BooleanToggle(False)
add_remove_fins_2 = BooleanToggle(False)
count = Slider(2, range=1..10)
offset_m = Slider(0, range=0..2)
depth_m = Slider(0.3, range=0..10)
depth_m_2 = Slider(0.3, range=0..10)
win_u_val_si = Slider(2.2, range=0..5)
win_shgc = Slider(0.3, range=0..1)
floor_refl = Slider(0.2, range=0..1)
wall_refl = Slider(0.5, range=0..1)
wall_r_val_ip = Slider(20, range=0..50)
ceiling_refl = Slider(0.7, range=0..1)
glazing_trans = Slider(0.3, range=0..1)
roof_r_val_ip = Slider(30, range=0..100)
merge = Merge(Data1=toggle, Data2=toggle, Data3=Toggle(True))
panel_4 = Panel("""Sml   
Med   
Lrg   """)
number_slider = Slider(2, range=0..10)
number_slider_2 = Slider(2, range=0..10)
panel_5 = Panel("Set interior walls' outlines.")
radiobtn = CreateRadioButton(RadioButtonName=panel_4, RadioButtonGroup="1", InitiallySelected=panel)
panel_6 = Panel("""Very Light: 80,000 * Af
Light : 110,000 * Af
Medium: 165,000 * Af
Heavy: 260,000 * Af
Very heavy: 370,000 * Af""")
txt = Text(["LargeOffice", "MediumOffice", "SmallOffice", "MidriseApartment", "HighriseApartment", "PrimarySchool", "SecondarySchool", "SmallHotel", "LargeHotel", "Laboratory"])

toggle_2 = CreateToggle(Default=False, OnLabel="Update", OffLabel="Update")
getprops = GetElementProperties(UIElement=toggle_2)  # -> PropertyNames, PropertyTypes
values = ValueListener(Elements=toggle_2, SomeProperty=True)  # -> Values, Indices
item = ListItem(List=getprops.PropertyNames, Index=11, Wrap=True)
filter = StreamFilter(Gate=values.Values, Stream1=Toggle(False))
panel_7 = Panel(values.Values)
setprop = SetElementProperty(UIElement=toggle_2, PropertyName=item, ValueToSet=filter)

panel_8 = Panel("""Electricity
Natural Gas
Fuel""")
panel_9 = Panel("""Open terrain
Country
Urban / City""")
checkbox = CreateCheckbox(StartingValue=True)
panel_10 = Panel("""Electricity
Natural Gas
Fuel""")

toggle_3 = CreateToggle(Default=False, OnLabel="Save Alternative", OffLabel="Save Alternative")
getprops_2 = GetElementProperties(UIElement=toggle_3)  # -> PropertyNames, PropertyTypes
values_2 = ValueListener(Elements=toggle_3, SomeProperty=True)  # -> Values, Indices
item_2 = ListItem(List=getprops_2.PropertyNames, Index=11, Wrap=True)
filter_2 = StreamFilter(Gate=values_2.Values, Stream1=Toggle(False))
panel_11 = Panel(values_2.Values)
setprop_2 = SetElementProperty(UIElement=toggle_3, PropertyName=item_2, ValueToSet=filter_2)

radiobtn_2 = CreateRadioButton(RadioButtonName=panel_2, RadioButtonGroup="10", InitiallySelected=merge)
num = Number(0.6096)
txt_2 = Text("")
data = Data(simplify(flatten(txt)))

toggle_4 = CreateToggle(Default=False, OnLabel="Apply to selected", OffLabel="Apply to selected")
getprops_3 = GetElementProperties(UIElement=toggle_4)  # -> PropertyNames, PropertyTypes
values_3 = ValueListener(Elements=toggle_4, SomeProperty=True)  # -> Values, Indices
item_3 = ListItem(List=getprops_3.PropertyNames, Index=11, Wrap=True)
filter_3 = StreamFilter(Gate=values_3.Values, Stream1=Toggle(False))
panel_12 = Panel(values_3.Values)
setprop_3 = SetElementProperty(UIElement=toggle_4, PropertyName=item_3, ValueToSet=filter_3)

label = CreateLabel(LabelText=" Sensor Grid : ", LabelSize=12, Justification=0)
num_2 = Number(0.6096)
division = Division(A=num, B=2)
series_2 = Series(Start=number_slider_2, Step=number_slider_2, Count=3)
wwr = Slider(0.5, range=0..1)
label_2 = CreateLabel(LabelText=" Sensor Grid : ", LabelSize=12, Justification=0)
filepicker = CreateFilePicker(ButtonLabelText="Folder to Save", DialogType=2, MustExist=True, Filter="All Files|*.*", StartingPath=txt_2)
panel_13 = Panel("""True
False""")
filepicker_2 = CreateFilePicker(ButtonLabelText="Weather File", DialogType=0, MustExist=True, Filter="Weather Files |* .epw")
panel_14 = Panel("""Vertical      
Horizontal""")
pickbtn = CreateRhinoPickButton(ButtonName="Footprint", Prompt="Set a closed Outline.", AllowMultiple=False, AllowNone=True, Type=2, ButtonStyle=0)
pickbtn_2 = CreateRhinoPickButton(ButtonName="Int Walls", Prompt=panel_5, AllowMultiple=True, AllowNone=True, Type=2, ButtonStyle=0)
division_2 = Division(A=num_2, B=2)
tooltip = AttachTooltipToElement(ElementsToAttachTo=label, TooltipContent=" Grid Size for daylight analysis", ShowDelay=500, Duration=2000)
series_3 = Series(Start=number_slider, Step=number_slider, Count=3)
pickbtn_3 = CreateRhinoPickButton(ButtonName="Context", Prompt="Set context buildings.", AllowMultiple=True, AllowNone=True, Type=0, ButtonStyle=0)
floor_to_floor_m = Slider(3.2, range=1..6)
footprint_offset = Slider(0, range=0..500)
number_of_floors = Slider(20, range=1..100)
values_4 = ValueListener(Elements=radiobtn, SomeProperty=True)  # -> flatten(Values), Indices
clip_plane_m = Slider(3, range=0..10)
multiplication = Multiplication(A=division, B=series_2)
tooltip_2 = AttachTooltipToElement(ElementsToAttachTo=label_2, TooltipContent=" Grid Size for daylight analysis", ShowDelay=500, Duration=2000)
pulldown = CreatePulldownMenu(Label="Env Heat Cap", ListItems=panel_6, SelectedIndex=Slider(2, range=0..4), showLabel=True)
values_5 = ValueListener(Elements=radiobtn_2, SomeProperty=True)  # -> flatten(Values), Indices
pulldown_2 = CreatePulldownMenu(Label="Terrain", ListItems=panel_9, SelectedIndex=Slider(2, range=0..4), showLabel=True)
merge_2 = Merge(Data1=flatten(label), Data2=flatten(radiobtn))
panel_15 = Panel("""Small   
Medium   
Large   """)
multiplication_2 = Multiplication(A=division_2, B=series_3)
values_6 = ValueListener(Elements=filepicker_2, SomeProperty=True)  # -> Values, Indices
radiobtn_3 = CreateRadioButton(RadioButtonName=panel_14, RadioButtonGroup="ShDvc", InitiallySelected=panel_13)
panel_16 = Panel("""Small   
Medium   
Large   """)
merge_3 = Merge(Data1=flatten(label_2), Data2=flatten(radiobtn_2))
pulldown_3 = CreatePulldownMenu(Label="Heating Source", ListItems=panel_8, SelectedIndex=Slider(0, range=0..4), showLabel=True)
pulldown_4 = CreatePulldownMenu(Label="Hot Water Source", ListItems=panel_10, SelectedIndex=Slider(1, range=0..4), showLabel=True)
pulldown_5 = CreatePulldownMenu(Label="Building Type", ListItems=data, SelectedIndex=Slider(0, range=0..1000), showLabel=True)
format = Format(Format="{0}: {1} m2", Culture=127, Data0=panel_15, Data1=multiplication)
tooltip_3 = AttachTooltipToElement(ElementsToAttachTo=pulldown, TooltipContent="Envelope Heat Capacity", ShowDelay=500, Duration=2000)
values_7 = ValueListener(Elements=filepicker, SomeProperty=True)  # -> flatten(Values), Indices
swatch = ColourSwatch(SwatchColor=RGB(5, 5, 5))
format_2 = Format(Format="{0}: {1} m2", Culture=127, Data0=panel_16, Data1=multiplication_2)
c_script = CSharpScript(x=values_6.Values)  # -> out, A
# ---------- c_script: C# ----------
    A = !string.IsNullOrWhiteSpace(x.ToString());
# ---------- end c_script ----------
relay = Relay([pickbtn, pickbtn_2, pickbtn_3])
tooltip_4 = AttachTooltipToElement(ElementsToAttachTo=toggle_2, TooltipContent="On/Off Daylight and Energy calculation", ShowDelay=500, Duration=2000)
tooltip_5 = AttachTooltipToElement(ElementsToAttachTo=radiobtn, TooltipContent=format, ShowDelay=500, Duration=2000)
cull = CullPattern(List=multiplication_2, CullPattern=values_5.Values)
stack = CreateStack(UIElements=radiobtn_3, Horizontal=True)
tooltip_6 = AttachTooltipToElement(ElementsToAttachTo=radiobtn_2, TooltipContent=format_2, ShowDelay=500, Duration=2000)
slider = CreateSlider(
    Slider=footprint_offset,
    SnapValue=0.1,
    ShowBounds=False,
    ShowTicks=False,
    ShowTooltip=False,
    ShowValLabel=True,
    showLabel=True)
c_script_2 = CSharpScript(x=values_7.Values, y=txt_2)  # -> out, A; inputs x: String, y: String
# ---------- c_script_2: C# ----------
    if(String.IsNullOrEmpty(x))
    {
      A = y;
    }
    else
      A = x;
# ---------- end c_script_2 ----------
slider_2 = CreateSlider(
    Slider=floor_to_floor_m,
    SnapValue=0.1,
    ShowBounds=False,
    ShowTicks=False,
    ShowTooltip=False,
    ShowValLabel=True,
    showLabel=True)
slider_3 = CreateSlider(
    Slider=number_of_floors,
    SnapValue=0.1,
    ShowBounds=False,
    ShowTicks=False,
    ShowTooltip=False,
    ShowValLabel=True,
    showLabel=True)
separator = CreateSeparator(Thickness=0.7, Horizontal=True, Color=swatch)
toggle_5 = CreateToggle(Default=Toggle(True), OnLabel="Clipping Plane", OffLabel="Clipping Plane")
slider_4 = CreateSlider(
    Slider=clip_plane_m,
    SnapValue=0.1,
    ShowBounds=False,
    ShowTicks=False,
    ShowTooltip=False,
    ShowValLabel=True,
    showLabel=True)
and = GateAnd(A=c_script.A, B=values.Values)
slider_5 = CreateSlider(Slider=count, SnapValue=1, ShowBounds=False, ShowTicks=False, ShowTooltip=False, ShowValLabel=True, showLabel=True)
slider_6 = CreateSlider(Slider=depth_m_2, SnapValue=0.1, ShowBounds=False, ShowTicks=False, ShowTooltip=False, ShowValLabel=True, showLabel=True)
toggle_6 = CreateToggle(Default=add_remove_fins_2, OnLabel="Shadings Devices", OffLabel="Shadings Devices")
separator_2 = CreateSeparator(Thickness=0.7, Horizontal=True, Color=swatch)
toggle_7 = CreateToggle(Default=add_remove_fins, OnLabel="OverHang", OffLabel="OverHang")
slider_7 = CreateSlider(Slider=offset_m, SnapValue=1, ShowBounds=False, ShowTicks=False, ShowTooltip=False, ShowValLabel=True, showLabel=True)
slider_8 = CreateSlider(Slider=depth_m, SnapValue=0.1, ShowBounds=False, ShowTicks=False, ShowTooltip=False, ShowValLabel=True, showLabel=True)
slider_9 = CreateSlider(Slider=wwr, SnapValue=0.01, ShowBounds=False, ShowTicks=False, ShowTooltip=False, ShowValLabel=True, showLabel=True)
separator_3 = CreateSeparator(Thickness=0.7, Horizontal=True, Color=swatch)
tooltip_7 = AttachTooltipToElement(ElementsToAttachTo=pulldown_5, TooltipContent="Floor Program", ShowDelay=500, Duration=2000)
separator_4 = CreateSeparator(Thickness=0.7, Horizontal=True, Color=swatch)
merge_4 = Merge(Data1=flatten(filepicker), Data2=flatten(toggle_3))
simplegrid = CreateSimpleGrid(UIElements=graft(merge_2), Width=graft(Slider(252, range=0..1000)), RowDefinitions="Auto", ColumnDefinitions="Auto")  # -> flatten(SimpleGrid)
number_slider_3 = Slider(3.753, range=0..10)
hideshow = HideShowElement(ElementToHideShow=[pulldown_4, pulldown_3, pulldown], Show=False, Collapse=True, Disable=False)
slider_10 = CreateSlider(
    Slider=win_u_val_si,
    SnapValue=0.01,
    ShowBounds=False,
    ShowTicks=False,
    ShowTooltip=False,
    ShowValLabel=True,
    showLabel=True)
slider_11 = CreateSlider(Slider=win_shgc, SnapValue=0.01, ShowBounds=False, ShowTicks=False, ShowTooltip=False, ShowValLabel=True, showLabel=True)
slider_12 = CreateSlider(Slider=wall_refl, SnapValue=0.1, ShowBounds=False, ShowTicks=False, ShowTooltip=False, ShowValLabel=True, showLabel=True)
slider_13 = CreateSlider(
    Slider=glazing_trans,
    SnapValue=0.1,
    ShowBounds=False,
    ShowTicks=False,
    ShowTooltip=False,
    ShowValLabel=True,
    showLabel=True)
separator_5 = CreateSeparator(Thickness=0.7, Horizontal=True, Color=swatch)
slider_14 = CreateSlider(
    Slider=wall_r_val_ip,
    SnapValue=1,
    ShowBounds=False,
    ShowTicks=False,
    ShowTooltip=False,
    ShowValLabel=True,
    showLabel=True)
slider_15 = CreateSlider(
    Slider=roof_r_val_ip,
    SnapValue=1,
    ShowBounds=False,
    ShowTicks=False,
    ShowTooltip=False,
    ShowValLabel=True,
    showLabel=True)
slider_16 = CreateSlider(
    Slider=ceiling_refl,
    SnapValue=0.1,
    ShowBounds=False,
    ShowTicks=False,
    ShowTooltip=False,
    ShowValLabel=True,
    showLabel=True)
slider_17 = CreateSlider(
    Slider=floor_refl,
    SnapValue=0.1,
    ShowBounds=False,
    ShowTicks=False,
    ShowTooltip=False,
    ShowValLabel=True,
    showLabel=True)
simplegrid_2 = CreateSimpleGrid(UIElements=graft(merge_3), Width=graft(Slider(252, range=0..1000)), RowDefinitions="Auto", ColumnDefinitions="Auto")  # -> flatten(SimpleGrid)
merge_5 = Merge(Data1=slider_2, Data2=slider_3, Data3=slider, Data4=separator, Data5=toggle_5, Data6=slider_4)
number_slider_4 = Slider(32, range=0..1000)
getprops_4 = GetElementProperties(UIElement=toggle_6)  # -> PropertyNames, PropertyTypes
values_8 = ValueListener(Elements=pickbtn, SomeProperty=True)  # -> flatten(Values), Indices
values_9 = ValueListener(Elements=pickbtn_2, SomeProperty=True)  # -> flatten(Values), Indices
number_slider_5 = Slider(191, range=0..1000)
simplegrid_3 = CreateSimpleGrid(UIElements=graft(relay), Width=Slider(199, range=0..1000), RowDefinitions="1*", ColumnDefinitions="1*")  # -> flatten(SimpleGrid)
join = TextJoin(Text=[Slider(0, range=0..100), number_slider_3, Slider(0, range=0..100), number_slider_3], Join=",")
data_2 = Data([slider_5, slider_6, slider_7, slider_8])
panel_17 = Panel(and)
item_4 = ListItem(List=getprops_4.PropertyNames, Index=33, Wrap=True)
data_3 = Data([slider_16, slider_17, slider_12, slider_13, separator_5, slider_14, slider_15, slider_10, slider_11])
data_4 = Data([pulldown_2, pulldown_5])
tooltip_8 = AttachTooltipToElement(ElementsToAttachTo=slider, TooltipContent="Footprint offset from ground level", ShowDelay=500, Duration=2000)
tooltip_9 = AttachTooltipToElement(ElementsToAttachTo=slider_2, TooltipContent="Storey Height", ShowDelay=500, Duration=2000)
setslider = SetSlider(UISlider=slider_9)
data_5 = Data([slider_16, slider_17, slider_12, slider_13, slider_14, slider_15, slider_10, slider_11])
adjustelem = AdjustElementAppearance(
    ElementsToAdjust=toggle_2,
    Foreground=ColourSwatch(SwatchColor=RGB(0, 0, 0)),
    Background=ColourSwatch(SwatchColor=RGB(204, 204, 204)),
    FontSize=Slider(11.73, range=0..20))
setprop_4 = SetElementProperty(UIElement=[toggle_6, toggle_7], PropertyName=item_4, ValueToSet=Slider(12.35, range=0..14))
adjustpos = AdjustElementPositioning(
    ElementsToAdjust=toggle_2,
    Margin="0",
    AbsolutePositioning=False,
    Width=Slider(123, range=0..1000),
    Height=Slider(31, range=0..100))
data_6 = Data([slider_2, slider_3, slider, slider_4])
adjustelem_2 = AdjustElementAppearance(
    ElementsToAdjust=graft(toggle_3),
    Foreground=ColourSwatch(SwatchColor=RGB(0, 0, 0)),
    Background=ColourSwatch(SwatchColor=RGB(255, 255, 255)),
    FontSize=Slider(13, range=0..20))
adjustpos_2 = AdjustElementPositioning(ElementsToAdjust=data_4, Margin="0", AbsolutePositioning=False, Height=Slider(34, range=0..100))
merge_6 = Merge(
    Data1=slider_9,
    Data2=separator_4,
    Data3=toggle_6,
    Data4=stack,
    Data5=slider_5,
    Data6=slider_6,
    Data7=separator_2,
    Data8=toggle_7,
    Data9=slider_7,
    Data10=slider_8,
    Data11=separator_3,
    Data12=toggle_4)
adjustpos_3 = AdjustElementPositioning(
    ElementsToAdjust=toggle_3,
    Margin=Slider(7, range=0..10),
    AbsolutePositioning=False,
    Width=number_slider_5,
    Height=number_slider_4)
values_10 = ValueListener(Elements=slider_4, SomeProperty=True)  # -> flatten(Values), Indices
adjustpos_4 = AdjustElementPositioning(
    ElementsToAdjust=merge_4,
    Margin="0,10,50,10",
    AbsolutePositioning=False,
    Width=[Slider(172, range=0..1000), number_slider_5],
    Height=number_slider_4)
adjustpos_5 = AdjustElementPositioning(ElementsToAdjust=data_5, AbsolutePositioning=False, Height=Slider(27, range=0..100))
adjustpos_6 = AdjustElementPositioning(
    ElementsToAdjust=filepicker_2,
    Margin=join,
    AbsolutePositioning=True,
    Width=Slider(189.6, range=0..200),
    Height=Slider(31.953, range=0..100))
adjustpos_7 = AdjustElementPositioning(ElementsToAdjust=data_6, AbsolutePositioning=False, Height=Slider(27, range=0..100))
data_7 = Data(merge_6)
adjustpos_8 = AdjustElementPositioning(ElementsToAdjust=data_2, AbsolutePositioning=False, Height=Slider(27, range=0..100))
panel_18 = Panel("""Floor   
Wall""")
values_11 = ValueListener(Elements=pickbtn_3, SomeProperty=True)  # -> flatten(Values), Indices
number_slider_6 = Slider(0.764, range=0..10)
merge_7 = Merge(
    Data1=flatten(simplegrid_3),
    Data2=flatten(filepicker_2),
    Data3=flatten(pulldown_5),
    Data4=flatten(pulldown_2),
    Data5=flatten(merge_5))
checkbox_2 = CreateCheckbox(Label=panel_18, StartingValue=[True, False])
label_3 = CreateLabel(LabelText=" Heatmap On/Off:     ", LabelSize=12, Justification=0)
adjustelem_3 = AdjustElementAppearance(
    ElementsToAdjust=graft(toggle_4),
    Foreground=ColourSwatch(SwatchColor=RGB(0, 0, 0)),
    Background=ColourSwatch(SwatchColor=RGB(222, 222, 222)),
    FontSize=Slider(11.9, range=0..20))
expander = CreateExpander(UIElements=data_7, Header="WWR & Shading Devices          ", Open=True)
brep = Brep(values_11.Values)
mesh = Mesh(values_11.Values)
adjustpos_9 = AdjustElementPositioning(
    ElementsToAdjust=relay,
    Margin=Slider(1, range=0..100),
    AbsolutePositioning=True,
    Width=Slider(60, range=0..300),
    Height=Slider(28.8, range=0..100))
stack_2 = CreateStack(UIElements=flatten([label_3, checkbox_2]), Horizontal=True)
toggle_8 = BooleanToggle(True)
join_2 = TextJoin(Text=[Slider(0, range=0..100), number_slider_6, Slider(0, range=0..100), number_slider_6], Join=",")
mesh_2 = MeshBrep(
    Brep=brep,
    Settings={GridMaxCount=0, GridMinCount=16, JaggedSeams=False, MaxEdgeLength=0, MinEdgeLength=0.0001, MinTolerance=0, Refine=True, RefineAngle=0, RelativeTolerance=0.65, SimplePlanes=True, Tolerance=0})
simplegrid_4 = CreateSimpleGrid(UIElements=graft(merge_4), RowDefinitions="Auto", ColumnDefinitions="Auto")
values_12 = ValueListener(Elements=checkbox_2, SomeProperty=True)  # -> Values, Indices
adjustelem_4 = AdjustElementAppearance(
    ElementsToAdjust=relay,
    Foreground=ColourSwatch(SwatchColor=RGB(102, 102, 102)),
    Background=ColourSwatch(SwatchColor=RGB(230, 230, 230)),
    FontSize=Slider(11, range=0..100))
tooltip_10 = AttachTooltipToElement(ElementsToAttachTo=pickbtn, TooltipContent="Set a closed Outline.", ShowDelay=500, Duration=2000)
tooltip_11 = AttachTooltipToElement(ElementsToAttachTo=pickbtn_2, TooltipContent=panel_5, ShowDelay=500, Duration=2000)
tooltip_12 = AttachTooltipToElement(ElementsToAttachTo=pickbtn_3, TooltipContent="Set context buildings.", ShowDelay=500, Duration=2000)
clean = CleanTree(RemoveNulls=True, RemoveInvalid=True, RemoveEmpty=False, Tree=flatten([mesh, mesh_2]))
int = Integer(values_12.Values)
stack_3 = CreateStack(UIElements=stack_2, Horizontal=True)
adjustelem_5 = AdjustElementAppearance(
    Foreground=ColourSwatch(SwatchColor=RGB(0, 0, 0)),
    Background=ColourSwatch(SwatchColor=RGB(255, 255, 255)),
    FontSize=Slider(13.6, range=0..20))
c_script_3 = CSharpScript(x=values_11.Values)  # -> out, A; inputs x: list
# ---------- c_script_3: C# ----------
    if(x.Count==0)
      A = false;
    else
      A = true;
# ---------- end c_script_3 ----------
tooltip_13 = AttachTooltipToElement(ElementsToAttachTo=slider_14, TooltipContent="the R-Value of the exterior walls", ShowDelay=500, Duration=2000)
tooltip_14 = AttachTooltipToElement(ElementsToAttachTo=slider_15, TooltipContent="the R-Value of the Roof", ShowDelay=500, Duration=2000)
tooltip_15 = AttachTooltipToElement(ElementsToAttachTo=slider_10, TooltipContent="the U-Value of the glazing system", ShowDelay=500, Duration=2000)
tooltip_16 = AttachTooltipToElement(
    ElementsToAttachTo=slider_11,
    TooltipContent="the Solar Heat Gain Coefficient of the glazing system",
    ShowDelay=500,
    Duration=2000)
mjoin = MeshJoin(Meshes=clean)
mbox = MeshBox(
    Base={Plane=PlaneXY(100000000, 100000000, 100000000), X=Domain(-2, 2), Y=Domain(-0.5, 0.5), Z=Domain(0, 0.25)},
    XCount=1,
    YCount=1,
    ZCount=1)
merge_8 = Merge(Data1=flatten(simplegrid_2), Data2=flatten(stack_3))
expander_2 = CreateExpander(UIElements=flatten(merge_7), Header="Building Inputs", Open=True)
filter_4 = StreamFilter(Gate=c_script_3.A, Stream0=mbox, Stream1=mjoin)
stack_4 = CreateStack(UIElements=flatten(merge_8), Horizontal=False)
panel_19 = Panel(values_12.Values)
tooltip_17 = AttachTooltipToElement(ElementsToAttachTo=slider_16, TooltipContent="Ceiling Reflectance", ShowDelay=500, Duration=2000)
tooltip_18 = AttachTooltipToElement(ElementsToAttachTo=slider_17, TooltipContent="Floor Reflectance", ShowDelay=500, Duration=2000)
tooltip_19 = AttachTooltipToElement(ElementsToAttachTo=slider_12, TooltipContent="Wall Reflectance", ShowDelay=500, Duration=2000)
tooltip_20 = AttachTooltipToElement(ElementsToAttachTo=slider_13, TooltipContent="Glazing transparency", ShowDelay=500, Duration=2000)
preview = CustomPreview(Geometry=filter_4, Material=ColourSwatch(SwatchColor=RGB(191, 250, 255)))
id = Guid(values_8.Values)
stack_5 = CreateStack(UIElements=flatten([toggle_2, stack_4]), Horizontal=True)
clean_2 = CleanTree(RemoveNulls=True, RemoveInvalid=True, RemoveEmpty=True, Tree=id)
expander_3 = CreateExpander(UIElements=data_3, Header="Building Materials", Open=Toggle(False))
L = ChecklistItems("Deselect All")
crv = Curve(clean_2)
L_2 = ChecklistItems("Select All")
toggle_9 = BooleanToggle(True)
button = CreateButton(ButtonName=L, ButtonStyle=0)
button_2 = CreateButton(ButtonName=L_2, ButtonStyle=0)
cluster = Cluster_11(relay=crv)
updatewallcount = Integer(4)
adjustelem_6 = AdjustElementAppearance(
    ElementsToAdjust=graft([expander_3, expander]),
    Foreground=ColourSwatch(SwatchColor=RGB(255, 255, 255)),
    Background=ColourSwatch(SwatchColor=RGB(102, 102, 102)),
    FontSize=Slider(13.4, range=0..20))
checklist = CreateChecklist(ChecklistItems=["Wall 0", "Wall 1", "Wall 2", "Wall 3", "Wall 4", "Wall 5"], Selected=toggle_9)
c_script_4 = CSharpScript(x=values_7.Values)  # -> out, A; inputs x: String
# ---------- c_script_4: C# ----------
    A = x.ToCharArray().Length;
# ---------- end c_script_4 ----------
values_13 = ValueListener(Elements=button, SomeProperty=True)  # -> Values, Indices
values_14 = ValueListener(Elements=button_2, SomeProperty=True)  # -> Values, Indices
id_2 = Guid(values_9.Values)
larger = LargerThan(FirstNumber=c_script_4.A, SecondNumber=0)  # -> LargerThan, OrEqualTo
c_script_5 = CSharpScript(x=values_13.Values)  # -> out, A; inputs x: Int32
# ---------- c_script_5: C# ----------
    foreach( var obj in GrasshopperDocument.Objects){
      if(obj.NickName == "UpdateSelectAllWallCount"){
        guid = obj.InstanceGuid;
      }
    }

    if(x == 1){
      Grasshopper.Kernel.Parameters.Param_Integer cmp = (Grasshopper.Kernel.Parameters.Param_Integer) this.GrasshopperDocument.FindObject(guid, true);
      cmp.PersistentData.Clear();
      cmp.PersistentData.Append(new Grasshopper.Kernel.Types.GH_Integer(0));
      cmp.ExpireSolution(true);
    }
# ---------- c_script_5: C# additional code ----------
  Guid guid;
# ---------- end c_script_5 ----------
c_script_6 = CSharpScript(x=values_14.Values)  # -> out, A; inputs x: Int32
# ---------- c_script_6: C# ----------
    foreach( var obj in GrasshopperDocument.Objects){
      if(obj.NickName == "UpdateSelectAllWallCount"){
        guid = obj.InstanceGuid;
      }
    }

    if(x == 1){
      Grasshopper.Kernel.Parameters.Param_Integer cmp = (Grasshopper.Kernel.Parameters.Param_Integer) this.GrasshopperDocument.FindObject(guid, true);
      cmp.PersistentData.Clear();
      cmp.PersistentData.Append(new Grasshopper.Kernel.Types.GH_Integer(1));
      cmp.ExpireSolution(true);
    }
# ---------- c_script_6: C# additional code ----------
  Guid guid;
# ---------- end c_script_6 ----------
series_4 = Series(Start=0, Step=1, Count=updatewallcount)
clean_3 = CleanTree(RemoveNulls=True, RemoveInvalid=True, RemoveEmpty=True, Tree=id_2)
format_3 = Format(Format="Wall {0}", Culture=127, Data0=series_4)
stack_6 = CreateStack(UIElements=flatten([button_2, button]), Horizontal=True)
crv_2 = Curve(clean_3)
updateselectallwallcount = Integer(1)
c_script_7 = CSharpScript(curve=crv_2, Reference="C:\USERS\AMPANAVOSS\DOWNLOADS\D.PREDICT.V3\NET48\Newtonsoft.Json.dll")  # -> out, simplify(JSON); inputs curve: Curve
# ---------- c_script_7: C# usings ----------
using Newtonsoft.Json;
# ---------- c_script_7: C# ----------
    JSON = CurveToJSON(curve);
# ---------- c_script_7: C# additional code ----------
  public string CurveToJSON (Curve curve){
    string jsonData = JsonConvert.SerializeObject(curve, Formatting.None);
    return jsonData;
  }

  public Curve JSONToCurve (string serializedCurve){
    Curve deserializedCurve = JsonConvert.DeserializeObject<Curve>(serializedCurve);
    return deserializedCurve;
  }
# ---------- end c_script_7 ----------
c_script_8 = CSharpScript(curve=cluster, Reference="C:\USERS\AMPANAVOSS\DOWNLOADS\D.PREDICT.V3\NET48\Newtonsoft.Json.dll")  # -> out, simplify(JSON); inputs curve: Curve; same code as c_script_7
values_15 = ValueListener(Elements=toggle_5, SomeProperty=True)  # -> flatten(Values), Indices
setchecklist = SetChecklistContents(ChecklistToModify=checklist, NewChecklistContents=format_3, Selected=toggle_9)
setchecklist_2 = SetChecklistContents(ChecklistToModify=checklist, NewChecklistContents=format_3, Selected=updateselectallwallcount)
c_script_9 = CSharpScript(update=values_15.Values)  # -> out, A; inputs update: Boolean
# ---------- c_script_9: C# ----------
    foreach( var obj in GrasshopperDocument.Objects){
      if(obj.NickName == "updateBooleanClip"){
        guid = obj.InstanceGuid;
      }
    }

    if(n == 0){
      Grasshopper.Kernel.Parameters.Param_Boolean cmp = (Grasshopper.Kernel.Parameters.Param_Boolean) this.GrasshopperDocument.FindObject(guid, true);
      cmp.PersistentData.Clear();
      cmp.PersistentData.Append(new GH_Boolean(false));
      cmp.ExpireSolution(true);
      
    }


    if(update.ToString() != current){
      current = update.ToString();

      Grasshopper.Kernel.Parameters.Param_Boolean cmp = (Grasshopper.Kernel.Parameters.Param_Boolean) this.GrasshopperDocument.FindObject(guid, true);
      cmp.PersistentData.Clear();
      cmp.PersistentData.Append(new GH_Boolean(update));
      cmp.ExpireSolution(true);
      n++;
    }
# ---------- c_script_9: C# additional code ----------
  int n = 0;
  Guid guid;
  string current = "";
# ---------- end c_script_9 ----------
updatebooleanclip = Boolean(True)
separator_6 = CreateSeparator(Thickness=Slider(1, range=0..100), Horizontal=True, Color=swatch)
scrollviewer = CreateScrollViewer(
    UIElements=checklist,
    HorizontalScrollBarVisibility=2,
    VerticalScrollBarVisibility=0,
    Width=Slider(193, range=0..1000),
    Height=Slider(231, range=0..1000))
values_16 = ValueListener(Elements=toggle_6, SomeProperty=True)  # -> Values, Indices
values_17 = ValueListener(Elements=radiobtn_3, SomeProperty=True)  # -> flatten(Values), Indices
and_2 = GateAnd(A=values_16.Values, B=values_17.Values)
merge_9 = Merge(Data1=flatten(stack_6), Data2=flatten(separator_6), Data3=flatten(scrollviewer))
int_2 = Integer(and_2)
item_5 = ListItem(List=int_2, Index=0, Wrap=True)  # -> Item, Item1
values_18 = ValueListener(Elements=pulldown_2, SomeProperty=True)  # -> Values, Indices

values_19 = ValueListener(Elements=pulldown, SomeProperty=True)  # -> Values, Indices
values_20 = ValueListener(Elements=pulldown_3, SomeProperty=True)  # -> Values, Indices
values_21 = ValueListener(Elements=pulldown_4, SomeProperty=True)  # -> Values, Indices

values_22 = ValueListener(Elements=slider_2, SomeProperty=True)  # -> Values, Indices
values_23 = ValueListener(Elements=slider_3, SomeProperty=True)  # -> Values, Indices
values_24 = ValueListener(Elements=pulldown_5, SomeProperty=True)  # -> Values, Indices
values_25 = ValueListener(Elements=pulldown_2, SomeProperty=True)  # -> Values, Indices
values_26 = ValueListener(Elements=slider, SomeProperty=True)  # -> Values, Indices
values_27 = ValueListener(Elements=slider_16, SomeProperty=True)  # -> Values, Indices
values_28 = ValueListener(Elements=slider_17, SomeProperty=True)  # -> Values, Indices
values_29 = ValueListener(Elements=slider_12, SomeProperty=True)  # -> Values, Indices
values_30 = ValueListener(Elements=slider_13, SomeProperty=True)  # -> Values, Indices
values_31 = ValueListener(Elements=slider_14, SomeProperty=True)  # -> Values, Indices
values_32 = ValueListener(Elements=slider_15, SomeProperty=True)  # -> Values, Indices
values_33 = ValueListener(Elements=slider_10, SomeProperty=True)  # -> Values, Indices
values_34 = ValueListener(Elements=slider_11, SomeProperty=True)  # -> Values, Indices
expander_4 = CreateExpander(UIElements=flatten(merge_9), Header="Select Walls", Open=Toggle(False))
values_35 = ValueListener(Elements=checklist, SomeProperty=True)  # -> Values, Indices
values_36 = ValueListener(Elements=slider_9, SomeProperty=True)  # -> Values, Indices
values_37 = ValueListener(Elements=slider_5, SomeProperty=True)  # -> Values, Indices
values_38 = ValueListener(Elements=slider_6, SomeProperty=True)  # -> Values, Indices
values_39 = ValueListener(Elements=slider_7, SomeProperty=True)  # -> Values, Indices
values_40 = ValueListener(Elements=slider_8, SomeProperty=True)  # -> Values, Indices
values_41 = ValueListener(Elements=toggle_7, SomeProperty=True)  # -> Values, Indices
int_3 = Integer(item_5.Item)
num_3 = Number(values_37.Values)
num_4 = Number(values_38.Values)
int_4 = Integer(item_5.Item1)
int_5 = Integer(values_41.Values)
num_5 = Number(values_39.Values)
num_6 = Number(values_40.Values)
number_slider_7 = Slider(40, range=0..100)
merge_10 = Merge(
    Data1=values_36.Values,
    Data2=int_3,
    Data3=num_3,
    Data4=num_4,
    Data5=int_4,
    Data6=num_3,
    Data7=num_4,
    Data8=int_5,
    Data9=num_5,
    Data10=num_6)
bool = Boolean(values_35.Values)
bool_2 = Boolean(values_3.Values)

c_script_10 = CSharpScript(update=bool_2, currAltString=merge_10)  # -> out, A; inputs update: Boolean, currAltString: list of String
# ---------- c_script_10: C# ----------
    foreach( var obj in GrasshopperDocument.Objects){
      if(obj.NickName == "updateWallPropertises"){
        guid = obj.InstanceGuid;
      }
    }


    if(n == 0){
      Grasshopper.Kernel.Parameters.Param_String cmp = (Grasshopper.Kernel.Parameters.Param_String) this.GrasshopperDocument.FindObject(guid, true);
      cmp.PersistentData.Clear();
      cmp.PersistentData.Append(new GH_String("0.5"));
      cmp.PersistentData.Append(new GH_String("0"));
      cmp.PersistentData.Append(new GH_String("2"));
      cmp.PersistentData.Append(new GH_String("0.3"));
      cmp.PersistentData.Append(new GH_String("0"));
      cmp.PersistentData.Append(new GH_String("1"));
      cmp.PersistentData.Append(new GH_String("0.3"));
      cmp.ExpireSolution(true);
    }

    if(update){
      Grasshopper.Kernel.Parameters.Param_String cmp = (Grasshopper.Kernel.Parameters.Param_String) this.GrasshopperDocument.FindObject(guid, true);
      cmp.PersistentData.Clear();
      IEnumerable<Grasshopper.Kernel.Types.GH_String> convertedList = currAltString.Select(s => new Grasshopper.Kernel.Types.GH_String(s));
      cmp.PersistentData.AppendRange(convertedList, new GH_Path(0));
      cmp.ExpireSolution(true);
      n++;
    }




    n++;
# ---------- c_script_10: C# additional code ----------
  int n = 0;
  Guid guid;
# ---------- end c_script_10 ----------
updatewallpropertises = Text(["0.6", "0", "2", "0.3", "0", "2", "0.3", "0", "0", "0.3"])

c_script_11 = CSharpScript(update=bool_2, currAltString=bool)  # -> out, A; inputs update: Boolean, currAltString: list of String
# ---------- c_script_11: C# ----------
    foreach( var obj in GrasshopperDocument.Objects){
      if(obj.NickName == "updateSelectedWalls"){
        guid = obj.InstanceGuid;
      }
    }


    if(n == 0){
      Grasshopper.Kernel.Parameters.Param_String cmp = (Grasshopper.Kernel.Parameters.Param_String) this.GrasshopperDocument.FindObject(guid, true);
      cmp.PersistentData.Clear();
      IEnumerable<Grasshopper.Kernel.Types.GH_String> convertedList = currAltString.Select(s => new Grasshopper.Kernel.Types.GH_String(s));
      cmp.PersistentData.AppendRange(convertedList, new GH_Path(0));
      cmp.ExpireSolution(true);
    }

    if(update){
      Grasshopper.Kernel.Parameters.Param_String cmp = (Grasshopper.Kernel.Parameters.Param_String) this.GrasshopperDocument.FindObject(guid, true);
      cmp.PersistentData.Clear();
      IEnumerable<Grasshopper.Kernel.Types.GH_String> convertedList = currAltString.Select(s => new Grasshopper.Kernel.Types.GH_String(s));
      cmp.PersistentData.AppendRange(convertedList, new GH_Path(0));
      cmp.ExpireSolution(true);
      n++;
    }




    n++;
# ---------- c_script_11: C# additional code ----------
  int n = 0;
  Guid guid;
# ---------- end c_script_11 ----------
updateselectedwalls = Text(["True", "True", "True", "True"])

number_slider_8 = Slider(115, range=0..117)
series_5 = Series(Start=1, Step=1, Count=number_slider_7)
dup = DuplicateData(Data="<Alternative>", Number=number_slider_7, Order=True)
checkbox_3 = CreateCheckbox(Label=series_5, StartingValue=False)
true_button = CreateTrueOnlyButton(ButtonName=dup, ButtonStyle=3)
merge_11 = Merge(Data1=graft(checkbox_3), Data2=graft(true_button))
panel_20 = Panel(updatewallpropertises)
stack_7 = CreateStack(UIElements=merge_11, Horizontal=False)  # -> flatten(Stack)
values_42 = ValueListener(Elements=checkbox_3, SomeProperty=True)  # -> flatten(Values), Indices
series_6 = Series(Start=0, Step=1, Count=number_slider_7)
adjustpos_10 = AdjustElementPositioning(ElementsToAdjust=true_button, Margin="0", AbsolutePositioning=False, Width=number_slider_8, Height=number_slider_8)
hideshow_2 = HideShowElement(ElementToHideShow=true_button, Show=True, Collapse=True, Disable=True)
item_6 = ListItem(List=updatewallpropertises, Index=0, Wrap=True)  # -> Item, Item1, Item2, Item3, Item4, Item5, Item6, Item7, Item8, Item9
cull_2 = CullPattern(List=series_6, CullPattern=values_42.Values)
partition = PartitionList(List=stack_7, Size="2")
item_7 = ListItem(List=cull_2, Index=0, Wrap=True)
item_8 = ListItem(List=alternativesdata, Index=item_7, Wrap=True)
c_script_12 = CSharpScript(AltStrings=item_8, Splitter="___")  # -> out, A; inputs AltStrings: String, Splitter: String
# ---------- c_script_12: C# ----------
    string[] parts = AltStrings.Split(new string[] { Splitter }, StringSplitOptions.None);
    A = parts;
# ---------- end c_script_12 ----------
c_script_13 = CSharpScript(AltStrings=c_script_12.A, Splitter="|||")  # -> out, simplify(A); inputs AltStrings: String, Splitter: String; same code as c_script_12
branch = TreeBranch(Tree=c_script_13.A, Path=series, MaintainPaths=True)

# ---- group: Retrieved
data_8 = Data(branch)

# ----
branch_2 = TreeBranch(Tree=data_8, Path="9", MaintainPaths=True)
branch_3 = TreeBranch(Tree=data_8, Path="10", MaintainPaths=True)
setlist = SetListContents(ListToModify=pulldown_2, NewListContents=panel_9, SelectedIndex=branch_2)
branch_4 = TreeBranch(Tree=data_8, Path="15", MaintainPaths=True)
branch_5 = TreeBranch(Tree=data_8, Path="11", MaintainPaths=True)
setlist_2 = SetListContents(ListToModify=pulldown, NewListContents=panel_6, SelectedIndex=branch_3)
branch_6 = TreeBranch(Tree=data_8, Path="12", MaintainPaths=True)
setlist_3 = SetListContents(ListToModify=pulldown_5, NewListContents=data, SelectedIndex=branch_4)
setlist_4 = SetListContents(ListToModify=pulldown_3, NewListContents=panel_8, SelectedIndex=branch_5)
setlist_5 = SetListContents(ListToModify=pulldown_4, NewListContents=panel_10, SelectedIndex=branch_6)
branch_7 = TreeBranch(Tree=data_8, Path="13", MaintainPaths=True)
branch_8 = TreeBranch(Tree=data_8, Path="14", MaintainPaths=True)
branch_9 = TreeBranch(Tree=data_8, Path="28", MaintainPaths=True)
setslider_2 = SetSlider(UISlider=slider_3, Value=branch_8)
setslider_3 = SetSlider(UISlider=slider, Value=branch_9)
setslider_4 = SetSlider(UISlider=slider_2, Value=branch_7)
branch_10 = TreeBranch(Tree=data_8, Path="{23}", MaintainPaths=True)
branch_11 = TreeBranch(Tree=data_8, Path="{24}", MaintainPaths=True)
branch_12 = TreeBranch(Tree=data_8, Path="{21}", MaintainPaths=True)
branch_13 = TreeBranch(Tree=data_8, Path="{22}", MaintainPaths=True)
updated_win_shgc = Text(branch_11)
updated_roof_r_val = Text(branch_13)
updated_win_u_val = Text(branch_10)
updated_wall_r_val = Text(branch_12)
setslider_5 = SetSlider(UISlider=slider_14, Value=updated_wall_r_val)
setslider_6 = SetSlider(UISlider=slider_15, Value=updated_roof_r_val)
setslider_7 = SetSlider(UISlider=slider_10, Value=updated_win_u_val)
setslider_8 = SetSlider(UISlider=slider_11, Value=updated_win_shgc)
branch_14 = TreeBranch(Tree=data_8, Path="{19}", MaintainPaths=True)
branch_15 = TreeBranch(Tree=data_8, Path="{20}", MaintainPaths=True)
branch_16 = TreeBranch(Tree=data_8, Path="{18}", MaintainPaths=True)
branch_17 = TreeBranch(Tree=data_8, Path="{17}", MaintainPaths=True)
updated_glazing_trans = Text(branch_15)
updated_ceiling_reflt = Text(branch_17)
updated_floor_reflt = Text(branch_16)
updated_wall_reflt = Text(branch_14)
setslider_9 = SetSlider(UISlider=slider_16, Value=updated_ceiling_reflt)
setslider_10 = SetSlider(UISlider=slider_17, Value=updated_floor_reflt)
setslider_11 = SetSlider(UISlider=slider_12, Value=updated_wall_reflt)
setslider_12 = SetSlider(UISlider=slider_13, Value=updated_glazing_trans)
branch_18 = TreeBranch(Tree=data_8, Path="{1}", MaintainPaths=True)
branch_19 = TreeBranch(Tree=data_8, Path="{0}", MaintainPaths=True)
panel_21 = Panel("""False
False
True""")
panel_22 = Panel("""Retrieve
Investigate
None""")

getscreen = GetScreenDimensions()  # -> Width, Height
multiplication_3 = Multiplication(A=getscreen.Height, B=Slider(0.17, range=0..1))
multiplication_4 = Multiplication(A=getscreen.Width, B=Slider(0.11, range=0..1))
dom = ConstructDomain(DomainStart=Slider(20, range=0..1000), DomainEnd=Slider(40, range=0..10000))
dom_2 = ConstructDomain(DomainStart=Slider(864, range=0..1000), DomainEnd=Slider(1440, range=0..10000))
filter_5 = StreamFilter(Gate=and, Stream1="Analyzing . . .")
pt = ConstructPoint(XCoordinate=multiplication_4, YCoordinate=multiplication_3, ZCoordinate=0)
remap = RemapNumbers(Value=getscreen.Height, Source=dom_2, Target=dom)  # -> Mapped, Clipped
texttoscreen = RenderTextToScreen(
    Text=filter_5,
    Location=pt,
    Size=remap.Mapped,
    Color=ColourSwatch(SwatchColor=RGB(61, 0, 0)),
    Font="Cambria",
    m_scWithvp=False)

number_slider_9 = Slider(135, range=0..170)
ma = MassAddition(Input=values_42.Values)  # -> Result, PartialResults
radiobtn_4 = CreateRadioButton(RadioButtonName=panel_22, RadioButtonGroup="Operations", InitiallySelected=panel_21)
item_9 = ListItem(List=radiobtn_4, Index=0, Wrap=True)  # -> Item, Item1
larger_2 = LargerThan(FirstNumber=ma.Result, SecondNumber=1)  # -> LargerThan, OrEqualTo
adjustelem_7 = AdjustElementAppearance(
    ElementsToAdjust=graft(radiobtn_4),
    Foreground=ColourSwatch(SwatchColor=RGB(0, 0, 0)),
    Background=ColourSwatch(SwatchColor=RGB(255, 255, 255)),
    FontSize=Slider(16.3, range=0..20))
adjustpos_11 = AdjustElementPositioning(
    ElementsToAdjust=partition,
    Margin=Slider(0, range=0..1),
    AbsolutePositioning=False,
    Width=number_slider_9,
    Height=number_slider_9)
values_43 = ValueListener(Elements=item_9.Item, SomeProperty=True)  # -> Values, Indices
updateretrievedbool = Boolean(invert(values_43.Values))
filter_6 = StreamFilter(Gate=updateretrievedbool, Stream0=branch_19, Stream1=c_script_8.JSON)
filter_7 = StreamFilter(Gate=updateretrievedbool, Stream0=branch_18, Stream1=c_script_7.JSON)
c_script_14 = CSharpScript(JSON=filter_6, Reference="C:\USERS\AMPANAVOSS\DOWNLOADS\D.PREDICT.V3\NET48\Newtonsoft.Json.dll")  # -> out, simplify(curve); inputs JSON: String
# ---------- c_script_14: C# ----------
    curve = JSONToCurve(JSON);
# ---------- c_script_14: C# additional code ----------
  public string CurveToJSON (Curve curve){
    string jsonData = JsonConvert.SerializeObject(curve, Formatting.None);
    return jsonData;
  }

  public Curve JSONToCurve (string serializedCurve){
    Curve deserializedCurve = JsonConvert.DeserializeObject<Curve>(serializedCurve);
    return deserializedCurve;
  }
# ---------- end c_script_14 ----------
crv_3 = Curve(c_script_14.curve)

# ---- group: Clipping Plane
cluster_2 = Cluster_3(C=crv_3, relay=values_10.Values, onoff=updatebooleanclip)

# ----
explode = Explode(Curve=crv_3, Recursive=True)  # -> Segments, Vertices
lng = ListLength(List=explode.Segments)
c_script_15 = CSharpScript(x=lng)  # -> out, A; inputs x: Int32
# ---------- c_script_15: C# ----------
    foreach( var obj in GrasshopperDocument.Objects){
      if(obj.NickName == "UpdateWallCount"){
        guid = obj.InstanceGuid;
      }
    }

    if(x != count){
      count = x;
      Grasshopper.Kernel.Parameters.Param_Integer cmp = (Grasshopper.Kernel.Parameters.Param_Integer) this.GrasshopperDocument.FindObject(guid, true);
      cmp.PersistentData.Clear();
      cmp.PersistentData.Append(new Grasshopper.Kernel.Types.GH_Integer(count));
      cmp.ExpireSolution(true);
      A = cmp;
    }


    A = count;
# ---------- c_script_15: C# additional code ----------
  Guid guid;
  int count = 4;
# ---------- end c_script_15 ----------
updateretrievedbool_2 = Boolean(values_43.Values)
c_script_16 = CSharpScript(
    currentOutlineJSON=filter_6,
    interiorWallsJSON=filter_7,
    selectedWalls=updateselectedwalls,
    WWR=item_6.Item,
    verticalFnOnOff=item_6.Item1,
    verticalFnCnt=item_6.Item2,
    verticalFnDp=item_6.Item3,
    horizontalFnOnOff=item_6.Item4,
    horizontalFnCnt=item_6.Item5,
    horizontalFnDp=item_6.Item6,
    overhangOnOff=item_6.Item7,
    overhangOfst=item_6.Item8,
    overhangDp=item_6.Item9,
    terrain=values_18.Indices,
    heatCapacity="2",
    heatingSource="0",
    hotWaterSource="1",
    height=values_22.Values,
    floorCount=values_23.Values,
    floorProgram=values_24.Indices,
    floorType=values_25.Indices,
    footprintOffset=values_26.Values,
    ceilingReflectance=values_27.Values,
    floorReflectance=values_28.Values,
    wallReflectance=values_29.Values,
    glazingReflectance=values_30.Values,
    wallRValue=values_31.Values,
    roofRValue=values_32.Values,
    winUValue=values_33.Values,
    winSHGC=values_34.Values,
    retrievedData=data_8,
    isRetrieved=updateretrievedbool_2,
    Reference="C:\USERS\AMPANAVOSS\DOWNLOADS\D.Predict.v3\net48\Newtonsoft.Json.dll")  # -> out, Overhangs, ZoneOutline, InteriorWallsCurves, SurfaceFloor, MeshFloor, MeshCeiling, MeshExteriorWalls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; inputs currentOutlineJSON: String, interiorWallsJSON: list of String, selectedWalls: list of Boolean, WWR: Double, verticalFnOnOff: Double, verticalFnCnt: Int32, verticalFnDp: Double, horizontalFnOnOff: Double, horizontalFnCnt: Int32, horizontalFnDp: Double, overhangOnOff: Double, overhangOfst: Double, overhangDp: Double, terrain: String, heatCapacity: String, heatingSource: String, hotWaterSource: String, height: Double, floorCount: Int32, floorProgram: Double, floorType: Double, footprintOffset: Double, ceilingReflectance: Double, floorReflectance: Double, wallReflectance: Double, glazingReflectance: Double, wallRValue: Double, roofRValue: Double, groundRValue: Double, winUValue: Double, winSHGC: Double, retrievedData: tree of String, isRetrieved: Boolean
# ---------- c_script_16: C# ----------
    ///////////////////////Generating data

    if(wallcount != selectedWalls.Count ){
      allData.Clear();

      for(int i = 0 ;i < selectedWalls.Count ;i++){

        allData.Add("0", new GH_Path(2));
        allData.Add("0", new GH_Path(3));
        allData.Add("0", new GH_Path(4));
        allData.Add("0", new GH_Path(5));
        allData.Add("0", new GH_Path(6));
        allData.Add("0", new GH_Path(7));
        allData.Add("0", new GH_Path(8));

        allData.Add("0", new GH_Path(25));
        allData.Add("0", new GH_Path(26));
        allData.Add("0", new GH_Path(27));
        if(i == 0){
          allData.Add("", new GH_Path(0));
          allData.AddRange(interiorWallsJSON, new GH_Path(1));

          allData.Add(terrain.ToString(), new GH_Path(9));
          allData.Add(heatCapacity.ToString(), new GH_Path(10));
          allData.Add(heatingSource.ToString(), new GH_Path(11));
          allData.Add(hotWaterSource.ToString(), new GH_Path(12));

          allData.Add(height.ToString(), new GH_Path(13));
          allData.Add(floorCount.ToString(), new GH_Path(14));
          allData.Add(floorProgram.ToString(), new GH_Path(15));
          allData.Add(floorType.ToString(), new GH_Path(16));
          allData.Add(ceilingReflectance.ToString(), new GH_Path(17));
          allData.Add(floorReflectance.ToString(), new GH_Path(18));
          allData.Add(wallReflectance.ToString(), new GH_Path(19));
          allData.Add(glazingReflectance.ToString(), new GH_Path(20));
          allData.Add(wallRValue.ToString(), new GH_Path(21));
          allData.Add(roofRValue.ToString(), new GH_Path(22));
          allData.Add(winUValue.ToString(), new GH_Path(23));
          allData.Add(winSHGC.ToString(), new GH_Path(24));

          allData.Add(footprintOffset.ToString(), new GH_Path(28));
        }
      }
    }


    wallcount = selectedWalls.Count;



    for(int i = 0 ;i < selectedWalls.Count ;i++){

      if(String.IsNullOrEmpty(currentOutlineJSON))continue;
      allData[new GH_Path(0), 0] = currentOutlineJSON;

      allData.RemovePath(new GH_Path(1));
      allData.AddRange(interiorWallsJSON, new GH_Path(1));

      if(selectedWalls[i]){
        allData[new GH_Path(2), i] = WWR.ToString();
        allData[new GH_Path(3), i] = verticalFnOnOff.ToString();
        allData[new GH_Path(4), i] = verticalFnCnt.ToString();
        allData[new GH_Path(5), i] = verticalFnDp.ToString();
        allData[new GH_Path(6), i] = horizontalFnOnOff.ToString();
        allData[new GH_Path(7), i] = horizontalFnCnt.ToString();
        allData[new GH_Path(8), i] = horizontalFnDp.ToString();

        allData[new GH_Path(25), i] = overhangOnOff.ToString();
        allData[new GH_Path(26), i] = overhangOfst.ToString();
        allData[new GH_Path(27), i] = overhangDp.ToString();
      }

      allData[new GH_Path(9), 0] = terrain.ToString();
      allData[new GH_Path(10), 0] = heatCapacity.ToString();
      allData[new GH_Path(11), 0] = heatingSource.ToString();
      allData[new GH_Path(12), 0] = hotWaterSource.ToString();

      allData[new GH_Path(13), 0] = height.ToString();
      allData[new GH_Path(14), 0] = floorCount.ToString();
      allData[new GH_Path(15), 0] = floorProgram.ToString();
      allData[new GH_Path(16), 0] = floorType.ToString();
      allData[new GH_Path(17), 0] = ceilingReflectance.ToString();
      allData[new GH_Path(18), 0] = floorReflectance.ToString();
      allData[new GH_Path(19), 0] = wallReflectance.ToString();
      allData[new GH_Path(20), 0] = glazingReflectance.ToString();
      allData[new GH_Path(21), 0] = wallRValue.ToString();
      allData[new GH_Path(22), 0] = roofRValue.ToString();
      allData[new GH_Path(23), 0] = winUValue.ToString();
      allData[new GH_Path(24), 0] = winSHGC.ToString();

      allData[new GH_Path(28), 0] = footprintOffset.ToString();
    }

    //////////////////////////Defining active curve and data and active interiorwall curves


    Curve outline ;
    List<Curve> activeInteriorWalls = new List<Curve>();
    DataTree<string> activeData = new DataTree<string>();

    if(isRetrieved && retrievedData.Branch(0).Count > 0 && retrievedData.AllData().Count > 0){
      activeData = retrievedData;
      outline = JSONToCurve(activeData[new GH_Path(0), 0]);
      for(int i = 0; i < activeData.Branch(1).Count ;i++ ){
        Curve crv = JSONToCurve(activeData[new GH_Path(1), i]);
        if(crv != null)
          activeInteriorWalls.Add(crv);
      }
    }
    else{
      activeData = allData;
      outline = JSONToCurve(activeData.Branch(0)[0]);
      for(int i = 0; i < activeData.Branch(1).Count ;i++ ){
        Curve crv = JSONToCurve(activeData[new GH_Path(1), i]);
        if(crv != null)
          activeInteriorWalls.Add(crv);
      }
    }



    //A = activeData;
    /////////////////////Generating Frames and fins

    List<Curve> AllClosedCurves = new List<Curve> ();
    AllClosedCurves.Add(outline);
    if(activeInteriorWalls.Count > 0){
      foreach(Curve c in activeInteriorWalls){
        if(c.IsClosed){
          List<Point3d> cornerPoints = new List<Point3d> ();
          cornerPoints.AddRange(c.ToNurbsCurve().GrevillePoints());
          foreach(Point3d pt in cornerPoints){
            if(outline.Contains(pt, Plane.WorldXY, 0.01) == Rhino.Geometry.PointContainment.Inside){
              AllClosedCurves.Add(c);
            }
          }
        }
      }
    }

    Brep FloorBrep = Brep.CreatePlanarBreps(AllClosedCurves, 0.01)[0].DuplicateBrep();
    Mesh floorM = Mesh.CreateFromBrep(FloorBrep, MeshingParameters.FastRenderMesh)[0];
    Mesh ceilingM = floorM.DuplicateMesh();
    ceilingM.Translate(Vector3d.ZAxis * Convert.ToDouble(activeData[new GH_Path(13), 0]));
    MeshFloor = floorM;
    MeshCeiling = ceilingM;
    SurfaceFloor = FloorBrep;

    //////Ceiling and Floor geometry without holes
    Brep solidFloorBrep = Brep.CreatePlanarBreps(outline, 0.01)[0].DuplicateBrep();
    Mesh solidFloorM = Mesh.CreateFromBrep(solidFloorBrep, MeshingParameters.FastRenderMesh)[0];
    Mesh solidCeilingM = solidFloorM.DuplicateMesh();
    solidCeilingM.Translate(Vector3d.ZAxis * Convert.ToDouble(activeData[new GH_Path(13), 0]));
    SolidMeshFloor = solidFloorM;
    SolidMeshCeiling = solidCeilingM;




    DataTree<Mesh> porousWalls = new DataTree<Mesh>();
    DataTree<Mesh> solidWalls = new DataTree<Mesh>();
    DataTree<double> wwrForEachWall = new DataTree<double>();

    DataTree<Mesh> AllFrames = new DataTree<Mesh>();
    DataTree<Mesh> AllVrtFins = new DataTree<Mesh>();
    DataTree<Mesh> AllHrzFins = new DataTree<Mesh>();
    DataTree<Mesh> AllOverhangs = new DataTree<Mesh>();
    Mesh mesh = new Mesh();
    Mesh VrtFins = new Mesh();
    Mesh HrzFins = new Mesh();
    DataTree<double> verticalSpacingNumbers = new DataTree<double>();
    DataTree<double> horizontalSpacingNumbers = new DataTree<double>();
    DataTree<double> verticalFinsDepth = new DataTree<double>();
    DataTree<double> horizontalFinsDepth = new DataTree<double>();
    DataTree<Mesh> allWindows = new DataTree<Mesh>();
    double verticalSpacing = 0;double horizontalSpacing = 0; Vector3d normalVector = new Vector3d();
    List<Curve> allSegments1 = new List<Curve> ();
    allSegments1.AddRange(outline.DuplicateSegments());
    List<Curve> allSegments2 = new List<Curve> ();
    double minLng = 3;
    TWWR = 0;




    if(allSegments1.Count != selectedWalls.Count)return; /////Checkkkk


    DataTree<double> lgVrtHrzSpacingDepth = new DataTree<double>();



    for(int i = 0 ;i < allSegments1.Count ;i++){
      ///*
      TWWR += Convert.ToDouble(activeData[new GH_Path(2), i]) / allSegments1.Count * 1.0;
      Curve cr = allSegments1[i];
      cr.Domain = new Interval(0, 1);

      /////////////////////////////////Generating objects for energy performance
      if(Convert.ToDouble(activeData[new GH_Path(2), i]) > 0){
        porousWalls.Add(GenerateInteriorWalls(FloorBrep, cr, Convert.ToDouble(activeData[new GH_Path(13), 0])), new GH_Path(i));
        wwrForEachWall.Add(Convert.ToDouble(activeData[new GH_Path(2), i]), new GH_Path(i));
      }
      else
        solidWalls.Add(GenerateInteriorWalls(FloorBrep, cr, Convert.ToDouble(activeData[new GH_Path(13), 0])), new GH_Path(i));
      ///////////////////////


      double crvLength = cr.PointAtStart.DistanceTo(cr.PointAtEnd);
      lgVrtHrzSpacingDepth.Add(crvLength, new GH_Path(i));//

      int crvDivision = (int) Math.Ceiling(crvLength / minLng);
      Mesh win = new Mesh();
      Mesh overhng = new Mesh();
      if(crvDivision == 1){
        GenerateFrame(FloorBrep, cr, Convert.ToDouble(activeData[new GH_Path(2), i]), Convert.ToDouble(activeData[new GH_Path(13), 0]), Convert.ToInt32(activeData[new GH_Path(3), i]), Convert.ToInt32(activeData[new GH_Path(4), i]),
          Convert.ToDouble(activeData[new GH_Path(5), i]), Convert.ToInt32(activeData[new GH_Path(6), i]), Convert.ToInt32(activeData[new GH_Path(7), i]), Convert.ToDouble(activeData[new GH_Path(8), i])
          , Convert.ToInt32(activeData[new GH_Path(25), i]), Convert.ToDouble(activeData[new GH_Path(26), i]), Convert.ToDouble(activeData[new GH_Path(27), i]),
          out mesh, out VrtFins, out  HrzFins, out verticalSpacing, out horizontalSpacing, out normalVector, out win, out overhng);
        AllFrames.Add(mesh, new GH_Path(i));
        AllVrtFins.Add(VrtFins, new GH_Path(i));
        AllHrzFins.Add(HrzFins, new GH_Path(i));
        AllOverhangs.Add(overhng, new GH_Path(i));
        if(Convert.ToDouble(activeData[new GH_Path(2), i]) > 0){
          verticalSpacingNumbers.Add(verticalSpacing, new GH_Path(i));
          horizontalSpacingNumbers.Add(horizontalSpacing, new GH_Path(i));
          allWindows.Add(win, new GH_Path(i));

          lgVrtHrzSpacingDepth.Add(verticalSpacing, new GH_Path(i));//
          lgVrtHrzSpacingDepth.Add(horizontalSpacing, new GH_Path(i));//

          if(Convert.ToInt32(activeData[new GH_Path(3), i]) == 0){
            verticalFinsDepth.Add(0, new GH_Path(i));
            lgVrtHrzSpacingDepth.Add(0, new GH_Path(i));//
          }
          else{
            verticalFinsDepth.Add(Convert.ToDouble(activeData[new GH_Path(5), i]), new GH_Path(i));
            lgVrtHrzSpacingDepth.Add(Convert.ToDouble(activeData[new GH_Path(5), i]), new GH_Path(i));//

          }

          if(Convert.ToInt32(activeData[new GH_Path(6), i]) == 0){
            horizontalFinsDepth.Add(0, new GH_Path(i));
            lgVrtHrzSpacingDepth.Add(0, new GH_Path(i));//
          }
          else{
            horizontalFinsDepth.Add(Convert.ToDouble(activeData[new GH_Path(8), i]), new GH_Path(i));
            lgVrtHrzSpacingDepth.Add(Convert.ToDouble(activeData[new GH_Path(8), i]), new GH_Path(i));//
          }

        }
      }
      else{
        List<double> tParameters = new List<double> ();
        List<Curve> splittedCurves = new List<Curve> ();
        for(int j = 0 ;j < crvDivision ;j++)
          tParameters.Add(j * (1.0 / crvDivision * 1.0));
        splittedCurves.AddRange(cr.Split(tParameters));
        for(int k = 0 ;k < splittedCurves.Count ;k++){
          GenerateFrame(FloorBrep, splittedCurves[k], Convert.ToDouble(activeData[new GH_Path(2), i]), Convert.ToDouble(activeData[new GH_Path(13), 0]), Convert.ToInt32(activeData[new GH_Path(3), i]), Convert.ToInt32(activeData[new GH_Path(4), i]),
            Convert.ToDouble(activeData[new GH_Path(5), i]), Convert.ToInt32(activeData[new GH_Path(6), i]), Convert.ToInt32(activeData[new GH_Path(7), i]), Convert.ToDouble(activeData[new GH_Path(8), i])
            , Convert.ToInt32(activeData[new GH_Path(25), i]), Convert.ToDouble(activeData[new GH_Path(26), i]), Convert.ToDouble(activeData[new GH_Path(27), i]),
            out mesh, out VrtFins, out  HrzFins, out verticalSpacing, out horizontalSpacing, out normalVector, out win, out overhng);
          AllFrames.Add(mesh, new GH_Path(i));
          AllVrtFins.Add(VrtFins, new GH_Path(i));
          AllHrzFins.Add(HrzFins, new GH_Path(i));
          AllOverhangs.Add(overhng, new GH_Path(i));
          if(Convert.ToDouble(activeData[new GH_Path(2), i]) > 0){
            verticalSpacingNumbers.Add(verticalSpacing, new GH_Path(i));
            horizontalSpacingNumbers.Add(horizontalSpacing, new GH_Path(i));

            if(k == 0){
              lgVrtHrzSpacingDepth.Add(verticalSpacing, new GH_Path(i));//
              lgVrtHrzSpacingDepth.Add(horizontalSpacing, new GH_Path(i));//
            }

            allWindows.Add(win, new GH_Path(i));
            if(Convert.ToDouble(activeData[new GH_Path(3), i]) == 0){
              verticalFinsDepth.Add(0, new GH_Path(i));
              if(k == 0){
                lgVrtHrzSpacingDepth.Add(0, new GH_Path(i));//
              }
            }
            else{
              verticalFinsDepth.Add(Convert.ToDouble(activeData[new GH_Path(5), i]), new GH_Path(i));
              if(k == 0){
                lgVrtHrzSpacingDepth.Add(Convert.ToDouble(activeData[new GH_Path(5), i]), new GH_Path(i));//
              }
            }
            if(Convert.ToDouble(activeData[new GH_Path(6), i]) == 0){
              horizontalFinsDepth.Add(0, new GH_Path(i));
              if(k == 0){
                lgVrtHrzSpacingDepth.Add(0, new GH_Path(i));//
              }
            }
            else{
              horizontalFinsDepth.Add(Convert.ToDouble(activeData[new GH_Path(8), i]), new GH_Path(i));
              if(k == 0){
                lgVrtHrzSpacingDepth.Add(Convert.ToDouble(activeData[new GH_Path(8), i]), new GH_Path(i));//
              }
            }
          }
        }
      }

    }



    CurveLngVerticalHorizontalSpacingDepth = lgVrtHrzSpacingDepth;

    ///////////////////////Generating Interior Walls
    Mesh interiorWallMesh = new Mesh();
    InteriorWallsCurves = activeInteriorWalls;

    if(activeInteriorWalls.Count > 0){

      foreach(Curve crv in activeInteriorWalls){
        List<Curve> allSegments = new List<Curve> ();
        allSegments.AddRange(crv.DuplicateSegments());

        for(int i = 0 ;i < allSegments.Count ;i++){
          Curve cr = allSegments[i];
          double h = Convert.ToDouble(activeData[new GH_Path(13), 0]);
          Surface srf = Surface.CreateExtrusion(cr, Vector3d.ZAxis * h);

          interiorWallMesh.Append(Mesh.CreateFromSurface(srf));
        }
        interiorWallMesh = repairMesh(interiorWallMesh);
      }
    }

    //A = interiorWallMesh;

    DataTree<Mesh> JoinedAllFrames = new DataTree<Mesh>();
    for (int i = 0; i < AllFrames.BranchCount; i++){
      var joinedMesh = new Mesh();
      AllFrames.Branch(i).ForEach(m => joinedMesh.Append(m));
      JoinedAllFrames.Add(joinedMesh, AllFrames.Path(i));
    }

    DataTree<Mesh> JoinedAllVrtFins = new DataTree<Mesh>();
    for (int i = 0; i < AllVrtFins.BranchCount; i++){
      var joinedMesh = new Mesh();
      AllVrtFins.Branch(i).ForEach(m => joinedMesh.Append(m));
      JoinedAllVrtFins.Add(joinedMesh, AllVrtFins.Path(i));
    }

    DataTree<Mesh> JoinedAllHrzFins = new DataTree<Mesh>();
    for (int i = 0; i < AllHrzFins.BranchCount; i++){
      var joinedMesh = new Mesh();
      AllHrzFins.Branch(i).ForEach(m => joinedMesh.Append(m));
      JoinedAllHrzFins.Add(joinedMesh, AllHrzFins.Path(i));
    }

    DataTree<Mesh> JoinedAllOverhangs = new DataTree<Mesh>();
    for (int i = 0; i < AllOverhangs.BranchCount; i++){
      var joinedMesh = new Mesh();
      AllOverhangs.Branch(i).ForEach(m => joinedMesh.Append(m));
      JoinedAllOverhangs.Add(joinedMesh, AllOverhangs.Path(i));
    }

    MeshExteriorWalls = JoinedAllFrames;
    //if(AllVrtFins.Vertices.Count > 0)
    MeshVerticalFins = JoinedAllVrtFins;
    //if(AllHrzFins.Vertices.Count > 0)
    MeshHorizontalFins = JoinedAllHrzFins;
    MeshInteriorWalls = repairMesh(interiorWallMesh);//.SplitDisjointPieces();
    VerticalFinsSpacing = verticalSpacingNumbers;
    HorizontalFinsSpacing = horizontalSpacingNumbers;
    AlternativeData = activeData;
    MeshWindows = allWindows;
    TotalWWR = RoundNumber(TWWR, 0.01);
    VerticalFinsDepth = verticalFinsDepth;
    HorizontalFinsDepth = horizontalFinsDepth;
    PorousWalls = porousWalls;
    WwrForEachWall = wwrForEachWall;
    SolidWalls = solidWalls;
    ZoneOutline = allSegments1;


    Overhangs = JoinedAllOverhangs;
# ---------- c_script_16: C# additional code ----------
  double TWWR = 0;
  int wallcount = 0;
  DataTree<string> allData = new DataTree<string>();

  List<double> VrtFinDep = new List<double>();
  List<int> VrtFinCnt = new List<int>();

  List<double> HrzFinDep = new List<double>();
  List<int> HrzFinCnt = new List<int>();


  public void GenerateFrame (Brep floor, Curve crv, double WWR, double height, int verticalFnOnOff, int verticalFnCnt, double verticalFnDp, int horizontalFnOnOff, int horizontalFnCnt,
    double horizontalFnDp, int overhangOnOff, double overhangOfst, double overhangDp, out Mesh Frame, out Mesh VrtFins, out Mesh HrzFins, out double verticalSpacing, out double horizontalSpacing, out Vector3d normalVector,
  out Mesh window, out Mesh OverhangMesh){


    ///////////////////////////////Generating frame Mesh
    Frame = new Mesh();
    Curve crv1 = crv.DuplicateCurve();
    Curve crv2 = crv.DuplicateCurve();
    crv1.Domain = new Interval(0, 1);
    Point3d midPt = crv1.PointAt(0.5) + new Vector3d(0, 0, height / 2);
    var tr1 = Rhino.Geometry.Transform.Scale(midPt, Math.Sqrt(WWR));
    crv2.Transform(tr1);
    Point3d p1 = crv1.PointAtStart; Point3d p2 = crv1.PointAtEnd;
    Point3d p4 = crv2.PointAtStart; Point3d p3 = crv2.PointAtEnd;
    Frame.Vertices.Add(p1);
    Frame.Vertices.Add(p2);
    Frame.Vertices.Add(p3);
    Frame.Vertices.Add(p4);


    var tr2 = Rhino.Geometry.Transform.Translation(new Vector3d(0, 0, height));
    Curve crvTop = crv.DuplicateCurve();
    crvTop.Transform(tr2);
    Curve crv3 = crvTop.DuplicateCurve();
    Curve crv4 = crvTop.DuplicateCurve();
    crv1.Domain = new Interval(0, 1);
    midPt = crv1.PointAt(0.5) + new Vector3d(0, 0, height / 2);
    crv4.Transform(tr1);
    Point3d p5 = crv3.PointAtStart; Point3d p6 = crv3.PointAtEnd;
    Point3d p8 = crv4.PointAtStart; Point3d p7 = crv4.PointAtEnd;
    Frame.Vertices.Add(p5);
    Frame.Vertices.Add(p6);
    Frame.Vertices.Add(p7);
    Frame.Vertices.Add(p8);

    if(WWR > 0.01){
      Frame.Faces.AddFace(new MeshFace(0, 1, 2, 3));
      Frame.Faces.AddFace(new MeshFace(4, 5, 6, 7));
      Frame.Faces.AddFace(new MeshFace(1, 5, 6, 2));
      Frame.Faces.AddFace(new MeshFace(4, 0, 3, 7));
      Frame.UnifyNormals();
    }
    else
      Frame.Faces.AddFace(new MeshFace(0, 1, 5, 4));

    Frame = repairMesh(Frame);

    ////////////////////////////////Normal Vector
    Vector3d vr1 = p2 - p1;
    vr1.Unitize();
    vr1.Rotate(0.5 * Math.PI, Vector3d.ZAxis);
    Vector3d vr2 = -1 * vr1;
    Point3d[] testPs = new Point3d[2] {(p1 + p2) / 2 + (0.1 * vr1),(p1 + p2) / 2 + (0.1 * vr2)};
    Vector3d[] testVs = new Vector3d[2] {vr1,vr2};
    double[] testDs = new double[2] {testPs[0].DistanceTo(floor.ClosestPoint(testPs[0])),testPs[1].DistanceTo(floor.ClosestPoint(testPs[1]))};
    Array.Sort(testDs, testVs);
    normalVector = testVs[1];

    /////////////////////////////Defining objects
    window = new Mesh();
    verticalSpacing = 0;
    VrtFins = new Mesh();
    horizontalSpacing = 0;
    HrzFins = new Mesh();
    OverhangMesh = new Mesh();

    //////////////////////////////Overhang
    if(overhangOnOff != 0){
      crv1.Domain = new Interval(0, 1);
      Point3d[] overhangPt = new Point3d[2]{ crv1.PointAt(0.1) , crv1.PointAt(0.9)};
      Vector3d vtt1 = crv1.TangentAtStart;
      vtt1.Rotate(0.5 * Math.PI, Vector3d.ZAxis);

      Vector3d vtt2 = crv1.TangentAtEnd;
      vtt2.Rotate(0.5 * Math.PI, Vector3d.ZAxis);

      Point3d[] overhangPtStart = new Point3d[2]{ overhangPt[0] + 0.1 * vtt1, overhangPt[0] - 0.1 * vtt1};
      Point3d[] overhangPtEnd = new Point3d[2]{ overhangPt[1] + 0.1 * vtt2, overhangPt[1] - 0.1 * vtt2};
      Vector3d[] overhangVtStart = new Vector3d[2]{ vtt1, -1 * vtt1};
      Vector3d[] overhangVtEnd = new Vector3d[2]{ vtt2, -1 * vtt2};

      double[] overhangDisStart = new double[2]{overhangPtStart[0].DistanceTo(floor.ClosestPoint(overhangPtStart[0])),overhangPtStart[1].DistanceTo(floor.ClosestPoint(overhangPtStart[1]))};
      double[] overhangDisEnd = new double[2]{overhangPtEnd[0].DistanceTo(floor.ClosestPoint(overhangPtEnd[0])),overhangPtEnd[1].DistanceTo(floor.ClosestPoint(overhangPtEnd[1]))};
      Array.Sort(overhangDisStart, overhangVtStart);
      Array.Sort(overhangDisEnd, overhangVtEnd);

      OverhangMesh.Vertices.Add(crvTop.PointAtStart);
      OverhangMesh.Vertices.Add(crvTop.PointAtEnd);
      OverhangMesh.Vertices.Add(crvTop.PointAtEnd + (overhangDp * overhangVtEnd[1]));
      OverhangMesh.Vertices.Add(crvTop.PointAtStart + (overhangDp * overhangVtStart[1]));

      OverhangMesh.Faces.AddFace(new MeshFace(0, 1, 2, 3));
      OverhangMesh.Translate(Vector3d.ZAxis * overhangOfst * -1);
      OverhangMesh = repairMesh(OverhangMesh);
    }

    //////////////////////////////Generating windows
    if(WWR > 0){
      window.Vertices.Add(p3);
      window.Vertices.Add(p4);
      window.Vertices.Add(p8);
      window.Vertices.Add(p7);
      window.Faces.AddFace(new MeshFace(0, 1, 2, 3));

      /////////////////////////verticalSpacing

      int realVerticalFinCnt = verticalFnCnt;
      verticalFnCnt--;
      if(verticalFnCnt == 0)verticalFnCnt = 1;

      if(verticalFnCnt < 1)
        verticalSpacing = p3.DistanceTo(p4);
      else
        verticalSpacing = p3.DistanceTo(p4) / verticalFnCnt * 1.0;

      if(verticalFnOnOff == 1){
        ///////////////////////VerticalFinMesh
        for(int i = 0 ;i <= verticalFnCnt ;i++){
          double step = 1.0 / verticalFnCnt * 1.0;
          Point3d topPt = (p3 * (i * step)) + (p4 * (1 - (i * step)));
          Point3d bottomPt = (p7 * (i * step)) + (p8 * (1 - (i * step)));
          VrtFins.Vertices.Add(topPt);
          VrtFins.Vertices.Add(bottomPt);
          VrtFins.Vertices.Add(topPt + testVs[1] * verticalFnDp);
          VrtFins.Vertices.Add(bottomPt + testVs[1] * verticalFnDp);
          VrtFins.Faces.AddFace((4 * i) + 0, (4 * i) + 1, (4 * i) + 3, (4 * i) + 2);

          if(realVerticalFinCnt == 1)break;
        }
        VrtFins = repairMesh(VrtFins);
      }

      ////////////////////////horizontalSpacing
      //horizontalFnCnt--;

      if(horizontalFnCnt < 1)
        horizontalSpacing = p3.DistanceTo(p7);
      else
        horizontalSpacing = p3.DistanceTo(p7) / horizontalFnCnt * 1.0;

      if(horizontalFnOnOff == 1){
        ////////////////////////////////horizontalFinMesh
        for(int i = 0 ;i < horizontalFnCnt ;i++){
          
          double step = 1.0 / (horizontalFnCnt) *1.0;
          Point3d leftPt = (p3 * (i * step)) + (p7 * (1 - (i * step)));
          Point3d rightPt = (p4 * (i * step)) + (p8 * (1 - (i * step)));
          HrzFins.Vertices.Add(leftPt);
          HrzFins.Vertices.Add(rightPt);
          HrzFins.Vertices.Add(leftPt + testVs[1] * horizontalFnDp);
          HrzFins.Vertices.Add(rightPt + testVs[1] * horizontalFnDp);
          HrzFins.Faces.AddFace((4 * i) + 0, (4 * i) + 1, (4 * i) + 3, (4 * i) + 2);
        }
        HrzFins = repairMesh(HrzFins);
      }
    }

  }

  public Mesh repairMesh(Mesh invalidMesh){
    if(invalidMesh.Vertices.Count > 0){
      invalidMesh.Vertices.CombineIdentical(true, true);
      invalidMesh.Faces.CullDegenerateFaces();
      invalidMesh.UnifyNormals();
      invalidMesh.RebuildNormals();
      invalidMesh.Compact();
      return invalidMesh;
    }
    else
      return null;
  }


  public Mesh GenerateInteriorWalls (Brep floor, Curve crv, double height){

    Mesh InetriorWall = new Mesh();
    Point3d midPt = (crv.PointAtStart + crv.PointAtEnd) * 0.5;
    double testDs = midPt.DistanceTo(floor.ClosestPoint(midPt));
    if(testDs < 1){

      Point3d p1 = crv.PointAtStart; Point3d p2 = crv.PointAtEnd;
      Point3d p3 = crv.PointAtStart + Vector3d.ZAxis * height; Point3d p4 = crv.PointAtEnd + Vector3d.ZAxis * height;
      InetriorWall.Vertices.Add(p1);
      InetriorWall.Vertices.Add(p2);
      InetriorWall.Vertices.Add(p4);
      InetriorWall.Vertices.Add(p3);
      InetriorWall.Faces.AddFace(new MeshFace(0, 1, 2, 3));

      InetriorWall = repairMesh(InetriorWall);
      return InetriorWall;
    }
    else{
      return null;
    }
  }

  public double RoundNumber (double Number, double Scope){
    double Divide = Number / Scope;
    double wholeDiv = Math.Round(Divide);
    return Scope * wholeDiv;
  }

  public string CurveToJSON (Curve curve){
    string jsonData = JsonConvert.SerializeObject(curve, Formatting.None);
    return jsonData;
  }

  public Curve JSONToCurve (string serializedCurve){
    Curve deserializedCurve = JsonConvert.DeserializeObject<Curve>(serializedCurve);
    return deserializedCurve;
  }
# ---------- end c_script_16 ----------
hideshow_3 = HideShowElement(ElementToHideShow=item_9.Item, Show=True, Collapse=True, Disable=larger_2.LargerThan)
panel_23 = Panel(c_script_16.HorizontalFinsSpacing)
mesh_3 = Mesh(c_script_16.MeshExteriorWalls)
mjoin_2 = MeshJoin(Meshes=mesh_3)
area = Area(Geometry=c_script_16.SurfaceFloor)  # -> Area, Centroid
xy = XYPlane(Origin=area.Centroid)
planesrf = PlaneSurface(Plane=xy, XSize=Domain(-500, 500), YSize=Domain(-500, 500))
mplane = MeshPlane(Boundary=planesrf, WidthCount=10, HeightCount=10)  # -> Mesh, Area
mesh_4 = Mesh(c_script_16.MeshWindows)
mesh_5 = Mesh(c_script_16.MeshWindows)
mesh_6 = Mesh(c_script_16.MeshCeiling)
mesh_7 = Mesh([c_script_16.MeshVerticalFins, c_script_16.MeshHorizontalFins])
mesh_8 = Mesh(c_script_16.MeshFloor)
mesh_9 = Mesh(mjoin_2)
mesh_10 = Mesh(filter_4)
mesh_11 = Mesh(mplane.Mesh)
mesh_12 = Mesh(c_script_16.MeshInteriorWalls)
mesh_13 = Mesh(c_script_16.Overhangs)
entwine = Entwine(
    Branch00=mesh_6,
    Branch01=mesh_8,
    Branch02=mesh_9,
    Branch03=mesh_10,
    Branch04=mesh_11,
    Branch05=mesh_12,
    Branch06=mesh_13,
    Branch07=mesh_7,
    FlattenInputs=True)
crv_4 = Curve(c_script_16.ZoneOutline)
c_script_17 = CSharpScript(update=and, currAltString=c_script_16.AlternativeData)  # -> out, A; inputs update: Boolean, currAltString: tree of String
# ---------- c_script_17: C# ----------
    foreach( var obj in GrasshopperDocument.Objects){
      if(obj.NickName == "updateString3"){
        guid = obj.InstanceGuid;
      }
    }


    if(n == 0){
      Grasshopper.Kernel.Parameters.Param_String cmp = (Grasshopper.Kernel.Parameters.Param_String) this.GrasshopperDocument.FindObject(guid, true);
      cmp.PersistentData.Clear();
      cmp.ExpireSolution(true);
      n++;
    }

    if(update){
      Grasshopper.Kernel.Parameters.Param_String cmp = (Grasshopper.Kernel.Parameters.Param_String) this.GrasshopperDocument.FindObject(guid, true);
      cmp.PersistentData.Clear();
      for (int i = 0; i < currAltString.BranchCount; i++)
      {
        IEnumerable<Grasshopper.Kernel.Types.GH_String> convertedList = currAltString.Branch(i).Select(s => new Grasshopper.Kernel.Types.GH_String(s));
        cmp.PersistentData.AppendRange(convertedList, currAltString.Path(i));
      }
      cmp.ExpireSolution(true);
      n++;
    }
# ---------- c_script_17: C# additional code ----------
  int n = 0;
  Guid guid;
# ---------- end c_script_17 ----------
c_script_18 = CSharpScript(update=and, currAltString=c_script_16.CurveLngVerticalHorizontalSpacingDepth)  # -> out, A; inputs update: Boolean, currAltString: tree of String
# ---------- c_script_18: C# ----------
    foreach( var obj in GrasshopperDocument.Objects){
      if(obj.NickName == "updateString5"){
        guid = obj.InstanceGuid;
      }
    }


    if(n == 0){
      Grasshopper.Kernel.Parameters.Param_String cmp = (Grasshopper.Kernel.Parameters.Param_String) this.GrasshopperDocument.FindObject(guid, true);
      cmp.PersistentData.Clear();
      cmp.ExpireSolution(true);
      n++;
    }

    if(update){
      Grasshopper.Kernel.Parameters.Param_String cmp = (Grasshopper.Kernel.Parameters.Param_String) this.GrasshopperDocument.FindObject(guid, true);
      cmp.PersistentData.Clear();
      for (int i = 0; i < currAltString.BranchCount; i++)
      {
        IEnumerable<Grasshopper.Kernel.Types.GH_String> convertedList = currAltString.Branch(i).Select(s => new Grasshopper.Kernel.Types.GH_String(s));
        cmp.PersistentData.AppendRange(convertedList, currAltString.Path(i));
      }
      cmp.ExpireSolution(true);
      n++;
    }
# ---------- c_script_18: C# additional code ----------
  int n = 0;
  Guid guid;
# ---------- end c_script_18 ----------

# ---- group: Spacing
c_script_19 = CSharpScript(update=and, currAltString=c_script_16.HorizontalFinsSpacing)  # -> out, A; inputs update: Boolean, currAltString: tree of String
# ---------- c_script_19: C# ----------
    foreach( var obj in GrasshopperDocument.Objects){
      if(obj.NickName == "updateString22"){
        guid = obj.InstanceGuid;
      }
    }


    if(n == 0){
      Grasshopper.Kernel.Parameters.Param_String cmp = (Grasshopper.Kernel.Parameters.Param_String) this.GrasshopperDocument.FindObject(guid, true);
      cmp.PersistentData.Clear();
      cmp.ExpireSolution(true);
    }

    if(update){
      Grasshopper.Kernel.Parameters.Param_String cmp = (Grasshopper.Kernel.Parameters.Param_String) this.GrasshopperDocument.FindObject(guid, true);
      cmp.PersistentData.Clear();
      for (int i = 0; i < currAltString.BranchCount; i++)
      {
        IEnumerable<Grasshopper.Kernel.Types.GH_String> convertedList = currAltString.Branch(i).Select(s => new Grasshopper.Kernel.Types.GH_String(s));
        cmp.PersistentData.AppendRange(convertedList, currAltString.Path(i));
      }
      cmp.ExpireSolution(true);

    }

    n++;
# ---------- c_script_19: C# additional code ----------
  int n = 0;
  Guid guid;
# ---------- end c_script_19 ----------
c_script_20 = CSharpScript(update=and, currAltString=c_script_16.VerticalFinsSpacing)  # -> out, A; inputs update: Boolean, currAltString: tree of String
# ---------- c_script_20: C# ----------
    foreach( var obj in GrasshopperDocument.Objects){
      if(obj.NickName == "updateString11"){
        guid = obj.InstanceGuid;
      }
    }


    if(n == 0){
      Grasshopper.Kernel.Parameters.Param_String cmp = (Grasshopper.Kernel.Parameters.Param_String) this.GrasshopperDocument.FindObject(guid, true);
      cmp.PersistentData.Clear();
      cmp.ExpireSolution(true);
    }

    if(update){
      Grasshopper.Kernel.Parameters.Param_String cmp = (Grasshopper.Kernel.Parameters.Param_String) this.GrasshopperDocument.FindObject(guid, true);
      cmp.PersistentData.Clear();
      for (int i = 0; i < currAltString.BranchCount; i++)
      {
        IEnumerable<Grasshopper.Kernel.Types.GH_String> convertedList = currAltString.Branch(i).Select(s => new Grasshopper.Kernel.Types.GH_String(s));
        cmp.PersistentData.AppendRange(convertedList, currAltString.Path(i));
      }
      cmp.ExpireSolution(true);

    }

    n++;
# ---------- c_script_20: C# additional code ----------
  int n = 0;
  Guid guid;
# ---------- end c_script_20 ----------

# ----
c_script_21 = CSharpScript(update=and, sensorGridSize=cull)  # -> out, A; inputs update: Boolean, sensorGridSize: String
# ---------- c_script_21: C# ----------
    foreach( var obj in GrasshopperDocument.Objects){
      if(obj.NickName == "updateSensorGrid"){
        guid = obj.InstanceGuid;
      }
    }

    if(n == 0){
      Grasshopper.Kernel.Parameters.Param_String cmp = (Grasshopper.Kernel.Parameters.Param_String) this.GrasshopperDocument.FindObject(guid, true);
      cmp.PersistentData.Clear();
      cmp.PersistentData.Append(new GH_String("1.828"));
      cmp.ExpireSolution(true);
    }


    if(update){
      Grasshopper.Kernel.Parameters.Param_String cmp = (Grasshopper.Kernel.Parameters.Param_String) this.GrasshopperDocument.FindObject(guid, true);
      cmp.PersistentData.Clear();
      cmp.PersistentData.Append(new GH_String(sensorGridSize));
      cmp.ExpireSolution(true);
      n++;
    }
# ---------- c_script_21: C# additional code ----------
  int n = 0;
  Guid guid;
# ---------- end c_script_21 ----------

# ---- group: Depth
c_script_22 = CSharpScript(update=and, currAltString=c_script_16.VerticalFinsDepth)  # -> out, A; inputs update: Boolean, currAltString: tree of String
# ---------- c_script_22: C# ----------
    foreach( var obj in GrasshopperDocument.Objects){
      if(obj.NickName == "updateString33"){
        guid = obj.InstanceGuid;
      }
    }


    if(n == 0){
      Grasshopper.Kernel.Parameters.Param_String cmp = (Grasshopper.Kernel.Parameters.Param_String) this.GrasshopperDocument.FindObject(guid, true);
      cmp.PersistentData.Clear();
      cmp.ExpireSolution(true);
    }

    if(update){
      Grasshopper.Kernel.Parameters.Param_String cmp = (Grasshopper.Kernel.Parameters.Param_String) this.GrasshopperDocument.FindObject(guid, true);
      cmp.PersistentData.Clear();
      for (int i = 0; i < currAltString.BranchCount; i++)
      {
        IEnumerable<Grasshopper.Kernel.Types.GH_String> convertedList = currAltString.Branch(i).Select(s => new Grasshopper.Kernel.Types.GH_String(s));
        cmp.PersistentData.AppendRange(convertedList, currAltString.Path(i));
      }
      cmp.ExpireSolution(true);

    }

    n++;
# ---------- c_script_22: C# additional code ----------
  int n = 0;
  Guid guid;
# ---------- end c_script_22 ----------
c_script_23 = CSharpScript(update=and, currAltString=c_script_16.HorizontalFinsDepth)  # -> out, A; inputs update: Boolean, currAltString: tree of String
# ---------- c_script_23: C# ----------
    foreach( var obj in GrasshopperDocument.Objects){
      if(obj.NickName == "updateString44"){
        guid = obj.InstanceGuid;
      }
    }


    if(n == 0){
      Grasshopper.Kernel.Parameters.Param_String cmp = (Grasshopper.Kernel.Parameters.Param_String) this.GrasshopperDocument.FindObject(guid, true);
      cmp.PersistentData.Clear();
      cmp.ExpireSolution(true);
    }

    if(update){
      Grasshopper.Kernel.Parameters.Param_String cmp = (Grasshopper.Kernel.Parameters.Param_String) this.GrasshopperDocument.FindObject(guid, true);
      cmp.PersistentData.Clear();
      for (int i = 0; i < currAltString.BranchCount; i++)
      {
        IEnumerable<Grasshopper.Kernel.Types.GH_String> convertedList = currAltString.Branch(i).Select(s => new Grasshopper.Kernel.Types.GH_String(s));
        cmp.PersistentData.AppendRange(convertedList, currAltString.Path(i));
      }
      cmp.ExpireSolution(true);

    }

    n++;
# ---------- c_script_23: C# additional code ----------
  int n = 0;
  Guid guid;
# ---------- end c_script_23 ----------

# ----
c_script_24 = CSharpScript(update=and, currAltCurves=c_script_16.ZoneOutline)  # -> out, A; inputs update: Boolean, currAltCurves: tree of Curve
# ---------- c_script_24: C# ----------
    foreach( var obj in GrasshopperDocument.Objects){
      if(obj.NickName == "currAltCurves"){
        guid = obj.InstanceGuid;
      }
    }


    if(n == 0){
      Grasshopper.Kernel.Parameters.Param_Curve cmp = (Grasshopper.Kernel.Parameters.Param_Curve) this.GrasshopperDocument.FindObject(guid, true);
      cmp.PersistentData.Clear();
      cmp.ExpireSolution(true);
    }


    if(update){
      Grasshopper.Kernel.Parameters.Param_Curve cmp = (Grasshopper.Kernel.Parameters.Param_Curve) this.GrasshopperDocument.FindObject(guid, true);
      cmp.PersistentData.Clear();
      for (int i = 0; i < currAltCurves.BranchCount; i++)
      {
        IEnumerable<Grasshopper.Kernel.Types.GH_Curve> convertedList = currAltCurves.Branch(i).Select(s => new Grasshopper.Kernel.Types.GH_Curve(s));
        cmp.PersistentData.AppendRange(convertedList, currAltCurves.Path(i));
      }
      cmp.ExpireSolution(true);
      
    }


n++;
# ---------- c_script_24: C# additional code ----------
  int n = 0;
  Guid guid;
# ---------- end c_script_24 ----------
c_script_25 = CSharpScript(update=and, currAltMesh=mesh_5)  # -> out, A; inputs update: Boolean, currAltMesh: tree of Mesh
# ---------- c_script_25: C# ----------
    foreach( var obj in GrasshopperDocument.Objects){
      if(obj.NickName == "updateMesh2"){
        guid = obj.InstanceGuid;
      }
    }


    if(n == 0){
      Grasshopper.Kernel.Parameters.Param_Mesh cmp = (Grasshopper.Kernel.Parameters.Param_Mesh) this.GrasshopperDocument.FindObject(guid, true);
      cmp.PersistentData.Clear();
      cmp.ExpireSolution(true);
    }


    if(update){
      Grasshopper.Kernel.Parameters.Param_Mesh cmp = (Grasshopper.Kernel.Parameters.Param_Mesh) this.GrasshopperDocument.FindObject(guid, true);
      cmp.PersistentData.Clear();
      for (int i = 0; i < currAltMesh.BranchCount; i++)
      {
        IEnumerable<Grasshopper.Kernel.Types.GH_Mesh> convertedList = currAltMesh.Branch(i).Select(s => new Grasshopper.Kernel.Types.GH_Mesh(s));
        cmp.PersistentData.AppendRange(convertedList, currAltMesh.Path(i));
      }
      cmp.ExpireSolution(true);

    }

    n++;
# ---------- c_script_25: C# additional code ----------
  int n = 0;
  Guid guid;
# ---------- end c_script_25 ----------
c_script_26 = CSharpScript(update=and, epwPath=values_6.Values)  # -> out, A; inputs update: Boolean, epwPath: String
# ---------- c_script_26: C# ----------
    foreach( var obj in GrasshopperDocument.Objects){
      if(obj.NickName == "updateEPW"){
        guid = obj.InstanceGuid;
      }
    }

    if(n == 0){
      Grasshopper.Kernel.Parameters.Param_String cmp = (Grasshopper.Kernel.Parameters.Param_String) this.GrasshopperDocument.FindObject(guid, true);
      cmp.PersistentData.Clear();
      cmp.PersistentData.Append(new GH_String(""));
      cmp.ExpireSolution(true);
    }


    if(update){
      Grasshopper.Kernel.Parameters.Param_String cmp = (Grasshopper.Kernel.Parameters.Param_String) this.GrasshopperDocument.FindObject(guid, true);
      cmp.PersistentData.Clear();
      cmp.PersistentData.Append(new GH_String(epwPath));
      cmp.ExpireSolution(true);
      n++;
    }
# ---------- c_script_26: C# additional code ----------
  int n = 0;
  Guid guid;
# ---------- end c_script_26 ----------
c_script_27 = CSharpScript(update=and, currAltMesh=entwine)  # -> out, A; inputs update: Boolean, currAltMesh: tree of Mesh
# ---------- c_script_27: C# ----------
    foreach( var obj in GrasshopperDocument.Objects){
      if(obj.NickName == "updateMesh1"){
        guid = obj.InstanceGuid;
      }
    }


    if(n == 0){
      Grasshopper.Kernel.Parameters.Param_Mesh cmp = (Grasshopper.Kernel.Parameters.Param_Mesh) this.GrasshopperDocument.FindObject(guid, true);
      cmp.PersistentData.Clear();
      cmp.ExpireSolution(true);
    }


    if(update){
      Grasshopper.Kernel.Parameters.Param_Mesh cmp = (Grasshopper.Kernel.Parameters.Param_Mesh) this.GrasshopperDocument.FindObject(guid, true);
      cmp.PersistentData.Clear();
      for (int i = 0; i < currAltMesh.BranchCount; i++)
      {
        IEnumerable<Grasshopper.Kernel.Types.GH_Mesh> convertedList = currAltMesh.Branch(i).Select(s => new Grasshopper.Kernel.Types.GH_Mesh(s));
        cmp.PersistentData.AppendRange(convertedList, currAltMesh.Path(i));
      }
      cmp.ExpireSolution(true);
      
    }

n++;
# ---------- c_script_27: C# additional code ----------
  int n = 0;
  Guid guid;
# ---------- end c_script_27 ----------
c_script_28 = CSharpScript(update=and)  # -> out, A; inputs update: Boolean
# ---------- c_script_28: C# ----------
    foreach( var obj in GrasshopperDocument.Objects){
      if(obj.NickName == "updateBoolean1"){
        guid = obj.InstanceGuid;
      }
    }

    if(n == 0){
      Grasshopper.Kernel.Parameters.Param_Boolean cmp = (Grasshopper.Kernel.Parameters.Param_Boolean) this.GrasshopperDocument.FindObject(guid, true);
      cmp.PersistentData.Clear();
      cmp.PersistentData.Append(new GH_Boolean(false));
      cmp.ExpireSolution(true);
    }


    if(update){
      Grasshopper.Kernel.Parameters.Param_Boolean cmp = (Grasshopper.Kernel.Parameters.Param_Boolean) this.GrasshopperDocument.FindObject(guid, true);
      cmp.PersistentData.Clear();
      cmp.PersistentData.Append(new GH_Boolean(true));
      cmp.ExpireSolution(true);
      n++;
    }
# ---------- c_script_28: C# additional code ----------
  int n = 0;
  Guid guid;
# ---------- end c_script_28 ----------
cluster_3 = Cluster_4(relay=crv_4, T=c_script_16.AlternativeData)  # -> pl_2, R
cluster_4 = Cluster_2(relay=crv_4)  # -> pl_2, R
c_script_29 = CSharpScript(update=and, srf=c_script_16.SurfaceFloor)  # -> out, A; inputs update: Boolean, srf: Brep
# ---------- c_script_29: C# ----------
    foreach( var obj in GrasshopperDocument.Objects){
      if(obj.NickName == "updateSurface1"){
        guid = obj.InstanceGuid;
      }
    }


    if(n == 0){
      Grasshopper.Kernel.Parameters.Param_Brep cmp = (Grasshopper.Kernel.Parameters.Param_Brep) this.GrasshopperDocument.FindObject(guid, true);
      cmp.PersistentData.Clear();
      cmp.ExpireSolution(true);
    }


    if(update){
      Grasshopper.Kernel.Parameters.Param_Brep cmp = (Grasshopper.Kernel.Parameters.Param_Brep) this.GrasshopperDocument.FindObject(guid, true);
      cmp.PersistentData.Clear();
      cmp.PersistentData.Append(new GH_Brep(srf));
      cmp.ExpireSolution(true);
      
    }


n++;
# ---------- c_script_29: C# additional code ----------
  int n = 0;
  Guid guid;
# ---------- end c_script_29 ----------
updatestring5 = Text(Tree({0}: ["26", "2.23772371114206", "1.23935467078637", "0", "0"], {1}: ["8", "2.06559111797729", "1.23935467078637", "0", "0"], {2}: ["26", "2.23772371114206", "1.23935467078637", "0", "0"], {3}: ["8", "2.06559111797729", "1.23935467078637", "0", "0"]))
swatch_2 = ColourSwatch(SwatchColor=RGB(107, 80, 36))
updateboolean1 = Boolean(True)
and_3 = GateAnd(C=updateboolean1, A=values_2.Values, B=larger.LargerThan)
panel_24 = Panel(and_3)
updatestring11 = Text(Tree({0}: ["2.23772371114206", "2.23772371114206", "2.23772371114206", "2.23772371114207", "2.23772371114206", "2.23772371114207", "2.23772371114205", "2.23772371114207", "2.23772371114206"], {1}: ["2.06559111797729", "2.06559111797729", "2.06559111797729"], {2}: ["2.23772371114206", "2.23772371114206", "2.23772371114206", "2.23772371114207", "2.23772371114207", "2.23772371114207", "2.23772371114206", "2.23772371114207", "2.23772371114206"], {3}: ["2.06559111797729", "2.06559111797729", "2.06559111797729"]))
updatestring33 = Text(Tree({0}: ["0", "0", "0", "0", "0", "0", "0", "0", "0"], {1}: ["0", "0", "0"], {2}: ["0", "0", "0", "0", "0", "0", "0", "0", "0"], {3}: ["0", "0", "0"]))
updatestring44 = Text(Tree({0}: ["0", "0", "0", "0", "0", "0", "0", "0", "0"], {1}: ["0", "0", "0"], {2}: ["0", "0", "0", "0", "0", "0", "0", "0", "0"], {3}: ["0", "0", "0"]))
updateepw = Text("C:\Users\ampanavoss\AppData\Roaming\Grasshopper\Libraries\DPredict\EPW\Atlanta\USA_GA_Atlanta-Hartsfield-Jackson.Intl.AP.722190_TMY3.epw")
updatesensorgrid = Text("1.8288")
updatestring22 = Text(Tree({0}: ["1.23935467078637", "1.23935467078637", "1.23935467078637", "1.23935467078637", "1.23935467078637", "1.23935467078637", "1.23935467078637", "1.23935467078637", "1.23935467078637"], {1}: ["1.23935467078637", "1.23935467078637", "1.23935467078637"], {2}: ["1.23935467078637", "1.23935467078637", "1.23935467078637", "1.23935467078637", "1.23935467078637", "1.23935467078637", "1.23935467078637", "1.23935467078637", "1.23935467078637"], {3}: ["1.23935467078637", "1.23935467078637", "1.23935467078637"]))
updatemesh2 = Mesh(Tree({0}: [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], {1}: [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], {2}: [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], {3}: [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]))
updatesurface1 = Brep(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)
updatestring3 = Text(Tree({0}: ["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"], {1}: ["null"], {2}: ["0.6", "0.6", "0.6", "0.6"], {3}: ["0", "0", "0", "0"], {4}: ["2", "2", "2", "2"], {5}: ["0.3", "0.3", "0.3", "0.3"]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))
updatemesh1 = Mesh(Tree({0;0}: [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], {0;1}: [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], {0;2}: [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], {0;3}: [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], {0;4}: [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], {0;5}: [null], {0;6}: [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], {0;7}: [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]))
curraltcurves = Curve([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])
tag = TextTag3D(
    Location=cluster_3.pl_2,
    Text=cluster_3.R,
    Size=Slider(0.18, range=0..10),
    Colour=ColourSwatch(SwatchColor=RGB(0, 65, 135)),
    Justification=7)
preview_2 = CustomPreview(Geometry=c_script_16.Overhangs, Material=ColourSwatch(SwatchColor=RGB(176, 176, 176)))
preview_3 = CustomPreview(Geometry=c_script_16.MeshFloor, Material=ColourSwatch(SwatchColor=RGB(46, 46, 46)))
preview_4 = CustomPreview(Geometry=c_script_16.MeshHorizontalFins, Material=swatch_2)
preview_5 = CustomPreview(Geometry=c_script_16.MeshVerticalFins, Material=swatch_2)
tag_2 = TextTag3D(
    Location=cluster_4.pl_2,
    Text=cluster_4.R,
    Size=Slider(1.01, range=0..10),
    Colour=ColourSwatch(SwatchColor=RGB(0, 65, 135)),
    Justification=9)
preview_6 = CustomPreview(
    Geometry=[c_script_16.MeshExteriorWalls, c_script_16.MeshInteriorWalls],
    Material=ColourSwatch(SwatchColor=RGB(99, 99, 99)))
panel_25 = Panel(updateepw)
panel_26 = Panel(updatestring3)
clean_4 = CleanTree(RemoveNulls=True, RemoveInvalid=True, RemoveEmpty=False, Tree=updatemesh1)
bang = ExplodeTree(Data=clean_4)  # -> Branch0, Branch1, Branch2, Branch3, Branch4, Branch5, Branch6, Branch7
mesh_14 = Mesh(bang.Branch6)
txt_3 = Text(Tree({0}: ["0.051129|6.888896|7.965286|8.340905", "15.6_15.6_24_24|15.6_15.6_24_24|15.6_15.6_24_24|15.6_15.6_24_24|17.8_16.7_24_24|20_17.8_24_24|21_18.3_24_24|21_18.3_24_24|21_18.3_24_24|21_18.3_24_24|21_18.3_24_24|21_18.3_24_24|21_18.3_24_24|21_18.3_24_24|21_18.3_24_24|21_18.3_24_24|21_18.3_24_24|21_15.6_24_24|21_15.6_24_24|21_15.6_24_24|21_15.6_24_24|21_15.6_24_24|15.6_15.6_24_24|15.6_15.6_24_24", "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"], {1}: ["0.051129|9.364593|7.965286|1.291949", "15.6_15.6_24_24|15.6_15.6_24_24|15.6_15.6_24_24|15.6_15.6_24_24|15.6_15.6_24_24|21_18.3_24_24|21_18.3_24_24|21_18.3_24_24|21_18.3_24_24|21_18.3_24_24|21_18.3_24_24|21_18.3_24_24|21_18.3_24_24|21_18.3_24_24|21_18.3_24_24|21_18.3_24_24|21_18.3_24_24|21_15.6_24_24|21_15.6_24_24|21_15.6_24_24|21_15.6_24_24|21_15.6_24_24|15.6_15.6_24_24|15.6_15.6_24_24", "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"], {2}: ["0.051129|9.364593|7.965286|0.022217", "15.56_15.56_23.89_23.89|15.56_15.56_23.89_23.89|15.56_15.56_23.89_23.89|15.56_15.56_23.89_23.89|15.56_15.56_23.89_23.89|15.56_15.56_23.89_23.89|21.11_15.56_23.89_23.89|21.11_15.56_23.89_23.89|21.11_15.56_23.89_23.89|21.11_15.56_23.89_23.89|21.11_15.56_23.89_23.89|21.11_15.56_23.89_23.89|21.11_15.56_23.89_23.89|21.11_15.56_23.89_23.89|21.11_15.56_23.89_23.89|21.11_15.56_23.89_23.89|21.11_15.56_23.89_23.89|21.11_15.56_23.89_23.89|21.11_15.56_23.89_23.89|15.56_15.56_23.89_23.89|15.56_15.56_23.89_23.89|15.56_15.56_23.89_23.89|15.56_15.56_23.89_23.89|15.56_15.56_23.89_23.89", "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"], {3}: ["0.028309|6.669994|6.45834|0.149258", "21.1_21.1_24_24|21.1_21.1_24_24|21.1_21.1_24_24|21.1_21.1_24_24|21.1_21.1_24_24|21.1_21.1_24_24|21.1_21.1_24_24|21.1_21.1_24_24|21.1_21.1_24_24|21.1_21.1_24_24|21.1_21.1_24_24|21.1_21.1_24_24|21.1_21.1_24_24|21.1_21.1_24_24|21.1_21.1_24_24|21.1_21.1_24_24|21.1_21.1_24_24|21.1_21.1_24_24|21.1_21.1_24_24|21.1_21.1_24_24|21.1_21.1_24_24|21.1_21.1_24_24|21.1_21.1_24_24|21.1_21.1_24_24", "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"], {4}: ["0.028309|6.669994|6.45834|0.149258", "21.7_21.7_24.4_24.4|21.7_21.7_24.4_24.4|21.7_21.7_24.4_24.4|21.7_21.7_24.4_24.4|21.7_21.7_24.4_24.4|21.7_21.7_24.4_24.4|21.7_21.7_24.4_24.4|21.7_21.7_24.4_24.4|21.7_21.7_24.4_24.4|21.7_21.7_24.4_24.4|21.7_21.7_24.4_24.4|21.7_21.7_24.4_24.4|21.7_21.7_24.4_24.4|21.7_21.7_24.4_24.4|21.7_21.7_24.4_24.4|21.7_21.7_24.4_24.4|21.7_21.7_24.4_24.4|21.7_21.7_24.4_24.4|21.7_21.7_24.4_24.4|21.7_21.7_24.4_24.4|21.7_21.7_24.4_24.4|21.7_21.7_24.4_24.4|21.7_21.7_24.4_24.4|21.7_21.7_24.4_24.4", "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"], {5}: ["0.269098|14.999495|7.642369|1.12574", "15.6_15.6_24_24|15.6_15.6_24_24|15.6_15.6_24_24|15.6_15.6_24_24|15.6_15.6_24_24|15.6_15.6_24_24|21_15.6_24_24|21_15.6_24_24|21_15.6_24_24|21_15.6_24_24|21_15.6_24_24|21_15.6_24_24|21_15.6_24_24|21_15.6_24_24|21_15.6_24_24|21_15.6_24_24|21_15.6_24_24|21_15.6_24_24|21_15.6_24_24|21_15.6_24_24|21_15.6_24_24|15.6_15.6_24_24|15.6_15.6_24_24|15.6_15.6_24_24", "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"], {6}: ["0.376737|9.999663|7.642369|0.94112", "15.6_15.6_24_24|15.6_15.6_24_24|15.6_15.6_24_24|15.6_15.6_24_24|15.6_15.6_24_24|15.6_15.6_24_24|17.8_15.6_24_24|20_15.6_24_24|21_15.6_24_24|21_15.6_24_24|21_15.6_24_24|21_15.6_24_24|21_15.6_24_24|21_15.6_24_24|21_15.6_24_24|21_15.6_24_24|21_15.6_24_24|21_15.6_24_24|21_15.6_24_24|21_15.6_24_24|21_15.6_24_24|15.6_15.6_24_24|15.6_15.6_24_24|15.6_15.6_24_24", "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"], {7}: ["0.045962|11.84029|4.413199|0.257708", "21.11_21.11_21.11_21.11|21.11_21.11_21.11_21.11|21.11_21.11_21.11_21.11|21.11_21.11_21.11_21.11|21.11_21.11_21.11_21.11|21.11_21.11_21.11_21.11|21.11_21.11_21.11_21.11|21.11_21.11_21.11_21.11|21.11_21.11_21.11_21.11|21.11_21.11_21.11_21.11|21.11_21.11_21.11_21.11|21.11_21.11_21.11_21.11|21.11_21.11_21.11_21.11|21.11_21.11_21.11_21.11|21.11_21.11_21.11_21.11|21.11_21.11_21.11_21.11|21.11_21.11_21.11_21.11|21.11_21.11_21.11_21.11|21.111_21.11_21.111_21.11|21.111_21.11_21.111_21.11|21.111_21.11_21.111_21.11|21.111_21.11_21.111_21.11|21.111_21.11_21.111_21.11|21.111_21.11_21.111_21.11", "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"], {8}: ["0.038427|6.748965|4.413199|0.121267", "21.11_21.11_21.11_21.11|21.11_21.11_21.11_21.11|21.11_21.11_21.11_21.11|21.11_21.11_21.11_21.11|21.11_21.11_21.11_21.11|21.11_21.11_21.11_21.11|21.11_21.11_21.11_21.11|21.11_21.11_21.11_21.11|21.11_21.11_21.11_21.11|21.11_21.11_21.11_21.11|21.11_21.11_21.11_21.11|21.11_21.11_21.11_21.11|21.11_21.11_21.11_21.11|21.11_21.11_21.11_21.11|21.11_21.11_21.11_21.11|21.11_21.11_21.11_21.11|21.11_21.11_21.11_21.11|21.11_21.11_21.11_21.11|21.11_21.11_21.11_21.11|21.11_21.11_21.11_21.11|21.11_21.11_21.11_21.11|21.11_21.11_21.11_21.11|21.11_21.11_21.11_21.11|21.11_21.11_21.11_21.11", "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"]))
txt_4 = Text(flatten(Tree({0}: ["0.05382|43.0556|14.315987|0.028594"], {1}: ["22.22_22.22_22.22_22.22|22.22_22.22_22.22_22.22|22.22_22.22_22.22_22.22|22.22_22.22_22.22_22.22|22.22_22.22_22.22_22.22|22.22_22.22_22.22_22.22|22.22_22.22_22.22_22.22|22.22_22.22_22.22_22.22|22.22_22.22_22.22_22.22|22.22_22.22_22.22_22.22|22.22_22.22_22.22_22.22|22.22_22.22_22.22_22.22|22.22_22.22_22.22_22.22|22.22_22.22_22.22_22.22|22.22_22.22_22.22_22.22|22.22_22.22_22.22_22.22|22.22_22.22_22.22_22.22|22.22_22.22_22.22_22.22|22.22_22.22_22.22_22.22|22.22_22.22_22.22_22.22|22.22_22.22_22.22_22.22|22.22_22.22_22.22_22.22|22.22_22.22_22.22_22.22|22.22_22.22_22.22_22.22"], {2}: ["0.05_0.05_0.2_0.2_0.2_0.1|0.05_0.05_0.2_0.2_0.2_0.1|0.05_0.05_0.2_0.2_0.2_0.1|0.05_0.05_0.2_0.2_0.2_0.1|0.05_0.05_0.2_0.2_0.2_0.1|0.05_0.05_0.2_0.3_0.3_0.1|0.1_0.1_0.3_0.3_0.5_0.1|0.2_0.1_0.4_0.4_0.9_0.4|0.9_0.3_0.5_0.4_0.9_0.4|0.9_0.3_0.5_0.4_0.9_0.4|0.45_0.3_0.5_0.4_0.9_0.4|0.45_0.3_0.4_0.3_0.8_0.2|0.9_0.1_0.5_0.3_0.9_0.2|0.9_0.1_0.5_0.3_0.9_0.2|0.9_0.1_0.5_0.3_0.9_0.2|0.9_0.1_0.5_0.3_0.9_0.2|0.9_0.1_0.4_0.2_0.9_0.1|0.3_0.05_0.3_0.2_0.5_0.1|0.1_0.05_0.3_0.2_0.5_0.1|0.1_0.05_0.2_0.2_0.3_0.1|0.1_0.05_0.2_0.2_0.3_0.1|0.05_0.05_0.2_0.2_0.2_0.1|0.05_0.05_0.2_0.2_0.2_0.1|0.05_0.05_0.2_0.2_0.2_0.1"])))
bang_2 = ExplodeTree(Data=txt_3)  # -> Branch0, Branch1, Branch2, Branch3, Branch4, Branch5, Branch6, Branch7, Branch8
entwine_2 = Entwine(
    Branch00=bang_2.Branch0,
    Branch01=bang_2.Branch1,
    Branch02=bang_2.Branch2,
    Branch03=bang_2.Branch3,
    Branch04=bang_2.Branch4,
    Branch05=bang_2.Branch5,
    Branch06=bang_2.Branch6,
    Branch07=bang_2.Branch7,
    Branch08=bang_2.Branch8,
    Branch09=txt_4,
    FlattenInputs=True)  # -> simplify(Result)
brep_2 = Brep(updatesurface1)
text = Text(updateepw)
curve = Curve(curraltcurves)
text_2 = Text(updatestring3)
text_3 = Text(updatestring5)
# Footprint offset from ground level
branch_20 = TreeBranch(Tree=simplify(updatestring3), Path="{28}", MaintainPaths=True)
branch_21 = TreeBranch(Tree=simplify(updatestring3), Path="{13}", MaintainPaths=True)
branch_22 = TreeBranch(Tree=simplify(updatestring3), Path="{14}", MaintainPaths=True)
cluster_5 = Cluster_10(relay=brep_2)  # -> srf_2, R, R_2
multiplication_5 = Multiplication(A=branch_21, B=branch_22)
srf = Surface(cluster_5.srf_2)
neg = Negative(Value=branch_20)
addition = Addition(A=branch_20, B=branch_21)
Z = UnitZ(Factor=neg)
subtraction = Subtraction(A=multiplication_5, B=addition)
cluster_6 = Cluster_16(crv=curve, mesh=bang.Branch3, relay=updatesurface1, relay_2=updatemesh2, relay_3=updatestring3, B=branch_20)  # -> horizonangles, R
move = Move(Geometry=updatesurface1, Motion=Z)  # -> Geometry, Transform
mesh_15 = Mesh(bang.Branch4)
Z_2 = UnitZ(Factor=multiplication_5)
Z_3 = UnitZ(Factor=branch_21)
abs = Absolute(Value=subtraction)
demesh = DeconstructMesh(Mesh=mesh_15)  # -> Vertices, Faces, Colours, Normals
extr = Extrude(Base=move.Geometry, Direction=Z_2)
branch_23 = TreeBranch(Tree=simplify(text_2), Path="{13}", MaintainPaths=True)
branch_24 = TreeBranch(Tree=simplify(text_2), Path="{2}", MaintainPaths=True)
branch_25 = TreeBranch(Tree=text_2, Path="{15}", MaintainPaths=True)
branch_26 = TreeBranch(Tree=text_2, Path="{14}", MaintainPaths=True)
move_2 = Move(Geometry=updatesurface1, Motion=Z_3)  # -> Geometry, Transform
Z_4 = UnitZ(Factor=abs)
item_10 = ListItem(List=demesh.Vertices, Index=0, Wrap=True)
txt_5 = Text(["LargeOffice", "MediumOffice", "SmallOffice", "MidriseApartment", "HighriseApartment", "PrimarySchool", "SecondarySchool", "SmallHotel", "LargeHotel"])
num_7 = Number(cluster_5.R_2)
horizon_angle = Panel(cluster_6.horizonangles)
extr_2 = Extrude(Base=move_2.Geometry, Direction=Z_4)
pdecon = Deconstruct(Point=item_10)  # -> XComponent, YComponent, ZComponent
cluster_7 = Cluster_14(crv=curve, data=text_3)  # -> alpha, beta
edges = BrepEdges(Brep=extr)  # -> Naked, Interior, NonManifold
panel_27 = Panel("""S
SE
E
NE
N
NW
W
SW""")
jagged = SettingsSpeed()
subtraction_2 = Subtraction(A=pdecon.ZComponent, B=branch_20, C=1)
cluster_8 = Cluster_12(C=branch_26, crv=curve, B=branch_23, relay=branch_24)  # -> wall_2, win_2
dash = DashPattern(Curve=edges.Interior, Pattern=[Slider(0.09, range=0..1), Slider(0.19, range=0..1)])  # -> Dashes, Gaps
mesh_16 = MeshBrep(Brep=extr_2, Settings=jagged)
horizontal = Panel(cluster_7.alpha)
txt_6 = Text(Tree({0}: ["0.051129|6.888896|7.965286|8.340905", "15.6_15.6_24_24|15.6_15.6_24_24|15.6_15.6_24_24|15.6_15.6_24_24|17.8_16.7_24_24|20_17.8_24_24|21_18.3_24_24|21_18.3_24_24|21_18.3_24_24|21_18.3_24_24|21_18.3_24_24|21_18.3_24_24|21_18.3_24_24|21_18.3_24_24|21_18.3_24_24|21_18.3_24_24|21_18.3_24_24|21_15.6_24_24|21_15.6_24_24|21_15.6_24_24|21_15.6_24_24|21_15.6_24_24|15.6_15.6_24_24|15.6_15.6_24_24", "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"], {1}: ["0.051129|9.364593|7.965286|1.291949", "15.6_15.6_24_24|15.6_15.6_24_24|15.6_15.6_24_24|15.6_15.6_24_24|15.6_15.6_24_24|21_18.3_24_24|21_18.3_24_24|21_18.3_24_24|21_18.3_24_24|21_18.3_24_24|21_18.3_24_24|21_18.3_24_24|21_18.3_24_24|21_18.3_24_24|21_18.3_24_24|21_18.3_24_24|21_18.3_24_24|21_15.6_24_24|21_15.6_24_24|21_15.6_24_24|21_15.6_24_24|21_15.6_24_24|15.6_15.6_24_24|15.6_15.6_24_24", "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"], {2}: ["0.051129|9.364593|7.965286|0.022217", "15.56_15.56_23.89_23.89|15.56_15.56_23.89_23.89|15.56_15.56_23.89_23.89|15.56_15.56_23.89_23.89|15.56_15.56_23.89_23.89|15.56_15.56_23.89_23.89|21.11_15.56_23.89_23.89|21.11_15.56_23.89_23.89|21.11_15.56_23.89_23.89|21.11_15.56_23.89_23.89|21.11_15.56_23.89_23.89|21.11_15.56_23.89_23.89|21.11_15.56_23.89_23.89|21.11_15.56_23.89_23.89|21.11_15.56_23.89_23.89|21.11_15.56_23.89_23.89|21.11_15.56_23.89_23.89|21.11_15.56_23.89_23.89|21.11_15.56_23.89_23.89|15.56_15.56_23.89_23.89|15.56_15.56_23.89_23.89|15.56_15.56_23.89_23.89|15.56_15.56_23.89_23.89|15.56_15.56_23.89_23.89", "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"], {3}: ["0.028309|6.669994|6.45834|0.149258", "21.1_21.1_24_24|21.1_21.1_24_24|21.1_21.1_24_24|21.1_21.1_24_24|21.1_21.1_24_24|21.1_21.1_24_24|21.1_21.1_24_24|21.1_21.1_24_24|21.1_21.1_24_24|21.1_21.1_24_24|21.1_21.1_24_24|21.1_21.1_24_24|21.1_21.1_24_24|21.1_21.1_24_24|21.1_21.1_24_24|21.1_21.1_24_24|21.1_21.1_24_24|21.1_21.1_24_24|21.1_21.1_24_24|21.1_21.1_24_24|21.1_21.1_24_24|21.1_21.1_24_24|21.1_21.1_24_24|21.1_21.1_24_24", "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"], {4}: ["0.028309|6.669994|6.45834|0.149258", "21.7_21.7_24.4_24.4|21.7_21.7_24.4_24.4|21.7_21.7_24.4_24.4|21.7_21.7_24.4_24.4|21.7_21.7_24.4_24.4|21.7_21.7_24.4_24.4|21.7_21.7_24.4_24.4|21.7_21.7_24.4_24.4|21.7_21.7_24.4_24.4|21.7_21.7_24.4_24.4|21.7_21.7_24.4_24.4|21.7_21.7_24.4_24.4|21.7_21.7_24.4_24.4|21.7_21.7_24.4_24.4|21.7_21.7_24.4_24.4|21.7_21.7_24.4_24.4|21.7_21.7_24.4_24.4|21.7_21.7_24.4_24.4|21.7_21.7_24.4_24.4|21.7_21.7_24.4_24.4|21.7_21.7_24.4_24.4|21.7_21.7_24.4_24.4|21.7_21.7_24.4_24.4|21.7_21.7_24.4_24.4", "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"], {5}: ["0.269098|14.999495|7.642369|1.12574", "15.6_15.6_24_24|15.6_15.6_24_24|15.6_15.6_24_24|15.6_15.6_24_24|15.6_15.6_24_24|15.6_15.6_24_24|21_15.6_24_24|21_15.6_24_24|21_15.6_24_24|21_15.6_24_24|21_15.6_24_24|21_15.6_24_24|21_15.6_24_24|21_15.6_24_24|21_15.6_24_24|21_15.6_24_24|21_15.6_24_24|21_15.6_24_24|21_15.6_24_24|21_15.6_24_24|21_15.6_24_24|15.6_15.6_24_24|15.6_15.6_24_24|15.6_15.6_24_24", "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"], {6}: ["0.376737|9.999663|7.642369|0.94112", "15.6_15.6_24_24|15.6_15.6_24_24|15.6_15.6_24_24|15.6_15.6_24_24|15.6_15.6_24_24|15.6_15.6_24_24|17.8_15.6_24_24|20_15.6_24_24|21_15.6_24_24|21_15.6_24_24|21_15.6_24_24|21_15.6_24_24|21_15.6_24_24|21_15.6_24_24|21_15.6_24_24|21_15.6_24_24|21_15.6_24_24|21_15.6_24_24|21_15.6_24_24|21_15.6_24_24|21_15.6_24_24|15.6_15.6_24_24|15.6_15.6_24_24|15.6_15.6_24_24", "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"], {7}: ["0.045962|11.84029|4.413199|0.257708", "21.11_21.11_21.11_21.11|21.11_21.11_21.11_21.11|21.11_21.11_21.11_21.11|21.11_21.11_21.11_21.11|21.11_21.11_21.11_21.11|21.11_21.11_21.11_21.11|21.11_21.11_21.11_21.11|21.11_21.11_21.11_21.11|21.11_21.11_21.11_21.11|21.11_21.11_21.11_21.11|21.11_21.11_21.11_21.11|21.11_21.11_21.11_21.11|21.11_21.11_21.11_21.11|21.11_21.11_21.11_21.11|21.11_21.11_21.11_21.11|21.11_21.11_21.11_21.11|21.11_21.11_21.11_21.11|21.11_21.11_21.11_21.11|21.111_21.11_21.111_21.11|21.111_21.11_21.111_21.11|21.111_21.11_21.111_21.11|21.111_21.11_21.111_21.11|21.111_21.11_21.111_21.11|21.111_21.11_21.111_21.11", "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"], {8}: ["0.038427|6.748965|4.413199|0.121267", "21.11_21.11_21.11_21.11|21.11_21.11_21.11_21.11|21.11_21.11_21.11_21.11|21.11_21.11_21.11_21.11|21.11_21.11_21.11_21.11|21.11_21.11_21.11_21.11|21.11_21.11_21.11_21.11|21.11_21.11_21.11_21.11|21.11_21.11_21.11_21.11|21.11_21.11_21.11_21.11|21.11_21.11_21.11_21.11|21.11_21.11_21.11_21.11|21.11_21.11_21.11_21.11|21.11_21.11_21.11_21.11|21.11_21.11_21.11_21.11|21.11_21.11_21.11_21.11|21.11_21.11_21.11_21.11|21.11_21.11_21.11_21.11|21.11_21.11_21.11_21.11|21.11_21.11_21.11_21.11|21.11_21.11_21.11_21.11|21.11_21.11_21.11_21.11|21.11_21.11_21.11_21.11|21.11_21.11_21.11_21.11", "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"], {9}: ["0.05382|43.0556|14.315987|0.028594", "22.22_22.22_22.22_22.22|22.22_22.22_22.22_22.22|22.22_22.22_22.22_22.22|22.22_22.22_22.22_22.22|22.22_22.22_22.22_22.22|22.22_22.22_22.22_22.22|22.22_22.22_22.22_22.22|22.22_22.22_22.22_22.22|22.22_22.22_22.22_22.22|22.22_22.22_22.22_22.22|22.22_22.22_22.22_22.22|22.22_22.22_22.22_22.22|22.22_22.22_22.22_22.22|22.22_22.22_22.22_22.22|22.22_22.22_22.22_22.22|22.22_22.22_22.22_22.22|22.22_22.22_22.22_22.22|22.22_22.22_22.22_22.22|22.22_22.22_22.22_22.22|22.22_22.22_22.22_22.22|22.22_22.22_22.22_22.22|22.22_22.22_22.22_22.22|22.22_22.22_22.22_22.22|22.22_22.22_22.22_22.22", "0.05_0.05_0.2_0.2_0.2_0.1|0.05_0.05_0.2_0.2_0.2_0.1|0.05_0.05_0.2_0.2_0.2_0.1|0.05_0.05_0.2_0.2_0.2_0.1|0.05_0.05_0.2_0.2_0.2_0.1|0.05_0.05_0.2_0.3_0.3_0.1|0.1_0.1_0.3_0.3_0.5_0.1|0.2_0.1_0.4_0.4_0.9_0.4|0.9_0.3_0.5_0.4_0.9_0.4|0.9_0.3_0.5_0.4_0.9_0.4|0.45_0.3_0.5_0.4_0.9_0.4|0.45_0.3_0.4_0.3_0.8_0.2|0.9_0.1_0.5_0.3_0.9_0.2|0.9_0.1_0.5_0.3_0.9_0.2|0.9_0.1_0.5_0.3_0.9_0.2|0.9_0.1_0.5_0.3_0.9_0.2|0.9_0.1_0.4_0.2_0.9_0.1|0.3_0.05_0.3_0.2_0.5_0.1|0.1_0.05_0.3_0.2_0.5_0.1|0.1_0.05_0.2_0.2_0.3_0.1|0.1_0.05_0.2_0.2_0.3_0.1|0.05_0.05_0.2_0.2_0.2_0.1|0.05_0.05_0.2_0.2_0.2_0.1|0.05_0.05_0.2_0.2_0.2_0.1"]))
panel_28 = Panel(cluster_8.wall_2)
previewlw = CustomPreviewLineweights(Geometry=dash.Dashes, Shader=ColourSwatch(SwatchColor=RGB(79, 79, 79)), Thickness=0.1, Absolute=False)
multiplication_6 = Multiplication(A=num_7, B=branch_26)
multiplication_7 = Multiplication(A=branch_26, B=branch_23)
vertical = Panel(cluster_7.beta)
multiplication_8 = Multiplication(A=num_7, B=branch_26, C=branch_23)
branch_27 = TreeBranch(Tree=txt_6, Path=branch_25, MaintainPaths=True)
panel_29 = Panel(cluster_8.win_2)
panel_30 = Panel("""{21}
{22}
{23}
{24}""")
item_11 = ListItem(List=branch_27, Index=0, Wrap=True)  # -> Item, Item1, Item2
branch_28 = TreeBranch(Tree=text_2, Path=panel_30, MaintainPaths=True)
split = TextSplit(Text=item_11.Item, Separators="|")
bang_3 = ExplodeTree(Data=branch_28)  # -> Branch0, Branch1, Branch2, Branch3
panel_31 = Panel("""S
SE
E
NE
N
NW
W
SW
Roof(Hor)""")
item_12 = ListItem(List=split, Index=0, Wrap=True)  # -> Item, Item1, Item2, Item3
txt_7 = Text(flatten(cluster_8.win_2))
txt_8 = Text(flatten(cluster_8.wall_2))
multiplication_9 = Multiplication(A=cluster_5.R, B=branch_26, C=branch_23)
multiplication_10 = Multiplication(A=branch_26, B=branch_23)
multiplication_11 = Multiplication(A=cluster_5.R, B=branch_26)
num_8 = Number(bang_3.Branch3)
num_9 = Number(bang_3.Branch2)
multiplication_12 = Multiplication(A=bang_3.Branch1, B="0.176228083653")
multiplication_13 = Multiplication(A=bang_3.Branch0, B="0.176228083653")
one_over_x = OneOverX(Value=item_12.Item)
branch_29 = TreeBranch(Tree=text_2, Path="{9}", MaintainPaths=True)
branch_30 = TreeBranch(Tree=text_2, Path="{10}", MaintainPaths=True)
branch_31 = TreeBranch(Tree=text_2, Path="{11}", MaintainPaths=True)
branch_32 = TreeBranch(Tree=text_2, Path="{12}", MaintainPaths=True)
merge_12 = Merge(Data1=flatten(cluster_6.horizonangles), Data2=flatten(""))
merge_13 = Merge(Data1=flatten(txt_7), Data2=flatten(""))
merge_14 = Merge(Data1=flatten(cluster_7.alpha), Data2=flatten(""))
merge_15 = Merge(Data1=flatten(cluster_7.beta), Data2=flatten(""))
merge_16 = Merge(Data1=flatten(txt_8), Data2=flatten(num_7))
dup_2 = DuplicateData(Number=9, Order=True)  # -> simplify(Data)
c_script_30 = CSharpScript(SHGC=num_8, U=num_9)  # -> out, A; inputs SHGC: Double, U: Double
# ---------- c_script_30: C# ----------
    if(U>4.5 && SHGC <0.7206)
      A = 0.939998 * Math.Pow(SHGC, 2) + 0.20332 * SHGC;
    if(U > 4.5 && SHGC >= 0.7206)
      A = 1.30415*SHGC  - 0.30515;
    if(U < 3.4 && SHGC <= 0.15)
      A = 0.41040 * SHGC;
    if(U < 3.4 && SHGC > 0.15)
      A = 0.085775 * Math.Pow(SHGC, 2)+ 0.963954 *SHGC -0.084958;
# ---------- end c_script_30 ----------
one_over_x_2 = OneOverX(Value=multiplication_12)
one_over_x_3 = OneOverX(Value=multiplication_13)
c_script_31 = CSharpScript(x=branch_25, y="120")  # -> out, A; inputs x: list of Double, y: Double
# ---------- c_script_31: C# ----------
    if(x.Count > 0 )
      A = y;
    else
      A =x;
# ---------- end c_script_31 ----------
c_script_32 = CSharpScript(x=item_12.Item3, y="0.735")  # -> out, A; inputs x: list of Double, y: Double
# ---------- c_script_32: C# ----------
    if(x.Count > 0 )
      A = x[0] * y;
    else
      A = x;
# ---------- end c_script_32 ----------
item_13 = ListItem(
    List=["Very Light: 80,000 * Af", "Light : 110,000 * Af", "Medium: 165,000 * Af", "Heavy: 260,000 * Af", "Very heavy: 370,000 * Af"],
    Index=branch_30,
    Wrap=True)
c_script_33 = CSharpScript(x=branch_25, y="8.02")  # -> out, A; inputs x: list of Double, y: Double; same code as c_script_31
item_14 = ListItem(List=["Electricity", "Natural Gas", "Fuel"], Index=branch_31, Wrap=True)
item_15 = ListItem(List=["Electricity", "Natural Gas", "Fuel"], Index=branch_32, Wrap=True)
item_16 = ListItem(List=["Open terrain", "Country", "Urban / City"], Index=branch_29, Wrap=True)
merge_17 = Merge(Data1=flatten(one_over_x_3), Data2=flatten(0.85), Data3=flatten(0.85), Data4=flatten(" "))
merge_18 = Merge(Data1=flatten(num_9), Data2=flatten(" "), Data3=flatten(0.85), Data4=flatten(c_script_30.A))
merge_19 = Merge(Data1=flatten(one_over_x_2), Data2=flatten(0.85), Data3=flatten(0.85), Data4=flatten(" "))
dup_3 = DuplicateData(Number="4", Order=True)
panel_32 = Panel("""3
6""")
entwine_3 = Entwine(
    Branch00=merge_16,
    Branch01=dup_2,
    Branch02=merge_13,
    Branch03=merge_14,
    Branch04=merge_15,
    Branch05=merge_12,
    FlattenInputs=True)  # -> simplify(Result)
branch_33 = TreeBranch(Tree=updatestring3, Path=panel_32, MaintainPaths=True)  # -> simplify(Branch)
txt_9 = Text(item_15)
txt_10 = Text(item_14)
txt_11 = Text(multiplication_7)
txt_12 = Text(item_13)
txt_13 = Text(multiplication_8)
txt_14 = Text(item_16)
branch_34 = TreeBranch(Tree=updatestring3, Path="{17}", MaintainPaths=True)
branch_35 = TreeBranch(Tree=updatestring3, Path="{18}", MaintainPaths=True)
branch_36 = TreeBranch(Tree=updatestring3, Path="{19}", MaintainPaths=True)
branch_37 = TreeBranch(Tree=updatestring3, Path="{20}", MaintainPaths=True)
dup_4 = DuplicateData(Number="8", Order=True)
flip = FlipMatrix(Data=entwine_3)
merge_20 = Merge(
    Data1=flatten(multiplication_6),
    Data2=flatten(one_over_x),
    Data3=flatten(c_script_31.A),
    Data4=flatten(item_12.Item1),
    Data5=flatten(item_12.Item2),
    Data6=flatten(c_script_33.A),
    Data7=flatten(c_script_32.A))
merge_21 = Merge(Data1=txt_10, Data2=txt_9)  # -> flatten(Result)
bang_4 = ExplodeTree(Data=branch_33)  # -> Branch0, Branch1
merge_22 = Merge(
    Data1=flatten(txt_14),
    Data2=flatten(txt_13),
    Data3=flatten(txt_11),
    Data4=flatten(""),
    Data5=flatten(""),
    Data6=flatten(txt_12))
entwine_4 = Entwine(Branch00=merge_19, Branch01=dup_3, Branch02=merge_17, Branch03=dup_3, Branch04=merge_18, FlattenInputs=True)  # -> simplify(Result)
join_3 = TextJoin(Text=flip, Join="_")  # -> flatten(Result)
num_10 = Number(branch_34)
num_11 = Number(branch_36)
num_12 = Number(branch_37)
num_13 = Number(branch_35)
c_script_34 = CSharpScript(x=bang_4.Branch0, y=bang_4.Branch1)  # -> out, simplify(graft(A)); inputs x: Int32, y: Int32
# ---------- c_script_34: C# ----------
    if(x==1)
      A = 0;
    else if (y==1)
      A = 1;
    else
      A = 2;
# ---------- end c_script_34 ----------
merge_23 = Merge(Data1=flatten(dup_4), Data2=flatten(cluster_5.R))
merge_24 = Merge(Data1=flatten(cluster_7.alpha), Data2=flatten(""))
merge_25 = Merge(Data1=flatten(cluster_7.beta), Data2=flatten(""))
merge_26 = Merge(Data1=flatten(dup_4), Data2=flatten(""))
join_4 = TextJoin(Text=merge_22, Join="|")  # -> flatten(Result)
join_5 = TextJoin(Text=merge_21, Join="|")  # -> flatten(Result)
dup_5 = DuplicateData(Number=9, Order=True)  # -> simplify(Data)
join_6 = TextJoin(Text=merge_20, Join="|")  # -> flatten(Result)
dup_6 = DuplicateData(Number="8", Order=True)
tstat = TreeStatistics(Tree=updatemesh2)  # -> Paths, Length, Count
join_7 = TextJoin(Text=join_3, Join="|")  # -> flatten(Result)
join_8 = TextJoin(Text=entwine_4, Join="_")  # -> flatten(Result)
branch_38 = TreeBranch(Tree=simplify(c_script_34.A), Path=simplify(tstat.Paths), MaintainPaths=True)
entwine_5 = Entwine(
    Branch00=merge_23,
    Branch01=dup_5,
    Branch02=merge_26,
    Branch03=merge_24,
    Branch04=merge_25,
    Branch05=dup_6,
    FlattenInputs=True)  # -> simplify(Result)
join_9 = TextJoin(Text=join_8, Join="|")  # -> flatten(Result)
lng_2 = ListLength(List=updatestring44)  # -> expr("x/x", Length)
flip_2 = FlipMatrix(Data=entwine_5)
multiplication_14 = Multiplication(A=updatestring33, B=0)
dup_7 = DuplicateData(Data="vertical", Number=lng_2, Order=True)
dup_8 = DuplicateData(Data="horizontal", Number=lng_2, Order=True)
number_slider_10 = Slider(0.5, range=0..1)
merge_27 = Merge(
    Data1=flatten(multiplication_11),
    Data2=flatten(one_over_x),
    Data3=flatten(c_script_31.A),
    Data4=flatten(item_12.Item1),
    Data5=flatten(item_12.Item2),
    Data6=flatten(c_script_33.A),
    Data7=flatten(c_script_32.A))
merge_28 = Merge(
    Data1=flatten(txt_14),
    Data2=flatten(multiplication_9),
    Data3=flatten(multiplication_10),
    Data4=flatten(""),
    Data5=flatten(""),
    Data6=flatten(txt_12))
join_10 = TextJoin(Text=flip_2, Join="_")  # -> flatten(Result)
c_script_35 = CSharpScript(key=simplify(branch_38), firstData=simplify(updatestring11), secondData=simplify(updatestring22))  # -> out, A; inputs key: tree of Int32, firstData: tree, secondData: tree
# ---------- c_script_35: C# ----------
    DataTree<object> results = new DataTree<object>();
    for(int i = 0 ; i < key.Branches.Count ;i++){
      if(key.Branches[i][0] == 0)
        results.AddRange(firstData.Branches[i], new GH_Path(i));
      else if(key.Branches[i][0] == 1)
        results.AddRange(secondData.Branches[i], new GH_Path(i));
      else
        results.AddRange(secondData.Branches[i], new GH_Path(i));
    }
    A = results;
# ---------- end c_script_35 ----------
c_script_36 = CSharpScript(
    key=simplify(branch_38),
    firstData=simplify(updatestring33),
    secondData=simplify(updatestring44),
    thirdData=simplify(multiplication_14))  # -> out, A; inputs key: tree of Int32, firstData: tree, secondData: tree, thirdData: tree
# ---------- c_script_36: C# ----------
    DataTree<object> results = new DataTree<object>();
    for(int i = 0 ; i < key.Branches.Count ;i++){
      if(key.Branches[i][0] == 0)
        results.AddRange(firstData.Branches[i], new GH_Path(i));
      else if(key.Branches[i][0] == 1)
        results.AddRange(secondData.Branches[i], new GH_Path(i));
      else
        results.AddRange(thirdData.Branches[i], new GH_Path(i));
    }
    A = results;
# ---------- end c_script_36 ----------
c_script_37 = CSharpScript(key=simplify(branch_38), firstData=simplify(dup_7), secondData=simplify(dup_8))  # -> out, A; inputs key: tree of Int32, firstData: tree, secondData: tree; same code as c_script_35
mesh_17 = Mesh(mesh_14)
c_script_38 = CSharpScript(mesh=bang.Branch0)  # -> out, A; inputs mesh: Mesh
# ---------- c_script_38: C# ----------
    
    mesh.Flip(true, true, true);
    A = mesh;
# ---------- end c_script_38 ----------
mesh_18 = Mesh(bang.Branch5)
mesh_19 = Mesh(flatten([bang.Branch3, mesh_16]))
join_11 = TextJoin(Text=merge_28, Join="|")  # -> flatten(Result)
mjoin_3 = MeshJoin(Meshes=bang.Branch2)
join_12 = TextJoin(Text=merge_27, Join="|")  # -> flatten(Result)
join_13 = TextJoin(Text=join_10, Join="|")  # -> flatten(Result)
opaque_object = ConstructOpaqueDaylightObjectPWAIV0400(BuildingGeometry=flatten(mesh_19), ReflectanceValue=number_slider_10)  # -> flatten(OpaqueDaylightObject)

# ---- group: Overhang
opaque_object_2 = ConstructOpaqueDaylightObjectPWAIV0400(BuildingGeometry=flatten(mesh_17), ReflectanceValue=number_slider_10)  # -> flatten(OpaqueDaylightObject)

# ----
panel_33 = Panel(c_script_35.A)
transparent_object = ConstructTransparentDaylightObjectPWAIV0400(
    GlazingGeometry=updatemesh2,
    TransparencyValue=num_12,
    ShadingDepth=simplify(c_script_36.A),
    ShadingSpacing=simplify(c_script_35.A),
    ShadingType=simplify(c_script_37.A),
    GenerateShadingGeometries=True)  # -> GlazingDaylighObject, ShadingDeviceGeometry

# ---- group: Interior Walls
opaque_object_3 = ConstructOpaqueDaylightObjectPWAIV0400(BuildingGeometry=mesh_18, ReflectanceValue=num_13)

# ---- group: Ceiling
opaque_object_4 = ConstructOpaqueDaylightObjectPWAIV0400(BuildingGeometry=c_script_38.A, ReflectanceValue=num_10)

# ---- group: Floor
opaque_object_5 = ConstructOpaqueDaylightObjectPWAIV0400(BuildingGeometry=bang.Branch1, ReflectanceValue=num_13)

# ---- group: Exterior wall
opaque_object_6 = ConstructOpaqueDaylightObjectPWAIV0400(BuildingGeometry=mjoin_3, ReflectanceValue=num_11)

# ----
analysis_grid = ConstructAnalysisGridPWAIV0420(FloorPlane=updatesurface1, GridSpacing=updatesensorgrid)
merge_29 = Merge(Data1=flatten(join_11), Data2=flatten(join_5), Data3=flatten(join_12), Data4=flatten(join_13), Data5=flatten(join_9))
merge_30 = Merge(Data1=flatten(item_11.Item1), Data2=flatten(item_11.Item2))
merge_31 = Merge(Data1=flatten(join_4), Data2=flatten(join_5), Data3=flatten(join_6), Data4=flatten(join_7), Data5=flatten(join_9))
panel_34 = Panel(entwine_4)
dl_obj = DaylightObjectPWAIV0400(flatten([opaque_object_4, opaque_object_5, opaque_object_6, transparent_object.GlazingDaylighObject, opaque_object_3]))
dl_obj_2 = DaylightObjectPWAIV0562(flatten([opaque_object, opaque_object_2]))
entwine_6 = Entwine(Branch00=merge_30, Branch01=merge_31, Branch02=merge_29, FlattenInputs=True)  # -> simplify(Result)
toggle_10 = BooleanToggle(True)
panel_35 = Panel("""15_3|20_3
10_7|8769_15""")
panel_36 = Panel("""13_3|18_3
73_3|74_3
10_7|16_7
50_7|58_12
64_7|68_11""")
panel_37 = Panel("""20_7|43_10
20_13|43_18""")
panel_38 = Panel("""13_3|18_3
73_3|74_3
10_7|16_7
50_7|58_12
64_7|68_11""")
demesh_2 = DeconstructMesh(Mesh=analysis_grid)  # -> Vertices, Faces, Colours, Normals
predict_daylight_ogl = PredictDaylightMetricsFromGeometryMaterialsAndWeatherDataUsingOpenGLPWAIV0630(
    AnalysisGrid=analysis_grid,
    BuildingDaylightObjects=dl_obj,
    SurroundingDaylightObjects=dl_obj_2,
    GroundElevation=subtraction_2,
    NorthOffset=0,
    PathOfEpwFile=updateepw,
    ComputeSolution=Toggle(True),
    PredictDA=toggle_10,
    PredictSE=toggle_10,
    PredictMI=toggle_10,
    PredictUDI=toggle_10)  # -> PredictedDaylightAutonomy_sensor_array, PredictedSunlightExposure_sensor_array, PredictedMeanIlluminance_sensor_array, PredictedUsefulDaylightIlluminanceFailing_sensor_array, PredictedUsefulDaylightIlluminanceSupplementary_sensor_array, PredictedUsefulDaylightIlluminanceAcceptable_sensor_array, PredictedUsefulDaylightIlluminanceExcessive_sensor_array
entwine_7 = Entwine(Branch00=panel_37, Branch01=panel_36, Branch02=panel_38, FlattenInputs=True)  # -> simplify(Result)
conmesh = ConstructMesh(Vertices=demesh_2.Vertices, Faces=demesh_2.Faces)
panel_39 = Panel("""INPUT
INPUT
INPUT""")
epc_connector = EPCConnectorPlus(
    RunComponent=Toggle(True),
    PathOfEpwFile=text,
    SheetNameToWrite=panel_39,
    StartEndCellsToWrite=entwine_7,
    ValuesToWrite=entwine_6,
    SheetNameToRead="RESULT",
    RowClnToRead="13_3|25_4")  # -> CellValueStringList, WorkingExcelFilePath
merge_32 = Merge(Data1=cluster_5.R_2, Data2=cluster_5.R)
ma_2 = MassAddition(Input=merge_32)  # -> Result, PartialResults
division_3 = Division(A=merge_32, B=ma_2.Result)
panel_40 = Panel(epc_connector.WorkingExcelFilePath)
flip_3 = FlipMatrix(Data=epc_connector.CellValueStringList)
item_17 = ListItem(List=flip_3, Index=0, Wrap=True)  # -> flatten(Item), flatten(Item1)
path = FilePath(c_script_2.A)
split_2 = TextSplit(Text=item_17.Item1, Separators="_")  # -> simplify(Result)
split_3 = TextSplit(Text=item_17.Item, Separators="_")  # -> simplify(Result)
num_14 = Number(division_3)
item_18 = ListItem(List=num_14, Index=0, Wrap=True)  # -> Item, Item1
c_script_39 = CSharpScript(x=split_3)  # -> out, A; inputs x: String
# ---------- c_script_39: C# ----------
      A = Math.Round(double.Parse(x), 2);
# ---------- end c_script_39 ----------
c_script_40 = CSharpScript(x=split_2)  # -> out, A; inputs x: String; same code as c_script_39
multiplication_15 = Multiplication(A=c_script_39.A, B=item_18.Item)  # -> simplify(Result)
multiplication_16 = Multiplication(A=c_script_40.A, B=item_18.Item1)  # -> simplify(Result)
addition_2 = Addition(A=multiplication_15, B=multiplication_16)
flip_4 = FlipMatrix(Data=addition_2)
flip_5 = FlipMatrix(Data=split_3)
flip_6 = FlipMatrix(Data=split_2)
item_19 = ListItem(List=flip_4, Index="12", Wrap=True)  # -> flatten(Item)
cull_i = CullIndex(List=flip_4, Indices="12", Wrap=True)  # -> simplify(List)
item_20 = ListItem(List=flip_5, Index="12", Wrap=True)  # -> flatten(Item)
item_21 = ListItem(List=flip_6, Index="12", Wrap=True)  # -> flatten(Item)
c_script_41 = CSharpScript(x=cull_i)  # -> out, A; inputs x: String; same code as c_script_39
c_script_42 = CSharpScript(x=item_19)  # -> out, A; inputs x: String; same code as c_script_39

# ---- group: Primary
num_15 = Number(item_20)

# ---- group: Core
num_16 = Number(item_21)

# ----
c_script_43 = CSharpScript(path=path, trigger=and_3)  # -> out, A; inputs path: String
# ---------- c_script_43: C# usings ----------
using System.Runtime;
using System.IO;
using System.Drawing;
# ---------- c_script_43: C# ----------
    string filePath1 = Path.Combine(path, "Repository.txt");

    // Read all lines from the file if it exists
    if (File.Exists(filePath1))
    {
      List<string> lines = new List<string>();
      using (StreamReader fileReader = new StreamReader(filePath1))
      {
        string line;
        while ((line = fileReader.ReadLine()) != null)
        {
          lines.Add(line);
        }
      }

      // Assign the read lines to the output object
      A = lines.Count;
    }
    else{
      A =0;
    }
# ---------- end c_script_43 ----------
cluster_9 = Cluster(
    relay_2=predict_daylight_ogl.PredictedDaylightAutonomy_sensor_array,
    relay=predict_daylight_ogl.PredictedSunlightExposure_sensor_array,
    I=predict_daylight_ogl.PredictedUsefulDaylightIlluminanceAcceptable_sensor_array,
    I_2=predict_daylight_ogl.PredictedMeanIlluminance_sensor_array)  # -> T, A
panel_41 = Panel(c_script_43.A)
tstat_2 = TreeStatistics(Tree=updatestring3)  # -> Paths, Length, Count
merge_33 = Merge(Data1=flatten(c_script_16.TotalWWR), Data2=flatten(cluster_9.A), Data3=flatten(c_script_42.A))  # -> simplify(graft(Result))
c_script_44 = CSharpScript(ADD=and_3, currAlt=updatestring3, newData=merge_33, currentNumber=c_script_43.A, trigger=and_3)  # -> out, A, B; inputs ADD: Boolean, currAlt: tree of String, newData: tree of String, currentNumber: Int32, trigger: Boolean
# ---------- c_script_44: C# ----------
    foreach( var obj in GrasshopperDocument.Objects){
      if(obj.NickName == "AlternativeDataUpdate1"){
        guid1 = obj.InstanceGuid;
      }
      if(obj.NickName == "trigger"){
        guid2 = obj.InstanceGuid;
      }
    }

    if(n == 0){
      Grasshopper.Kernel.Parameters.Param_String cmp1 = (Grasshopper.Kernel.Parameters.Param_String) this.GrasshopperDocument.FindObject(guid1, true);
      cmp1.PersistentData.Clear();
      cmp1.ExpireSolution(true);

      Grasshopper.Kernel.Parameters.Param_Boolean cmp2 = (Grasshopper.Kernel.Parameters.Param_Boolean) this.GrasshopperDocument.FindObject(guid2, true);
      cmp2.PersistentData.Clear();
      cmp2.ExpireSolution(true);

      n++;
    }


    int branchCount = currAlt.BranchCount;
    string timeStamp = DateTime.Now.ToString("yyyyMMddHHmmss");
    string imageFileName = (currentNumber + 1).ToString() + "_" + timeStamp;

    for(int i = 0; i < newData.BranchCount ;i++)
      currAlt.AddRange(newData.Branch(i), new GH_Path(i + branchCount + 1));
    currAlt.Add(imageFileName, new GH_Path(branchCount));



    if(ADD){
      Grasshopper.Kernel.Parameters.Param_String cmp1 = (Grasshopper.Kernel.Parameters.Param_String) this.GrasshopperDocument.FindObject(guid1, true);
      cmp1.PersistentData.Clear();
      for (int i = 0; i < currAlt.BranchCount; i++)
      {
        IEnumerable<Grasshopper.Kernel.Types.GH_String> convertedList = currAlt.Branch(i).Select(s => new Grasshopper.Kernel.Types.GH_String(s));
        cmp1.PersistentData.AppendRange(convertedList, currAlt.Path(i));
      }
      cmp1.ExpireSolution(true);




      Grasshopper.Kernel.Parameters.Param_Boolean cmp2 = (Grasshopper.Kernel.Parameters.Param_Boolean) this.GrasshopperDocument.FindObject(guid2, true);
      cmp2.PersistentData.Clear();
      cmp2.PersistentData.Append(new GH_Boolean(trigger));
      cmp2.ExpireSolution(true);


      n++;

      //altNumber++;
    }



    A = currAlt;
    B = imageFileName;
    // Trigger = trigger;
# ---------- c_script_44: C# additional code ----------
  Guid guid1;  Guid guid2; int n = 0;
  //int altNumber = 0;
  DataTree<string> allData = new DataTree<string>();
# ---------- end c_script_44 ----------

alternativedataupdate1 = Text()
trigger = Boolean()

panel_42 = Panel(merge_33)
c_script_45 = CSharpScript(x=trigger)  # -> out, A; inputs x: Boolean
# ---------- c_script_45: C# ----------
    foreach( var obj in GrasshopperDocument.Objects){

      if(obj.NickName == "trigger"){
        guid = obj.InstanceGuid;
      }
    }

    if(x){
      Grasshopper.Kernel.Parameters.Param_Boolean cmp1 = (Grasshopper.Kernel.Parameters.Param_Boolean) this.GrasshopperDocument.FindObject(guid, true);
      cmp1.PersistentData.Clear();
      cmp1.PersistentData.Append(new GH_Boolean(false));
      cmp1.ExpireSolution(true);
    }
# ---------- c_script_45: C# additional code ----------
  Guid guid;
# ---------- end c_script_45 ----------
panel_43 = Panel(c_script_44.A)
panel_44 = Panel(alternativedataupdate1)
item_22 = ListItem(List=srf, Index=0, Wrap=True)

# ---- group: Primary
num_17 = Number(num_15)

# ---- group: Core
num_18 = Number(num_16)

# ----
panel_45 = Panel("""{0,1000,1000}
{10,1000,1000}
{20,1000,1000}""")
planar = Planar(Curve=item_22)  # -> Planar, Plane, Deviation
data_9 = Data(conmesh)
demesh_3 = DeconstructMesh(Mesh=data_9)  # -> Vertices, Faces, Colours, Normals
pt_2 = Point(demesh_3.Vertices)
project = Project(Geometry=pt_2, Plane=planar.Plane)  # -> Geometry, Transform
mesh_20 = Mesh(bang.Branch2)
lng_3 = ListLength(List=pt_2)
pull = PullPoint(Point=project.Geometry, Geometry=srf, ClosestOnly=True)  # -> ClosestPoint, Distance
dup_9 = DuplicateData(Data=graft(num_17), Number=lng_3, Order=True)
dup_10 = DuplicateData(Data=graft(num_18), Number=lng_3, Order=True)
mjoin_4 = MeshJoin(Meshes=mesh_20)
larger_3 = LargerThan(FirstNumber=pull.Distance, SecondNumber=0.01)  # -> LargerThan, OrEqualTo
branch_39 = TreeBranch(Tree=alternativedataupdate1, Path=tstat_2.Count, MaintainPaths=True)
join_14 = TextJoin(Text=alternativedataupdate1, Join="|||")
join_15 = TextJoin(Text=flatten(join_14), Join="___")
bbox = BoundingBox(Content=mjoin_4, Plane=PlaneXY(0, 0, 0))  # -> Box, Box_2
txt_15 = Text(branch_39)
txt_16 = Text(["Heatmap_1", "Heatmap_2", "Heatmap_3"])
txt_17 = Text("3DView")
number_slider_11 = Slider(100, range=0..1000)
dup_11 = DuplicateData(Data=graft(larger_3.LargerThan), Number=2, Order=True)  # -> simplify(Data)
flip_7 = FlipMatrix(Data=dup_11)  # -> graft(Data)
cluster_10 = Cluster_17(B=bbox.Box, G=trigger)
demesh_4 = DeconstructMesh(Mesh=data_9)  # -> Vertices, Faces, Colours, Normals
larger_4 = LargerThan(FirstNumber=predict_daylight_ogl.PredictedDaylightAutonomy_sensor_array, SecondNumber=0.5)  # -> LargerThan, OrEqualTo
dispatch = Dispatch(List=graft(dup_10), DispatchPattern=graft(flip_7))  # -> simplify(ListA), ListB
dispatch_2 = Dispatch(List=graft(dup_9), DispatchPattern=graft(flip_7))  # -> ListA, simplify(ListB)
c_script_46 = CSharpScript()  # -> out, A
# ---------- c_script_46: C# ----------
    RhinoDoc doc = Rhino.RhinoDoc.ActiveDoc;

    var activeViewport = doc.Views.ActiveView;
    doc.Views.ActiveView = activeViewport;
    activeViewport.Maximized = true;
# ---------- end c_script_46 ----------
larger_5 = LargerThan(FirstNumber=predict_daylight_ogl.PredictedSunlightExposure_sensor_array, SecondNumber=0.5)  # -> LargerThan, OrEqualTo
mesh_21 = Mesh(cluster_10)
dispatch_3 = Dispatch(List=dup_9, DispatchPattern=larger_3.LargerThan)  # -> ListA, ListB
panel_46 = Panel(c_script_46.A)
merge_34 = Merge(Data1=simplify(dispatch.ListA), Data2=simplify(dispatch_2.ListB))
int_6 = Integer(larger_4.LargerThan)
int_7 = Integer(larger_5.LargerThan)
gradient = Gradient(
    LowerLimit=0,
    UpperLimit=1,
    Parameter=int_7,
    stops=[0: RGB(138, 138, 138), 0: RGB(186, 186, 186), 0: RGB(221, 232, 170), 0: RGB(173, 173, 173), 1: RGB(255, 208, 18)])
gradient_2 = Gradient(
    LowerLimit=0,
    UpperLimit=1,
    Parameter=int_6,
    stops=[0: RGB(181, 181, 181), 0: RGB(186, 186, 186), 0: RGB(221, 232, 170), 0: RGB(173, 173, 173), 1: RGB(200, 250, 147)])
gradient_3 = Gradient(
    LowerLimit=Slider(3000, range=0..10000),
    UpperLimit=Slider(50, range=0..100),
    Parameter=predict_daylight_ogl.PredictedMeanIlluminance_sensor_array,
    stops=[0: RGB(234, 38, 0), 0.25: RGB(234, 126, 0), 0.5: RGB(254, 244, 84), 0.75: RGB(173, 203, 249), 1: RGB(75, 107, 169)])
pshift = ShiftPaths(Data=merge_34, Offset=-1)
data_10 = Data(data_9)
bang_5 = ExplodeTree(Data=pshift)  # -> Branch0, Branch1
cluster_11 = Cluster_18(relay_2=num_18, relay=num_17)
panel_47 = Panel(dispatch.ListA)
c_script_47 = CSharpScript(
    srf=updatesurface1,
    sensor=demesh_4.Vertices,
    spacing=updatesensorgrid,
    f=predict_daylight_ogl.PredictedUsefulDaylightIlluminanceFailing_sensor_array,
    s=predict_daylight_ogl.PredictedUsefulDaylightIlluminanceSupplementary_sensor_array,
    a=predict_daylight_ogl.PredictedUsefulDaylightIlluminanceAcceptable_sensor_array,
    e=predict_daylight_ogl.PredictedUsefulDaylightIlluminanceExcessive_sensor_array,
    colors=[ColourSwatch(SwatchColor=RGB(65, 128, 176)), ColourSwatch(SwatchColor=RGB(117, 186, 163)), ColourSwatch(SwatchColor=RGB(180, 224, 119)), ColourSwatch(SwatchColor=RGB(255, 176, 255))])  # -> out, A; inputs srf: Surface, sensor: Point3d, spacing: Double, f: Double, s: Double, a: Double, e: Double, colors: list of Color
# ---------- c_script_47: C# ----------
    Curve crVt = srf.IsoCurve(0, 0);
    Vector3d v1 = crVt.PointAtEnd - crVt.PointAtStart;
    v1.Unitize();
    Vector3d v2 = v1;
    v2.Rotate(-0.5 * Math.PI, Vector3d.ZAxis);



    Mesh Tmesh = new Mesh();

    double totalVal = f + s + a + e;
    f = f / totalVal * spacing;
    s = s / totalVal * spacing;
    a = a / totalVal * spacing;
    e = e / totalVal * spacing;


    Mesh fMesh = new Mesh();
    Point3d p0 = sensor + (v1 * (0.5 * f)) + (v2 * (0.5 * f));
    Point3d p1 = sensor - (v1 * (0.5 * f)) + (v2 * (0.5 * f));
    Point3d p2 = sensor - (v1 * (0.5 * f)) - (v2 * (0.5 * f));
    Point3d p3 = sensor + (v1 * (0.5 * f)) - (v2 * (0.5 * f));
    fMesh.Vertices.Add(p0);
    fMesh.Vertices.Add(p1);
    fMesh.Vertices.Add(p2);
    fMesh.Vertices.Add(p3);
    fMesh.Faces.AddFace(0, 1, 2, 3);
    fMesh.VertexColors.CreateMonotoneMesh(colors[0]);
    fMesh = repairMesh(fMesh);



    Mesh sMesh = new Mesh();
    Point3d p4 = sensor + (v1 * (0.5 * (f + s))) + (v2 * (0.5 * (f + s)));
    Point3d p5 = sensor - (v1 * (0.5 * (f + s))) + (v2 * (0.5 * (f + s)));
    Point3d p6 = sensor - (v1 * (0.5 * (f + s))) - (v2 * (0.5 * (f + s)));
    Point3d p7 = sensor + (v1 * (0.5 * (f + s))) - (v2 * (0.5 * (f + s)));
    sMesh.Vertices.Add(p0);
    sMesh.Vertices.Add(p1);
    sMesh.Vertices.Add(p2);
    sMesh.Vertices.Add(p3);
    sMesh.Vertices.Add(p4);
    sMesh.Vertices.Add(p5);
    sMesh.Vertices.Add(p6);
    sMesh.Vertices.Add(p7);
    sMesh.Faces.AddFace(0, 4, 5, 1);
    sMesh.Faces.AddFace(1, 5, 6, 2);
    sMesh.Faces.AddFace(2, 6, 7, 3);
    sMesh.Faces.AddFace(0, 3, 7, 4);
    sMesh.VertexColors.CreateMonotoneMesh(colors[1]);
    sMesh = repairMesh(sMesh);


    Mesh aMesh = new Mesh();
    Point3d p8 = sensor + (v1 * ( 0.5 * (f + s + a))) + (v2 * (0.5 * (f + s + a)));
    Point3d p9 = sensor - (v1 * (0.5 * (f + s + a))) + (v2 * (0.5 * (f + s + a)));
    Point3d p10 = sensor - (v1 * (0.5 * (f + s + a))) - (v2 * (0.5 * (f + s + a)));
    Point3d p11 = sensor + (v1 * (0.5 * (f + s + a))) - (v2 * (0.5 * (f + s + a)));
    aMesh.Vertices.Add(p4);
    aMesh.Vertices.Add(p5);
    aMesh.Vertices.Add(p6);
    aMesh.Vertices.Add(p7);
    aMesh.Vertices.Add(p8);
    aMesh.Vertices.Add(p9);
    aMesh.Vertices.Add(p10);
    aMesh.Vertices.Add(p11);
    aMesh.Faces.AddFace(0, 4, 5, 1);
    aMesh.Faces.AddFace(1, 5, 6, 2);
    aMesh.Faces.AddFace(2, 6, 7, 3);
    aMesh.Faces.AddFace(0, 3, 7, 4);
    aMesh.VertexColors.CreateMonotoneMesh(colors[2]);
    aMesh = repairMesh(aMesh);


    Mesh eMesh = new Mesh();
    Point3d p12 = sensor + (v1 * (0.5 * (f + s + a + e))) + (v2 * (0.5 * (f + s + a + e)));
    Point3d p13 = sensor - (v1 * (0.5 * (f + s + a + e))) + (v2 * (0.5 * (f + s + a + e)));
    Point3d p14 = sensor - (v1 * (0.5 * (f + s + a + e))) - (v2 * (0.5 * (f + s + a + e)));
    Point3d p15 = sensor + (v1 * (0.5 * (f + s + a + e))) - (v2 * (0.5 * (f + s + a + e)));
    eMesh.Vertices.Add(p8);
    eMesh.Vertices.Add(p9);
    eMesh.Vertices.Add(p10);
    eMesh.Vertices.Add(p11);
    eMesh.Vertices.Add(p12);
    eMesh.Vertices.Add(p13);
    eMesh.Vertices.Add(p14);
    eMesh.Vertices.Add(p15);
    eMesh.Faces.AddFace(0, 4, 5, 1);
    eMesh.Faces.AddFace(1, 5, 6, 2);
    eMesh.Faces.AddFace(2, 6, 7, 3);
    eMesh.Faces.AddFace(0, 3, 7, 4);
    eMesh.VertexColors.CreateMonotoneMesh(colors[3]);
    eMesh = repairMesh(eMesh);


    Tmesh.Append(fMesh);
    Tmesh.Append(sMesh);
    Tmesh.Append(aMesh);
    Tmesh.Append(eMesh);

    A = Tmesh;
# ---------- c_script_47: C# additional code ----------
  public Mesh repairMesh(Mesh invalidMesh){
    invalidMesh.Vertices.CombineIdentical(true, true);
    invalidMesh.Faces.CullDegenerateFaces();
    invalidMesh.UnifyNormals();
    invalidMesh.RebuildNormals();
    invalidMesh.Compact();
    return invalidMesh;
  }
# ---------- end c_script_47 ----------
panel_48 = Panel(cluster_11)
J = Join(",")
merge_35 = Merge(
    Data1=ColourSwatch(SwatchColor=RGB(227, 0, 0)),
    Data2=ColourSwatch(SwatchColor=RGB(0, 123, 255)),
    Data3=ColourSwatch(SwatchColor=RGB(181, 181, 181)))
mcol = MeshColours(Mesh=data_10, Colours=gradient_3)
avr = Average(Input=int_7)  # -> flatten(ArithmeticMean)
mcol_2 = MeshColours(Mesh=data_10, Colours=gradient)
avr_2 = Average(Input=int_6)  # -> flatten(ArithmeticMean)
mcol_3 = MeshColours(Mesh=data_10, Colours=gradient_2)
c_script_48 = CSharpScript(
    srf=updatesurface1,
    sensor=pt_2,
    spacing=updatesensorgrid,
    heating=bang_5.Branch0,
    cooling=bang_5.Branch1,
    colors=merge_35,
    max=Slider(200, range=0..1000))  # -> out, A, graft(B), graft(C), graft(D); inputs srf: Surface, sensor: Point3d, spacing: Double, heating: Double, cooling: Double, colors: list of Color, max: Double
# ---------- c_script_48: C# ----------
    Curve crVt = srf.IsoCurve(0, 0);
    Vector3d v1 = crVt.PointAtEnd - crVt.PointAtStart;
    v1.Unitize();
    Vector3d v2 = v1;
    v2.Rotate(-0.5 * Math.PI, Vector3d.ZAxis);



    Mesh Tmesh = new Mesh();

    double totalVal = max;
    double grey = max - (heating + cooling);
    heating = heating / totalVal * spacing;
    cooling = cooling / totalVal * spacing;

    grey = grey / totalVal * spacing;

    B = heating;
    C = cooling;
    D = grey;


    if (heating > 0.1 && cooling > 0.1){

      Mesh heatingMesh = new Mesh();
      Point3d p0 = sensor + (v1 * (0.5 * heating)) + (v2 * (0.5 * heating));
      Point3d p1 = sensor - (v1 * (0.5 * heating)) + (v2 * (0.5 * heating));
      Point3d p2 = sensor - (v1 * (0.5 * heating)) - (v2 * (0.5 * heating));
      Point3d p3 = sensor + (v1 * (0.5 * heating)) - (v2 * (0.5 * heating));
      heatingMesh.Vertices.Add(p0);
      heatingMesh.Vertices.Add(p1);
      heatingMesh.Vertices.Add(p2);
      heatingMesh.Vertices.Add(p3);
      heatingMesh.Faces.AddFace(0, 1, 2, 3);
      heatingMesh.VertexColors.CreateMonotoneMesh(colors[0]);
      heatingMesh = repairMesh(heatingMesh);



      Mesh coolingMesh = new Mesh();
      Point3d p4 = sensor + (v1 * (0.5 * (heating + cooling))) + (v2 * (0.5 * (heating + cooling)));
      Point3d p5 = sensor - (v1 * (0.5 * (heating + cooling))) + (v2 * (0.5 * (heating + cooling)));
      Point3d p6 = sensor - (v1 * (0.5 * (heating + cooling))) - (v2 * (0.5 * (heating + cooling)));
      Point3d p7 = sensor + (v1 * (0.5 * (heating + cooling))) - (v2 * (0.5 * (heating + cooling)));
      coolingMesh.Vertices.Add(p0);
      coolingMesh.Vertices.Add(p1);
      coolingMesh.Vertices.Add(p2);
      coolingMesh.Vertices.Add(p3);
      coolingMesh.Vertices.Add(p4);
      coolingMesh.Vertices.Add(p5);
      coolingMesh.Vertices.Add(p6);
      coolingMesh.Vertices.Add(p7);
      coolingMesh.Faces.AddFace(0, 4, 5, 1);
      coolingMesh.Faces.AddFace(1, 5, 6, 2);
      coolingMesh.Faces.AddFace(2, 6, 7, 3);
      coolingMesh.Faces.AddFace(0, 3, 7, 4);
      coolingMesh.VertexColors.CreateMonotoneMesh(colors[1]);
      coolingMesh = repairMesh(coolingMesh);


      Mesh greyMesh = new Mesh();
      Point3d p8 = sensor + (v1 * ( 0.5 * (heating + cooling + grey))) + (v2 * (0.5 * (heating + cooling + grey)));
      Point3d p9 = sensor - (v1 * (0.5 * (heating + cooling + grey))) + (v2 * (0.5 * (heating + cooling + grey)));
      Point3d p10 = sensor - (v1 * (0.5 * (heating + cooling + grey))) - (v2 * (0.5 * (heating + cooling + grey)));
      Point3d p11 = sensor + (v1 * (0.5 * (heating + cooling + grey))) - (v2 * (0.5 * (heating + cooling + grey)));
      greyMesh.Vertices.Add(p4);
      greyMesh.Vertices.Add(p5);
      greyMesh.Vertices.Add(p6);
      greyMesh.Vertices.Add(p7);
      greyMesh.Vertices.Add(p8);
      greyMesh.Vertices.Add(p9);
      greyMesh.Vertices.Add(p10);
      greyMesh.Vertices.Add(p11);
      greyMesh.Faces.AddFace(0, 4, 5, 1);
      greyMesh.Faces.AddFace(1, 5, 6, 2);
      greyMesh.Faces.AddFace(2, 6, 7, 3);
      greyMesh.Faces.AddFace(0, 3, 7, 4);
      greyMesh.VertexColors.CreateMonotoneMesh(colors[2]);
      greyMesh = repairMesh(greyMesh);




      Tmesh.Append(heatingMesh);
      Tmesh.Append(coolingMesh);
      Tmesh.Append(greyMesh);
    }


    else if(heating <= 0.1 ){

      Mesh coolingMesh = new Mesh();
      Point3d p0 = sensor + (v1 * (0.5 * cooling)) + (v2 * (0.5 * cooling));
      Point3d p1 = sensor - (v1 * (0.5 * cooling)) + (v2 * (0.5 * cooling));
      Point3d p2 = sensor - (v1 * (0.5 * cooling)) - (v2 * (0.5 * cooling));
      Point3d p3 = sensor + (v1 * (0.5 * cooling)) - (v2 * (0.5 * cooling));
      coolingMesh.Vertices.Add(p0);
      coolingMesh.Vertices.Add(p1);
      coolingMesh.Vertices.Add(p2);
      coolingMesh.Vertices.Add(p3);
      coolingMesh.Faces.AddFace(0, 1, 2, 3);
      coolingMesh.VertexColors.CreateMonotoneMesh(colors[1]);
      coolingMesh = repairMesh(coolingMesh);



      Mesh greyMesh = new Mesh();
      Point3d p4 = sensor + (v1 * (0.5 * (grey + cooling))) + (v2 * (0.5 * (grey + cooling)));
      Point3d p5 = sensor - (v1 * (0.5 * (grey + cooling))) + (v2 * (0.5 * (grey + cooling)));
      Point3d p6 = sensor - (v1 * (0.5 * (grey + cooling))) - (v2 * (0.5 * (grey + cooling)));
      Point3d p7 = sensor + (v1 * (0.5 * (grey + cooling))) - (v2 * (0.5 * (grey + cooling)));
      greyMesh.Vertices.Add(p0);
      greyMesh.Vertices.Add(p1);
      greyMesh.Vertices.Add(p2);
      greyMesh.Vertices.Add(p3);
      greyMesh.Vertices.Add(p4);
      greyMesh.Vertices.Add(p5);
      greyMesh.Vertices.Add(p6);
      greyMesh.Vertices.Add(p7);
      greyMesh.Faces.AddFace(0, 4, 5, 1);
      greyMesh.Faces.AddFace(1, 5, 6, 2);
      greyMesh.Faces.AddFace(2, 6, 7, 3);
      greyMesh.Faces.AddFace(0, 3, 7, 4);
      greyMesh.VertexColors.CreateMonotoneMesh(colors[2]);
      greyMesh = repairMesh(greyMesh);


      Tmesh.Append(coolingMesh);
      Tmesh.Append(greyMesh);

    }

    else if(cooling <= 0.1 ){

      Mesh heatingMesh = new Mesh();
      Point3d p0 = sensor + (v1 * (0.5 * heating)) + (v2 * (0.5 * heating));
      Point3d p1 = sensor - (v1 * (0.5 * heating)) + (v2 * (0.5 * heating));
      Point3d p2 = sensor - (v1 * (0.5 * heating)) - (v2 * (0.5 * heating));
      Point3d p3 = sensor + (v1 * (0.5 * heating)) - (v2 * (0.5 * heating));
      heatingMesh.Vertices.Add(p0);
      heatingMesh.Vertices.Add(p1);
      heatingMesh.Vertices.Add(p2);
      heatingMesh.Vertices.Add(p3);
      heatingMesh.Faces.AddFace(0, 1, 2, 3);
      heatingMesh.VertexColors.CreateMonotoneMesh(colors[0]);
      heatingMesh = repairMesh(heatingMesh);



      Mesh greyMesh = new Mesh();
      Point3d p4 = sensor + (v1 * (0.5 * (grey + heating))) + (v2 * (0.5 * (grey + heating)));
      Point3d p5 = sensor - (v1 * (0.5 * (grey + heating))) + (v2 * (0.5 * (grey + heating)));
      Point3d p6 = sensor - (v1 * (0.5 * (grey + heating))) - (v2 * (0.5 * (grey + heating)));
      Point3d p7 = sensor + (v1 * (0.5 * (grey + heating))) - (v2 * (0.5 * (grey + heating)));
      greyMesh.Vertices.Add(p0);
      greyMesh.Vertices.Add(p1);
      greyMesh.Vertices.Add(p2);
      greyMesh.Vertices.Add(p3);
      greyMesh.Vertices.Add(p4);
      greyMesh.Vertices.Add(p5);
      greyMesh.Vertices.Add(p6);
      greyMesh.Vertices.Add(p7);
      greyMesh.Faces.AddFace(0, 4, 5, 1);
      greyMesh.Faces.AddFace(1, 5, 6, 2);
      greyMesh.Faces.AddFace(2, 6, 7, 3);
      greyMesh.Faces.AddFace(0, 3, 7, 4);
      greyMesh.VertexColors.CreateMonotoneMesh(colors[2]);
      greyMesh = repairMesh(greyMesh);


      Tmesh.Append(heatingMesh);
      Tmesh.Append(greyMesh);
    }



    A = Tmesh;
# ---------- c_script_48: C# additional code ----------
  public Mesh repairMesh(Mesh invalidMesh){
    invalidMesh.Vertices.CombineIdentical(true, true);
    invalidMesh.Faces.CullDegenerateFaces();
    invalidMesh.UnifyNormals();
    invalidMesh.RebuildNormals();
    invalidMesh.Compact();
    return invalidMesh;
  }
# ---------- end c_script_48 ----------
panel_49 = Panel(bang_5.Branch1)
ase = Panel(avr)
sda = Panel(avr_2)
mesh_22 = Mesh(c_script_48.A)
mesh_23 = Mesh(mcol_3)
avr_3 = Average(Input=predict_daylight_ogl.PredictedUsefulDaylightIlluminanceFailing_sensor_array)
avr_4 = Average(Input=predict_daylight_ogl.PredictedUsefulDaylightIlluminanceSupplementary_sensor_array)
avr_5 = Average(Input=predict_daylight_ogl.PredictedUsefulDaylightIlluminanceAcceptable_sensor_array)
avr_6 = Average(Input=predict_daylight_ogl.PredictedUsefulDaylightIlluminanceExcessive_sensor_array)
group = Group(Objects=c_script_47.A)
mesh_24 = Mesh(mcol_2)
mesh_25 = Mesh(mcol)
multiplication_17 = Multiplication(A=avr_3, B=100)
multiplication_18 = Multiplication(A=avr_4, B=100)
multiplication_19 = Multiplication(A=avr_5, B=100)
multiplication_20 = Multiplication(A=avr_6, B=100)
round = Round(Number=multiplication_18)  # -> Nearest, Floor, Ceiling
round_2 = Round(Number=multiplication_19)  # -> Nearest, Floor, Ceiling
round_3 = Round(Number=multiplication_20)  # -> Nearest, Floor, Ceiling
round_4 = Round(Number=multiplication_17)  # -> Nearest, Floor, Ceiling
merge_36 = Merge(Data1=mesh_23, Data2=mesh_24, Data3=group)
mesh_26 = Mesh(merge_36)
cluster_12 = Cluster_8(relay=merge_36, relay_2=panel_45)  # -> bbxmaps, maps
data_11 = Data(cluster_12.maps)
data_12 = Data(cluster_12.bbxmaps)
c_script_49 = CSharpScript(
    save=trigger,
    path=values_7.Values,
    imageName=txt_15,
    altData=join_15,
    bbxs_HM=data_12,
    viewNames_HM=txt_16,
    bbx_3D=bbox.Box,
    viewName_3D=txt_17,
    size=number_slider_11)  # -> out, A, threeD, maps, B; inputs save: Boolean, path: String, imageName: String, altData: list of String, bbxs_HM: list of Box, viewNames_HM: list of String, bbx_3D: Box, viewName_3D: String, size: Int32
# ---------- c_script_49: C# ----------
    if(save){
      if(String.IsNullOrEmpty(imageName) || altData.Count == 0 || bbxs_HM.Count == 0 )return;


      RhinoDoc doc = Rhino.RhinoDoc.ActiveDoc;
      Rhino.Display.DisplayModeDescription displaymode = Rhino.Display.DisplayModeDescription.FindByName("Shaded");
      Rhino.Display.RhinoView view2D = doc.Views.Add("view2D", Rhino.Display.DefinedViewportProjection.Top, new System.Drawing.Rectangle(0, 0, 10, 10), false);


      var activeViewport = doc.Views.ActiveView;



      string directoryPath = Path.Combine(path, "High Resolution");

      for (int i = 0; i < 3; i++)
      {

        BoundingBox bbx2D = bbxs_HM[i].BoundingBox;
        Rhino.Geometry.Transform x2D = Rhino.Geometry.Transform.Scale(bbx2D.Center, 1.2);
        bbx2D.Transform(x2D);
        view2D.MainViewport.ZoomBoundingBox(bbx2D);
        doc.Views.Redraw();

        string vn_HM = viewNames_HM[i];
        Bitmap image_HM = view2D.CaptureToBitmap(new Size(size, size), displaymode);
        Bitmap image_HR1 = view2D.CaptureToBitmap(new Size(1000, 1000), displaymode);

        string subFolder = "Alternative_" + imageName.Split('_')[0] + "_" + imageName.Split('_')[1];
        string fileName_LR = imageName + "_" + viewNames_HM[i].ToString() + ".png";
        string filePath_LR_2D = Path.Combine(path, subFolder, fileName_LR);


        string fileName_HR = imageName + "_" + viewNames_HM[i].ToString() + ".png";
        string filePath_HR_2D = Path.Combine(directoryPath, fileName_HR);


        try{
          Directory.CreateDirectory(Path.GetDirectoryName(filePath_LR_2D)); // Ensure directory exists
          image_HM.Save(filePath_LR_2D, System.Drawing.Imaging.ImageFormat.Png);

          Directory.CreateDirectory(Path.GetDirectoryName(filePath_HR_2D)); // Ensure directory exists
          image_HR1.Save(filePath_HR_2D, System.Drawing.Imaging.ImageFormat.Png);
        }
        finally{
          image_HM.Dispose();
          image_HR1.Dispose();
        }


      }

      view2D.Close();

      /*
      // Capture the first existing clipping plane
      Rhino.DocObjects.ClippingPlaneObject firstClippingPlane = null;
      foreach (var obj in doc.Objects)
      {
        var clippingPlaneObj = obj as Rhino.DocObjects.ClippingPlaneObject;
        if (clippingPlaneObj != null)
        {
          firstClippingPlane = clippingPlaneObj;
          break;
        }
      }
      */

      view2D = doc.Views.Add("view", Rhino.Display.DefinedViewportProjection.Perspective, new System.Drawing.Rectangle(0, 0, 500, 500), false);
      BoundingBox bbx3D = bbx_3D.BoundingBox;
      Rhino.Geometry.Transform x3D = Rhino.Geometry.Transform.Scale(bbx3D.Center, 1.1);
      bbx3D.Transform(x3D);
      view2D.MainViewport.ZoomBoundingBox(bbx3D);


      /*
      if (firstClippingPlane != null)
      {
        var clippingPlaneSurface = firstClippingPlane.Geometry as Rhino.Geometry.ClippingPlaneSurface;
        if (clippingPlaneSurface != null)
        {
          var plane = clippingPlaneSurface.Plane;
          doc.Objects.AddClippingPlane(plane, 1, 1, view2D.MainViewport.Id);
        }
      }
      */


      doc.Views.Redraw();


      string subFolder_LR_3D = "Alternative_" + imageName.Split('_')[0] + "_" + imageName.Split('_')[1];
      string fileName_LR_3D = imageName + "_" + viewName_3D.ToString() + ".png";
      string filePath_LR_3D = Path.Combine(path, subFolder_LR_3D, fileName_LR_3D);

      string fileName_HR_3D = imageName + "_" + viewName_3D.ToString() + ".png";
      string filePath_HR_3D = Path.Combine(directoryPath, fileName_HR_3D);


      Bitmap image3D_LR = view2D.CaptureToBitmap(new Size(size, size), displaymode);
      Bitmap image3D_HR = view2D.CaptureToBitmap(new Size(1000, 1000), displaymode);

      try{

        Directory.CreateDirectory(Path.GetDirectoryName(filePath_LR_3D)); // Ensure directory exists
        image3D_LR.Save(filePath_LR_3D, System.Drawing.Imaging.ImageFormat.Png);

        Directory.CreateDirectory(Path.GetDirectoryName(filePath_HR_3D)); // Ensure directory exists
        image3D_HR.Save(filePath_HR_3D, System.Drawing.Imaging.ImageFormat.Png);
      }
      finally{
        image3D_LR.Dispose();
        image3D_HR.Dispose();
      }

      view2D.Close();


      doc.Views.ActiveView = activeViewport;
      activeViewport.Maximized = true;
    }





    //////////////////////////Store alternative data//////////////////////////
    string filePath1 = Path.Combine(path, "Repository.txt");

    // Check if the Save button is clicked
    if (save){
      // If the file doesn't exist, create it and write data
      // If the file exists, append data to it
      using (StreamWriter outputFile = new StreamWriter(filePath1, true)){
        foreach (string txt in altData)
          outputFile.WriteLine(txt);
      }
    }


    // Read all lines from the file if it exists
    if (File.Exists(filePath1))
    {
      List<string> lines = new List<string>();
      using (StreamReader fileReader = new StreamReader(filePath1))
      {
        string line;
        while ((line = fileReader.ReadLine()) != null)
        {
          lines.Add(line);
        }
      }

      // Assign the read lines to the output object
      A = lines.ToArray();
    }
    else
    {
      A = new string[0]; // File doesn't exist, so return empty array
    }

    List<string> folderList = new List<string> ();
    folderList.AddRange(Directory.GetDirectories(path, "Alternative_*"));

    DataTree<string> folderListContents_JPG = new DataTree<string> ();
    DataTree<string> folderListContents_PNG = new DataTree<string> ();

    for(int n = 0; n < folderList.Count;n++){

      folderListContents_JPG.AddRange(Directory.GetFiles(folderList[n], "*_3DView.png"), new GH_Path(n));
      folderListContents_PNG.AddRange(Directory.GetFiles(folderList[n], "*_Heatmap_*.png"), new GH_Path(n));

    }

    threeD = folderListContents_JPG;
    maps = folderListContents_PNG;
# ---------- end c_script_49 ----------
c_script_50 = CSharpScript(update=values_43.Values, allAlternativeData=c_script_49.A)  # -> out, A; inputs update: Boolean, allAlternativeData: list of String
# ---------- c_script_50: C# ----------
    foreach( var obj in GrasshopperDocument.Objects){
      if(obj.NickName == "AlternativesData"){
        guid = obj.InstanceGuid;
      }
    }

    if(n == 0){
      Grasshopper.Kernel.Parameters.Param_String cmp = (Grasshopper.Kernel.Parameters.Param_String) this.GrasshopperDocument.FindObject(guid, true);
      cmp.PersistentData.Clear();
      cmp.PersistentData.Append(new GH_String(""));
      cmp.ExpireSolution(true);
    }


    if(update){
      Grasshopper.Kernel.Parameters.Param_String cmp = (Grasshopper.Kernel.Parameters.Param_String) this.GrasshopperDocument.FindObject(guid, true);
      cmp.PersistentData.Clear();
      foreach(string str in allAlternativeData){
        cmp.PersistentData.Append(new GH_String(str));
      }
      cmp.ExpireSolution(true);
      n++;
    }
# ---------- c_script_50: C# additional code ----------
  int n = 0;
  Guid guid;
# ---------- end c_script_50 ----------
txt_18 = Text(c_script_49.threeD)
txt_19 = Text(c_script_49.maps)
join_16 = TextJoin(Text=txt_19, Join=J)  # -> flatten(Result)
split_4 = TextSplit(Text=txt_18, Separators="\")
join_17 = TextJoin(Text=txt_18, Join=J)  # -> flatten(Result)
panel_50 = Panel(c_script_49.A)
item_23 = ListItem(List=reverse(split_4), Index=0, Wrap=True)
split_5 = TextSplit(Text=item_23, Separators="_")
item_24 = ListItem(List=split_5, Index=1, Wrap=True)  # -> flatten(Item)
sort = SortList(Keys=item_24, ValuesA=join_17)  # -> Keys, ValuesA
sort_2 = SortList(Keys=item_24, ValuesA=join_16)  # -> Keys, ValuesA
split_6 = TextSplit(Text=sort.ValuesA, Separators=J)  # -> flatten(Result)
short = ShortestList(ListA=true_button, ListB=flatten(split_6), TrimMode=2)  # -> ListA, ListB
setbtn = SetButton(ButtonToModify=short.ListA, ImagePath=short.ListB)
split_7 = TextSplit(Text=sort_2.ValuesA, Separators=J)
format_4 = Format(
    Format=["{0}%", "{1}%", "{2}%", "{3}%"],
    Culture=127,
    Data0=round_4.Nearest,
    Data1=round.Nearest,
    Data2=round_2.Nearest,
    Data3=round_3.Nearest)
number_slider_12 = Slider(3.7, range=0..10)
number_slider_13 = Slider(5.6, range=0..10)
range = Range(Domain=Slider(7.2, range=0..20), Steps=Slider(21, range=0..1000))
panel_51 = Panel("""UDIf:
UDIs:
UDIa:
UDIe:""")
number_slider_14 = Slider(2, range=0..100)
merge_37 = Merge(Data1=simplify(graft(panel_51)), Data2=simplify(graft(format_4)))
shift = ShiftList(List=range, Shift=-1, Wrap=False)
range_2 = Range(Domain=Slider(7.1, range=0..20), Steps=Slider(21, range=0..1000))
range_3 = Range(Domain=number_slider_13, Steps=3)
division_4 = Division(A=number_slider_13, B=3)
pt_3 = ConstructPoint(XCoordinate=0, YCoordinate=[number_slider_12, Slider(0, range=0..100)], ZCoordinate=0)
neg_2 = Negative(Value=shift)
pt_4 = ConstructPoint(XCoordinate=0, YCoordinate=[number_slider_12, Slider(0, range=0..100)], ZCoordinate=0)
join_18 = TextJoin(Text=merge_37, Join="    ")  # -> flatten(Result)
pt_5 = ConstructPoint(XCoordinate=0, YCoordinate=range_3, ZCoordinate=0)
item_25 = ListItem(List=range_2, Index=0, Wrap=True)  # -> Item, Item1
item_26 = ListItem(List=range, Index=0, Wrap=True)  # -> Item, Item1
pt_6 = ConstructPoint(XCoordinate=0, YCoordinate=range_2, ZCoordinate=0)
pt_7 = ConstructPoint(XCoordinate=0, YCoordinate=neg_2, ZCoordinate=0)
c_script_51 = CSharpScript(AltStrings=c_script_49.A, Splitter="___")  # -> out, A; inputs AltStrings: String, Splitter: String; same code as c_script_12
planesrf_2 = PlaneSurface(Plane=pt_3, XSize=number_slider_14, YSize=number_slider_12)
subtraction_3 = Subtraction(A=item_25.Item1, B=item_25.Item)
planesrf_3 = PlaneSurface(Plane=pt_5, XSize=number_slider_14, YSize=division_4)
subtraction_4 = Subtraction(A=item_26.Item1, B=item_26.Item)
planesrf_4 = PlaneSurface(Plane=pt_4, XSize=number_slider_14, YSize=number_slider_12)
join_19 = TextJoin(Text=format_4, Join="    ")
bnd = Bounds(Numbers=range)
panel_52 = Panel("""< 50 %
> 50 %""")
panel_53 = Panel("""50 lux
3000 lux""")
mplane_2 = MeshPlane(Boundary=planesrf_2, WidthCount=1, HeightCount=1)  # -> Mesh, Area
mplane_3 = MeshPlane(Boundary=planesrf_3, WidthCount=1, HeightCount=1)  # -> Mesh, Area
multiplication_21 = Multiplication(A=avr, B=100)
mplane_4 = MeshPlane(Boundary=planesrf_4, WidthCount=1, HeightCount=1)  # -> Mesh, Area
bnd_2 = Bounds(Numbers=range_2)
panel_54 = Panel("""<250hr
>250hr""")
remap_2 = RemapNumbers(Value=range, Source=bnd, Target=Domain(0, 1))  # -> reverse(Mapped), reverse(Clipped)
planesrf_5 = PlaneSurface(Plane=pt_6, XSize=number_slider_14, YSize=subtraction_3)
c_script_52 = CSharpScript(AltStrings=c_script_51.A, Splitter="|||")  # -> out, simplify(A); inputs AltStrings: String, Splitter: String; same code as c_script_12
multiplication_22 = Multiplication(A=avr_2, B=100)
panel_55 = Panel("of space")
planesrf_6 = PlaneSurface(Plane=pt_7, XSize=number_slider_14, YSize=subtraction_4)
int_8 = Integer(multiplication_21)
remap_3 = RemapNumbers(Value=range_2, Source=bnd_2, Target=Domain(0, 1))  # -> reverse(Mapped), Clipped
mplane_5 = MeshPlane(Boundary=planesrf_5, WidthCount=1, HeightCount=1)  # -> Mesh, Area
int_9 = Integer(multiplication_22)
panel_56 = Panel("""High
Low
Window Exposure""")
gradient_4 = Gradient(
    LowerLimit=1,
    UpperLimit=0,
    Parameter=remap_2.Mapped,
    stops=[0: RGB(234, 38, 0), 0.25: RGB(234, 126, 0), 0.5: RGB(254, 244, 84), 0.75: RGB(173, 203, 249), 1: RGB(75, 107, 169)])
format_5 = Format(Format="ASE:{0} % ", Culture=127, Data0=int_8)
format_6 = Format(Format="Mean Illuminance", Culture=127)
merge_38 = Merge(Data1=flatten(join_18), Data2=flatten(" "), Data3=flatten(" "))
mplane_6 = MeshPlane(Boundary=planesrf_6, WidthCount=1, HeightCount=1)  # -> Mesh, Area
item_27 = ListItem(List=flatten(int), Index=0, Wrap=True)  # -> Item, Item1
gradient_5 = Gradient(
    LowerLimit=0,
    UpperLimit=1,
    Parameter=remap_3.Mapped,
    stops=[0: RGB(234, 38, 0), 0.25: RGB(234, 126, 0), 0.5: RGB(254, 244, 84), 0.75: RGB(173, 203, 249), 1: RGB(75, 107, 169)])
format_7 = Format(Format="sDA: {0}%", Culture=127, Data0=int_9)
mcol_4 = MeshColours(
    Mesh=graft(mplane_2.Mesh),
    Colours=graft([ColourSwatch(SwatchColor=RGB(202, 252, 149)), ColourSwatch(SwatchColor=RGB(178, 178, 178))]))  # -> flatten(Mesh)
mcol_5 = MeshColours(
    Mesh=graft(mplane_3.Mesh),
    Colours=graft([ColourSwatch(SwatchColor=RGB(65, 128, 176)), ColourSwatch(SwatchColor=RGB(117, 186, 163)), ColourSwatch(SwatchColor=RGB(180, 224, 119)), ColourSwatch(SwatchColor=RGB(255, 176, 255))]))  # -> flatten(Mesh)
join_20 = TextJoin(Text=c_script_52.A, Join="|")
mcol_6 = MeshColours(
    Mesh=graft(mplane_4.Mesh),
    Colours=graft([ColourSwatch(SwatchColor=RGB(255, 226, 10)), ColourSwatch(SwatchColor=RGB(178, 178, 178))]))  # -> flatten(Mesh)
merge_39 = Merge(Data1=flatten(panel_54), Data2=format_5, Data3=flatten(""))
merge_40 = Merge(Data1=flatten(panel_53), Data2=format_6, Data3=flatten(" "))
merge_41 = Merge(Data1=flatten(panel_52), Data2=format_7, Data3=flatten(""))
tstat_3 = TreeStatistics(Tree=join_20)  # -> Paths, Length, Count
mcol_7 = MeshColours(Mesh=graft(mplane_6.Mesh), Colours=graft(gradient_4))  # -> flatten(Mesh)
mcol_8 = MeshColours(Mesh=graft(mplane_5.Mesh), Colours=graft(gradient_5))  # -> flatten(Mesh)
mesh_27 = Mesh(simplify(cluster_6.R))
mjoin_5 = MeshJoin(Meshes=mcol_4)
mjoin_6 = MeshJoin(Meshes=mcol_5)
mjoin_7 = MeshJoin(Meshes=mcol_6)
join_21 = TextJoin(Text=merge_38, Join="_")
join_22 = TextJoin(Text=merge_39, Join="_")
join_23 = TextJoin(Text=merge_40, Join="_")
item_28 = ListItem(List=tstat_3.Paths, Index=0, Wrap=True)
join_24 = TextJoin(Text=merge_41, Join="_")
mjoin_8 = MeshJoin(Meshes=mcol_7)
mjoin_9 = MeshJoin(Meshes=mcol_8)
dup_12 = DuplicateData(Data=mesh_27, Number=2, Order=True)
item_29 = ListItem(List=flatten(mesh_27), Index=0, Wrap=True)
relay_2 = Relay([mjoin_7, join_22])
relay_3 = Relay([mjoin_6, join_21])
dpath = DeconstructPath(Branch=item_28)
item_30 = ListItem(List=dpath, Index=0, Wrap=True)
relay_4 = Relay([mjoin_5, join_24])
num_19 = Number(num_18)
num_20 = Number(num_17)
relay_5 = Relay([mjoin_9, join_23])
c_script_53 = CSharpScript(x=dup_12)  # -> out, simplify(A); inputs x: Mesh
# ---------- c_script_53: C# ----------
    x.Flip(true, true, true);
    A = x;
# ---------- end c_script_53 ----------
c_script_54 = CSharpScript(x=item_29)  # -> out, A
# ---------- c_script_54: C# ----------
    if(x == null)
      A = false;
    else
      A = true;
# ---------- end c_script_54 ----------
c_script_55 = CSharpScript(x=num_20)  # -> out, A; inputs x: String
# ---------- c_script_55: C# ----------
    A = Math.Round(double.Parse(x), 1);
# ---------- end c_script_55 ----------
lng_4 = ListLength(List=dpath)
c_script_56 = CSharpScript(x=num_19)  # -> out, A; inputs x: String; same code as c_script_55
lng_5 = ListLength(List=split_6)
mesh_28 = Mesh([c_script_53.A, mesh_27])
smaller = SmallerThan(FirstNumber=lng_4, SecondNumber=2)  # -> SmallerThan, OrEqualTo
and_4 = GateAnd(A=c_script_54.A, B=item_27.Item1)
and_5 = GateAnd(A=c_script_54.A, B=item_27.Item)
pshift_2 = ShiftPaths(Data=join_20, Offset=-1)
subtraction_5 = Subtraction(A=number_slider_7, B=lng_5)
cluster_13 = Cluster_6(relay=c_script_16.SurfaceFloor)
dup_13 = DuplicateData(Data=False, Number=subtraction_5, Order=True)
dup_14 = DuplicateData(Data=True, Number=lng_5, Order=True)
filter_8 = StreamFilter(Gate=smaller.SmallerThan, Stream0=pshift_2, Stream1=flatten(join_20))  # -> simplify(Stream)
merge_42 = Merge(Data1=flatten(dup_14), Data2=flatten(dup_13))
number_slider_15 = Slider(30, range=0..100)
filter_9 = StreamFilter(Gate=and_4, Stream1=mesh_28)
filter_10 = StreamFilter(Gate=and_4, Stream1=mjoin_8)
filter_11 = StreamFilter(Gate=and_4, Stream1=panel_56)
heat_map_size = Slider(123, range=0..1000)
tag_3 = TextTag3D(
    Location=cluster_13,
    Text="→ N",
    Size=Slider(5, range=0..10),
    Colour=ColourSwatch(SwatchColor=RGB(0, 0, 0)),
    Justification=7)
and_6 = GateAnd(A=values_42.Values, B=merge_42)
number_slider_16 = Slider(11, range=0..1000)
data_13 = Data(filter_8)
number_slider_17 = Slider(0, range=0..20)

button_3 = CreateButton(ButtonName="Bake", ButtonStyle=0)
getprops_5 = GetElementProperties(UIElement=button_3)  # -> PropertyNames, PropertyTypes
values_44 = ValueListener(Elements=button_3, SomeProperty=True)  # -> Values, Indices
item_31 = ListItem(List=getprops_5.PropertyNames, Index=3, Wrap=True)
filter_12 = StreamFilter(Gate=values_44.Values, Stream1=Toggle(False))
panel_57 = Panel(values_44.Values)
setprop_5 = SetElementProperty(UIElement=button_3, PropertyName=item_31, ValueToSet=filter_12)

N = Number(Slider(3, range=0..10))
c_script_57 = CSharpScript(x=num_14)  # -> out, A; inputs x: String
# ---------- c_script_57: C# ----------
    A = Math.Round(double.Parse(x), 3)*100;
# ---------- end c_script_57 ----------
split_8 = SplitList(List=data_13, Index=expr("x+1", tstat_2.Count))  # -> ListA, simplify(ListB)
item_32 = ListItem(List=data_13, Index=tstat_2.Count, Wrap=True)
updated_analysis = Text(["Name", "WWR : 0", "sDA: 0 %", "ASE: 0 %", "UDIa: 0%", "MI: 0 lux", "Heat Nd : 0", "Cool Nd : 0"])
multiplication_23 = Multiplication(A=number_slider_15, B=N)
item_33 = ListItem(List=c_script_57.A, Index=0, Wrap=True)  # -> Item, Item1
split_9 = TextSplit(Text=item_32, Separators="_")
number_slider_18 = Slider(2.5, range=0..5)
lng_6 = ListLength(List=updated_analysis)
addition_3 = Addition(A=number_slider_17, B=Slider(92, range=0..1000))
dup_15 = DuplicateData(Data="<Alternative>", Number=multiplication_23, Order=True)
txt_20 = Text(c_script_42.A)
item_34 = ListItem(List=split_9, Index=0, Wrap=True)

# ---- group: Perimeter
num_21 = Number(item_33.Item)

# ---- group: Core
num_22 = Number(item_33.Item1)

# ----
number_slider_19 = Slider(9, range=0..100)
dup_16 = DuplicateData(Data=updated_analysis, Number=number_slider_15, Order=True)
neg_3 = Negative(Value=number_slider_18)
dom_3 = ConstructDomain(DomainStart=number_slider_17, DomainEnd=addition_3)
true_button_2 = CreateTrueOnlyButton(ButtonName=dup_15, ButtonStyle=3)
toggle_11 = BooleanToggle(False)
toggle_12 = BooleanToggle(False)
format_8 = Format(Format="Alternative {0}", Culture=127, Data0=item_34)
format_9 = Format(
    Format=["WWR: {0} %", "sDA: {0} %", "ASE: {0} %", "UDIa: {0}%", "MI: {0} lux", "Heat Need: {0}", "Cool Need: {0}"],
    Culture=127,
    Data0=split_8.ListB)
merge_43 = Merge(Data1=flatten(cluster_9.T), Data2=flatten("Energy"))
merge_44 = Merge(Data1=0, Data2=neg_3)
partition_2 = PartitionList(List=dup_16, Size=lng_6)
txt_21 = Text(split_7)
partition_3 = PartitionList(List=true_button_2, Size=N)
true_button_3 = CreateTrueOnlyButton(ButtonName=[" sDA ", " ASE ", " UDI ", " MI ", " H/C"], ButtonStyle=0)
remap_4 = RemapNumbers(Value=txt_20, Source=Domain(0, 100), Target=Slider(14.7, range=0..20))  # -> Mapped, Clipped
pt_8 = ConstructPoint(XCoordinate=0, YCoordinate=merge_44, ZCoordinate=0)
split_10 = SplitList(List=partition_2, Index=1)  # -> simplify(ListA), simplify(ListB)
merge_45 = Merge(Data1=toggle_12, Data2=toggle_11, Data3=toggle_11, Data4=toggle_12)
dup_17 = DuplicateData(Data="<Alternative>", Number=number_slider_15, Order=True)
item_35 = ListItem(List=c_script_55.A, Index=0, Wrap=True)  # -> Item, Item1
planesrf_7 = PlaneSurface(Plane=pt_8, XSize=remap_4.Clipped, YSize=number_slider_18)
item_36 = ListItem(List=c_script_56.A, Index=0, Wrap=True)  # -> Item, Item1
item_37 = ListItem(List=txt_20, Index=0, Wrap=True)  # -> Item, Item1
setbtn_2 = SetButton(ButtonToModify=true_button_3, ButtonName=merge_43)
setbtn_3 = SetButton(ButtonToModify=simplify(partition_3), ImagePath=simplify(txt_21))
hideshow_4 = HideShowElement(ElementToHideShow=true_button_3, Show=True, Collapse=True, Disable=merge_45)
label_4 = CreateLabel(LabelText=split_10.ListA, LabelSize=12, Justification=1)  # -> simplify(Label)
label_5 = CreateLabel(LabelText=split_10.ListB, LabelSize=12, Justification=0)  # -> simplify(Label)
mplane_7 = MeshPlane(Boundary=planesrf_7, WidthCount=1, HeightCount=1)  # -> Mesh, Area
true_button_4 = CreateTrueOnlyButton(ButtonName=dup_17, ButtonStyle=3)
relay_6 = Relay([ColourSwatch(SwatchColor=RGB(224, 0, 0)), ColourSwatch(SwatchColor=RGB(0, 133, 235))])
panel_58 = Panel(item_35.Item1)
panel_59 = Panel(item_36.Item1)
panel_60 = Panel(item_37.Item1)
panel_61 = Panel(num_21)
panel_62 = Panel(num_22)
panel_63 = Panel(item_35.Item)
panel_64 = Panel(item_36.Item)
panel_65 = Panel(item_37.Item)
number_slider_20 = Slider(100, range=0..170)
mcol_9 = MeshColours(Mesh=graft(mplane_7.Mesh), Colours=graft(relay_6))  # -> flatten(Mesh)
series_7 = Series(Start=Slider(200, range=0..200), Step=Slider(76, range=0..1000), Count=Slider(4, range=0..10))
series_8 = Series(Start=Slider(20, range=0..100), Step=Slider(24, range=0..1000), Count=Slider(3, range=0..10))
merge_46 = Merge(Data2=flatten("Perimeter"), Data3=flatten("Core"), Data4=flatten("Total"))
merge_47 = Merge(Data1="Heating", Data2=flatten(panel_63), Data3=flatten(panel_64), Data4=flatten(panel_65))
merge_48 = Merge(Data1="Cooling", Data2=flatten(panel_58), Data3=flatten(panel_59), Data4=flatten(panel_60))
merge_49 = Merge(Data1="Area %", Data2=flatten(panel_61), Data3=flatten(panel_62), Data4=flatten(""))
panel_66 = Panel(txt_21)
getscreen_2 = GetScreenDimensions()  # -> Width, Height
dom_4 = ConstructDomain(DomainStart=Slider(600, range=0..1000), DomainEnd=Slider(1200, range=0..10000))
panel_67 = Panel("""1*
1*
1*
1*
1*""")
cluster_14 = Cluster_7(T=split_8.ListB, I=and_6)
pt_9 = ConstructPoint(XCoordinate=series_7, YCoordinate=graft(series_8), ZCoordinate=0)  # -> flatten(Point)
mjoin_10 = MeshJoin(Meshes=mcol_9)
adjustpos_12 = AdjustElementPositioning(
    ElementsToAdjust=[true_button_4, true_button_2],
    AbsolutePositioning=False,
    Width=number_slider_11,
    Height=number_slider_11)
values_45 = ValueListener(Elements=true_button_3, SomeProperty=True)  # -> flatten(Values), Indices
remap_5 = RemapNumbers(Value=getscreen_2.Height, Source=dom_4, Target=Domain(0, 1))  # -> Mapped, Clipped
entwine_8 = Entwine(Branch00=merge_46, Branch01=merge_47, Branch02=merge_48, Branch03=merge_49, FlattenInputs=True)
panel_68 = Panel("""0
1
2""")
relay_7 = Relay([ColourSwatch(SwatchColor=RGB(240, 255, 217)), ColourSwatch(SwatchColor=RGB(252, 250, 217)), ColourSwatch(SwatchColor=RGB(214, 254, 255)), ColourSwatch(SwatchColor=RGB(232, 232, 255)), ColourSwatch(SwatchColor=RGB(209, 157, 207))])
adjustelem_8 = AdjustElementAppearance(ElementsToAdjust=simplify(label_4), Foreground=ColourSwatch(SwatchColor=RGB(0, 0, 0)), FontSize=11)
adjustelem_9 = AdjustElementAppearance(ElementsToAdjust=simplify(label_5), Foreground=cluster_14, FontSize=11)
setlabel = SetLabelContents(LabelToModify=simplify(label_4), NewLabelContents=simplify(format_8))
setlabel_2 = SetLabelContents(LabelToModify=simplify(label_5), NewLabelContents=simplify(format_9))
adjustpos_13 = AdjustElementPositioning(
    ElementsToAdjust=[partition_3, true_button_4],
    Margin=Slider(0.515, range=0..1),
    AbsolutePositioning=False,
    Width=number_slider_11,
    Height=number_slider_11)
c_script_58 = CSharpScript(x=values_45.Values)  # -> out, A; inputs x: list of Boolean
# ---------- c_script_58: C# ----------
    for(int i = 0 ;i < x.Count ;i++){
      if(x[i])
        a = i;
    }
    A = a;
# ---------- c_script_58: C# additional code ----------
  int a = 1;
# ---------- end c_script_58 ----------
int_10 = Integer(c_script_58.A)
filter_13 = StreamFilter(Gate=int_10, Stream0=mesh_23, Stream1=mesh_24, Stream2=c_script_47.A, Stream3=mesh_25, Stream4=mesh_22)
mesh_29 = Mesh(filter_13)
filter_14 = StreamFilter(Gate=updateboolean1, Stream1=mesh_29)
filter_15 = StreamFilter(Gate=updateboolean1, Stream1=int_10)
filter_16 = StreamFilter(Gate=filter_15, Stream0=relay_4, Stream1=relay_2, Stream2=relay_3, Stream3=relay_5)
item_38 = ListItem(List=filter_16, Index=0, Wrap=True)  # -> Item, Item1
filter_17 = StreamFilter(Gate=and_5, Stream1=filter_14)
split_11 = TextSplit(Text=item_38.Item1, Separators="_")
cluster_15 = Cluster_5(relay=heat_map_size, relay_2=filter_14)  # -> G, pt_3, num_2
lng_7 = ListLength(List=split_11)  # -> expr("x-2", Length)
lng_8 = ListLength(List=split_11)  # -> expr("x-1", Length)
mesh_30 = Mesh(filter_17)
mesh_31 = Mesh(cluster_15.G)
multiplication_24 = Multiplication(A=cluster_15.num_2, B=Slider(2.08, range=0..3))
item_39 = ListItem(List=split_11, Index=expr("x-1", lng_8), Wrap=True)
cull_i_2 = CullIndex(List=split_11, Indices=[lng_8, lng_7], Wrap=True)
item_40 = ListItem(List=split_11, Index=lng_8, Wrap=True)
series_9 = Series(Start=multiplication_24, Step=Slider(19, range=0..1000), Count=10)
lng_9 = ListLength(List=cull_i_2)  # -> expr("x", Length)
item_41 = ListItem(List=series_9, Index=0, Wrap=True)  # -> Item, Item1, Item2, Item3
range_4 = Range(Domain=dom_3, Steps=lng_9)
num_23 = Number(multiplication_24)
shift_2 = ShiftList(List=range_4, Shift=-1, Wrap=False)
pt_10 = ConstructPoint(XCoordinate=number_slider_16, YCoordinate=item_41.Item, ZCoordinate=0)
pt_11 = ConstructPoint(XCoordinate=number_slider_16, YCoordinate=item_41.Item1, ZCoordinate=0)
pt_12 = ConstructPoint(XCoordinate=number_slider_16, YCoordinate=item_41.Item2, ZCoordinate=0)
addition_4 = Addition(A=multiplication_24, B=Slider(87, range=0..1000))
item_42 = ListItem(List=shift_2, Index=0, Wrap=True)  # -> Item, Item1
addition_5 = Addition(A=multiplication_24, B=Slider(202, range=0..1000))
subtraction_6 = Subtraction(A=item_42.Item1, B=item_42.Item)
addition_6 = Addition(A=addition_5, B=Slider(22, range=0..1000))
subtraction_7 = Subtraction(A=addition_5, B=Slider(104, range=0..1000))
division_5 = Division(A=subtraction_6, B=Slider(2.5, range=0..10))
merge_50 = Merge(Data1=addition_4, Data2=addition_5, Data3=addition_6)
addition_7 = Addition(A=shift_2, B=division_5)
pt_13 = ConstructPoint(XCoordinate=number_slider_16, YCoordinate=subtraction_7, ZCoordinate=0)
pt_14 = ConstructPoint(XCoordinate=number_slider_16, YCoordinate=merge_50, ZCoordinate=0)
simplegrid_5 = CreateSimpleGrid(UIElements=graft(true_button_3), Width=Slider(423, range=0..530), RowDefinitions="Auto", ColumnDefinitions=panel_67)
pt_15 = ConstructPoint(XCoordinate=Slider(483, range=0..1000), YCoordinate=Slider(50, range=0..1000), ZCoordinate=0)
adjustelem_10 = AdjustElementAppearance(
    ElementsToAdjust=true_button_3,
    Foreground=ColourSwatch(SwatchColor=RGB(0, 0, 0)),
    Background=relay_7,
    FontSize=Slider(11, range=0..100))
adjustpos_14 = AdjustElementPositioning(
    ElementsToAdjust=true_button_3,
    Margin=Slider(0, range=0..100),
    AbsolutePositioning=True,
    Width=Slider(76, range=0..530),
    Height=Slider(38, range=0..1000),
    HorizontalAlignment=Slider(1, range=0..100))
neg_4 = Negative(Value=addition_7)
stack_8 = CreateStack(UIElements=partition, Horizontal=False)
merge_51 = Merge(Data1=simplify(label_4), Data2=simplify(graft(true_button_4)), Data3=simplify(partition_3), Data4=simplify(label_5))
branch_40 = TreeBranch(Tree=simplify(entwine_8), Path=panel_68, MaintainPaths=True)
number_slider_21 = Slider(10, range=0..100)
item_43 = ListItem(List=c_script_55.A, Index=0, Wrap=True)
item_44 = ListItem(List=true_button_3, Index=0, Wrap=True)  # -> Item, Item1, Item2, Item3
setbtn_4 = SetButton(ButtonToModify=true_button_4, ImagePath=split_6)
meshtoscreen = RenderMeshToScreen(
    Mesh=filter_10,
    Location=pt_13,
    ScaleFactor=Slider(13, range=0..100),
    Depth=Slider(0.9999, range=0..1),
    Fixed=True,
    m_scWithvp=False)
texttoscreen_2 = RenderTextToScreen(Text=filter_11, Location=pt_14, Size=Slider(10, range=0..100), Color=RGB(0, 0, 0), m_scWithvp=False)
mesh_32 = Mesh(filter_9)
button_4 = CreateButton(ButtonName="Exp CSV", ButtonStyle=0)
c_script_59 = CSharpScript(x=item_43)  # -> out, A; same code as c_script_54
stack_9 = CreateStack(UIElements=merge_51, Horizontal=False)  # -> flatten(Stack)
addition_8 = Addition(A=neg_4, B=item_41.Item)
panel_69 = Panel("""Useful Daylight Index (UDI) metrics.

UDIf (Failing) : percentage of time that the sensor receives below 100 lux.
UDIs (Supplementary) : percentage of time that the sensor receives between 100 lux and 300 lux.
UDIa (Acceptable) : percentage of time that the sensor receives between 300 lux and 3000 lux.
UDIe (Excessive): percentage of time that the sensor receives above 3000 lux.""")
panel_70 = Panel("""Mean Illuminance in lux
The quantity of light emitted by a source that falls on a surface.
 Illuminance is measured in lux (lumens per m2)""")
panel_71 = Panel("""Aunual Sunlight Exposure in %
the percentage of space that receives too much direct sunlight (1000 Lux or more for at least 250 occupied hours per year), which can cause glare or increased cooling loads.
If a sensor in space receives more than 1000 lux for at least 250 hours per year, the sensor color will be yellow.
If ASE is > 10%, glare conditions must be addressed, or FAIL score for all LEED daylighting credits.
LEED Score (0-1)""")
panel_72 = Panel("""Spatial Daylight Autonomy in %
Percentage of space that receives more than 300 lux for at least 50% of the time.
If a sensor in space receives more than 300 lux for at least 50 % of time, the sensor color will be light green.
For LEED® projects, scoring varies by building type; higher scores equals more credits.
sDA300/50% (300 lux for 50% of annual hours)
40% = 1 credit
55% = 2 credits
75% = 3 credits""")
txt_22 = Text(["in:Name", "in:Ceiling Reflectance", "in:Floor Reflectance", "in:Wall Reflectance", "in:Glazing Transparency", "in:Wall R-value", "in:Roof R-value", "in:Window U-value", "in:Window SHGC", "in:Total WWR(%)", "out:sDA(%)", "out:ASE(%)", "out:UDIa(%)", "out:MI(lux)", "out:Heating Need(kWh/m2/yr)", "out:Cooling Need(kWh/m2/yr)", "img_3D", "img_sDA", "img_ASE", "img_UDI"])
data_14 = Data(filter_8)
number_slider_22 = Slider(0.9999, range=0..1)
pt_16 = ConstructPoint(XCoordinate=Slider(44, range=0..100), YCoordinate=addition_8, ZCoordinate=200)
tooltip_21 = AttachTooltipToElement(ElementsToAttachTo=button_4, TooltipContent="Export the alternatives to a csv file", ShowDelay=500, Duration=4000)
values_46 = ValueListener(Elements=button_4, SomeProperty=True)  # -> Values, Indices
hideshow_5 = HideShowElement(ElementToHideShow=stack_9, Show=and_6, Collapse=True, Disable=True)
adjustpos_15 = AdjustElementPositioning(
    ElementsToAdjust=[button_4, button_3],
    AbsolutePositioning=False,
    Width=Slider(58, range=0..100),
    Height=Slider(29, range=0..100))
sd = ShowDelay(500)
D = Duration(20000)
addition_9 = Addition(A=tstat_2.Count, B=1)
filter_18 = StreamFilter(Gate=c_script_59.A, Stream1=flatten(branch_40))
filter_19 = StreamFilter(Gate=c_script_59.A, Stream1=mjoin_10)
filter_20 = StreamFilter(Gate=and_5, Stream1=item_38.Item)
stack_10 = CreateStack(UIElements=flatten(stack_8), Horizontal=True)
stack_11 = CreateStack(UIElements=flatten(stack_9), Horizontal=True)
filter_21 = StreamFilter(Gate=and_5, Stream1=cluster_15.G)
filter_22 = StreamFilter(Gate=and_5, Stream1=cull_i_2)
filter_23 = StreamFilter(Gate=and_5, Stream1=item_39)
filter_24 = StreamFilter(Gate=and_5, Stream1=item_40)
series_10 = Series(Start=17, Step=1, Count=8)
series_11 = Series(Start=addition_9, Step=1, Count=7)
updateview3 = Text("1")
tooltip_22 = AttachTooltipToElement(ElementsToAttachTo=item_44.Item, TooltipContent=panel_72, ShowDelay=sd, Duration=D)
tooltip_23 = AttachTooltipToElement(ElementsToAttachTo=item_44.Item1, TooltipContent=panel_71, ShowDelay=sd, Duration=D)
tooltip_24 = AttachTooltipToElement(ElementsToAttachTo=item_44.Item2, TooltipContent=panel_69, ShowDelay=sd, Duration=50000)
tooltip_25 = AttachTooltipToElement(ElementsToAttachTo=item_44.Item3, TooltipContent=panel_70, ShowDelay=sd, Duration=D)
texttoscreen_3 = RenderTextToScreen(Text=filter_18, Location=pt_9, Size=Slider(10, range=0..100), Color=RGB(0, 0, 0), m_scWithvp=False)
expander_5 = CreateExpander(UIElements=simplegrid_5, Header="Metric to Display", Open=True)
meshtoscreen_2 = RenderMeshToScreen(Mesh=filter_19, Location=pt_15, ScaleFactor=Slider(10, range=0..100), Depth=0.9999, Fixed=True, m_scWithvp=False)
item_45 = ListItem(List=data_14, Index=series_11, Wrap=True)
item_46 = ListItem(List=data_14, Index=tstat_2.Count, Wrap=True)
prespective = RenderMeshToScreen(
    Mesh=graft(filter_21),
    Location=graft(cluster_15.pt_3),
    ScaleFactor=updateview3,
    Depth=number_slider_22,
    Fixed=True,
    m_scWithvp=False)
number_slider_23 = Slider(13.9, range=0..20)
adjustelem_11 = AdjustElementAppearance(
    ElementsToAdjust=graft(button_3),
    Foreground=ColourSwatch(SwatchColor=RGB(0, 0, 0)),
    Background=ColourSwatch(SwatchColor=RGB(255, 255, 255)),
    FontSize=number_slider_23)
texttoscreen_4 = RenderTextToScreen(Text=filter_22, Location=pt_16, Size=Slider(9, range=0..100), Color=RGB(0, 0, 0), m_scWithvp=False)
meshtoscreen_3 = RenderMeshToScreen(
    Mesh=filter_20,
    Location=pt_10,
    ScaleFactor=Slider(13, range=0..100),
    Depth=number_slider_22,
    Fixed=True,
    m_scWithvp=False)
texttoscreen_5 = RenderTextToScreen(Text=filter_23, Location=pt_11, Size=number_slider_19, Color=RGB(0, 0, 0), m_scWithvp=False)
texttoscreen_6 = RenderTextToScreen(Text=filter_24, Location=pt_12, Size=number_slider_19, Color=RGB(0, 0, 0), m_scWithvp=False)
item_47 = ListItem(List=data_14, Index=series_10, Wrap=True)
format_10 = Format(Format="Alternative_{1}", Culture=127, Data0=c_script_2.A, Data1=item_46)
cluster_16 = Cluster_9(relay=item_45)
cluster_17 = Cluster_9(relay=item_47)
format_11 = Format(
    Format=["Alternative_{0}\{0}_3DView.png", "Alternative_{0}\{0}_Heatmap_1.png", "Alternative_{0}\{0}_Heatmap_2.png", "Alternative_{0}\{0}_Heatmap_3.png"],
    Culture=127,
    Data0=item_46)
scrollviewer_2 = CreateScrollViewer(
    UIElements=stack_10,
    HorizontalScrollBarVisibility=1,
    VerticalScrollBarVisibility=2,
    Width=Slider(405, range=0..1000),
    Height=Slider(289, range=0..1000))
scrollviewer_3 = CreateScrollViewer(
    UIElements=stack_11,
    HorizontalScrollBarVisibility=0,
    VerticalScrollBarVisibility=0,
    Width=Slider(420, range=0..1000),
    Height=Slider(283, range=0..1000))
adjustelem_12 = AdjustElementAppearance(
    ElementsToAdjust=graft(button_4),
    Foreground=ColourSwatch(SwatchColor=RGB(255, 255, 255)),
    Background=ColourSwatch(SwatchColor=RGB(0, 166, 6)),
    FontSize=number_slider_23)
adjustelem_13 = AdjustElementAppearance(ElementsToAdjust=stack_11, Background=ColourSwatch(SwatchColor=RGB(255, 255, 255)))
adjustelem_14 = AdjustElementAppearance(
    ElementsToAdjust=graft(stack_10),
    Background=graft(ColourSwatch(SwatchColor=RGB(255, 255, 255))),
    FontSize=Slider(8.028, range=0..20))
panel_73 = Panel("""Heating Need (kWh/m2/yr)
Cooling Need (kWh/m2/yr)""")
merge_52 = Merge(Data1=simplify(format_10), Data2=simplify(cluster_17), Data3=simplify(cluster_16), Data4=simplify(format_11))
c_script_60 = CSharpScript(Number=c_script_41.A, Scope=0.01)  # -> out, A; inputs Number: Double, Scope: Double; same code as c_script_2
num_24 = Number(simplify([0, 0, 0, 0, 0, 0, 0, 0, 0, 0, 0, 0]))
panel_74 = Panel(merge_52)
merge_53 = Merge(Data1=simplify(graft(num_24)), Data2=simplify(graft(num_24)))
format_12 = Format(Format="{0}\data.csv", Culture=127, Data0=c_script_2.A)
join_25 = TextJoin(Text=txt_22, Join=",")  # -> flatten(Result)
join_26 = TextJoin(Text=merge_52, Join=",")  # -> flatten(Result)
bool_3 = Boolean(values_46.Values)
flip_8 = FlipMatrix(Data=c_script_60.A)
ct = ClusterTitle(["Jan", "Feb", "Mar", "Apr", "May", "Jun", "Jul", "Aug", "Sep", "Oct", "Nov", "Dec"])
panel_75 = Panel("""1*
1.5*
1*""")
merge_54 = Merge(Data1=flatten(join_25), Data2=flatten(join_26))
multichart = CreateMultiChart(Data=merge_53, Names=flatten(panel_73), ClusterTitle=ct, ChartType=3)
c_script_61 = CSharpScript(x=flip_8, y=merge_53)  # -> out, A
# ---------- c_script_61: C# ----------
    if(x==null)
      A = y;
    else
      A = x;
# ---------- end c_script_61 ----------
merge_55 = Merge(Data1=flatten(button_4), Data2=flatten(button_3))
simplegrid_6 = CreateSimpleGrid(UIElements=graft(radiobtn_4), Width=Slider(396, range=0..530), RowDefinitions="Auto", ColumnDefinitions=panel_75)
setmultichart = SetMultiChartContents(ChartToModify=multichart, NewChartValues=c_script_61.A, ClusterTitle=ct)
values_47 = ValueListener(Elements=item_9.Item1, SomeProperty=True)  # -> Values, Indices
c_script_62 = CSharpScript(Save=bool_3, path=format_12, data=merge_54)  # inputs Save: Boolean, path: String, data: list of String
# ---------- c_script_62: C# usings ----------
using System.Runtime;
using System.IO;
# ---------- c_script_62: C# ----------
    if(Save){
      var fileInfo = new System.IO.FileInfo(path);
      if(!fileInfo.Directory.Exists)
        fileInfo.Directory.Create();

      var sw = fileInfo.CreateText();
      for(int i = 0 ;i < data.Count; i++){
        string row = data[i];
        if(i < data.Count - 1){
          sw.WriteLine(row);
        }
        else{
          sw.Write(row);
        }

      }
      sw.Flush();
      sw.Close();
    }
# ---------- end c_script_62 ----------
panel_76 = Panel(bool_3)
toggle_13 = BooleanToggle(True)
not = GateNot(A=values_47.Values)
stack_12 = CreateStack(UIElements=flatten(simplegrid_6), Horizontal=True)
merge_56 = Merge(Data1=ColourSwatch(SwatchColor=RGB(224, 22, 0)), Data2=ColourSwatch(SwatchColor=RGB(18, 53, 255)))  # -> flatten(Result)
stack_13 = CreateStack(UIElements=flatten([scrollviewer_3, scrollviewer_2]), Horizontal=True)
panel_77 = Panel("""Heating: {0}
Cooling: {1}""")
c_script_63 = CSharpScript(Number=txt_20, Scope=0.01)  # -> out, A; inputs Number: Double, Scope: Double
# ---------- c_script_63: C# ----------
    double x = Number;
    double y = Scope;
    double Divide = x / y;
    double wholeDiv = Math.Round(Divide);
    A = Convert.ToString(Scope * wholeDiv);
# ---------- end c_script_63 ----------
hideshow_6 = HideShowElement(ElementToHideShow=scrollviewer_2, Show=not, Collapse=True, Disable=False)
hideshow_7 = HideShowElement(ElementToHideShow=scrollviewer_3, Show=values_47.Values, Collapse=True, Disable=False)
adjustpos_16 = AdjustElementPositioning(
    ElementsToAdjust=merge_55,
    Margin="0,10,180,10",
    AbsolutePositioning=False,
    Width=Slider(107, range=0..1000),
    Height=Slider(33, range=0..100),
    HorizontalAlignment=Slider(1, range=0..10),
    VerticalAlignment=Slider(1, range=0..10))
panel_78 = Panel("Annual Heating / Cooling Need                            (kWh/m2/yr)  ")
chartappearance = ChartAppearance(ChartToModify=multichart, Colors=flatten(merge_56), Legend=toggle_13, Title=toggle_13)
adjustpos_17 = AdjustElementPositioning(
    ElementsToAdjust=multichart,
    AbsolutePositioning=True,
    Width=Slider(382, range=0..1000),
    Height=Slider(392, range=0..1000),
    HorizontalAlignment=0,
    VerticalAlignment=1)
adjustelem_15 = AdjustElementAppearance(
    ElementsToAdjust=multichart,
    Foreground=ColourSwatch(SwatchColor=RGB(0, 0, 0)),
    Background=ColourSwatch(SwatchColor=RGB(255, 255, 255)),
    FontSize=Slider(6.148, range=0..10))
label_6 = CreateLabel(LabelText=["Heating Need: 0", "Cooling Need: 0"], LabelSize=12, Justification=0)
simplegrid_7 = CreateSimpleGrid(UIElements=graft(merge_55), RowDefinitions="Auto", ColumnDefinitions="Auto")
item_48 = ListItem(List=c_script_63.A, Index=0, Wrap=True)  # -> Item, Item1
separator_7 = CreateSeparator(Thickness=0.5, Horizontal=True, Color=RGB(0, 0, 0))
separator_8 = CreateSeparator(Thickness=0.5, Horizontal=True, Color=RGB(0, 0, 0))
relay_8 = Relay([ColourSwatch(SwatchColor=RGB(161, 0, 0)), ColourSwatch(SwatchColor=RGB(0, 75, 156))])
adjustpos_18 = AdjustElementPositioning(ElementsToAdjust=stack_13, Margin="0,0,0,10", AbsolutePositioning=False)
format_13 = Format(Format=panel_77, Culture=127, Data0=item_48.Item, Data1=item_48.Item1)
border = CreateBorder(UIElement=multichart, BorderThickness=0, BorderColor=RGB(0, 0, 0), CornerRadius=0)
adjustelem_16 = AdjustElementAppearance(
    ElementsToAdjust=graft(label_6),
    Foreground=graft(relay_8),
    Background=graft(ColourSwatch(SwatchColor=RGB(250, 250, 250))),
    FontSize=Slider(15, range=0..20))
adjustpos_19 = AdjustElementPositioning(
    ElementsToAdjust=stack_12,
    Margin="0,10,0,0",
    AbsolutePositioning=False,
    Width=Slider(406, range=0..1000),
    Height=Slider(44, range=0..100),
    HorizontalAlignment=Slider(0, range=0..10),
    VerticalAlignment=Slider(0, range=0..10))
merge_57 = Merge(
    Data1=flatten(simplegrid_4),
    Data2=flatten(separator_7),
    Data3=flatten(stack_12),
    Data4=flatten(stack_13),
    Data5=separator_8,
    Data6=flatten(simplegrid_7))
adjustpos_20 = AdjustElementPositioning(
    ElementsToAdjust=[separator_7, separator_8],
    AbsolutePositioning=False,
    Width=Slider(406, range=0..1000),
    Height=Slider(1, range=0..100),
    HorizontalAlignment=Slider(0, range=0..10),
    VerticalAlignment=Slider(0, range=0..10))
stack_14 = CreateStack(UIElements=label_6, Horizontal=True)
setlabel_3 = SetLabelContents(LabelToModify=label_6, NewLabelContents=format_13)
expander_6 = CreateExpander(UIElements=stack_14, Header=panel_78, Open=True)
stack_15 = CreateStack(UIElements=merge_57, Horizontal=False)  # -> flatten(Stack)
hideshow_8 = HideShowElement(ElementToHideShow=border, Show=Toggle(True), Collapse=True, Disable=False)
panel_79 = Panel(merge_57)
adjustpos_21 = AdjustElementPositioning(
    ElementsToAdjust=border,
    AbsolutePositioning=True,
    Width=Slider(389, range=0..1000),
    Height=Slider(257, range=0..1000),
    HorizontalAlignment=1,
    VerticalAlignment=3)
adjustpos_22 = AdjustElementPositioning(
    ElementsToAdjust=label_6,
    Margin="0",
    AbsolutePositioning=True,
    Width=Slider(223, range=0..1000),
    Height=Slider(29, range=0..100),
    HorizontalAlignment=1)
panel_80 = Panel("Heating / Cooling Need                             Monthly Breakdown")
expander_7 = CreateExpander(UIElements=stack_15, Header="Repository", Open=Toggle(True))

I = Indices(0)
datatable = CreateDataTable(
    Data=Tree({0;0;0}: ["Perimeter", "Core", "Total"], {0;1;0}: ["0", "0", "0"], {0;2;0}: ["0", "0", "0"], {0;3;0}: ["0", "0"]),
    ColumnHeadings=flatten(["", "Heating", "Cooling", "Area %"]),
    AllowSorting=True,
    ColumnSizingMode=-1)
cull_i_3 = CullIndex(List=entwine_8, Indices=I, Wrap=True)
setdatatable = SetDataTable(DataTableToSet=datatable, Data=cull_i_3)
txt_23 = Text(flatten(branch_39))
join_27 = TextJoin(Text=[txt_23, "HeatingCoolingTable.png"], Join="_")
merge_58 = Merge(Data1=flatten(values_7.Values), Data2="High Resolution", Data3=flatten(join_27))  # -> flatten(Result)
join_28 = TextJoin(Text=merge_58, Join="\")
capture = CaptureWindowOrElementToFile(WindowOrElement=datatable, FilePath=join_28, ScaleFactor="2", Run=trigger, CaptureEntireWindow=False)

expander_8 = CreateExpander(UIElements=border, Header=panel_80, Open=Toggle(False))
adjustpos_23 = AdjustElementPositioning(ElementsToAdjust=expander_7, AbsolutePositioning=False, Height=Slider(498, range=0..1000))
txt_24 = Text(flatten(branch_39))
join_29 = TextJoin(Text=[txt_24, "HeatingCoolingNeed.png"], Join="_")
merge_59 = Merge(Data1=flatten(values_7.Values), Data2="High Resolution", Data3=flatten(join_29))  # -> flatten(Result)
join_30 = TextJoin(Text=merge_59, Join="\")
capture_2 = CaptureWindowOrElementToFile(WindowOrElement=expander_8, FilePath=join_30, ScaleFactor="2", Run=trigger, CaptureEntireWindow=False)
merge_60 = Merge(Data1=flatten(expander_2), Data2=flatten(expander_3), Data3=flatten(expander), Data4=flatten(expander_4))  # -> flatten(Result)
adjustelem_17 = AdjustElementAppearance(
    ElementsToAdjust=graft(merge_60),
    Foreground=ColourSwatch(SwatchColor=RGB(255, 255, 255)),
    Background=ColourSwatch(SwatchColor=RGB(105, 105, 105)),
    FontSize=Slider(13.4, range=0..20))
merge_61 = Merge(Data1=flatten(expander_5), Data2=flatten(expander_6), Data3=flatten(expander_8), Data4=flatten(expander_7))  # -> flatten(Result)

number_slider_24 = Slider(13.4, range=0..20)
swatch_3 = ColourSwatch(SwatchColor=RGB(102, 102, 102))
swatch_4 = ColourSwatch(SwatchColor=RGB(255, 255, 255))
adjustelem_18 = AdjustElementAppearance(ElementsToAdjust=graft(expander_2), Foreground=swatch_4, Background=swatch_3, FontSize=number_slider_24)
adjustelem_19 = AdjustElementAppearance(
    ElementsToAdjust=graft(merge_61),
    Foreground=ColourSwatch(SwatchColor=RGB(255, 255, 255)),
    Background=ColourSwatch(SwatchColor=RGB(79, 79, 79)),
    FontSize=Slider(13.6, range=0..20))
adjustelem_20 = AdjustElementAppearance(ElementsToAdjust=graft(expander_4), Foreground=swatch_4, Background=swatch_3, FontSize=number_slider_24)

adjustpos_24 = AdjustElementPositioning(ElementsToAdjust=merge_60, AbsolutePositioning=False, Width=Slider(217, range=0..1000))
merge_62 = Merge(Data1=flatten(stack_5), Data2=flatten(merge_61))  # -> flatten(Result)
adjustelem_21 = AdjustElementAppearance(
    ElementsToAdjust=graft(stack_5),
    Foreground=ColourSwatch(SwatchColor=RGB(255, 255, 255)),
    Background=ColourSwatch(SwatchColor=RGB(255, 255, 255)),
    FontSize=Slider(13.6, range=0..20))
adjustpos_25 = AdjustElementPositioning(ElementsToAdjust=merge_62, Margin="0", AbsolutePositioning=False, Width=Slider(432, range=0..1000))
mesh_33 = Mesh(bang.Branch7)
mjoin_11 = MeshJoin(Meshes=mesh_33)
mesh_34 = Mesh(bang.Branch5)

mjoin_12 = MeshJoin(Meshes=filter_14)
join_31 = JoinCurves(Curves=c_script_16.ZoneOutline, Preserve=False)
crv_5 = Curve(c_script_16.InteriorWallsCurves)
merge_63 = Merge(Data1=flatten(join_31), Data2=flatten(crv_5))
merge_64 = Merge(Data1=flatten(mjoin_4), Data2=flatten(mjoin_12), Data3=flatten(mesh_34), Data4=flatten(mjoin_11))
c_script_64 = CSharpScript(Go=values_44.Values, meshes=merge_64, curves=merge_63)  # -> out, A; inputs Go: Boolean, meshes: list of Mesh, curves: list of Curve
# ---------- c_script_64: C# ----------
    if(Go)
    {
      Rhino.DocObjects.ObjectAttributes objectAttributes = new Rhino.DocObjects.ObjectAttributes();
      int currentLayerIndex = Rhino.RhinoDoc.ActiveDoc.Layers.CurrentLayer.LayerIndex;
      objectAttributes.LayerIndex = currentLayerIndex;
      foreach(Mesh m in meshes)
        Rhino.RhinoDoc.ActiveDoc.Objects.AddMesh(m, objectAttributes);
      
      foreach(Curve cr in curves)
        Rhino.RhinoDoc.ActiveDoc.Objects.AddCurve(cr, objectAttributes);

    }
# ---------- end c_script_64 ----------

stack_16 = CreateStack(UIElements=merge_60, Horizontal=False)
stack_17 = CreateStack(UIElements=merge_62, Horizontal=False)
scrollviewer_4 = CreateScrollViewer(UIElements=stack_16, HorizontalScrollBarVisibility=2, VerticalScrollBarVisibility=0)
scrollviewer_5 = CreateScrollViewer(UIElements=stack_17, HorizontalScrollBarVisibility=2, VerticalScrollBarVisibility=0)
adjustelem_22 = AdjustElementAppearance(ElementsToAdjust=stack_16, Background=ColourSwatch(SwatchColor=RGB(255, 255, 255)))
merge_65 = Merge(Data1=flatten(scrollviewer_4), Data2=flatten(scrollviewer_5))
panel_81 = Panel("\"Amber\", \"Blue\", \"Brown\", \"Cobalt\", \"Crimson\", \"Cyan\", \"Emerald\", \"Green\", \"Indigo\", \"Lime\", \"Magenta\", \"Mauve\", \"Olive\", \"Orange\", \"Pink\", \"Purple\", \"Red\", \"Sienna\", \"Steel\", \"Taupe\", \"Teal\", \"Violet\", \"Yellow\",\"Black\"")
split_12 = TextSplit(Text=panel_81, Separators=", ")
split_13 = TextSplit(Text=split_12, Separators="\"\"")
lng_10 = ListLength(List=split_13)
larger_6 = LargerThan(FirstNumber=lng_10, SecondNumber=2)  # -> LargerThan, OrEqualTo
cull_3 = CullPattern(List=split_13, CullPattern=larger_6.LargerThan)
launchwin = LaunchWindow(
    Show=Toggle(True),
    Name="DPredict [Beta]",
    Width=Slider(698, range=0..1000),
    Height=Slider(811, range=800..900),
    ChildStatus=2,
    EnableHorizScroll=False)
clean_5 = CleanTree(RemoveNulls=True, RemoveInvalid=True, RemoveEmpty=True, Tree=cull_3)
merge_66 = Merge(Data1=Slider(231, range=0..1000), Data2=Slider(911, range=0..5000))
merge_67 = Merge(Data1=Slider(761, range=0..1000))
relay_9 = Relay([Slider(0, range=0..2), Slider(0, range=0..2)])
relay_10 = Relay([Slider(0, range=0..2), Slider(1, range=0..2)])
item_49 = ListItem(List=clean_5, Index=1, Wrap=True)  # -> flatten(Item)
item_50 = ListItem(List=item_49, Index=Slider(11, range=0..26), Wrap=True)
grid = CreateGrid(
    UIElements=merge_65,
    Width=Slider(700, range=0..5000),
    Height=Slider(760, range=600..800),
    RowDefinitions=flatten(merge_67),
    ColumnDefinitions=flatten(merge_66),
    ElementRow=relay_9,
    ElementColumn=relay_10,
    ElementRowSpan=2,
    ElementColumnSpan=1)

# ---- group: Checking the Unit
panel_82 = Panel("Change Rhino unit to \"Meters\" and ensure that your model is in meters.")
toggle_14 = CreateToggle(Default=False, OnLabel="Ok", OffLabel="Ok")
values_48 = ValueListener(Elements=toggle_14, SomeProperty=True)  # -> Values, Indices
label_7 = CreateLabel(LabelText=panel_82, LabelSize=24, Justification=1)
filter_25 = StreamFilter(Gate=values_48.Values, Stream1=Toggle(False))
getprops_6 = GetElementProperties(UIElement=toggle_14)  # -> PropertyNames, PropertyTypes
item_51 = ListItem(List=getprops_6.PropertyNames, Index=52, Wrap=True)
stack_18 = CreateStack(UIElements=[label_7, toggle_14], Horizontal=False)
item_52 = ListItem(List=getprops_6.PropertyNames, Index=11, Wrap=True)
adjustpos_26 = AdjustElementPositioning(
    ElementsToAdjust=toggle_14,
    Margin="0,30,0,0",
    AbsolutePositioning=True,
    Width=Slider(95, range=0..300),
    Height=Slider(41, range=0..100),
    HorizontalAlignment=1,
    VerticalAlignment=1)
panel_83 = Panel(values_48.Values)
adjustelem_23 = AdjustElementAppearance(
    ElementsToAdjust=[toggle_14, label_7],
    Foreground=ColourSwatch(SwatchColor=RGB(36, 36, 36)),
    FontSize=Slider(19, range=0..100))
setprop_6 = SetElementProperty(UIElement=toggle_14, PropertyName=item_51, ValueToSet="Ok")
setprop_7 = SetElementProperty(UIElement=toggle_14, PropertyName=item_52, ValueToSet=filter_25)
c_script_65 = CSharpScript(x=values_48.Values)  # -> out, A; inputs x: Boolean
# ---------- c_script_65: C# ----------
    if(x)
      A = false;
# ---------- end c_script_65 ----------
c_script_66 = CSharpScript()  # -> out, A
# ---------- c_script_66: C# ----------
    if(Rhino.RhinoDoc.ActiveDoc.ModelUnitSystem.ToString() == "Meters")
    {
      A = false;
    }
    else
      A = true;
# ---------- end c_script_66 ----------
hideshow_9 = HideShowElement(ElementToHideShow=stack_18, Show=c_script_65.A, Collapse=True, Disable=False)
hideshow_10 = HideShowElement(ElementToHideShow=stack_18, Show=c_script_66.A, Collapse=True, Disable=False)
hideshow_11 = HideShowElement(ElementToHideShow=grid, Show=invert(c_script_65.A), Collapse=True, Disable=False)
hideshow_12 = HideShowElement(ElementToHideShow=grid, Show=invert(c_script_66.A), Collapse=True, Disable=False)

# ----
winprops = SetWindowProperties(
    Window=launchwin,
    AccentColor=item_50,
    ShowTitleBar=True,
    BackgroundColor=ColourSwatch(SwatchColor=RGB(255, 255, 255)),
    ScaleFactor=1)
merge_68 = Merge(Data1=grid, Data2=stack_18)
addelems = AddElements(Window=launchwin, Elements=flatten(merge_68), DoVLChecking=True)  # -> AddedElements, ElementNames

c_script_67 = CSharpScript(
    path=values_6.Values,
    Reference="C:\Users\ampanavoss\Documents\ML_Daylight\ML-daylight\GrasshopperML\GrasshopperML\bin\Release\net48\EPWReader.dll")  # -> out, Location; inputs path: String
# ---------- c_script_67: C# usings ----------
using EPWReader;
# ---------- c_script_67: C# ----------
    EPWeatherData epw = new EPWeatherData(path);
    Location = epw.Location.City.ToString();
# ---------- end c_script_67 ----------
split_14 = TextSplit(Text=c_script_67.Location, Separators=".")  # -> flatten(Result)
item_53 = ListItem(List=split_14, Index=0, Wrap=True)
split_15 = TextSplit(Text=item_53, Separators="-")  # -> flatten(Result)
item_54 = ListItem(List=split_15, Index=0, Wrap=True)

c_script_68 = CSharpScript(x=item_54)  # -> out, A
# ---------- c_script_68: C# ----------
    if(x == null)
      A = "";
    else
      A = "(" + x.ToString() + ")";
# ---------- end c_script_68 ----------

format_14 = Format(Format="{0} {1}", Culture=127, Data0="Building Inputs", Data1=c_script_68.A)
setexp = SetExpander(Expander=expander_2, Name=format_14)
panel_84 = Panel(format_14)

# ==== cluster Cluster
se_threshold = Slider(250, range=0..1000)
relay = ClusterInput()
relay_2 = ClusterInput()
c_script = CSharpScript(x=relay, y=Slider(0.5, range=0..1))  # -> out, A; inputs x: Double, y: Double
# ---------- c_script: C# ----------
    if(x>=y)
      A = 1;
    else
      A = 0;
# ---------- end c_script ----------
larger = LargerThan(FirstNumber=relay_2, SecondNumber=0.5)  # -> LargerThan, OrEqualTo
larger_2 = LargerThan(FirstNumber=c_script.A, SecondNumber=0)  # -> LargerThan, OrEqualTo
int = Integer(larger.LargerThan)
cull = CullPattern(List=c_script.A, CullPattern=larger_2.LargerThan)
lng = ListLength(List=cull)
lng_2 = ListLength(List=c_script.A)
I = ClusterInput()
I_2 = ClusterInput()
avr = Average(Input=int)
division = Division(A=lng, B=lng_2)
avr_2 = Average(Input=I)
S = Scope(0.01)
avr_3 = Average(Input=I_2)
multiplication = Multiplication(A=division, B=100)
multiplication_2 = Multiplication(A=avr, B=100)
multiplication_3 = Multiplication(A=avr_2, B=100)
c_script_2 = CSharpScript(Number=avr_3, Scope=S)  # -> out, A; inputs Number: Double, Scope: Double
# ---------- c_script_2: C# usings ----------
using System.IO;
using System.Linq;
using System.Data;
using System.Drawing;
using System.Reflection;
using System.Windows.Forms;
using System.Xml;
using System.Xml.Linq;
using System.Runtime.InteropServices;

using Rhino.DocObjects;
using Rhino.Collections;
using GH_IO;
using GH_IO.Serialization;
# ---------- c_script_2: C# ----------
    double x = Number;
    double y = Scope;
    double Divide = x / y;
    double wholeDiv = Math.Round(Divide);
    A = Scope * wholeDiv;
# ---------- end c_script_2 ----------
c_script_3 = CSharpScript(Number=multiplication_2, Scope=S)  # -> out, A; inputs Number: Double, Scope: Double; same code as c_script_2
c_script_4 = CSharpScript(Number=multiplication, Scope=S)  # -> out, A; inputs Number: Double, Scope: Double; same code as c_script_2
null = NullItem(Item=avr_3)  # -> NullFlags, InvalidFlags, Description
c_script_5 = CSharpScript(Number=multiplication_3, Scope=S)  # -> out, A; inputs Number: Double, Scope: Double; same code as c_script_2
null_2 = NullItem(Item=avr_2)  # -> NullFlags, InvalidFlags, Description
null_3 = NullItem(Item=division)  # -> NullFlags, InvalidFlags, Description
null_4 = NullItem(Item=avr)  # -> NullFlags, InvalidFlags, Description
filter = StreamFilter(Gate=null.NullFlags, Stream0=c_script_2.A, Stream1="0")
filter_2 = StreamFilter(Gate=null_3.NullFlags, Stream0=c_script_4.A, Stream1="0")
filter_3 = StreamFilter(Gate=null_4.NullFlags, Stream0=c_script_3.A, Stream1="0")
filter_4 = StreamFilter(Gate=null_2.NullFlags, Stream0=c_script_5.A, Stream1="0")
round = Round(Number=filter)  # -> Nearest, Floor, Ceiling
merge = Merge(Data1=flatten(filter_3), Data2=flatten(filter_2), Data3=flatten(filter_4), Data4=flatten(round.Nearest))
c_script_6 = CSharpScript(x=merge, y=["0", "0", "0", "0"])  # -> out, A; inputs x: Double, y: Double
# ---------- c_script_6: C# ----------
    if(x == null){
      A = y;}
    else
      A = x;
# ---------- end c_script_6 ----------
format = Format(Format="{0}:{1}{2}", Culture=127, Data0=["sDA", "ASE", "UDIa", "MI"], Data1=c_script_6.A, Data2=["%", "%", "%", "Lux"])
A = ClusterOutput(c_script_6.A)
T = ClusterOutput(format)
panel = Panel(format)

# ==== cluster Cluster_2
number_slider = Slider(0.4, range=0..10)
relay = ClusterInput()
neg = Negative(Value=number_slider)
end = EndPoints(Curve=relay)  # -> Start, End
merge = Merge(Data1=neg, Data2=number_slider)
Z = UnitZ(Factor=1)
ln = Line(StartPoint=end.Start, EndPoint=end.End)
join = JoinCurves(Curves=relay, Preserve=False)
vrot = Rotate(Vector=graft(ln), Axis=Z, Angle=[1.570796327, -1.570796327])
offset_l = OffsetCurveLoose(Curve=graft(relay), Distance=merge)
curvepoint = PointOnCurve(relay, parameter=0.5)
addition = Addition(A=graft(curvepoint), B=vrot)
boundary = BoundarySurfaces(Edges=join)
curvepoint_2 = PointOnCurve(offset_l, parameter=0.5)
pull = PullPoint(Point=addition, Geometry=boundary, ClosestOnly=True)  # -> ClosestPoint, Distance
pull_2 = PullPoint(Point=curvepoint_2, Geometry=boundary, ClosestOnly=True)  # -> ClosestPoint, Distance
sort = SortList(Keys=pull.Distance, ValuesA=vrot)  # -> Keys, ValuesA
sort_2 = SortList(Keys=pull_2.Distance, ValuesA=offset_l)  # -> Keys, ValuesA
item = ListItem(List=reverse(sort.ValuesA), Index=0, Wrap=True)
item_2 = ListItem(List=reverse(sort_2.ValuesA), Index=0, Wrap=True)  # -> simplify(Item)
vrot_2 = Rotate(Vector=item, Axis=Vector(0, 0, 1), Angle=-1.570796327)
curvepoint_3 = PointOnCurve(item_2, parameter=0.5)
tstat = TreeStatistics(Tree=item_2)  # -> graft(Paths), Length, Count
Z_2 = UnitZ(Factor=1)
dpath = DeconstructPath(Branch=tstat.Paths)
pl = ConstructPlane(Origin=curvepoint_3, XAxis=expr("-X", vrot_2), YAxis=Z_2)  # -> simplify(Plane)
weave = Weave(Pattern=[1, 0, 1], Stream0=dpath, Stream1=["[", "]"], NullGaps=False)
join_2 = TextJoin(Text=weave)
pl_2 = ClusterOutput(pl)
R = ClusterOutput(join_2)

# ==== cluster Cluster_3
C = ClusterInput()
relay = ClusterInput()
onoff = ClusterInput()

# ---- group: Clipping Plane
bbox = BoundingBox(Content=C, Plane=PlaneXY(0, 0, 0))  # -> Box, Box_2
area = Area(Geometry=bbox.Box)  # -> Area, Centroid
Z = UnitZ(Factor=relay)
move = Move(Geometry=area.Centroid, Motion=Z)  # -> Geometry, Transform
xy = XYPlane(Origin=move.Geometry)
c_script = CSharpScript(plane=xy, onOff=Toggle(False))  # -> out, A; inputs plane: Plane, onOff: Boolean; disabled
# ---------- c_script: C# ----------
    foreach(var obj in RhinoDocument.Objects){
      if(obj is Rhino.DocObjects.ClippingPlaneObject){
        doc.Objects.Delete(obj.Id, true);
      }
    }
    
    if(onOff){
      plane.Flip();
      foreach (var view in RhinoDocument.Views.GetStandardRhinoViews()){
        
        //if()
        id = RhinoDocument.Objects.AddClippingPlane(plane, 0.5, 0.5, view.ActiveViewportID);
        
      }
    }
    //id = RhinoDocument.Objects.AddClippingPlane(plane, 0.5, 0.5, RhinoDocument.Views.GetStandardRhinoViews()[0].ActiveViewportID);
# ---------- c_script: C# additional code ----------
  Guid id;
# ---------- end c_script ----------

# ----
c_script_2 = CSharpScript(plane=xy, onOff=onoff)  # -> out, A; inputs plane: Plane, onOff: Boolean
# ---------- c_script_2: C# ----------
    // Get the active Rhino document
    var doc = Rhino.RhinoDoc.ActiveDoc;

    // Iterate through all objects in the document
    foreach (var obj in doc.Objects)
    {
      // Check if the object is a clipping plane
      if (obj is Rhino.DocObjects.ClippingPlaneObject)
      {
        // Delete the clipping plane
        doc.Objects.Delete(obj.Id, true);
      }
    }

    // If onOff is true, create a new clipping plane
    if (onOff)
    {
      plane.Flip();
      foreach (var view in doc.Views)
      {
        // Add a new clipping plane to the document
        id = doc.Objects.AddClippingPlane(plane, 0.5, 0.5, view.ActiveViewportID);
      }
    }
# ---------- c_script_2: C# additional code ----------
  Guid id;
# ---------- end c_script_2 ----------
c_script_3 = CSharpScript(plane=xy, onOff=onoff)  # -> out, A; inputs plane: Plane, onOff: Boolean; disabled
# ---------- c_script_3: C# ----------
    foreach(var obj in RhinoDocument.Objects){
      if(obj is Rhino.DocObjects.ClippingPlaneObject){
        doc.Objects.Delete(obj.Id, true);
      }
    }

    if(onOff){
      plane.Flip();
      foreach(var v in RhinoDocument.Views.GetStandardRhinoViews())
        id = RhinoDocument.Objects.AddClippingPlane(plane, 0.5, 0.5, v.ActiveViewportID);
    }
# ---------- c_script_3: C# additional code ----------
  Guid id;
# ---------- end c_script_3 ----------
panel = Panel(c_script_2.A)  # disabled
panel_2 = Panel(c_script_3.A)  # disabled

# ==== cluster Cluster_4
number_slider = Slider(0.3, range=0..10)
T = ClusterInput()
relay = ClusterInput()
branch = TreeBranch(Tree=T, Path=["{2}", "{3}", "{4}", "{5}", "{6}", "{7}", "{8}"], MaintainPaths=True)
neg = Negative(Value=number_slider)
bang = ExplodeTree(Data=branch)  # -> Branch0, Branch1, Branch2, Branch3, Branch4, Branch5, Branch6
end = EndPoints(Curve=relay)  # -> Start, End
merge = Merge(Data1=neg, Data2=number_slider)
join = JoinCurves(Curves=relay, Preserve=False)
ln = Line(StartPoint=end.Start, EndPoint=end.End)
Z = UnitZ(Factor=1)
offset_l = OffsetCurveLoose(Curve=graft(relay), Distance=merge)
curvepoint = PointOnCurve(relay, parameter=0.5)
vrot = Rotate(Vector=graft(ln), Axis=Z, Angle=[1.570796327, -1.570796327])
multiplication = Multiplication(A=bang.Branch5, B=0)
multiplication_2 = Multiplication(A=bang.Branch6, B=0)
multiplication_3 = Multiplication(A=bang.Branch6, B=1)
multiplication_4 = Multiplication(A=bang.Branch5, B=1)
multiplication_5 = Multiplication(A=bang.Branch2, B=0)
multiplication_6 = Multiplication(A=bang.Branch2, B=1)
multiplication_7 = Multiplication(A=bang.Branch3, B=0)
multiplication_8 = Multiplication(A=bang.Branch3, B=1)
addition = Addition(A=graft(curvepoint), B=vrot)
boundary = BoundarySurfaces(Edges=join)
curvepoint_2 = PointOnCurve(offset_l, parameter=0.5)
c_script = CSharpScript(x=bang.Branch1, y=multiplication_7, z=multiplication_8)  # -> out, A; inputs x: Int32, y: Double, z: Double
# ---------- c_script: C# ----------
    if(x==0)
      A = y;
    else
      A = z;
# ---------- end c_script ----------
c_script_2 = CSharpScript(x=bang.Branch4, y=multiplication, z=multiplication_4)  # -> out, A; inputs x: Int32, y: Double, z: Double; same code as c_script
c_script_3 = CSharpScript(x=bang.Branch4, y=multiplication_2, z=multiplication_3)  # -> out, A; inputs x: Int32, y: Double, z: Double; same code as c_script
c_script_4 = CSharpScript(x=bang.Branch1, y=multiplication_5, z=multiplication_6)  # -> out, A; inputs x: Int32, y: Double, z: Double; same code as c_script
pull = PullPoint(Point=addition, Geometry=boundary, ClosestOnly=True)  # -> ClosestPoint, Distance
format = Format(Format="  WWR: {0}", Culture=127, Data0=graft(bang.Branch0))  # -> simplify(Text)
pull_2 = PullPoint(Point=curvepoint_2, Geometry=boundary, ClosestOnly=True)  # -> ClosestPoint, Distance
format_2 = Format(Format="  VrtF: ({0}) {1}m", Culture=127, Data0=graft(c_script_4.A), Data1=graft(c_script.A))  # -> simplify(Text)
format_3 = Format(Format="  HrzF: ({0}) {1}m", Culture=127, Data0=graft(c_script_2.A), Data1=graft(c_script_3.A))  # -> simplify(Text)
sort = SortList(Keys=pull.Distance, ValuesA=vrot)  # -> Keys, ValuesA
sort_2 = SortList(Keys=pull_2.Distance, ValuesA=offset_l)  # -> Keys, ValuesA
panel = Panel(branch)
item = ListItem(List=reverse(sort.ValuesA), Index=0, Wrap=True)
item_2 = ListItem(List=reverse(sort_2.ValuesA), Index=0, Wrap=True)  # -> simplify(Item)
join_2 = TextJoin(Text=simplify([format, format_2, format_3]))
vrot_2 = Rotate(Vector=item, Axis=Vector(0, 0, 1), Angle=-1.570796327)
curvepoint_3 = PointOnCurve(item_2, parameter=0.5)
R = ClusterOutput(join_2)
tstat = TreeStatistics(Tree=item_2)  # -> graft(Paths), Length, Count
Z_2 = UnitZ(Factor=1)
Z_3 = UnitZ(Factor=Slider(0.66, range=0..3))
dpath = DeconstructPath(Branch=tstat.Paths)
move = Move(Geometry=curvepoint_3, Motion=Z_3)  # -> Geometry, Transform
weave = Weave(Pattern=[1, 0, 1], Stream0=dpath, Stream1=["[", "]"], NullGaps=False)
pl = ConstructPlane(Origin=move.Geometry, XAxis=expr("-X", vrot_2), YAxis=Z_2)
pl_2 = ClusterOutput(pl)

# ==== cluster Cluster_5
relay = ClusterInput()
relay_2 = ClusterInput()
bbox = BoundingBox(Content=relay_2, Plane=PlaneXY(0, 0, 0), UnionBox=True)  # -> Box, Box_2
pt = ConstructPoint(XCoordinate=0, YCoordinate=0, ZCoordinate=0)
area = Area(Geometry=bbox.Box)  # -> Area, Centroid
subtraction = Subtraction(A=pt, B=area.Centroid)
move = Move(Geometry=relay_2, Motion=subtraction)  # -> Geometry, Transform
bbox_2 = BoundingBox(Content=move.Geometry, Plane=PlaneXY(0, 0, 0), UnionBox=True)  # -> Box, Box_2
debox = DeconstructBox(Box=bbox_2.Box)  # -> Plane, X, Y, Z
dedomain = DeconstructDomain(Domain=debox.X)  # -> Start, End
dedomain_2 = DeconstructDomain(Domain=debox.Y)  # -> Start, End
subtraction_2 = Subtraction(A=dedomain.End, B=dedomain.Start)
subtraction_3 = Subtraction(A=dedomain_2.End, B=dedomain_2.Start)
max = Maximum(A=subtraction_2, B=subtraction_3)
division = Division(A=relay, B=max)
scale = Scale(Geometry=move.Geometry, Center=pt, Factor=division)  # -> Geometry, Transform
bbox_3 = BoundingBox(Content=scale.Geometry, Plane=PlaneXY(0, 0, 0), UnionBox=True)  # -> Box, Box_2
debox_2 = DeconstructBox(Box=bbox_3.Box)  # -> Plane, X, Y, Z
dedomain_3 = DeconstructDomain(Domain=debox_2.X)  # -> Start, End
dedomain_4 = DeconstructDomain(Domain=debox_2.Y)  # -> Start, End
subtraction_4 = Subtraction(A=dedomain_3.End, B=dedomain_3.Start)
subtraction_5 = Subtraction(A=dedomain_4.End, B=dedomain_4.Start)
division_2 = Division(A=subtraction_4, B=2)
division_3 = Division(A=subtraction_5, B=2)
addition = Addition(A=division_3, B=Slider(100, range=0..100))
pt_2 = ConstructPoint(XCoordinate=division_2, YCoordinate=addition, ZCoordinate=0)
num = Number(addition)
G = ClusterOutput(scale.Geometry)
pt_3 = ClusterOutput(pt_2)
num_2 = ClusterOutput(num)

# ==== cluster Cluster_6
relay = ClusterInput()
planar = Planar(Curve=relay)  # -> Planar, Plane, Deviation
project = Project(Geometry=relay, Plane=planar.Plane)  # -> Geometry, Transform
bbox = BoundingBox(Content=project.Geometry, Plane=PlaneXY(0, 0, 0), UnionBox=True)  # -> Box, Box_2
debrep = DeconstructBrep(Brep=bbox.Box)  # -> Faces, Edges, Vertices
edges = BrepEdges(Brep=bbox.Box)  # -> Naked, Interior, NonManifold
avr = Average(Input=debrep.Vertices)
relay_2 = Relay([edges.Naked, edges.Interior])
scale = Scale(Geometry=flatten(relay_2), Center=avr, Factor=Slider(2.1, range=0..10))  # -> Geometry, Transform
curvepoint = PointOnCurve(scale.Geometry, parameter=0.5)
pdecon = Deconstruct(Point=curvepoint)  # -> XComponent, YComponent, ZComponent
sort = SortList(Keys=pdecon.YComponent, ValuesA=curvepoint)  # -> Keys, reverse(ValuesA)
item = ListItem(List=sort.ValuesA, Index=0, Wrap=True)
xy = XYPlane(Origin=item)
prot = RotatePlane(Plane=xy, Angle=1.570796327)
P = ClusterOutput(prot)

# ==== cluster Cluster_7
T = ClusterInput()
I = ClusterInput()
clean = CleanTree(RemoveNulls=True, RemoveInvalid=True, RemoveEmpty=False, Tree=T)
cull = CullPattern(List=clean, CullPattern=graft(I))
clean_2 = CleanTree(RemoveNulls=True, RemoveInvalid=True, RemoveEmpty=True, Tree=cull)
ma = MassAddition(Input=I)  # -> Result, PartialResults
flip = FlipMatrix(Data=clean_2)
c_script = CSharpScript(x=flip, y=ma.Result)  # -> out, A; inputs x: tree of Double, y: Double
# ---------- c_script: C# usings ----------
using System.Linq;
# ---------- c_script: C# ----------
    DataTree<System.Drawing.Color> colors = new DataTree<System.Drawing.Color>();
    for(int i = 0;i < x.BranchCount ;i++){
      if(y > 1){
        double[] Numbers = x.Branch(i).ToArray();
        double max = Numbers.Max();
        double min = Numbers.Min();
        double diff = max - min;
        for(int j = 0;j < x.Branch(i).Count ;j++){
          if(diff == 0)
          {
            colors.Add(System.Drawing.Color.Black, new GH_Path(i));
          }
          else if(x.Branch(i)[j] == min)
          {
            colors.Add(System.Drawing.Color.Red, new GH_Path(i));
          }
          else if(x.Branch(i)[j] == max)
          {
            colors.Add(System.Drawing.Color.Green, new GH_Path(i));
          }
          else
          {
            colors.Add(System.Drawing.Color.Black, new GH_Path(i));
          }
        }
      }
      else{
        colors.Add(System.Drawing.Color.Black, new GH_Path(i));
      }
    }
    A = colors;
# ---------- end c_script ----------
flip_2 = FlipMatrix(Data=c_script.A)
D = ClusterOutput(flip_2)
panel = Panel(flip_2)

# ==== cluster Cluster_8
relay = ClusterInput()
relay_2 = ClusterInput()
bbox = BoundingBox(Content=relay, Plane=PlaneXY(0, 0, 0), UnionBox=True)  # -> Box, Box_2
bbox_2 = BoundingBox(Content=relay, Plane=PlaneXY(0, 0, 0), UnionBox=True)  # -> Box, Box_2
area = Area(Geometry=bbox_2.Box)  # -> Area, Centroid
debox = DeconstructBox(Box=bbox.Box)  # -> Plane, X, Y, Z
neg = Negative(Value=area.Centroid)
dedomain = DeconstructDomain(Domain=debox.X)  # -> Start, End
dedomain_2 = DeconstructDomain(Domain=debox.Y)  # -> Start, End
subtraction = Subtraction(A=dedomain.End, B=dedomain.Start)
subtraction_2 = Subtraction(A=dedomain_2.End, B=dedomain_2.Start)
move = Move(Geometry=relay, Motion=neg)  # -> Geometry, Transform
max = Maximum(A=subtraction, B=subtraction_2)
rectangle = Rectangle(Plane=PlaneXY(0, 0, 0), XSize=Domain(-20, 20), YSize=Domain(-20, 20), Radius=0)  # -> Rectangle, Length
division = Division(A=1, B=max)
mplane = MeshPlane(Boundary=rectangle.Rectangle, WidthCount=10, HeightCount=10)  # -> Mesh, Area
scale = Scale(Geometry=move.Geometry, Center=Point(0, 0, 0), Factor=division)  # -> Geometry, Transform
mcol = MeshColours(Mesh=mplane.Mesh, Colours=ColourSwatch(SwatchColor=RGB(255, 255, 255)))
subtraction_3 = Subtraction(A=relay_2, B="{0,0,1}")
mesh = Mesh(mcol)
avr = Average(Input=subtraction_3)
move_2 = Move(Geometry=mesh, Motion=avr)  # -> Geometry, Transform
move_3 = Move(Geometry=scale.Geometry, Motion=relay_2)  # -> Geometry, Transform
data = Data(flatten([move_3.Geometry, move_2.Geometry]))
bbox_3 = BoundingBox(Content=move_3.Geometry, Plane=PlaneXY(0, 0, 0))  # -> Box, Box_2
bbxmaps = ClusterOutput(bbox_3.Box)  # bbxMaps
maps = ClusterOutput(data)  # Maps

# ==== cluster Cluster_9
relay = ClusterInput()
tstat = TreeStatistics(Tree=relay)  # -> Paths, Length, Count
item = ListItem(List=tstat.Paths, Index=0, Wrap=True)
dpath = DeconstructPath(Branch=item)
lng = ListLength(List=dpath)
larger = LargerThan(FirstNumber=lng, SecondNumber=1)  # -> LargerThan, OrEqualTo
pshift = ShiftPaths(Data=relay, Offset=1)
filter = StreamFilter(Gate=larger.LargerThan, Stream0=relay, Stream1=pshift)
s_1 = ClusterOutput(filter)

# ==== cluster Cluster_10
relay = ClusterInput()
edges = BrepEdges(Brep=relay)  # -> Naked, Interior, NonManifold
number_slider = Slider(20, range=0..100)
join = JoinCurves(Curves=edges.Naked, Preserve=False)
ext = ExtendCurve(Curve=edges.Naked, Type=0, Start=number_slider, End=number_slider)
reb = RebuildCurve(Curve=ext, Degree=3, Count=10, Tangents=False)
pipe = Pipe(Curve=reb, Radius="5", Caps=1)  # -> flatten(Pipe)
splitmul = SplitBrepMultiple(Brep=relay, Cutters=pipe)
popgeo = PopulateGeometry(Geometry=splitmul, Count=1, Seed=1)  # -> flatten(Population)
pull = PullPoint(Point=popgeo, Geometry=join, ClosestOnly=True)  # -> ClosestPoint, Distance
larger = LargerThan(FirstNumber=pull.Distance, SecondNumber=5)  # -> LargerThan, OrEqualTo
cull = CullPattern(List=splitmul, CullPattern=invert(larger.LargerThan))
area = Area(Geometry=relay)  # -> Area, Centroid
area_2 = Area(Geometry=cull)  # -> Area, Centroid
ma = MassAddition(Input=area_2.Area)  # -> Result, PartialResults
subtraction = Subtraction(A=area.Area, B=ma.Result)
srf = Surface(cull)
srf_2 = ClusterOutput(srf)
R = ClusterOutput(subtraction)
R_2 = ClusterOutput(ma.Result)

# ==== cluster Cluster_11
relay = ClusterInput()
disc = Discontinuity(Curve=relay, Level=1)  # -> Points, Parameters
shatter = Shatter(Curve=relay, Parameters=disc.Parameters)
len = Length(Curve=shatter)
division = Division(A=len, B=1)
round = Round(Number=division)  # -> Nearest, Floor, Ceiling
reb = RebuildCurve(Curve=shatter, Degree=3, Count=round.Ceiling, Tangents=False)
join = JoinCurves(Curves=reb, Preserve=False)
C = ClusterOutput(join)

# ==== cluster Cluster_12
C = ClusterInput()
crv = ClusterInput()
B = ClusterInput()
relay = ClusterInput()
crv_2 = Curve(crv)
end = EndPoints(Curve=crv_2)  # -> Start, End
ln = Line(StartPoint=end.Start, EndPoint=end.End)
Z = UnitZ(Factor=1)
len = Length(Curve=crv_2)
amp = Amplitude(Vector=ln, Amplitude=1)
vrot = Rotate(Vector=graft(amp), Axis=Z, Angle=[1.570796327, -1.570796327])
curvepoint = PointOnCurve(crv_2, parameter=0.5)
join = JoinCurves(Curves=crv_2, Preserve=False)

# ---- group: Wall Areas
multiplication = Multiplication(A=len, B=B)

# ----
boundary = BoundarySurfaces(Edges=join)
addition = Addition(A=graft(curvepoint), B=vrot)
pull = PullPoint(Point=addition, Geometry=boundary, ClosestOnly=True)  # -> ClosestPoint, Distance
sort = SortList(Keys=pull.Distance, ValuesA=vrot)  # -> Keys, ValuesA
item = ListItem(List=reverse(sort.ValuesA), Index=0, Wrap=True)
Y = UnitY(Factor=-1)
pl = ConstructPlane(Origin=Point(0, 0, 0), XAxis=Vector(-1, 0, 0), YAxis=Vector(0, 1, 0))
angle = Angle(VectorA=item, VectorB=Y, Plane=pl)  # -> Angle, Reflex
pi = Pi(Factor=1)
B_2 = B(8)
division = Division(A=pi, B=B_2)
series = Series(Start=0, Step=division, Count=expr("(x*2)+1", B_2))
multiplication_2 = Multiplication(A=multiplication, B=C)
consec = ConsecutiveDomains(Numbers=series, Additive=False)
shift = ShiftList(List=consec, Shift=-1, Wrap=True)
multiplication_3 = Multiplication(A=multiplication_2, B=relay)
crv_3 = Curve(crv_2)
fdom = FindDomain(Domains=shift, Number=flatten(angle.Angle), Strict=False)  # -> Index, Neighbour
c_script = CSharpScript(x=multiplication_3, y=multiplication_3)  # -> out, A; inputs x: Double
# ---------- c_script: C# ----------
    if(x < 0)
      A = "";
    else
      A = y;
# ---------- end c_script ----------
subtraction = Subtraction(A=multiplication_2, B=multiplication_3)
division_2 = Division(A=fdom.Index, B=2)
c_script_2 = CSharpScript(x=multiplication_3, y=subtraction)  # -> out, A; inputs x: Double; same code as c_script
round = Round(Number=division_2)  # -> Nearest, Floor, Ceiling
panel = Panel("""S
SE
E
NE
N
NW
W
SW""")
panel_2 = Panel(subtraction)
num = Number(c_script.A)
num_2 = Number(c_script_2.A)
c_script_3 = CSharpScript(x=round.Floor, z=num_2, u=num, y=panel)  # -> out, Wall, Win; inputs x: list of Int32, z: list of Double, u: list of Double, y: list of String
# ---------- c_script_3: C# ----------
    if(x.Count != z.Count)return;
    List<string> strList1 = new List <string>();
    List<string> strList2 = new List <string>();

    for(int i = 0 ;i < y.Count;i++){
      double win = 0;
      double wall = 0;
      for(int j = 0 ;j < x.Count;j++){
        if(x[j] == i){
          if(u[j] >= 0){
            wall += z[j];
            win += u[j];
          }
        }
      }
      double n1;
      double n2;
      if(wall != 0){
        n1 = Math.Round(wall, 2);
      }
      else{
        n1 = 0;
      }
      if(win != 0){
        n2 = Math.Round(win, 2);
      }
      else{
        n2 = 0;
      }
      if(n1!=0)
        strList1.Add(n1.ToString());
      else
        strList1.Add("");

      if(n2 != 0)
        strList2.Add(n2.ToString());
      else
        strList2.Add("");

    }
    Wall = strList1;
    Win = strList2;
# ---------- end c_script_3 ----------
panel_3 = Panel(num_2)
win = Text(simplify(graft(c_script_3.Win)))
wall = Text(simplify(graft(c_script_3.Wall)))
panel_4 = Panel(num)
c_script_4 = CSharpScript(x=multiplication_3)  # -> out, A; inputs x: Double
# ---------- c_script_4: C# ----------
if(x<0)
      A = "";
    else
      A = x;
# ---------- end c_script_4 ----------
panel_5 = Panel(c_script_4.A)
wall_2 = ClusterOutput(wall)
win_2 = ClusterOutput(win)
panel_6 = Panel(wall)

# ==== cluster Cluster_14
data = ClusterInput()
panel = Panel("""CurveLng
VerticalSpacing
HorizontalSpacing
VerticalDepth
HorizontalDepth""")
data_2 = Data(data)
crv = ClusterInput()
item = ListItem(List=data_2, Index=0, Wrap=False)  # -> flatten(Item), flatten(Item1), flatten(Item2), flatten(Item3), flatten(Item4)
crv_2 = Curve(crv)
end = EndPoints(Curve=crv_2)  # -> Start, End
division = Division(A=item.Item1, B=2)  # -> flatten(Result)
division_2 = Division(A=item.Item2, B=2)  # -> flatten(Result)
ln = Line(StartPoint=end.Start, EndPoint=end.End)
Z = UnitZ(Factor=1)
division_3 = Division(A=item.Item3, B=division)
amp = Amplitude(Vector=ln, Amplitude=1)
division_4 = Division(A=item.Item4, B=division_2)
vrot = Rotate(Vector=graft(amp), Axis=Z, Angle=[1.570796327, -1.570796327])
curvepoint = PointOnCurve(crv_2, parameter=0.5)
join = JoinCurves(Curves=crv_2, Preserve=False)
atan = ArcTangent(Value=division_3)
atan_2 = ArcTangent(Value=division_4)
deg = Degrees(Radians=atan_2)
deg_2 = Degrees(Radians=atan)
boundary = BoundarySurfaces(Edges=join)
addition = Addition(A=graft(curvepoint), B=vrot)
pull = PullPoint(Point=addition, Geometry=boundary, ClosestOnly=True)  # -> ClosestPoint, Distance
sort = SortList(Keys=pull.Distance, ValuesA=vrot)  # -> Keys, ValuesA
panel_2 = Panel(deg_2)
pi = Pi(Factor=1)
B = B(8)
item_2 = ListItem(List=reverse(sort.ValuesA), Index=0, Wrap=True)
division_5 = Division(A=pi, B=B)
series = Series(Start=0, Step=division_5, Count=expr("(x*2)+1", B))
Y = UnitY(Factor=-1)
pl = ConstructPlane(Origin=Point(0, 0, 0), XAxis=Vector(-1, 0, 0), YAxis=Vector(0, 1, 0))
panel_5 = Panel(deg)
consec = ConsecutiveDomains(Numbers=series, Additive=False)
angle = Angle(VectorA=item_2, VectorB=Y, Plane=pl)  # -> Angle, Reflex
shift = ShiftList(List=consec, Shift=-1, Wrap=True)
fdom = FindDomain(Domains=shift, Number=flatten(angle.Angle), Strict=False)  # -> Index, Neighbour
division_6 = Division(A=fdom.Index, B=2)
round = Round(Number=division_6)  # -> Nearest, Floor, Ceiling
panel_7 = Panel(item.Item)
panel_9 = Panel(round.Floor)
panel_11 = Panel("""S
SE
E
NE
N
NW
W
SW""")
c_script = CSharpScript(x=round.Floor, z=deg, u=deg_2, v=item.Item, y=panel_11)  # -> out, A, alpha, beta; inputs x: list of Int32, z: list of Double, u: list of Double, v: list of Double, y: list of String
# ---------- c_script: C# ----------
    if(x.Count != z.Count)return;
    List<string> strList1 = new List <string>();
    List<string> strList2 = new List <string>();
    List<string> strList3 = new List <string>();

    for(int i = 0 ;i < y.Count;i++){
      double Alpha = 0;
      double Beta = 0;
      double SideLengthA = 0;
      double SideLengthB = 0;
      for(int j = 0 ;j < x.Count;j++){
        if(x[j] == i){
          if(z[j] > 0){
            Alpha += z[j] * v[j];
            SideLengthA += v[j];
          }
          if(u[j] > 0){
            Beta += u[j] * v[j];
            SideLengthB += v[j];
          }
        }
      }


      double a = (Alpha * 1.0 / SideLengthA * 1.0);
      double b = (Beta * 1.0 / SideLengthB * 1.0);
      if(a.ToString()!="NaN")
        strList1.Add(a.ToString());
      else
        strList1.Add("");
      if(b.ToString() != "NaN")
        strList2.Add(b.ToString());
      else
        strList2.Add("");
      

    }
    alpha = strList1;
    beta = strList2;
# ---------- end c_script ----------
cluster = Cluster_13(relay=c_script.alpha)
cluster_2 = Cluster_13(relay=c_script.beta)
panel_12 = Panel(c_script.alpha)
beta = ClusterOutput(cluster_2)
alpha = ClusterOutput(cluster)
panel_13 = Panel(cluster_2)

# ==== cluster Cluster_16
mesh = ClusterInput()
relay = ClusterInput()
relay_2 = ClusterInput()
relay_3 = ClusterInput()
B = ClusterInput()
mesh_2 = Mesh(mesh)
number_of_levels = Slider(3, range=0..10)
disjoint = DisjointMesh(Mesh=mesh_2)
branch = TreeBranch(Tree=relay_3, Path=["{13}", "{14}"], MaintainPaths=True)
bang = ExplodeTree(Data=branch)  # -> Branch0, Branch1
facen = FaceNormals(Mesh=relay_2)  # -> flatten(Centers), Normals
avr = Average(Input=facen.Centers)
div = DivideDomain(Domain=Domain(0, 1), Count=number_of_levels)
dedomain = DeconstructDomain(Domain=div)  # -> simplify(graft(Start)), simplify(graft(End))
pdecon = Deconstruct(Point=avr)  # -> XComponent, YComponent, ZComponent
division = Division(A=bang.Branch0, B=2)
subtraction = Subtraction(A=pdecon.ZComponent, B=division)
avr_2 = Average(Input=[dedomain.Start, dedomain.End])  # -> flatten(ArithmeticMean)
subtraction_2 = Subtraction(A=subtraction, B=B)
multiplication = Multiplication(A=bang.Branch0, B=bang.Branch1)
pt = ConstructPoint(XCoordinate=pdecon.XComponent, YCoordinate=pdecon.YComponent, ZCoordinate=subtraction_2)
panel = Panel(avr_2)
facen_2 = FaceNormals(Mesh=relay_2)  # -> Centers, Normals
multiplication_2 = Multiplication(A=multiplication, B=panel)
merge = Merge(Data1=flatten(multiplication_2), Data2=flatten(pdecon.ZComponent))
volume = Volume(Geometry=disjoint)  # -> Volume, Centroid
neg = Negative(Value=facen_2.Normals)
xy = XYPlane(Origin=volume.Centroid)
range = Range(Domain=Domain(0, 3.141592654), Steps=Slider(20, range=0..100))
merge_2 = Merge(Data1=neg, Data2=facen_2.Normals)
rotate = Rotate(Geometry=graft(xy), Angle=range, Plane=graft(volume.Centroid))  # -> Geometry, Transform
bbox = BoundingBox(Content=graft(disjoint), Plane=rotate.Geometry)  # -> Box, Box_2
multiplication_3 = Multiplication(A=merge_2, B=0.05)
number_slider = Slider(7, range=1..31)
tstat = TreeStatistics(Tree=simplify(bbox.Box))  # -> Paths, Length, Count
addition = Addition(A=facen_2.Centers, B=multiplication_3)
item = ListItem(List=tstat.Paths, Index=0, Wrap=True)
division_2 = Division(A=multiplication, B=2)
pi = Pi(Factor=Slider(0.25, range=0..1))
pdecon_2 = Deconstruct(Point=facen_2.Centers)  # -> XComponent, YComponent, ZComponent
dpath = DeconstructPath(Branch=item)
pull = PullPoint(Point=addition, Geometry=relay, ClosestOnly=True)  # -> ClosestPoint, Distance
neg_2 = Negative(Value=pi)
addition_2 = Addition(A=subtraction_2, B=merge)
lng = ListLength(List=dpath)
dom = ConstructDomain(DomainStart=neg_2, DomainEnd=pi)
sort = SortList(Keys=pull.Distance, ValuesA=multiplication_3)  # -> Keys, reverse(ValuesA)
pshift = ShiftPaths(Data=simplify(bbox.Box), Offset=-1)
larger = LargerThan(FirstNumber=lng, SecondNumber=1)  # -> LargerThan, OrEqualTo
range_2 = Range(Domain=dom, Steps=expr("x-1", number_slider))
pt_2 = ConstructPoint(XCoordinate=pdecon_2.XComponent, YCoordinate=pdecon_2.YComponent, ZCoordinate=addition_2)
item_2 = ListItem(List=sort.ValuesA, Index=0, Wrap=True)
lng_2 = ListLength(List=merge)
filter = StreamFilter(Gate=larger.LargerThan, Stream0=flatten(bbox.Box), Stream1=pshift)
Z = UnitZ(Factor=1)
dup = DuplicateData(Data=item_2, Number=lng_2, Order=True)  # -> simplify(graft(Data))
project = Project(Geometry=relay, Plane=pt)  # -> Geometry, Transform
volume_2 = Volume(Geometry=filter)  # -> Volume, Centroid
sort_2 = SortList(Keys=volume_2.Volume, ValuesA=filter)  # -> Keys, ValuesA
addition_3 = Addition(A=pt_2, B=item_2)
vrot = Rotate(Vector=dup, Axis=Z, Angle=range_2)
item_3 = ListItem(List=sort_2.ValuesA, Index=0, Wrap=True)  # -> flatten(Item)
Z_2 = UnitZ(Factor=multiplication)
line = LineSDL(Start=graft(addition_3), Direction=vrot, Length=100)
crv = ClusterInput()
extr = Extrude(Base=project.Geometry, Direction=Z_2)
end = EndPoints(Curve=line)  # -> graft(Start), End
bcx = BrepCurve(Brep=extr, Curve=graft(line))  # -> Curves, simplify(Points)
bcx_2 = BrepCurve(Brep=flatten(item_3), Curve=graft(line))  # -> Curves, Points
dist = Distance(PointA=end.Start, PointB=bcx.Points)
pull_2 = PullPoint(Point=bcx_2.Points, Geometry=flatten(addition_3), ClosestOnly=True)  # -> ClosestPoint, Distance
sort_3 = SortList(Keys=dist, ValuesA=bcx.Points)  # -> Keys, ValuesA
dup_2 = DuplicateData(Data=graft(pt_2), Number=simplify(flatten(number_slider)), Order=True)  # -> simplify(graft(Data))
crv_2 = Curve(crv)
item_4 = ListItem(List=sort_3.ValuesA, Index=0, Wrap=True)
sort_4 = SortList(Keys=pull_2.Distance, ValuesA=bcx_2.Points)  # -> Keys, ValuesA
end_2 = EndPoints(Curve=crv_2)  # -> Start, End
item_5 = ListItem(List=sort_4.ValuesA, Index=0, Wrap=False)
tstat_2 = TreeStatistics(Tree=simplify(sort_4.ValuesA))  # -> Paths, Length, Count
dist_2 = Distance(PointA=dup_2, PointB=item_4)
ln = Line(StartPoint=end_2.Start, EndPoint=end_2.End)
item_6 = ListItem(List=tstat_2.Paths, Index=0, Wrap=True)
clean = CleanTree(RemoveNulls=True, RemoveInvalid=True, RemoveEmpty=False, Tree=item_5)
panel_2 = Panel(item_4)
c_script = CSharpScript(x=bang.Branch0, y=bang.Branch1, u=dist_2)  # -> out, A; inputs x: Double, y: Double, u: String
# ---------- c_script: C# ----------
    if(!String.IsNullOrEmpty(u))
      A = ((x * y) / 2) / Convert.ToDouble(u);
    else
     A = null;
# ---------- end c_script ----------
dpath_2 = DeconstructPath(Branch=item_6)
lng_3 = ListLength(List=dpath_2)
lng_4 = ListLength(List=clean)
atan = ArcTangent(Value=c_script.A)
larger_2 = LargerThan(FirstNumber=lng_3, SecondNumber=1)  # -> LargerThan, OrEqualTo
lng_5 = ListLength(List=item_3)
pshift_2 = ShiftPaths(Data=lng_4, Offset=-1)
filter_2 = StreamFilter(Gate=larger_2.LargerThan, Stream0=lng_4, Stream1=pshift_2)
series = Series(Start=0, Step=1, Count=lng_5)
cull = CullPattern(List=flatten(series), CullPattern=filter_2)
Z_3 = UnitZ(Factor=1)
amp = Amplitude(Vector=ln, Amplitude=1)
replace = ReplaceItems(List=item_2, Item=addition_2, Indices=0, Wrap=False)  # -> simplify(graft(List))
item_7 = ListItem(List=cull, Index=0, Wrap=True)
vrot_2 = Rotate(Vector=graft(amp), Axis=Z_3, Angle=[1.570796327, -1.570796327])
curvepoint = PointOnCurve(crv_2, parameter=0.5)
join = JoinCurves(Curves=crv_2, Preserve=False)
item_8 = ListItem(List=item_3, Index=item_7, Wrap=True)
pt_3 = Point(addition_3)
debrep = DeconstructBrep(Brep=item_8)  # -> Faces, Edges, Vertices
dup_3 = DuplicateData(Data=replace, Number=number_slider, Order=True)  # -> simplify(graft(Data))
pshift_3 = ShiftPaths(Data=clean, Offset=-1)
dup_4 = DuplicateData(Data=graft(pt_3), Number=number_slider, Order=True)  # -> simplify(graft(Data))
pdecon_3 = Deconstruct(Point=debrep.Vertices)  # -> XComponent, YComponent, ZComponent
panel_3 = Panel(replace)
sort_5 = SortList(Keys=pdecon_3.ZComponent, ValuesA=debrep.Vertices)  # -> reverse(Keys), reverse(ValuesA)
boundary = BoundarySurfaces(Edges=join)
item_9 = ListItem(List=sort_5.Keys, Index=0, Wrap=True)  # -> simplify(Item)
addition_4 = Addition(A=graft(curvepoint), B=vrot_2)
dist_3 = Distance(PointA=dup_4, PointB=pshift_3)
c_script_2 = CSharpScript(x=item_9, y=dup_3)  # -> out, A; inputs x: String, y: String
# ---------- c_script_2: C# ----------
    if(String.IsNullOrEmpty(x))
      A = null;
    else
      A = Convert.ToDouble( x) - Convert.ToDouble(y);
# ---------- end c_script_2 ----------
pull_3 = PullPoint(Point=addition_4, Geometry=boundary, ClosestOnly=True)  # -> ClosestPoint, Distance
sort_6 = SortList(Keys=pull_3.Distance, ValuesA=vrot_2)  # -> Keys, ValuesA
pi_2 = Pi(Factor=1)
B_2 = B(8)
division_3 = Division(A=c_script_2.A, B=dist_3)
item_10 = ListItem(List=reverse(sort_6.ValuesA), Index=0, Wrap=True)
division_4 = Division(A=pi_2, B=B_2)
panel_4 = Panel(atan)
series_2 = Series(Start=0, Step=division_4, Count=expr("(x*2)+1", B_2))
Y = UnitY(Factor=-1)
pl = ConstructPlane(Origin=Point(0, 0, 0), XAxis=Vector(-1, 0, 0), YAxis=Vector(0, 1, 0))
panel_5 = Panel(division_3)
consec = ConsecutiveDomains(Numbers=series_2, Additive=False)
angle = Angle(VectorA=item_10, VectorB=Y, Plane=pl)  # -> Angle, Reflex
num = Number(simplify(graft(atan)))
ln_2 = Line(StartPoint=dup_4, EndPoint=pshift_3)
null = NullItem(Item=atan)  # -> simplify(graft(NullFlags)), InvalidFlags, Description
ln_3 = Line(StartPoint=dup_4, EndPoint=item_4)
atan_2 = ArcTangent(Value=division_3)  # -> simplify(Result)
shift = ShiftList(List=consec, Shift=-1, Wrap=True)
fdom = FindDomain(Domains=shift, Number=flatten(angle.Angle), Strict=False)  # -> Index, Neighbour
cull_2 = CullPattern(List=ln_3, CullPattern=invert(null.NullFlags))  # -> simplify(List)
cull_3 = CullPattern(List=num, CullPattern=invert(null.NullFlags))  # -> simplify(List)
cull_4 = CullPattern(List=ln_2, CullPattern=null.NullFlags)  # -> simplify(List)
cull_5 = CullPattern(List=atan_2, CullPattern=null.NullFlags)  # -> simplify(List)
division_5 = Division(A=fdom.Index, B=2)
merge_3 = Merge(Data1=cull_3, Data2=cull_5)
round = Round(Number=division_5)  # -> Nearest, Floor, Ceiling
panel_6 = Panel(atan_2)
pshift_4 = ShiftPaths(Data=merge_3, Offset=-1)
ma = MassAddition(Input=pshift_4)  # -> Result, PartialResults
crv_3 = Curve([cull_4, cull_2])
division_6 = Division(A=ma.Result, B=number_slider)
pshift_5 = ShiftPaths(Data=division_6, Offset=-1)
cull_i = CullIndex(List=pshift_5, Indices=expr("x-1", lng_2), Wrap=True)  # -> simplify(List)
item_11 = ListItem(List=pshift_5, Index=expr("x-1", lng_2), Wrap=True)
rad = Radians(Degrees=Slider(70, range=0..200))
subtraction_3 = Subtraction(A=lng_2, B=1)
B_3 = DomainEnd(rad)
A = DomainStart(Slider(0, range=0..1))
ma_2 = MassAddition(Input=cull_i)  # -> Result, PartialResults
dom_2 = ConstructDomain(DomainStart=B_3, DomainEnd=A)
panel_7 = Panel(ma_2.Result)
division_7 = Division(A=ma_2.Result, B=subtraction_3)
remap = RemapNumbers(Value=item_11, Source=dom_2, Target=Domain(0, 1))  # -> Mapped, Clipped
pshift_6 = ShiftPaths(Data=division_7, Offset=-1)
# High Exposure / Low Exposure
gradient = Gradient(
    LowerLimit=B_3,
    UpperLimit=A,
    Parameter=remap.Mapped,
    stops=[0: RGB(255, 255, 0), 0.471: RGB(255, 255, 0), 1: RGB(65, 105, 225)])
clean_2 = CleanTree(RemoveNulls=True, RemoveInvalid=True, RemoveEmpty=False, Tree=pshift_6)
lng_6 = ListLength(List=relay_2)
ma_3 = MassAddition(Input=clean_2)  # -> Result, PartialResults
division_8 = Division(A=ma_3.Result, B=lng_6)  # -> flatten(Result)
number_slider_2 = Slider(0.95, range=0..1)
ahsl = SplitAHSL(Colour=gradient)  # -> Alpha, Hue, Saturation, Luminance
col = Colour(simplify(graft(gradient)))
mesh_3 = Mesh(graft(relay_2))
len = Length(Curve=crv_2)
hsl = ColourHSL(Alpha=number_slider_2, Hue=ahsl.Hue, Saturation=ahsl.Saturation, Luminance=ahsl.Luminance)
panel_8 = Panel(division_8)
demesh = DeconstructMesh(Mesh=mesh_3)  # -> Vertices, Faces, Colours, Normals
demesh_2 = DeconstructMesh(Mesh=mesh_3)  # -> Vertices, Faces, Colours, Normals
hsl_2 = ColourHSL(Alpha=number_slider_2, Hue=Slider(0, range=0..1), Saturation=Slider(1, range=0..1), Luminance=Slider(0.38, range=0..1))
deg = Degrees(Radians=division_8)  # -> flatten(Degrees)
panel_9 = Panel(hsl)
null_2 = NullItem(Item=col)  # -> simplify(graft(NullFlags)), InvalidFlags, Description
conmesh = ConstructMesh(Vertices=demesh.Vertices, Faces=demesh.Faces, Colours=hsl)  # -> simplify(Mesh)
conmesh_2 = ConstructMesh(Vertices=demesh_2.Vertices, Faces=demesh_2.Faces, Colours=hsl_2)  # -> simplify(Mesh)
cull_6 = CullPattern(List=conmesh, CullPattern=invert(null_2.NullFlags))
panel_10 = Panel(deg)
c_script_3 = CSharpScript(x=round.Floor, z=deg, v=len)  # -> out, HorizonAngles, A; inputs x: list of Int32, z: list of Double, v: list of Double
# ---------- c_script_3: C# ----------
    if(x.Count != z.Count)return;
    List<string> strList1 = new List <string>();


    for(int i = 0 ;i < 8;i++){
      double Hrzn = 0;
      double SideLength = 0;
      for(int j = 0 ;j < x.Count;j++){
        if(x[j] == i){
          if(z[j] > 0){
            Hrzn += z[j] * v[j];
            SideLength += v[j];
          }
        }
      }


      double a = (Hrzn * 1.0 / SideLength * 1.0);

      if(a.ToString()!="NaN")
        strList1.Add(a.ToString());
      else
        strList1.Add("");


    }
    HorizonAngles = strList1;
# ---------- end c_script_3 ----------
cull_7 = CullPattern(List=conmesh_2, CullPattern=null_2.NullFlags)
crv_4 = Curve(crv_3)
merge_4 = Merge(Data1=simplify(cull_6), Data2=simplify(cull_7))
cluster = Cluster_15(relay=c_script_3.HorizonAngles)
panel_11 = Panel("""S
SE
E
NE
N
NW
W
SW""")
R = ClusterOutput(merge_4)
panel_12 = Panel(cluster)
panel_13 = Panel(null_2.NullFlags)
horizonangles = ClusterOutput(cluster)

# ==== cluster Cluster_17
B = ClusterInput()
debrep = DeconstructBrep(Brep=B)  # -> Faces, Edges, Vertices
popgeo = PopulateGeometry(Geometry=debrep.Faces, Count=1, Seed=1)  # -> flatten(Population)
pdecon = Deconstruct(Point=popgeo)  # -> XComponent, YComponent, ZComponent
sort = SortList(Keys=pdecon.ZComponent, ValuesA=debrep.Faces)  # -> Keys, ValuesA
item = ListItem(List=sort.ValuesA, Index=0, Wrap=True)
pcen = PolygonCenter(Polyline=item)  # -> CenterV, CenterE, CenterA
pdecon_2 = Deconstruct(Point=pcen.CenterV)  # -> XComponent, YComponent, expr("-(x+1)", ZComponent)
pdecon_3 = Deconstruct(Point=pcen.CenterV)  # -> XComponent, YComponent, ZComponent
scale = Scale(Geometry=item, Center=pcen.CenterV, Factor=10)  # -> Geometry, Transform
neg = Negative(Value=Slider(1, range=0..1))
Z = UnitZ(Factor=neg)
subtraction = Subtraction(A=pdecon_3.ZComponent, B=1)
move = Move(Geometry=scale.Geometry, Motion=Z)  # -> Geometry, Transform
smesh = SimpleMesh(Brep=move.Geometry)
mcol = MeshColours(Mesh=smesh, Colours=ColourSwatch(SwatchColor=RGB(255, 255, 255)))
G = ClusterInput()
filter = StreamFilter(Gate=G, Stream1=mcol)
M = ClusterOutput(mcol)

# ==== cluster Cluster_18
relay = ClusterInput()
relay_2 = ClusterInput()
item = ListItem(List=relay_2, Index=0, Wrap=True)
item_2 = ListItem(List=relay, Index=0, Wrap=True)
max = Maximum(A=item, B=item_2)
item_3 = ListItem(List=reverse(relay_2), Index=0, Wrap=True)
item_4 = ListItem(List=reverse(relay), Index=0, Wrap=True)
max_2 = Maximum(A=item_3, B=item_4)
addition = Addition(A=max, B=max_2)
R = ClusterOutput(addition)

# ==== cluster Cluster_13
relay = ClusterInput()
panel = Panel("""0
30
45
60""")
c_script = CSharpScript(x=simplify(graft(relay)), y=simplify(panel))  # -> out, A
# ---------- c_script: C# ----------
    if(x == null)
      A = null;
    else
      A = Math.Abs(Convert.ToDouble(x) - Convert.ToDouble(y));
# ---------- end c_script ----------
sort = SortList(Keys=c_script.A, ValuesA=panel)  # -> Keys, ValuesA
item = ListItem(List=sort.ValuesA, Index=0, Wrap=True)  # -> flatten(Item)
c_script_2 = CSharpScript(x=relay, y=item)  # -> out, A; inputs x: String
# ---------- c_script_2: C# ----------
    if(String.IsNullOrEmpty(x))
      A = String.Empty;
    else
      A = y;
# ---------- end c_script_2 ----------
A = ClusterOutput(c_script_2.A)

# ==== cluster Cluster_15
relay = ClusterInput()
series = Series(Start=0, Step=10, Count=9)
c_script = CSharpScript(x=simplify(graft(relay)), y=simplify(series))  # -> out, A; same code as c_script
sort = SortList(Keys=c_script.A, ValuesA=series)  # -> Keys, ValuesA
item = ListItem(List=sort.ValuesA, Index=0, Wrap=True)  # -> flatten(Item)
c_script_2 = CSharpScript(x=relay, y=item)  # -> out, A; inputs x: String; same code as c_script_2
A = ClusterOutput(c_script_2.A)
