# Grasshopper definition basic_room_meshes_2.gh (Grasshopper 1.0.7)
# plug-ins: ShapeDiverForGrasshopper

fin_depth_side_1 = Slider(1, range=0..1)
width = Slider(10, range=3..20)
depth = Slider(10, range=3..20)
window_u_side_1 = Slider(0, range=-1..1)
window_width_norm_side_1 = Slider(0.99, range=0.01..0.99)
window_u_side_2 = Slider(0, range=-1..1)
window_width_norm_side_2 = Slider(0.99, range=0.01..0.99)
fin_depth_side_2 = Slider(0, range=0..1)
window_u_side_3 = Slider(0, range=-1..1)
window_v_side_3 = Slider(0, range=-1..1)
fin_depth_side_3 = Slider(0, range=0..1)
n_fins_multiplier_side_3 = Slider(0.21, range=0..1)
window_u_side_4 = Slider(0, range=-1..1)
window_width_norm_side_4 = Slider(0.99, range=0.01..0.99)
fin_depth_side_4 = Slider(0.63, range=0..1)
degrees = Slider(360, range=0..360)
height = Slider(4, range=2.4..5)
window_v_side_1 = Slider(0, range=-1..1)
window_height_norm_side_1 = Slider(0.99, range=0.01..0.99)
n_fins_multiplier_side_1 = Slider(0.21, range=0..1)
window_v_side_2 = Slider(0, range=-1..1)
window_height_norm_side_2 = Slider(0.99, range=0.01..0.99)
n_fins_multiplier_side_2 = Slider(0.21, range=0..1)
window_height_norm_side_3 = Slider(0.99, range=0.01..0.99)
window_width_norm_side_3 = Slider(0.99, range=0.01..0.99)
window_v_side_4 = Slider(0, range=-1..1)
window_height_norm_side_4 = Slider(0.99, range=0.01..0.99)
n_fins_multiplier_side_4 = Slider(0.13, range=0..1)
rad = Radians(Degrees=degrees)
window_height_norm = Data(window_height_norm_side_4)
window_height_norm_2 = Data(window_height_norm_side_1)
window_height_norm_3 = Data(window_height_norm_side_2)
window_height_norm_4 = Data(window_height_norm_side_3)
window_width_norm = Data(window_width_norm_side_1)
n_fins_multiplier = Data(n_fins_multiplier_side_1)
window_width_norm_2 = Data(window_width_norm_side_2)
n_fins_multiplier_2 = Data(n_fins_multiplier_side_2)
window_width_norm_3 = Data(window_width_norm_side_3)
n_fins_multiplier_3 = Data(n_fins_multiplier_side_3)
window_width_norm_4 = Data(window_width_norm_side_4)
n_fins_multiplier_4 = Data(n_fins_multiplier_side_4)
window_u = Data(window_u_side_1)
window_u_2 = Data(window_u_side_2)
window_u_3 = Data(window_u_side_3)
window_u_4 = Data(window_u_side_4)
window_v = Data(window_v_side_1)
window_v_2 = Data(window_v_side_2)
window_v_3 = Data(window_v_side_3)
window_v_4 = Data(window_v_side_4)
fin_depth = Data(fin_depth_side_2)
fin_depth_2 = Data(fin_depth_side_1)
fin_depth_3 = Data(fin_depth_side_3)
fin_depth_4 = Data(fin_depth_side_4)
angle = Data(rad)
width_2 = Data(width)
depth_2 = Data(depth)
height_2 = Data(height)

minimum_fin_spacing = Slider(0.3, range=0..1)
minimum_fin_spacing_2 = Data(minimum_fin_spacing)

# ---- group: room box
xy = XYPlane(Origin=Point(0, 0, 0))
rotate = Rotate(Geometry=xy, Angle=angle, Plane=PlaneXY(0, 0, 0))  # -> Geometry, Transform
box = CenterBox(Base=rotate.Geometry, X=expr("0.5*x", width_2), Y=expr("0.5*x", depth_2), Z=expr("0.5*x", height_2))
debrep = DeconstructBrep(Brep=box)  # -> Faces, Edges, Vertices

# ----
number_slider = Slider(1, range=0..1)  # disabled
item = ListItem(List=debrep.Faces, Index="1", Wrap=True)
cluster = Cluster(srf=item, u=window_u_2, v=window_v_2, height_norm=window_height_norm_3, width_norm=window_width_norm_2)  # -> wall, window, plane, win_wid_vec, window_width, window_height
cluster_2 = Cluster_2(
    window_plane=cluster.plane,
    fin_depth=fin_depth,
    window_vector=cluster.win_wid_vec,
    window_height=cluster.window_height,
    window_width=cluster.window_width,
    fin_multiplier=n_fins_multiplier_2,
    min_fin_spacing=minimum_fin_spacing_2)  # -> louvers, louver_depth, louver_spacing, fins, fin_depth_2, fin_spacing

number_slider_2 = Slider(2, range=0..10)  # disabled
item_2 = ListItem(List=debrep.Faces, Index="2", Wrap=True)
cluster_3 = Cluster(srf=item_2, u=window_u_3, v=window_v_3, height_norm=window_height_norm_4, width_norm=window_width_norm_3)  # -> wall, window, plane, win_wid_vec, window_width, window_height
cluster_4 = Cluster_2(
    window_plane=cluster_3.plane,
    fin_depth=fin_depth_3,
    window_vector=cluster_3.win_wid_vec,
    window_height=cluster_3.window_height,
    window_width=cluster_3.window_width,
    fin_multiplier=n_fins_multiplier_3,
    min_fin_spacing=minimum_fin_spacing_2)  # -> louvers, louver_depth, louver_spacing, fins, fin_depth_2, fin_spacing

number_slider_3 = Slider(3, range=0..10)  # disabled
item_3 = ListItem(List=debrep.Faces, Index="3", Wrap=True)
cluster_5 = Cluster(srf=item_3, u=window_u_4, v=window_v_4, height_norm=window_height_norm, width_norm=window_width_norm_4)  # -> wall, window, plane, win_wid_vec, window_width, window_height
cluster_6 = Cluster_2(
    window_plane=cluster_5.plane,
    fin_depth=fin_depth_4,
    window_vector=cluster_5.win_wid_vec,
    window_height=cluster_5.window_height,
    window_width=cluster_5.window_width,
    fin_multiplier=n_fins_multiplier_4,
    min_fin_spacing=minimum_fin_spacing_2)  # -> louvers, louver_depth, louver_spacing, fins, fin_depth_2, fin_spacing

item_4 = ListItem(List=debrep.Faces, Index=0, Wrap=True)
cluster_7 = Cluster(srf=item_4, u=window_u, v=window_v, height_norm=window_height_norm_2, width_norm=window_width_norm)  # -> wall, window, plane, win_wid_vec, window_width, window_height
cluster_8 = Cluster_2(
    window_plane=cluster_7.plane,
    fin_depth=fin_depth_2,
    window_vector=cluster_7.win_wid_vec,
    window_height=cluster_7.window_height,
    window_width=cluster_7.window_width,
    fin_multiplier=n_fins_multiplier,
    min_fin_spacing=minimum_fin_spacing_2)  # -> louvers, louver_depth, louver_spacing, fins, fin_depth_2, fin_spacing

number_slider_4 = Slider(4, range=0..10)
number_slider_5 = Slider(5, range=0..10)
item_5 = ListItem(List=debrep.Faces, Index="4", Wrap=True)
item_6 = ListItem(List=debrep.Faces, Index="5", Wrap=True)
floor = Data(item_5)
ceiling = Data(item_6)
fin_spacing = Panel(cluster_8.fin_spacing)
windows = Merge(Data1=cluster_7.window, Data2=cluster.window, Data3=cluster_3.window, Data4=cluster_5.window)
louvers = Data([cluster_8.louvers, cluster_2.louvers, cluster_4.louvers, cluster_6.louvers])  # disabled
louver_spacing = Merge(
    Data1=cluster_8.louver_spacing,
    Data2=cluster_2.louver_spacing,
    Data3=cluster_4.louver_spacing,
    Data4=cluster_6.louver_spacing)
fin_spacings = Merge(Data1=cluster_8.fin_spacing, Data2=cluster_2.fin_spacing, Data3=cluster_4.fin_spacing, Data4=cluster_6.fin_spacing)
louver_depth = Merge(Data1=cluster_8.louver_depth, Data2=cluster_2.louver_depth, Data3=cluster_4.louver_depth, Data4=cluster_6.louver_depth)
fin_depths = Merge(Data1=cluster_8.fin_depth_2, Data2=cluster_2.fin_depth_2, Data3=cluster_4.fin_depth_2, Data4=cluster_6.fin_depth_2)
finspacing = DirectDataOutput(FinSpacing=fin_spacings)
findepth = DirectDataOutput(FinDepth=fin_depths)
brep = Brep(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)
walltype = Slider(4, range=0..9)
floortype = Slider(4, range=0..9)
ceilingtype = Slider(4, range=0..9)
glazingtype = Slider(4, range=0..9)
brep_2 = Brep(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)

# ---- group: geometry inputs
# Geometries
brep_3 = Brep(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)
srf = Surface(<surface referenced from the Rhino model>)
brep_4 = Brep(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)
brep_5 = Brep(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)
brep_6 = Brep(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)
brep_7 = Brep(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)

# ----
# Materials
panel = Panel("0.0425")
panel_2 = Panel(walltype)
panel_3 = Panel(floortype)
panel_4 = Panel(ceilingtype)
panel_5 = Panel(glazingtype)
panel_6 = Panel("Solarban 72 (2) on Starphire - Solarban 72 (4) on Starphire - Starphire")
swatch = ColourSwatch(SwatchColor=RGB(133, 0, 0))
num = Number(panel)
num_2 = Number("0.0975")
num_3 = Number("0.2174")
num_4 = Number("0.2984")
num_5 = Number("0.4191")
num_6 = Number("0.5065")
num_7 = Number("0.6214")
num_8 = Number("0.7052")
num_9 = Number("0.8069")
num_10 = Number("0.9253")
num_11 = Number("0.0507")
num_12 = Number("0.5720")
num_13 = Number("0.7000")
num_14 = Number("0.7233")
num_15 = Number("0.7803")
num_16 = Number("0.8060")
num_17 = Number("0.8220")
num_18 = Number("0.8490")
num_19 = Number("0.8718")
num_20 = Number("0.894")
num_21 = Number("0.0475")
num_22 = Number("0.1294")
num_23 = Number("0.2000")
num_24 = Number("0.2885")
num_25 = Number("0.3708")
num_26 = Number("0.4179")
num_27 = Number("0.5204")
num_28 = Number("0.6039")
num_29 = Number("0.7032")
num_30 = Number("0.7773")
num_31 = Number("0.9110")
num_32 = Number("0.835")
num_33 = Number("0.214")
num_34 = Number("0.278")
num_35 = Number("0.359")
num_36 = Number("0.437")
num_37 = Number("0.512")
num_38 = Number("0.595")
num_39 = Number("0.678")
num_40 = Number("0.7540")
sddisplay = LegacyDisplay(Geometry=[brep_2, brep], ShapeDiverMaterial=ColourSwatch(SwatchColor=RGB(255, 176, 176)))
filter = StreamFilter(
    Gate=panel_4,
    Stream0="Black Ceiling",
    Stream1="Metal Reflector On Ceiling",
    Stream2="Ceiling LM83",
    Stream3="Plastic Ceiling Vent E14 526",
    Stream4="Specular Reflective Ceiling Panels",
    Stream5="Plastic Ceiling Vent E14 548",
    Stream6="White Painted Room Ceiling",
    Stream7="Dropped Ceiling Panel",
    Stream8="White Painted Corridor Ceiling",
    Stream9="White painted ceiling")
filter_2 = StreamFilter(
    Gate=ceilingtype,
    Stream0=num_11,
    Stream1=num_12,
    Stream2=num_13,
    Stream3=num_14,
    Stream4=num_15,
    Stream5=num_16,
    Stream6=num_17,
    Stream7=num_18,
    Stream8=num_19,
    Stream9=num_20)
filter_3 = StreamFilter(
    Gate=walltype,
    Stream0=num,
    Stream1=num_2,
    Stream2=num_3,
    Stream3=num_4,
    Stream4=num_5,
    Stream5=num_6,
    Stream6=num_7,
    Stream7=num_8,
    Stream8=num_9,
    Stream9=num_10)
filter_4 = StreamFilter(
    Gate=panel_2,
    Stream0="Black Ceramic wall Tile",
    Stream1="Darkgreen Ceramic Tile wall",
    Stream2="Grey Plaster wall",
    Stream3="Rough Concrete Wall",
    Stream4="Violet Painted Interior Walls",
    Stream5="Green Painted Wall",
    Stream6="Brown Ceramic Tile wall",
    Stream7="Pink Painted wall",
    Stream8="Matte White wall",
    Stream9="Whiteboard wall")
filter_5 = StreamFilter(
    Gate=floortype,
    Stream0=num_21,
    Stream1=num_22,
    Stream2=num_23,
    Stream3=num_24,
    Stream4=num_25,
    Stream5=num_26,
    Stream6=num_27,
    Stream7=num_28,
    Stream8=num_29,
    Stream9=num_30)
filter_6 = StreamFilter(
    Gate=panel_3,
    Stream0="Black Wooden Stage Floor",
    Stream1="Dark Grey Painted Floor",
    Stream2="Floor LM83",
    Stream3="Concrete Floor",
    Stream4="Light Grey Painted Floor",
    Stream5="Light Grey Floor Tiles Nonslip",
    Stream6="Light Wood Floor",
    Stream7="Light Grey Ceramic Tile floor",
    Stream8="Ceramic tile floor",
    Stream9="Light Blue Ceramic Tile floor")
filter_7 = StreamFilter(
    Gate=glazingtype,
    Stream0=num_33,
    Stream1=num_34,
    Stream2=num_35,
    Stream3=num_36,
    Stream4=num_37,
    Stream5=num_38,
    Stream6=num_39,
    Stream7=num_40,
    Stream8=num_32,
    Stream9=num_31)
filter_8 = StreamFilter(
    Gate=panel_5,
    Stream0="Pacifica - Solarban 90 (3)",
    Stream1="Vistacool on Pacifica - Sungate 400 (3)",
    Stream2="Pacifica - Sungate 400 (3)",
    Stream3="Solarban 90 (2) on Solexia - Clear",
    Stream4=panel_6,
    Stream5="Azuria - Clear",
    Stream6="Solexia - Clear (Argon)",
    Stream7="Clear - Sungate 400 (3) (Argon)",
    Stream8="Starphire - Starphire (Argon)",
    Stream9="Starphire")
gltf2material = GlTF20Material(
    BaseColorFactor=swatch,
    MetallicFactor=0,
    RoughnessFactor=1,
    EmissiveFactor=RGB(0, 0, 0),
    AlphaMode="OPAQUE",
    AlphaCutoff=0.5,
    DoubleSided=True)
gltfdisplay = GlTF20Display()

# ---- group: visualize
walls = Data([cluster_7.wall, cluster.wall, cluster_5.wall, cluster_3.wall])
fins = Data([cluster_8.fins, cluster_2.fins, cluster_6.fins, cluster_4.fins])

# ----
wires = BrepWireframe(Brep=[louvers, fins, walls], Density=-1)

# ---- group: visualize (continued)
preview = CustomPreview(Geometry=[louvers, wires], Material=ColourSwatch(SwatchColor=RGB(0, 0, 0)))

# ----
walls_2 = Geometry(walls)
ceiling_2 = Geometry(ceiling)
floor_2 = Geometry(floor)
window = Geometry(windows)
shading = Data(fins)

mesh = Mesh(shading)
mesh_2 = Mesh(ceiling_2)
mesh_3 = Mesh(floor_2)
mesh_4 = Mesh(window)
mesh_5 = Mesh(walls_2)
floor_geom = LegacyDisplay(Geometry=mesh_3, ShapeDiverMaterial=swatch)
walls_geom = LegacyDisplay(Geometry=mesh_5, ShapeDiverMaterial=swatch)
ceiling_geom = LegacyDisplay(Geometry=mesh_2, ShapeDiverMaterial=swatch)
glazing_geom = LegacyDisplay(Geometry=mesh_4, ShapeDiverMaterial=swatch)
fin_geom = LegacyDisplay(Geometry=mesh, ShapeDiverMaterial=swatch)
glazing_output = DirectDataOutput(Data=window)

# ---- group: analysis grid
Z = UnitZ(Factor="0.762")
move = Move(Geometry=floor_2, Motion=Z)  # -> Geometry, Transform
c__0_003 = CSharpScript(gridSurface=move.Geometry, spacing=0.6096, offset="0.0254 * 18", complex=Toggle(False))  # -> out, A, B, nU, nV, E; inputs gridSurface: Brep, spacing: Double, offset: Double, complex: Boolean
# ---------- c__0_003: C# ----------
    Surface srf = gridSurface.Faces[0];

    double width = 0.0;
    double depth = 0.0;
    srf.GetSurfaceSize(out width, out depth);

    srf.SetDomain(0, new Interval(0, width));
    srf.SetDomain(1, new Interval(0, depth));

    int n_usteps = (int) (0.999999999 + (width - 2.0 * offset) / spacing);
    int n_vsteps = (int) (0.999999999 + (depth - 2.0 * offset) / spacing);
    double u_spacing = (width - 2.0 * offset) / n_usteps;
    double v_spacing = (depth - 2.0 * offset) / n_vsteps;

    Mesh m = new Mesh();

    for (int i = 0; i < n_usteps + 1; ++i) {
      for (int j = 0; j < n_vsteps + 1; ++j) {
        Point3d pt;
        Vector3d[] vv;
        srf.Evaluate(offset + i * u_spacing, offset + j * v_spacing, 0, out pt, out vv);
        m.Vertices.Add(pt.X, pt.Y, pt.Z);
      }
    }

    for (int j = 0; j < n_usteps ; ++j) {
      for (int i = 0; i < n_vsteps ; ++i) {
        m.Faces.AddFace(new MeshFace(i + j * (n_vsteps + 1), i + (j + 1) * (n_vsteps + 1), i + (j + 1) * (n_vsteps + 1) + 1, i + j * (n_vsteps + 1) + 1));
      }
    }


    // filter vertices outside of the trimmed surface
    if (complex) {
      bool[] validVertices = new bool[m.Vertices.Count];
      for (int i = 0; i < validVertices.Length; ++i) {
        validVertices[i] = false;
      }

      for (int i = 0; i < m.Vertices.Count; ++i) {
        foreach (BrepFace face in  gridSurface.Faces) {
          if (!face.IsValid) continue;

          double u, v;
          face.ClosestPoint(m.Vertices[i], out u, out v);
          PointFaceRelation pfr = face.IsPointOnFace(u, v);
          if (pfr == PointFaceRelation.Interior) {
            validVertices[i] = true;
            break;
          }
        }
      }

      List<int> cullVertices = new List<int>();
      for (int i = 0; i < validVertices.Length; ++i) {
        if (!validVertices[i]) {
          cullVertices.Add(i);
        }
      }

      m.Vertices.Remove(cullVertices, true);
    }

    m.RebuildNormals();


    A = m;
    B = m.Vertices;
    nU = n_usteps;
    nV = n_vsteps;
    E = srf;
# ---------- end c__0_003 ----------

# ----
glazing_gltf = GlTF20Display(Geometry=mesh_4, Material=gltf2material)
pt = Point(c__0_003.B)
# sensor views (ray casting)
sensorspos = DirectDataOutput(SensorsPos=c__0_003.B)

# ==== cluster Cluster
srf = ClusterInput()
u = ClusterInput()
v = ClusterInput()
height_norm = ClusterInput()
width_norm = ClusterInput()
pt = ConstructPoint(XCoordinate=expr("x+0.5", u), YCoordinate=expr("x+0.5", v), ZCoordinate=0)
srf_2 = Surface(reparameterize(srf))
dim = Dimensions(Surface=srf)  # -> UDimension, VDimension
multiplication = Multiplication(A=dim.VDimension, B=height_norm)
multiplication_2 = Multiplication(A=dim.UDimension, B=width_norm)
dom = ConstructDomain(DomainStart=expr("-0.5*x", multiplication), DomainEnd=expr("0.5*x", multiplication))
dom_2 = ConstructDomain(DomainStart=expr("-0.5*x", multiplication_2), DomainEnd=expr("0.5*x", multiplication_2))
evalsrf = EvaluateSurface(Surface=srf_2, Point=pt)  # -> Point, Normal, UDirection, VDirection, Frame
pl = ConstructPlane(Origin=evalsrf.Point, XAxis=evalsrf.UDirection, YAxis=evalsrf.VDirection)
rectangle = Rectangle(Plane=pl, XSize=dom_2, YSize=dom, Radius=0)  # -> Rectangle, Length
boundary = BoundarySurfaces(Edges=[srf_2, rectangle.Rectangle])
boundary_2 = BoundarySurfaces(Edges=rectangle.Rectangle)
srfpt = SurfacePoints(Surface=boundary_2)  # -> Points, Weights, Greville, UCount, VCount
item = ListItem(List=srfpt.Points, Index=Slider(0, range=0..10), Wrap=True)
item_2 = ListItem(List=srfpt.Points, Index=Slider(2, range=0..10), Wrap=True)
vec2pt = Vector2Pt(PointA=item, PointB=item_2, Unitize=False)  # -> Vector, Length
pl_origin = PlaneOrigin(Base=pl, Origin=item)
wall = ClusterOutput(boundary)
window = ClusterOutput(boundary_2)
plane = ClusterOutput(pl_origin)
win_wid_vec = ClusterOutput(vec2pt.Vector)
window_width = ClusterOutput(multiplication_2)
window_height = ClusterOutput(multiplication)

# ==== cluster Cluster_2
window_plane = ClusterInput()
fin_depth = ClusterInput()
window_vector = ClusterInput()
window_height = ClusterInput()
window_width = ClusterInput()
fin_multiplier = ClusterInput()
min_fin_spacing = ClusterInput()
data = Data(window_plane)
deplane = DeconstructPlane(Plane=window_plane)  # -> Origin, XAxis, YAxis, ZAxis
xy = XYPlane(Origin=window_plane)
c__louvers = CSharpScript(window_height=window_height, fin_multiplier=fin_multiplier, min_fin_spacing=min_fin_spacing, fin_depth=fin_depth)  # -> out, N_Fins, Spacing, Depth; inputs window_height: Double, fin_multiplier: Double, min_fin_spacing: Double, fin_depth: Double
# ---------- c__louvers: C# ----------
    int max_n_fins = (int) (window_height / min_fin_spacing);
    int n_fins = (int) (fin_multiplier * max_n_fins);
    double spacing;
    double depth;

    if (n_fins <= 1) {
      spacing = window_height;
      depth = 0;
    }
    else {
      spacing = window_height / (n_fins - 1);
      depth = fin_depth;
    }

    N_Fins = n_fins;
    Spacing = spacing;
    Depth = depth;
# ---------- end c__louvers ----------
c_script = CSharpScript(window_width=window_width, fin_multiplier=fin_multiplier, min_fin_spacing=min_fin_spacing, fin_depth=fin_depth)  # -> out, N_Fins, Spacing, Depth; inputs window_width: Double, fin_multiplier: Double, min_fin_spacing: Double, fin_depth: Double
# ---------- c_script: C# ----------
    int max_n_fins = (int) (window_width / min_fin_spacing);
    int n_fins = (int) (fin_multiplier * max_n_fins);
    double spacing;
    double depth;

    if (n_fins <= 1) {
      spacing = window_width;
      depth = 0;
    }
    else {
      spacing = window_width / (n_fins-1);
      depth = fin_depth;
    }

    N_Fins = n_fins;
    Spacing = spacing;
    Depth = depth;
# ---------- end c_script ----------
rotate = Rotate(Geometry=window_plane, Angle=-1.570796327, Plane=xy)  # -> Geometry, Transform
pl = ConstructPlane(Origin=deplane.Origin, XAxis=window_vector, YAxis=deplane.ZAxis)
panel = Panel(c_script.N_Fins)
rectangle = Rectangle(Plane=pl, XSize=window_width, YSize=c__louvers.Depth, Radius=0)  # -> Rectangle, Length
rectangle_2 = Rectangle(Plane=rotate.Geometry, XSize=c_script.Depth, YSize=window_height, Radius=0)  # -> Rectangle, Length
series = Series(Start=0, Step=c__louvers.Spacing, Count=c__louvers.N_Fins)
boundary = BoundarySurfaces(Edges=rectangle.Rectangle)
boundary_2 = BoundarySurfaces(Edges=rectangle_2.Rectangle)
series_2 = Series(Start=0, Step=c_script.Spacing, Count=c_script.N_Fins)
Z = UnitZ(Factor=series)
amp = Amplitude(Vector=window_vector, Amplitude=series_2)
move = Move(Geometry=boundary, Motion=Z)  # -> Geometry, Transform
move_2 = Move(Geometry=boundary_2, Motion=amp)  # -> Geometry, Transform
louvers = ClusterOutput(move.Geometry)
louver_depth = ClusterOutput(c__louvers.Depth)
louver_spacing = ClusterOutput(c__louvers.Spacing)
fins = ClusterOutput(move_2.Geometry)
fin_depth_2 = ClusterOutput(c_script.Depth)
fin_spacing = ClusterOutput(c_script.Spacing)
