# Grasshopper definition parametricRoom-V1- 4.7.2023.gh (Grasshopper 1.0.7)

rotation_degree = Slider(360, range=0..360)
reset_button = Button()
romm_width = Slider(7.4, range=0..10)
list = ValueList({"Wall 0": 0, "Wall 1": 1, "Wall 2": 2, "Wall 3": 3}, selected=["Wall 0", "Wall 1", "Wall 2", "Wall 3"])
room_length = Slider(8.9, range=0..10)
wallheight = Slider(2.5, range=0..10)

winlength = Slider(3.9, range=0..6.5)
winheight = Slider(1.3, range=0..6.5)
lateralmovement = Slider(0.03, range=-4..4)
verticalmovement = Slider(0.32, range=-4..4)
fins_width = Slider(0.51, range=0..5)
fins_depth = Slider(0.34, range=0..5)

wall_thickness = Panel("0.15")
ceiling_thickness = Panel("0.15")
rectangle = Rectangle(Plane=PlaneXY(0, 0, 0), XSize=room_length, YSize=romm_width, Radius=0)  # -> Rectangle, Length
num = Number([winlength, winheight, lateralmovement, verticalmovement, fins_width, fins_depth])
pcen = PolygonCenter(Polyline=rectangle.Rectangle)  # -> CenterV, CenterE, CenterA
rotate = Rotate(Geometry=rectangle.Rectangle, Angle=degrees(rotation_degree), Plane=pcen.CenterV)  # -> Geometry, Transform
explode = Explode(Curve=rectangle.Rectangle, Recursive=True)  # -> Segments, Vertices
lng = ListLength(List=explode.Segments)
c_script = CSharpScript(Reset=reset_button, initialNumbers=["2", "2", "0", "0", "0.1", "0.1"], branches=list, newNumbers=num, WindowsCount=lng)  # -> out, A; inputs Reset: Boolean, initialNumbers: list of Double, branches: list of Int32, newNumbers: list of Double, WindowsCount: Int32
# ---------- c_script: C# ----------
    bool CheckifChanged = (WindowsCount != WindowNom);

    List<string> opts1 = new List<string> ();
    for(int i = 0 ;i < WindowsCount ;i++){
      opts1.Add(i.ToString());
    }

    //Updating value list
    if(Reset || (!CheckifChanged))oldstate = true;
    else if((!Reset && oldstate) || (CheckifChanged) ){
      oldstate = false;
      valList = (Grasshopper.Kernel.Special.GH_ValueList) this.Component.Params.Input[2].Sources[0];
      if(valList != null){
        opts = opts1;
        vals = opts1;
        this.GrasshopperDocument.ScheduleSolution(3, SolutionCallback);
      }
    }

    ///////////////////////////////////

    Numbers = initialNumbers.ToArray();

    ///Adding initial input values to branches
    if(Reset || (CheckifChanged)){
      AllInitialNumbers.ClearData();
      for(int i = 0 ;i < WindowsCount;i++)
        AllInitialNumbers.AddRange(initialNumbers, new GH_Path(i));
    }





    ///Regenerating input Values based on new numbers
    for(int i = 0 ;i < AllInitialNumbers.BranchCount;i++){
      bool flag = false;
      for(int j = 0 ;j < branches.Count;j++){
        if(i == branches[j]){
          flag = true;
        }
      }
      if(flag){
        AllInitialNumbers.Branch(i).Clear();
        AllInitialNumbers.AddRange(newNumbers, new GH_Path(i));
      }
    }

    ///Removing empty branches
    List<int> emptyList = new List<int>();
    for(int i = 0 ;i < AllInitialNumbers.BranchCount ;i++){
      if(AllInitialNumbers.Branch(i).Count == 0 )
        emptyList.Add(i);
    }
    for (int i = emptyList.Count - 1; i >= 0; i--)
      AllInitialNumbers.RemovePath(emptyList[i]);

    WindowNom = WindowsCount;


    n++;
    A = AllInitialNumbers;
# ---------- c_script: C# additional code ----------
  int n = 0;

  int WindowNom = 4;

  double[] Numbers ;
  DataTree<double> AllInitialNumbers = new DataTree<double>();

  /////////////////////////////
  public bool oldstate = false;
  public Grasshopper.Kernel.Special.GH_ValueList valList;
  public List<string> opts;
  public List<string> vals;
  private void SolutionCallback(GH_Document document){
    valList.ListItems.Clear();
    for (int i = 0; i < opts.Count; i++){
      valList.ListItems.Add(new Grasshopper.Kernel.Special.GH_ValueListItem("Wall " + opts[i], vals[i]));
    }
    valList.ExpireSolution(true);
  }
# ---------- end c_script ----------
Z = UnitZ(Factor=wallheight)
boundary = BoundarySurfaces(Edges=rectangle.Rectangle)
extr = Extrude(Base=rotate.Geometry, Direction=Z)
move = Move(Geometry=boundary, Motion=Z)  # -> Geometry, Transform
debrep = DeconstructBrep(Brep=extr)  # -> Faces, Edges, Vertices
srf = Surface([move.Geometry, boundary])
item = ListItem(List=c_script.A, Index=0, Wrap=True)  # -> Item, Item1, Item2, Item3, Item4, Item5
edges = BrepEdges(Brep=debrep.Faces)  # -> Naked, Interior, NonManifold
curvepoint = PointOnCurve(edges.Naked, parameter=0.5)
pdecon = Deconstruct(Point=curvepoint)  # -> XComponent, YComponent, ZComponent
sort = SortList(Keys=pdecon.ZComponent, ValuesA=edges.Naked)  # -> Keys, ValuesA
item_2 = ListItem(List=sort.ValuesA, Index=0, Wrap=True)

# ---- group: LateralMovement
num_2 = Number(item.Item2)

# ---- group: WinLength
num_3 = Number(item.Item)

# ----
len = Length(Curve=item_2)
multiplication = Multiplication(A=wall_thickness, B=2)
subtraction = Subtraction(A=len, B=multiplication)
c_script_2 = CSharpScript(x=num_3, y=subtraction)  # -> out, A; inputs x: Double
# ---------- c_script_2: C# ----------
    double Number = 0;
    if(x >= y.Max)
      Number = y.Max;
    else if(x<= y.Min)
      Number = y.Min;
    else
      Number = x;
    
    A = Number;
# ---------- end c_script_2 ----------

# ---- group: VerticalMovement
num_4 = Number(item.Item3)

# ---- group: WinHeight
num_5 = Number(item.Item1)

# ----
c_script_3 = CSharpScript(x=num_5, y=wallheight)  # -> out, A; inputs x: Double; same code as c_script_2
subtraction_2 = Subtraction(A=subtraction, B=c_script_2.A)
subtraction_3 = Subtraction(A=wallheight, B=c_script_3.A)
multiplication_2 = Multiplication(A=ceiling_thickness, B=2)
c_script_4 = CSharpScript(x=subtraction_2)  # -> out, A; inputs x: Double
# ---------- c_script_4: C# ----------
    x = x / 2;
    Interval Intrvl = new Interval(-x, x);
    A = Intrvl;
# ---------- end c_script_4 ----------
subtraction_4 = Subtraction(A=subtraction_3, B=multiplication_2)
c_script_5 = CSharpScript(x=num_2, y=c_script_4.A)  # -> out, A; inputs x: Double; same code as c_script_2
len_2 = Length(Curve=item_2)
c_script_6 = CSharpScript(x=subtraction_4)  # -> out, A; inputs x: Double; same code as c_script_4
division = Division(A=c_script_5.A, B=len_2)
c_script_7 = CSharpScript(x=num_4, y=c_script_6.A)  # -> out, A; inputs x: Double; same code as c_script_2
division_2 = Division(A=wallheight, B=2)
addition = Addition(A=division_2, B=c_script_7.A)
addition_2 = Addition(A=division, B="0.5")
bbox = BoundingBox(Content=flatten(item_2), Plane=PlaneXY(0, 0, 0), UnionBox=True)  # -> Box, Box_2
eval = EvaluateCurve(Curve=reparameterize(item_2), Parameter=addition_2)  # -> Point, Tangent, Angle
area = Area(Geometry=bbox.Box)  # -> Area, Centroid
Z_2 = UnitZ(Factor=1)
subtraction_5 = Subtraction(A=area.Centroid, B=eval.Point)
vrot = Rotate(Vector=eval.Tangent, Axis=Z_2, Angle=[-1.570796327, 1.570796327])
angle = Angle(VectorA=subtraction_5, VectorB=vrot)  # -> Angle, Reflex
sort_2 = SortList(Keys=angle.Angle, ValuesA=vrot)  # -> Keys, reverse(ValuesA)
multiplication_3 = Multiplication(A=Z_2, B=addition)
dom = ConstructDomain(DomainStart="0.05", DomainEnd=num_3)
item_3 = ListItem(List=sort_2.ValuesA, Index=0, Wrap=True)
c_script_8 = CSharpScript(x=c_script_3.A)  # -> out, A; inputs x: Double; same code as c_script_4
c_script_9 = CSharpScript(x=c_script_2.A)  # -> out, A; inputs x: Double; same code as c_script_4
c_script_10 = CSharpScript(x=item.Item4, y=dom)  # -> out, A; inputs x: Double; same code as c_script_2
move_2 = Move(Geometry=eval.Point, Motion=multiplication_3)  # -> Geometry, Transform
vrot_2 = Rotate(Vector=Z_2, Axis=item_3, Angle=-1.570796327)
pl = ConstructPlane(Origin=move_2.Geometry, XAxis=vrot_2, YAxis=Z_2)
rectangle_2 = Rectangle(Plane=pl, XSize=c_script_9.A, YSize=c_script_8.A, Radius=0)  # -> simplify(Rectangle), Length
join = JoinCurves(Curves=edges.Naked, Preserve=False)  # -> simplify(Curves)
area_2 = Area(Geometry=rectangle_2.Rectangle)  # -> Area, Centroid
larger = LargerThan(FirstNumber=area_2.Area, SecondNumber=0.1)  # -> LargerThan, OrEqualTo
cull = CullPattern(List=rectangle_2.Rectangle, CullPattern=larger.LargerThan)
division_3 = Division(A=c_script_2.A, B=c_script_10.A)
round = Round(Number=division_3)  # -> Nearest, Floor, Ceiling
boundary_2 = BoundarySurfaces(Edges=cull)
boundary_3 = BoundarySurfaces(Edges=[join, cull])
divide = DivideDomain²(Domain=boundary_2, UCount=round.Nearest, VCount=1)
subsrf = Isotrim(Surface=boundary_2, Domain=divide)
join_2 = BrepJoin(Breps=subsrf)  # -> Breps, Closed
edges_2 = BrepEdges(Brep=join_2.Breps)  # -> simplify(Naked), simplify(Interior), NonManifold
amp = Amplitude(Vector=item_3, Amplitude=item.Item5)
join_3 = JoinCurves(Curves=[edges_2.Naked, edges_2.Interior], Preserve=False)
extr_2 = Extrude(Base=join_3, Direction=amp)
srf_2 = Surface(srf)
brep = Brep(boundary_3)
