# Grasshopper definition parametricRoom-V11-12.8.2023.gh (Grasshopper 1.0.7)
# plug-ins: Pufferfish, Human, Parakeet, Human UI, Heteroptera, EleFront, PW_AI

number_slider = Slider(4, range=0..10)

rotation_degree = Slider(0, range=0..360)
x_dimension = Slider(6.5, range=1..10)
y_dimension = Slider(4.5, range=1..10)
wallheight = Slider(3.3, range=1..6)

series = Series(Start=0, Step=1, Count=number_slider)
dup = DuplicateData(Data="1", Number=number_slider, Order=True)
checklist = CreateChecklist(ChecklistItems=series, Selected=Toggle(False), Height=Slider(200, range=0..1000))
slider = CreateSlider(Slider=rotation_degree, ShowBounds=False, ShowTicks=False, ShowTooltip=False, ShowValLabel=True, showLabel=True)
slider_2 = CreateSlider(Slider=x_dimension, ShowBounds=False, ShowTicks=False, ShowTooltip=False, ShowValLabel=True, showLabel=True)
slider_3 = CreateSlider(Slider=y_dimension, ShowBounds=False, ShowTicks=False, ShowTooltip=False, ShowValLabel=True, showLabel=True)
slider_4 = CreateSlider(Slider=wallheight, ShowBounds=False, ShowTicks=False, ShowTooltip=False, ShowValLabel=True, showLabel=True)
merge = Merge(Data1=flatten(slider), Data2=flatten(slider_2), Data3=flatten(slider_3), Data4=flatten(slider_4))  # -> flatten(Result)

winlength = Slider(1.5, range=1..3)
winheight = Slider(2.5, range=0..4)
lateralmovement = Slider(0, range=-2..2)
verticalmovement = Slider(0, range=-2..2)
fins_multiplier = Slider(0.2, range=0..0.8)
fins_depth = Slider(0.65, range=0..1)
fins_rotation = Slider(0, range=-90..90)

min_fin_spacing = Slider(0.1, range=0..1)
format = Format(Format="Wall {0}", Culture=127, Data0=series)
values = ValueListener(Elements=merge, SomeProperty=True)  # -> flatten(Values), Indices
textbox = CreateTextBox(Label=format, DefaultText=dup, UpdateButton=True, showLabel=True)
expander = CreateExpander(UIElements=merge, Header="Room Propertices", Open=True)
button = Button()
toggle = BooleanToggle(True)
expander_2 = CreateExpander(UIElements=textbox, Header="number of windows on walls", Open=True)
values_2 = ValueListener(Elements=textbox, SomeProperty=True)  # -> flatten(Values), Indices
slider_5 = CreateSlider(Slider=winlength, ShowBounds=False, ShowTicks=False, ShowTooltip=False, ShowValLabel=True, showLabel=True)
slider_6 = CreateSlider(Slider=winheight, ShowBounds=False, ShowTicks=False, ShowTooltip=False, ShowValLabel=True, showLabel=True)
slider_7 = CreateSlider(Slider=lateralmovement, ShowBounds=False, ShowTicks=False, ShowTooltip=False, ShowValLabel=True, showLabel=True)
slider_8 = CreateSlider(Slider=verticalmovement, ShowBounds=False, ShowTicks=False, ShowTooltip=False, ShowValLabel=True, showLabel=True)
slider_9 = CreateSlider(Slider=fins_multiplier, ShowBounds=False, ShowTicks=False, ShowTooltip=False, ShowValLabel=True, showLabel=True)
slider_10 = CreateSlider(Slider=fins_depth, ShowBounds=False, ShowTicks=False, ShowTooltip=False, ShowValLabel=True, showLabel=True)
slider_11 = CreateSlider(Slider=fins_rotation, ShowBounds=False, ShowTicks=False, ShowTooltip=False, ShowValLabel=True, showLabel=True)
number_slider_2 = Slider(136, range=0..1000)
number_slider_3 = Slider(260, range=0..1000)
number_slider_4 = Slider(200, range=0..1000)
number_slider_5 = Slider(306, range=0..1000)
merge_2 = Merge(
    Data1=flatten(slider_5),
    Data2=flatten(slider_6),
    Data3=flatten(slider_7),
    Data4=flatten(slider_8),
    Data5=flatten(slider_9),
    Data6=flatten(slider_10),
    Data7=flatten(slider_11))
adjustpos = AdjustElementPositioning(
    ElementsToAdjust=expander,
    Margin="0,0,0,0",
    AbsolutePositioning=toggle,
    Width=number_slider_3,
    Height=number_slider_4,
    HorizontalAlignment=Slider(0, range=0..10),
    VerticalAlignment=Slider(2, range=0..10))
expander_3 = CreateExpander(UIElements=merge_2, Header="Windows Propertices", Open=True)
item = ListItem(List=values.Values, Index=0, Wrap=True)  # -> Item, Item1, Item2, Item3
adjustpos_2 = AdjustElementPositioning(
    ElementsToAdjust=expander_2,
    Margin="0,0,0,0",
    AbsolutePositioning=toggle,
    Width=number_slider_2,
    Height=number_slider_4,
    HorizontalAlignment=Slider(0, range=0..10),
    VerticalAlignment=Slider(2, range=0..10))
values_3 = ValueListener(Elements=merge_2, SomeProperty=True)  # -> flatten(Values), Indices
rectangle = Rectangle(Plane=PlaneXY(0, 0, 0), XSize=item.Item1, YSize=item.Item2, Radius=0)  # -> Rectangle, Length
crv = Curve(rectangle.Rectangle)
number_slider_6 = Slider(315, range=0..1000)
pcen = PolygonCenter(Polyline=crv)  # -> CenterV, CenterE, CenterA
rotate = Rotate(Geometry=crv, Angle=degrees(item.Item), Plane=pcen.CenterE)  # -> Geometry, Transform
lng = ListLength(List=textbox)
values_4 = ValueListener(Elements=textbox, SomeProperty=True)  # -> flatten(Values), Indices
adjustpos_3 = AdjustElementPositioning(
    ElementsToAdjust=expander_3,
    Margin="0,0,0,0",
    AbsolutePositioning=toggle,
    Width=number_slider_3,
    Height=number_slider_5,
    HorizontalAlignment=Slider(0, range=0..10),
    VerticalAlignment=Slider(2, range=0..10))
explode = Explode(Curve=rotate.Geometry, Recursive=True)  # -> Segments, Vertices
ma = MassAddition(Input=values_4.Values)  # -> Result, PartialResults
c_script = CSharpScript(Reset=button, SelectedSubWinWalls=values_4.Values, wallCount=lng)  # -> out, A; inputs Reset: Boolean, SelectedSubWinWalls: list of Int32, wallCount: Int32
# ---------- c_script: C# ----------
    if(Reset ){
      wallSubWinsList.Clear();
      for(int i = 0;i < wallCount ;i++)
        wallSubWinsList.Add(1);
    }


    wallSubWinsList = SelectedSubWinWalls;

    List<string> opts1 = new List<string> ();
    for(int i = 0 ;i < wallCount ;i++){
      if(wallSubWinsList.Count == wallCount){
        for(int j = 0 ;j < wallSubWinsList[i] ;j++){
          opts1.Add(i.ToString() + "-" + j.ToString());
        }
      }
    }

    A = opts1;
# ---------- c_script: C# additional code ----------
  int WallCount = 4;
  int WindowCount ;
  List<int> wallSubWinsList = new List<int> ();
# ---------- end c_script ----------
split = TextSplit(Text=c_script.A, Separators="-")  # -> simplify(Result)
item_2 = ListItem(List=split, Index=0, Wrap=True)  # -> flatten(Item), flatten(Item1)
format_2 = Format(Format="Wall {0} __ Win {1}", Culture=127, Data0=item_2.Item, Data1=item_2.Item1)
checklist_2 = CreateChecklist(ChecklistItems=format_2, Selected=Toggle(True))
values_5 = ValueListener(Elements=checklist_2, SomeProperty=True)  # -> Values, Indices
expander_4 = CreateExpander(UIElements=checklist_2, Header="Select Window/s", Open=True)
adjustpos_4 = AdjustElementPositioning(
    ElementsToAdjust=expander_4,
    Margin="0,0,0,0",
    AbsolutePositioning=toggle,
    Width=number_slider_2,
    Height=number_slider_5,
    HorizontalAlignment=Slider(0, range=0..2),
    VerticalAlignment=Slider(2, range=0..2))
c_script_2 = CSharpScript(Reset=button, opts1=c_script.A, branches=values_5.Indices, newNumbers=values_3.Values)  # -> out, A; inputs Reset: Boolean, opts1: list of String, branches: list of Int32, newNumbers: list of Double
# ---------- c_script_2: C# ----------
    bool Check = false;/////////////////////////
    if (opts1.Count != opts2.Count )
    {
      Check = true;////////////////////////////
      opts2.Clear();
      opts2.AddRange(opts1);
    }
    else{
      for(int i = 0; i < opts1.Count;i++){ //////////
        if( opts1[i] != opts2[i]){////////
          Check = true;////////////////////////////
          opts2.Clear();
          opts2.AddRange(opts1);
        }
      }
    }


    if(Reset || Check){
      AllInitialNumbers.ClearData();
      for(int i = 0 ;i < opts1.Count;i++){
        var brancheNames = opts1[i].Split('-');
        AllInitialNumbers.AddRange(Numbers, new GH_Path(new int[2]{Int32.Parse(brancheNames[0]),Int32.Parse(brancheNames[1])}));
      }
    }

    ///Regenerating input Values based on new numbers
    for(int j = 0 ;j < branches.Count;j++){
      var brancheNames = opts1[branches[j]].Split('-');
      var path = new GH_Path(new int[2]{Int32.Parse(brancheNames[0]),Int32.Parse(brancheNames[1])});
      if(AllInitialNumbers.PathExists(path)){
        AllInitialNumbers.Branch(path).Clear();
        AllInitialNumbers.AddRange(newNumbers, new GH_Path(path));
      }
    }

    ///Removing empty branches
    List<GH_Path> allBranchePathes = new List<GH_Path>();
    for(int i = 0 ;i < AllInitialNumbers.BranchCount ;i++){
      allBranchePathes.Add(AllInitialNumbers.Path(i));
    }
    for(int i = 0 ;i < allBranchePathes.Count ;i++){
      if(AllInitialNumbers.Branch(allBranchePathes[i]) != null){
        bool flag = AllInitialNumbers.Branch(allBranchePathes[i]).Count == 0;
        if(flag)
          AllInitialNumbers.RemovePath(allBranchePathes[i]);
      }
    }

    A = AllInitialNumbers;
# ---------- c_script_2: C# additional code ----------
  double[] Numbers = new double[7]{3,3,0,0,0.5,0.4,0};

  List<string> opts2 = new List<string>(){"0-0","1-0","2-0","3-0"};
  DataTree<double> AllInitialNumbers = new DataTree<double>();
# ---------- end c_script_2 ----------
ceiling_thickness = Panel("0.1")
wall_thickness = Panel("0.1")
c_script_3 = CSharpScript(x=values_2.Values)  # -> out, A; inputs x: Int32
# ---------- c_script_3: C# ----------
    if(x ==0)
      x = 1;
    
    A = x;
# ---------- end c_script_3 ----------
crv_2 = Curve(simplify(graft(explode.Segments)))
div = DivideDomain(Domain=Domain(0, 1), Count=values_2.Values)
div_2 = DivideDomain(Domain=Domain(0, 1), Count=c_script_3.A)
subcrv = SubCurve(BaseCurve=reparameterize(simplify(crv_2)), Domain=simplify(div_2))  # -> simplify(graft(Curve))
subcrv_2 = SubCurve(BaseCurve=reparameterize(simplify(crv_2)), Domain=simplify(div))  # -> graft(Curve)
lng_2 = ListLength(List=subcrv_2)
clean = CleanTree(RemoveNulls=True, RemoveInvalid=True, RemoveEmpty=True, Tree=subcrv_2)
equals = Equality(FirstNumber=lng_2, SecondNumber=0)  # -> Equality, Inequality
cull = CullPattern(List=subcrv, CullPattern=equals.Equality)
boundary = BoundarySurfaces(Edges=rotate.Geometry)
Z = UnitZ(Factor=item.Item3)
move = Move(Geometry=boundary, Motion=Z)  # -> Geometry, Transform
srf = Surface([move.Geometry, boundary])
item_3 = ListItem(List=c_script_2.A, Index=0, Wrap=True)  # -> Item, Item1, Item2, Item3, Item4, Item5, Item6
crv_3 = Curve(clean)
len = Length(Curve=crv_3)
multiplication = Multiplication(A=wall_thickness, B=2)
num = Number(item_3.Item2)
num_2 = Number(item_3.Item)
subtraction = Subtraction(A=len, B=multiplication)
c_script_4 = CSharpScript(x=num_2, y=subtraction)  # -> out, A; inputs x: Double
# ---------- c_script_4: C# ----------
    double Number = 0;
    if(x >= y.Max)
      Number = y.Max;
    else if(x<= y.Min)
      Number = y.Min;
    else
      Number = x;
    
    A = Number;
# ---------- end c_script_4 ----------
subtraction_2 = Subtraction(A=subtraction, B=c_script_4.A)
multiplication_2 = Multiplication(A=ceiling_thickness, B=2)
num_3 = Number(item_3.Item1)
offset_l = OffsetCurveLoose(Curve=rotate.Geometry, Distance=[1, -1])
subtraction_3 = Subtraction(A=item.Item3, B=multiplication_2)
c_script_5 = CSharpScript(x=subtraction_2)  # -> out, A; inputs x: Double
# ---------- c_script_5: C# ----------
    x = x / 2;
    Interval Intrvl = new Interval(-x, x);
    A = Intrvl;
# ---------- end c_script_5 ----------
len_2 = Length(Curve=offset_l)
c_script_6 = CSharpScript(x=num_3, y=subtraction_3)  # -> out, A; inputs x: Double; same code as c_script_4
c_script_7 = CSharpScript(x=num, y=c_script_5.A)  # -> out, A; inputs x: Double; same code as c_script_4
len_3 = Length(Curve=crv_3)
sort = SortList(Keys=len_2, ValuesA=offset_l)  # -> Keys, ValuesA
num_4 = Number(item_3.Item3)
item_4 = ListItem(List=sort.ValuesA, Index=0, Wrap=True)
division = Division(A=c_script_7.A, B=len_3)
subtraction_4 = Subtraction(A=item.Item3, B=c_script_6.A)
subtraction_5 = Subtraction(A=subtraction_4, B=multiplication_2)
c_script_8 = CSharpScript(x=subtraction_5)  # -> out, A; inputs x: Double; same code as c_script_5
addition = Addition(A=division, B="0.5")
c_script_9 = CSharpScript(x=num_4, y=c_script_8.A)  # -> out, A; inputs x: Double; same code as c_script_4
division_2 = Division(A=item.Item3, B=2)
eval = EvaluateCurve(Curve=reparameterize(crv_3), Parameter=addition)  # -> Point, Tangent, Angle
addition_2 = Addition(A=division_2, B=c_script_9.A)
pull = PullPoint(Point=eval.Point, Geometry=item_4, ClosestOnly=True)  # -> ClosestPoint, Distance
Z_2 = UnitZ(Factor=1)
vrot = Rotate(Vector=eval.Tangent, Axis=Z_2, Angle=[-1.570796327, 1.570796327])
subtraction_6 = Subtraction(A=pull.ClosestPoint, B=eval.Point)
angle = Angle(VectorA=subtraction_6, VectorB=vrot)  # -> Angle, Reflex
multiplication_3 = Multiplication(A=Z_2, B=addition_2)
sort_2 = SortList(Keys=angle.Angle, ValuesA=vrot)  # -> Keys, reverse(ValuesA)
item_5 = ListItem(List=sort_2.ValuesA, Index=0, Wrap=True)
move_2 = Move(Geometry=eval.Point, Motion=multiplication_3)  # -> Geometry, Transform
vrot_2 = Rotate(Vector=Z_2, Axis=item_5, Angle=-1.570796327)
c_script_10 = CSharpScript(x=c_script_6.A)  # -> out, A; inputs x: Double; same code as c_script_5
crv_4 = Curve(clean)
pl = ConstructPlane(Origin=move_2.Geometry, XAxis=vrot_2, YAxis=Z_2)
c_script_11 = CSharpScript(x=c_script_4.A)  # -> out, A; inputs x: Double; same code as c_script_5
match = MatchTree(Tree=pl, Guide=c_script_11.A)
extr = Extrude(Base=crv_4, Direction=Z)
rectangle_2 = Rectangle(Plane=match, XSize=c_script_11.A, YSize=c_script_10.A, Radius=0)  # -> Rectangle, Length
join = JoinCurves(Curves=extr, Preserve=False)  # -> simplify(Curves)
area = Area(Geometry=rectangle_2.Rectangle)  # -> Area, Centroid
larger = LargerThan(FirstNumber=area.Area, SecondNumber=0.1)  # -> LargerThan, OrEqualTo
clean_2 = CleanTree(RemoveNulls=True, RemoveInvalid=True, RemoveEmpty=True, Tree=cull)
amp = Amplitude(Vector=item_5, Amplitude=Slider(0.11, range=0..1))
amp_2 = Amplitude(Vector=item_5, Amplitude=Slider(0.05, range=0..1))
cull_2 = CullPattern(List=rectangle_2.Rectangle, CullPattern=larger.LargerThan)
neg = Negative(Value=amp)
extr_2 = Extrude(Base=clean_2, Direction=Z)
move_3 = Move(Geometry=cull_2, Motion=neg)  # -> Geometry, Transform
move_4 = Move(Geometry=cull_2, Motion=amp_2)  # -> Geometry, Transform
match_2 = MatchTree(Tree=join, Guide=cull_2)
explode_2 = Explode(Curve=cull_2, Recursive=True)  # -> Segments, Vertices
explode_3 = Explode(Curve=move_4.Geometry, Recursive=True)  # -> Segments, Vertices
merge_3 = Merge(Data1=move_3.Geometry, Data2=move_4.Geometry)  # -> simplify(Result)
merge_4 = Merge(Data1=cull_2, Data2=match_2, Data3=extr_2)
curvepoint = PointOnCurve(explode_3.Segments, parameter=0.5)
pdecon = Deconstruct(Point=curvepoint)  # -> XComponent, YComponent, ZComponent
number_slider_7 = Slider(0.004, range=0..0.02)
number_slider_8 = Slider(0.05, range=0..0.1)
sort_3 = SortList(Keys=pdecon.ZComponent, ValuesC=explode_2.Segments, ValuesA=explode_3.Segments)  # -> Keys, ValuesC, ValuesA
number_slider_9 = Slider(1.75, range=0..10)
crv_5 = Curve(rotate.Geometry)
disc = Discontinuity(Curve=move_4.Geometry, Level=1)  # -> Points, Parameters
item_6 = ListItem(List=sort_3.ValuesC, Index=0, Wrap=True)
boundary_2 = BoundarySurfaces(Edges=merge_4)
neg_2 = Negative(Value=number_slider_8)
pdecon_2 = Deconstruct(Point=disc.Points)  # -> XComponent, YComponent, ZComponent
c_script_12 = CSharpScript(x=simplify(graft(values_2.Values)))  # -> out, A; inputs x: tree of Int32
# ---------- c_script_12: C# ----------
    DataTree<int> y = new DataTree<int> ();
    for(int i = 0 ;i < x.BranchCount ;i++)
    {
      if(x.Branch(i)[0] == 0)
        y.Add(0, new GH_Path(i));
    }
    A = y;
# ---------- end c_script_12 ----------
neg_3 = Negative(Value=number_slider_9)
neg_4 = Negative(Value=number_slider_7)
len_4 = Length(Curve=item_6)
offset = OffsetCurve(Curve=crv_5, Distance=[0.1, -0.1], Corners=1)  # -> flatten(Curve)
area_2 = Area(Geometry=extr)  # -> Area, Centroid
area_3 = Area(Geometry=cull_2)  # -> Area, Centroid
c_script_13 = CSharpScript(window_width=len_4, minFinSpacing=min_fin_spacing, finMultiplier=item_3.Item4, finDepth=item_3.Item5)  # -> out, N_Fins, Spacing, Depth; inputs window_width: Double, minFinSpacing: Double, finMultiplier: Double, finDepth: Double
# ---------- c_script_13: C# ----------
    int max_n_fins = (int) (window_width / minFinSpacing);
    int n_fins = (int) (finMultiplier * max_n_fins);
    double spacing;
    double depth;

    if (n_fins <= 1) {
      spacing = window_width;
      depth = 0;
    }
    else {
      spacing = window_width / (n_fins - 1);
      depth = finDepth;
    }

    N_Fins = n_fins;
    Spacing = spacing;
    Depth = depth;
# ---------- end c_script_13 ----------
join_2 = BrepJoin(Breps=flatten(boundary_2))  # -> Breps, Closed
sort_4 = SortList(Keys=offset, ValuesA=offset)  # -> Keys, reverse(ValuesA)
num_5 = Number(wall_thickness)
pshift = ShiftPaths(Data=area_2.Area, Offset=-1)
pshift_2 = ShiftPaths(Data=area_3.Area, Offset=-1)
sort_5 = SortList(Keys=pdecon_2.ZComponent, ValuesA=disc.Points)  # -> Keys, ValuesA
offset_2 = OffsetCurve(Curve=graft(merge_3), Distance=flatten([number_slider_7, neg_4]), Corners=1)
offset_3 = OffsetCurve(Curve=graft(merge_3), Distance=flatten([number_slider_8, neg_2]), Corners=1)
explode_4 = Explode(Curve=crv_5, Recursive=True)  # -> Segments, Vertices
merge_5 = Merge(Data1=neg_3, Data2=number_slider_9)
explode_5 = Explode(Curve=rotate.Geometry, Recursive=True)  # -> Segments, Vertices
fmerge = MergeFaces(Brep=join_2.Breps)  # -> Breps, Before, After
neg_5 = Negative(Value=num_5)
item_7 = ListItem(List=sort_4.ValuesA, Index=0, Wrap=True)
ma_2 = MassAddition(Input=pshift)  # -> Result, PartialResults
ma_3 = MassAddition(Input=pshift_2)  # -> Result, PartialResults
Z_3 = UnitZ(Factor=1)
item_8 = ListItem(List=reverse(sort_3.ValuesC), Index=0, Wrap=True)
divide = DivideCurve(Curve=item_6, Count=c_script_13.N_Fins, Kinks=False)  # -> Points, Tangents, Parameters
item_9 = ListItem(List=sort_5.ValuesA, Index=0, Wrap=True)
curvepoint_2 = PointOnCurve(explode_4.Segments, parameter=0.5)
pshift_3 = ShiftPaths(Data=offset_2, Offset=-1)
pshift_4 = ShiftPaths(Data=offset_3, Offset=-1)
merge_6 = Merge(Data1=neg_5, Data2=num_5)
item_10 = ListItem(List=reverse(sort_3.ValuesA), Index=0, Wrap=True)
mesh = MeshBrep(
    Brep=fmerge.Breps,
    Settings={GridMaxCount=0, GridMinCount=16, JaggedSeams=False, MaxEdgeLength=0, MinEdgeLength=0.0001, MinTolerance=0, Refine=True, RefineAngle=0, RelativeTolerance=0.65, SimplePlanes=True, Tolerance=0})
Z_4 = UnitZ(Factor=Slider(1.05, range=0..10))
curvepoint_3 = PointOnCurve(crv_4, parameter=0.5)
vrot_3 = Rotate(Vector=graft(explode_5.Segments), Axis=Z_3, Angle=[1.570796327, -1.570796327])
curvepoint_4 = PointOnCurve(explode_5.Segments, parameter=0.5)
multiplication_4 = Multiplication(A=Z, B=1.2)
division_3 = Division(A=ma_3.Result, B=ma_2.Result)
disc_2 = Discontinuity(Curve=item_7, Level=1)  # -> Points, Parameters
amp_3 = Amplitude(Vector=item_5, Amplitude=c_script_13.Depth)
disc_3 = Discontinuity(Curve=crv_5, Level=1)  # -> Points, Parameters
pull_2 = PullPoint(Point=divide.Points, Geometry=item_8, ClosestOnly=True)  # -> ClosestPoint, Distance
pull_3 = PullPoint(Point=curvepoint_2, Geometry=item_7, ClosestOnly=True)  # -> ClosestPoint, Distance
len_5 = Length(Curve=pshift_4)
len_6 = Length(Curve=pshift_3)
offset_l_2 = OffsetCurveLoose(Curve=graft(explode_5.Segments), Distance=merge_5)
move_5 = Move(Geometry=item_10, Motion=Z_4)  # -> Geometry, Transform
offmsh = OffsetMesh(Mesh=mesh, Distance=merge_6, BothSides=False, CreateSolid=True)  # -> flatten(Offset)
move_6 = Move(Geometry=curvepoint_3, Motion=multiplication_4)  # -> Geometry, Transform
addition_3 = Addition(A=graft(curvepoint_4), B=vrot_3)
boundary_3 = BoundarySurfaces(Edges=rotate.Geometry)
Z_5 = UnitZ(Factor=1)
item_11 = ListItem(List=reverse(sort_3.ValuesA), Index=[0, 1], Wrap=True)
ln = Line(StartPoint=divide.Points, EndPoint=pull_2.ClosestPoint)
merge_7 = Merge(Data1=division_3, Data2=c_script_12.A)
subtraction_7 = Subtraction(A=pull_3.ClosestPoint, B=curvepoint_2)
sort_6 = SortList(Keys=len_5, ValuesA=pshift_4)  # -> Keys, reverse(ValuesA)
pull_4 = PullPoint(Point=disc_3.Points, Geometry=disc_2.Points, ClosestOnly=True)  # -> ClosestPoint, Distance
line = LineSDL(Start=disc_3.Points, Direction=Z_5, Length=item.Item3)
sort_7 = SortList(Keys=len_6, ValuesA=pshift_3)  # -> Keys, ValuesA
Z_6 = UnitZ(Factor=expr("-X", 0.1))
curvepoint_5 = PointOnCurve(offset_l_2, parameter=0.5)
divide_2 = DivideCurve(Curve=item_10, Count=1, Kinks=False)  # -> Points, Tangents, Parameters
tstat = TreeStatistics(Tree=move_6.Geometry)  # -> Paths, Length, Count
ma_4 = MassAddition(Input=flatten(merge_7))  # -> Result, PartialResults
volume = Volume(Geometry=offmsh)  # -> Volume, Centroid
curvepoint_6 = PointOnCurve(line, parameter=0.5)
vrot_4 = Rotate(Vector=subtraction_7, Axis=Z_5, Angle=-1.570796327)
subtraction_8 = Subtraction(A=disc_3.Points, B=pull_4.ClosestPoint)
pull_5 = PullPoint(Point=addition_3, Geometry=boundary_3, ClosestOnly=True)  # -> ClosestPoint, Distance
item_12 = ListItem(List=sort_7.ValuesA, Index=0, Wrap=True)
item_13 = ListItem(List=sort_6.ValuesA, Index=0, Wrap=True)
move_7 = Move(Geometry=move_5.Geometry, Motion=Z_6)  # -> Geometry, Transform
pull_6 = PullPoint(Point=curvepoint_5, Geometry=boundary_3, ClosestOnly=True)  # -> ClosestPoint, Distance
divide_3 = DivideCurve(Curve=move_5.Geometry, Count=1, Kinks=False)  # -> Points, Tangents, Parameters
dpath = DeconstructPath(Branch=tstat.Paths)  # -> simplify(Indices)
extr_3 = Extrude(Base=ln, Direction=amp_3)
sort_8 = SortList(Keys=volume.Volume, ValuesA=offmsh)  # -> Keys, ValuesA
division_4 = Division(A=ma_4.Result, B=4)
random = Random(Range=Domain(1000, 5000), Number=1, Seed=division_4)
sort_9 = SortList(Keys=pull_5.Distance, ValuesA=vrot_3)  # -> Keys, ValuesA
end = EndPoints(Curve=line)  # -> Start, End
line_2 = LineSDL(Start=curvepoint_2, Direction=vrot_4, Length=1)
pl_2 = ConstructPlane(Origin=curvepoint_6, XAxis=subtraction_8, YAxis=Z_5)
curvepoint_7 = PointOnCurve(item_11, parameter=0.451)
ln_2 = Line(StartPoint=divide_2.Points, EndPoint=divide_3.Points)
curvepoint_8 = PointOnCurve(move_7.Geometry, parameter=0.5)
sort_10 = SortList(Keys=pull_6.Distance, ValuesA=offset_l_2)  # -> Keys, ValuesA
Z_7 = UnitZ(Factor=1)
pshift_5 = ShiftPaths(Data=item_13, Offset=-1)
pshift_6 = ShiftPaths(Data=item_12, Offset=-1)
series_2 = Series(Start=0, Step=1, Count=Slider(4, range=0..10))
item_14 = ListItem(List=sort_8.ValuesA, Index=0, Wrap=True)
rotax = RotateAxis(Geometry=extr_3, Angle=degrees(item_3.Item6), Axis=ln)  # -> simplify(Geometry), Transform
item_15 = ListItem(List=dpath, Index=0, Wrap=True)  # -> Item, Item1
item_16 = ListItem(List=reverse(sort_9.ValuesA), Index=0, Wrap=True)  # -> flatten(Item)
project = Project(Geometry=item_9, Plane=PlaneXY(0, 0, 0))  # -> Geometry, Transform
boundary_4 = BoundarySurfaces(Edges=move_4.Geometry)
vrot_5 = Rotate(Vector=item_11, Axis=amp_3, Angle=-1.570796327)
item_17 = ListItem(List=reverse(sort_10.ValuesA), Index=0, Wrap=True)  # -> flatten(Item)
vrot_6 = Rotate(Vector=Z_7, Axis=amp_3, Angle=-1.570796327)
flip = FlipCurve(Curve=graft(explode_4.Segments), Guide=graft(line_2))  # -> flatten(Curve), Flag
pl_3 = ConstructPlane(Origin=curvepoint_2, XAxis=vrot_4, YAxis=subtraction_7)
merge_8 = Merge(Data1=pshift_6, Data2=reverse(pshift_5))  # -> simplify(Result)
format_3 = Format(Format="w  {1}", Culture=127, Data0=item_15.Item, Data1=item_15.Item1)
custom_round = CustomRound(Numbers=merge_7, Scope=0.01)
tstat_2 = TreeStatistics(Tree=merge_7)  # -> Paths, Length, Count
vrot_7 = Rotate(Vector=item_16, Axis=Vector(0, 0, 1), Angle=-1.570796327)
ln_3 = Line(StartPoint=project.Geometry, EndPoint=item_9)
end_2 = EndPoints(Curve=item_11)  # -> Start, End
pl_4 = ConstructPlane(Origin=curvepoint_7, XAxis=item_11, YAxis=vrot_5)
entwine = Entwine(
    Branch00=item.Item1,
    Branch01=item.Item2,
    Branch02=item.Item3,
    Branch03=ma.Result,
    Branch04=division_4,
    Branch05=random,
    FlattenInputs=True)
mesh_2 = MeshBrep(
    Brep=rotax.Geometry,
    Settings={GridMaxCount=0, GridMinCount=16, JaggedSeams=False, MaxEdgeLength=0, MinEdgeLength=0.0001, MinTolerance=0, Refine=True, RefineAngle=0, RelativeTolerance=0.65, SimplePlanes=True, Tolerance=0})
mesh_3 = MeshBrep(
    Brep=boundary_4,
    Settings={GridMaxCount=0, GridMinCount=16, JaggedSeams=False, MaxEdgeLength=0, MinEdgeLength=0.0001, MinTolerance=0, Refine=True, RefineAngle=0, RelativeTolerance=0.65, SimplePlanes=True, Tolerance=0})
end_3 = EndPoints(Curve=flip.Curve)  # -> Start, End
pl_5 = ConstructPlane(Origin=curvepoint_8, XAxis=vrot_6, YAxis=Z_7)
curvepoint_9 = PointOnCurve(item_17, parameter=0.5)
panel = Panel("""0 to 20
0 to 20
0 to 10
0 to 10
0 to 1
0 to 5000""")
crv_6 = Curve([move_7.Geometry, ln_2])
match_3 = MatchTree(Tree=simplify(format_3), Guide=simplify(move_6.Geometry))
format_4 = Format(Format="W {0} ", Culture=127, Data0=series_2)
panel_2 = Panel("""X Dim
Y Dim
Ceiling Height
Window Numbers
WWR
illuminance""")
end_4 = EndPoints(Curve=ln_3)  # -> Start, End
item_18 = ListItem(List=pl_4, Index=0, Wrap=True)
loft = Loft(Curves=merge_8, Options={Adjust=False, Closed=True, LoftEnds=0, LoftSimp=0, LoftType=3, Rebuild=10, Refit=0.01})
format_5 = Format(Format="  WWR = {0}", Culture=127, Data0=custom_round)
Z_8 = UnitZ(Factor=1)
merge_9 = Merge(Data1=flatten(end_3.Start), Data2=flatten(end.Start))
merge_10 = Merge(Data1=flatten(end_3.End), Data2=flatten(end.End))
swatch = ColourSwatch(SwatchColor=RGB(191, 0, 0))
merge_11 = Merge(Data1=pl_3, Data2=pl_2)
offmsh_2 = OffsetMesh(Mesh=mesh_2, Distance=Slider(0.01, range=0..0.01), BothSides=True, CreateSolid=True)  # -> flatten(Offset)
dedomain = DeconstructDomain(Domain=panel)  # -> Start, End
chart = CreateChart(Data=series_2, Names=format_4, ChartType=1)
random_2 = Random(Range=Domain(0, 1), Number=Slider(4, range=0..10), Seed=2)
pl_6 = ConstructPlane(Origin=curvepoint_9, XAxis=expr("-X", vrot_7), YAxis=Z_8)
remap = RemapNumbers(Value=entwine, Source=graft(panel), Target=Domain(0, 1))  # -> flatten(Mapped), Clipped
graft = GraftTree(Tree=pl_6, IncludeEmptyLists=True, IncludeNullItems=True)  # -> simplify(Tree)
lng_3 = ListLength(List=panel)
tag = TextTag3D(Location=pl_5, Text=match_3, Size=Slider(0.34, range=0..10), Colour=swatch, Justification=8)
previewlw = CustomPreviewLineweights(Geometry=crv_6, Shader=swatch, Absolute=False)
lng_4 = ListLength(List=panel_2)
lng_5 = ListLength(List=dedomain.End)
interpolate_color = InterpolateColor(
    Colors=[ColourSwatch(SwatchColor=RGB(191, 0, 0)), ColourSwatch(SwatchColor=RGB(0, 55, 255)), ColourSwatch(SwatchColor=RGB(0, 255, 179))],
    InterpolationParameters=random_2)
aligndim = AlignedDimension(
    Plane=item_18,
    PointA=end_4.Start,
    PointB=end_4.End,
    Offset=Slider(0.14, range=0..1),
    Text="{0:0.00}",
    Size=Slider(0.1, range=0..1))
aligndim_2 = AlignedDimension(
    Plane=pl_4,
    PointA=end_2.Start,
    PointB=end_2.End,
    Offset=Slider(0.24, range=0..1),
    Text="{0:0.00}",
    Size=Slider(0.1, range=0..1))
series_3 = Series(Start=0, Step=Slider(1.15, range=0..10), Count=lng_3)
branch = TreeBranch(Tree=graft, Path=tstat_2.Paths, MaintainPaths=True)
C = Count(lng_4)
C_2 = Count(lng_5)
preview = CustomPreview(Geometry=item_14, Material=ColourSwatch(SwatchColor=RGBA(186, 186, 186, 167)))
preview_2 = CustomPreview(Geometry=mesh_3, Material=ColourSwatch(SwatchColor=RGBA(0, 225, 255, 24)))
preview_3 = CustomPreview(Geometry=offmsh_2, Material=ColourSwatch(SwatchColor=RGB(110, 93, 24)))
preview_4 = CustomPreview(Geometry=loft, Material=ColourSwatch(SwatchColor=RGB(84, 84, 84)))
lng_6 = ListLength(List=explode_4.Segments)
tag_2 = TextTag3D(
    Location=branch,
    Text=format_5,
    Size=Slider(0.56, range=0..10),
    Colour=ColourSwatch(SwatchColor=RGB(191, 0, 0)),
    Justification=7)
chartappearance = ChartAppearance(ChartToModify=chart, Colors=interpolate_color)
dup_2 = DuplicateData(Data=Slider(125, range=0..200), Number=C, Order=True)
dup_3 = DuplicateData(Data=Slider(129, range=0..200), Number=C_2, Order=True)
aligndim_3 = AlignedDimension(
    Plane=merge_11,
    PointA=merge_9,
    PointB=merge_10,
    Offset=Slider(0.7, range=0..1),
    Text="{0:0.00}",
    Size=Slider(0.17, range=0..1))
pt = ConstructPoint(XCoordinate=series_3, YCoordinate=0, ZCoordinate=0)
Y = UnitY(Factor=1)
pt_2 = ConstructPoint(XCoordinate=series_3, YCoordinate=1, ZCoordinate=0)
expander_5 = CreateExpander(UIElements=chart, Header="WWR", Open=True)
setchart = SetChartContents(ChartToModify=chart, NewChartValues=flatten(custom_round), NewChartNames=format_4)
series_4 = Series(Start=0, Step=1, Count=lng_6)
subtraction_9 = Subtraction(A=lng_3, B=1)
label = CreateLabel(LabelText=panel_2, LabelSize=12, Justification=1)
series_5 = Series(Start=0, Step=1, Count=C)
label_2 = CreateLabel(LabelText=dedomain.End, LabelSize=12, Justification=1)
series_6 = Series(Start=0, Step=1, Count=C_2)
list = ValueList({"Centimeters Architectural", "Centimeters Large", "Centimeters Small", "Engrave", "Arial Bold"}, selected="Engrave")
line_3 = LineSDL(Start=pt, Direction=Y, Length=Slider(1, range=0..1))
panel_3 = Panel("""XSize
YSize
CeilingHeight
WindowNumbers
WWR
Illuminance""")
tag_3 = TextTag3D(
    Location=pl_6,
    Text=series_4,
    Size=Slider(1.03, range=0..10),
    Colour=ColourSwatch(SwatchColor=RGB(191, 0, 0)),
    Justification=9)
item_19 = ListItem(List=c_script_2.A, Index=0, Wrap=True)  # -> Item, Item1, Item2, Item3, Item4, Item5, Item6
custom_round_2 = CustomRound(Numbers=flatten(entwine), Scope=Slider(0.1, range=0..1))
rectangle_3 = Rectangle(Plane=PlaneXY(0, 0, 0), XSize=subtraction_9, YSize="1", Radius=0)  # -> Rectangle, Length
eval_2 = EvaluateCurve(Curve=reparameterize(line_3), Parameter=remap.Mapped)  # -> Point, Tangent, Angle
Y_2 = UnitY(Factor=Slider(0.17, range=0..1))
divide_4 = DivideCurve(Curve=line_3, Count=Slider(5, range=0..10), Kinks=False)  # -> Points, Tangents, Parameters
grid = CreateGrid(UIElements=label, ColumnDefinitions=dup_2, ElementColumn=series_5, ElementRowSpan=1, ElementColumnSpan=1)
grid_2 = CreateGrid(UIElements=label_2, ColumnDefinitions=dup_3, ElementColumn=series_6, ElementRowSpan=1, ElementColumnSpan=1)
merge_12 = Merge(
    Data1=c_script_4.A,
    Data2=c_script_6.A,
    Data3=c_script_7.A,
    Data4=c_script_9.A,
    Data5=item_19.Item4,
    Data6=item_19.Item5,
    Data7=item_19.Item6)
flip_2 = FlipMatrix(Data=divide_4.Points)
format_6 = Format(Format="{0}={1}", Culture=127, Data0=graft(panel_3), Data1=graft(custom_round_2))  # -> flatten(Text)
move_8 = Move(Geometry=eval_2.Point, Motion=Y_2)  # -> Geometry, Transform
text = DefineTextObject(Text=custom_round_2, Plane=move_8.Geometry, DimensionStyle=list, OutputType="Curve")
pline = PolyLine(Vertices=flip_2, Closed=False)
join_3 = TextJoin(Text=format_6, Join="+")
adjustpos_5 = AdjustElementPositioning(
    ElementsToAdjust=chart,
    Margin="0,0,0,0",
    AbsolutePositioning=toggle,
    Width=Slider(276, range=0..1000),
    Height=Slider(183, range=0..1000),
    HorizontalAlignment=Slider(0, range=0..10),
    VerticalAlignment=Slider(2, range=0..10))
scale = Scale(Geometry=text, Center=graft(move_8.Geometry), Factor=Slider(0.022, range=0..0.1))  # -> flatten(Geometry), Transform
dash = DashPattern(Curve=pline, Pattern=[Slider(0.006, range=0..0.02), Slider(0.02, range=0..0.1)])  # -> flatten(Dashes), Gaps
dash_2 = DashPattern(Curve=line_3, Pattern=[Slider(0.02, range=0..0.02), Slider(0.02, range=0..0.1)])  # -> flatten(Dashes), Gaps
pline_2 = PolyLine(Vertices=eval_2.Point, Closed=False)
pline_3 = PolyLine(Vertices=pt, Closed=False)
pline_4 = PolyLine(Vertices=pt_2, Closed=False)
cir = Circle(Plane=eval_2.Point, Radius=Slider(0.02, range=0..1))
entwine_2 = Entwine(Branch00=boundary, Branch01=move.Geometry, Branch02=mesh_3, Branch03=mesh, Branch04=mesh_2, FlattenInputs=True)
crv_7 = Curve(dash_2.Dashes)
bang = ExplodeTree(Data=entwine_2)  # -> Branch0, Branch1, Branch2, Branch3, Branch4

# ---- group: Window Propertices
item_20 = ListItem(List=merge_12, Index=0, Wrap=True)  # -> Item, Item1, Item2, Item3, Item4, Item5, Item6

# ----
crv_8 = Curve(flatten([crv_7, pline_3, pline_4, pline_2, cir, scale.Geometry, dash.Dashes]))

# ---- group: Floor
roof = Geometry(bang.Branch0)

# ---- group: Ceiling
geo = Geometry(bang.Branch1)

# ---- group: Window
geo_2 = Geometry(bang.Branch2)

# ---- group: Walls
geo_3 = Geometry(bang.Branch3)

# ---- group: Fins
geo_4 = Geometry(bang.Branch4)

# ----
number_slider_10 = Slider(114, range=0..1000)
shape = CreateShape(Shape=rectangle_3.Rectangle, StrokeColor=RGB(0, 0, 0), Scale=number_slider_10)

# ---- group: analysis grid
Z_9 = UnitZ(Factor="0.762")
move_9 = Move(Geometry=roof, Motion=Z_9)  # -> Geometry, Transform
c__0_003 = CSharpScript(gridSurface=move_9.Geometry, spacing=0.6096, offset="0.0254 * 10", complex=Toggle(False))  # -> out, A, B, nU, nV, E; inputs gridSurface: Brep, spacing: Double, offset: Double, complex: Boolean
# ---------- c__0_003: C# ----------
    Surface srf = gridSurface.Faces[0];

    double width = 0.0;
    double depth = 0.0;
    srf.GetSurfaceSize(out width, out depth);

    srf.SetDomain(0, new Interval(0, width));
    srf.SetDomain(1, new Interval(0, depth));

    int n_usteps = (int) (0.999999999 + (width - 2.0 * offset) / spacing);
    int n_vsteps = (int) (0.999999999 + (depth - 2.0 * offset) / spacing);
    double u_spacing = (width - 2.0 * offset) / n_usteps;
    double v_spacing = (depth - 2.0 * offset) / n_vsteps;

    Mesh m = new Mesh();

    for (int i = 0; i < n_usteps + 1; ++i) {
      for (int j = 0; j < n_vsteps + 1; ++j) {
        Point3d pt;
        Vector3d[] vv;
        srf.Evaluate(offset + i * u_spacing, offset + j * v_spacing, 0, out pt, out vv);
        m.Vertices.Add(pt.X, pt.Y, pt.Z);
      }
    }

    for (int j = 0; j < n_usteps ; ++j) {
      for (int i = 0; i < n_vsteps ; ++i) {
        m.Faces.AddFace(new MeshFace(i + j * (n_vsteps + 1), i + (j + 1) * (n_vsteps + 1), i + (j + 1) * (n_vsteps + 1) + 1, i + j * (n_vsteps + 1) + 1));
      }
    }


    // filter vertices outside of the trimmed surface
    if (complex) {
      bool[] validVertices = new bool[m.Vertices.Count];
      for (int i = 0; i < validVertices.Length; ++i) {
        validVertices[i] = false;
      }

      for (int i = 0; i < m.Vertices.Count; ++i) {
        foreach (BrepFace face in  gridSurface.Faces) {
          if (!face.IsValid) continue;

          double u, v;
          face.ClosestPoint(m.Vertices[i], out u, out v);
          PointFaceRelation pfr = face.IsPointOnFace(u, v);
          if (pfr == PointFaceRelation.Interior) {
            validVertices[i] = true;
            break;
          }
        }
      }

      List<int> cullVertices = new List<int>();
      for (int i = 0; i < validVertices.Length; ++i) {
        if (!validVertices[i]) {
          cullVertices.Add(i);
        }
      }

      m.Vertices.Remove(cullVertices, true);
    }

    m.RebuildNormals();


    A = m;
    B = m.Vertices;
    nU = n_usteps;
    nV = n_vsteps;
    E = srf;
# ---------- end c__0_003 ----------

# ----
flatten = FlattenTree(Tree=c_script_13.Spacing, Path="{0}")
flatten_2 = FlattenTree(Tree=item_20.Item5, Path="{0}")

area_4 = Area(Geometry=roof)  # -> Area, Centroid
xy = XYPlane(Origin=area_4.Centroid)
planesrf = PlaneSurface(Plane=xy, XSize="-500 To 500", YSize="-500 To 500")

number_slider_11 = Slider(0.05, range=0..1)
box = CenterBox(Base=PlaneXY(0, 0, 0), X=number_slider_11, Y=number_slider_11, Z=number_slider_11)

new_shape = Curve(flatten(crv_8))
panel_4 = Panel(flatten)
merge_13 = Merge(Data1=flatten(grid_2), Data2=flatten(shape), Data3=flatten(grid))
panel_5 = Panel(flatten_2)
merge_14 = Merge(
    Data1=Slider(0, range=0..1000),
    Data2=Slider(0, range=0..1000),
    Data3=Slider(0, range=0..1000),
    Data4=Slider(0, range=0..1000))
join_4 = TextJoin(Text=merge_14, Join=",")
expander_6 = CreateExpander(UIElements=flatten(merge_13), Header="parallel cordination", Open=True)
setshape = SetShape(
    ShapeToModify=shape,
    ShapeCurve=new_shape,
    StrokeWeight=Slider(1.3, range=0..2),
    StrokeColor=ColourSwatch(SwatchColor=RGB(10, 0, 0)),
    Scale=number_slider_10)
adjustpos_6 = AdjustElementPositioning(
    ElementsToAdjust=expander_6,
    Margin=join_4,
    AbsolutePositioning=Toggle(False),
    Width=Slider(709, range=0..1000),
    Height=Slider(197.838, range=150..250),
    HorizontalAlignment=Slider(0, range=0..10),
    VerticalAlignment=Slider(2, range=0..10))
predictda = PredictDAFromGeometryAndMaterialInputs(
    SensorsPositions=c__0_003.B,
    CeilingGeometries=geo,
    FloorGeometries=roof,
    WallsGeometries=geo_3,
    GlazingGeometries=geo_2,
    ShadingGeometries=geo_2,
    SurroundingGeometries=box,
    GroundSurface=planesrf,
    CeilingReflectance=Slider(0.5, range=0..1),
    FloorReflectance=Slider(0.2, range=0..1),
    WallsReflectance=Slider(0.5, range=0..1),
    GlazingTransparency=Slider(0.3, range=0..1),
    FinDepth=flatten_2,
    FinSpacing=flatten,
    ComputeSolution=Toggle(True),
    NumberOfThreads=-1,
    ProduceAdditionalDataForDebugging=False,
    IndexOfSensorToDebug=0,
    City="Boston")
remap_2 = RemapNumbers(Value=predictda, Source=Domain(0, 1), Target=Domain(1, 0))  # -> Mapped, Clipped
gradient = Gradient(
    LowerLimit=1,
    UpperLimit=0,
    Parameter=predictda,
    stops=[0: RGB(234, 38, 0), 0.25: RGB(234, 126, 0), 0.5: RGB(254, 244, 84), 0.75: RGB(173, 203, 249), 1: RGB(75, 107, 169)])
number_slider_12 = Slider(10, range=0..10)
mcol = MeshColours(Mesh=c__0_003.A, Colours=gradient)
Z_10 = UnitZ(Factor=Slider(0.8, range=0..10))
div_3 = DivideDomain(Domain=Domain(0, 1), Count=number_slider_12)
move_10 = Move(Geometry=mcol, Motion=Z_10)  # -> Geometry, Transform
fdom = FindDomain(Domains=div_3, Number=predictda, Strict=False)  # -> Index, Neighbour
range = Range(Domain=Domain(0, 1), Steps=expr("x-1", number_slider_12))
key_allocator = KeyAllocator(KeyTag=fdom.Index, Data=fdom.Index)  # -> BranchName, Data
gradient_2 = Gradient(
    LowerLimit=1,
    UpperLimit=0,
    Parameter=range,
    stops=[0: RGB(234, 38, 0), 0.25: RGB(234, 126, 0), 0.5: RGB(254, 244, 84), 0.75: RGB(173, 203, 249), 1: RGB(75, 107, 169)])
lng_7 = ListLength(List=flatten(key_allocator.Data))
lng_8 = ListLength(List=key_allocator.Data)
range_2 = Range(Domain=Domain(0, 20), Steps=expr("x-1", number_slider_12))
tstat_3 = TreeStatistics(Tree=key_allocator.Data)  # -> Paths, Length, Count
custom_round_3 = CustomRound(Numbers=range_2, Scope=1)
branch_2 = TreeBranch(Tree=simplify(graft(custom_round_3)), Path=tstat_3.Paths, MaintainPaths=True)  # -> flatten(Branch)
division_5 = Division(A=lng_8, B=lng_7)
branch_3 = TreeBranch(Tree=simplify(graft(gradient_2)), Path=tstat_3.Paths, MaintainPaths=True)  # -> flatten(Branch)
lng_9 = ListLength(List=branch_2)
multiplication_5 = Multiplication(A=division_5, B=100)
dup_4 = DuplicateData(Data="0.1", Number=number_slider_12, Order=True)
format_7 = Format(Format="{0}% ", Culture=127, Data0=branch_2)
custom_round_4 = CustomRound(Numbers=multiplication_5, Scope=1)
chart_2 = CreateChart(Data=div_3, Names=dup_4, ChartType=2)
relay = Relay([number_slider_4, Slider(326, range=0..1000)])
textbox_2 = CreateTextBox(Label="Image Name", DefaultText="image01", UpdateButton=True, showLabel=True)
setchart_2 = SetChartContents(ChartToModify=chart_2, NewChartValues=flatten(custom_round_4), NewChartNames=format_7)
expander_7 = CreateExpander(UIElements=chart_2, Header="Daylight Autonomy", Open=True)
merge_15 = Merge(
    Data1=flatten(expander),
    Data2=flatten(expander_2),
    Data3=flatten(expander_5),
    Data4=flatten(expander_3),
    Data5=flatten(expander_4),
    Data6=flatten(expander_7),
    Data7=flatten(expander_6))  # -> flatten(Result)
grid_3 = CreateGrid(
    UIElements=merge_15,
    Width=Slider(4060, range=0..5000),
    Height=Slider(4895, range=0..7000),
    RowDefinitions=flatten(relay),
    ColumnDefinitions=flatten([Slider(273, range=150..400), Slider(147, range=0..1000), Slider(290, range=0..1000)]),
    ElementRow=[Slider(0, range=0..2), Slider(0, range=0..2), Slider(0, range=0..2), Slider(1, range=0..3), Slider(1, range=0..2), Slider(1, range=0..3), Slider(2, range=0..3)],
    ElementColumn=[Slider(0, range=0..2), Slider(1, range=0..2), Slider(2, range=0..2), Slider(0, range=0..3), Slider(1, range=0..2), Slider(2, range=0..3), Slider(0, range=0..3)],
    ElementRowSpan=2,
    ElementColumnSpan=1)
chartappearance_2 = ChartAppearance(ChartToModify=chart_2, Colors=branch_3)
values_6 = ValueListener(Elements=textbox_2, SomeProperty=True)  # -> flatten(Values), Indices
button_2 = CreateButton(ButtonName="Save Alternative", ButtonStyle=0)
txt = Text(join_3)
txt_2 = Text(values_6.Values)
merge_16 = Merge(Data1=txt_2, Data2=txt)  # -> flatten(Result)
values_7 = ValueListener(Elements=button_2, SomeProperty=True)  # -> flatten(Values), Indices
adjustpos_7 = AdjustElementPositioning(
    ElementsToAdjust=grid_3,
    Margin="0,0,0,0",
    AbsolutePositioning=Toggle(True),
    Width=Slider(927, range=0..2000),
    Height=Slider(535, range=0..1000))
join_5 = TextJoin(Text=merge_16, Join="-")
num_6 = Number(number_slider_5)
grid_4 = CreateGrid(
    UIElements=[textbox_2, button_2],
    Width=Slider(5000, range=0..5000),
    Height=Slider(7000, range=0..7000),
    ColumnDefinitions=flatten([Slider(400, range=150..400), Slider(1000, range=0..1000)]),
    ElementColumn=[Slider(0, range=0..3), Slider(1, range=0..3)],
    ElementRowSpan=Slider(1, range=0..10),
    ElementColumnSpan=1)
c_script_14 = CSharpScript(takePic=values_7.Values, path="D:\SFU\MITACS\Parametric Room\New folder\images", fileName=join_5)  # -> out, A, B; inputs takePic: Boolean, path: String, fileName: String
# ---------- c_script_14: C# usings ----------
using System.Drawing;
using System.IO;
using System.Drawing.Imaging;
using System.Windows.Forms;
# ---------- c_script_14: C# ----------
    Bitmap screenshot = null;
    screenshot = CaptureScreen();

   if(takePic){
      string filePath = Path.Combine(path, fileName + ".jpg");
      screenshot.Save(filePath);
      B = filePath;
    }

    //A = screenshot;
# ---------- c_script_14: C# additional code ----------
  private Bitmap CaptureScreen()
  {
    Rectangle bounds = Screen.PrimaryScreen.Bounds;
    Bitmap screenshot = new Bitmap(bounds.Width, bounds.Height - 50, PixelFormat.Format32bppArgb);

    using (Graphics graphics = Graphics.FromImage(screenshot))
    {
      graphics.CopyFromScreen(bounds.X, bounds.Y, 0, 0, bounds.Size, CopyPixelOperation.SourceCopy);
    }

    return screenshot;
  }
  private Bitmap ResizeImage(Bitmap image, int width, int height)
  {
    Bitmap resizedImage = new Bitmap(width, height);
    using (Graphics graphics = Graphics.FromImage(resizedImage))
    {
      graphics.DrawImage(image, 0, 0, width, height);
    }
    return resizedImage;
  }
# ---------- end c_script_14 ----------
expander_8 = CreateExpander(UIElements=flatten(grid_4), Header="Capture Alternative", Open=True)
adjustpos_8 = AdjustElementPositioning(
    ElementsToAdjust=chart_2,
    Margin="0,0,0,0",
    AbsolutePositioning=Toggle(True),
    Width=Slider(289, range=0..1000),
    Height=Slider(267, range=0..1000),
    HorizontalAlignment=Slider(2, range=0..10),
    VerticalAlignment=Slider(0, range=0..10))
merge_17 = Merge(Data1=flatten(grid_3), Data2=flatten(expander_8), Data3=flatten(expander_6))
merge_18 = Merge(
    Data1=Slider(0, range=0..1000),
    Data2=Slider(0, range=0..1000),
    Data3=Slider(0, range=0..1000),
    Data4=Slider(0, range=0..1000))
join_6 = TextJoin(Text=merge_18, Join=",")
adjustpos_9 = AdjustElementPositioning(
    ElementsToAdjust=expander_8,
    Margin=join_6,
    AbsolutePositioning=Toggle(True),
    Width=Slider(709, range=0..1000),
    Height=Slider(73, range=0..1000),
    HorizontalAlignment=Slider(0, range=0..10),
    VerticalAlignment=Slider(2, range=0..10))
relay_2 = Relay([Slider(507, range=0..1000), Slider(199, range=0..1000), Slider(74, range=0..1000)])
grid_5 = CreateGrid(
    UIElements=merge_17,
    Width=Slider(5000, range=0..5000),
    Height=Slider(7000, range=0..7000),
    RowDefinitions=flatten(relay_2),
    ElementRow=[Slider(0, range=0..2), Slider(2, range=0..2), Slider(1, range=0..2)],
    ElementRowSpan=2,
    ElementColumnSpan=1)
launchwin = LaunchWindow(
    Show=Toggle(True),
    Name="Dashboard",
    Width=Slider(719, range=0..1000),
    Height=Slider(834, range=0..1000),
    ChildStatus=0,
    EnableHorizScroll=False)
adjustpos_10 = AdjustElementPositioning(
    ElementsToAdjust=grid_5,
    Margin="0,0,0,0",
    AbsolutePositioning=Toggle(True),
    Width=Slider(927, range=0..2000),
    Height=Slider(789, range=0..1000),
    HorizontalAlignment=0)
addelems = AddElements(Window=launchwin, Elements=grid_5, DoVLChecking=True)  # -> AddedElements, ElementNames
