# Grasshopper definition parametricRoom-V2-11.7.2023.gh (Grasshopper 1.0.7)
# plug-ins: ShapeDiverForGrasshopper

brep = Brep(<brep referenced from the Rhino model>)
number_slider = Slider(3.7, range=0..5)
Z = UnitZ(Factor=1)
contour = Contour(Shape=brep, Point=Point(0, 0, 0), Direction=Z, Distance=number_slider)
sddp = ShapeDiverDocumentPayload({AbsoluteTolerance=0, AngleTolerance=0, DistanceDisplayPrecision=0, GltfVersion="Gltf2", InputGroups="{}", OutputGroups="{}", RelativeTolerance=0, UnitSystem=0, VersionCreated="1.13.1.0", VersionSaved="1.13.1.0"})
amp = Amplitude(Vector=Z, Amplitude=number_slider)
extr = Extrude(Base=contour, Direction=amp)
item = ListItem(List=flatten(contour), Index=Slider(7, range=0..20), Wrap=True)
extr_2 = Extrude(Base=item, Direction=amp)
wallheight = Slider(3.2, range=0..10)
rotation_degree = Slider(360, range=0..360)
reset_button = Button()

# ---- group: Walls
list = ValueList({"Wall 0": 0, "Wall 1": 1, "Wall 2": 2, "Wall 3": 3}, selected=["Wall 0", "Wall 1"])

# ----
X = UnitX(Factor=Slider(37, range=0..100))

fins_rotation = Slider(0, range=-90..90)
winlength = Slider(3.3, range=0..6.5)
winheight = Slider(2.1, range=0..6.5)
verticalmovement = Slider(-0.14, range=-4..4)
fins_width = Slider(0.62, range=0..5)
fins_depth = Slider(0.31, range=0..5)
lateralmovement = Slider(0.12, range=-4..4)

preview = CustomPreview(
    Geometry=extr_2,
    Material={diffuse=RGB(221, 160, 221), emission=RGB(66, 48, 66), shine=0.5, specular=RGB(255, 255, 255), transparency=0})
move = Move(Geometry=item, Motion=X)  # -> Geometry, Transform
P = Plane(PlaneXY(0, 0, 0))

# ---- group: Windows
list_2 = ValueList({"Wall0- Win0": 0, "Wall0- Win1": 1, "Wall1- Win0": 2, "Wall1- Win1": 3, "Wall2- Win0": 4, "Wall3- Win0": 5}, selected=[])

# ----
rectangle = Rectangle(Plane=P, XSize=Slider(9.5, range=0..100), YSize=Slider(22.6, range=0..100), Radius=0)  # -> Rectangle, Length
crv = Curve(<curve referenced from the Rhino model>)
crv_2 = Curve(rectangle.Rectangle)
num = Number([winlength, winheight, lateralmovement, verticalmovement, fins_width, fins_depth, fins_rotation])
P_2 = Plane(PlaneXY(0, 0, 0))
polygon = Polygon(Plane=P_2, Radius=Slider(6.9, range=0..10), Segments=Slider(5, range=0..10), FilletRadius=0)  # -> Polygon, Length
pcen = PolygonCenter(Polyline=crv_2)  # -> CenterV, CenterE, CenterA
rotate = Rotate(Geometry=crv_2, Angle=degrees(rotation_degree), Plane=pcen.CenterE)  # -> Geometry, Transform
explode = Explode(Curve=rotate.Geometry, Recursive=True)  # -> Segments, Vertices
lng = ListLength(List=explode.Segments)
c_script = CSharpScript(
    Reset=reset_button,
    updatedWindowCount=Slider(2, range=0..10),
    branches=list_2,
    newNumbers=num,
    SelectedSubWinWalls=list,
    updatedWallCount=lng)  # -> out, A, B, C, D; inputs Reset: Boolean, updatedWindowCount: Int32, branches: list of Int32, newNumbers: list of Double, SelectedSubWinWalls: list of Int32, updatedWallCount: Int32
# ---------- c_script: C# ----------
    bool reset = false;
    if(Reset) reset = true;

    if( updatedWallCount == null) return;
    bool CheckifChanged = (updatedWallCount != WallCount);
    bool CheckifChangedSubWin = (updatedWindowCount != WindowCount);
    WallCount = updatedWallCount;
    WindowCount = updatedWindowCount;

    //Define each wall has how many windows
    if(reset){
      wallSubWinsList.Clear();
      for(int i = 0;i < updatedWallCount ;i++)
        wallSubWinsList.Add(1);
    }



    //updating each wall has how many windows
    if(SelectedSubWinWalls != null)
    {
      for(int i = 0; i < SelectedSubWinWalls.Count ;i++)
        if(SelectedSubWinWalls[i] < wallSubWinsList.Count)
          wallSubWinsList[SelectedSubWinWalls[i]] = updatedWindowCount;
    }



    //updating branch paths
    List<string> opts1 = new List<string> ();
    for(int i = 0 ;i < updatedWallCount ;i++){
      if(wallSubWinsList.Count == updatedWallCount){
        for(int j = 0 ;j < wallSubWinsList[i] ;j++){
          opts1.Add(i.ToString() + "-" + j.ToString());
        }
      }
    }


    if(reset || CheckifChanged || CheckifChangedSubWin){
      AllInitialNumbers.ClearData();
      for(int i = 0 ;i < opts1.Count;i++){
        var brancheNames = opts1[i].Split('-');
        AllInitialNumbers.AddRange(Numbers, new GH_Path(new int[2]{Int32.Parse(brancheNames[0]),Int32.Parse(brancheNames[1])}));
      }
    }




    if( CheckifChanged){
      valList2 = (Grasshopper.Kernel.Special.GH_ValueList) this.Component.Params.Input[4].Sources[0];
      if(valList2 != null){
        opts = opts1;
        this.GrasshopperDocument.ScheduleSolution(10, SolutionCallback2);
      }
    }



    //Updating value list of Windows
    if(reset || CheckifChangedSubWin){
      valList = (Grasshopper.Kernel.Special.GH_ValueList) this.Component.Params.Input[2].Sources[0];
      if(valList != null){
        opts = opts1;
        this.GrasshopperDocument.ScheduleSolution(20, SolutionCallback);
      }
    }




    B = wallSubWinsList;

    ///////////////////////////////////

    //Numbers = initialNumbers.ToArray();

    ///Adding initial input values to branches



    D = AllInitialNumbers;


    ///Regenerating input Values based on new numbers
    for(int j = 0 ;j < branches.Count;j++){
      var brancheNames = opts1[branches[j]].Split('-');
      var path = new GH_Path(new int[2]{Int32.Parse(brancheNames[0]),Int32.Parse(brancheNames[1])});
      if(AllInitialNumbers.PathExists(path)){
        AllInitialNumbers.Branch(path).Clear();
        AllInitialNumbers.AddRange(newNumbers, new GH_Path(path));
      }
    }

    C = opts1;

    A = AllInitialNumbers;

    //D = AllInitialNumbers;

    ///*
    ///Removing empty branches
    List<GH_Path> allBranchePathes = new List<GH_Path>();
    for(int i = 0 ;i < AllInitialNumbers.BranchCount ;i++){
      allBranchePathes.Add(AllInitialNumbers.Path(i));
    }
    for(int i = 0 ;i < allBranchePathes.Count ;i++){
      if(AllInitialNumbers.Branch(allBranchePathes[i]) != null){
        bool flag = AllInitialNumbers.Branch(allBranchePathes[i]).Count == 0;
        if(flag)
          AllInitialNumbers.RemovePath(allBranchePathes[i]);
      }
    }

    //*/

    reset = false;


    n++;
# ---------- c_script: C# additional code ----------
  int n = 0;
  int WallCount = 4;
  int WindowCount ;
  double[] Numbers = new double[7]{2,2,0,0,0.1,0.1,0};
  DataTree<double> AllInitialNumbers = new DataTree<double>();
  /////////////////////////////
  public bool oldstate = false;
  public Grasshopper.Kernel.Special.GH_ValueList valList;
  public Grasshopper.Kernel.Special.GH_ValueList valList2;
  public List<string> opts;

  private void SolutionCallback(GH_Document document){
    valList.ListItems.Clear();
    for (int i = 0; i < opts.Count; i++){
      var brancheNames = opts[i].Split('-');
      valList.ListItems.Add(new Grasshopper.Kernel.Special.GH_ValueListItem("Wall" + brancheNames[0] + "- Win" + brancheNames[1], i.ToString()));
    }
    valList.ExpireSolution(true);
  }
  ////////////////////////
  ////////////////////////

  public List<string> opts2;
  public List<string> vals2;

  List<int> wallSubWinsList = new List<int>();
  private void SolutionCallback2(GH_Document document){
    valList2.ListItems.Clear();
    for (int i = 0; i < WallCount; i++){
      valList2.ListItems.Add(new Grasshopper.Kernel.Special.GH_ValueListItem("Wall " + i.ToString(), i.ToString()));
    }
    valList2.ExpireSolution(true);
  }
# ---------- end c_script ----------
wall_thickness = Panel("0.15")
ceiling_thickness = Panel("0.15")
panel = Panel(c_script.A)
expression = Expression(a=c_script.B, Expression="if(a=0,1,a)")
crv_3 = Curve(simplify(graft(explode.Segments)))
div = DivideDomain(Domain=Domain(0, 1), Count=c_script.B)
div_2 = DivideDomain(Domain=Domain(0, 1), Count=expression)
subcrv = SubCurve(BaseCurve=reparameterize(simplify(crv_3)), Domain=simplify(div))  # -> graft(Curve)
subcrv_2 = SubCurve(BaseCurve=reparameterize(simplify(crv_3)), Domain=simplify(div_2))  # -> simplify(graft(Curve))
clean = CleanTree(RemoveNulls=True, RemoveInvalid=True, RemoveEmpty=True, Tree=subcrv)
lng_2 = ListLength(List=subcrv)
equals = Equality(FirstNumber=lng_2, SecondNumber=0)  # -> Equality, Inequality
cull = CullPattern(List=subcrv_2, CullPattern=equals.Equality)
Z_2 = UnitZ(Factor=wallheight)
boundary = BoundarySurfaces(Edges=rotate.Geometry)
move_2 = Move(Geometry=boundary, Motion=Z_2)  # -> Geometry, Transform
srf = Surface([move_2.Geometry, boundary])
item_2 = ListItem(List=c_script.A, Index=0, Wrap=True)  # -> Item, Item1, Item2, Item3, Item4, Item5, Item6
merge = Merge(Data1=simplify(clean), Data2=simplify(cull))
num_2 = Number(item_2.Item2)
num_3 = Number(item_2.Item)
crv_4 = Curve(clean)
len = Length(Curve=crv_4)
multiplication = Multiplication(A=wall_thickness, B=2)
multiplication_2 = Multiplication(A=ceiling_thickness, B=2)
subtraction = Subtraction(A=len, B=multiplication)
num_4 = Number(item_2.Item1)
subtraction_2 = Subtraction(A=wallheight, B=multiplication_2)
c_script_2 = CSharpScript(x=num_3, y=subtraction)  # -> out, A; inputs x: Double
# ---------- c_script_2: C# ----------
    double Number = 0;
    if(x >= y.Max)
      Number = y.Max;
    else if(x<= y.Min)
      Number = y.Min;
    else
      Number = x;
    
    A = Number;
# ---------- end c_script_2 ----------
c_script_3 = CSharpScript(x=num_4, y=subtraction_2)  # -> out, A; inputs x: Double; same code as c_script_2
num_5 = Number(item_2.Item3)
subtraction_3 = Subtraction(A=subtraction, B=c_script_2.A)
panel_2 = Panel(clean)
subtraction_4 = Subtraction(A=wallheight, B=c_script_3.A)
c_script_4 = CSharpScript(x=subtraction_3)  # -> out, A; inputs x: Double
# ---------- c_script_4: C# ----------
    x = x / 2;
    Interval Intrvl = new Interval(-x, x);
    A = Intrvl;
# ---------- end c_script_4 ----------
subtraction_5 = Subtraction(A=subtraction_4, B=multiplication_2)
c_script_5 = CSharpScript(x=subtraction_5)  # -> out, A; inputs x: Double; same code as c_script_4
c_script_6 = CSharpScript(x=num_2, y=c_script_4.A)  # -> out, A; inputs x: Double; same code as c_script_2
len_2 = Length(Curve=crv_4)
offset_l = OffsetCurveLoose(Curve=rotate.Geometry, Distance=[1, -1])
viewer = ParamViewer(subtraction_3)
division = Division(A=c_script_6.A, B=len_2)
c_script_7 = CSharpScript(x=num_5, y=c_script_5.A)  # -> out, A; inputs x: Double; same code as c_script_2
division_2 = Division(A=wallheight, B=2)
len_3 = Length(Curve=offset_l)
sort = SortList(Keys=len_3, ValuesA=offset_l)  # -> Keys, ValuesA
addition = Addition(A=division, B="0.5")
item_3 = ListItem(List=sort.ValuesA, Index=0, Wrap=True)
addition_2 = Addition(A=division_2, B=c_script_7.A)
eval = EvaluateCurve(Curve=reparameterize(crv_4), Parameter=addition)  # -> Point, Tangent, Angle
pull = PullPoint(Point=eval.Point, Geometry=item_3, ClosestOnly=True)  # -> ClosestPoint, Distance
Z_3 = UnitZ(Factor=1)
subtraction_6 = Subtraction(A=pull.ClosestPoint, B=eval.Point)
vrot = Rotate(Vector=eval.Tangent, Axis=Z_3, Angle=[-1.570796327, 1.570796327])
angle = Angle(VectorA=subtraction_6, VectorB=vrot)  # -> Angle, Reflex
sort_2 = SortList(Keys=angle.Angle, ValuesA=vrot)  # -> Keys, reverse(ValuesA)
multiplication_3 = Multiplication(A=Z_3, B=addition_2)
dom = ConstructDomain(DomainStart="0.05", DomainEnd=num_3)
item_4 = ListItem(List=sort_2.ValuesA, Index=0, Wrap=True)
vrot_2 = Rotate(Vector=Z_3, Axis=item_4, Angle=-1.570796327)
c_script_8 = CSharpScript(x=item_2.Item4, y=dom)  # -> out, A; inputs x: Double; same code as c_script_2
c_script_9 = CSharpScript(x=c_script_2.A)  # -> out, A; inputs x: Double; same code as c_script_4
move_3 = Move(Geometry=eval.Point, Motion=multiplication_3)  # -> Geometry, Transform
crv_5 = Curve(clean)
c_script_10 = CSharpScript(x=c_script_3.A)  # -> out, A; inputs x: Double; same code as c_script_4
pl = ConstructPlane(Origin=move_3.Geometry, XAxis=vrot_2, YAxis=Z_3)
match = MatchTree(Tree=pl, Guide=c_script_9.A)
rectangle_2 = Rectangle(Plane=match, XSize=c_script_9.A, YSize=c_script_10.A, Radius=0)  # -> simplify(Rectangle), Length
extr_3 = Extrude(Base=crv_5, Direction=Z_2)
clean_2 = CleanTree(RemoveNulls=True, RemoveInvalid=True, RemoveEmpty=True, Tree=cull)
area = Area(Geometry=rectangle_2.Rectangle)  # -> Area, Centroid
larger = LargerThan(FirstNumber=area.Area, SecondNumber=0.1)  # -> LargerThan, OrEqualTo
extr_4 = Extrude(Base=clean_2, Direction=Z_2)
curvepoint = PointOnCurve(crv_5, parameter=0.5)
cull_2 = CullPattern(List=rectangle_2.Rectangle, CullPattern=larger.LargerThan)
multiplication_4 = Multiplication(A=Z_2, B=1.2)
join = JoinCurves(Curves=extr_3, Preserve=False)  # -> simplify(Curves)
explode_2 = Explode(Curve=cull_2, Recursive=True)  # -> Segments, Vertices
move_4 = Move(Geometry=curvepoint, Motion=multiplication_4)  # -> Geometry, Transform
curvepoint_2 = PointOnCurve(explode_2.Segments, parameter=0.5)
pdecon = Deconstruct(Point=curvepoint_2)  # -> XComponent, YComponent, ZComponent
tstat = TreeStatistics(Tree=move_4.Geometry)  # -> Paths, Length, Count
merge_2 = Merge(Data1=cull_2, Data2=join, Data3=extr_4)
sort_3 = SortList(Keys=pdecon.ZComponent, ValuesA=explode_2.Segments)  # -> Keys, ValuesA
dpath = DeconstructPath(Branch=tstat.Paths)  # -> simplify(Indices)
division_3 = Division(A=c_script_2.A, B=c_script_8.A)
boundary_2 = BoundarySurfaces(Edges=merge_2)
item_5 = ListItem(List=reverse(sort_3.ValuesA), Index=0, Wrap=True)
item_6 = ListItem(List=sort_3.ValuesA, Index=0, Wrap=True)
round = Round(Number=division_3)  # -> Nearest, Floor, Ceiling
item_7 = ListItem(List=dpath, Index=0, Wrap=True)  # -> Item, Item1
format = Format(Format="{0} - Win{1}", Culture=127, Data0=item_7.Item, Data1=item_7.Item1)
divide = DivideCurve(Curve=item_6, Count=round.Floor, Kinks=False)  # -> Points, Tangents, Parameters
match_2 = MatchTree(Tree=simplify(format), Guide=simplify(move_4.Geometry))
pull_2 = PullPoint(Point=divide.Points, Geometry=item_5, ClosestOnly=True)  # -> ClosestPoint, Distance
tstat_2 = TreeStatistics(Tree=match_2)  # -> flatten(Paths), Length, Count
item_8 = ListItem(List=reverse(sort_3.ValuesA), Index=[0, 1], Wrap=True)
ln = Line(StartPoint=divide.Points, EndPoint=pull_2.ClosestPoint)
dpath_2 = DeconstructPath(Branch=tstat_2.Paths)
amp_2 = Amplitude(Vector=item_4, Amplitude=item_2.Item5)
item_9 = ListItem(List=dpath_2, Index=0, Wrap=True)
bnd = Bounds(Numbers=flatten(item_9))
extr_5 = Extrude(Base=ln, Direction=amp_2)
srf_2 = Surface(srf)
curvepoint_3 = PointOnCurve(item_8, parameter=0.451)
remap = RemapNumbers(Value=item_9, Source=bnd, Target=Domain(0, 1))  # -> Mapped, Clipped
vrot_3 = Rotate(Vector=item_8, Axis=amp_2, Angle=-1.570796327)
rotax = RotateAxis(Geometry=extr_5, Angle=degrees(item_2.Item6), Axis=ln)  # -> simplify(Geometry), Transform
brep_2 = Brep(simplify(boundary_2))
gradient = Gradient(
    LowerLimit=0,
    UpperLimit=1,
    Parameter=remap.Mapped,
    stops=[0: RGB(234, 38, 0), 0.25: RGB(234, 126, 0), 0.5: RGB(125, 122, 77), 0.75: RGB(87, 112, 148), 1: RGB(75, 107, 169)])
pl_2 = ConstructPlane(Origin=curvepoint_3, XAxis=item_8, YAxis=vrot_3)
end = EndPoints(Curve=item_8)  # -> Start, End
merge_3 = Merge(Data1=brep_2, Data2=rotax.Geometry)
tag = TextTag(Location=move_4.Geometry, Text=match_2, Colour=graft(ColourSwatch(SwatchColor=RGB(0, 0, 0))))
aligndim = AlignedDimension(
    Plane=pl_2,
    PointA=end.Start,
    PointB=end.End,
    Offset=Slider(0.38, range=0..1),
    Text="{0:0.00}",
    Size=Slider(0.15, range=0..1))
preview_2 = CustomPreview(Geometry=merge_3, Material=ColourSwatch(SwatchColor=RGB(126, 128, 85)))
