# Grasshopper definition parametricRoom-V3-13.7.2023.gh (Grasshopper 1.0.7)

# ---- group: Window Propertises
verticalmovement = Slider(0, range=-4..4)
winlength = Slider(6.5, range=0..6.5)
winheight = Slider(2.8, range=0..6.5)
lateralmovement = Slider(0, range=-4..4)
fins_width = Slider(0.28, range=0..5)
fins_depth = Slider(0.28, range=0..5)
number_slider = Slider(-52, range=-90..90)

# ---- group: Number of windows on
wall_0 = Slider(3, range=0..5)
wall_1 = Slider(2, range=0..5)
wall_2 = Slider(1, range=0..5)
wall_2_2 = Slider(4, range=0..5)

# ---- group: Room Propertises
rotation_degree = Slider(360, range=0..360)
room_length = Slider(8.9, range=0..10)
romm_width = Slider(7.4, range=0..10)
wall_height = Slider(3.2, range=0..10)

# ----
list = ValueList({"Wall 0": 0, "Wall 1": 1, "Wall 2": 2, "Wall 3": 3}, selected="Wall 2")
int = Integer([wall_0, wall_1, wall_2, wall_2_2])
num = Number([winlength, winheight, lateralmovement, verticalmovement, fins_width, fins_depth, number_slider])
rectangle = Rectangle(Plane=PlaneXY(0, 0, 0), XSize=room_length, YSize=romm_width, Radius=0)  # -> Rectangle, Length
c_script = CSharpScript(Reset=Toggle(True), branches=list, newNumbers=num)  # -> out, A, B; inputs Reset: Boolean, branches: list of Int32, newNumbers: list of Double
# ---------- c_script: C# ----------
    if(reset && Reset){
      AllInitialNumbers.ClearData();
      for(int i = 0 ;i < 4;i++){
        AllInitialNumbers.AddRange(Numbers, new GH_Path(i));
      }
      reset = false;
    }

    if(!Reset)
    {
      reset = true;
      AllInitialNumbers.ClearData();
    }


    if(Reset){
      for(int j = 0 ;j < branches.Count;j++){
        AllInitialNumbers.RemovePath(branches[j]);
        AllInitialNumbers.AddRange(newNumbers, new GH_Path(branches[j]));
      }
    }




    ///Removing empty branches
    List<GH_Path> allBranchePathes = new List<GH_Path>();
    for(int i = 0 ;i < AllInitialNumbers.BranchCount ;i++){
      allBranchePathes.Add(AllInitialNumbers.Path(i));
    }
    for(int i = 0 ;i < allBranchePathes.Count ;i++){
      if(AllInitialNumbers.Branch(allBranchePathes[i]) != null){
        bool flag = AllInitialNumbers.Branch(allBranchePathes[i]).Count == 0;
        if(flag)
          AllInitialNumbers.RemovePath(allBranchePathes[i]);
      }
    }

    A = AllInitialNumbers;
    B = n;
# ---------- c_script: C# additional code ----------
  public bool reset = true;

  public int n = 0;
  double[] Numbers = new double[7]{2,2,0,0,0.1,0.1,0};
  DataTree<double> AllInitialNumbers = new DataTree<double>();
# ---------- end c_script ----------
int_2 = Integer(int)
pcen = PolygonCenter(Polyline=rectangle.Rectangle)  # -> CenterV, CenterE, CenterA
ceiling_thickness = Panel("0.15")
wall_thickness = Panel("0.15")
rotate = Rotate(Geometry=rectangle.Rectangle, Angle=degrees(rotation_degree), Plane=pcen.CenterV)  # -> Geometry, Transform
item = ListItem(List=c_script.A, Index=0, Wrap=True)  # -> Item, Item1, Item2, Item3, Item4, Item5, Item6
explode = Explode(Curve=rotate.Geometry, Recursive=True)  # -> Segments, Vertices
crv = Curve(simplify(graft(explode.Segments)))
expression = Expression(a=int_2, Expression="if(a=0,1,a)")
Z = UnitZ(Factor=wall_height)
boundary = BoundarySurfaces(Edges=rotate.Geometry)
move = Move(Geometry=boundary, Motion=Z)  # -> Geometry, Transform
div = DivideDomain(Domain=Domain(0, 1), Count=int_2)
div_2 = DivideDomain(Domain=Domain(0, 1), Count=expression)
srf = Surface([move.Geometry, boundary])
subcrv = SubCurve(BaseCurve=reparameterize(simplify(crv)), Domain=simplify(div))  # -> graft(Curve)
subcrv_2 = SubCurve(BaseCurve=reparameterize(simplify(crv)), Domain=simplify(div_2))  # -> simplify(graft(Curve))
clean = CleanTree(RemoveNulls=True, RemoveInvalid=True, RemoveEmpty=True, Tree=subcrv)
lng = ListLength(List=subcrv)
crv_2 = Curve(clean)
num_2 = Number(item.Item)
num_3 = Number(item.Item2)
equals = Equality(FirstNumber=lng, SecondNumber=0)  # -> Equality, Inequality
cull = CullPattern(List=subcrv_2, CullPattern=equals.Equality)
tstat = TreeStatistics(Tree=crv_2)  # -> Paths, Length, Count
item_2 = ListItem(List=tstat.Paths, Index=0, Wrap=True)
dpath = DeconstructPath(Branch=item_2)
lng_2 = ListLength(List=dpath)
larger = LargerThan(FirstNumber=lng_2, SecondNumber=1)  # -> LargerThan, OrEqualTo
pshift = ShiftPaths(Data=crv_2, Offset=-1)
B = B(2)
filter = StreamFilter(Gate=larger.LargerThan, Stream0=crv_2, Stream1=pshift)
tstat_2 = TreeStatistics(Tree=filter)  # -> Paths, Length, Count
multiplication = Multiplication(A=wall_thickness, B=B)
len = Length(Curve=filter)
multiplication_2 = Multiplication(A=ceiling_thickness, B=2)
branch = TreeBranch(Tree=num_2, Path=tstat_2.Paths, MaintainPaths=True)
subtraction = Subtraction(A=len, B=multiplication)
branch_2 = TreeBranch(Tree=item.Item4, Path=tstat_2.Paths, MaintainPaths=True)
num_4 = Number(item.Item1)
subtraction_2 = Subtraction(A=wall_height, B=multiplication_2)
c_script_2 = CSharpScript(x=branch, y=subtraction)  # -> out, A; inputs x: Double
# ---------- c_script_2: C# ----------
    double Number = 0;
    if(x >= y.Max)
      Number = y.Max;
    else if(x<= y.Min)
      Number = y.Min;
    else
      Number = x;
    
    A = Number;
# ---------- end c_script_2 ----------
c_script_3 = CSharpScript(x=num_4, y=subtraction_2)  # -> out, A; inputs x: Double; same code as c_script_2
num_5 = Number(item.Item3)
subtraction_3 = Subtraction(A=subtraction, B=c_script_2.A)
subtraction_4 = Subtraction(A=wall_height, B=c_script_3.A)
subtraction_5 = Subtraction(A=subtraction_4, B=multiplication_2)
c_script_4 = CSharpScript(x=subtraction_3)  # -> out, A; inputs x: Double
# ---------- c_script_4: C# ----------
    x = x / 2;
    Interval Intrvl = new Interval(-x, x);
    A = Intrvl;
# ---------- end c_script_4 ----------
branch_3 = TreeBranch(Tree=num_3, Path=tstat_2.Paths, MaintainPaths=True)
c_script_5 = CSharpScript(x=subtraction_5)  # -> out, A; inputs x: Double; same code as c_script_4
offset_l = OffsetCurveLoose(Curve=rotate.Geometry, Distance=[1, -1])
len_2 = Length(Curve=filter)
c_script_6 = CSharpScript(x=branch_3, y=c_script_4.A)  # -> out, A; inputs x: Double; same code as c_script_2
c_script_7 = CSharpScript(x=c_script_3.A)  # -> out, A; inputs x: Double; same code as c_script_4
c_script_8 = CSharpScript(x=num_5, y=c_script_5.A)  # -> out, A; inputs x: Double; same code as c_script_2
division = Division(A=wall_height, B=2)
len_3 = Length(Curve=offset_l)
division_2 = Division(A=c_script_6.A, B=len_2)
sort = SortList(Keys=len_3, ValuesA=offset_l)  # -> Keys, ValuesA
addition = Addition(A=division, B=c_script_8.A)
addition_2 = Addition(A=division_2, B="0.5")
item_3 = ListItem(List=sort.ValuesA, Index=0, Wrap=True)
branch_4 = TreeBranch(Tree=addition, Path=tstat_2.Paths, MaintainPaths=True)
eval = EvaluateCurve(Curve=reparameterize(filter), Parameter=addition_2)  # -> Point, Tangent, Angle
branch_5 = TreeBranch(Tree=c_script_7.A, Path=tstat_2.Paths, MaintainPaths=True)
pull = PullPoint(Point=eval.Point, Geometry=item_3, ClosestOnly=True)  # -> ClosestPoint, Distance
dom = ConstructDomain(DomainStart="0.05", DomainEnd=branch)
Z_2 = UnitZ(Factor=1)
c_script_9 = CSharpScript(x=branch_2, y=dom)  # -> out, A; inputs x: Double; same code as c_script_2
subtraction_6 = Subtraction(A=pull.ClosestPoint, B=eval.Point)
vrot = Rotate(Vector=eval.Tangent, Axis=Z_2, Angle=[-1.570796327, 1.570796327])
angle = Angle(VectorA=subtraction_6, VectorB=vrot)  # -> Angle, Reflex
multiplication_3 = Multiplication(A=Z_2, B=branch_4)
sort_2 = SortList(Keys=angle.Angle, ValuesA=vrot)  # -> Keys, reverse(ValuesA)
item_4 = ListItem(List=sort_2.ValuesA, Index=0, Wrap=True)
move_2 = Move(Geometry=eval.Point, Motion=multiplication_3)  # -> Geometry, Transform
vrot_2 = Rotate(Vector=Z_2, Axis=item_4, Angle=-1.570796327)
crv_3 = Curve(filter)
c_script_10 = CSharpScript(x=c_script_2.A)  # -> out, A; inputs x: Double; same code as c_script_4
pl = ConstructPlane(Origin=move_2.Geometry, XAxis=vrot_2, YAxis=Z_2)
extr = Extrude(Base=crv_3, Direction=Z)
amp = Amplitude(Vector=item_4, Amplitude=item.Item5)
tstat_3 = TreeStatistics(Tree=extr)  # -> Paths, Length, Count
rectangle_2 = Rectangle(Plane=pl, XSize=c_script_10.A, YSize=branch_5, Radius=0)  # -> simplify(Rectangle), Length
branch_6 = TreeBranch(Tree=amp, Path=tstat_3.Paths, MaintainPaths=True)
area = Area(Geometry=rectangle_2.Rectangle)  # -> Area, Centroid
larger_2 = LargerThan(FirstNumber=area.Area, SecondNumber=0.1)  # -> LargerThan, OrEqualTo
cull_2 = CullPattern(List=rectangle_2.Rectangle, CullPattern=larger_2.LargerThan)
clean_2 = CleanTree(RemoveNulls=True, RemoveInvalid=True, RemoveEmpty=True, Tree=cull)
extr_2 = Extrude(Base=clean_2, Direction=Z)
join = JoinCurves(Curves=extr, Preserve=False)  # -> simplify(Curves)
curvepoint = PointOnCurve(crv_3, parameter=0.5)
multiplication_4 = Multiplication(A=Z, B=1.2)
explode_2 = Explode(Curve=cull_2, Recursive=True)  # -> Segments, Vertices
curvepoint_2 = PointOnCurve(explode_2.Segments, parameter=0.5)
move_3 = Move(Geometry=curvepoint, Motion=multiplication_4)  # -> Geometry, Transform
merge = Merge(Data1=graft(cull_2), Data2=graft(join), Data3=extr_2)
pdecon = Deconstruct(Point=curvepoint_2)  # -> XComponent, YComponent, ZComponent
tstat_4 = TreeStatistics(Tree=move_3.Geometry)  # -> Paths, Length, Count
sort_3 = SortList(Keys=pdecon.ZComponent, ValuesA=explode_2.Segments)  # -> Keys, ValuesA
dpath_2 = DeconstructPath(Branch=tstat_4.Paths)  # -> simplify(Indices)
division_3 = Division(A=c_script_2.A, B=c_script_9.A)
boundary_2 = BoundarySurfaces(Edges=merge)
item_5 = ListItem(List=reverse(sort_3.ValuesA), Index=0, Wrap=True)
round = Round(Number=division_3)  # -> Nearest, graft(Floor), Ceiling
item_6 = ListItem(List=sort_3.ValuesA, Index=0, Wrap=True)
item_7 = ListItem(List=dpath_2, Index=0, Wrap=True)  # -> Item, Item1
divide = DivideCurve(Curve=simplify(item_6), Count=simplify(round.Floor), Kinks=False)  # -> simplify(Points), Tangents, Parameters
branch_7 = TreeBranch(Tree=item.Item6, Path=tstat_3.Paths, MaintainPaths=True)
lng_3 = ListLength(List=cull_2)
dup = DuplicateData(Data=branch_7, Number=lng_3, Order=True)  # -> simplify(graft(Data))
pull_2 = PullPoint(Point=divide.Points, Geometry=item_5, ClosestOnly=True)  # -> ClosestPoint, Distance
dup_2 = DuplicateData(Data=branch_6, Number=lng_3, Order=True)  # -> simplify(graft(Data))
ln = Line(StartPoint=divide.Points, EndPoint=pull_2.ClosestPoint)
extr_3 = Extrude(Base=ln, Direction=dup_2)
brep = Brep(simplify(boundary_2))
format = Format(Format="{0} - Win{1}", Culture=127, Data0=item_7.Item, Data1=item_7.Item1)
rotax = RotateAxis(Geometry=simplify(extr_3), Angle=degrees(dup), Axis=ln)  # -> simplify(Geometry), Transform
match = MatchTree(Tree=simplify(format), Guide=simplify(move_3.Geometry))
tstat_5 = TreeStatistics(Tree=match)  # -> flatten(Paths), Length, Count
item_8 = ListItem(List=reverse(sort_3.ValuesA), Index=[0, 1], Wrap=True)
merge_2 = Merge(Data1=brep, Data2=rotax.Geometry)
dpath_3 = DeconstructPath(Branch=tstat_5.Paths)
curvepoint_3 = PointOnCurve(item_8, parameter=0.451)
vrot_3 = Rotate(Vector=item_8, Axis=dup_2, Angle=-1.570796327)
item_9 = ListItem(List=dpath_3, Index=0, Wrap=True)
pl_2 = ConstructPlane(Origin=curvepoint_3, XAxis=item_8, YAxis=vrot_3)
end = EndPoints(Curve=item_8)  # -> Start, End
bnd = Bounds(Numbers=flatten(item_9))
remap = RemapNumbers(Value=item_9, Source=bnd, Target=Domain(0, 1))  # -> Mapped, Clipped
gradient = Gradient(
    LowerLimit=0,
    UpperLimit=1,
    Parameter=remap.Mapped,
    stops=[0: RGB(234, 38, 0), 0.25: RGB(234, 126, 0), 0.5: RGB(125, 122, 77), 0.75: RGB(87, 112, 148), 1: RGB(75, 107, 169)])
preview = CustomPreview(Geometry=merge_2, Material=ColourSwatch(SwatchColor=RGB(126, 128, 85)))
tag = TextTag(Location=move_3.Geometry, Text=match, Colour=graft(ColourSwatch(SwatchColor=RGB(0, 0, 0))))
aligndim = AlignedDimension(
    Plane=pl_2,
    PointA=end.Start,
    PointB=end.End,
    Offset=Slider(0.38, range=0..1),
    Text="{0:0.00}",
    Size=Slider(0.15, range=0..1))
