# Grasshopper definition parametricRoom-V4-21.7.2023.gh (Grasshopper 1.0.7)
# plug-ins: ShapeDiverForGrasshopper, Pufferfish, Human

brep = Brep(<brep referenced from the Rhino model>)
number_slider = Slider(3.7, range=0..5)
Z = UnitZ(Factor=1)
contour = Contour(Shape=brep, Point=Point(0, 0, 0), Direction=Z, Distance=number_slider)
sddp = ShapeDiverDocumentPayload({AbsoluteTolerance=0, AngleTolerance=0, DistanceDisplayPrecision=0, GltfVersion="Gltf2", InputGroups="{}", OutputGroups="{}", RelativeTolerance=0, UnitSystem=0, VersionCreated="1.13.1.0", VersionSaved="1.13.1.0"})
amp = Amplitude(Vector=Z, Amplitude=number_slider)
extr = Extrude(Base=contour, Direction=amp)
item = ListItem(List=flatten(contour), Index=Slider(7, range=0..20), Wrap=True)
extr_2 = Extrude(Base=item, Direction=amp)
X = UnitX(Factor=Slider(37, range=0..100))
preview = CustomPreview(
    Geometry=extr_2,
    Material={diffuse=RGB(221, 160, 221), emission=RGB(66, 48, 66), shine=0.5, specular=RGB(255, 255, 255), transparency=0})
move = Move(Geometry=item, Motion=X)  # -> Geometry, Transform
crv = Curve(<curve referenced from the Rhino model>)

# ---- group: Windows
list = ValueList({"Wall0- Win0": 0, "Wall0- Win1": 1, "Wall3- Win0": 2, "Wall3- Win1": 3}, selected=["Wall0- Win0", "Wall3- Win0"])

# ----
P = Plane(PlaneXY(0, 0, 0))
polygon = Polygon(Plane=P, Radius=Slider(6.9, range=0..10), Segments=Slider(5, range=0..10), FilletRadius=0)  # -> Polygon, Length

# ---- group: Walls
number_slider_2 = Slider(2, range=0..10)
list_2 = ValueList({"Wall 0": 0, "Wall 1": 1, "Wall 2": 2, "Wall 3": 3}, selected=["Wall 0", "Wall 3"])

# ----
winlength = Slider(1.3, range=0..6.5)
winheight = Slider(3.2, range=0..6.5)
lateralmovement = Slider(-4, range=-4..4)
verticalmovement = Slider(0.01, range=-4..4)
fins_width = Slider(0.62, range=0..5)
fins_depth = Slider(0.49, range=0..5)
fins_rotation = Slider(-58.48, range=-90..90)

rotation_degree = Slider(360, range=0..360)
wallheight = Slider(3.5, range=0..10)

reset = Button()
rectangle = Rectangle(Plane=PlaneXY(0, 0, 0), XSize=Slider(11.8, range=0..100), YSize=Slider(7, range=0..100), Radius=0)  # -> Rectangle, Length
num = Number([winlength, winheight, lateralmovement, verticalmovement, fins_width, fins_depth, fins_rotation])
crv_2 = Curve(rectangle.Rectangle)
pcen = PolygonCenter(Polyline=crv_2)  # -> CenterV, CenterE, CenterA
rotate = Rotate(Geometry=crv_2, Angle=degrees(rotation_degree), Plane=pcen.CenterE)  # -> Geometry, Transform
explode = Explode(Curve=rotate.Geometry, Recursive=True)  # -> Segments, Vertices
lng = ListLength(List=explode.Segments)
ceiling_thickness = Panel("0.1")
wall_thickness = Panel("0.1")
c_script = CSharpScript(
    Reset=reset,
    updatedWindowCount=number_slider_2,
    branches=list,
    newNumbers=num,
    SelectedSubWinWalls=list_2,
    updatedWallCount=lng)  # -> out, A, B, C, D; inputs Reset: Boolean, updatedWindowCount: Int32, branches: list of Int32, newNumbers: list of Double, SelectedSubWinWalls: list of Int32, updatedWallCount: Int32
# ---------- c_script: C# ----------
    bool reset = false;
    if(Reset) reset = true;

    if( updatedWallCount == null) return;
    bool CheckifChanged = (updatedWallCount != WallCount);
    bool CheckifChangedSubWin = (updatedWindowCount != WindowCount);
    WallCount = updatedWallCount;
    WindowCount = updatedWindowCount;



    //Define each wall has how many windows
    if(reset || wallSubWinsList.Count == 0){
      wallSubWinsList.Clear();
      for(int i = 0;i < updatedWallCount ;i++)
        wallSubWinsList.Add(1);
    }


    bool windowCountOnWallCheck = false;/////////////////////////
    List<int> checkWallSubWinsList = new List<int>();///////
    checkWallSubWinsList.AddRange(wallSubWinsList);/////////

    //updating each wall has how many windows
    if(SelectedSubWinWalls != null)
    {
      for(int i = 0; i < SelectedSubWinWalls.Count ;i++)
        if(SelectedSubWinWalls[i] < wallSubWinsList.Count)
          wallSubWinsList[SelectedSubWinWalls[i]] = updatedWindowCount;
    }

    for(int i = 0; i < wallSubWinsList.Count;i++){ //////////
      if(wallSubWinsList[i] != checkWallSubWinsList[i])////////
        windowCountOnWallCheck = true;////////////////////////////
    }


    ///*



    //updating branch paths
    List<string> opts1 = new List<string> ();
    for(int i = 0 ;i < updatedWallCount ;i++){
      if(wallSubWinsList.Count == updatedWallCount){
        for(int j = 0 ;j < wallSubWinsList[i] ;j++){
          opts1.Add(i.ToString() + "-" + j.ToString());
        }
      }
    }

    //    D = opts1;



    if(reset || CheckifChangedSubWin || windowCountOnWallCheck || opts1.Count == 0){
      AllInitialNumbers.ClearData();
      for(int i = 0 ;i < opts1.Count;i++){
        var brancheNames = opts1[i].Split('-');
        AllInitialNumbers.AddRange(Numbers, new GH_Path(new int[2]{Int32.Parse(brancheNames[0]),Int32.Parse(brancheNames[1])}));
      }
    }




    if( CheckifChanged){
      valList2 = (Grasshopper.Kernel.Special.GH_ValueList) this.Component.Params.Input[4].Sources[0];
      if(valList2 != null){
        opts = opts1;
        this.GrasshopperDocument.ScheduleSolution(10, SolutionCallback2);
      }
    }



    //Updating value list of Windows
    if(reset || CheckifChangedSubWin){
      valList = (Grasshopper.Kernel.Special.GH_ValueList) this.Component.Params.Input[2].Sources[0];
      if(valList != null){
        opts = opts1;
        this.GrasshopperDocument.ScheduleSolution(20, SolutionCallback);
      }
    }


    B = wallSubWinsList;

    ///////////////////////////////////



    ///Regenerating input Values based on new numbers
    for(int j = 0 ;j < branches.Count;j++){
      var brancheNames = opts1[branches[j]].Split('-');
      var path = new GH_Path(new int[2]{Int32.Parse(brancheNames[0]),Int32.Parse(brancheNames[1])});
      if(AllInitialNumbers.PathExists(path)){
        AllInitialNumbers.Branch(path).Clear();
        AllInitialNumbers.AddRange(newNumbers, new GH_Path(path));
      }
    }

    //   C = branches.Count;



    ///Removing empty branches
    List<GH_Path> allBranchePathes = new List<GH_Path>();
    for(int i = 0 ;i < AllInitialNumbers.BranchCount ;i++){
      allBranchePathes.Add(AllInitialNumbers.Path(i));
    }
    for(int i = 0 ;i < allBranchePathes.Count ;i++){
      if(AllInitialNumbers.Branch(allBranchePathes[i]) != null){
        bool flag = AllInitialNumbers.Branch(allBranchePathes[i]).Count == 0;
        if(flag)
          AllInitialNumbers.RemovePath(allBranchePathes[i]);
      }
    }


    A = AllInitialNumbers;
    //*/

    reset = false;


    n++;
    /**/
# ---------- c_script: C# additional code ----------
  int n = 0;
  int WallCount = 4;
  int WindowCount ;
  double[] Numbers = new double[7]{3,3,0,0,0.5,0.4,0};
  DataTree<double> AllInitialNumbers = new DataTree<double>();
  // AllInitialNumbers.AddRange(Numbers, new GH_Path(0));
  /////////////////////////////
  public bool oldstate = false;
  public Grasshopper.Kernel.Special.GH_ValueList valList;
  public Grasshopper.Kernel.Special.GH_ValueList valList2;
  public List<string> opts;

  private void SolutionCallback(GH_Document document){
    valList.ListItems.Clear();
    for (int i = 0; i < opts.Count; i++){
      var brancheNames = opts[i].Split('-');
      valList.ListItems.Add(new Grasshopper.Kernel.Special.GH_ValueListItem("Wall" + brancheNames[0] + "- Win" + brancheNames[1], i.ToString()));
    }
    valList.ExpireSolution(true);
  }
  ////////////////////////
  ////////////////////////

  public List<string> opts2;
  public List<string> vals2;

  List<int> wallSubWinsList = new List<int>();
  private void SolutionCallback2(GH_Document document){
    valList2.ListItems.Clear();
    for (int i = 0; i < WallCount; i++){
      valList2.ListItems.Add(new Grasshopper.Kernel.Special.GH_ValueListItem("Wall " + i.ToString(), i.ToString()));
    }
    valList2.ExpireSolution(true);
  }
# ---------- end c_script ----------
expression = Expression(a=c_script.B, Expression="if(a=0,1,a)")
crv_3 = Curve(simplify(graft(explode.Segments)))
div = DivideDomain(Domain=Domain(0, 1), Count=c_script.B)
div_2 = DivideDomain(Domain=Domain(0, 1), Count=expression)
subcrv = SubCurve(BaseCurve=reparameterize(simplify(crv_3)), Domain=simplify(div_2))  # -> simplify(graft(Curve))
subcrv_2 = SubCurve(BaseCurve=reparameterize(simplify(crv_3)), Domain=simplify(div))  # -> graft(Curve)
lng_2 = ListLength(List=subcrv_2)
clean = CleanTree(RemoveNulls=True, RemoveInvalid=True, RemoveEmpty=True, Tree=subcrv_2)
equals = Equality(FirstNumber=lng_2, SecondNumber=0)  # -> Equality, Inequality
cull = CullPattern(List=subcrv, CullPattern=equals.Equality)
Z_2 = UnitZ(Factor=wallheight)
boundary = BoundarySurfaces(Edges=rotate.Geometry)
move_2 = Move(Geometry=boundary, Motion=Z_2)  # -> Geometry, Transform
srf = Surface([move_2.Geometry, boundary])
item_2 = ListItem(List=c_script.A, Index=0, Wrap=True)  # -> Item, Item1, Item2, Item3, Item4, Item5, Item6
crv_4 = Curve(clean)
len = Length(Curve=crv_4)
multiplication = Multiplication(A=wall_thickness, B=2)
num_2 = Number(item_2.Item2)
num_3 = Number(item_2.Item)
subtraction = Subtraction(A=len, B=multiplication)
c_script_2 = CSharpScript(x=num_3, y=subtraction)  # -> out, A; inputs x: Double
# ---------- c_script_2: C# ----------
    double Number = 0;
    if(x >= y.Max)
      Number = y.Max;
    else if(x<= y.Min)
      Number = y.Min;
    else
      Number = x;
    
    A = Number;
# ---------- end c_script_2 ----------
subtraction_2 = Subtraction(A=subtraction, B=c_script_2.A)
multiplication_2 = Multiplication(A=ceiling_thickness, B=2)
num_4 = Number(item_2.Item1)
offset_l = OffsetCurveLoose(Curve=rotate.Geometry, Distance=[1, -1])
subtraction_3 = Subtraction(A=wallheight, B=multiplication_2)
c_script_3 = CSharpScript(x=subtraction_2)  # -> out, A; inputs x: Double
# ---------- c_script_3: C# ----------
    x = x / 2;
    Interval Intrvl = new Interval(-x, x);
    A = Intrvl;
# ---------- end c_script_3 ----------
len_2 = Length(Curve=offset_l)
c_script_4 = CSharpScript(x=num_4, y=subtraction_3)  # -> out, A; inputs x: Double; same code as c_script_2
c_script_5 = CSharpScript(x=num_2, y=c_script_3.A)  # -> out, A; inputs x: Double; same code as c_script_2
len_3 = Length(Curve=crv_4)
sort = SortList(Keys=len_2, ValuesA=offset_l)  # -> Keys, ValuesA
num_5 = Number(item_2.Item3)
item_3 = ListItem(List=sort.ValuesA, Index=0, Wrap=True)
division = Division(A=c_script_5.A, B=len_3)
subtraction_4 = Subtraction(A=wallheight, B=c_script_4.A)
subtraction_5 = Subtraction(A=subtraction_4, B=multiplication_2)
c_script_6 = CSharpScript(x=subtraction_5)  # -> out, A; inputs x: Double; same code as c_script_3
addition = Addition(A=division, B="0.5")
c_script_7 = CSharpScript(x=num_5, y=c_script_6.A)  # -> out, A; inputs x: Double; same code as c_script_2
division_2 = Division(A=wallheight, B=2)
eval = EvaluateCurve(Curve=reparameterize(crv_4), Parameter=addition)  # -> Point, Tangent, Angle
addition_2 = Addition(A=division_2, B=c_script_7.A)
pull = PullPoint(Point=eval.Point, Geometry=item_3, ClosestOnly=True)  # -> ClosestPoint, Distance
Z_3 = UnitZ(Factor=1)
vrot = Rotate(Vector=eval.Tangent, Axis=Z_3, Angle=[-1.570796327, 1.570796327])
subtraction_6 = Subtraction(A=pull.ClosestPoint, B=eval.Point)
angle = Angle(VectorA=subtraction_6, VectorB=vrot)  # -> Angle, Reflex
sort_2 = SortList(Keys=angle.Angle, ValuesA=vrot)  # -> Keys, reverse(ValuesA)
multiplication_3 = Multiplication(A=Z_3, B=addition_2)
item_4 = ListItem(List=sort_2.ValuesA, Index=0, Wrap=True)
dom = ConstructDomain(DomainStart="0.05", DomainEnd=num_3)
vrot_2 = Rotate(Vector=Z_3, Axis=item_4, Angle=-1.570796327)
move_3 = Move(Geometry=eval.Point, Motion=multiplication_3)  # -> Geometry, Transform
c_script_8 = CSharpScript(x=item_2.Item4, y=dom)  # -> out, A; inputs x: Double; same code as c_script_2
crv_5 = Curve(clean)
c_script_9 = CSharpScript(x=c_script_4.A)  # -> out, A; inputs x: Double; same code as c_script_3
pl = ConstructPlane(Origin=move_3.Geometry, XAxis=vrot_2, YAxis=Z_3)
c_script_10 = CSharpScript(x=c_script_2.A)  # -> out, A; inputs x: Double; same code as c_script_3
match = MatchTree(Tree=pl, Guide=c_script_10.A)
rectangle_2 = Rectangle(Plane=match, XSize=c_script_10.A, YSize=c_script_9.A, Radius=0)  # -> simplify(Rectangle), Length
area = Area(Geometry=rectangle_2.Rectangle)  # -> Area, Centroid
extr_3 = Extrude(Base=crv_5, Direction=Z_2)
larger = LargerThan(FirstNumber=area.Area, SecondNumber=0.1)  # -> LargerThan, OrEqualTo
amp_2 = Amplitude(Vector=item_4, Amplitude=Slider(0.11, range=0..1))
join = JoinCurves(Curves=extr_3, Preserve=False)  # -> simplify(Curves)
amp_3 = Amplitude(Vector=item_4, Amplitude=Slider(0.05, range=0..1))
clean_2 = CleanTree(RemoveNulls=True, RemoveInvalid=True, RemoveEmpty=True, Tree=cull)
cull_2 = CullPattern(List=rectangle_2.Rectangle, CullPattern=larger.LargerThan)
neg = Negative(Value=amp_2)
extr_4 = Extrude(Base=clean_2, Direction=Z_2)
move_4 = Move(Geometry=cull_2, Motion=neg)  # -> Geometry, Transform
move_5 = Move(Geometry=cull_2, Motion=amp_3)  # -> Geometry, Transform
match_2 = MatchTree(Tree=join, Guide=cull_2)
explode_2 = Explode(Curve=cull_2, Recursive=True)  # -> Segments, Vertices
explode_3 = Explode(Curve=move_5.Geometry, Recursive=True)  # -> Segments, Vertices
merge = Merge(Data1=move_4.Geometry, Data2=move_5.Geometry)  # -> simplify(Result)
merge_2 = Merge(Data1=cull_2, Data2=match_2, Data3=extr_4)
curvepoint = PointOnCurve(explode_3.Segments, parameter=0.5)
pdecon = Deconstruct(Point=curvepoint)  # -> XComponent, YComponent, ZComponent
number_slider_3 = Slider(0.004, range=0..0.02)
number_slider_4 = Slider(0.05, range=0..0.1)
division_3 = Division(A=c_script_2.A, B=c_script_8.A)
sort_3 = SortList(Keys=pdecon.ZComponent, ValuesC=explode_2.Segments, ValuesA=explode_3.Segments)  # -> Keys, ValuesC, ValuesA
item_5 = ListItem(List=sort_3.ValuesC, Index=0, Wrap=True)
round = Round(Number=division_3)  # -> Nearest, Floor, Ceiling
number_slider_5 = Slider(2.88, range=0..10)
crv_6 = Curve(rotate.Geometry)
neg_2 = Negative(Value=number_slider_3)
boundary_2 = BoundarySurfaces(Edges=merge_2)
neg_3 = Negative(Value=number_slider_4)
offset = OffsetCurve(Curve=crv_6, Distance=[0.1, -0.1], Corners=1)  # -> flatten(Curve)
item_6 = ListItem(List=reverse(sort_3.ValuesC), Index=0, Wrap=True)
num_6 = Number(wall_thickness)
divide = DivideCurve(Curve=item_5, Count=round.Floor, Kinks=False)  # -> Points, Tangents, Parameters
offset_2 = OffsetCurve(Curve=graft(merge), Distance=flatten([number_slider_3, neg_2]), Corners=1)
offset_3 = OffsetCurve(Curve=graft(merge), Distance=flatten([number_slider_4, neg_3]), Corners=1)
neg_4 = Negative(Value=number_slider_5)
join_2 = BrepJoin(Breps=boundary_2)  # -> Breps, Closed
join_3 = BrepJoin(Breps=flatten(boundary_2))  # -> Breps, Closed
neg_5 = Negative(Value=num_6)
sort_4 = SortList(Keys=offset, ValuesA=offset)  # -> Keys, reverse(ValuesA)
explode_4 = Explode(Curve=crv_6, Recursive=True)  # -> Segments, Vertices
pull_2 = PullPoint(Point=divide.Points, Geometry=item_6, ClosestOnly=True)  # -> ClosestPoint, Distance
merge_3 = Merge(Data1=neg_4, Data2=number_slider_5)
pshift = ShiftPaths(Data=offset_2, Offset=-1)
pshift_2 = ShiftPaths(Data=offset_3, Offset=-1)
fmerge = MergeFaces(Brep=join_3.Breps)  # -> Breps, Before, After
merge_4 = Merge(Data1=neg_5, Data2=num_6)
item_7 = ListItem(List=sort_4.ValuesA, Index=0, Wrap=True)
curvepoint_2 = PointOnCurve(explode_4.Segments, parameter=0.5)
explode_5 = Explode(Curve=rotate.Geometry, Recursive=True)  # -> Segments, Vertices
disc = Discontinuity(Curve=crv_6, Level=1)  # -> Points, Parameters
item_8 = ListItem(List=reverse(sort_3.ValuesA), Index=0, Wrap=True)
amp_4 = Amplitude(Vector=item_4, Amplitude=item_2.Item5)
ln = Line(StartPoint=divide.Points, EndPoint=pull_2.ClosestPoint)
Z_4 = UnitZ(Factor=Slider(1.05, range=0..10))
curvepoint_3 = PointOnCurve(crv_5, parameter=0.5)
multiplication_4 = Multiplication(A=Z_2, B=1.2)
offset_l_2 = OffsetCurveLoose(Curve=rotate.Geometry, Distance=merge_3)
len_4 = Length(Curve=pshift_2)
len_5 = Length(Curve=pshift)
Z_5 = UnitZ(Factor=1)
offmsh = OffsetMesh(Mesh=fmerge.Breps, Distance=merge_4, BothSides=False, CreateSolid=True)  # -> flatten(Offset)
pull_3 = PullPoint(Point=curvepoint_2, Geometry=item_7, ClosestOnly=True)  # -> ClosestPoint, Distance
disc_2 = Discontinuity(Curve=item_7, Level=1)  # -> Points, Parameters
item_9 = ListItem(List=reverse(sort_3.ValuesA), Index=[0, 1], Wrap=True)
move_6 = Move(Geometry=item_8, Motion=Z_4)  # -> Geometry, Transform
move_7 = Move(Geometry=curvepoint_3, Motion=multiplication_4)  # -> Geometry, Transform
len_6 = Length(Curve=offset_l_2)
sort_5 = SortList(Keys=len_4, ValuesA=pshift_2)  # -> Keys, reverse(ValuesA)
sort_6 = SortList(Keys=len_5, ValuesA=pshift)  # -> Keys, ValuesA
line = LineSDL(Start=disc.Points, Direction=Z_5, Length=wallheight)
subtraction_7 = Subtraction(A=pull_3.ClosestPoint, B=curvepoint_2)
Z_6 = UnitZ(Factor=1)
pull_4 = PullPoint(Point=disc.Points, Geometry=disc_2.Points, ClosestOnly=True)  # -> ClosestPoint, Distance
curvepoint_4 = PointOnCurve(explode_5.Segments, parameter=0.5)
Z_7 = UnitZ(Factor=expr("-X", 0.1))
volume = Volume(Geometry=offmsh)  # -> Volume, Centroid
divide_2 = DivideCurve(Curve=item_8, Count=1, Kinks=False)  # -> Points, Tangents, Parameters
sort_7 = SortList(Keys=len_6, ValuesA=offset_l_2)  # -> Keys, ValuesA
tstat = TreeStatistics(Tree=move_7.Geometry)  # -> Paths, Length, Count
item_10 = ListItem(List=sort_6.ValuesA, Index=0, Wrap=True)
item_11 = ListItem(List=sort_5.ValuesA, Index=0, Wrap=True)
extr_5 = Extrude(Base=ln, Direction=amp_4)
vrot_3 = Rotate(Vector=subtraction_7, Axis=Z_6, Angle=1.570796327)
curvepoint_5 = PointOnCurve(line, parameter=0.5)
subtraction_8 = Subtraction(A=disc.Points, B=pull_4.ClosestPoint)
move_8 = Move(Geometry=move_6.Geometry, Motion=Z_7)  # -> Geometry, Transform
sort_8 = SortList(Keys=volume.Volume, ValuesA=offmsh)  # -> Keys, ValuesA
divide_3 = DivideCurve(Curve=move_6.Geometry, Count=1, Kinks=False)  # -> Points, Tangents, Parameters
item_12 = ListItem(List=reverse(sort_7.ValuesA), Index=0, Wrap=True)
dpath = DeconstructPath(Branch=tstat.Paths)  # -> simplify(Indices)
curvepoint_6 = PointOnCurve(item_9, parameter=0.451)
pshift_3 = ShiftPaths(Data=item_11, Offset=-1)
pshift_4 = ShiftPaths(Data=item_10, Offset=-1)
curvepoint_7 = PointOnCurve(move_8.Geometry, parameter=0.5)
item_13 = ListItem(List=sort_8.ValuesA, Index=0, Wrap=True)
ln_2 = Line(StartPoint=divide_2.Points, EndPoint=divide_3.Points)
pl_2 = ConstructPlane(Origin=curvepoint_2, XAxis=vrot_3, YAxis=subtraction_7)
pl_3 = ConstructPlane(Origin=curvepoint_5, XAxis=subtraction_8, YAxis=Z_6)
end = EndPoints(Curve=explode_4.Segments)  # -> Start, End
end_2 = EndPoints(Curve=line)  # -> Start, End
Z_8 = UnitZ(Factor=1)
rotax = RotateAxis(Geometry=extr_5, Angle=degrees(item_2.Item6), Axis=ln)  # -> simplify(Geometry), Transform
pull_5 = PullPoint(Point=curvepoint_4, Geometry=item_12, ClosestOnly=True)  # -> ClosestPoint, Distance
explode_6 = Explode(Curve=item_12, Recursive=True)  # -> Segments, Vertices
vrot_4 = Rotate(Vector=item_9, Axis=amp_4, Angle=-1.570796327)
item_14 = ListItem(List=dpath, Index=0, Wrap=True)  # -> Item, Item1
vrot_5 = Rotate(Vector=Z_8, Axis=amp_4, Angle=-1.570796327)
subtraction_9 = Subtraction(A=pull_5.ClosestPoint, B=curvepoint_4)
curvepoint_8 = PointOnCurve(explode_6.Segments, parameter=0.5)
end_3 = EndPoints(Curve=item_9)  # -> Start, End
pl_4 = ConstructPlane(Origin=curvepoint_6, XAxis=item_9, YAxis=vrot_4)
format = Format(Format="w  {1}", Culture=127, Data0=item_14.Item, Data1=item_14.Item1)
merge_5 = Merge(Data1=pl_2, Data2=pl_3)
merge_6 = Merge(Data1=end.Start, Data2=end_2.Start)
merge_7 = Merge(Data1=end.End, Data2=end_2.End)
offmsh_2 = OffsetMesh(Mesh=rotax.Geometry, Distance=Slider(0.01, range=0..0.01), BothSides=True, CreateSolid=True)  # -> flatten(Offset)
boundary_3 = BoundarySurfaces(Edges=move_5.Geometry)
merge_8 = Merge(Data1=pshift_4, Data2=reverse(pshift_3))  # -> simplify(Result)
vrot_6 = Rotate(Vector=subtraction_9, Axis=Vector(0, 0, 1), Angle=-1.570796327)
Z_9 = UnitZ(Factor=1)
pl_5 = ConstructPlane(Origin=curvepoint_7, XAxis=vrot_5, YAxis=Z_8)
crv_7 = Curve([move_8.Geometry, ln_2])
match_3 = MatchTree(Tree=simplify(format), Guide=simplify(move_7.Geometry))
lng_3 = ListLength(List=explode_4.Segments)
pl_6 = ConstructPlane(Origin=curvepoint_8, XAxis=expr("-X", vrot_6), YAxis=Z_9)
swatch = ColourSwatch(SwatchColor=RGB(191, 0, 0))
series = Series(Start=0, Step=1, Count=lng_3)
loft = Loft(Curves=merge_8, Options={Adjust=False, Closed=True, LoftEnds=0, LoftSimp=0, LoftType=3, Rebuild=10, Refit=0.01})
preview_2 = CustomPreview(Geometry=offmsh_2, Material=ColourSwatch(SwatchColor=RGB(110, 93, 24)))
tag = TextTag3D(
    Location=pl_6,
    Text=series,
    Size=Slider(2.28, range=0..10),
    Colour=ColourSwatch(SwatchColor=RGB(191, 0, 0)),
    Justification=7)
tag_2 = TextTag3D(Location=pl_5, Text=match_3, Size=Slider(0.34, range=0..10), Colour=swatch, Justification=8)
previewlw = CustomPreviewLineweights(Geometry=crv_7, Shader=swatch, Absolute=False)
aligndim = AlignedDimension(
    Plane=merge_5,
    PointA=merge_6,
    PointB=merge_7,
    Offset=Slider(0.7, range=0..1),
    Text="{0:0.00}",
    Size=Slider(0.17, range=0..1))
aligndim_2 = AlignedDimension(
    Plane=pl_4,
    PointA=end_3.Start,
    PointB=end_3.End,
    Offset=Slider(0.24, range=0..1),
    Text="{0:0.00}",
    Size=Slider(0.1, range=0..1))
preview_3 = CustomPreview(Geometry=item_13, Material=ColourSwatch(SwatchColor=RGBA(186, 186, 186, 167)))
preview_4 = CustomPreview(Geometry=boundary_3, Material=ColourSwatch(SwatchColor=RGBA(0, 225, 255, 24)))
preview_5 = CustomPreview(Geometry=loft, Material=ColourSwatch(SwatchColor=RGB(84, 84, 84)))

# ---- group: For Daylight Anaysis
entwine = Entwine(
    Branch00=boundary,
    Branch01=move_2.Geometry,
    Branch02=boundary_3,
    Branch03=fmerge.Breps,
    Branch04=rotax.Geometry,
    FlattenInputs=True)

# ----
bang = ExplodeTree(Data=entwine)  # -> Branch0, Branch1, Branch2, Branch3, Branch4
geo = Geometry(bang.Branch4)
