# Grasshopper definition parametricRoom-V70-27.3.2024.gh (Grasshopper 1.0.7)
# plug-ins: ShapeDiverForGrasshopper, PW_AI, Human, Human UI

filepicker = CreateFilePicker(ButtonLabelText="Weather file", DialogType=0, MustExist=True, Filter="All Files|*.*")

# ---- group: UnitConvertor to Meters
c_script = CSharpScript()  # -> out, A
# ---------- c_script: C# ----------
    Rhino.RhinoDoc.ActiveDoc.AdjustModelUnitSystem(UnitSystem.Meters, false);
# ---------- end c_script ----------

# ----
add_remove_fins = BooleanToggle(False)
add_remove_fins_2 = BooleanToggle(False)
count = Slider(1, range=1..5)
depth_m = Slider(0.3, range=0..1)
count_2 = Slider(2, range=2..5)
depth_m_2 = Slider(0.3, range=0..1)
wall_refl = Slider(0.5, range=0..1)
wall_r_val = Slider(20, range=10..30)
ground_r_val = Slider(10, range=5..30)
ceiling_refl = Slider(0.7, range=0..1)
floor_refl = Slider(0.2, range=0..1)
glazing_trans = Slider(0.3, range=0..1)
roof_r_val = Slider(30, range=20..40)
win_u_val = Slider(0.3, range=0.2..0.4)
win_shgc = Slider(0.3, range=0.2..0.4)
panel = Panel("Set interior walls' outlines.")
clip_plane_m = Slider(3.1, range=0..10)
floor_to_floor_m = Slider(3.2, range=1..6)
data = Data(simplify(flatten(Tree({0;0;0;0}: ["2019::LargeOffice::Attic", "2019::LargeOffice::BreakRoom", "2019::LargeOffice::Classroom", "2019::LargeOffice::ClosedOffice", "2019::LargeOffice::Conference", "2019::LargeOffice::Corridor", "2019::LargeOffice::Dining", "2019::LargeOffice::Elec/MechRoom", "2019::LargeOffice::Elevator Lobby", "2019::LargeOffice::Elevator Machine Room", "2019::LargeOffice::Elevator Shaft", "2019::LargeOffice::IT_Room", "2019::LargeOffice::Lobby", "2019::LargeOffice::Main Electrical", "2019::LargeOffice::Main Mechanical", "2019::LargeOffice::OfficeLarge Data Center", "2019::LargeOffice::OfficeLarge Main Data Center", "2019::LargeOffice::OpenOffice", "2019::LargeOffice::PrintRoom", "2019::LargeOffice::Restroom", "2019::LargeOffice::Stair", "2019::LargeOffice::Storage", "2019::LargeOffice::Vending"], {0;0;0;1}: ["2019::MediumOffice::Breakroom", "2019::MediumOffice::Classroom", "2019::MediumOffice::ClosedOffice", "2019::MediumOffice::Conference", "2019::MediumOffice::Corridor", "2019::MediumOffice::Dining", "2019::MediumOffice::Elec/MechRoom", "2019::MediumOffice::Lobby", "2019::MediumOffice::OpenOffice", "2019::MediumOffice::Restroom", "2019::MediumOffice::Stair", "2019::MediumOffice::Storage"], {0;0;0;2}: ["2019::SmallOffice::Breakroom", "2019::SmallOffice::Classroom", "2019::SmallOffice::ClosedOffice", "2019::SmallOffice::Conference", "2019::SmallOffice::Corridor", "2019::SmallOffice::Dining", "2019::SmallOffice::Elec/MechRoom", "2019::SmallOffice::Lobby", "2019::SmallOffice::OpenOffice", "2019::SmallOffice::Restroom", "2019::SmallOffice::Stair", "2019::SmallOffice::Storage"], {0;0;0;3}: ["2019::MidriseApartment::Apartment", "2019::MidriseApartment::Corridor", "2019::MidriseApartment::Office"], {0;0;0;4}: ["2019::HighriseApartment::Apartment", "2019::HighriseApartment::Corridor", "2019::HighriseApartment::Office"], {0;0;0;5}: ["2019::Retail::Back_Space", "2019::Retail::Core_Retail", "2019::Retail::Entry", "2019::Retail::Front_Retail", "2019::Retail::Point_of_Sale", "2019::Retail::Retail"]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))))
panel_2 = Panel("""False
False
True""")
panel_3 = Panel("""Sml   
Med   
Lrg   """)
number_slider = Slider(2, range=0..10)
panel_4 = Panel("""Single floor
Ground floor
Middle floor
Top floor""")
radiobtn = CreateRadioButton(RadioButtonName=panel_3, RadioButtonGroup="1", InitiallySelected=panel_2)
txt = Text("")
pickbtn = CreateRhinoPickButton(ButtonName="Zone", Prompt="Set a closed Outline.", AllowMultiple=False, AllowNone=True, Type=2, ButtonStyle=0)
pickbtn_2 = CreateRhinoPickButton(ButtonName="Walls", Prompt=panel, AllowMultiple=True, AllowNone=True, Type=2, ButtonStyle=0)
pickbtn_3 = CreateRhinoPickButton(ButtonName="Context", Prompt="Set context buildings.", AllowMultiple=True, AllowNone=True, Type=1, ButtonStyle=0)
num = Number(0.6096)
slider = CreateSlider(
    Slider=floor_to_floor_m,
    SnapValue=0.1,
    ShowBounds=False,
    ShowTicks=False,
    ShowTooltip=False,
    ShowValLabel=True,
    showLabel=True)
toggle = CreateToggle(Default=Toggle(False), OnLabel="Update", OffLabel="Update")
slider_2 = CreateSlider(
    Slider=clip_plane_m,
    SnapValue=0.1,
    ShowBounds=False,
    ShowTicks=False,
    ShowTooltip=False,
    ShowValLabel=True,
    showLabel=True)
label = CreateLabel(LabelText=" Sensor Grid  ", LabelSize=12, Justification=0)
filepicker_2 = CreateFilePicker(ButtonLabelText="Folder", DialogType=2, MustExist=True, Filter="All Files|*.*", StartingPath=txt)
bool = Boolean(Tree({0;0}: [True, True], {0;1}: [True, False], {0;2}: [False, False], {0;3}: [False, True]))
pulldown = CreatePulldownMenu(Label="Floor Location", ListItems=panel_4, SelectedIndex=Slider(0, range=0..4), showLabel=True)
division = Division(A=num, B=2)
series = Series(Start=number_slider, Step=number_slider, Count=3)
tooltip = AttachTooltipToElement(ElementsToAttachTo=label, TooltipContent=" Grid Size for daylight analysis", ShowDelay=500, Duration=2000)
values = ValueListener(Elements=filepicker_2, SomeProperty=True)  # -> flatten(Values), Indices
toggle_2 = CreateToggle(Default=False, OnLabel="Save Alt", OffLabel="Save Alt")
values_2 = ValueListener(Elements=radiobtn, SomeProperty=True)  # -> flatten(Values), Indices
relay = Relay([slider, slider_2])
panel_5 = Panel("""Floor Type:
Single Floor: if the building consists of only one storey.
Ground Floor: if the floor is at ground level in a multiple-storey building.
Middle Floor: if the floor is located between the ground and top floors in a multiple-storey building.
Top Floor: if the floor is at the highest level in a multiple-storey building.""")
multiplication = Multiplication(A=division, B=series)
pulldown_2 = CreatePulldownMenu(Label="Building Type", ListItems=data, SelectedIndex=Slider(121, range=0..1000), showLabel=True)
values_3 = ValueListener(Elements=pulldown, SomeProperty=True)  # -> Values, Indices
values_4 = ValueListener(Elements=toggle, SomeProperty=True)  # -> Values, Indices
getprops = GetElementProperties(UIElement=toggle)  # -> PropertyNames, PropertyTypes
wwr = Slider(0.5, range=0..1)
tooltip_2 = AttachTooltipToElement(ElementsToAttachTo=toggle, TooltipContent="On/Off Daylight and Energy calculation", ShowDelay=500, Duration=2000)
panel_6 = Panel("""Small   
Medium   
Large   """)
merge = Merge(Data1=flatten(label), Data2=flatten(radiobtn))
c_script_2 = CSharpScript(x=values.Values, y=txt)  # -> out, A; inputs x: String, y: String
# ---------- c_script_2: C# ----------
    if(String.IsNullOrEmpty(x))
    {
      A = y;
    }
    else
      A = x;
# ---------- end c_script_2 ----------
relay_2 = Relay([pickbtn, pickbtn_2, pickbtn_3])
filter = StreamFilter(Gate=values_4.Values, Stream1=Toggle(False))
adjustpos = AdjustElementPositioning(
    ElementsToAdjust=filepicker_2,
    Margin="0,10,0,0",
    AbsolutePositioning=False,
    Width=Slider(244, range=0..1000),
    Height=Slider(30, range=0..1000))
item = ListItem(List=getprops.PropertyNames, Index=11, Wrap=True)
swatch = ColourSwatch(SwatchColor=RGB(5, 5, 5))
branch = TreeBranch(Tree=simplify(bool), Path=values_3.Indices, MaintainPaths=True)
format = Format(Format="{0}: {1} m2", Culture=127, Data0=panel_6, Data1=multiplication)
tooltip_3 = AttachTooltipToElement(ElementsToAttachTo=pulldown, TooltipContent=panel_5, ShowDelay=500, Duration=10000)
tooltip_4 = AttachTooltipToElement(ElementsToAttachTo=pulldown_2, TooltipContent="Floor Program", ShowDelay=500, Duration=2000)
values_5 = ValueListener(Elements=toggle_2, SomeProperty=True)  # -> Values, Indices
cull = CullPattern(List=multiplication, CullPattern=values_2.Values)
setprop = SetElementProperty(UIElement=toggle, PropertyName=item, ValueToSet=filter)
tooltip_5 = AttachTooltipToElement(ElementsToAttachTo=radiobtn, TooltipContent=format, ShowDelay=500, Duration=2000)
values_6 = ValueListener(Elements=slider_2, SomeProperty=True)  # -> flatten(Values), Indices
values_7 = ValueListener(Elements=slider, SomeProperty=True)  # -> flatten(Values), Indices
getprops_2 = GetElementProperties(UIElement=toggle_2)  # -> PropertyNames, PropertyTypes
tooltip_6 = AttachTooltipToElement(ElementsToAttachTo=slider, TooltipContent="Storey Height", ShowDelay=500, Duration=2000)
slider_3 = CreateSlider(Slider=wwr, SnapValue=0.01, ShowBounds=False, ShowTicks=False, ShowTooltip=False, ShowValLabel=True, showLabel=True)
toggle_3 = CreateToggle(Default=add_remove_fins_2, OnLabel="Vertical Shadings", OffLabel="Vertical Shadings")
toggle_4 = CreateToggle(Default=add_remove_fins, OnLabel="Horizontal Shadings", OffLabel="Horizontal Shadings")
slider_4 = CreateSlider(Slider=count_2, SnapValue=1, ShowBounds=False, ShowTicks=False, ShowTooltip=False, ShowValLabel=True, showLabel=True)
slider_5 = CreateSlider(Slider=depth_m_2, SnapValue=0.1, ShowBounds=False, ShowTicks=False, ShowTooltip=False, ShowValLabel=True, showLabel=True)
separator = CreateSeparator(Thickness=0.7, Horizontal=True, Color=swatch)
slider_6 = CreateSlider(Slider=count, SnapValue=1, ShowBounds=False, ShowTicks=False, ShowTooltip=False, ShowValLabel=True, showLabel=True)
slider_7 = CreateSlider(Slider=depth_m, SnapValue=0.1, ShowBounds=False, ShowTicks=False, ShowTooltip=False, ShowValLabel=True, showLabel=True)
separator_2 = CreateSeparator(Thickness=0.7, Horizontal=True, Color=swatch)
toggle_5 = CreateToggle(Default=False, OnLabel="Apply to selected", OffLabel="Apply to selected")
separator_3 = CreateSeparator(Thickness=0.7, Horizontal=True, Color=swatch)
filter_2 = StreamFilter(Gate=values_5.Values, Stream1=Toggle(False))
slider_8 = CreateSlider(Slider=wall_refl, SnapValue=0.1, ShowBounds=False, ShowTicks=False, ShowTooltip=False, ShowValLabel=True, showLabel=True)
slider_9 = CreateSlider(
    Slider=glazing_trans,
    SnapValue=0.1,
    ShowBounds=False,
    ShowTicks=False,
    ShowTooltip=False,
    ShowValLabel=True,
    showLabel=True)
separator_4 = CreateSeparator(Thickness=0.7, Horizontal=True, Color=swatch)
slider_10 = CreateSlider(Slider=wall_r_val, SnapValue=1, ShowBounds=False, ShowTicks=False, ShowTooltip=False, ShowValLabel=True, showLabel=True)
slider_11 = CreateSlider(Slider=roof_r_val, SnapValue=1, ShowBounds=False, ShowTicks=False, ShowTooltip=False, ShowValLabel=True, showLabel=True)
slider_12 = CreateSlider(
    Slider=ground_r_val,
    SnapValue=1,
    ShowBounds=False,
    ShowTicks=False,
    ShowTooltip=False,
    ShowValLabel=True,
    showLabel=True)
slider_13 = CreateSlider(
    Slider=win_u_val,
    SnapValue=0.01,
    ShowBounds=False,
    ShowTicks=False,
    ShowTooltip=False,
    ShowValLabel=True,
    showLabel=True)
slider_14 = CreateSlider(Slider=win_shgc, SnapValue=0.01, ShowBounds=False, ShowTicks=False, ShowTooltip=False, ShowValLabel=True, showLabel=True)
slider_15 = CreateSlider(
    Slider=ceiling_refl,
    SnapValue=0.1,
    ShowBounds=False,
    ShowTicks=False,
    ShowTooltip=False,
    ShowValLabel=True,
    showLabel=True)
item_2 = ListItem(List=getprops_2.PropertyNames, Index=11, Wrap=True)
adjustelem = AdjustElementAppearance(
    ElementsToAdjust=graft(toggle_2),
    Foreground=ColourSwatch(SwatchColor=RGB(255, 255, 255)),
    Background=ColourSwatch(SwatchColor=RGB(84, 84, 84)),
    FontSize=Slider(10.9, range=0..20))
slider_16 = CreateSlider(
    Slider=floor_refl,
    SnapValue=0.1,
    ShowBounds=False,
    ShowTicks=False,
    ShowTooltip=False,
    ShowValLabel=True,
    showLabel=True)
adjustpos_2 = AdjustElementPositioning(
    ElementsToAdjust=toggle_2,
    Margin=Slider(7, range=0..10),
    AbsolutePositioning=False,
    Width=Slider(127, range=0..1000),
    Height=Slider(32, range=0..1000))
item_3 = ListItem(List=getprops_2.PropertyNames, Index=52, Wrap=True)
simplegrid = CreateSimpleGrid(UIElements=graft(merge), Width=graft(Slider(252, range=0..1000)), RowDefinitions="Auto", ColumnDefinitions="Auto")  # -> flatten(SimpleGrid)
values_8 = ValueListener(Elements=pickbtn, SomeProperty=True)  # -> flatten(Values), Indices
adjustpos_3 = AdjustElementPositioning(ElementsToAdjust=relay_2, Margin=Slider(1, range=0..100), AbsolutePositioning=True, Width=Slider(62, range=0..300))
getprops_3 = GetElementProperties(UIElement=toggle_5)  # -> PropertyNames, PropertyTypes
values_9 = ValueListener(Elements=toggle_5, SomeProperty=True)  # -> Values, Indices
simplegrid_2 = CreateSimpleGrid(UIElements=graft(relay_2), Width=Slider(199, range=0..1000), RowDefinitions="1*", ColumnDefinitions="1*")  # -> flatten(SimpleGrid)
values_10 = ValueListener(Elements=pickbtn_2, SomeProperty=True)  # -> flatten(Values), Indices
setprop_2 = SetElementProperty(UIElement=toggle_2, PropertyName=item_2, ValueToSet=filter_2)
panel_7 = Panel(values_5.Values)
setprop_3 = SetElementProperty(UIElement=toggle_2, PropertyName=item_3, ValueToSet="Save Alt")
getprops_4 = GetElementProperties(UIElement=toggle_3)  # -> PropertyNames, PropertyTypes
adjustelem_2 = AdjustElementAppearance(
    ElementsToAdjust=relay_2,
    Foreground=ColourSwatch(SwatchColor=RGB(102, 102, 102)),
    Background=ColourSwatch(SwatchColor=RGB(230, 230, 230)),
    FontSize=Slider(11, range=0..100))
tooltip_7 = AttachTooltipToElement(ElementsToAttachTo=pickbtn, TooltipContent="Set a closed Outline.", ShowDelay=500, Duration=2000)
tooltip_8 = AttachTooltipToElement(ElementsToAttachTo=pickbtn_2, TooltipContent=panel, ShowDelay=500, Duration=2000)
tooltip_9 = AttachTooltipToElement(ElementsToAttachTo=pickbtn_3, TooltipContent="Set context buildings.", ShowDelay=500, Duration=2000)
filter_3 = StreamFilter(Gate=values_9.Values, Stream1=Toggle(False))
item_4 = ListItem(List=getprops_4.PropertyNames, Index=33, Wrap=True)
item_5 = ListItem(List=getprops_3.PropertyNames, Index=52, Wrap=True)
item_6 = ListItem(List=getprops_3.PropertyNames, Index=11, Wrap=True)
data_2 = Data([slider_15, slider_16, slider_8, slider_9, separator_4, slider_10, slider_11, slider_12, slider_13, slider_14])
number_slider_2 = Slider(4, range=0..10)
setprop_4 = SetElementProperty(UIElement=[toggle_3, toggle_4], PropertyName=item_4, ValueToSet=Slider(12.35, range=0..14))
setprop_5 = SetElementProperty(UIElement=toggle_5, PropertyName=item_5, ValueToSet="Apply to selected")
setprop_6 = SetElementProperty(UIElement=toggle_5, PropertyName=item_6, ValueToSet=filter_3)
panel_8 = Panel(values_9.Values)
grid = CreateGrid(
    UIElements=flatten([toggle_2, filepicker_2]),
    Height=Slider(60, range=0..100),
    ColumnDefinitions=flatten([Slider(276, range=150..400), Slider(336, range=0..1000)]),
    ElementColumn=[Slider(1, range=0..3), Slider(0, range=0..3)],
    ElementRowSpan=2,
    ElementColumnSpan=1)
stack = CreateStack(UIElements=flatten([toggle, simplegrid]), Horizontal=True)
merge_2 = Merge(
    Data1=slider_3,
    Data2=separator_2,
    Data3=toggle_3,
    Data4=slider_4,
    Data5=slider_5,
    Data6=separator,
    Data7=toggle_4,
    Data8=slider_6,
    Data9=slider_7,
    Data10=separator_3,
    Data11=toggle_5)
values_11 = ValueListener(Elements=pickbtn_3, SomeProperty=True)  # -> flatten(Values), Indices
number_slider_3 = Slider(202, range=0..300)
item_7 = ListItem(List=data_2, Index=number_slider_2, Wrap=True)
cull_i = CullIndex(List=data_2, Indices=number_slider_2, Wrap=True)
number_slider_4 = Slider(0, range=0..21)
data_3 = Data(merge_2)
panel_9 = Panel("Capture Alternative                                                                                                             ")
number_slider_5 = Slider(0, range=0..21)
join = TextJoin(Text=[Slider(0, range=0..100), Slider(0, range=0..100), Slider(0, range=0..100), Slider(0, range=0..100)], Join=",")
join_2 = TextJoin(Text=[Slider(0, range=0..100), Slider(6, range=0..100), Slider(0, range=0..100), Slider(0, range=0..100)], Join=",")
crv = Curve(values_8.Values)
box = CenterBox(Base=Plane(origin=(-178, 941, 0), x=(-1, 0, 0), y=(0, -1, 0)), X=1, Y=1, Z=1)
cluster = Cluster_9(id=values_11.Values)
mbox = MeshBox(
    Base={Plane=PlaneXY(100000000, 100000000, 100000000), X=Domain(-2, 2), Y=Domain(-0.5, 0.5), Z=Domain(0, 0.25)},
    XCount=1,
    YCount=1,
    ZCount=1)
id = Guid(values_11.Values)
adjustpos_4 = AdjustElementPositioning(
    ElementsToAdjust=flatten(cull_i),
    Margin=Slider(1.8, range=0..10),
    AbsolutePositioning=True,
    Width=Slider(179, range=0..300),
    HorizontalAlignment=0)
adjustpos_5 = AdjustElementPositioning(
    ElementsToAdjust=flatten(item_7),
    Margin="0,0,0,10",
    AbsolutePositioning=True,
    Width=Slider(241, range=0..300),
    HorizontalAlignment=0)
merge_3 = Merge(Data1=flatten(simplegrid_2), Data2=filepicker, Data3=flatten(pulldown_2), Data4=flatten(pulldown), Data5=flatten(relay))
adjustpos_6 = AdjustElementPositioning(ElementsToAdjust=slider_2, Margin=join, AbsolutePositioning=True, Width=number_slider_3)
adjustpos_7 = AdjustElementPositioning(ElementsToAdjust=slider, Margin=join_2, AbsolutePositioning=True, Width=number_slider_3)
L = ChecklistItems("Deselect All")
c_script_3 = CSharpScript(x=id, y=box)  # -> out, A; inputs x: list of Guid, y: Brep
# ---------- c_script_3: C# ----------
    if(x.Count>0)
      A = x;
    else 
      A = y;
# ---------- end c_script_3 ----------
L_2 = ChecklistItems("Select All")
explode = Explode(Curve=crv, Recursive=True)  # -> Segments, Vertices
c_script_4 = CSharpScript(x=cluster, y=mbox)  # -> out, A; inputs x: list of Mesh, y: Mesh; same code as c_script_3
expander = CreateExpander(UIElements=flatten(grid), Header=panel_9, Open=Toggle(True))
expander_2 = CreateExpander(UIElements=data_3, Header="WWR & Shading Devices", Open=True)
lng = ListLength(List=explode.Segments)
adjustpos_8 = AdjustElementPositioning(
    ElementsToAdjust=toggle_5,
    Margin=Slider(0, range=0..100),
    AbsolutePositioning=True,
    Width=Slider(197, range=0..300),
    HorizontalAlignment=number_slider_4,
    VerticalAlignment=number_slider_4)
relay_3 = Relay([toggle_3, toggle_4])
adjustpos_9 = AdjustElementPositioning(
    ElementsToAdjust=data_3,
    Margin=Slider(0, range=0..100),
    AbsolutePositioning=True,
    Width=Slider(197, range=0..300),
    HorizontalAlignment=number_slider_5,
    VerticalAlignment=number_slider_5)
number_slider_6 = Slider(1, range=0..1)
c_script_5 = CSharpScript(x=lng)  # -> out, A; inputs x: Int32
# ---------- c_script_5: C# ----------
    foreach( var obj in GrasshopperDocument.Objects){
      if(obj.NickName == "UpdateWallCount"){
        guid = obj.InstanceGuid;
      }
    }

    if(x != count){
      count = x;
      Grasshopper.Kernel.Parameters.Param_Integer cmp = (Grasshopper.Kernel.Parameters.Param_Integer) this.GrasshopperDocument.FindObject(guid, true);
      cmp.PersistentData.Clear();
      cmp.PersistentData.Append(new Grasshopper.Kernel.Types.GH_Integer(count));
      cmp.ExpireSolution(true);
      A = cmp;
    }


    A = count;
# ---------- c_script_5: C# additional code ----------
  Guid guid;
  int count = 4;
# ---------- end c_script_5 ----------
button = CreateButton(ButtonName=L, ButtonStyle=0)
button_2 = CreateButton(ButtonName=L_2, ButtonStyle=0)
join_3 = TextJoin(Text=[Slider(0, range=0..100), Slider(5, range=0..100), Slider(0, range=0..100), Slider(0, range=0..100)], Join=",")
swatch_2 = ColourSwatch(SwatchColor=RGB(181, 54, 54))
tooltip_10 = AttachTooltipToElement(ElementsToAttachTo=slider_10, TooltipContent="the R-Value of the exterior walls", ShowDelay=500, Duration=2000)
tooltip_11 = AttachTooltipToElement(ElementsToAttachTo=slider_11, TooltipContent="the R-Value of the Roof", ShowDelay=500, Duration=2000)
tooltip_12 = AttachTooltipToElement(ElementsToAttachTo=slider_12, TooltipContent="the R-Value of the Ground", ShowDelay=500, Duration=2000)
tooltip_13 = AttachTooltipToElement(ElementsToAttachTo=slider_13, TooltipContent="the U-Value of the glazing system", ShowDelay=500, Duration=2000)
tooltip_14 = AttachTooltipToElement(
    ElementsToAttachTo=slider_14,
    TooltipContent="the Solar Heat Gain Coefficient of the glazing system",
    ShowDelay=500,
    Duration=2000)
toggle_6 = BooleanToggle(True)
adjustelem_3 = AdjustElementAppearance(
    ElementsToAdjust=graft(expander),
    Foreground=ColourSwatch(SwatchColor=RGB(255, 255, 255)),
    Background=ColourSwatch(SwatchColor=RGB(102, 102, 102)),
    FontSize=Slider(13.6, range=0..20))
adjustpos_10 = AdjustElementPositioning(
    ElementsToAdjust=expander,
    Margin="0,0,0,0",
    AbsolutePositioning=Toggle(True),
    Width=Slider(419, range=0..1000),
    Height=Slider(89, range=0..1000),
    HorizontalAlignment=Slider(0, range=0..10),
    VerticalAlignment=Slider(2, range=0..10))
values_12 = ValueListener(Elements=button, SomeProperty=True)  # -> Values, Indices
preview = CustomPreview(Geometry=c_script_4.A, Material=ColourSwatch(SwatchColor=RGB(46, 46, 46)))
values_13 = ValueListener(Elements=button_2, SomeProperty=True)  # -> Values, Indices
adjustelem_4 = AdjustElementAppearance(ElementsToAdjust=toggle_3, Foreground=swatch_2, Background=swatch_2, FontSize=Slider(53, range=0..100))
adjustpos_11 = AdjustElementPositioning(
    ElementsToAdjust=relay_3,
    Margin=Slider(5, range=0..100),
    AbsolutePositioning=False,
    Width=Slider(218, range=0..400),
    Height=Slider(39, range=0..100),
    HorizontalAlignment=number_slider_6,
    VerticalAlignment=number_slider_6)
adjustpos_12 = AdjustElementPositioning(
    ElementsToAdjust=merge_3,
    Margin=join_3,
    AbsolutePositioning=True,
    Width=Slider(198, range=0..300),
    Height=Slider(35, range=0..100))
tooltip_15 = AttachTooltipToElement(ElementsToAttachTo=slider_15, TooltipContent="Ceiling Reflectance", ShowDelay=500, Duration=2000)
tooltip_16 = AttachTooltipToElement(ElementsToAttachTo=slider_16, TooltipContent="Floor Reflectance", ShowDelay=500, Duration=2000)
tooltip_17 = AttachTooltipToElement(ElementsToAttachTo=slider_8, TooltipContent="Wall Reflectance", ShowDelay=500, Duration=2000)
tooltip_18 = AttachTooltipToElement(ElementsToAttachTo=slider_9, TooltipContent="Glazing transparency", ShowDelay=500, Duration=2000)
checklist = CreateChecklist(ChecklistItems=["Wall 0", "Wall 1", "Wall 2", "Wall 3", "Wall 4", "Wall 5"], Selected=toggle_6)
updatewallcount = Integer(12)
c_script_6 = CSharpScript(x=values_12.Values)  # -> out, A; inputs x: Int32
# ---------- c_script_6: C# ----------
    foreach( var obj in GrasshopperDocument.Objects){
      if(obj.NickName == "UpdateSelectAllWallCount"){
        guid = obj.InstanceGuid;
      }
    }

    if(x == 1){
      Grasshopper.Kernel.Parameters.Param_Integer cmp = (Grasshopper.Kernel.Parameters.Param_Integer) this.GrasshopperDocument.FindObject(guid, true);
      cmp.PersistentData.Clear();
      cmp.PersistentData.Append(new Grasshopper.Kernel.Types.GH_Integer(0));
      cmp.ExpireSolution(true);
    }
# ---------- c_script_6: C# additional code ----------
  Guid guid;
# ---------- end c_script_6 ----------
c_script_7 = CSharpScript(x=values_13.Values)  # -> out, A; inputs x: Int32
# ---------- c_script_7: C# ----------
    foreach( var obj in GrasshopperDocument.Objects){
      if(obj.NickName == "UpdateSelectAllWallCount"){
        guid = obj.InstanceGuid;
      }
    }

    if(x == 1){
      Grasshopper.Kernel.Parameters.Param_Integer cmp = (Grasshopper.Kernel.Parameters.Param_Integer) this.GrasshopperDocument.FindObject(guid, true);
      cmp.PersistentData.Clear();
      cmp.PersistentData.Append(new Grasshopper.Kernel.Types.GH_Integer(1));
      cmp.ExpireSolution(true);
    }
# ---------- c_script_7: C# additional code ----------
  Guid guid;
# ---------- end c_script_7 ----------
series_2 = Series(Start=0, Step=1, Count=updatewallcount)
expander_3 = CreateExpander(UIElements=flatten(merge_3), Header="Set Objects", Open=True)
stack_2 = CreateStack(UIElements=flatten([button_2, button]), Horizontal=True)
format_2 = Format(Format="Wall {0}", Culture=127, Data0=series_2)
updateselectallwallcount = Integer(1)
setchecklist = SetChecklistContents(ChecklistToModify=checklist, NewChecklistContents=format_2, Selected=toggle_6)
setchecklist_2 = SetChecklistContents(ChecklistToModify=checklist, NewChecklistContents=format_2, Selected=updateselectallwallcount)
separator_5 = CreateSeparator(Thickness=Slider(1, range=0..100), Horizontal=True, Color=swatch)
expander_4 = CreateExpander(UIElements=data_2, Header="Room Material", Open=Toggle(True))
scrollviewer = CreateScrollViewer(
    UIElements=checklist,
    HorizontalScrollBarVisibility=2,
    VerticalScrollBarVisibility=0,
    Width=Slider(193, range=0..1000),
    Height=Slider(263, range=0..1000))
c_script_8 = CSharpScript(x=values.Values)  # -> out, A; inputs x: String
# ---------- c_script_8: C# ----------
    A = x.ToCharArray().Length;
# ---------- end c_script_8 ----------
merge_4 = Merge(Data1=flatten(stack_2), Data2=flatten(separator_5), Data3=flatten(scrollviewer))
larger = LargerThan(FirstNumber=c_script_8.A, SecondNumber=0)  # -> LargerThan, OrEqualTo
button_3 = Button()
number_slider_7 = Slider(115, range=0..117)
adjustelem_5 = AdjustElementAppearance(
    ElementsToAdjust=graft([expander_4, expander_2]),
    Foreground=ColourSwatch(SwatchColor=RGB(255, 255, 255)),
    Background=ColourSwatch(SwatchColor=RGB(102, 102, 102)),
    FontSize=Slider(13.4, range=0..20))
expander_5 = CreateExpander(UIElements=flatten(merge_4), Header="Select Walls", Open=Toggle(True))
panel_10 = Panel(c_script_2.A)
sddp = ShapeDiverDocumentPayload({AbsoluteTolerance=0, AngleTolerance=0, DistanceDisplayPrecision=0, GltfVersion="Gltf2", InputGroups="{}", OutputGroups="{}", RelativeTolerance=0, UnitSystem=0, VersionCreated="1.13.1.0", VersionSaved="1.13.1.0"})
number_slider_8 = Slider(99, range=0..100)
id_2 = Guid(values_8.Values)
values_14 = ValueListener(Elements=toggle_3, SomeProperty=True)  # -> Values, Indices
values_15 = ValueListener(Elements=checklist, SomeProperty=True)  # -> Values, Indices
values_16 = ValueListener(Elements=slider_5, SomeProperty=True)  # -> Values, Indices
values_17 = ValueListener(Elements=slider_4, SomeProperty=True)  # -> Values, Indices
values_18 = ValueListener(Elements=slider_3, SomeProperty=True)  # -> Values, Indices
values_19 = ValueListener(Elements=toggle_4, SomeProperty=True)  # -> Values, Indices
values_20 = ValueListener(Elements=slider_6, SomeProperty=True)  # -> Values, Indices
values_21 = ValueListener(Elements=slider_7, SomeProperty=True)  # -> Values, Indices
values_22 = ValueListener(Elements=slider, SomeProperty=True)  # -> Values, Indices
values_23 = ValueListener(Elements=pulldown_2, SomeProperty=True)  # -> Values, Indices
values_24 = ValueListener(Elements=pulldown, SomeProperty=True)  # -> Values, Indices
values_25 = ValueListener(Elements=slider_15, SomeProperty=True)  # -> Values, Indices
values_26 = ValueListener(Elements=slider_16, SomeProperty=True)  # -> Values, Indices
values_27 = ValueListener(Elements=slider_8, SomeProperty=True)  # -> Values, Indices
values_28 = ValueListener(Elements=slider_9, SomeProperty=True)  # -> Values, Indices
values_29 = ValueListener(Elements=slider_10, SomeProperty=True)  # -> Values, Indices
values_30 = ValueListener(Elements=slider_11, SomeProperty=True)  # -> Values, Indices
values_31 = ValueListener(Elements=slider_12, SomeProperty=True)  # -> Values, Indices
values_32 = ValueListener(Elements=slider_13, SomeProperty=True)  # -> Values, Indices
values_33 = ValueListener(Elements=slider_14, SomeProperty=True)  # -> Values, Indices
id_3 = Guid(id_2)
id_4 = Guid(values_10.Values)
num_2 = Number(values_17.Values)
num_3 = Number(values_16.Values)
int = Integer(values_14.Values)
int_2 = Integer(values_19.Values)
num_4 = Number(values_20.Values)
num_5 = Number(values_21.Values)
clean = CleanTree(RemoveNulls=True, RemoveInvalid=True, RemoveEmpty=True, Tree=id_3)
clean_2 = CleanTree(RemoveNulls=True, RemoveInvalid=True, RemoveEmpty=True, Tree=id_4)
series_3 = Series(Start=1, Step=1, Count=number_slider_8)
dup = DuplicateData(Data="<Alternative>", Number=number_slider_8, Order=True)
crv_2 = Curve(clean)
crv_3 = Curve(clean_2)
checkbox = CreateCheckbox(Label=series_3, StartingValue=False)
true_button = CreateTrueOnlyButton(ButtonName=dup, ButtonStyle=3)

# ---- group: Clipping Plane
cluster_2 = Cluster_10(C=crv, relay=values_6.Values)

# ----
id_5 = Guid(crv_2)
clean_3 = CleanTree(RemoveNulls=True, RemoveInvalid=True, RemoveEmpty=True, Tree=crv_3)
merge_5 = Merge(Data1=graft(checkbox), Data2=graft(true_button))
id_6 = Guid(clean_3)
bool_2 = Boolean(values_15.Values)
merge_6 = Merge(Data1=values_18.Values, Data2=int, Data3=num_2, Data4=num_3, Data5=int_2, Data6=num_4, Data7=num_5)
bool_3 = Boolean(values_9.Values)
stack_3 = CreateStack(UIElements=merge_5, Horizontal=False)  # -> flatten(Stack)
values_34 = ValueListener(Elements=checkbox, SomeProperty=True)  # -> flatten(Values), Indices
series_4 = Series(Start=0, Step=1, Count=number_slider_8)
adjustpos_13 = AdjustElementPositioning(ElementsToAdjust=true_button, Margin="3", AbsolutePositioning=False, Width=number_slider_7, Height=number_slider_7)
hideshow = HideShowElement(ElementToHideShow=true_button, Show=True, Collapse=True, Disable=True)

c_script_9 = CSharpScript(update=bool_3, currAltString=merge_6)  # -> out, A; inputs update: Boolean, currAltString: list of String
# ---------- c_script_9: C# usings ----------
using System.Linq;
# ---------- c_script_9: C# ----------
    foreach( var obj in GrasshopperDocument.Objects){
      if(obj.NickName == "updateWallPropertises"){
        guid = obj.InstanceGuid;
      }
    }


    if(n == 0){
      Grasshopper.Kernel.Parameters.Param_String cmp = (Grasshopper.Kernel.Parameters.Param_String) this.GrasshopperDocument.FindObject(guid, true);
      cmp.PersistentData.Clear();
      cmp.PersistentData.Append(new GH_String("0.5"));
      cmp.PersistentData.Append(new GH_String("0"));
      cmp.PersistentData.Append(new GH_String("2"));
      cmp.PersistentData.Append(new GH_String("0.3"));
      cmp.PersistentData.Append(new GH_String("0"));
      cmp.PersistentData.Append(new GH_String("1"));
      cmp.PersistentData.Append(new GH_String("0.3"));
      cmp.ExpireSolution(true);
    }

    if(update){
      Grasshopper.Kernel.Parameters.Param_String cmp = (Grasshopper.Kernel.Parameters.Param_String) this.GrasshopperDocument.FindObject(guid, true);
      cmp.PersistentData.Clear();
      IEnumerable<Grasshopper.Kernel.Types.GH_String> convertedList = currAltString.Select(s => new Grasshopper.Kernel.Types.GH_String(s));
      cmp.PersistentData.AppendRange(convertedList, new GH_Path(0));
      cmp.ExpireSolution(true);
      n++;
    }




    n++;
# ---------- c_script_9: C# additional code ----------
  int n = 0;
  Guid guid;
# ---------- end c_script_9 ----------
updatewallpropertises = Text(["0.22", "1", "3", "0.3", "1", "1", "0.3"])

c_script_10 = CSharpScript(update=bool_3, currAltString=bool_2)  # -> out, A; inputs update: Boolean, currAltString: list of String
# ---------- c_script_10: C# ----------
    foreach( var obj in GrasshopperDocument.Objects){
      if(obj.NickName == "updateSelectedWalls"){
        guid = obj.InstanceGuid;
      }
    }


    if(n == 0){
      Grasshopper.Kernel.Parameters.Param_String cmp = (Grasshopper.Kernel.Parameters.Param_String) this.GrasshopperDocument.FindObject(guid, true);
      cmp.PersistentData.Clear();
      IEnumerable<Grasshopper.Kernel.Types.GH_String> convertedList = currAltString.Select(s => new Grasshopper.Kernel.Types.GH_String(s));
      cmp.PersistentData.AppendRange(convertedList, new GH_Path(0));
      cmp.ExpireSolution(true);
    }

    if(update){
      Grasshopper.Kernel.Parameters.Param_String cmp = (Grasshopper.Kernel.Parameters.Param_String) this.GrasshopperDocument.FindObject(guid, true);
      cmp.PersistentData.Clear();
      IEnumerable<Grasshopper.Kernel.Types.GH_String> convertedList = currAltString.Select(s => new Grasshopper.Kernel.Types.GH_String(s));
      cmp.PersistentData.AppendRange(convertedList, new GH_Path(0));
      cmp.ExpireSolution(true);
      n++;
    }




    n++;
# ---------- c_script_10: C# additional code ----------
  int n = 0;
  Guid guid;
# ---------- end c_script_10 ----------
updateselectedwalls = Text(["True", "True", "True", "True", "True", "True", "True", "True", "True", "True", "True", "True"])

cull_2 = CullPattern(List=series_4, CullPattern=values_34.Values)
partition = PartitionList(List=stack_3, Size="3")
item_8 = ListItem(List=cull_2, Index=0, Wrap=True)
item_9 = ListItem(List=updatewallpropertises, Index=0, Wrap=True)  # -> Item, Item1, Item2, Item3, Item4, Item5, Item6
panel_11 = Panel(updatewallpropertises)
saveddata = Text(Tree({0;0}: ["e452e38c-1154-4cc5-893f-1d6c19d47754"], {0;1}: [], {0;2}: ["0.22", "0.22", "0.22", "0.22", "0.22", "0.22", "0.22", "0.22", "0.22", "0.22", "0.22", "0.22"], {0;3}: ["1", "1", "1", "1", "1", "1", "1", "1", "1", "1", "1", "1"], {0;4}: ["3", "3", "3", "3", "3", "3", "3", "3", "3", "3", "3", "3"], {0;5}: ["0.3", "0.3", "0.3", "0.3", "0.3", "0.3", "0.3", "0.3", "0.3", "0.3", "0.3", "0.3"]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))
panel_12 = Panel("""False
False
True""")
panel_13 = Panel("""Retrieve
Investigate
None""")
retrieving = Text()
branch_2 = TreeBranch(Tree=retrieving, Path="11", MaintainPaths=True)
branch_3 = TreeBranch(Tree=retrieving, Path="10", MaintainPaths=True)
setlist = SetListContents(ListToModify=pulldown, NewListContents=panel_4, SelectedIndex=branch_2)
setlist_2 = SetListContents(ListToModify=pulldown_2, NewListContents=data, SelectedIndex=branch_3)
branch_4 = TreeBranch(Tree=retrieving, Path="9", MaintainPaths=True)
setslider = SetSlider(UISlider=slider, Value=branch_4)
ma = MassAddition(Input=values_34.Values)  # -> Result, PartialResults
radiobtn_2 = CreateRadioButton(RadioButtonName=panel_13, RadioButtonGroup="Operations", InitiallySelected=panel_12)
larger_2 = LargerThan(FirstNumber=ma.Result, SecondNumber=1)  # -> LargerThan, OrEqualTo
item_10 = ListItem(List=radiobtn_2, Index=0, Wrap=True)  # -> Item, Item1
values_35 = ValueListener(Elements=item_10.Item, SomeProperty=True)  # -> Values, Indices
c_script_11 = CSharpScript(
    currentOutlineGuid=id_5,
    interiorWallsGuid=id_6,
    selectedWalls=updateselectedwalls,
    WWR=item_9.Item,
    verticalFnOnOff=item_9.Item1,
    verticalFnCnt=item_9.Item2,
    verticalFnDp=item_9.Item3,
    horizontalFnOnOff=item_9.Item4,
    horizontalFnCnt=item_9.Item5,
    horizontalFnDp=item_9.Item6,
    height=values_22.Values,
    floorProgram=values_23.Indices,
    floorType=values_24.Indices,
    ceilingReflectance=values_25.Values,
    floorReflectance=values_26.Values,
    wallReflectance=values_27.Values,
    glazingReflectance=values_28.Values,
    wallRValue=values_29.Values,
    roofRValue=values_30.Values,
    groundRValue=values_31.Values,
    winUValue=values_32.Values,
    winSHGC=values_33.Values,
    retrievedData=retrieving,
    isRetrieved=values_35.Values)  # -> out, ZoneOutline, SurfaceFloor, MeshFloor, MeshCeiling, MeshExteriorWalls, MeshVerticalFins, MeshHorizontalFins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; inputs currentOutlineGuid: list of Guid, interiorWallsGuid: list of Guid, selectedWalls: list of Boolean, WWR: Double, verticalFnOnOff: Double, verticalFnCnt: Int32, verticalFnDp: Double, horizontalFnOnOff: Double, horizontalFnCnt: Int32, horizontalFnDp: Double, height: Double, floorProgram: Double, floorType: Double, ceilingReflectance: Double, floorReflectance: Double, wallReflectance: Double, glazingReflectance: Double, wallRValue: Double, roofRValue: Double, groundRValue: Double, winUValue: Double, winSHGC: Double, retrievedData: tree of String, isRetrieved: Boolean
# ---------- c_script_11: C# ----------
    Curve currentOutlineCurve = (Curve) Rhino.RhinoDoc.ActiveDoc.Objects.FindId(currentOutlineGuid[0]).Geometry;
    if(currentOutlineGuid.Count == 0 || !currentOutlineCurve.IsClosed )return;



    ////////////////////////////////////////
    string strCurrentOutlineGuid = currentOutlineGuid[0].ToString();
    List<string> strInteriorWallsGuidList = new List<string>();
    if(interiorWallsGuid.Count > 0){
      for(int i = 0; i < interiorWallsGuid.Count;i++ )
        strInteriorWallsGuidList.Add(interiorWallsGuid[i].ToString());
    }


    ///////////////////////Generating data

    if(wallcount != selectedWalls.Count ){
      allData.Clear();

      for(int i = 0 ;i < selectedWalls.Count ;i++){

        allData.Add("0", new GH_Path(2));
        allData.Add("0", new GH_Path(3));
        allData.Add("0", new GH_Path(4));
        allData.Add("0", new GH_Path(5));
        allData.Add("0", new GH_Path(6));
        allData.Add("0", new GH_Path(7));
        allData.Add("0", new GH_Path(8));
        if(i == 0){
          allData.Add(strCurrentOutlineGuid.ToString(), new GH_Path(0));
          allData.AddRange(strInteriorWallsGuidList, new GH_Path(1));
          allData.Add(height.ToString(), new GH_Path(9));
          allData.Add(floorProgram.ToString(), new GH_Path(10));
          allData.Add(floorType.ToString(), new GH_Path(11));
          allData.Add(ceilingReflectance.ToString(), new GH_Path(12));
          allData.Add(floorReflectance.ToString(), new GH_Path(13));
          allData.Add(wallReflectance.ToString(), new GH_Path(14));
          allData.Add(glazingReflectance.ToString(), new GH_Path(15));
          allData.Add(wallRValue.ToString(), new GH_Path(16));
          allData.Add(roofRValue.ToString(), new GH_Path(17));
          allData.Add(groundRValue.ToString(), new GH_Path(18));
          allData.Add(winUValue.ToString(), new GH_Path(19));
          allData.Add(winSHGC.ToString(), new GH_Path(20));
        }
      }
    }
    wallcount = selectedWalls.Count;

    A = allData;

    for(int i = 0 ;i < selectedWalls.Count ;i++){

      allData[new GH_Path(0), 0] = strCurrentOutlineGuid;
      
      allData.RemovePath(new GH_Path(1));
      allData.AddRange(strInteriorWallsGuidList, new GH_Path(1));

      if(selectedWalls[i]){
        allData[new GH_Path(2), i] = WWR.ToString();
        allData[new GH_Path(3), i] = verticalFnOnOff.ToString();
        allData[new GH_Path(4), i] = verticalFnCnt.ToString();
        allData[new GH_Path(5), i] = verticalFnDp.ToString();
        allData[new GH_Path(6), i] = horizontalFnOnOff.ToString();
        allData[new GH_Path(7), i] = horizontalFnCnt.ToString();
        allData[new GH_Path(8), i] = horizontalFnDp.ToString();
      }
      allData[new GH_Path(9), 0] = height.ToString();
      allData[new GH_Path(10), 0] = floorProgram.ToString();
      allData[new GH_Path(11), 0] = floorType.ToString();
      allData[new GH_Path(12), 0] = ceilingReflectance.ToString();
      allData[new GH_Path(13), 0] = floorReflectance.ToString();
      allData[new GH_Path(14), 0] = wallReflectance.ToString();
      allData[new GH_Path(15), 0] = glazingReflectance.ToString();
      allData[new GH_Path(16), 0] = wallRValue.ToString();
      allData[new GH_Path(17), 0] = roofRValue.ToString();
      allData[new GH_Path(18), 0] = groundRValue.ToString();
      allData[new GH_Path(19), 0] = winUValue.ToString();
      allData[new GH_Path(20), 0] = winSHGC.ToString();
    }

    //////////////////////////Defining active curve and data


    Curve outline ;
    DataTree<string> activeData = new DataTree<string>();
    if(isRetrieved && retrievedData.Branch(0).Count > 0 && retrievedData.AllData().Count > 0){
      activeData = retrievedData;
      //outline = (Curve) Rhino.RhinoDoc.ActiveDoc.Objects.FindId(activeData[new GH_Path(0), 0]).Geometry;
    }
    else{
      activeData = allData;
      //outline = currentOutlineCurve;
    }

    outline = (Curve) Rhino.RhinoDoc.ActiveDoc.Objects.FindId(new Guid(activeData[new GH_Path(0), 0])).Geometry;



    /////////////////////////////Defining active interiorwall curves

    List<Curve> activeInteriorWalls = new List<Curve>();
    for(int i = 0; i < activeData.Branch(1).Count ;i++ ){
      activeInteriorWalls.Add((Curve) Rhino.RhinoDoc.ActiveDoc.Objects.FindId(new Guid(activeData[new GH_Path(1), i])).Geometry);
    }


    /////////////////////Generating Frames and fins

    List<Curve> AllClosedCurves = new List<Curve> ();
    AllClosedCurves.Add(outline);
    foreach(Curve c in activeInteriorWalls){
      if(c.IsClosed){
        List<Point3d> cornerPoints = new List<Point3d> ();
        cornerPoints.AddRange(c.ToNurbsCurve().GrevillePoints());
        foreach(Point3d pt in cornerPoints){
          if(outline.Contains(pt, Plane.WorldXY, 0.01) == Rhino.Geometry.PointContainment.Inside){
            AllClosedCurves.Add(c);
          }
        }
      }
    }

    Brep FloorBrep = Brep.CreatePlanarBreps(AllClosedCurves, 0.01)[0].DuplicateBrep();
    Mesh floorM = Mesh.CreateFromBrep(FloorBrep, MeshingParameters.FastRenderMesh)[0];
    Mesh ceilingM = floorM.DuplicateMesh();
    ceilingM.Translate(Vector3d.ZAxis * Convert.ToDouble(activeData[new GH_Path(9), 0]));
    MeshFloor = floorM;
    MeshCeiling = ceilingM;
    SurfaceFloor = FloorBrep;

    //////Ceiling and Floor geometry without holes
    Brep solidFloorBrep = Brep.CreatePlanarBreps(outline, 0.01)[0].DuplicateBrep();
    Mesh solidFloorM = Mesh.CreateFromBrep(solidFloorBrep, MeshingParameters.FastRenderMesh)[0];
    Mesh solidCeilingM = solidFloorM.DuplicateMesh();
    solidCeilingM.Translate(Vector3d.ZAxis * Convert.ToDouble(activeData[new GH_Path(9), 0]));
    SolidMeshFloor = solidFloorM;
    SolidMeshCeiling = solidCeilingM;




    List<Mesh> porousWalls = new List<Mesh>();Mesh solidWalls = new Mesh();
    List<double> wwrForEachWall = new List<double>();

    Mesh AllFrames = new Mesh();Mesh AllVrtFins = new Mesh();Mesh AllHrzFins = new Mesh();
    Mesh mesh = new Mesh();Mesh VrtFins = new Mesh(); Mesh HrzFins = new Mesh();
    List<double> verticalSpacingNumbers = new List<double>();
    List<double> horizontalSpacingNumbers = new List<double>();
    List<double> verticalFinsDepth = new List<double>();List<double> horizontalFinsDepth = new List<double>();
    List<Mesh> allWindows = new List<Mesh>();
    double verticalSpacing = 0;double horizontalSpacing = 0; Vector3d normalVector = new Vector3d();
    List<Curve> allSegments1 = new List<Curve> ();
    allSegments1.AddRange(outline.DuplicateSegments());
    List<Curve> allSegments2 = new List<Curve> ();
    double minLng = 3;
    TWWR = 0;


    A = activeData;
    for(int i = 0 ;i < allSegments1.Count ;i++){
      ///*
      TWWR += Convert.ToDouble(activeData[new GH_Path(2), i]) / allSegments1.Count * 1.0;

      Curve cr = allSegments1[i];

      cr.Domain = new Interval(0, 1);

      /////////////////////////////////Generating objects for energy performance
      if(Convert.ToDouble(activeData[new GH_Path(2), i]) > 0){
        porousWalls.Add(GenerateInteriorWalls(FloorBrep, cr, Convert.ToDouble(activeData[new GH_Path(9), 0])));
        wwrForEachWall.Add(Convert.ToDouble(activeData[new GH_Path(2), i]));
      }
      else
        solidWalls.Append(GenerateInteriorWalls(FloorBrep, cr, Convert.ToDouble(activeData[new GH_Path(9), 0])));
      ///////////////////////


      double crvLength = cr.PointAtStart.DistanceTo(cr.PointAtEnd);
      int crvDivision = (int) Math.Ceiling(crvLength / minLng);
      Mesh win = new Mesh();
      if(crvDivision == 1){
        GenerateFrame(FloorBrep, cr, Convert.ToDouble(activeData[new GH_Path(2), i]), Convert.ToDouble(activeData[new GH_Path(9), 0]), Convert.ToInt32(activeData[new GH_Path(3), i]), Convert.ToInt32(activeData[new GH_Path(4), i]),
          Convert.ToDouble(activeData[new GH_Path(5), i]), Convert.ToInt32(activeData[new GH_Path(6), i]), Convert.ToInt32(activeData[new GH_Path(7), i]), Convert.ToDouble(activeData[new GH_Path(8), i]), out mesh, out VrtFins, out  HrzFins, out verticalSpacing, out horizontalSpacing, out normalVector, out win);
        AllFrames.Append(mesh);
        AllVrtFins.Append(VrtFins);
        AllHrzFins.Append(HrzFins);
        if(Convert.ToDouble(activeData[new GH_Path(2), i]) > 0){
          verticalSpacingNumbers.Add(verticalSpacing);
          horizontalSpacingNumbers.Add(horizontalSpacing);
          allWindows.Add(win);

          if(Convert.ToInt32(activeData[new GH_Path(3), i]) == 0)
            verticalFinsDepth.Add(0);
          else
            verticalFinsDepth.Add(Convert.ToDouble(activeData[new GH_Path(5), i]));

          if(Convert.ToInt32(activeData[new GH_Path(6), i]) == 0)
            horizontalFinsDepth.Add(0);
          else
            horizontalFinsDepth.Add(Convert.ToDouble(activeData[new GH_Path(8), i]));

        }
      }
      else{
        List<double> tParameters = new List<double> ();
        List<Curve> splittedCurves = new List<Curve> ();
        for(int j = 0 ;j < crvDivision ;j++)
          tParameters.Add(j * (1.0 / crvDivision * 1.0));
        splittedCurves.AddRange(cr.Split(tParameters));
        for(int k = 0 ;k < splittedCurves.Count ;k++){
          GenerateFrame(FloorBrep, splittedCurves[k], Convert.ToDouble(activeData[new GH_Path(2), i]), Convert.ToDouble(activeData[new GH_Path(9), 0]), Convert.ToInt32(activeData[new GH_Path(3), i]), Convert.ToInt32(activeData[new GH_Path(4), i]),
            Convert.ToDouble(activeData[new GH_Path(5), i]), Convert.ToInt32(activeData[new GH_Path(6), i]), Convert.ToInt32(activeData[new GH_Path(7), i]), Convert.ToDouble(activeData[new GH_Path(8), i]), out mesh, out VrtFins, out  HrzFins, out verticalSpacing, out horizontalSpacing, out normalVector, out win);
          AllFrames.Append(mesh);
          AllVrtFins.Append(VrtFins);
          AllHrzFins.Append(HrzFins);
          if(Convert.ToDouble(activeData[new GH_Path(2), i]) > 0){
            verticalSpacingNumbers.Add(verticalSpacing);
            horizontalSpacingNumbers.Add(horizontalSpacing);
            allWindows.Add(win);
            if(Convert.ToDouble(activeData[new GH_Path(3), i]) == 0)
              verticalFinsDepth.Add(0);
            else
              verticalFinsDepth.Add(Convert.ToDouble(activeData[new GH_Path(5), i]));
            if(Convert.ToDouble(activeData[new GH_Path(6), i]) == 0)
              horizontalFinsDepth.Add(0);
            else
              horizontalFinsDepth.Add(Convert.ToDouble(activeData[new GH_Path(8), i]));
          }
        }
      }

    }



    ///////////////////////Generating Interior Walls
    Mesh interiorWallMesh = new Mesh();

    if(activeInteriorWalls.Count > 0){

      foreach(Curve crv in activeInteriorWalls){
        List<Curve> allSegments = new List<Curve> ();
        allSegments.AddRange(crv.DuplicateSegments());

        for(int i = 0 ;i < allSegments.Count ;i++){
          Curve cr = allSegments[i];
          interiorWallMesh.Append(GenerateInteriorWalls(FloorBrep, cr, Convert.ToDouble(activeData[new GH_Path(9), 0])));
        }
      }
    }


    MeshExteriorWalls = AllFrames;
    if(AllVrtFins.Vertices.Count > 0)
      MeshVerticalFins = AllVrtFins;
    if(AllHrzFins.Vertices.Count > 0)
      MeshHorizontalFins = AllHrzFins;
    MeshInteriorWalls = interiorWallMesh;//.SplitDisjointPieces();
    VerticalFinsSpacing = verticalSpacingNumbers;
    HorizontalFinsSpacing = horizontalSpacingNumbers;
    AlternativeData = activeData;
    MeshWindows = allWindows;
    TotalWWR = RoundNumber(TWWR, 0.01);
    VerticalFinsDepth = verticalFinsDepth;
    HorizontalFinsDepth = horizontalFinsDepth;
    PorousWalls = porousWalls;
    WwrForEachWall = wwrForEachWall;
    SolidWalls = solidWalls;
    ZoneOutline = allSegments1;


    // A = activeData;
# ---------- c_script_11: C# additional code ----------
  double TWWR = 0;
  int wallcount = 0;
  DataTree<string> allData = new DataTree<string>();

  List<double> VrtFinDep = new List<double>();
  List<int> VrtFinCnt = new List<int>();

  List<double> HrzFinDep = new List<double>();
  List<int> HrzFinCnt = new List<int>();


  public void GenerateFrame (Brep floor, Curve crv, double WWR, double height, int verticalFnOnOff, int verticalFnCnt, double verticalFnDp, int horizontalFnOnOff, int horizontalFnCnt,
    double horizontalFnDp, out Mesh Frame, out Mesh VrtFins, out Mesh HrzFins, out double verticalSpacing, out double horizontalSpacing, out Vector3d normalVector,
  out Mesh window){


    ///////////////////////////////Generating frame Mesh
    Frame = new Mesh();
    Curve crv1 = crv.DuplicateCurve();
    Curve crv2 = crv.DuplicateCurve();
    crv1.Domain = new Interval(0, 1);
    Point3d midPt = crv1.PointAt(0.5) + new Vector3d(0, 0, height / 2);
    var tr1 = Rhino.Geometry.Transform.Scale(midPt, Math.Sqrt(WWR));
    crv2.Transform(tr1);
    Point3d p1 = crv1.PointAtStart; Point3d p2 = crv1.PointAtEnd;
    Point3d p4 = crv2.PointAtStart; Point3d p3 = crv2.PointAtEnd;
    Frame.Vertices.Add(p1);
    Frame.Vertices.Add(p2);
    Frame.Vertices.Add(p3);
    Frame.Vertices.Add(p4);


    var tr2 = Rhino.Geometry.Transform.Translation(new Vector3d(0, 0, height));
    Curve crvTop = crv.DuplicateCurve();
    crvTop.Transform(tr2);
    Curve crv3 = crvTop.DuplicateCurve();
    Curve crv4 = crvTop.DuplicateCurve();
    crv1.Domain = new Interval(0, 1);
    midPt = crv1.PointAt(0.5) + new Vector3d(0, 0, height / 2);
    crv4.Transform(tr1);
    Point3d p5 = crv3.PointAtStart; Point3d p6 = crv3.PointAtEnd;
    Point3d p8 = crv4.PointAtStart; Point3d p7 = crv4.PointAtEnd;
    Frame.Vertices.Add(p5);
    Frame.Vertices.Add(p6);
    Frame.Vertices.Add(p7);
    Frame.Vertices.Add(p8);

    if(WWR > 0.01){
      Frame.Faces.AddFace(new MeshFace(0, 1, 2, 3));
      Frame.Faces.AddFace(new MeshFace(4, 5, 6, 7));
      Frame.Faces.AddFace(new MeshFace(1, 5, 6, 2));
      Frame.Faces.AddFace(new MeshFace(4, 0, 3, 7));
      Frame.UnifyNormals();
    }
    else
      Frame.Faces.AddFace(new MeshFace(0, 1, 5, 4));

    Frame = repairMesh(Frame);

    ////////////////////////////////Normal Vector
    Vector3d vr1 = p2 - p1;
    vr1.Unitize();
    vr1.Rotate(0.5 * Math.PI, Vector3d.ZAxis);
    Vector3d vr2 = -1 * vr1;
    Point3d[] testPs = new Point3d[2] {(p1 + p2) / 2 + (0.1 * vr1),(p1 + p2) / 2 + (0.1 * vr2)};
    Vector3d[] testVs = new Vector3d[2] {vr1,vr2};
    double[] testDs = new double[2] {testPs[0].DistanceTo(floor.ClosestPoint(testPs[0])),testPs[1].DistanceTo(floor.ClosestPoint(testPs[1]))};
    Array.Sort(testDs, testVs);

    normalVector = testVs[1];

    /////////////////////////////Defining objects
    window = new Mesh();
    verticalSpacing = 0;
    VrtFins = new Mesh();
    horizontalSpacing = 0;
    HrzFins = new Mesh();
    //////////////////////////////Generating windows
    if(WWR > 0){
      window.Vertices.Add(p3);
      window.Vertices.Add(p4);
      window.Vertices.Add(p8);
      window.Vertices.Add(p7);
      window.Faces.AddFace(new MeshFace(0, 1, 2, 3));

      /////////////////////////verticalSpacing

      if(verticalFnCnt < 2)
        verticalSpacing = p3.DistanceTo(p4);
      else
        verticalSpacing = p3.DistanceTo(p4) / verticalFnCnt * 1.0;

      if(verticalFnOnOff == 1){
        ///////////////////////VerticalFinMesh
        verticalFnCnt--;
        for(int i = 0 ;i <= verticalFnCnt ;i++){
          double step = 1.0 / verticalFnCnt * 1.0;
          Point3d topPt = (p3 * (i * step)) + (p4 * (1 - (i * step)));
          Point3d bottomPt = (p7 * (i * step)) + (p8 * (1 - (i * step)));
          VrtFins.Vertices.Add(topPt);
          VrtFins.Vertices.Add(bottomPt);
          VrtFins.Vertices.Add(topPt + testVs[1] * verticalFnDp);
          VrtFins.Vertices.Add(bottomPt + testVs[1] * verticalFnDp);
          VrtFins.Faces.AddFace((4 * i) + 0, (4 * i) + 1, (4 * i) + 3, (4 * i) + 2);
        }
        VrtFins = repairMesh(VrtFins);
      }

      ////////////////////////horizontalSpacing
      if(horizontalFnCnt < 2)
        horizontalSpacing = p3.DistanceTo(p7);
      else
        horizontalSpacing = p3.DistanceTo(p7) / horizontalFnCnt * 1.0;

      if(horizontalFnOnOff == 1){
        ////////////////////////////////horizontalFinMesh
        for(int i = 0 ;i < horizontalFnCnt ;i++){
          double step = 1.0 / horizontalFnCnt * 1.0;
          Point3d leftPt = (p3 * (i * step)) + (p7 * (1 - (i * step)));
          Point3d rightPt = (p4 * (i * step)) + (p8 * (1 - (i * step)));
          HrzFins.Vertices.Add(leftPt);
          HrzFins.Vertices.Add(rightPt);
          HrzFins.Vertices.Add(leftPt + testVs[1] * horizontalFnDp);
          HrzFins.Vertices.Add(rightPt + testVs[1] * horizontalFnDp);
          HrzFins.Faces.AddFace((4 * i) + 0, (4 * i) + 1, (4 * i) + 3, (4 * i) + 2);
        }
        HrzFins = repairMesh(HrzFins);
      }
    }

  }

  public Mesh repairMesh(Mesh invalidMesh){
    invalidMesh.Vertices.CombineIdentical(true, true);
    invalidMesh.Faces.CullDegenerateFaces();
    invalidMesh.UnifyNormals();
    invalidMesh.RebuildNormals();
    invalidMesh.Compact();
    return invalidMesh;
  }


  public Mesh GenerateInteriorWalls (Brep floor, Curve crv, double height){

    Mesh InetriorWall = new Mesh();
    Point3d midPt = (crv.PointAtStart + crv.PointAtEnd) * 0.5;
    double testDs = midPt.DistanceTo(floor.ClosestPoint(midPt));
    if(testDs < 1){

      Point3d p1 = crv.PointAtStart; Point3d p2 = crv.PointAtEnd;
      Point3d p3 = crv.PointAtStart + Vector3d.ZAxis * height; Point3d p4 = crv.PointAtEnd + Vector3d.ZAxis * height;
      InetriorWall.Vertices.Add(p1);
      InetriorWall.Vertices.Add(p2);
      InetriorWall.Vertices.Add(p4);
      InetriorWall.Vertices.Add(p3);
      InetriorWall.Faces.AddFace(new MeshFace(0, 1, 2, 3));

      InetriorWall = repairMesh(InetriorWall);
      return InetriorWall;
    }
    else{
      return null;
    }
  }

  public double RoundNumber (double Number, double Scope){
    double Divide = Number / Scope;
    double wholeDiv = Math.Round(Divide);
    return Scope * wholeDiv;
  }
# ---------- end c_script_11 ----------

c_script_12 = CSharpScript(allData=saveddata, retrievedIndex=item_8, isRetrieved=values_35.Values)  # -> out, A; inputs allData: tree of String, retrievedIndex: Int32, isRetrieved: Boolean
# ---------- c_script_12: C# ----------
    foreach( var obj in GrasshopperDocument.Objects){
      if(obj.NickName == "Retrieving"){
        guid = obj.InstanceGuid;
      }
    }

    DataTree<string> retrievedAlternative = new DataTree<string>();
    if(allData.DataCount > 0){
      if(true){
        for(int i = 0 ;i < allData.BranchCount ;i++ ){
          if(allData.Path(i).ToString().Split(';')[0].Split('{')[1] == retrievedIndex.ToString()){
            retrievedAlternative.AddRange(allData.Branch(allData.Path(i)), allData.Path(i));
          }
        }
      }
    }

    if(isRetrieved){
      Grasshopper.Kernel.Parameters.Param_String cmp = (Grasshopper.Kernel.Parameters.Param_String) this.GrasshopperDocument.FindObject(guid, true);
cmp.PersistentData.Clear();
      for (int i = 0; i < retrievedAlternative.BranchCount; i++)
      {
        IEnumerable<Grasshopper.Kernel.Types.GH_String> convertedList = retrievedAlternative.Branch(i).Select(s => new Grasshopper.Kernel.Types.GH_String(s));
        cmp.PersistentData.AppendRange(convertedList, new GH_Path(i));
      }
      cmp.ExpireSolution(true);
    }

    A = retrievedAlternative;
# ---------- c_script_12: C# additional code ----------
  Guid guid;
# ---------- end c_script_12 ----------
c_script_13 = CSharpScript()  # -> out, A
# ---------- c_script_13: C# ----------
    foreach( var obj in GrasshopperDocument.Objects){
      if(obj.NickName == "Retrieving"){
        guid = obj.InstanceGuid;
      }
    }

    if(n == 0){
      Grasshopper.Kernel.Parameters.Param_String cmp = (Grasshopper.Kernel.Parameters.Param_String) this.GrasshopperDocument.FindObject(guid, true);
      cmp.PersistentData.Clear();
      cmp.ExpireSolution(true);
    }

    n++;
# ---------- c_script_13: C# additional code ----------
  Guid guid;
  int n = 0;
# ---------- end c_script_13 ----------

mesh = Mesh([c_script_11.MeshExteriorWalls, c_script_11.MeshInteriorWalls])
mjoin = MeshJoin(Meshes=mesh)
area = Area(Geometry=c_script_11.SurfaceFloor)  # -> Area, Centroid
xy = XYPlane(Origin=area.Centroid)
number_slider_9 = Slider(30, range=0..100)
planesrf = PlaneSurface(Plane=xy, XSize=Domain(-500, 500), YSize=Domain(-500, 500))
hideshow_2 = HideShowElement(ElementToHideShow=item_10.Item, Show=True, Collapse=True, Disable=larger_2.LargerThan)
mplane = MeshPlane(Boundary=planesrf, WidthCount=10, HeightCount=10)  # -> Mesh, Area
button_4 = CreateButton(ButtonName="Exp CSV", ButtonStyle=0)
updated_analysis = Text(["Img _", "WWR : 0", "sDA: 0 %", "ASE: 0 %", "MI: 0 lux", "Total Load : 0", "Cooling : 0", "Heating : 0", "Lighting : 0", "Equipment : 0"])
multiplication_2 = Multiplication(A=number_slider_9, B=3)
txt_2 = Text(branch)
number_slider_10 = Slider(0.01, range=0..1)
mesh_2 = Mesh(mplane.Mesh)
mesh_3 = Mesh(c_script_11.MeshWindows)
mesh_4 = Mesh(c_script_11.MeshCeiling)
mesh_5 = Mesh(mjoin)
mesh_6 = Mesh(c_script_4.A)
mesh_7 = Mesh(c_script_11.MeshFloor)
data_4 = Data(saveddata)
tooltip_19 = AttachTooltipToElement(ElementsToAttachTo=button_4, TooltipContent="Export the alternatives to a csv file", ShowDelay=500, Duration=4000)
values_36 = ValueListener(Elements=button_4, SomeProperty=True)  # -> Values, Indices
lng_2 = ListLength(List=updated_analysis)
adjustpos_14 = AdjustElementPositioning(ElementsToAdjust=button_4, AbsolutePositioning=False, Width=Slider(80, range=0..100), Height=Slider(32, range=0..100))
dup_2 = DuplicateData(Data="<Alternative>", Number=number_slider_9, Order=True)
dup_3 = DuplicateData(Data="<Alternative>", Number=multiplication_2, Order=True)
join_4 = TextJoin(Text=data_4, Join="|")
dup_4 = DuplicateData(Data=updated_analysis, Number=number_slider_9, Order=True)
N = Number(3)
true_button_2 = CreateTrueOnlyButton(ButtonName=dup_3, ButtonStyle=3)
entwine = Entwine(
    Branch00=c_script_11.VerticalFinsDepth,
    Branch01=c_script_11.VerticalFinsSpacing,
    Branch02=c_script_11.HorizontalFinsDepth,
    Branch03=c_script_11.HorizontalFinsSpacing,
    Branch04=c_script_11.WwrForEachWall,
    Branch05=txt_2,
    FlattenInputs=True)
entwine_2 = Entwine(
    Branch00=mesh_4,
    Branch01=mesh_7,
    Branch02=mesh_5,
    Branch03=mesh_3,
    Branch04=mesh_6,
    Branch05=mesh_2,
    Branch06=c_script_11.PorousWalls,
    Branch07=c_script_11.SolidWalls,
    Branch08=c_script_11.SolidMeshFloor,
    Branch09=c_script_11.SolidMeshCeiling,
    FlattenInputs=True)
pshift = ShiftPaths(Data=join_4, Offset=-1)
true_button_3 = CreateTrueOnlyButton(ButtonName=dup_2, ButtonStyle=3)
partition_2 = PartitionList(List=dup_4, Size=lng_2)
txt_3 = Text(c_script_11.AlternativeData)
c_script_14 = CSharpScript(mesh=c_script_11.MeshVerticalFins, offsetDistance=number_slider_10)  # -> out, A; inputs mesh: Mesh, offsetDistance: Double
# ---------- c_script_14: C# ----------
    A =mesh.Offset(offsetDistance, true);
# ---------- end c_script_14 ----------
c_script_15 = CSharpScript(mesh=[c_script_11.MeshExteriorWalls, c_script_11.MeshInteriorWalls], offsetDistance=Slider(0.1, range=0..1))  # -> out, A; inputs mesh: Mesh, offsetDistance: Double; same code as c_script_14
c_script_16 = CSharpScript(mesh=c_script_11.MeshHorizontalFins, offsetDistance=number_slider_10)  # -> out, A; inputs mesh: Mesh, offsetDistance: Double; same code as c_script_14
c_script_17 = CSharpScript(mesh=c_script_11.MeshFloor, offsetDistance=Slider(0.05, range=0..1))  # -> out, A; inputs mesh: Mesh, offsetDistance: Double; same code as c_script_14
partition_3 = PartitionList(List=true_button_2, Size=N)
adjustelem_6 = AdjustElementAppearance(
    ElementsToAdjust=graft(button_4),
    Foreground=ColourSwatch(SwatchColor=RGB(255, 255, 255)),
    Background=ColourSwatch(SwatchColor=RGB(0, 166, 6)),
    FontSize=Slider(12.5, range=0..20))
label_2 = CreateLabel(LabelText=partition_2, LabelSize=12, Justification=0)  # -> simplify(Label)
split = SplitList(List=pshift, Index=Slider(21, range=0..100))  # -> ListA, simplify(ListB)
crv_4 = Curve(c_script_11.ZoneOutline)
c_script_18 = CSharpScript(update=values_4.Values, currAltString=entwine)  # -> out, A; inputs update: Boolean, currAltString: tree of String
# ---------- c_script_18: C# ----------
    foreach( var obj in GrasshopperDocument.Objects){
      if(obj.NickName == "updateString1"){
        guid = obj.InstanceGuid;
      }
    }


    if(n == 0){
      Grasshopper.Kernel.Parameters.Param_String cmp = (Grasshopper.Kernel.Parameters.Param_String) this.GrasshopperDocument.FindObject(guid, true);
      cmp.PersistentData.Clear();
      cmp.ExpireSolution(true);
    }

    if(update){
      Grasshopper.Kernel.Parameters.Param_String cmp = (Grasshopper.Kernel.Parameters.Param_String) this.GrasshopperDocument.FindObject(guid, true);
      cmp.PersistentData.Clear();
      for (int i = 0; i < currAltString.BranchCount; i++)
      {
        IEnumerable<Grasshopper.Kernel.Types.GH_String> convertedList = currAltString.Branch(i).Select(s => new Grasshopper.Kernel.Types.GH_String(s));
        cmp.PersistentData.AppendRange(convertedList, currAltString.Path(i));
      }
      cmp.ExpireSolution(true);
      n++;
    }
# ---------- c_script_18: C# additional code ----------
  int n = 0;
  Guid guid;
# ---------- end c_script_18 ----------
c_script_19 = CSharpScript(update=values_4.Values, currAltString=txt_3)  # -> out, A; inputs update: Boolean, currAltString: tree of String
# ---------- c_script_19: C# ----------
    foreach( var obj in GrasshopperDocument.Objects){
      if(obj.NickName == "updateString2"){
        guid = obj.InstanceGuid;
      }
    }


    if(n == 0){
      Grasshopper.Kernel.Parameters.Param_String cmp = (Grasshopper.Kernel.Parameters.Param_String) this.GrasshopperDocument.FindObject(guid, true);
      cmp.PersistentData.Clear();
      cmp.ExpireSolution(true);
      n++;
    }

    if(update){
      Grasshopper.Kernel.Parameters.Param_String cmp = (Grasshopper.Kernel.Parameters.Param_String) this.GrasshopperDocument.FindObject(guid, true);
      cmp.PersistentData.Clear();
      for (int i = 0; i < currAltString.BranchCount; i++)
      {
        IEnumerable<Grasshopper.Kernel.Types.GH_String> convertedList = currAltString.Branch(i).Select(s => new Grasshopper.Kernel.Types.GH_String(s));
        cmp.PersistentData.AppendRange(convertedList, currAltString.Path(i));
      }
      cmp.ExpireSolution(true);
      n++;
    }
# ---------- c_script_19: C# additional code ----------
  int n=0;
  Guid guid;
# ---------- end c_script_19 ----------
c_script_20 = CSharpScript(update=values_4.Values, currAltMesh=entwine_2)  # -> out, A; inputs update: Boolean, currAltMesh: tree of Mesh
# ---------- c_script_20: C# ----------
    foreach( var obj in GrasshopperDocument.Objects){
      if(obj.NickName == "updateMesh1"){
        guid = obj.InstanceGuid;
      }
    }


    if(n == 0){
      Grasshopper.Kernel.Parameters.Param_Mesh cmp = (Grasshopper.Kernel.Parameters.Param_Mesh) this.GrasshopperDocument.FindObject(guid, true);
      cmp.PersistentData.Clear();
      cmp.ExpireSolution(true);
    }


    if(update){
      Grasshopper.Kernel.Parameters.Param_Mesh cmp = (Grasshopper.Kernel.Parameters.Param_Mesh) this.GrasshopperDocument.FindObject(guid, true);
      cmp.PersistentData.Clear();
      for (int i = 0; i < currAltMesh.BranchCount; i++)
      {
        IEnumerable<Grasshopper.Kernel.Types.GH_Mesh> convertedList = currAltMesh.Branch(i).Select(s => new Grasshopper.Kernel.Types.GH_Mesh(s));
        cmp.PersistentData.AppendRange(convertedList, currAltMesh.Path(i));
      }
      cmp.ExpireSolution(true);
      n++;
    }
# ---------- c_script_20: C# additional code ----------
  int n = 0;
  Guid guid;
# ---------- end c_script_20 ----------
preview_2 = CustomPreview(Geometry=c_script_14.A, Material=ColourSwatch(SwatchColor=RGB(168, 132, 108)))
c_script_21 = CSharpScript(update=values_4.Values)  # -> out, A; inputs update: Boolean
# ---------- c_script_21: C# ----------
    foreach( var obj in GrasshopperDocument.Objects){
      if(obj.NickName == "updateBoolean1"){
        guid = obj.InstanceGuid;
      }
    }

    if(n == 0){
      Grasshopper.Kernel.Parameters.Param_Boolean cmp = (Grasshopper.Kernel.Parameters.Param_Boolean) this.GrasshopperDocument.FindObject(guid, true);
      cmp.PersistentData.Clear();
      cmp.PersistentData.Append(new GH_Boolean(false));
      cmp.ExpireSolution(true);
    }


    if(update){
      Grasshopper.Kernel.Parameters.Param_Boolean cmp = (Grasshopper.Kernel.Parameters.Param_Boolean) this.GrasshopperDocument.FindObject(guid, true);
      cmp.PersistentData.Clear();
      cmp.PersistentData.Append(new GH_Boolean(true));
      cmp.ExpireSolution(true);
      n++;
    }
# ---------- c_script_21: C# additional code ----------
  int n = 0;
  Guid guid;
# ---------- end c_script_21 ----------
preview_3 = CustomPreview(Geometry=c_script_15.A, Material=ColourSwatch(SwatchColor=RGB(148, 148, 148)))
preview_4 = CustomPreview(Geometry=c_script_16.A, Material=ColourSwatch(SwatchColor=RGB(92, 67, 22)))
c_script_22 = CSharpScript(update=values_4.Values, srf=c_script_11.SurfaceFloor)  # -> out, A; inputs update: Boolean, srf: Brep
# ---------- c_script_22: C# ----------
    foreach( var obj in GrasshopperDocument.Objects){
      if(obj.NickName == "updateSurface1"){
        guid = obj.InstanceGuid;
      }
    }


    if(n == 0){
      Grasshopper.Kernel.Parameters.Param_Brep cmp = (Grasshopper.Kernel.Parameters.Param_Brep) this.GrasshopperDocument.FindObject(guid, true);
      cmp.PersistentData.Clear();
      cmp.ExpireSolution(true);
    }


    if(update){
      Grasshopper.Kernel.Parameters.Param_Brep cmp = (Grasshopper.Kernel.Parameters.Param_Brep) this.GrasshopperDocument.FindObject(guid, true);
      cmp.PersistentData.Clear();
      cmp.PersistentData.Append(new GH_Brep(srf));
      cmp.ExpireSolution(true);
      n++;
    }
# ---------- c_script_22: C# additional code ----------
  int n = 0;
  Guid guid;
# ---------- end c_script_22 ----------
preview_5 = CustomPreview(Geometry=c_script_17.A, Material=ColourSwatch(SwatchColor=RGB(186, 186, 186)))
cluster_3 = Cluster_14(relay=crv_4, T=c_script_11.AlternativeData)  # -> pl_2, R
merge_7 = Merge(Data1=simplify(graft(true_button_3)), Data2=simplify(partition_3), Data3=simplify(label_2))
merge_8 = Merge(Data1=flatten(radiobtn_2), Data2=flatten(button_4))
setlabel = SetLabelContents(LabelToModify=label_2, NewLabelContents=split.ListB)
cull_i_2 = CullIndex(List=split.ListB, Indices=0, Wrap=True)
item_11 = ListItem(List=split.ListB, Index=0, Wrap=True)
cluster_4 = Cluster_7(relay=crv_4)  # -> pl_2, R
stack_4 = CreateStack(UIElements=merge_7, Horizontal=False)  # -> flatten(Stack)
split_2 = TextSplit(Text=cull_i_2, Separators=":")
split_3 = TextSplit(Text=item_11, Separators="Img")
number_slider_11 = Slider(0.35, range=0..1)  # disabled
number_slider_12 = Slider(0.17, range=0..1)  # disabled
updatesurface1 = Brep(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)
item_12 = ListItem(List=reverse(split_2), Index=0, Wrap=True)
updatemesh1 = Mesh(Tree({0;0}: [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], {0;1}: [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], {0;2}: [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], {0;3}: [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], {0;4}: [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], {0;5}: [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], {0;6}: [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], {0;7}: [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], {0;8}: [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], {0;9}: [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]))
updatestring1 = Text(Tree({0;0}: ["0.3", "0.3", "0.3", "0.3", "0.3", "0.3", "0.3", "0.3", "0.3", "0.3", "0.3", "0.3", "0.3", "0.3", "0.3", "0.3", "0.3", "0.3", "0.3", "0.3", "0.3", "0.3", "0.3", "0.3", "0.3", "0.3", "0.3", "0.3", "0.3", "0.3", "0.3", "0.3", "0.3", "0.3", "0.3", "0.3", "0.3", "0.3", "0.3", "0.3", "0.3", "0.3", "0.3", "0.3", "0.3", "0.3", "0.3", "0.3", "0.3", "0.3", "0.3", "0.3", "0.3", "0.3", "0.3", "0.3"], {0;1}: ["0.238273120599033", "0.238273120599039", "0.238273120598995", "0.238273120599017", "0.238273120599017", "0.430111125176824", "0.430111125176862", "0.430111125176824", "0.430111125176824", "0.430111125176786", "0.430111125176786", "0.430111125176786", "0.430111125176824", "0.357409680898549", "0.357409680898544", "0.357409680898543", "0.357409680898544", "0.430111125176824", "0.430111125176786", "0.430111125176786", "0.430111125176824", "0.430111125176824", "0.430111125176786", "0.430111125176786", "0.430111125176824", "0.238273120599101", "0.238273120598995", "0.465251362683723", "0.465251362683723", "0.465251362683723", "0.465251362683723", "0.465251362683723", "0.465251362683727", "0.465251362683728", "0.397121867665042", "0.39712186766508", "0.39712186766508", "0.397121867665042", "0.397121867665004", "0.39712186766508", "0.444812514178123", "0.444812514178113", "0.444812514178118", "0.444812514178118", "0.444812514178118", "0.444812514178118", "0.444812514178118", "0.444812514178122", "0.444812514178113", "0.444812514178117", "0.397121867665042", "0.397121867665042", "0.397121867665042", "0.397121867665042", "0.39712186766508", "0.39712186766508"], {0;2}: ["0", "0", "0", "0", "0", "0", "0", "0", "0", "0", "0", "0", "0", "0", "0", "0", "0", "0", "0", "0", "0", "0", "0", "0", "0", "0", "0", "0", "0", "0", "0", "0", "0", "0", "0", "0", "0", "0", "0", "0", "0", "0", "0", "0", "0", "0", "0", "0", "0", "0", "0", "0", "0", "0", "0", "0"], {0;3}: ["1.5009330431435", "1.5009330431435", "1.5009330431435", "1.5009330431435", "1.5009330431435", "1.5009330431435", "1.5009330431435", "1.5009330431435", "1.5009330431435", "1.5009330431435", "1.5009330431435", "1.5009330431435", "1.5009330431435", "1.5009330431435", "1.5009330431435", "1.5009330431435", "1.5009330431435", "1.5009330431435", "1.5009330431435", "1.5009330431435", "1.5009330431435", "1.5009330431435", "1.5009330431435", "1.5009330431435", "1.5009330431435", "1.5009330431435", "1.5009330431435", "1.5009330431435", "1.5009330431435", "1.5009330431435", "1.5009330431435", "1.5009330431435", "1.5009330431435", "1.5009330431435", "1.5009330431435", "1.5009330431435", "1.5009330431435", "1.5009330431435", "1.5009330431435", "1.5009330431435", "1.5009330431435", "1.5009330431435", "1.5009330431435", "1.5009330431435", "1.5009330431435", "1.5009330431435", "1.5009330431435", "1.5009330431435", "1.5009330431435", "1.5009330431435", "1.5009330431435", "1.5009330431435", "1.5009330431435", "1.5009330431435", "1.5009330431435", "1.5009330431435"], {0;4}: ["0.22", "0.22", "0.22", "0.22", "0.22", "0.22", "0.22", "0.22", "0.22", "0.22", "0.22", "0.22"], {0;5}: ["True", "True"]))
updatestring2 = Text(Tree({0}: ["e452e38c-1154-4cc5-893f-1d6c19d47754"], {1}: [], {2}: ["0.22", "0.22", "0.22", "0.22", "0.22", "0.22", "0.22", "0.22", "0.22", "0.22", "0.22", "0.22"], {3}: ["1", "1", "1", "1", "1", "1", "1", "1", "1", "1", "1", "1"], {4}: ["3", "3", "3", "3", "3", "3", "3", "3", "3", "3", "3", "3"], {5}: ["0.3", "0.3", "0.3", "0.3", "0.3", "0.3", "0.3", "0.3", "0.3", "0.3", "0.3", "0.3"]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))
updateboolean1 = Boolean(True)
and = GateAnd(C=updateboolean1, A=values_5.Values, B=larger.LargerThan)
c_script_23 = CSharpScript(x=and, y=c_script_2.A)  # -> out, A; inputs y: String
# ---------- c_script_23: C# ----------
    A = y;
# ---------- end c_script_23 ----------
item_13 = ListItem(List=reverse(split_3), Index=0, Wrap=True)
stack_5 = CreateStack(UIElements=partition, Horizontal=False)
series_5 = Series(Start=12, Step=1, Count=9)
cluster_5 = Cluster_8(relay=crv_4, L=values_7.Values)  # -> R, R_2, R_3; disabled
txt_4 = Text(["Name", "Ceiling Reflectance", "Floor Reflectance", "Wall Reflectance", "Glazing Transparency", "Wall R-value", "Roof R-value", "Ground R-value", "Window U-value", "Window SHGC", "Total WWR", "sDA", "ASE", "MI", "Total Load ", "Cooling ", "Heating ", "Lighting ", "Equipment ", "Image"])
stack_6 = CreateStack(UIElements=flatten(stack_5), Horizontal=True)
stack_7 = CreateStack(UIElements=flatten(stack_4), Horizontal=True)
clean_4 = CleanTree(RemoveNulls=True, RemoveInvalid=True, RemoveEmpty=False, Tree=updatemesh1)
pshift_2 = ShiftPaths(Data=item_12, Offset=-1)  # -> simplify(Data)
format_3 = Format(Format="Alternative {0}", Culture=127, Data0=item_13)  # -> simplify(Text)
item_14 = ListItem(List=pshift, Index=series_5, Wrap=True)  # -> simplify(Item)
aligndim = AlignedDimension(
    Plane=cluster_5.R,
    PointA=cluster_5.R_2,
    PointB=cluster_5.R_3,
    Offset=number_slider_11,
    Text="{0:0.00}",
    Size=number_slider_12)  # disabled
panel_14 = Panel("""0.9*
1*
0.8*
1.5*""")
format_4 = Format(Format="{0}.jpg", Culture=127, Data0=item_11)
tag = TextTag3D(
    Location=cluster_3.pl_2,
    Text=cluster_3.R,
    Size=Slider(0.18, range=0..10),
    Colour=ColourSwatch(SwatchColor=RGB(0, 65, 135)),
    Justification=7)
tag_2 = TextTag3D(
    Location=cluster_4.pl_2,
    Text=cluster_4.R,
    Size=Slider(0.8, range=0..10),
    Colour=ColourSwatch(SwatchColor=RGB(0, 65, 135)),
    Justification=9)
values_37 = ValueListener(Elements=item_10.Item1, SomeProperty=True)  # -> Values, Indices
bang = ExplodeTree(Data=clean_4)  # -> Branch0, Branch1, Branch2, Branch3, Branch4, Branch5, Branch6, Branch7, Branch8, Branch9
simplegrid_3 = CreateSimpleGrid(
    UIElements=graft(merge_8),
    Width=Slider(388, range=0..700),
    Height=Slider(36, range=0..1000),
    RowDefinitions="Auto",
    ColumnDefinitions=panel_14)  # -> flatten(SimpleGrid)
bang_2 = ExplodeTree(Data=updatestring1)  # -> Branch0, Branch1, Branch2, Branch3, Branch4, Branch5
tstat = TreeStatistics(Tree=format_3)  # -> graft(Paths), Length, Count
not = GateNot(A=values_37.Values)
hideshow_3 = HideShowElement(ElementToHideShow=stack_6, Show=not, Collapse=True, Disable=False)
hideshow_4 = HideShowElement(ElementToHideShow=stack_7, Show=values_37.Values, Collapse=True, Disable=False)
mesh_8 = Mesh(bang.Branch5)
c_script_24 = CSharpScript(branchPath=tstat.Paths, items=format_4)  # -> out, A; inputs items: list
# ---------- c_script_24: C# ----------
    var bp = (GH_Path) branchPath;

    DataTree <object> treeStucture = new DataTree<object >();
    treeStucture.AddRange(items, (GH_Path) branchPath);

    A = treeStucture;
# ---------- end c_script_24 ----------
c_script_25 = CSharpScript(branchPath=tstat.Paths, items=pshift_2)  # -> out, A; inputs items: list; same code as c_script_24
c_script_26 = CSharpScript(branchPath=tstat.Paths, items=item_14)  # -> out, A; inputs items: list; same code as c_script_24
c_script_27 = CSharpScript(branchPath=tstat.Paths, items=format_3)  # -> out, A; inputs items: list; same code as c_script_24
stack_8 = CreateStack(UIElements=flatten([stack_6, stack_7]), Horizontal=True)
separator_6 = CreateSeparator(Thickness=0.5, Horizontal=True, Color=RGB(0, 0, 0))
data_5 = Data(["50 %", " 77 %", " 62 %", " 1181 lux", " 186.6", " 29 kwh", " 97.8 kwh", " 21.5 kwh", " 38.2 kwh"])
merge_9 = Merge(
    Data1=simplify(c_script_27.A),
    Data2=simplify(c_script_26.A),
    Data3=simplify(c_script_25.A),
    Data4=simplify(c_script_24.A))
panel_15 = Panel(data_5)
join_5 = TextJoin(Text=txt_4, Join=",")  # -> flatten(Result)
join_6 = TextJoin(Text=merge_9, Join=",")  # -> flatten(Result)
data_6 = Data(Tree({0;0}: ["0.7", "0.2", "0.5", "0.3", "20", "30", "10", "0.3", "0.3", "Img0.jpg"], {0;0;0}: ["Alternative 0", "50 %", " 77 %", " 62 %", " 1181 lux", " 186.6", " 29 kwh", " 97.8 kwh", " 21.5 kwh", " 38.2 kwh"]))
merge_10 = Merge(Data1=flatten(simplegrid_3), Data2=flatten(stack_8))
format_5 = Format(Format="{0}\data.csv", Culture=127, Data0=c_script_2.A)
bool_4 = Boolean(values_36.Values)
panel_16 = Panel(data_6)
merge_11 = Merge(Data1=flatten(join_5), Data2=flatten(join_6))
c_script_28 = CSharpScript(Save=bool_4, path=format_5, data=merge_11)  # inputs Save: Boolean, path: String, data: list of String
# ---------- c_script_28: C# usings ----------
using System.Runtime;
using System.IO;
# ---------- c_script_28: C# ----------
    if(Save){
      var fileInfo = new System.IO.FileInfo(path);
      if(!fileInfo.Directory.Exists)
        fileInfo.Directory.Create();

      var sw = fileInfo.CreateText();
      for(int i = 0 ;i < data.Count; i++){
        string row = data[i];
        if(i < data.Count - 1){
          sw.WriteLine(row);
        }
        else{
          sw.Write(row);
        }

      }
      sw.Flush();
      sw.Close();
    }
# ---------- end c_script_28 ----------
panel_17 = Panel(bool_4)
stack_9 = CreateStack(UIElements=merge_10, Horizontal=False)  # -> flatten(Stack)
branch_5 = TreeBranch(Tree=updatestring2, Path="{12}", MaintainPaths=True)
branch_6 = TreeBranch(Tree=updatestring2, Path="{13}", MaintainPaths=True)
branch_7 = TreeBranch(Tree=updatestring2, Path="{14}", MaintainPaths=True)
branch_8 = TreeBranch(Tree=updatestring2, Path="{15}", MaintainPaths=True)
branch_9 = TreeBranch(Tree=updatestring2, Path="{10}", MaintainPaths=True)
branch_10 = TreeBranch(Tree=updatestring2, Path="{16}", MaintainPaths=True)
branch_11 = TreeBranch(Tree=updatestring2, Path="{17}", MaintainPaths=True)
branch_12 = TreeBranch(Tree=updatestring2, Path="{18}", MaintainPaths=True)
branch_13 = TreeBranch(Tree=updatestring2, Path="{19}", MaintainPaths=True)
branch_14 = TreeBranch(Tree=updatestring2, Path="{20}", MaintainPaths=True)
expander_6 = CreateExpander(UIElements=stack_9, Header="Repository", Open=Toggle(True))

# ---- group: analysis grid
Z = UnitZ(Factor="0.762")
move = Move(Geometry=updatesurface1, Motion=Z)  # -> Geometry, Transform
c__0_003 = CSharpScript(gridSurface=move.Geometry, spacing=cull, offset="0.0254 * 10", complex=Toggle(True))  # -> out, A, B, nU, nV, E; inputs gridSurface: Brep, spacing: Double, offset: Double, complex: Boolean
# ---------- c__0_003: C# ----------
    Surface srf = gridSurface.Faces[0];

    double width = 0.0;
    double depth = 0.0;
    srf.GetSurfaceSize(out width, out depth);

    srf.SetDomain(0, new Interval(0, width));
    srf.SetDomain(1, new Interval(0, depth));

    int n_usteps = (int) (0.999999999 + (width - 2.0 * offset) / spacing);
    int n_vsteps = (int) (0.999999999 + (depth - 2.0 * offset) / spacing);
    double u_spacing = (width - 2.0 * offset) / n_usteps;
    double v_spacing = (depth - 2.0 * offset) / n_vsteps;

    Mesh m = new Mesh();

    for (int i = 0; i < n_usteps + 1; ++i) {
      for (int j = 0; j < n_vsteps + 1; ++j) {
        Point3d pt;
        Vector3d[] vv;
        srf.Evaluate(offset + i * u_spacing, offset + j * v_spacing, 0, out pt, out vv);
        m.Vertices.Add(pt.X, pt.Y, pt.Z);
      }
    }

    for (int j = 0; j < n_usteps ; ++j) {
      for (int i = 0; i < n_vsteps ; ++i) {
        m.Faces.AddFace(new MeshFace(i + j * (n_vsteps + 1), i + (j + 1) * (n_vsteps + 1), i + (j + 1) * (n_vsteps + 1) + 1, i + j * (n_vsteps + 1) + 1));
      }
    }


    // filter vertices outside of the trimmed surface
    if (complex) {
      bool[] validVertices = new bool[m.Vertices.Count];
      for (int i = 0; i < validVertices.Length; ++i) {
        validVertices[i] = false;
      }

      for (int i = 0; i < m.Vertices.Count; ++i) {
        foreach (BrepFace face in  gridSurface.Faces) {
          if (!face.IsValid) continue;

          double u, v;
          face.ClosestPoint(m.Vertices[i], out u, out v);
          PointFaceRelation pfr = face.IsPointOnFace(u, v);
          if (pfr == PointFaceRelation.Interior) {
            validVertices[i] = true;
            break;
          }
        }
      }

      List<int> cullVertices = new List<int>();
      for (int i = 0; i < validVertices.Length; ++i) {
        if (!validVertices[i]) {
          cullVertices.Add(i);
        }
      }

      m.Vertices.Remove(cullVertices, true);
    }

    m.RebuildNormals();


    A = m;
    B = m.Vertices;
    nU = n_usteps;
    nV = n_vsteps;
    E = srf;
# ---------- end c__0_003 ----------

# ----
item_15 = ListItem(List=bang_2.Branch5, Index=0, Wrap=True)  # -> Item, Item1
mesh_9 = Mesh(bang.Branch9)
mesh_10 = Mesh(bang.Branch6)
num_6 = Number(bang_2.Branch4)
mesh_11 = Mesh(bang.Branch7)
mesh_12 = Mesh(bang.Branch8)
branch_15 = TreeBranch(Tree=retrieving, Path="{16}", MaintainPaths=True)
branch_16 = TreeBranch(Tree=retrieving, Path="{17}", MaintainPaths=True)
branch_17 = TreeBranch(Tree=retrieving, Path="{18}", MaintainPaths=True)
branch_18 = TreeBranch(Tree=retrieving, Path="{19}", MaintainPaths=True)
branch_19 = TreeBranch(Tree=retrieving, Path="{20}", MaintainPaths=True)
cluster_6 = Cluster(wall_r=branch_10, roof_r=branch_11, ground_slab_r=branch_12, window_u=branch_13, window_shgc=branch_14)
updated_roof_r_val = Text(branch_16)
updated_win_u_val = Text(branch_18)
updated_win_shgc = Text(branch_19)
updated_wall_r_val = Text(branch_15)
updated_ground_r_val = Text(branch_17)
setslider_2 = SetSlider(UISlider=slider_10, Value=updated_wall_r_val)
setslider_3 = SetSlider(UISlider=slider_11, Value=updated_roof_r_val)
setslider_4 = SetSlider(UISlider=slider_12, Value=updated_ground_r_val)
setslider_5 = SetSlider(UISlider=slider_13, Value=updated_win_u_val)
setslider_6 = SetSlider(UISlider=slider_14, Value=updated_win_shgc)
cluster_7 = Cluster_2(
    i=branch_9,
    constr_set=cluster_6,
    geo_3=mesh_10,
    ratio=num_6,
    geo_4=mesh_11,
    geo=mesh_12,
    geo_2=mesh_9,
    G=item_15.Item,
    G_2=item_15.Item1,
    run=updateboolean1)  # -> total_load, data_6, balance
branch_20 = TreeBranch(Tree=retrieving, Path="{12}", MaintainPaths=True)
branch_21 = TreeBranch(Tree=retrieving, Path="{13}", MaintainPaths=True)
branch_22 = TreeBranch(Tree=retrieving, Path="{14}", MaintainPaths=True)
branch_23 = TreeBranch(Tree=retrieving, Path="{15}", MaintainPaths=True)
updated_ceiling_reflt = Text(branch_20)
updated_floor_reflt = Text(branch_21)
updated_wall_reflt = Text(branch_22)
updated_glazing_trans = Text(branch_23)
setslider_7 = SetSlider(UISlider=slider_15, Value=updated_ceiling_reflt)
setslider_8 = SetSlider(UISlider=slider_16, Value=updated_floor_reflt)
setslider_9 = SetSlider(UISlider=slider_8, Value=updated_wall_reflt)
setslider_10 = SetSlider(UISlider=slider_9, Value=updated_glazing_trans)
data_7 = Data(cluster_7.balance)
data_8 = Data(cluster_7.data_6)

adjustelem_7 = AdjustElementAppearance(
    ElementsToAdjust=graft(expander_6),
    Foreground=ColourSwatch(SwatchColor=RGB(255, 255, 255)),
    Background=ColourSwatch(SwatchColor=RGB(0, 0, 0)),
    FontSize=Slider(13.6, range=0..20))
toggle_7 = BooleanToggle(True)
num_7 = Number(branch_8)
num_8 = Number(branch_7)
num_9 = Number(branch_5)
num_10 = Number(bang_2.Branch0)
num_11 = Number(branch_6)
num_12 = Number(bang_2.Branch1)
num_13 = Number(bang_2.Branch2)
num_14 = Number(bang_2.Branch3)
predict_daylight = PredictDaylightMetricsFromGeometryAndMaterialInputsPWAIV0301(
    SensorsPositions=c__0_003.B,
    CeilingGeometries=bang.Branch0,
    FloorGeometries=bang.Branch1,
    WallsGeometries=bang.Branch2,
    GlazingGeometries=bang.Branch3,
    SurroundingGeometries=bang.Branch4,
    GroundSurface=bang.Branch5,
    CeilingReflectance=num_9,
    FloorReflectance=num_11,
    WallsReflectance=num_8,
    GlazingTransparency=num_7,
    VerticalShadingDeviceDepth=num_10,
    VerticalShadingDeviceSpacing=num_12,
    HorizontalShadingDeviceDepth=num_13,
    HorizontalShadingDeviceSpacing=num_14,
    ComputeSolution=updateboolean1,
    PredictDA=toggle_7,
    PredictSE=toggle_7,
    PredictMI=toggle_7,
    PredictUDI=toggle_7,
    NumberOfThreads=-1,
    ProduceAdditionalDataForDebugging=False,
    IndexOfSensorToDebug=0,
    City="Boston")  # -> PredictedDaylightAutonomy_sensor_array, PredictedSunlightExposure_sensor_array, PredictedMeanIlluminance_sensor_array, PredictedUsefulDaylightIlluminanceFailing_sensor_array, PredictedUsefulDaylightIlluminanceSupplementary_sensor_array, PredictedUsefulDaylightIlluminanceAcceptable_sensor_array, PredictedUsefulDaylightIlluminanceExcessive_sensor_array, Rays
cluster_8 = Cluster_5(
    relay_2=predict_daylight.PredictedDaylightAutonomy_sensor_array,
    relay=predict_daylight.PredictedSunlightExposure_sensor_array,
    I=predict_daylight.PredictedUsefulDaylightIlluminanceSupplementary_sensor_array,
    I_2=predict_daylight.PredictedMeanIlluminance_sensor_array)

# ---- group: Energy Results
cluster_9 = Cluster_6(I=cluster_7.total_load, L=cluster_7.total_load)  # -> A, i, R

# ---- group: Total WWR
c_script_29 = CSharpScript(Number=c_script_11.TotalWWR, Scope=0.001)  # -> out, A; inputs Number: Double, Scope: Double
# ---------- c_script_29: C# ----------
    double x = Number;
    double y = Scope;
    double Divide = x / y;
    double wholeDiv = Math.Round(Divide);
    A = "Total WWR:"+Convert.ToString((Scope * wholeDiv) * 100) + " %";
# ---------- end c_script_29 ----------

# ----
monthly_loads = Data(data_7)
format_6 = Format(Format="  {0} ", Culture=127, Data0=cluster_8)

# ---- group: DayLighting Results
cull_i_3 = CullIndex(List=cluster_8, Indices=2, Wrap=True)

# ----
txt_5 = Text(simplify(["Mesh (V:44  F:11)", "", "Heating", "Solar", "Electric Equipment", "Lighting", "People", "Infiltration", "Mechanical Ventilation", "Opaque Conduction", "Window Conduction", "Cooling", "Storage"]))
merge_12 = Merge(Data2=flatten(c_script_29.A), Data3=flatten(cull_i_3), Data4=flatten(cluster_9.R))  # -> simplify(graft(Result))

c_script_30 = CSharpScript(ADD=and, currAlt=c_script_11.AlternativeData, Clean=Button(), newData=merge_12)  # -> out, A, B; inputs ADD: Boolean, currAlt: tree of String, Clean: Boolean, newData: tree of String
# ---------- c_script_30: C# ----------
    foreach( var obj in GrasshopperDocument.Objects){
      if(obj.NickName == "SavedData"){
        guid = obj.InstanceGuid;
      }
    }


    int branchCount = currAlt.BranchCount;
    currAlt.Add("Img" + altNumber.ToString(), new GH_Path(branchCount));
    for(int i = 0; i < newData.BranchCount ;i++)
      currAlt.AddRange(newData.Branch(i), new GH_Path(i + branchCount + 1));


    if(ADD){
      Grasshopper.Kernel.Parameters.Param_String cmp = (Grasshopper.Kernel.Parameters.Param_String) this.GrasshopperDocument.FindObject(guid, true);

      for (int i = 0; i < currAlt.BranchCount; i++)
      {

        IEnumerable<Grasshopper.Kernel.Types.GH_String> convertedList = currAlt.Branch(i).Select(s => new Grasshopper.Kernel.Types.GH_String(s));
        cmp.PersistentData.AppendRange(convertedList, new GH_Path(altNumber, i));
      }
      cmp.ExpireSolution(true);
      altNumber++;
    }

    if(Clean){
      altNumber = 0;
      Grasshopper.Kernel.Parameters.Param_String cmp = (Grasshopper.Kernel.Parameters.Param_String) this.GrasshopperDocument.FindObject(guid, true);
      cmp.PersistentData.Clear();
      cmp.ExpireSolution(true);
    }



    A = currAlt;
    B = "Img" + altNumber.ToString();
# ---------- c_script_30: C# additional code ----------
  Guid guid;
  int altNumber = 0;
  DataTree<string> allData = new DataTree<string>();
# ---------- end c_script_30 ----------
c_script_31 = CSharpScript()  # -> out, A
# ---------- c_script_31: C# ----------
    foreach( var obj in GrasshopperDocument.Objects){
      if(obj.NickName == "SavedData"){
        guid = obj.InstanceGuid;
      }
    }

    if(n == 0){
      Grasshopper.Kernel.Parameters.Param_String cmp = (Grasshopper.Kernel.Parameters.Param_String) this.GrasshopperDocument.FindObject(guid, true);
      cmp.PersistentData.Clear();
      cmp.ExpireSolution(true);
    }

    n++;
# ---------- c_script_31: C# additional code ----------
  Guid guid;
  int n = 0;
# ---------- end c_script_31 ----------

txt_6 = Text(c_script_30.B)
cull_i_4 = CullIndex(List=txt_5, Indices=[0, 1], Wrap=True)
xdata = LBDeconstructData(data=monthly_loads)  # -> out, header, values; plug-in component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
split_4 = TextSplit(Text=cull_i_4, Separators=" ")  # -> reverse(Result)
number_slider_13 = Slider(0.1, range=0..0.1)
monthly_loads_2 = Data(data_8)
item_16 = ListItem(List=split_4, Index=0, Wrap=True)  # -> flatten(Item)
panel_18 = Panel(merge_12)
split_5 = TextSplit(Text=xdata.header, Separators=" ")  # -> reverse(Result)
c_script_32 = CSharpScript(x=values_5.Values, y=xdata.values)  # -> out, A; inputs y: tree of Double; same code as c_script_23
num_15 = Number(simplify(Tree({0;0}: [7.2265002e-06, 0, 0.1039358954, 0.2861826227, 0.9443003638, 2.748916509, 5.403891962, 4.634928965, 1.812474214, 0.2600811075, 0.003957734042, 2.370497837e-05], {0;1}: [2.608670595, 1.591759018, 0.8072011571, 0.07139265973, 0.01428444333, 0, 0, 0, 0, 0, 0.4241594778, 1.00916368], {0;2}: [1.813157427, 1.656090598, 1.875157491, 1.70500176, 1.875157491, 1.802135194, 1.778024058, 1.875157491, 1.767001824, 1.813157427, 1.802135194, 1.778024058], {0;3}: [3.227396731, 2.936581693, 3.288215763, 3.084670334, 3.288215763, 3.171004407, 3.201881691, 3.288215763, 3.145489367, 3.227396731, 3.171004407, 3.201881691])))
item_17 = ListItem(List=split_5, Index=0, Wrap=True)  # -> flatten(Item)
split_6 = SplitList(List=item_16, Index=5)  # -> ListA, ListB
c_script_33 = CSharpScript(Number=c_script_32.A, Scope=number_slider_13)  # -> out, A; inputs Number: Double, Scope: Double; same code as c_script_2
xdata_2 = LBDeconstructData(data=monthly_loads_2)  # -> out, header, values; plug-in component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
num_16 = Number(Tree({0;0;0}: [2.608670595, 1.591759018, 0.8072011571, 0.07139265973, 0.01428444333, 0, 0, 0, 0, 0, 0.4241594778, 1.00916368], {0;0;1}: [0, 0, 0, 0, 0, 0, 0, 0, 0, 0, 0, 0], {0;0;2}: [3.227396731, 2.936581693, 3.288215763, 3.084670334, 3.288215763, 3.171004407, 3.201881691, 3.288215763, 3.145489367, 3.227396731, 3.171004407, 3.201881691], {0;0;3}: [1.813157427, 1.656090598, 1.875157491, 1.70500176, 1.875157491, 1.802135194, 1.778024058, 1.875157491, 1.767001824, 1.813157427, 1.802135194, 1.778024058], {0;0;4}: [0.659397436, 0.6032097995, 0.6855537496, 0.6167723324, 0.6855537496, 0.6581057662, 0.6442203158, 0.6855537496, 0.642928646, 0.659397436, 0.6581057662, 0.6442203158], {0;0;5}: [0, 0, 0, 0, 0, 0, 0, 0, 0, 0, 0, 0], {0;0;6}: [-8.275603782, -6.752980342, -6.48901464, -5.358800368, -4.7529242, -2.810738808, -0.100010157, -1.071623298, -3.706898604, -5.493480634, -6.141083554, -6.749904266], {0;0;7}: [0, 0, 0, 0, 0, 0, 0, 0, 0, 0, 0, 0], {0;0;8}: [0, 0, 0, 0, 0, 0, 0, 0, 0, 0, 0, 0], {0;0;9}: [-7.2265002e-06, 0, -0.1039358954, -0.2861826227, -0.9443003638, -2.748916509, -5.403891962, -4.634928965, -1.812474214, -0.2600811075, -0.003957734042, -2.370497837e-05], {0;0;10}: [-0.0330111803, -0.03466076799, -0.06317762588, 0.1671459042, -0.1659868838, -0.07159004895, -0.1202239447, -0.1423747418, -0.03604701861, 0.0536101473, 0.08963644422, 0.1166382267]))
c_script_34 = CSharpScript(x=item_17, y=split_6.ListA)  # -> out, A; inputs x: list of String, y: String
# ---------- c_script_34: C# ----------
    int a =0 ;
    for(int i = 0 ;i < x.Count ;i++)
    {
      if(x[i] == y)
        a = i;
    }
    A = a;
# ---------- end c_script_34 ----------
c_script_35 = CSharpScript(x=item_17, y=split_6.ListB)  # -> out, A; inputs x: list of String, y: String; same code as c_script_34
flip = FlipMatrix(Data=c_script_33.A)  # -> simplify(Data)
c_script_36 = CSharpScript(Number=num_16, Scope=number_slider_13)  # -> out, A; inputs Number: Double, Scope: Double; same code as c_script_2
number_slider_14 = Slider(5, range=0..10)
c_script_37 = CSharpScript(x=values_5.Values, y=xdata_2.values)  # -> out, A; inputs y: tree of Double; same code as c_script_23
txt_7 = Text(["Mesh (V:44  F:11)", "", "Heating", "Solar", "Electric Equipment", "Lighting", "People", "Infiltration", "Mechanical Ventilation", "Opaque Conduction", "Window Conduction", "Cooling", "Storage"])
panel_19 = Panel("""cooling
heating
lighting
equipment""")
flip_2 = FlipMatrix(Data=c_script_36.A)  # -> simplify(Data)
cull_i_5 = CullIndex(List=txt_7, Indices=[0, 1], Wrap=True)
c_script_38 = CSharpScript(Number=num_15, Scope=Slider(0.1, range=0..0.1))  # -> out, A; inputs Number: Double, Scope: Double; same code as c_script_2
panel_20 = Panel("""Jan
Feb
Mar
Apr
May
Jun
Jul
Aug
Sep
Oct
Nov
Dec""")
c_script_39 = CSharpScript(Number=c_script_37.A, Scope=0.1)  # -> out, A; inputs Number: Double, Scope: Double; same code as c_script_2
true_button_4 = CreateTrueOnlyButton(ButtonName=["  sDA  ", "  ASE  ", "  UDI  ", "  MI  "], ButtonStyle=0)
replace = ReplaceItems(List=format_6, Item="       UDI        ", Indices=2, Wrap=False)
split_7 = SplitList(List=cull_i_5, Index=number_slider_14)  # -> ListA, ListB
split_8 = SplitList(List=flip_2, Index=number_slider_14)  # -> ListA, ListB
flip_3 = FlipMatrix(Data=c_script_38.A)
flip_4 = FlipMatrix(Data=c_script_39.A)
setbtn = SetButton(ButtonToModify=true_button_4, ButtonName=replace)
multichart = CreateMultiChart(
    Data=simplify(flip_3),
    Names=panel_19,
    SubTitle="Energy Load (kWh/m2)  &  Load Balance (kWh/m2)",
    ClusterTitle=panel_20,
    ChartType=2)
neg = Negative(Value=split_8.ListA)
abs = Absolute(Value=split_8.ListB)
panel_21 = Panel("""20
20
20
20""")
panel_22 = Panel(replace)
c_script_40 = CSharpScript(Number=cluster_9.i, Scope=Slider(0.1, range=0..1))  # -> out, A; inputs Number: Double, Scope: Double
# ---------- c_script_40: C# ----------
    double x = Number;
    double y = Scope;
    double Divide = x / y;
    double wholeDiv = Math.Round(Divide);
    A = Convert.ToString(Scope * wholeDiv) + "  kwh/m2";
# ---------- end c_script_40 ----------
multichart_2 = CreateMultiChart(Data=simplify(abs), Names=split_7.ListB, SubTitle="Load Balance (kWh/m2)", ClusterTitle=panel_20, ChartType=2)
item_18 = ListItem(List=flip, Index=c_script_34.A, Wrap=True)
lng_3 = ListLength(List=flip_3)
colrange = LBColorRange(index="19")  # -> colors; plug-in component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
multichart_3 = CreateMultiChart(Data=simplify(neg), Names=split_7.ListA, SubTitle="Load Balance (kWh/m2)", ClusterTitle=panel_20, ChartType=2)
item_19 = ListItem(List=flip, Index=c_script_35.A, Wrap=True)
panel_23 = Panel("Total Load Intensity (kWh/m2)")
series_6 = Series(Start=0, Step=1, Count=lng_3)  # -> simplify(Series)
datatable = CreateDataTable(
    Data=graft(panel_21),
    ColumnHeadings=["Cooling", "Heating", "Lighting", "Equipment"],
    AllowSorting=False,
    ColumnSizingMode=Slider(90, range=0..100))
lng_4 = ListLength(List=c_script_34.A)
relay_4 = Relay([ColourSwatch(SwatchColor=RGB(240, 255, 217)), ColourSwatch(SwatchColor=RGB(252, 250, 217)), ColourSwatch(SwatchColor=RGB(214, 254, 255)), ColourSwatch(SwatchColor=RGB(232, 232, 255))])
num_17 = Number(item_18)
split_9 = SplitList(List=colrange, Index=number_slider_14)  # -> ListA, ListB
panel_24 = Panel("{0}                                                      {1}")
lng_5 = ListLength(List=c_script_35.A)
replace_2 = ReplaceItems(List=flip_3, Item=flip_4, Indices=series_6, Wrap=False)  # -> simplify(List)
simplegrid_4 = CreateSimpleGrid(UIElements=graft(true_button_4), Width=Slider(357, range=0..530), RowDefinitions="1*", ColumnDefinitions="1*")
values_38 = ValueListener(Elements=true_button_4, SomeProperty=True)  # -> flatten(Values), Indices
adjustelem_8 = AdjustElementAppearance(ElementsToAdjust=true_button_4, Foreground=ColourSwatch(SwatchColor=RGB(0, 0, 0)), Background=relay_4, FontSize=10)
series_7 = Series(Start=0, Step=1, Count=lng_4)
adjustpos_15 = AdjustElementPositioning(
    ElementsToAdjust=true_button_4,
    Margin=Slider(0, range=0..100),
    AbsolutePositioning=True,
    Width=Slider(71, range=0..530),
    Height=Slider(32, range=0..1000),
    HorizontalAlignment=Slider(1, range=0..100))
expander_7 = CreateExpander(UIElements=datatable, Header=panel_23, Open=True)
chartappearance = ChartAppearance(ChartToModify=multichart_3, Colors=split_9.ListA, Legend=True, Title=True)
chartappearance_2 = ChartAppearance(ChartToModify=multichart_2, Colors=split_9.ListB, Legend=True, Title=False)
adjustelem_9 = AdjustElementAppearance(
    ElementsToAdjust=[multichart_3, multichart_2],
    Foreground=ColourSwatch(SwatchColor=RGB(10, 10, 10)),
    Background=ColourSwatch(SwatchColor=RGB(209, 209, 209)),
    FontSize=7)
format_7 = Format(Format=panel_24, Culture=127, Data0=panel_23, Data1=cluster_9.A)
series_8 = Series(Start=0, Step=1, Count=lng_5)
setdatatable = SetDataTable(DataTableToSet=datatable, Data=graft(c_script_40.A))
abs_2 = Absolute(Value=item_19)
c_script_41 = CSharpScript(x=values_38.Values)  # -> out, A; inputs x: list of Boolean
# ---------- c_script_41: C# ----------
    
    for(int i = 0 ;i < x.Count ;i++){
      if(x[i])
        a = i;
    }
    A = a;
# ---------- c_script_41: C# additional code ----------
    int a = 0;
# ---------- end c_script_41 ----------
number_slider_15 = Slider(265, range=100..600)
replace_3 = ReplaceItems(List=split_8.ListA, Item=num_17, Indices=series_7, Wrap=False)
adjustpos_16 = AdjustElementPositioning(ElementsToAdjust=expander_7, AbsolutePositioning=True, Width=Slider(369, range=0..530), Height=Slider(88, range=0..1000))
relay_5 = Relay([ColourSwatch(SwatchColor=RGB(18, 53, 255)), ColourSwatch(SwatchColor=RGB(224, 22, 0)), ColourSwatch(SwatchColor=RGB(255, 255, 0)), ColourSwatch(SwatchColor=RGB(255, 149, 0))])
replace_4 = ReplaceItems(List=split_8.ListB, Item=abs_2, Indices=series_8, Wrap=False)  # -> simplify(List)
item_20 = ListItem(List=true_button_4, Index=0, Wrap=True)  # -> Item, Item1, Item2, Item3
setexp = SetExpander(Expander=expander_7, Name=format_7)
setmultichart = SetMultiChartContents(ChartToModify=multichart, NewChartValues=simplify(replace_2))
setmultichart_2 = SetMultiChartContents(ChartToModify=multichart_3, NewChartValues=simplify(replace_3))
setmultichart_3 = SetMultiChartContents(ChartToModify=multichart_2, NewChartValues=simplify(replace_4))
adjustpos_17 = AdjustElementPositioning(
    ElementsToAdjust=multichart,
    AbsolutePositioning=True,
    Width=Slider(470, range=200..500),
    Height=Slider(260, range=20..600),
    HorizontalAlignment=0,
    VerticalAlignment=0)
chartappearance_3 = ChartAppearance(ChartToModify=multichart, Colors=relay_5, Legend=True, Title=True)
adjustelem_10 = AdjustElementAppearance(
    ElementsToAdjust=multichart,
    Foreground=ColourSwatch(SwatchColor=RGB(0, 0, 0)),
    Background=ColourSwatch(SwatchColor=RGB(237, 237, 237)),
    FontSize=7)
adjustpos_18 = AdjustElementPositioning(
    ElementsToAdjust=multichart_3,
    AbsolutePositioning=True,
    Width=Slider(470, range=200..500),
    Height=number_slider_15,
    HorizontalAlignment=0,
    VerticalAlignment=0)
adjustpos_19 = AdjustElementPositioning(
    ElementsToAdjust=multichart_2,
    AbsolutePositioning=False,
    Width=Slider(470, range=200..500),
    Height=number_slider_15,
    HorizontalAlignment=0,
    VerticalAlignment=0)
panel_25 = Panel("""Useful Daylight Index (UDI) metrics.

UDIf (Failing) : percentage of time that the sensor receives below 100 lux.
UDIs (Supplementary) : percentage of time that the sensor receives between 100 lux and 300 lux.
UDIa (Acceptable) : percentage of time that the sensor receives between 300 lux and 3000 lux.
UDIe (Excessive): percentage of time that the sensor receives above 3000 lux.""")
panel_26 = Panel("""Mean Illuminance in lux
The quantity of light emitted by a source that falls on a surface.
 Illuminance is measured in lux (lumens per m2)""")
panel_27 = Panel("""Aunual Sunlight Exposure in %
the percentage of space that receives too much direct sunlight (1000 Lux or more for at least 250 occupied hours per year), which can cause glare or increased cooling loads.
If a sensor in space receives more than 1000 lux for at least 250 hours per year, the sensor color will be yellow.
If ASE is > 10%, glare conditions must be addressed, or FAIL score for all LEED daylighting credits.
LEED Score (0-1)""")
panel_28 = Panel("""Spatial Daylight Autonomy in %
Percentage of space that receives more than 300 lux for at least 50% of the time.
If a sensor in space receives more than 300 lux for at least 50 % of time, the sensor color will be light green.
For LEED® projects, scoring varies by building type; higher scores equals more credits.
sDA300/50% (300 lux for 50% of annual hours)
40% = 1 credit
55% = 2 credits
75% = 3 credits""")
expander_8 = CreateExpander(UIElements=simplegrid_4, Header="Daylight", Open=True)
sd = ShowDelay(500)
D = Duration(20000)
adjustelem_11 = AdjustElementAppearance(
    ElementsToAdjust=graft(expander_8),
    Foreground=ColourSwatch(SwatchColor=RGB(255, 255, 255)),
    Background=ColourSwatch(SwatchColor=RGB(0, 0, 0)),
    FontSize=Slider(13.9, range=0..20))
tooltip_20 = AttachTooltipToElement(ElementsToAttachTo=item_20.Item, TooltipContent=panel_28, ShowDelay=sd, Duration=D)
tooltip_21 = AttachTooltipToElement(ElementsToAttachTo=item_20.Item1, TooltipContent=panel_27, ShowDelay=sd, Duration=D)
tooltip_22 = AttachTooltipToElement(ElementsToAttachTo=item_20.Item2, TooltipContent=panel_25, ShowDelay=sd, Duration=50000)
tooltip_23 = AttachTooltipToElement(ElementsToAttachTo=item_20.Item3, TooltipContent=panel_26, ShowDelay=sd, Duration=D)
larger_3 = LargerThan(FirstNumber=predict_daylight.PredictedSunlightExposure_sensor_array, SecondNumber=250)  # -> LargerThan, OrEqualTo
larger_4 = LargerThan(FirstNumber=predict_daylight.PredictedDaylightAutonomy_sensor_array, SecondNumber=0.5)  # -> LargerThan, OrEqualTo
adjustelem_12 = AdjustElementAppearance(
    ElementsToAdjust=graft(expander_7),
    Foreground=ColourSwatch(SwatchColor=RGB(255, 255, 255)),
    Background=ColourSwatch(SwatchColor=RGB(0, 0, 0)),
    FontSize=Slider(13, range=0..100))
merge_13 = Merge(Data1=flatten(multichart), Data2=flatten(multichart_3), Data3=flatten(multichart_2))
int_3 = Integer(larger_4.LargerThan)
int_4 = Integer(larger_3.LargerThan)
data_9 = Data(flatten(merge_13))
gradient = Gradient(
    LowerLimit=0,
    UpperLimit=1,
    Parameter=int_4,
    stops=[0: RGB(138, 138, 138), 0: RGB(186, 186, 186), 0: RGB(221, 232, 170), 0: RGB(173, 173, 173), 1: RGB(255, 208, 18)])
gradient_2 = Gradient(
    LowerLimit=0,
    UpperLimit=1,
    Parameter=int_3,
    stops=[0: RGB(181, 181, 181), 0: RGB(186, 186, 186), 0: RGB(221, 232, 170), 0: RGB(173, 173, 173), 1: RGB(200, 250, 147)])
gradient_3 = Gradient(
    LowerLimit=Slider(3000, range=0..10000),
    UpperLimit=Slider(50, range=0..100),
    Parameter=predict_daylight.PredictedMeanIlluminance_sensor_array,
    stops=[0: RGB(234, 38, 0), 0.25: RGB(234, 126, 0), 0.5: RGB(254, 244, 84), 0.75: RGB(173, 203, 249), 1: RGB(75, 107, 169)])
panel_29 = Panel("""1.2*
1.3*
1.3*""")
mesh_13 = Mesh(c__0_003.A)
c_script_42 = CSharpScript(
    srf=move.Geometry,
    sensor=c__0_003.B,
    spacing=cull,
    f=predict_daylight.PredictedUsefulDaylightIlluminanceFailing_sensor_array,
    s=predict_daylight.PredictedUsefulDaylightIlluminanceSupplementary_sensor_array,
    a=predict_daylight.PredictedUsefulDaylightIlluminanceAcceptable_sensor_array,
    e=predict_daylight.PredictedUsefulDaylightIlluminanceExcessive_sensor_array,
    colors=[ColourSwatch(SwatchColor=RGB(65, 128, 176)), ColourSwatch(SwatchColor=RGB(117, 186, 163)), ColourSwatch(SwatchColor=RGB(180, 224, 119)), ColourSwatch(SwatchColor=RGB(255, 176, 255))])  # -> out, A; inputs srf: Surface, sensor: Point3d, spacing: Double, f: Double, s: Double, a: Double, e: Double, colors: list of Color
# ---------- c_script_42: C# ----------
    Curve crVt = srf.IsoCurve(0, 0);
    Vector3d v1 = crVt.PointAtEnd - crVt.PointAtStart;
    v1.Unitize();
    Vector3d v2 = v1;
    v2.Rotate(-0.5 * Math.PI, Vector3d.ZAxis);



    Mesh Tmesh = new Mesh();

    double totalVal = f + s + a + e;
    f = f / totalVal * spacing;
    s = s / totalVal * spacing;
    a = a / totalVal * spacing;
    e = e / totalVal * spacing;


    Mesh fMesh = new Mesh();
    Point3d p0 = sensor + (v1 * (0.5 * f)) + (v2 * (0.5 * f));
    Point3d p1 = sensor - (v1 * (0.5 * f)) + (v2 * (0.5 * f));
    Point3d p2 = sensor - (v1 * (0.5 * f)) - (v2 * (0.5 * f));
    Point3d p3 = sensor + (v1 * (0.5 * f)) - (v2 * (0.5 * f));
    fMesh.Vertices.Add(p0);
    fMesh.Vertices.Add(p1);
    fMesh.Vertices.Add(p2);
    fMesh.Vertices.Add(p3);
    fMesh.Faces.AddFace(0, 1, 2, 3);
    fMesh.VertexColors.CreateMonotoneMesh(colors[0]);
    fMesh = repairMesh(fMesh);



    Mesh sMesh = new Mesh();
    Point3d p4 = sensor + (v1 * (0.5 * (f + s))) + (v2 * (0.5 * (f + s)));
    Point3d p5 = sensor - (v1 * (0.5 * (f + s))) + (v2 * (0.5 * (f + s)));
    Point3d p6 = sensor - (v1 * (0.5 * (f + s))) - (v2 * (0.5 * (f + s)));
    Point3d p7 = sensor + (v1 * (0.5 * (f + s))) - (v2 * (0.5 * (f + s)));
    sMesh.Vertices.Add(p0);
    sMesh.Vertices.Add(p1);
    sMesh.Vertices.Add(p2);
    sMesh.Vertices.Add(p3);
    sMesh.Vertices.Add(p4);
    sMesh.Vertices.Add(p5);
    sMesh.Vertices.Add(p6);
    sMesh.Vertices.Add(p7);
    sMesh.Faces.AddFace(0, 4, 5, 1);
    sMesh.Faces.AddFace(1, 5, 6, 2);
    sMesh.Faces.AddFace(2, 6, 7, 3);
    sMesh.Faces.AddFace(0, 3, 7, 4);
    sMesh.VertexColors.CreateMonotoneMesh(colors[1]);
    sMesh = repairMesh(sMesh);


    Mesh aMesh = new Mesh();
    Point3d p8 = sensor + (v1 * ( 0.5 * (f + s + a))) + (v2 * (0.5 * (f + s + a)));
    Point3d p9 = sensor - (v1 * (0.5 * (f + s + a))) + (v2 * (0.5 * (f + s + a)));
    Point3d p10 = sensor - (v1 * (0.5 * (f + s + a))) - (v2 * (0.5 * (f + s + a)));
    Point3d p11 = sensor + (v1 * (0.5 * (f + s + a))) - (v2 * (0.5 * (f + s + a)));
    aMesh.Vertices.Add(p4);
    aMesh.Vertices.Add(p5);
    aMesh.Vertices.Add(p6);
    aMesh.Vertices.Add(p7);
    aMesh.Vertices.Add(p8);
    aMesh.Vertices.Add(p9);
    aMesh.Vertices.Add(p10);
    aMesh.Vertices.Add(p11);
    aMesh.Faces.AddFace(0, 4, 5, 1);
    aMesh.Faces.AddFace(1, 5, 6, 2);
    aMesh.Faces.AddFace(2, 6, 7, 3);
    aMesh.Faces.AddFace(0, 3, 7, 4);
    aMesh.VertexColors.CreateMonotoneMesh(colors[2]);
    aMesh = repairMesh(aMesh);


    Mesh eMesh = new Mesh();
    Point3d p12 = sensor + (v1 * (0.5 * (f + s + a + e))) + (v2 * (0.5 * (f + s + a + e)));
    Point3d p13 = sensor - (v1 * (0.5 * (f + s + a + e))) + (v2 * (0.5 * (f + s + a + e)));
    Point3d p14 = sensor - (v1 * (0.5 * (f + s + a + e))) - (v2 * (0.5 * (f + s + a + e)));
    Point3d p15 = sensor + (v1 * (0.5 * (f + s + a + e))) - (v2 * (0.5 * (f + s + a + e)));
    eMesh.Vertices.Add(p8);
    eMesh.Vertices.Add(p9);
    eMesh.Vertices.Add(p10);
    eMesh.Vertices.Add(p11);
    eMesh.Vertices.Add(p12);
    eMesh.Vertices.Add(p13);
    eMesh.Vertices.Add(p14);
    eMesh.Vertices.Add(p15);
    eMesh.Faces.AddFace(0, 4, 5, 1);
    eMesh.Faces.AddFace(1, 5, 6, 2);
    eMesh.Faces.AddFace(2, 6, 7, 3);
    eMesh.Faces.AddFace(0, 3, 7, 4);
    eMesh.VertexColors.CreateMonotoneMesh(colors[3]);
    eMesh = repairMesh(eMesh);


    Tmesh.Append(fMesh);
    Tmesh.Append(sMesh);
    Tmesh.Append(aMesh);
    Tmesh.Append(eMesh);

    A = Tmesh;
# ---------- c_script_42: C# additional code ----------
  public Mesh repairMesh(Mesh invalidMesh){
    invalidMesh.Vertices.CombineIdentical(true, true);
    invalidMesh.Faces.CullDegenerateFaces();
    invalidMesh.UnifyNormals();
    invalidMesh.RebuildNormals();
    invalidMesh.Compact();
    return invalidMesh;
  }
# ---------- end c_script_42 ----------
simplegrid_5 = CreateSimpleGrid(
    UIElements=simplify(data_9),
    Width=Slider(500, range=300..500),
    Height=Slider(540, range=0..1000),
    RowDefinitions=panel_29,
    ColumnDefinitions="Auto")  # -> flatten(SimpleGrid)
avr = Average(Input=int_4)  # -> flatten(ArithmeticMean)
mcol = MeshColours(Mesh=mesh_13, Colours=gradient)
avr_2 = Average(Input=int_3)  # -> flatten(ArithmeticMean)
mcol_2 = MeshColours(Mesh=mesh_13, Colours=gradient_3)
mcol_3 = MeshColours(Mesh=mesh_13, Colours=gradient_2)
ase = Panel(avr)
panel_30 = Panel("Energy Load (kWh/m2)  &  Load Balance (kWh/m2)                             ")
sda = Panel(avr_2)
expander_9 = CreateExpander(UIElements=simplegrid_5, Header=panel_30, Open=Toggle(False))
mesh_14 = Mesh(mcol_2)
mesh_15 = Mesh(mcol_3)
mesh_16 = Mesh(mcol)
adjustelem_13 = AdjustElementAppearance(
    ElementsToAdjust=graft(expander_9),
    Foreground=ColourSwatch(SwatchColor=RGB(255, 255, 255)),
    Background=ColourSwatch(SwatchColor=RGB(0, 0, 0)),
    FontSize=Slider(13.6, range=0..20))
merge_14 = Merge(Data1=flatten(expander_9), Data2=flatten(expander_6))
avr_3 = Average(Input=predict_daylight.PredictedUsefulDaylightIlluminanceFailing_sensor_array)
avr_4 = Average(Input=predict_daylight.PredictedUsefulDaylightIlluminanceSupplementary_sensor_array)
avr_5 = Average(Input=predict_daylight.PredictedUsefulDaylightIlluminanceAcceptable_sensor_array)
avr_6 = Average(Input=predict_daylight.PredictedUsefulDaylightIlluminanceExcessive_sensor_array)
int_5 = Integer(c_script_41.A)
stack_10 = CreateStack(UIElements=merge_14, Horizontal=False)
multiplication_3 = Multiplication(A=avr_3, B=100)
multiplication_4 = Multiplication(A=avr_4, B=100)
multiplication_5 = Multiplication(A=avr_5, B=100)
multiplication_6 = Multiplication(A=avr_6, B=100)
panel_31 = Panel("460")
filter_4 = StreamFilter(Gate=int_5, Stream0=mesh_15, Stream1=mesh_16, Stream2=c_script_42.A, Stream3=mesh_14)
scrollviewer_2 = CreateScrollViewer(
    UIElements=stack_10,
    HorizontalScrollBarVisibility=1,
    VerticalScrollBarVisibility=0,
    Width=Slider(375, range=0..1000),
    Height="550")
round = Round(Number=multiplication_4)  # -> Nearest, Floor, Ceiling
round_2 = Round(Number=multiplication_5)  # -> Nearest, Floor, Ceiling
round_3 = Round(Number=multiplication_6)  # -> Nearest, Floor, Ceiling
round_4 = Round(Number=multiplication_3)  # -> Nearest, Floor, Ceiling
mesh_17 = Mesh(filter_4)
format_8 = Format(
    Format=["UDIf:{0}%", "UDIs:{1}%", "UDIa:{2}%", "UDIe:{3}%"],
    Culture=127,
    Data0=round_4.Nearest,
    Data1=round.Nearest,
    Data2=round_2.Nearest,
    Data3=round_3.Nearest)
filter_5 = StreamFilter(Gate=updateboolean1, Stream1=mesh_17)
number_slider_16 = Slider(10, range=0..100)
number_slider_17 = Slider(10, range=0..100)
range = Range(Domain=Slider(15, range=0..100), Steps=3)
range_2 = Range(Domain=Slider(18.927, range=0..100), Steps=Slider(50, range=0..1000))
pt = ConstructPoint(XCoordinate=[number_slider_16, Slider(0, range=0..100)], YCoordinate=0, ZCoordinate=0)
pt_2 = ConstructPoint(XCoordinate=range, YCoordinate=0, ZCoordinate=0)
pt_3 = ConstructPoint(XCoordinate=[number_slider_17, Slider(0, range=0..100)], YCoordinate=0, ZCoordinate=0)
item_21 = ListItem(List=range_2, Index=0, Wrap=True)  # -> Item, Item1
pt_4 = ConstructPoint(XCoordinate=range_2, YCoordinate=0, ZCoordinate=0)
planesrf_2 = PlaneSurface(Plane=pt, XSize=number_slider_16, YSize=Slider(2, range=0..100))
planesrf_3 = PlaneSurface(Plane=pt_2, XSize=Slider(5, range=0..100), YSize=Slider(2, range=0..100))
planesrf_4 = PlaneSurface(Plane=pt_3, XSize=number_slider_17, YSize=Slider(2, range=0..100))
subtraction = Subtraction(A=item_21.Item1, B=item_21.Item)
panel_32 = Panel("""50 lux
3000 lux""")
mplane_2 = MeshPlane(Boundary=planesrf_2, WidthCount=1, HeightCount=1)  # -> Mesh, Area
mplane_3 = MeshPlane(Boundary=planesrf_3, WidthCount=1, HeightCount=1)  # -> Mesh, Area
multiplication_7 = Multiplication(A=avr, B=100)
mplane_4 = MeshPlane(Boundary=planesrf_4, WidthCount=1, HeightCount=1)  # -> Mesh, Area
bnd = Bounds(Numbers=range_2)
panel_33 = Panel("""<250 hr
>250 hr""")
planesrf_5 = PlaneSurface(Plane=pt_4, XSize=subtraction, YSize=Slider(2, range=0..100))
multiplication_8 = Multiplication(A=avr_2, B=100)
panel_34 = Panel("""<50 %
>50 %""")
int_6 = Integer(multiplication_7)
remap = RemapNumbers(Value=range_2, Source=bnd, Target=Domain(0, 1))  # -> reverse(Mapped), Clipped
txt_8 = Text("Usefull Daylight Index (UDI) types")
mplane_5 = MeshPlane(Boundary=planesrf_5, WidthCount=1, HeightCount=1)  # -> Mesh, Area
int_7 = Integer(multiplication_8)
format_9 = Format(Format="Annual Sunlight Exposure : {0} % of Space", Culture=127, Data0=int_6)
format_10 = Format(Format="Mean Illuminance", Culture=127)
gradient_4 = Gradient(
    LowerLimit=0,
    UpperLimit=1,
    Parameter=remap.Mapped,
    stops=[0: RGB(234, 38, 0), 0.25: RGB(234, 126, 0), 0.5: RGB(254, 244, 84), 0.75: RGB(173, 203, 249), 1: RGB(75, 107, 169)])
mcol_4 = MeshColours(
    Mesh=graft(mplane_2.Mesh),
    Colours=graft([ColourSwatch(SwatchColor=RGB(202, 252, 149)), ColourSwatch(SwatchColor=RGB(178, 178, 178))]))  # -> flatten(Mesh)
mcol_5 = MeshColours(
    Mesh=graft(mplane_3.Mesh),
    Colours=graft([ColourSwatch(SwatchColor=RGB(65, 128, 176)), ColourSwatch(SwatchColor=RGB(117, 186, 163)), ColourSwatch(SwatchColor=RGB(180, 224, 119)), ColourSwatch(SwatchColor=RGB(255, 176, 255))]))  # -> flatten(Mesh)
format_11 = Format(Format="Spatial Daylight Autonomy : {0} % of space", Culture=127, Data0=int_7)
mcol_6 = MeshColours(
    Mesh=graft(mplane_4.Mesh),
    Colours=graft([ColourSwatch(SwatchColor=RGB(255, 226, 10)), ColourSwatch(SwatchColor=RGB(178, 178, 178))]))  # -> flatten(Mesh)
merge_15 = Merge(Data1=flatten(format_8), Data2="of space", Data3=flatten(txt_8))
merge_16 = Merge(Data1=flatten(panel_33), Data2=" per year receives 1000 Lux or more", Data3=flatten(format_9))
cluster_10 = Cluster_3(relay=mjoin)  # -> P, i, relay_2
merge_17 = Merge(Data1=flatten(panel_32), Data2=" ", Data3=flatten(format_10))
merge_18 = Merge(Data1=flatten(panel_34), Data2="of time receives more than 300 lux", Data3=flatten(format_11))
mcol_7 = MeshColours(Mesh=graft(mplane_5.Mesh), Colours=graft(gradient_4))  # -> flatten(Mesh)
mjoin_2 = MeshJoin(Meshes=mcol_4)
mjoin_3 = MeshJoin(Meshes=mcol_5)
mjoin_4 = MeshJoin(Meshes=mcol_6)
join_7 = TextJoin(Text=merge_15, Join="_")
join_8 = TextJoin(Text=merge_16, Join="_")
join_9 = TextJoin(Text=merge_17, Join="_")
join_10 = TextJoin(Text=merge_18, Join="_")
heat_map_size = Slider(220, range=0..1000)
mjoin_5 = MeshJoin(Meshes=mcol_7)
txt_9 = Text("3DView_1")
panel_35 = Panel(txt_9)
c_script_43 = CSharpScript(takePic=and, viewName=panel_35, path=c_script_2.A, fileName=txt_6, size=number_slider_7)  # -> out, A, B; inputs takePic: Boolean, viewName: String, path: String, fileName: String, size: Int32
# ---------- c_script_43: C# ----------
    string vn = viewName;
    Rhino.Display.RhinoView view = RhinoDocument.Views.Find(vn, false);

    if (view == null)
      return;

    Rhino.Display.DisplayModeDescription displaymode = Rhino.Display.DisplayModeDescription.FindByName("Shaded");
    Bitmap image = view.CaptureToBitmap(new Size(size, size), displaymode);
    if (image == null)
      return;
    if(takePic){
      string filePath = Path.Combine(path, fileName + ".jpg");
      image.Save(filePath);
      image.Dispose();
    }



    //A = screenshot;
# ---------- end c_script_43 ----------
c_script_44 = CSharpScript(Active=c_script_43.B, path=c_script_23.A, filter="*.jpg")  # -> out, A; inputs disable: Boolean, path: String, filter: String
# ---------- c_script_44: C# usings ----------
using System.IO;
# ---------- c_script_44: C# ----------
    if(disable)
      return;
    A = Directory.GetFiles(path, filter);
# ---------- end c_script_44 ----------
split_10 = TextSplit(Text=c_script_44.A, Separators="\")
panel_36 = Panel(c_script_44.A)
item_22 = ListItem(List=reverse(split_10), Index=0, Wrap=True)
split_11 = TextSplit(Text=item_22, Separators="Img.jpg")
item_23 = ListItem(List=split_11, Index=3, Wrap=True)  # -> flatten(Item)
sort = SortList(Keys=item_23, ValuesA=c_script_44.A)  # -> Keys, ValuesA
short = ShortestList(ListA=true_button, ListB=sort.ValuesA, TrimMode=2)  # -> ListA, ListB
setbtn_2 = SetButton(ButtonToModify=short.ListA, ImagePath=short.ListB)
lng_6 = ListLength(List=sort.ValuesA)
subtraction_2 = Subtraction(A=number_slider_8, B=lng_6)
dup_5 = DuplicateData(Data=False, Number=subtraction_2, Order=True)
dup_6 = DuplicateData(Data=True, Number=lng_6, Order=True)
merge_19 = Merge(Data1=flatten(dup_6), Data2=flatten(dup_5))
and_2 = GateAnd(A=values_34.Values, B=merge_19)
setbtn_3 = SetButton(ButtonToModify=true_button_3, ImagePath=sort.ValuesA)
hideshow_5 = HideShowElement(ElementToHideShow=stack_4, Show=and_2, Collapse=True, Disable=True)
cluster_11 = Cluster_11(C=c_script_11.SurfaceFloor)
relay_6 = Relay([mjoin_4, join_8])
relay_7 = Relay([mjoin_2, join_10])
merge_20 = Merge(Data1=flatten(stack), Data2=flatten(expander_8), Data3=flatten(expander_7), Data4=flatten(scrollviewer_2))  # -> flatten(Result)
relay_8 = Relay([mjoin_5, join_9])
relay_9 = Relay([mjoin_3, join_7])
c_script_45 = CSharpScript(ViewName="3DView_1")  # -> out, A; inputs ViewName: String
# ---------- c_script_45: C# usings ----------
using Rhino.DocObjects;
# ---------- c_script_45: C# ----------
    RhinoDoc doc = Rhino.RhinoDoc.ActiveDoc;
    Rhino.Display.RhinoView view = doc.Views.Find(ViewName, true);
    if (view == null)
    {
      view = doc.Views.Add(ViewName, Rhino.Display.DefinedViewportProjection.Top, new System.Drawing.Rectangle(0, 0, 0, 0), false);
      // Redraw the viewport
      doc.Views.Redraw();
    }



    if (view != null)
    {
      A = ViewName + " exists";
    }
# ---------- end c_script_45 ----------
mesh_18 = Mesh(filter_5)
group = Group(Objects=c_script_42.A)
filter_6 = StreamFilter(Gate=updateboolean1, Stream1=int_5)
cluster_12 = Cluster_4(relay=heat_map_size, relay_2=mesh_18)  # -> G, pt_3
number_slider_18 = Slider(13.4, range=0..20)
panel_37 = Panel(c_script_45.A)
filter_7 = StreamFilter(Gate=filter_6, Stream0=relay_7, Stream1=relay_6, Stream2=relay_9, Stream3=relay_8)
swatch_3 = ColourSwatch(SwatchColor=RGB(0, 0, 0))
swatch_4 = ColourSwatch(SwatchColor=RGB(255, 255, 255))
updateview3 = Text("1")
c_script_46 = CSharpScript(ViewName="Heatmap_2", x=int_5, y=mjoin)  # -> out, A, B; inputs ViewName: String
# ---------- c_script_46: C# ----------
    RhinoDoc doc = Rhino.RhinoDoc.ActiveDoc;
    Rhino.Display.RhinoView view = doc.Views.Find(ViewName, true);
    if (view == null)
    {
      view = doc.Views.Add(ViewName, Rhino.Display.DefinedViewportProjection.Top, new System.Drawing.Rectangle(0, 0, 0, 0), false);
      // Redraw the viewport
      doc.Views.Redraw();
    }

    // Modify viewport properties
    
    if (view != null)
    {
      
      
      Rhino.Display.RhinoViewport viewport = view.ActiveViewport;
      viewport.CameraUp = new Vector3d(0, 1, 0);
      viewport.Camera35mmLensLength = 0.1;
      viewport.ChangeToParallelProjection(true);
      viewport.SetCameraTarget(new Point3d(5, 0, 500), false);
      viewport.SetCameraLocation(new Point3d(5, 0, 501), false);

    }


    if (view != null)
    {
      A = ViewName + " exists";
    }
# ---------- end c_script_46 ----------
c_script_47 = CSharpScript(ViewName="Heatmap_3", x=int_5, y=mjoin)  # -> out, A, B; inputs ViewName: String
# ---------- c_script_47: C# ----------
    RhinoDoc doc = Rhino.RhinoDoc.ActiveDoc;
    Rhino.Display.RhinoView view = doc.Views.Find(ViewName, true);
    if (view == null)
    {
      view = doc.Views.Add(ViewName, Rhino.Display.DefinedViewportProjection.Top, new System.Drawing.Rectangle(0, 0, 0, 0), false);
      // Redraw the viewport
      doc.Views.Redraw();
    }

    // Modify viewport properties
    if (view != null)
    {
      Rhino.Display.RhinoViewport viewport = view.ActiveViewport;



      viewport.CameraUp = new Vector3d(0, 1, 0);
      viewport.Camera35mmLensLength = 0.1;
      viewport.ChangeToParallelProjection(true);
      viewport.SetCameraTarget(new Point3d(10, 0, 500), false);
      viewport.SetCameraLocation(new Point3d(10, 0, 501), false);


      Rhino.Display.RhinoView perspectiveView = doc.Views.GetViewList(true, true)[0];
      doc.Views.ActiveView = perspectiveView;
      doc.Views.Redraw();
      perspectiveView.Maximized = true;


    }


    if (view != null)
    {
      A = ViewName + " exists";
    }
# ---------- c_script_47: C# additional code ----------
  /// <summary>
  /// This method will be called once every solution, before any calls to RunScript.
  /// </summary>
  public override void BeforeRunScript()
  { }
  /// <summary>
  /// This method will be called once every solution, after any calls to RunScript.
  /// </summary>
  public override void AfterRunScript()
  { }
# ---------- end c_script_47 ----------
c_script_48 = CSharpScript(ViewName="Heatmap_1", x=int_5, y=mjoin)  # -> out, A, B; inputs ViewName: String
# ---------- c_script_48: C# ----------
    RhinoDoc doc = Rhino.RhinoDoc.ActiveDoc;
    Rhino.Display.RhinoView view = doc.Views.Find(ViewName, true);
    if (view == null)
    {
      view = doc.Views.Add(ViewName, Rhino.Display.DefinedViewportProjection.Top, new System.Drawing.Rectangle(0, 0, 0, 0), false);
      // Redraw the viewport
      doc.Views.Redraw();

    }



    // Modify viewport properties
    if (view != null)
    {
      Rhino.Display.RhinoViewport viewport = view.ActiveViewport;

      viewport.CameraUp = new Vector3d(0, 1, 0);
      viewport.Camera35mmLensLength = 0.1;
      viewport.ChangeToParallelProjection(true);
      viewport.SetCameraTarget(new Point3d(0, 0, 500), false);
      viewport.SetCameraLocation(new Point3d(0, 0, 501), false);


    }


    if (view != null)
    {
      A = ViewName + " exists";
    }
# ---------- end c_script_48 ----------

# ---- group: Updates the Human components
c_script_49 = CSharpScript(x=mjoin, z=int_5, y="3DView_1")  # -> out, A; inputs x: Int32
# ---------- c_script_49: C# ----------
    A = x + 1;
    A = z;
    A = y;
# ---------- end c_script_49 ----------

# ----
item_24 = ListItem(List=filter_7, Index=0, Wrap=True)  # -> Item, Item1, Item2
Z_2 = UnitZ(Factor=1)
updateview1 = Text("1")
prespective = RenderMeshToScreen(
    Mesh=graft(cluster_12.G),
    Location=graft(cluster_12.pt_3),
    ScaleFactor=updateview3,
    Depth=0.99,
    Fixed=True,
    m_scWithvp=False)
cll = CameraLensLength(88)
cluster_13 = Cluster_12(relay=group, T="{10,0,500}")
cluster_14 = Cluster_12(relay=mesh_16, T="{5,0,500}")
cluster_15 = Cluster_12(relay=mesh_15, T="{0,0,500}")
adjustelem_14 = AdjustElementAppearance(ElementsToAdjust=graft(expander_2), Foreground=swatch_4, Background=swatch_3, FontSize=number_slider_18)
adjustelem_15 = AdjustElementAppearance(ElementsToAdjust=graft(expander_4), Foreground=swatch_4, Background=swatch_3, FontSize=number_slider_18)
split_12 = TextSplit(Text=item_24.Item1, Separators="_")
adjustpos_20 = AdjustElementPositioning(
    ElementsToAdjust=expander_2,
    AbsolutePositioning=False,
    Width=Slider(205, range=0..300),
    Height=Slider(311, range=0..500))
updateviewfront = ModifyViewport(
    ViewportName=c_script_49.A,
    CameraLocation=cluster_10.i,
    CameraTarget=cluster_10.relay_2,
    CameraProjection=updateview1,
    CameraLensLength=cll,
    CameraUp=Z_2,
    AnimateRestore=False,
    RestoreFrames=10)
tag_3 = TextTag3D(
    Location=cluster_11,
    Text="→ N",
    Size=Slider(5, range=0..10),
    Colour=ColourSwatch(SwatchColor=RGB(0, 0, 0)),
    Justification=7)
panel_38 = Panel(c_script_46.A)
panel_39 = Panel(c_script_47.A)
panel_40 = Panel(c_script_48.A)
merge_21 = Merge(Data1=flatten(expander_2), Data2=flatten(expander_5))  # -> flatten(Result)
panel_41 = Panel(item_24.Item)
lng_7 = ListLength(List=split_12)  # -> expr("x-2", Length)
mesh_19 = Mesh(item_24.Item)
merge_22 = Merge(Data1=flatten(expander_3), Data2=flatten(expander_4))  # -> flatten(Result)
lng_8 = ListLength(List=split_12)  # -> expr("x-1", Length)
mcol_8 = MeshColours(Colours=[RGB(127, 255, 0), RGB(0, 100, 0), RGB(34, 139, 34), RGB(124, 252, 0), RGB(154, 205, 50), RGB(173, 255, 47), RGB(50, 205, 50), RGB(152, 251, 152)])
number_slider_19 = Slider(246, range=0..1000)
item_25 = ListItem(List=split_12, Index=expr("x-1", lng_8), Wrap=True)
cull_i_6 = CullIndex(List=split_12, Indices=[lng_8, lng_7], Wrap=True)
item_26 = ListItem(List=split_12, Index=lng_8, Wrap=True)
relay_10 = Relay(["Heatmap_1", "Heatmap_2", "Heatmap_3"])
txt_10 = Text(relay_10)
c_script_50 = CSharpScript(takePic=and, viewNames=txt_10, path=c_script_2.A, fileName=txt_6, size=number_slider_7)  # -> out, A, B; inputs takePic: Boolean, viewNames: list of String, path: String, fileName: String, size: Int32
# ---------- c_script_50: C# ----------
    for(int i = 0; i < viewNames.Count ;i++){
      string vn = viewNames[i];
      Rhino.Display.RhinoView view = RhinoDocument.Views.Find(vn, false);

      if (view == null)
        return;

      Rhino.Display.DisplayModeDescription displaymode = Rhino.Display.DisplayModeDescription.FindByName("Rendered");
      Bitmap image = view.CaptureToBitmap(new Size(size, size), displaymode);
      if (image == null)
        return;
      if(takePic){
        string filePath = Path.Combine(path, fileName +"_"+ i.ToString() + ".png");
        image.Save(filePath);
        image.Dispose();
      }
    }



    //A = screenshot;
# ---------- end c_script_50 ----------

# ---- group: High resolution
cluster_16 = Cluster_13(
    takepic=and,
    viewnames=txt_10,
    path=c_script_2.A,
    filename=txt_6,
    takepic_2=and,
    viewname=panel_35,
    path_2=c_script_2.A,
    filename_2=txt_6)

# ----
panel_42 = Panel(txt_10)
c_script_51 = CSharpScript(Active=c_script_50.B, path=c_script_23.A, filter="*.png")  # -> out, A; inputs Active: Boolean, disable: Boolean, path: String, filter: String
# ---------- c_script_51: C# ----------
    if(disable)
      return;
    
    A = Directory.GetFiles(path, filter);
# ---------- end c_script_51 ----------
split_13 = TextSplit(Text=c_script_51.A, Separators="\")
item_27 = ListItem(List=reverse(split_13), Index=0, Wrap=True)
split_14 = TextSplit(Text=item_27, Separators="Img.png")
item_28 = ListItem(List=split_14, Index=3, Wrap=True)  # -> flatten(Item)
split_15 = TextSplit(Text=item_28, Separators="_")
item_29 = ListItem(List=split_15, Index=0, Wrap=True)  # -> flatten(Item)
sort_2 = SortList(Keys=item_29, ValuesA=c_script_51.A)  # -> Keys, ValuesA
partition_4 = PartitionList(List=sort_2.ValuesA, Size=N)
setbtn_4 = SetButton(ButtonToModify=simplify(partition_3), ImagePath=simplify(partition_4))
series_9 = Series(Start=Slider(50, range=0..1000), Step=Slider(19, range=0..1000), Count=10)
merge_23 = Merge(Data1=Slider(286, range=0..300), Data2=Slider(413, range=0..1000))
number_slider_20 = Slider(210, range=0..300)
lng_9 = ListLength(List=cull_i_6)  # -> expr("x-1", Length)
dom = ConstructDomain(DomainStart=number_slider_19, DomainEnd=Slider(469, range=0..1000))
Z_3 = ZCoordinate(10)
item_30 = ListItem(List=series_9, Index=0, Wrap=True)  # -> Item, Item1, Item2, Item3
range_3 = Range(Domain=dom, Steps=lng_9)
merge_24 = Merge(Data1=Slider(315, range=0..1000), Data2=Slider(345, range=0..1000))
merge_25 = Merge(
    Data1=Slider(40, range=0..1000),
    Data2=Slider(73, range=0..1000),
    Data3=Slider(90, range=0..1000),
    Data4=Slider(569, range=0..1000))
neg_2 = Negative(Value=Slider(2000, range=0..10000))
relay_11 = Relay([Slider(0, range=0..2), Slider(1, range=0..2)])
relay_12 = Relay([Slider(0, range=0..2), Slider(0, range=0..2)])
relay_13 = Relay([Slider(0, range=0..2), Slider(1, range=0..2), Slider(2, range=0..2), Slider(3, range=0..3)])
relay_14 = Relay([Slider(0, range=0..2), Slider(0, range=0..2), Slider(0, range=0..2), Slider(0, range=0..2)])
pt_5 = ConstructPoint(XCoordinate=number_slider_19, YCoordinate=item_30.Item3, ZCoordinate=neg_2)
pt_6 = ConstructPoint(XCoordinate=number_slider_19, YCoordinate=item_30.Item2, ZCoordinate=10)
pt_7 = ConstructPoint(XCoordinate=range_3, YCoordinate=item_30.Item1, ZCoordinate=200)
pt_8 = ConstructPoint(XCoordinate=number_slider_19, YCoordinate=item_30.Item, ZCoordinate=0)
relay_15 = Relay([Slider(0, range=0..2), Slider(1, range=0..2)])
relay_16 = Relay([Slider(0, range=0..2), Slider(0, range=0..2)])
grid_2 = CreateGrid(
    UIElements=merge_21,
    Width=Slider(220, range=0..5000),
    Height=Slider(683, range=0..7000),
    RowDefinitions=flatten(merge_24),
    ColumnDefinitions=flatten(Slider(210, range=0..1000)),
    ElementRow=relay_11,
    ElementColumn=relay_12,
    ElementRowSpan=2,
    ElementColumnSpan=1)
meshtoscreen = RenderMeshToScreen(Mesh=item_24.Item, Location=pt_8, ScaleFactor=Slider(13, range=0..100), Depth=0.95, Fixed=True, m_scWithvp=False)
grid_3 = CreateGrid(
    UIElements=merge_22,
    Width=number_slider_20,
    Height=Slider(1055, range=0..7000),
    RowDefinitions=flatten(merge_23),
    ColumnDefinitions=flatten(number_slider_20),
    ElementRow=relay_15,
    ElementColumn=relay_16,
    ElementRowSpan=2,
    ElementColumnSpan=1)
texttoscreen = RenderTextToScreen(Text=cull_i_6, Location=pt_7, Size=Slider(10, range=0..100), Color=RGB(0, 0, 0), m_scWithvp=False)
texttoscreen_2 = RenderTextToScreen(Text=item_26, Location=pt_5, Size=Slider(10, range=0..100), Color=RGB(0, 0, 0), m_scWithvp=False)
texttoscreen_3 = RenderTextToScreen(Text=item_25, Location=pt_6, Size=Slider(10, range=0..100), Color=RGB(0, 0, 0), m_scWithvp=False)
grid_4 = CreateGrid(
    UIElements=merge_20,
    Width=Slider(469, range=0..5000),
    Height=Slider(1128, range=0..7000),
    RowDefinitions=flatten(merge_25),
    ColumnDefinitions=flatten(Slider(384, range=0..1000)),
    ElementRow=relay_13,
    ElementColumn=relay_14,
    ElementRowSpan=2,
    ElementColumnSpan=1)
merge_26 = Merge(Data1=grid_3, Data2=grid_2)
number_slider_21 = Slider(13.4, range=0..20)
swatch_5 = ColourSwatch(SwatchColor=RGB(102, 102, 102))
swatch_6 = ColourSwatch(SwatchColor=RGB(255, 255, 255))
adjustelem_16 = AdjustElementAppearance(ElementsToAdjust=graft(expander_3), Foreground=swatch_6, Background=swatch_5, FontSize=number_slider_21)
adjustelem_17 = AdjustElementAppearance(ElementsToAdjust=graft(expander_5), Foreground=swatch_6, Background=swatch_5, FontSize=number_slider_21)
merge_27 = Merge(Data1=Slider(215, range=0..1000), Data2=Slider(215, range=0..1000))
relay_17 = Relay([Slider(0, range=0..2), Slider(0, range=0..2)])
relay_18 = Relay([Slider(0, range=0..2), Slider(1, range=0..2)])
grid_5 = CreateGrid(
    UIElements=merge_26,
    Width=Slider(420, range=0..5000),
    Height=Slider(1332, range=0..7000),
    RowDefinitions=flatten(Slider(761, range=0..1000)),
    ColumnDefinitions=flatten(merge_27),
    ElementRow=relay_17,
    ElementColumn=relay_18,
    ElementRowSpan=2,
    ElementColumnSpan=1)
merge_28 = Merge(Data1=Slider(462, range=0..1000))
merge_29 = Merge(Data1=Slider(660, range=0..1000), Data2=Slider(100, range=0..1000))
relay_19 = Relay([Slider(0, range=0..2), Slider(1, range=0..2)])
relay_20 = Relay([Slider(0, range=0..2), Slider(0, range=0..2)])
merge_30 = Merge(Data1=grid_5, Data2=expander)  # -> flatten(Result)
grid_6 = CreateGrid(
    UIElements=merge_30,
    Width=Slider(430, range=0..5000),
    Height=Slider(1052, range=0..7000),
    RowDefinitions=flatten(merge_29),
    ColumnDefinitions=flatten(merge_28),
    ElementRow=relay_19,
    ElementColumn=relay_20,
    ElementRowSpan=2,
    ElementColumnSpan=1)
adjustelem_18 = AdjustElementAppearance(ElementsToAdjust=grid_6, Background=ColourSwatch(SwatchColor=RGB(255, 255, 255)))
merge_31 = Merge(Data1=flatten(grid_6), Data2=flatten(grid_4))
panel_43 = Panel("\"Amber\", \"Blue\", \"Brown\", \"Cobalt\", \"Crimson\", \"Cyan\", \"Emerald\", \"Green\", \"Indigo\", \"Lime\", \"Magenta\", \"Mauve\", \"Olive\", \"Orange\", \"Pink\", \"Purple\", \"Red\", \"Sienna\", \"Steel\", \"Taupe\", \"Teal\", \"Violet\", \"Yellow\",\"Black\"")
split_16 = TextSplit(Text=panel_43, Separators=", ")
split_17 = TextSplit(Text=split_16, Separators="\"\"")
lng_10 = ListLength(List=split_17)
larger_5 = LargerThan(FirstNumber=lng_10, SecondNumber=2)  # -> LargerThan, OrEqualTo
cull_3 = CullPattern(List=split_17, CullPattern=larger_5.LargerThan)
launchwin = LaunchWindow(
    Show=Toggle(True),
    Name="Dashboard",
    Width=Slider(815, range=0..1000),
    Height=Slider(814, range=800..900),
    FontFamily="Arial",
    ChildStatus=0,
    EnableHorizScroll=False)
clean_5 = CleanTree(RemoveNulls=True, RemoveInvalid=True, RemoveEmpty=True, Tree=cull_3)
merge_32 = Merge(Data1=Slider(768, range=0..1000))
merge_33 = Merge(Data1=Slider(426, range=0..1000), Data2=Slider(369, range=0..1000))
relay_21 = Relay([Slider(0, range=0..2), Slider(0, range=0..2)])
relay_22 = Relay([Slider(0, range=0..2), Slider(1, range=0..2)])
item_31 = ListItem(List=clean_5, Index=1, Wrap=True)  # -> flatten(Item)
item_32 = ListItem(List=item_31, Index=Slider(11, range=0..26), Wrap=True)
grid_7 = CreateGrid(
    UIElements=merge_31,
    Width=Slider(964, range=0..5000),
    Height=Slider(760, range=600..800),
    RowDefinitions=flatten(merge_32),
    ColumnDefinitions=flatten(merge_33),
    ElementRow=relay_21,
    ElementColumn=relay_22,
    ElementRowSpan=2,
    ElementColumnSpan=1)
winprops = SetWindowProperties(
    Window=launchwin,
    AccentColor=item_32,
    ShowTitleBar=True,
    BackgroundColor=ColourSwatch(SwatchColor=RGB(255, 255, 255)),
    ScaleFactor=1)
addelems = AddElements(Window=launchwin, Elements=flatten(grid_7), DoVLChecking=True)  # -> AddedElements, ElementNames

# ==== cluster Cluster
wall_r = ClusterInput()
roof_r = ClusterInput()
window_u = ClusterInput()
window_shgc = ClusterInput()
ground_slab_r = ClusterInput()
expression = Expression(x=roof_r, Expression="max(x - 0.337473, 1)")
expression_2 = Expression(x=ground_slab_r, Expression="max(x-0.604099-1, 1)")

# ---- group: Window construction making / You might give a new name
give_a_name_to_the_window = Panel("NewWindow")

# ---- group: Window construction making
uip2usi = Ladybug_uIP2uSI(U_IP=window_u)  # -> U_SI; plug-in component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
windowmat = HBWindowMaterial(name=give_a_name_to_the_window, u_factor=uip2usi, shgc=window_shgc)  # -> mat; plug-in component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
windowconstr = HBWindowConstruction(name=give_a_name_to_the_window, materials=windowmat)  # -> constr; plug-in component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
decnstrconstr = HBDeconstructConstruction(constr=windowconstr)  # -> materials, layers, r_val_si, r_val_ip, u_fac_si, u_fac_ip, shgc, t_sol, t_vis; plug-in component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

# ----
expression_3 = Expression(x=expression_2, Expression="Format(\"insulation-R{0}\", x)")
expression_4 = Expression(x=expression, Expression="Format(\"insulation-R{0}\", x)")

# ---- group: Wall construction making / You might give a new name
give_a_name_to_the_new_wall = Panel("NewConstruction")

# ---- group: Slab construction making / You might give a new name
give_a_name_to_the_new_slab = Panel("NewSlab")

# ---- group: Slab construction making
searchconstrs = HBSearchConstructions(keywords="typical insulated 6in R5")  # -> opaque_constrs, window_constrs, shade_constrs; plug-in component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
i_am_using_this_typical_assembly_as_the = Panel(searchconstrs.opaque_constrs)  # "I am using this typical assembly as the starting point"
decnstrconstr_2 = HBDeconstructConstruction(constr=searchconstrs.opaque_constrs)  # -> materials, layers, r_val_si, r_val_ip, u_fac_si, u_fac_ip, shgc, t_sol, t_vis; plug-in component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
bang = ExplodeTree(Data=graft(decnstrconstr_2.layers))  # -> _0000, _0001, _0002
example_slab_r_value = Panel(decnstrconstr_2.r_val_ip)
decnstrmat = HBDeconstructMaterial(mat=bang._0000)  # -> values, attr_names, r_val_si, r_val_ip; plug-in component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
panel = Panel(decnstrconstr_2.layers)
bang_2 = ExplodeTree(Data=graft(decnstrmat.values))  # -> _000000, _000001, _000002, _000003, _000004, _000005
rip2rsi = Ladybug_rIP2rSI(R_IP=expression_2)  # -> R_SI; plug-in component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
opaquematnomass = HBOpaqueMaterialNoMass(
    name=expression_3,
    r_value=rip2rsi,
    roughness=bang_2._000001,
    therm_absp=bang_2._000003,
    sol_absp=bang_2._000004,
    vis_absp=bang_2._000005)  # -> mat; plug-in component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
merge = Merge(Data1=opaquematnomass, Data2=bang._0001, Data3=bang._0002)  # -> flatten(Result)
opaqueconstr = HBOpaqueConstruction(name=give_a_name_to_the_new_slab, materials=merge)  # -> constr; plug-in component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
decnstrconstr_3 = HBDeconstructConstruction(constr=opaqueconstr)  # -> materials, layers, r_val_si, r_val_ip, u_fac_si, u_fac_ip, shgc, t_sol, t_vis; plug-in component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

# ---- group: Roof construction making / You might give a new name
give_a_name_to_the_new_roof = Panel("NewRoof")

# ---- group: Roof construction making
searchconstrs_2 = HBSearchConstructions(keywords="typical IEAD roof R10")  # -> opaque_constrs, window_constrs, shade_constrs; plug-in component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
i_am_using_this_typical_assembly_as_the_2 = Panel(searchconstrs_2.opaque_constrs)  # "I am using this typical assembly as the starting point"
decnstrconstr_4 = HBDeconstructConstruction(constr=searchconstrs_2.opaque_constrs)  # -> materials, layers, r_val_si, r_val_ip, u_fac_si, u_fac_ip, shgc, t_sol, t_vis; plug-in component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
bang_3 = ExplodeTree(Data=graft(decnstrconstr_4.layers))  # -> _0000, _0001, _0002
example_roof_r_value = Panel(decnstrconstr_4.r_val_ip)
decnstrmat_2 = HBDeconstructMaterial(mat=bang_3._0001)  # -> values, attr_names, r_val_si, r_val_ip; plug-in component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
panel_2 = Panel(decnstrconstr_4.layers)
bang_4 = ExplodeTree(Data=graft(decnstrmat_2.values))  # -> _000100, _000101, _000102, _000103, _000104, _000105
rip2rsi_2 = Ladybug_rIP2rSI(R_IP=expression)  # -> R_SI; plug-in component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
opaquematnomass_2 = HBOpaqueMaterialNoMass(
    name=expression_4,
    r_value=rip2rsi_2,
    roughness=bang_4._000101,
    therm_absp=bang_4._000103,
    sol_absp=bang_4._000104,
    vis_absp=bang_4._000105)  # -> mat; plug-in component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
merge_2 = Merge(Data1=bang_3._0000, Data2=opaquematnomass_2, Data3=bang_3._0002)  # -> flatten(Result)
opaqueconstr_2 = HBOpaqueConstruction(name=give_a_name_to_the_new_roof, materials=merge_2)  # -> constr; plug-in component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
decnstrconstr_5 = HBDeconstructConstruction(constr=opaqueconstr_2)  # -> materials, layers, r_val_si, r_val_ip, u_fac_si, u_fac_ip, shgc, t_sol, t_vis; plug-in component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

# ---- group: Window construction making / the new window construction and its new U & SHGC value
new_win_u_value = Panel(decnstrconstr.u_fac_ip)
new_shgc_value = Panel(decnstrconstr.shgc)

# ---- group: Slab construction making / the new slab construction and its new R value
new_slab_r_value = Panel(decnstrconstr_3.r_val_ip)

# ---- group: Roof construction making / the newroof construction and its new R value
new_roof_r_value = Panel(decnstrconstr_5.r_val_ip)

# ----
groundsubset = HBGroundConstructionSubset(ground_floor=opaqueconstr)  # -> ground_set; plug-in component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
interiorsubset = HBInteriorConstructionSubset()  # -> interior_set; plug-in component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
subfacesubset = HBSubfaceSubset(window=windowconstr)  # -> subface_set; plug-in component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

# ---- group: Give a new ConstructionSet name
panel_3 = Panel("CustomSet")

# ---- group: Wall construction making
searchconstrs_3 = HBSearchConstructions(keywords="typical insulated steel framed R5")  # -> opaque_constrs, window_constrs, shade_constrs; plug-in component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
expression_5 = Expression(x=wall_r, Expression="max(x - 0.329761-1, 1)")
decnstrconstr_6 = HBDeconstructConstruction(constr=searchconstrs_3.opaque_constrs)  # -> materials, layers, r_val_si, r_val_ip, u_fac_si, u_fac_ip, shgc, t_sol, t_vis; plug-in component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
rip2rsi_3 = Ladybug_rIP2rSI(R_IP=expression_5)  # -> R_SI; plug-in component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
bang_5 = ExplodeTree(Data=graft(decnstrconstr_6.layers))  # -> _0000, _0001, _0002, _0003
example_wall_r_value = Panel(decnstrconstr_6.r_val_ip)
panel_4 = Panel(decnstrconstr_6.layers)
decnstrmat_3 = HBDeconstructMaterial(mat=bang_5._0002)  # -> values, attr_names, r_val_si, r_val_ip; plug-in component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
bang_6 = ExplodeTree(Data=graft(decnstrmat_3.values))  # -> _000200, _000201, _000202, _000203, _000204, _000205

# ----
expression_6 = Expression(x=expression_5, Expression="Format(\"insulation-R{0}\", x)")

# ---- group: Wall construction making (continued)
opaquematnomass_3 = HBOpaqueMaterialNoMass(
    name=expression_6,
    r_value=rip2rsi_3,
    roughness=bang_6._000201,
    therm_absp=bang_6._000203,
    sol_absp=bang_6._000204,
    vis_absp=bang_6._000205)  # -> mat; plug-in component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
merge_3 = Merge(Data1=bang_5._0000, Data2=bang_5._0001, Data3=opaquematnomass_3, Data4=bang_5._0003)  # -> flatten(Result)
opaqueconstr_3 = HBOpaqueConstruction(name=give_a_name_to_the_new_wall, materials=merge_3)  # -> constr; plug-in component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
decnstrconstr_7 = HBDeconstructConstruction(constr=opaqueconstr_3)  # -> materials, layers, r_val_si, r_val_ip, u_fac_si, u_fac_ip, shgc, t_sol, t_vis; plug-in component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

# ---- group: Wall construction making / the new wall construction and its new R value
new_wall_r_value = Panel(decnstrconstr_7.r_val_ip)

# ----
exteriorsubset = HBExteriorConstructionSubset(exterior_wall=opaqueconstr_3, exterior_roof=opaqueconstr_2, exposed_floor=opaqueconstr)  # -> exterior_set; plug-in component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
constructionset = HBConstructionSet(
    name=panel_3,
    exterior_subset=exteriorsubset,
    ground_subset=groundsubset,
    interior_subset=interiorsubset,
    subface_subset=subfacesubset)  # -> constr_set; plug-in component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
constr_set = ClusterOutput(constructionset)
decnstrconstrset = HBDeconstructConstructionSet(constr_set=constructionset)  # -> exterior_wall, exterior_roof, exposed_floor, ground_wall, ground_roof, ground_floor, window, skylight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; plug-in component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
decnstrconstr_8 = HBDeconstructConstruction(constr=decnstrconstrset.exterior_wall)  # -> materials, layers, r_val_si, r_val_ip, u_fac_si, u_fac_ip, shgc, t_sol, t_vis; plug-in component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
decnstrconstr_9 = HBDeconstructConstruction(constr=decnstrconstrset.exterior_roof)  # -> materials, layers, r_val_si, r_val_ip, u_fac_si, u_fac_ip, shgc, t_sol, t_vis; plug-in component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
decnstrconstr_10 = HBDeconstructConstruction(constr=decnstrconstrset.ground_floor)  # -> materials, layers, r_val_si, r_val_ip, u_fac_si, u_fac_ip, shgc, t_sol, t_vis; plug-in component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
decnstrconstr_11 = HBDeconstructConstruction(constr=decnstrconstrset.exposed_floor)  # -> materials, layers, r_val_si, r_val_ip, u_fac_si, u_fac_ip, shgc, t_sol, t_vis; plug-in component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
decnstrconstr_12 = HBDeconstructConstruction(constr=decnstrconstrset.window)  # -> materials, layers, r_val_si, r_val_ip, u_fac_si, u_fac_ip, shgc, t_sol, t_vis; plug-in component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
panel_5 = Panel(decnstrconstr_9.r_val_ip)
panel_6 = Panel(decnstrconstr_8.r_val_ip)
panel_7 = Panel(decnstrconstr_11.r_val_ip)
panel_8 = Panel(decnstrconstr_10.r_val_ip)
panel_9 = Panel(decnstrconstr_12.u_fac_ip)
panel_10 = Panel(decnstrconstr_12.shgc)

# ==== cluster Cluster_2
G = ClusterInput()
G_2 = ClusterInput()
run = ClusterInput()
geo = ClusterInput()
geo_2 = ClusterInput()
geo_3 = ClusterInput()
filter = StreamFilter(Gate=G, Stream0="adiabatic", Stream1="outdoors")
filter_2 = StreamFilter(Gate=G_2, Stream0="adiabatic", Stream1="outdoors")
geo_4 = ClusterInput()
face = HBFace(geo=geo_4, bc="outdoors")  # -> report, faces; plug-in component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
face_2 = HBFace(geo=geo, type="Floor", bc=filter)  # -> report, faces; plug-in component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
face_3 = HBFace(geo=geo_3, bc="outdoors")  # -> report, faces; plug-in component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
face_4 = HBFace(geo=geo_2, type="RoofCeiling", bc=filter_2)  # -> report, faces; plug-in component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
ratio = ClusterInput()
aperturesbyratio = HBAperturesByRatio(hb_objs=flatten(face_3.faces), ratio=ratio, subdivide=Toggle(True))  # -> report, hb_objs; plug-in component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
data = Data(geo_3)
data_2 = Data(geo)
data_3 = Data(geo_2)
data_4 = Data(flatten([aperturesbyratio.hb_objs, face.faces, face_4.faces, face_2.faces]))
clean = CleanTree(RemoveNulls=True, RemoveInvalid=True, RemoveEmpty=False, Tree=data_4)
txt = Text(["2019::LargeOffice::Attic", "2019::LargeOffice::BreakRoom", "2019::LargeOffice::Classroom", "2019::LargeOffice::ClosedOffice", "2019::LargeOffice::Conference", "2019::LargeOffice::Corridor"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])
i = ClusterInput()
item = ListItem(List=txt, Index=i, Wrap=True)
txt_2 = Text(item)
panel = Panel("https://energyplus-weather.s3.amazonaws.com/north_and_central_america_wmo_region_4/USA/MA/USA_MA_Boston-Logan.Intl.AP.725090_TMY3/USA_MA_Boston-Logan.Intl.AP.725090_TMY3.zip")
constr_set = ClusterInput()
room = HBRoom(faces=flatten(clean), name="Hospital Shoe Box", constr_set=constr_set, program=txt_2, conditioned=True)  # -> report, room; plug-in component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
downloadepw = LBDownloadWeather(weather_URL=panel)  # -> epw_file, stat_file, ddy_file; plug-in component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
annualloads = HBAnnualLoads(rooms=flatten(room.room), epw_file=downloadepw.epw_file, run_bal=Toggle(True), run=run)  # -> report, total_load, cooling, heating, lighting, equip, process, hot_water, balance; plug-in component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
total_load = ClusterOutput(annualloads.total_load)
balance = ClusterOutput(annualloads.balance)
data_5 = Data(flatten([annualloads.cooling, annualloads.heating, annualloads.lighting, annualloads.equip, annualloads.hot_water]))
data_6 = ClusterOutput(data_5)

# ==== cluster Cluster_3
relay = ClusterInput()
bbox = BoundingBox(Content=relay, Plane=PlaneXY(0, 0, 0), UnionBox=True)  # -> Box, Box_2
debox = DeconstructBox(Box=bbox.Box)  # -> Plane, X, Y, Z
edges = BrepEdges(Brep=bbox.Box)  # -> Naked, Interior, NonManifold
dedomain = DeconstructDomain(Domain=debox.X)  # -> Start, End
dedomain_2 = DeconstructDomain(Domain=debox.Y)  # -> Start, End
join = JoinCurves(Curves=edges.Naked, Preserve=False)
number_slider = Slider(2.8, range=0..10)
number_slider_2 = Slider(3.6, range=0..10)
avr = Average(Input=[dedomain.Start, dedomain.End])
subtraction = Subtraction(A=dedomain.End, B=dedomain.Start)
area = Area(Geometry=join)  # -> Area, Centroid
dedomain_3 = DeconstructDomain(Domain=debox.Z)  # -> Start, End
avr_2 = Average(Input=[dedomain_2.Start, dedomain_2.End])
scale = Scale(Geometry=edges.Naked, Center=area.Centroid, Factor=Slider(2.1, range=0..10))  # -> Geometry, Transform
subtraction_2 = Subtraction(A=dedomain_2.End, B=dedomain_2.Start)
avr_3 = Average(Input=[dedomain_3.Start, dedomain_3.End])
curvepoint = PointOnCurve(scale.Geometry, parameter=0.5)
max = Maximum(A=subtraction, B=subtraction_2)
multiplication = Multiplication(A=subtraction, B=number_slider)
multiplication_2 = Multiplication(A=subtraction, B=number_slider)
multiplication_3 = Multiplication(A=subtraction_2, B=number_slider)
multiplication_4 = Multiplication(A=subtraction_2, B=number_slider)
pdecon = Deconstruct(Point=curvepoint)  # -> XComponent, YComponent, ZComponent
multiplication_5 = Multiplication(A=max, B=number_slider_2)
multiplication_6 = Multiplication(A=max, B=number_slider_2)
subtraction_3 = Subtraction(A=avr, B=multiplication)
addition = Addition(A=multiplication_2, B=avr)
sort = SortList(Keys=pdecon.YComponent, ValuesA=curvepoint)  # -> Keys, reverse(ValuesA)
subtraction_4 = Subtraction(A=avr_3, B=multiplication_5)
addition_2 = Addition(A=avr_3, B=multiplication_6)
subtraction_5 = Subtraction(A=avr_2, B=multiplication_3)
addition_3 = Addition(A=avr_2, B=multiplication_4)
dom = ConstructDomain(DomainStart=subtraction_3, DomainEnd=addition)
dom_2 = ConstructDomain(DomainStart=subtraction_4, DomainEnd=addition_2)
item = ListItem(List=sort.ValuesA, Index=0, Wrap=True)
dom_3 = ConstructDomain(DomainStart=subtraction_5, DomainEnd=addition_3)
xy = XYPlane(Origin=item)
box = DomainBox(Base=debox.Plane, X=dom, Y=dom_3, Z=dom_2)
prot = RotatePlane(Plane=xy, Angle=1.570796327)
area_2 = Area(Geometry=box)  # -> Area, Centroid
P = ClusterOutput(prot)
debrep = DeconstructBrep(Brep=box)  # -> Faces, Edges, Vertices
pdecon_2 = Deconstruct(Point=debrep.Vertices)  # -> XComponent, YComponent, ZComponent
sort_2 = SortList(Keys=pdecon_2.ZComponent, ValuesA=debrep.Vertices)  # -> Keys, reverse(ValuesA)
item_2 = ListItem(List=sort_2.ValuesA, Index=[0, 1, 2, 3], Wrap=True)
pdecon_3 = Deconstruct(Point=item_2)  # -> XComponent, YComponent, ZComponent
addition_4 = Addition(A=pdecon_3.XComponent, B=pdecon_3.YComponent)
sort_3 = SortList(Keys=addition_4, ValuesA=item_2)  # -> Keys, ValuesA
item_3 = ListItem(List=sort_3.ValuesA, Index=0, Wrap=True)
i = ClusterOutput(item_3)
relay_2 = ClusterOutput(area_2.Centroid)

# ==== cluster Cluster_4
relay = ClusterInput()
relay_2 = ClusterInput()
bbox = BoundingBox(Content=relay_2, Plane=PlaneXY(0, 0, 0), UnionBox=True)  # -> Box, Box_2
pt = ConstructPoint(XCoordinate=0, YCoordinate=0, ZCoordinate=0)
area = Area(Geometry=bbox.Box)  # -> Area, Centroid
subtraction = Subtraction(A=pt, B=area.Centroid)
move = Move(Geometry=relay_2, Motion=subtraction)  # -> Geometry, Transform
bbox_2 = BoundingBox(Content=move.Geometry, Plane=PlaneXY(0, 0, 0), UnionBox=True)  # -> Box, Box_2
debox = DeconstructBox(Box=bbox_2.Box)  # -> Plane, X, Y, Z
dedomain = DeconstructDomain(Domain=debox.X)  # -> Start, End
dedomain_2 = DeconstructDomain(Domain=debox.Y)  # -> Start, End
subtraction_2 = Subtraction(A=dedomain.End, B=dedomain.Start)
subtraction_3 = Subtraction(A=dedomain_2.End, B=dedomain_2.Start)
max = Maximum(A=subtraction_2, B=subtraction_3)
division = Division(A=relay, B=max)
scale = Scale(Geometry=move.Geometry, Center=pt, Factor=division)  # -> Geometry, Transform
bbox_3 = BoundingBox(Content=scale.Geometry, Plane=PlaneXY(0, 0, 0), UnionBox=True)  # -> Box, Box_2
debox_2 = DeconstructBox(Box=bbox_3.Box)  # -> Plane, X, Y, Z
dedomain_3 = DeconstructDomain(Domain=debox_2.X)  # -> Start, End
dedomain_4 = DeconstructDomain(Domain=debox_2.Y)  # -> Start, End
subtraction_4 = Subtraction(A=dedomain_3.End, B=dedomain_3.Start)
subtraction_5 = Subtraction(A=dedomain_4.End, B=dedomain_4.Start)
division_2 = Division(A=subtraction_4, B=2)
division_3 = Division(A=subtraction_5, B=2)
addition = Addition(A=division_3, B=Slider(25, range=0..100))
pt_2 = ConstructPoint(XCoordinate=division_2, YCoordinate=addition, ZCoordinate=0)
G = ClusterOutput(scale.Geometry)
pt_3 = ClusterOutput(pt_2)

# ==== cluster Cluster_5
se_threshold = Slider(250, range=0..1000)
relay = ClusterInput()
relay_2 = ClusterInput()
c_script = CSharpScript(x=relay, y=se_threshold)  # -> out, A; inputs x: Double, y: Double
# ---------- c_script: C# ----------
    if(x>=y)
      A = 1;
    else
      A = 0;
# ---------- end c_script ----------
larger = LargerThan(FirstNumber=relay_2, SecondNumber=0.5)  # -> LargerThan, OrEqualTo
larger_2 = LargerThan(FirstNumber=c_script.A, SecondNumber=0)  # -> LargerThan, OrEqualTo
int = Integer(larger.LargerThan)
cull = CullPattern(List=c_script.A, CullPattern=larger_2.LargerThan)
lng = ListLength(List=cull)
lng_2 = ListLength(List=c_script.A)
I = ClusterInput()
I_2 = ClusterInput()
avr = Average(Input=int)
division = Division(A=lng, B=lng_2)
avr_2 = Average(Input=I)
S = Scope(1)
avr_3 = Average(Input=I_2)
multiplication = Multiplication(A=division, B=100)
multiplication_2 = Multiplication(A=avr, B=100)
multiplication_3 = Multiplication(A=avr_2, B=100)
c_script_2 = CSharpScript(Number=avr_3, Scope=S)  # -> out, A; inputs Number: Double, Scope: Double
# ---------- c_script_2: C# usings ----------
using System.IO;
using System.Linq;
using System.Data;
using System.Drawing;
using System.Reflection;
using System.Windows.Forms;
using System.Xml;
using System.Xml.Linq;
using System.Runtime.InteropServices;

using Rhino.DocObjects;
using Rhino.Collections;
using GH_IO;
using GH_IO.Serialization;
# ---------- c_script_2: C# ----------
    double x = Number;
    double y = Scope;
    double Divide = x / y;
    double wholeDiv = Math.Round(Divide);
    A = Scope * wholeDiv;
# ---------- end c_script_2 ----------
c_script_3 = CSharpScript(Number=multiplication_2, Scope=S)  # -> out, A; inputs Number: Double, Scope: Double; same code as c_script_2
c_script_4 = CSharpScript(Number=multiplication, Scope=S)  # -> out, A; inputs Number: Double, Scope: Double; same code as c_script_2
null = NullItem(Item=avr_3)  # -> NullFlags, InvalidFlags, Description
c_script_5 = CSharpScript(Number=multiplication_3, Scope=S)  # -> out, A; inputs Number: Double, Scope: Double; same code as c_script_2
null_2 = NullItem(Item=avr_2)  # -> NullFlags, InvalidFlags, Description
null_3 = NullItem(Item=division)  # -> NullFlags, InvalidFlags, Description
null_4 = NullItem(Item=avr)  # -> NullFlags, InvalidFlags, Description
filter = StreamFilter(Gate=null.NullFlags, Stream0=c_script_2.A, Stream1="0")
filter_2 = StreamFilter(Gate=null_3.NullFlags, Stream0=c_script_4.A, Stream1="0")
filter_3 = StreamFilter(Gate=null_4.NullFlags, Stream0=c_script_3.A, Stream1="0")
filter_4 = StreamFilter(Gate=null_2.NullFlags, Stream0=c_script_5.A, Stream1="0")
merge = Merge(Data1=flatten(filter_3), Data2=flatten(filter_2), Data3=flatten(filter_4), Data4=flatten(filter))
c_script_6 = CSharpScript(x=merge, y=["0", "0", "0", "0"])  # -> out, A; inputs x: Double, y: Double
# ---------- c_script_6: C# ----------
    if(x == null){
      A = y;}
    else
      A = x;
# ---------- end c_script_6 ----------
format = Format(Format="{0}: {1} {2}", Culture=127, Data0=["sDA", "ASE", "UDI", "MI"], Data1=c_script_6.A, Data2=["%", "%", "%", "lux"])
T = ClusterOutput(format)

# ==== cluster Cluster_6
L = ClusterInput()
I = ClusterInput()
item = ListItem(List=L, Index=[0, 1, 2, 3], Wrap=True)
ma = MassAddition(Input=I)  # -> Result, PartialResults
c_script = CSharpScript(Number=ma.Result, Scope=0.1)  # -> out, A; inputs Number: Double, Scope: Double; same code as c_script_2
c_script_2 = CSharpScript(Number=item, Scope=0.1)  # -> out, A; inputs Number: Double, Scope: Double; same code as c_script_2
i = ClusterOutput(item)
format = Format(Format="{0} : {1} kwh", Culture=127, Data0=["Cooling", "Heating", "Lighting", "Equipment"], Data1=c_script_2.A)
format_2 = Format(Format="Total Load : {0}", Culture=127, Data0=c_script.A)
A = ClusterOutput(c_script.A)
merge = Merge(Data1=flatten(format_2), Data2=flatten(format))
R = ClusterOutput(merge)

# ==== cluster Cluster_7
number_slider = Slider(0.4, range=0..10)
relay = ClusterInput()
neg = Negative(Value=number_slider)
merge = Merge(Data1=neg, Data2=number_slider)
join = JoinCurves(Curves=relay, Preserve=False)
Z = UnitZ(Factor=1)
vrot = Rotate(Vector=graft(relay), Axis=Z, Angle=[1.570796327, -1.570796327])
offset_l = OffsetCurveLoose(Curve=graft(relay), Distance=merge)
curvepoint = PointOnCurve(relay, parameter=0.5)
addition = Addition(A=graft(curvepoint), B=vrot)
boundary = BoundarySurfaces(Edges=join)
curvepoint_2 = PointOnCurve(offset_l, parameter=0.5)
pull = PullPoint(Point=addition, Geometry=boundary, ClosestOnly=True)  # -> ClosestPoint, Distance
pull_2 = PullPoint(Point=curvepoint_2, Geometry=boundary, ClosestOnly=True)  # -> ClosestPoint, Distance
sort = SortList(Keys=pull.Distance, ValuesA=vrot)  # -> Keys, ValuesA
sort_2 = SortList(Keys=pull_2.Distance, ValuesA=offset_l)  # -> Keys, ValuesA
item = ListItem(List=reverse(sort.ValuesA), Index=0, Wrap=True)
item_2 = ListItem(List=reverse(sort_2.ValuesA), Index=0, Wrap=True)  # -> simplify(Item)
vrot_2 = Rotate(Vector=item, Axis=Vector(0, 0, 1), Angle=-1.570796327)
curvepoint_3 = PointOnCurve(item_2, parameter=0.5)
tstat = TreeStatistics(Tree=item_2)  # -> graft(Paths), Length, Count
Z_2 = UnitZ(Factor=1)
dpath = DeconstructPath(Branch=tstat.Paths)
pl = ConstructPlane(Origin=curvepoint_3, XAxis=expr("-X", vrot_2), YAxis=Z_2)
weave = Weave(Pattern=[1, 0, 1], Stream0=dpath, Stream1=["[", "]"], NullGaps=False)
join_2 = TextJoin(Text=weave)
pl_2 = ClusterOutput(pl)
R = ClusterOutput(join_2)

# ==== cluster Cluster_8
relay = ClusterInput()
join = JoinCurves(Curves=relay, Preserve=False)
offset = OffsetCurve(Curve=join, Distance=[0.1, -0.1], Corners=1)  # -> flatten(Curve)
sort = SortList(Keys=offset, ValuesA=offset)  # -> Keys, reverse(ValuesA)
curvepoint = PointOnCurve(relay, parameter=0.5)
item = ListItem(List=sort.ValuesA, Index=0, Wrap=True)
disc = Discontinuity(Curve=join, Level=1)  # -> Points, Parameters
pull = PullPoint(Point=curvepoint, Geometry=item, ClosestOnly=True)  # -> ClosestPoint, Distance
Z = UnitZ(Factor=1)
disc_2 = Discontinuity(Curve=item, Level=1)  # -> Points, Parameters
L = ClusterInput()
subtraction = Subtraction(A=pull.ClosestPoint, B=curvepoint)
pull_2 = PullPoint(Point=disc.Points, Geometry=disc_2.Points, ClosestOnly=True)  # -> ClosestPoint, Distance
line = LineSDL(Start=disc.Points, Direction=Z, Length=L)
vrot = Rotate(Vector=subtraction, Axis=Z, Angle=-1.570796327)
subtraction_2 = Subtraction(A=disc.Points, B=pull_2.ClosestPoint)
curvepoint_2 = PointOnCurve(line, parameter=0.5)
end = EndPoints(Curve=line)  # -> Start, End
line_2 = LineSDL(Start=curvepoint, Direction=vrot, Length=1)
pl = ConstructPlane(Origin=curvepoint_2, XAxis=subtraction_2, YAxis=Z)
flip = FlipCurve(Curve=graft(relay), Guide=graft(line_2))  # -> flatten(Curve), Flag
pl_2 = ConstructPlane(Origin=curvepoint, XAxis=vrot, YAxis=subtraction)
end_2 = EndPoints(Curve=flip.Curve)  # -> Start, End
merge = Merge(Data1=flatten(pl_2), Data2=flatten(pl))
merge_2 = Merge(Data1=flatten(end_2.Start), Data2=flatten(end.Start))
merge_3 = Merge(Data1=flatten(end_2.End), Data2=flatten(end.End))
R = ClusterOutput(merge)
R_2 = ClusterOutput(merge_2)
R_3 = ClusterOutput(merge_3)

# ==== cluster Cluster_9
id = ClusterInput()
id_2 = Guid(flatten(id))
geo = Geometry(id_2)
brep = Brep(geo)
null = NullItem(Item=brep)  # -> NullFlags, InvalidFlags, Description
int = Integer(null.NullFlags)
dispatch = Dispatch(List=geo, DispatchPattern=int)  # -> ListA, ListB
jagged = SettingsSpeed()
mesh = MeshBrep(Brep=dispatch.ListB, Settings=jagged)
mesh_2 = Mesh(dispatch.ListA)
mjoin = MeshJoin(Meshes=flatten([mesh, mesh_2]))
M = ClusterOutput(mjoin)

# ==== cluster Cluster_10
C = ClusterInput()
relay = ClusterInput()

# ---- group: Clipping Plane
bbox = BoundingBox(Content=C, Plane=PlaneXY(0, 0, 0))  # -> Box, Box_2
area = Area(Geometry=bbox.Box)  # -> Area, Centroid
Z = UnitZ(Factor=relay)
move = Move(Geometry=area.Centroid, Motion=Z)  # -> Geometry, Transform
xy = XYPlane(Origin=move.Geometry)
c_script = CSharpScript(plane=xy)  # -> out, A; inputs plane: Plane
# ---------- c_script: C# ----------
    foreach(var obj in RhinoDocument.Objects){
      if(obj is Rhino.DocObjects.ClippingPlaneObject){
        doc.Objects.Delete(obj.Id, true);
      }
    }

    int n = 0;
    plane.Flip();
    foreach (var view in RhinoDocument.Views.GetStandardRhinoViews()){
      id = RhinoDocument.Objects.AddClippingPlane(plane, 0.5, 0.5, view.ActiveViewportID);
      n++;
    }
    //id = RhinoDocument.Objects.AddClippingPlane(plane, 0.5, 0.5, RhinoDocument.Views.GetStandardRhinoViews()[0].ActiveViewportID);
# ---------- c_script: C# additional code ----------
  Guid id;
# ---------- end c_script ----------

# ==== cluster Cluster_11
C = ClusterInput()
bbox = BoundingBox(Content=C, Plane=PlaneXY(0, 0, 0), UnionBox=True)  # -> Box, Box_2
edges = BrepEdges(Brep=bbox.Box)  # -> Naked, Interior, NonManifold
join = JoinCurves(Curves=edges.Naked, Preserve=False)
area = Area(Geometry=join)  # -> Area, Centroid
scale = Scale(Geometry=edges.Naked, Center=area.Centroid, Factor=Slider(2.1, range=0..10))  # -> Geometry, Transform
curvepoint = PointOnCurve(scale.Geometry, parameter=0.5)
pdecon = Deconstruct(Point=curvepoint)  # -> XComponent, YComponent, ZComponent
sort = SortList(Keys=pdecon.YComponent, ValuesA=curvepoint)  # -> Keys, reverse(ValuesA)
item = ListItem(List=sort.ValuesA, Index=0, Wrap=True)
xy = XYPlane(Origin=item)
prot = RotatePlane(Plane=xy, Angle=1.570796327)
P = ClusterOutput(prot)

# ==== cluster Cluster_12
relay = ClusterInput()
T = ClusterInput()
bbox = BoundingBox(Content=relay, Plane=PlaneXY(0, 0, 0), UnionBox=True)  # -> Box, Box_2
bbox_2 = BoundingBox(Content=relay, Plane=PlaneXY(0, 0, 0), UnionBox=True)  # -> Box, Box_2
area = Area(Geometry=bbox_2.Box)  # -> Area, Centroid
debox = DeconstructBox(Box=bbox.Box)  # -> Plane, X, Y, Z
neg = Negative(Value=area.Centroid)
dedomain = DeconstructDomain(Domain=debox.X)  # -> Start, End
dedomain_2 = DeconstructDomain(Domain=debox.Y)  # -> Start, End
subtraction = Subtraction(A=dedomain.End, B=dedomain.Start)
subtraction_2 = Subtraction(A=dedomain_2.End, B=dedomain_2.Start)
move = Move(Geometry=relay, Motion=neg)  # -> Geometry, Transform
max = Maximum(A=subtraction, B=subtraction_2)
division = Division(A=1, B=max)
scale = Scale(Geometry=move.Geometry, Center=Point(0, 0, 0), Factor=division)  # -> Geometry, Transform
move_2 = Move(Geometry=scale.Geometry, Motion=T)  # -> Geometry, Transform
G = ClusterOutput(move_2.Geometry)

# ==== cluster Cluster_13
number_slider = Slider(900, range=0..900)
takepic = ClusterInput()
viewnames = ClusterInput()
path = ClusterInput()
filename = ClusterInput()
takepic_2 = ClusterInput()
viewname = ClusterInput()
path_2 = ClusterInput()
filename_2 = ClusterInput()
c_script = CSharpScript(takePic=takepic, viewNames=viewnames, path=path, fileName=filename, size=number_slider)  # -> out, A, B; inputs takePic: Boolean, viewNames: list of String, path: String, fileName: String, size: Int32
# ---------- c_script: C# usings ----------
using System.Drawing;
using System.IO;
using System.Drawing.Imaging;
using System.Windows.Forms;
# ---------- c_script: C# ----------
    for(int i = 0; i < viewNames.Count ;i++){
      string vn = viewNames[i];
      Rhino.Display.RhinoView view = RhinoDocument.Views.Find(vn, false);

      if (view == null)
        return;

      Rhino.Display.DisplayModeDescription displaymode = Rhino.Display.DisplayModeDescription.FindByName("Rendered");
      Bitmap image = view.CaptureToBitmap(new Size(size, size), displaymode);
      if (image == null)
        return;
      if(takePic){
        string directoryPath = Path.Combine(path, "High Resolution");
        if (!Directory.Exists(directoryPath))
        {
          Directory.CreateDirectory(directoryPath);
        }
        string filePath = Path.Combine(directoryPath, fileName + "_" + i.ToString() + ".png");
        image.Save(filePath);
        image.Dispose();
      }
    }



    //A = screenshot;
# ---------- end c_script ----------
c_script_2 = CSharpScript(takePic=takepic_2, viewName=viewname, path=path_2, fileName=filename_2, size=number_slider)  # -> out, A, B; inputs takePic: Boolean, viewName: String, path: String, fileName: String, size: Int32
# ---------- c_script_2: C# ----------
    string vn = viewName;
    Rhino.Display.RhinoView view = RhinoDocument.Views.Find(vn, false);

    if (view == null)
      return;


    Rhino.Display.DisplayModeDescription displaymode = Rhino.Display.DisplayModeDescription.FindByName("Shaded");
    Bitmap image = view.CaptureToBitmap(new Size(size, size), displaymode);
    if (image == null)
      return;
    if(takePic){
      string directoryPath = Path.Combine(path, "High Resolution");
      if (!Directory.Exists(directoryPath))
      {
        Directory.CreateDirectory(directoryPath);
      }
      string filePath = Path.Combine(directoryPath, fileName + ".jpg");
      image.Save(filePath);
      image.Dispose();
    }

    //A = screenshot;
# ---------- end c_script_2 ----------

# ==== cluster Cluster_14
number_slider = Slider(0.3, range=0..10)
T = ClusterInput()
relay = ClusterInput()
branch = TreeBranch(Tree=T, Path=["{2}", "{3}", "{4}", "{5}", "{6}", "{7}", "{8}"], MaintainPaths=True)
neg = Negative(Value=number_slider)
bang = ExplodeTree(Data=branch)  # -> Branch0, Branch1, Branch2, Branch3, Branch4, Branch5, Branch6
merge = Merge(Data1=neg, Data2=number_slider)
join = JoinCurves(Curves=relay, Preserve=False)
Z = UnitZ(Factor=1)
vrot = Rotate(Vector=graft(relay), Axis=Z, Angle=[1.570796327, -1.570796327])
offset_l = OffsetCurveLoose(Curve=graft(relay), Distance=merge)
curvepoint = PointOnCurve(relay, parameter=0.5)
multiplication = Multiplication(A=bang.Branch5, B=0)
multiplication_2 = Multiplication(A=bang.Branch6, B=0)
multiplication_3 = Multiplication(A=bang.Branch6, B=1)
multiplication_4 = Multiplication(A=bang.Branch5, B=1)
multiplication_5 = Multiplication(A=bang.Branch2, B=0)
multiplication_6 = Multiplication(A=bang.Branch2, B=1)
multiplication_7 = Multiplication(A=bang.Branch3, B=0)
multiplication_8 = Multiplication(A=bang.Branch3, B=1)
addition = Addition(A=graft(curvepoint), B=vrot)
boundary = BoundarySurfaces(Edges=join)
curvepoint_2 = PointOnCurve(offset_l, parameter=0.5)
c_script = CSharpScript(x=bang.Branch1, y=multiplication_7, z=multiplication_8)  # -> out, A; inputs x: Int32, y: Double, z: Double
# ---------- c_script: C# ----------
    if(x==0)
      A = y;
    else
      A = z;
# ---------- end c_script ----------
c_script_2 = CSharpScript(x=bang.Branch4, y=multiplication, z=multiplication_4)  # -> out, A; inputs x: Int32, y: Double, z: Double; same code as c_script
c_script_3 = CSharpScript(x=bang.Branch4, y=multiplication_2, z=multiplication_3)  # -> out, A; inputs x: Int32, y: Double, z: Double; same code as c_script
c_script_4 = CSharpScript(x=bang.Branch1, y=multiplication_5, z=multiplication_6)  # -> out, A; inputs x: Int32, y: Double, z: Double; same code as c_script
pull = PullPoint(Point=addition, Geometry=boundary, ClosestOnly=True)  # -> ClosestPoint, Distance
format = Format(Format="  WWR: {0}", Culture=127, Data0=graft(bang.Branch0))  # -> simplify(Text)
pull_2 = PullPoint(Point=curvepoint_2, Geometry=boundary, ClosestOnly=True)  # -> ClosestPoint, Distance
format_2 = Format(Format="  VrtF: ({0}) {1}m", Culture=127, Data0=graft(c_script_4.A), Data1=graft(c_script.A))  # -> simplify(Text)
format_3 = Format(Format="  HrzF: ({0}) {1}m", Culture=127, Data0=graft(c_script_2.A), Data1=graft(c_script_3.A))  # -> simplify(Text)
sort = SortList(Keys=pull.Distance, ValuesA=vrot)  # -> Keys, ValuesA
sort_2 = SortList(Keys=pull_2.Distance, ValuesA=offset_l)  # -> Keys, ValuesA
panel = Panel(branch)
item = ListItem(List=reverse(sort.ValuesA), Index=0, Wrap=True)
item_2 = ListItem(List=reverse(sort_2.ValuesA), Index=0, Wrap=True)  # -> simplify(Item)
join_2 = TextJoin(Text=simplify([format, format_2, format_3]))
vrot_2 = Rotate(Vector=item, Axis=Vector(0, 0, 1), Angle=-1.570796327)
curvepoint_3 = PointOnCurve(item_2, parameter=0.5)
R = ClusterOutput(join_2)
tstat = TreeStatistics(Tree=item_2)  # -> graft(Paths), Length, Count
Z_2 = UnitZ(Factor=1)
Z_3 = UnitZ(Factor=Slider(0.66, range=0..3))
dpath = DeconstructPath(Branch=tstat.Paths)
move = Move(Geometry=curvepoint_3, Motion=Z_3)  # -> Geometry, Transform
weave = Weave(Pattern=[1, 0, 1], Stream0=dpath, Stream1=["[", "]"], NullGaps=False)
pl = ConstructPlane(Origin=move.Geometry, XAxis=expr("-X", vrot_2), YAxis=Z_2)
pl_2 = ClusterOutput(pl)
